vi "counter+cp+window test.gvi"   [LabVIEW Communications System Design Suite 2.0.1]
outputs:
  "reference": c128[]
panel controls:
  "K": u32 = 4
  "M": u32 = 3
  "b": f64 = 0.5
  "Ncp": u16
  "Ncs": u16
  "Window?": bool
  "limit": f64 = 0.1
panel indicators:
  "host state": u16
  "output": FXP(16.7)[][]
  "Result": CFXP(16.16)[]
  "input data": c128[]
  "Resulting signal": UFXP(16.16)[]
  "Input signals": f64[][]
  "rising window": c128[]
  "address": u16[]
  "window in": CFXP(9.7)[]
  "data in": CFXP(9.7)[]
  "Test passed": bool
types:
  "modem_configuration.gtype" = cluster{"K-1": u16, "M-1": u8, "N-1": u16, "N": u16, "Block CP": u16, "End of frame": u16, "Nw": u16, "Modulator MUX config": u64[16], "CP start": u16[16], "Subsymbol end": u16[16], "Subsymbol start": u16[16], "K": u16, "fft_size_log2(K)": u8, "inverse_fft": bool, "Create preamble": bool, "Burstmode": bool, "Ncs": u16, "Ncp": u16, "N-Ncp": u16, "N+Ncp": u16, "N+Ncp+Ncs": u16, "Demodulator MUX config": u64[16], "M": u8}
uses:
  ::USRP::Interactive::counter+cp+window.gcdl
diagram:
  call "generate window.gvi"(K=$K, b=$b) -> (rising window=w1, Nw=w2)
  Multiply($K, $M) -> w3
  for (N = w3) (iteration -> i1) {
    Increment(x=i1) -> w6
    Real And Imaginary To Complex(x=w6, y=1) -> w7
    call "cfx_to_u32.gvi"(input=w7) -> (output=w8)
    append w8 to w4
    append w7 to w5
  }
  Build Array(w5, w1) -> w9
  Absolute Value(x=w9) -> w10
  $"Input signals" <- w10
  $"rising window" <- w1
  $"input data" <- w5
  Select(s=$"Window?", t=w2, f=0) -> w11
  Subtract(x=w3, y=$Ncp) -> w12
  Add(w3, $Ncp) -> w13
  Add(w13, $Ncs) -> w14
  Decrement(x=$M) -> w15
  Decrement(x=$K) -> w16
  Property Node(instance in="modem_configuration.gtype" {all zero or empty}, "Nw"=w11, "Ncp"=$Ncp, "N-Ncp"=w12, "N+Ncp"=w13, "N+Ncp+Ncs"=w14, "K-1"=w16, "M-1"=w15, "Ncs"=$Ncs) -> (instance out=w17)
  for {
    w18 = each element of w1
    call "cfx_to_u32.gvi"(input=w18) -> (output=w20)
    append w20 to w19
  }
  s1 = 0  # shift register
  s2 = CFXP(16.16)[] []  # shift register
  while {
    Feedback Node(input=w26) -> w27
    call "fifo simulator_32.gvi"(ready for output=w27, Array=w4) -> (element=w28, valid=w29)
    Feedback Node(input=w30) -> w31
    call "fifo simulator_32.gvi"(ready for output=w31, Array=w19) -> (element=w32, valid=w33)
    Is First Call() -> w34
    call "counter+cp+window.gcdl"(modem_configuration=w17, valid=w29, data=w28, reset=w34, window in=w32, window valid=w33) -> (output=w35, valid_out=w36, idx_n=w37, first_sample_of_GFDM_block=w38)
    call "add_to_array_32 bit.gvi"(Array in=s2, value=w35, valid out=w36) -> (Array out=w39)
    Boolean To Integer(Boolean=w36) -> (0, 1=w40)
    Multiply(w35, w40) -> w41
    call "u32_to_cfx.gvi"(input=w41) -> (output=w42)
    Boolean To Integer(Boolean=w38) -> (0, 1=w43)
    call "u32_to_cfx.gvi"(input=w32) -> (output=w44)
    call "u32_to_cfx.gvi"(input=w28) -> (output=w45)
    Feedback Node[DelayCount=10](input=w46) -> w47
    call "detect falling edge.gvi"(in=w36) -> (out=w46)
    call "detect falling edge.gvi"(in=w29) -> (out=w48)
    call "detect falling edge.gvi"(in=w33) -> (out=w49)
    case (s1) {
      frame 0, Default {
        Increment(x=s1) -> w50
        w30 = default
        w26 = default
      }
      frame 1 {
        Boolean To Integer(Boolean=w49) -> (0, 1=w51)
        Add(w51, s1) -> w50
        w30 = TRUE
        w26 = default
      }
      frame 3 {
        Boolean To Integer(Boolean=w48) -> (0, 1=w52)
        Add(w52, s1) -> w50
        w30 = default
        w26 = TRUE
      }
    }
    $"host state" <- w50
    append w42 to w21
    append w37 to w22
    append w44 to w23
    append w45 to w24
    append w43 to w25
    next s1 = w50
    next s2 = w39
    stop if w47
  }
  Absolute Value(x=s2) -> w53
  $"Resulting signal" <- w53
  $Result <- s2
  Absolute Value(x=w21) -> w54
  Build Array(w54, w25) -> w55
  $output <- w55
  $address <- w22
  $"window in" <- w23
  $"data in" <- w24
  call "CP+CS.gvi"(data in=w5, Ncp=$Ncp, N-Ncp=w12, Ncs=$Ncs) -> (data out=w56)
  call "window.gvi"(data in=w56, Nw=w11, window=w1) -> (data out=w57)
  call "compare_elements.gvi"(reference=w57, array=s2, limit=$limit) -> (equal=w58)
  $"Test passed" <- w58
  $reference <- w57
