vi "cp+window test.gvi"   [LabVIEW NXG]
panel controls:
  "K": u32 = 4
  "M": u32 = 3
  "b": f64 = 0.5
  "Ncp": u16
  "Ncs": u16
  "Window?": bool
panel indicators:
  "host state": u16
  "output": UFXP(9.7)[]
  "Result": CFXP(16.16)[]
  "input data": c128[]
  "Resulting signal": UFXP(16.16)[]
  "Input signals": f64[][]
  "rising window": c128[]
types:
  T1 = cluster{"K": u16, "M": u8, "K-1": u16, "M-1": u8, "Nw": u16, "Ncs": u16, "Ncp": u16, "N": u16, "N-1": u16, "N-Ncp": u16, "N+Ncp": u16, "N+Ncp+Ncs": u16, "fft_size_log2(K)": u8, "inverse_fft": bool}
uses:
  ::Project::USRP::cp+window.gcdl
diagram:
  call "generate window.gvi"(K=$K, b=$b) -> (rising window=w1, Nw=w2)
  Multiply($K, $M) -> w3
  for (N = w3) (iteration -> i1) {
    Increment(x=i1) -> w6
    Real And Imaginary To Complex(x=w6, y=1) -> w7
    call "cfx_to_u32.gvi"(input=w7) -> (output=w8)
    append w8 to w4
    append w7 to w5
  }
  Build Array(w5, w1) -> w9
  Absolute Value(x=w9) -> w10
  $"Input signals" <- w10
  $"rising window" <- w1
  $"input data" <- w5
  Select(s=$"Window?", t=w2, f=0) -> w11
  Subtract(x=w3, y=$Ncp) -> w12
  Add(w3, $Ncp) -> w13
  Add(w13, $Ncs) -> w14
  Property Node(instance in=T1 {all zero or empty}, "Nw"=w11, "Ncp"=$Ncp, "N-Ncp"=w12, "N+Ncp"=w13, "N+Ncp+Ncs"=w14) -> (instance out=w15)
  for {
    w16 = each element of w1
    call "cfx_to_u32.gvi"(input=w16) -> (output=w18)
    append w18 to w17
  }
  s1 = 0  # shift register
  s2 = CFXP(16.16)[] []  # shift register
  while {
    call "detect falling edge.gvi"(in=w20) -> (out=w21)
    Feedback Node(Input=w22) -> (Output=w23)
    call "fifo simulator_32.gvi"(ready for output=w23, Array=w17) -> (element=w24, valid=w25, address=w26)
    call "detect falling edge.gvi"(in=w25) -> (out=w27)
    case (s1) {
      frame 0, Default {
        Increment(x=s1) -> w28
        w22 = default
        w29 = default
      }
      frame 1 {
        Boolean To Integer(Boolean=w27) -> (0, 1=w30)
        Add(w30, s1) -> w28
        w22 = TRUE
        w29 = default
      }
      frame 3 {
        Boolean To Integer(Boolean=w21) -> (0, 1=w31)
        Add(w31, s1) -> w28
        w22 = default
        w29 = TRUE
      }
    }
    Feedback Node(Input=w29) -> (Output=w32)
    call "fifo simulator_32.gvi"(ready for output=w32, Array=w4) -> (element=w33, valid=w20, address=w34)
    Is First Call() -> w35
    call "detect falling edge.gvi"(in=w20) -> (out=w36)
    call "toggle_output.gvi"(toggle=w36, reset=w35) -> (output=w37)
    call "cp+window.gcdl"(input valid=w20, toggle bank=w37, data=w33, address=w34, settings=w15, reset=w35, window valid=w25, window in=w24, window address=w26) -> (valid_out=w38, output=w39)
    call "add_to_array_32_bits.gvi"(Array in=s2, value=w39, valid out=w38) -> (Array out=w40)
    Boolean To Integer(Boolean=w38) -> (0, 1=w41)
    Multiply(w39, w41) -> w42
    call "u32_to_cfx.gvi"(input=w42) -> (output=w43)
    call "detect falling edge.gvi"(in=w38) -> (out=w44)
    Feedback Node[DelayCount=10](Input=w44) -> (Output=w45)
    $"host state" <- w28
    append w43 to w19
    next s1 = w28
    next s2 = w40
    stop if w45
  }
  Absolute Value(x=s2) -> w46
  $"Resulting signal" <- w46
  $Result <- s2
  Absolute Value(x=w19) -> w47
  $output <- w47
