vi "test_address_counter.gvi"   [LabVIEW NXG]
panel indicators:
  "Graph": f64[][]
uses:
  ::Project::USRP::address_counter.gcdl
diagram:
  # Ncp
  # N
  # Ncs
  # Nw
  # block start impulse
  Initialize Array(element=FALSE, size=50) -> w1
  Initialize Array(element=FALSE, size=50) -> w2
  Initialize Array(element=TRUE, size=100) -> w3
  Build Array[ConcatenateInputs=True](w2, w3, w1) -> w4
  # number of clocks to simulate
  for {
    w5 = each element of w4
    Add(100, 10) -> w14
    Subtract(x=100, y=10) -> w15
    Add(w14, 20) -> w16
    call "address_counter.gcdl"(Ncp=10, N+Ncp=w14, N-Ncp=w15, toggle block=w5, Nw=1, N+Ncp+Ncs=w16, reset=FALSE) -> (is_data=w17, address=w18, is_cs=w19, is_cp=w20, block=w21, window_falling=w22, valid_out=w23, window_rising=w24)
    Boolean To Integer(Boolean=w21) -> (0, 1=w25)
    Multiply(w25, 5) -> w26
    Boolean To Integer(Boolean=w17) -> (0, 1=w27)
    Multiply(w27, 6) -> w28
    Boolean To Integer(Boolean=w19) -> (0, 1=w29)
    Multiply(w29, 7) -> w30
    Boolean To Integer(Boolean=w23) -> (0, 1=w31)
    Multiply(w31, 8) -> w32
    Boolean To Integer(Boolean=w20) -> (0, 1=w33)
    Multiply(w33, 9) -> w34
    Boolean To Integer(Boolean=w22) -> (0, 1=w35)
    Multiply(w35, 10) -> w36
    Boolean To Integer(Boolean=w24) -> (0, 1=w37)
    Multiply(w37, 11) -> w38
    append w26 to w6
    append w28 to w7
    append w30 to w8
    append w32 to w9
    append w18 to w10
    append w34 to w11
    append w36 to w12
    append w38 to w13
  }
  Boolean To Integer(Boolean=w4) -> (0, 1=w39)
  Multiply(w39, 30) -> w40
  Build Array(w10, w6, w7, w8, w9, w40, w11, w12, w13) -> w41
  $Graph <- w41
