vi "window test.gvi"   [LabVIEW NXG]
panel controls:
  "K": f64 = 18
  "b": f64 = 0.5
  "Variable: M": f64 = 3
panel indicators:
  "output": FXP(26.7)[][]
  "input": FXP(33.7)[][]
  "Nw": f64
uses:
  ::Project::USRP::window.gcdl
diagram:
  call "generate window.gvi"(K=$K, b=$b) -> (rising window=w1, Nw=w2)
  Math Node("K"=$K, "window"=w1, "M"=$"Variable: M", "Nw"=w2) -> ("cycles"=w3, "data"=w4, "window_falling"=w5, "window_rising"=w6, "write"=w7, "valid"=w8)
  ~~~
  N =K*M;
  repeats = 3;
  cycles =  repeats * N
  data = zeros(N,1);
  n = 1
  k = 0
  for m = 1:M
      for k = 1:K
          data(n) = m
          n = n + 1
      end
  end

  start = Nw + 10;

  window_rising = zeros(cycles,1);
  window_falling = zeros(cycles,1);
  write = zeros(cycles,1);
  write(2:Nw+1) = 1;

  valid = zeros(cycles,1);
  valid(start:2*N) = 1;
  window_rising(start:start+Nw) = 1;
  window_falling(start+N-Nw:start+N) = 1;
  start = start+N;
  window_rising(start:start+Nw) = 1;
  window_falling(start+N-Nw:start+N) = 1;
  ~~~
  for {
    w9 = each element of w4
    call "cfx_to_u32.gvi"(input=w9) -> (output=w11)
    append w11 to w10
  }
  for {
    w12 = each element of w1
    call "cfx_to_u32.gvi"(input=w12) -> (output=w14)
    append w14 to w13
  }
  for (N = w3) {
    w15 = each element of w7
    w16 = each element of w6
    w17 = each element of w5
    w18 = each element of w8
    call "fifo simulator_32_without reset.gvi"(ready for output=w18, Array=w10) -> (element=w29, valid=w30)
    call "u32_to_cfx.gvi"(input=w29) -> (output=w31)
    Absolute Value(x=w31) -> w32
    call "fifo simulator_32.gvi"(ready for output=w15, Array=w13) -> (element=w33, valid=w34, address=w35)
    call "window.gcdl"(valid_in=w30, window_falling=w17, window_rising=w16, data valid=w34, input=w29, address=w35, data=w33) -> (valid_out=w36, output=w37)
    call "u32_to_cfx.gvi"(input=w37) -> (output=w38)
    Boolean To Integer(Boolean=w36) -> (0, 1=w39)
    Multiply(w38, w39) -> w40: CFXP(25.7) Saturate:ConvergentRounding
    Absolute Value(x=w40) -> w41
    call "convert boolean to number.gvi"(Numeric Constant=6, boolean=w30) -> (element=w42)
    call "convert boolean to number.gvi"(Numeric Constant=2, boolean=w16) -> (element=w43)
    call "convert boolean to number.gvi"(Numeric Constant=3, boolean=w17) -> (element=w44)
    call "convert boolean to number.gvi"(Numeric Constant=4, boolean=w34) -> (element=w45)
    call "convert boolean to number.gvi"(Numeric Constant=5, boolean=w15) -> (element=w46)
    call "u32_to_cfx.gvi"(input=w33) -> (output=w47)
    Absolute Value(x=w47) -> w48
    append w41 to w19
    append w42 to w20
    append w32 to w21
    append w48 to w22
    append w35 to w23
    append w43 to w24
    append w44 to w25
    append w45 to w26
    append w46 to w27
    append w39 to w28
  }
  Build Array(w19, w28) -> w49
  $output <- w49
  Build Array(w20, w24, w25, w26, w27, w21, w22, w23) -> w50
  $input <- w50
  $Nw <- w2
