vi "CRC_bit_ref_test.gvi"   [LabVIEW Communications System Design Suite 2.0.1]
panel controls:
  "poly": u16
  "packet length [bits]": i32 = 1000
  "milliseconds to wait": u32
panel indicators:
  "crc_out": u16
  "error out": error
  "ref_crc": u16
  "err": u16
  "data": bool[]
  "loop iteration": i32
  "CRC_bit": bool[]
  "output_valid": bool
  "ready_for_input": bool
uses:
  ::USRP::Interactive::CRC16_bit.gcdl
diagram:
  w1 = $poly
  w2 = $"packet length [bits]"
  for (N = w2) {
    Random Number() -> (number (0 to 1)=w4)
    append w4 to w3
  }
  Is Greater Than 0(x=w3) -> w5
  for (N -> w6) (iteration -> i1) {
    w7 = each element of w5
    Wait(time to wait=$"milliseconds to wait")
    $"loop iteration" <- i1
    Is Equal To 0(x=i1) -> w8
    Subtract(x=w6, y=2) -> w9
    Is Equal(x=i1, y=w9) -> w10
    # For comparision only the first and last bits are not part of the data
    call "CRC16_bit.gcdl"(last_byte=w10, first_byte=w8, poly=w1, data_i=w7, enable=TRUE, input_valid=TRUE) -> (crc_out=w11, output_valid=w12, ready_for_input=w13)
    $crc_out <- w11
    $output_valid <- w12
    $ready_for_input <- w13
  }
  Number To Boolean Array(number=w11) -> (Boolean array=w14)
  $CRC_bit <- w14
  Number To Boolean Array(number=w1) -> (Boolean array=w15)
  Reverse 1D Array(array=w15) -> (reversed array=w16)
  Array Size(array=w5) -> (size(s)=w17)
  # one cycles is required to set first bit
  # and one cycle to set last bit
  Subtract(x=w17, y=3) -> w18
  # LV put the index 0 as LSB
  Array Subset(array=w5, index0=0, length0=w18) -> w19
  call "ref_CRC.gvi"(data=w19, g=w16, error in=no error) -> (error out=w20, CRC=w21)
  Reverse 1D Array(array=w21) -> (reversed array=w22)
  Boolean Array To Number(Boolean array=w22) -> (number=w23: u16)
  Subtract(x=w11, y=w23) -> w24
  $err <- w24
  $ref_crc <- w23
  $"error out" <- w20
  $data <- w19
