vi "CRC_byte_ref_test.gvi"   [LabVIEW Communications System Design Suite 2.0.1]
panel controls:
  "poly": u16
  "packet length [bits]": i32 = 1000
  "milliseconds to wait": u32
  "milliseconds to wait_2": u32
panel indicators:
  "crc_bit_2": u16
  "err": u16
  "loop iteration": i32
  "CRC_bit": bool[]
  "output_valid": bool
  "ready_for_input": bool
  "crc_out_byte": u8
  "loop iteration_2": i32
  "output_valid_2": bool
  "ready_for_input_2": bool
uses:
  ::USRP::Interactive::CRC16_bit.gcdl
  ::USRP::Interactive::CRC16_byte.gcdl
diagram:
  # one cycles is required to set first bit
  # one cycle to set last bit
  # and one additional cycle to get the final result as there a delay of 1 cycle.
  w1 = $poly
  w2 = $"packet length [bits]"
  for (N = w2) {
    Random Number() -> (number (0 to 1)=w5)
    Multiply(w5, w2) -> w6
    Round To Nearest(number=w6) -> w7
    To Unsigned Byte Integer(number=w7) -> w8
    Number To Boolean Array(number=w8) -> (Boolean array=w9)
    Reverse 1D Array(array=w9) -> (reversed array=w10)
    append w8 to w3
    concatenate w10 onto w4
  }
  Build Array[ConcatenateInputs=True](FALSE, w4, FALSE, FALSE) -> w11
  for (N -> w12) (iteration -> i1) {
    w13 = each element of w11
    Wait(time to wait=$"milliseconds to wait")
    $"loop iteration" <- i1
    Is Equal To 0(x=i1) -> w14
    Subtract(x=w12, y=2) -> w15
    Is Equal(x=i1, y=w15) -> w16
    # For comparision only the first and last bits are not part of the data
    call "CRC16_bit.gcdl"(last_bit=w16, first_bit=w14, poly=w1, data_i=w13, enable=TRUE, input_valid=TRUE) -> (crc_out=w17, output_valid=w18, ready_for_input=w19)
    $crc_bit_2 <- w17
    $output_valid <- w18
    $ready_for_input <- w19
  }
  Number To Boolean Array(number=w17) -> (Boolean array=w20)
  $CRC_bit <- w20
  Build Array[ConcatenateInputs=True](0, w3, 0, 0) -> w21
  for (N -> w22) (iteration -> i2) {
    w23 = each element of w21
    Wait(time to wait=$"milliseconds to wait_2")
    $"loop iteration_2" <- i2
    Is Equal To 0(x=i2) -> w24
    Subtract(x=w22, y=2) -> w25
    Is Equal(x=i2, y=w25) -> w26
    # For comparision only the first and last bits are not part of the data
    call "CRC16_byte.gcdl"(last_byte=w26, first_byte=w24, poly=w1, data_i=w23, enable=TRUE, input_valid=TRUE) -> (crc_out=w27, output_valid=w28, ready_for_input=w29)
    $crc_out_byte <- w27
    $output_valid_2 <- w28
    $ready_for_input_2 <- w29
  }
  Subtract(x=w17, y=w27) -> w30
  $err <- w30
