vi "ref_CRC.gvi"   [LabVIEW Communications System Design Suite 2.0.1]
inputs:
  "data": bool[]
  "g": bool[]
  "error in": error
outputs:
  "error out": error
  "div": bool[]
  "CRC": bool[]
diagram:
  Math Node("x"=$data, "g"=$g, Error In=$"error in") -> ("y"=w1, "r"=w2, Error Out=w3)
  ~~~
  % x: input bits index zero is MSB
  % g: polynomial index zero is MSB
  % r: reminder  index zero is MSB
  % y: div index zero is MSB

  K = length(x);
  Q = length(g);

  r = zeros(1,Q);
  y = zeros(1,K); % div result is already in MSB first
  % reverse g for indexing
  g = g(end:-1:1);
  for m=1:K
  y(m) = xor(r(Q),x(m));
  for q=Q:-1:2
      r(q) = xor(r(q-1), and(g(q), y(m)));
  end
  r(1) = and(g(1),y(m));
  end
  % to store in MSB
  r = r(end:-1:1);
  ~~~
  $"error out" <- w3
  Is Greater(x=w1, y=0) -> w4
  $div <- w4
  Is Greater(x=w2, y=0) -> w5
  $CRC <- w5
