vi "testCRC+Encoder.gvi"   [LabVIEW Communications System Design Suite 2.0.1]
panel controls:
  "times": i32
  "packetSize": i32
  "simulateRadyforInput": bool
  "max number of loops": u32 = 10000
  "forward broken crc": bool
  "forward repeated crc": bool
panel indicators:
  "number of samples out": u32
  "dataIn": u8[]
  "dataOut": u8[]
  "loop iteration": i32
  "yahoo!": bool
uses:
  ::USRP::Interactive::testWrapperCRC+Encoder.gcdl
diagram:
  w1 = $packetSize
  w2 = $times
  for (N = w2) (iteration -> i1) {
    for (N = w1) (iteration -> i2) {
      Random Number() -> (number (0 to 1)=w5)
      Multiply(w5, 255) -> w6
      To Unsigned Byte Integer(number=w6)
      Increment(x=i1) -> w7
      Is Not Equal To 0(x=i2) -> w8
      Select(s=w8, t=i2, f=w7) -> w9
      To Unsigned Byte Integer(number=w9) -> w10
      append w10 to w4
    }
    Build Array[ConcatenateInputs=True](w4, w4, w4) -> w11
    concatenate w11 onto w3
  }
  $dataIn <- w3
  Multiply(w1, w2) -> w12
  while (iteration -> i3) (after w12) {
    Feedback Node[DelayCount=10](input=w14) -> w15
    Array Size(array=w3) -> (size(s)=w16)
    case ($simulateRadyforInput) {
      frame False, Default {
        w17 = TRUE
      }
      frame True {
        Random Number() -> (number (0 to 1)=w18)
        Is Greater(x=w18, y=0.5) -> w17
      }
    }
    Is Greater(x=i3, y=10) -> w19
    Logical And(w19, w17) -> w20
    call "fifo simulator_32.gvi"(ready for output=w20, Array=w3) -> (element=w21, valid=w22)
    To Unsigned Byte Integer(number=w21) -> w23
    To Unsigned Long Integer(number=w1) -> w24
    call "testWrapperCRC+Encoder.gcdl"(data=w23, dataValid=w22, PacketLength=w24, forward broken crc=$"forward broken crc", forward repeated crc=$"forward repeated crc") -> (data_out=w25, valid_out=w26)
    call "collect n samples.gvi"(max number of loops=$"max number of loops", loop iteration=i3, max samples=w16, increment=w26) -> (number of samples out=w27, stop=w14)
    $"number of samples out" <- w27
    $"loop iteration" <- i3
    append w25 to w13 if w26
    stop if w15
  }
  Is Equal(x=w3, y=w13) -> w28
  And Array Elements(Boolean array=w28) -> (logical AND=w29)
  $"yahoo!" <- w29
  $dataOut <- w13
  $"yahoo!" <- FALSE
