vi "testCRC.gvi"   [LabVIEW Communications System Design Suite 2.0.1]
panel controls:
  "packetSize": u64
  "N": i32
  "Nof packets": u32
  "forward broken crc": bool
panel indicators:
  "Array": u8[]
  "Array_2": bool[]
uses:
  ::USRP::Interactive::testWrapperCRC.gcdl
diagram:
  w1 = $N
  w2 = $packetSize
  w3 = $"forward broken crc"
  Multiply($"Nof packets", w2) -> w4
  Math Node() -> ("data"=w5)
  ~~~
  data=uint8([(1:8),(9:16),(17:24),(17:24),(25:32)])
  ~~~
  for (N = w1) (iteration -> i1) {
    Decrement(x=i1) -> w8
    Array Index(array=w5) -> (out0[w8]=w9)
    Is Not Equal To 0(x=i1) -> w10
    Is Less Or Equal(x=i1, y=w4) -> w11
    Logical And(w10, w11) -> w12
    call "testWrapperCRC.gcdl"(data=w9, dataValid=w12, PacketLength=w2, forward broken&repeated crc=w3) -> (data_out=w13, valid_out=w14, CRC correct=w15)
    To Unsigned Byte Integer(number=i1)
    append w13 to w6 if w14
    append w15 to w7 if w14
  }
  $Array <- w6
  $Array_2 <- w7
