vi "Channel Equalizer reference.gvi"   [LabVIEW Communications System Design Suite 2.0.1]
inputs:
  "input": c128[]
  "GFDM parameter": "GFDM parameter.gtype" = {"Variable: K"=8, "Variable: M"=3, "Variable: a"=0.5, "filter type"="rc", "receive filter"="ZF", "inverse FFT"=FALSE, "Variable: b"=0.5, "Ncs"=0, "Ncp"=0}
  "channel coefficients": c128[]
  "error in": error
outputs:
  "Output": CFXP(1.15)[]
  "error out": error
types:
  "GFDM parameter.gtype" = cluster{"Variable: K": i32, "Variable: M": i32, "Variable: a": f64, "filter type": enum{"rc", "rect"}, "receive filter": enum{"MF", "ZF"}, "inverse FFT": bool, "Variable: b": f64, "Ncs": u16, "Ncp": u16}
uses:
  NI::Analysis::Transforms::Complex FFT.gvi
  NI::Analysis::Transforms::Inverse Complex FFT.gvi
diagram:
  case ($"error in") {
    frame Error {
      w1 = default
      w2 = $"error in"
    }
    frame No Error {
      call "norm_to_CFX_1.15.gvi"(Input=$input) -> (Output=w3)
      Property Node(instance in=$"GFDM parameter") -> ("Variable: K"=w4, "Variable: M"=w5)
      Multiply(w4, w5) -> w6
      call "Complex FFT.gvi"(x=w3, FFT size=w6, error in=$"error in") -> (FFT{x}=w7, error out=w8)
      call "norm_to_CFX_1.15.gvi"(Input=w7) -> (Output=w9)
      Multiply(w9, $"channel coefficients") -> w10
      call "Inverse Complex FFT.gvi"(FFT{x}=w10, error in=w8) -> (x=w11, error out=w2)
      call "norm_to_CFX_1.15.gvi"(Input=w11) -> (Output=w1)
    }
  }
  $Output <- w1
  $"error out" <- w2
