vi "multiply with factor test.gvi"   [LabVIEW Communications System Design Suite 2.0.1]
panel controls:
  "limit": f64 = 1
  "K": u32 = 64
  "M": u32 = 9
panel indicators:
  "equal": bool
  "Graph": f64[][]
  "overflow": bool
  "Number of read elements": u32
  "empty": bool
uses:
  ::USRP::Interactive::Multiply with factor wrapper.gcdl
diagram:
  Multiply($K, $M) -> w1
  for (N = w1) (iteration -> i1) {
    Random Number() -> (number (0 to 1)=w4)
    Random Number() -> (number (0 to 1)=w5)
    Subtract(x=w4, y=w5) -> w6
    Multiply(1, w6) -> w7
    Random Number() -> (number (0 to 1)=w8)
    Random Number() -> (number (0 to 1)=w9)
    Subtract(x=w8, y=w9) -> w10
    Multiply(1, w10) -> w11
    Real And Imaginary To Complex(x=w7, y=w11)
    Divide(x=i1, y=w1) -> w12
    call "1.15_cfx_to_u32.gvi"(input=w12) -> (output=w13)
    append w13 to w2
    append w12 to w3
  }
  for (N = w1) (iteration -> i2) {
    Random Number() -> (number (0 to 1)=w16)
    Random Number() -> (number (0 to 1)=w17)
    Subtract(x=w16, y=w17) -> w18
    Multiply(1, w18) -> w19
    Random Number() -> (number (0 to 1)=w20)
    Random Number() -> (number (0 to 1)=w21)
    Subtract(x=w20, y=w21) -> w22
    Multiply(1, w22) -> w23
    Real And Imaginary To Complex(x=w19, y=w23)
    Divide(x=i2, y=w1) -> w24
    call "1.15_cfx_to_u32.gvi"(input=w24) -> (output=w25)
    append w25 to w14
    append w24 to w15
  }
  Decrement(x=$K) -> w26
  Decrement(x=$M) -> w27
  Decrement(x=w1) -> w28
  while (iteration -> i3) {
    Is Equal To 0(x=i3) -> w32
    Feedback Node(input=w33) -> w34
    call "toggle_output.gvi"(toggle=w34, reset=w32) -> (output=w35)
    call "fifo simulator_32.gvi"(ready for output=w35, Array=w2, reset=w32) -> (element=w36, valid=w37)
    Feedback Node(input=w32) -> w38
    call "toggle_output.gvi"(toggle=w38, reset=w34) -> (output=w39)
    call "fifo simulator_32.gvi"(ready for output=w39, Array=w14, reset=w32) -> (element=w40, valid=w41)
    call "Multiply with factor wrapper.gcdl"(N-1=w28, M-1=w27, reset=w32, input valid=w37, input=w36, coefficients valid=w41, coefficients=w40, K-1=w26) -> (update done=w33, GFDM block end=w42, output valid=w43, output=w44, overflow=w45, empty=w46, elements count=w47)
    call "u32_to_1.15_cfx.gvi"(input=w44) -> (output=w48)
    append w48 to w29 if w43
    append w45 to w30
    append w46 to w31
    stop if w42
  }
  Multiply(w3, w15) -> w49
  Build Array(w29, w49) -> w50
  Absolute Value(x=w50) -> w51
  $Graph <- w51
  call "compare_elements.gvi"(reference=w49, array=w29, limit=$limit) -> (equal=w52)
  $equal <- w52
  Or Array Elements(Boolean array=w30) -> (logical OR=w53)
  $overflow <- w53
  Or Array Elements(Boolean array=w31) -> (logical OR=w54)
  $empty <- w54
  $"Number of read elements" <- w47
