vi "dft_test.gvi"   [LabVIEW Communications System Design Suite 2.0.1]
outputs:
  "N": i32
panel controls:
  "limit": f64 = 0.1
  "faktor": f64 = 1
panel indicators:
  "equal": bool
  "Graph": f64[][]
  "overflow": bool
  "loop iteration": i32
  "results": i32[][]
uses:
  NI::Analysis::Transforms::Complex FFT.gvi
  ::USRP::Interactive::dft_2.14 CFX.gcdl
diagram:
  s1 = i32[][] []  # shift register
  for {
    w1 = each element of [12, 24, 36, 48, 60, 72, 96, 108, 120, 144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]
    for (N = 10) (iteration -> i1) {
      $N <- w1
      w4 = $faktor
      for (N = w1) {
        Random Number() -> (number (0 to 1)=w7)
        Random Number() -> (number (0 to 1)=w8)
        Subtract(x=w7, y=w8) -> w9
        Multiply(w4, w9) -> w10
        Random Number() -> (number (0 to 1)=w11)
        Random Number() -> (number (0 to 1)=w12)
        Subtract(x=w11, y=w12) -> w13
        Multiply(w4, w13) -> w14
        Real And Imaginary To Complex(x=w10, y=w14) -> w15
        call "1.15_cfx_to_u32.gvi"(input=w15) -> (output=w16)
        append w16 to w5
        append w15 to w6
      }
      call "Complex FFT.gvi"(x=w6, FFT size=w1) -> (FFT{x}=w17)
      call "norm CFX-Array.gvi"(Input=w17) -> (Output=w18)
      while (iteration -> i2) {
        Is Equal To 0(x=i2) -> w21
        Not(x=w21) -> w22
        call "fifo simulator_32.gvi"(ready for output=w22, Array=w5, reset=w21) -> (element=w23, valid=w24)
        call "dft_core_config.gvi"(N=w1) -> (size=w25)
        call "detect rising edge.gvi"(in=w24) -> (out=w26)
        call "dft_2.14 CFX.gcdl"(data in=w23, SIZE=w25, Forward transform=TRUE, First sample in=w26, Reset=w21, data valid in=w24) -> (output valid=w27, output=w28, FFT halt=w29)
        call "detect falling edge.gvi"(in=w27) -> (out=w30)
        append w28 to w19 if w27
        append w29 to w20
        stop if w30
      }
      call "norm CFX-Array.gvi"(Input=w19) -> (Output=w31)
      Build Array(w31, w18) -> w32
      Absolute Value(x=w32) -> w33
      $Graph <- w33
      call "compare_elements.gvi"(reference=w18, array=w31, limit=$limit) -> (equal=w34)
      $equal <- w34
      Or Array Elements(Boolean array=w20) -> (logical OR=w35)
      $overflow <- w35
      $"loop iteration" <- i1
      append w34 to w2
      append w35 to w3
    }
    And Array Elements(Boolean array=w2) -> (logical AND=w36)
    Boolean To Integer(Boolean=w36) -> (0, 1=w37)
    Or Array Elements(Boolean array=w3) -> (logical OR=w38)
    Boolean To Integer(Boolean=w38) -> (0, 1=w39)
    Build Array(w1, w37, w39) -> w40
    Build Array[ConcatenateInputs=True](s1, w40) -> w41
    $results <- w41
    next s1 = w41
  }
