vi "Channel Estimation.gvi"   [LabVIEW Communications System Design Suite 2.0.1]
inputs:
  "Rx signal": c128[]
  "Preamble": c128[]
  "Channel Length": i32
  "preamble FFT size": i32 = -1
  "index": i32  # Index of the preamble starting point
  "data FFT size": i32 = -1
  "Fully allocated?": bool
outputs:
  "Channel Freq. Resp.": c128[]
uses:
  NI::Analysis::Transforms::Complex FFT.gvi
  NI::Analysis::Transforms::Inverse Complex FFT.gvi
diagram:
  Array Subset(array=$"Rx signal", index0=$index, length0=$"preamble FFT size") -> w1
  call "Complex FFT.gvi"(x=w1, FFT size=$"preamble FFT size") -> (FFT{x}=w2)
  call "Complex FFT.gvi"(x=$Preamble, FFT size=$"preamble FFT size") -> (FFT{x}=w3)
  call "ClearZerosInPreamble.gvi"(FFT{x}=w3, bypass=$"Fully allocated?") -> (x=w4)
  Reciprocal(x=w4) -> w5
  for {
    w6 = each element of w2
    w7 = each element of w5
    Multiply(w6, w7) -> w9
    append w9 to w8
  }
  call "Inverse Complex FFT.gvi"(FFT{x}=w8) -> (x=w10)
  Array Size(array=w10) -> (size(s)=w11)
  Subtract(x=w11, y=$"Channel Length") -> w12
  Array Subset(array=w10, index0=w12, length0=$"Channel Length") -> w13
  Initialize Array(element=0+0i, size=$"data FFT size") -> w14
  Array Subset(array=w10, index0=0, length0=$"Channel Length") -> w15
  Replace Array Subset(inArray=w14, index=0, new=w15) -> w16
  Subtract(x=$"data FFT size", y=$"Channel Length") -> w17
  Replace Array Subset(inArray=w16, index=w17, new=w13) -> w18
  call "Complex FFT.gvi"(x=w18, FFT size=$"data FFT size") -> (FFT{x}=w19)
  Add($index, $"preamble FFT size") -> w20
  Array Subset(array=$"Rx signal", index0=w20, length0=$"preamble FFT size") -> w21
  call "Complex FFT.gvi"(x=w21, FFT size=$"preamble FFT size") -> (FFT{x}=w22)
  call "Complex FFT.gvi"(x=$Preamble, FFT size=$"preamble FFT size") -> (FFT{x}=w23)
  call "ClearZerosInPreamble.gvi"(FFT{x}=w23, bypass=$"Fully allocated?") -> (x=w24)
  Reciprocal(x=w24) -> w25
  for {
    w26 = each element of w22
    w27 = each element of w25
    Multiply(w26, w27) -> w29
    append w29 to w28
  }
  call "Inverse Complex FFT.gvi"(FFT{x}=w28) -> (x=w30)
  Array Size(array=w30) -> (size(s)=w31)
  Subtract(x=w31, y=$"Channel Length") -> w32
  Array Subset(array=w30, index0=w32, length0=$"Channel Length") -> w33
  Initialize Array(element=0+0i, size=$"data FFT size") -> w34
  Array Subset(array=w30, index0=0, length0=$"Channel Length") -> w35
  Replace Array Subset(inArray=w34, index=0, new=w35) -> w36
  Subtract(x=$"data FFT size", y=$"Channel Length") -> w37
  Replace Array Subset(inArray=w36, index=w37, new=w33) -> w38
  call "Complex FFT.gvi"(x=w38, FFT size=$"data FFT size") -> (FFT{x}=w39)
  Add(w19, w39) -> w40
  Reciprocal(x=2+0i) -> w41
  for {
    w42 = each element of w40
    Multiply(w42, w41) -> w44
    append w44 to w43
  }
  $"Channel Freq. Resp." <- w43
