vi "Equalizer.gvi"   [LabVIEW Communications System Design Suite 2.0.1]
inputs:
  "Rx data": c128[]
  "Channel Freq": c128[]
  "FFT size": i32 = 576
outputs:
  "equalized data": c128[]
  "FFT{x}": c128[]
  "product": c128[]
uses:
  NI::Analysis::Transforms::Complex FFT.gvi
  NI::Analysis::Transforms::Inverse Complex FFT.gvi
diagram:
  call "Complex FFT.gvi"(x=$"Rx data", FFT size=$"FFT size") -> (FFT{x}=w1)
  $"FFT{x}" <- w1
  Reciprocal(x=$"Channel Freq") -> w2
  Multiply(w1, w2) -> w3
  $product <- w3
  call "Inverse Complex FFT.gvi"(FFT{x}=w3) -> (x=w4)
  $"equalized data" <- w4
