vi "PreambleAndData.gvi"   [LabVIEW Communications System Design Suite 2.0.1]
panel controls:
  "Tx Preamble": c128[] = [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]
  "Tx Data": c128[] = [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]
  "Rx Preamble": CFXP(4.12)[] = [0.02490234375-0.105224609375i, 0.00830078125+0.013916015625i, 0.063720703125-0.21337890625i, 0.364501953125+0.105224609375i, 0.59716796875+0.76220703125i, -0.242431640625+0.022216796875i, -0.06787109375+0.04150390625i, -0.0234375-0.072021484375i, -0.063720703125+0.0498046875i, 0.0361328125-0.013916015625i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]
  "Rx Data": CFXP(4.12)[] = [-0.083251953125-0.07470703125i, -0.076171875-0.0859375i, -0.081787109375-0.088623046875i, -0.072021484375-0.0859375i, -0.07763671875-0.106689453125i, -0.07470703125-0.0859375i, -0.072021484375-0.098388671875i, -0.0693359375-0.09423828125i, -0.0595703125-0.08447265625i, -0.065185546875-0.088623046875i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]
  "Channel Length": i32
panel indicators:
  "Preamble": f64[][]
  "Data": f64[][]
  "Graph": f64[]
  "DC level": f64[]
  "Impulse": f64[]
uses:
  NI::Analysis::Transforms::Inverse Complex FFT.gvi
diagram:
  call "average.gvi"(signal=$"Rx Preamble") -> (average=w1)
  Subtract(x=$"Rx Preamble", y=w1) -> w2
  call "Channel Estimation.gvi"(Rx signal=w2, Preamble=$"Tx Preamble", Channel Length=$"Channel Length", preamble FFT size=64, index=1, data FFT size=576) -> (Channel Freq. Resp.=w3)
  Absolute Value(x=w3) -> w4
  $Graph <- w4
  call "Inverse Complex FFT.gvi"(FFT{x}=w3) -> (x=w5)
  Absolute Value(x=w5) -> w6
  $Impulse <- w6
  Complex To Real Imaginary(x + iy=$"Tx Preamble") -> (x=w7, y=w8)
  Complex To Real Imaginary(x + iy=w2) -> (x=w9, y=w10)
  Build Array(w7, w8, w9, w10) -> w11
  $Preamble <- w11
  call "average.gvi"(signal=$"Rx Data") -> (average=w12)
  Subtract(x=$"Rx Data", y=w12) -> w13
  call "Equalizer.gvi"(Rx data=w13, Channel Freq=w3) -> (equalized data=w14)
  Complex To Real Imaginary(x + iy=w14) -> (x=w15, y=w16)
  Complex To Real Imaginary(x + iy=$"Tx Data") -> (x=w17, y=w18)
  Complex To Real Imaginary(x + iy=$"Rx Data") -> (x=w19, y=w20)
  Build Array(w17, w18, w19, w20, w15, w16) -> w21
  $Data <- w21
  Complex To Real Imaginary(x + iy=w1) -> (x=w22, y=w23)
  Complex To Real Imaginary(x + iy=w12) -> (x=w24, y=w25)
  Build Array(w22, w23, w24, w25) -> w26
  $"DC level" <- w26
