vi "channel equalizer test 2.14 u32.gvi"   [LabVIEW Communications System Design Suite 2.0.1]
panel controls:
  "GFDM parameter": "GFDM parameter.gtype" = {"Variable: K"=64, "Variable: M"=9, "Variable: a"=0.5, "filter type"="rc", "receive filter"="ZF", "inverse FFT"=FALSE, "Variable: b"=0.5, "Ncs"=0, "Ncp"=0}
  "limit": f64 = 1
  "Channel Length": i32 = 4
  "Rx Data": CFXP(4.12)[] = [-0.083251953125-0.07470703125i, -0.076171875-0.0859375i, -0.081787109375-0.088623046875i, -0.072021484375-0.0859375i, -0.07763671875-0.106689453125i, -0.07470703125-0.0859375i, -0.072021484375-0.098388671875i, -0.0693359375-0.09423828125i, -0.0595703125-0.08447265625i, -0.065185546875-0.088623046875i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]
  "Tx Preamble": c128[] = [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]
  "Rx Preamble": CFXP(4.12)[] = [0.02490234375-0.105224609375i, 0.00830078125+0.013916015625i, 0.063720703125-0.21337890625i, 0.364501953125+0.105224609375i, 0.59716796875+0.76220703125i, -0.242431640625+0.022216796875i, -0.06787109375+0.04150390625i, -0.0234375-0.072021484375i, -0.063720703125+0.0498046875i, 0.0361328125-0.013916015625i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]
panel indicators:
  "equal": bool
  "Graph": f64[][]
  "overflow": bool
  "empty": bool
  "loop iteration": i32
  "Preamble": f64[][]
  "Re": f64[][]
  "Im": f64[][]
  "channel": f64[]
  "RX.equ.debug out": T1
  "Array": T1[]
types:
  "GFDM parameter.gtype" = cluster{"Variable: K": i32, "Variable: M": i32, "Variable: a": f64, "filter type": enum{"rc", "rect"}, "receive filter": enum{"MF", "ZF"}, "inverse FFT": bool, "Variable: b": f64, "Ncs": u16, "Ncp": u16}
  T1 = cluster{"FFT misalignment count": u8, "FFT halt count": u8, "block start": u16, "block end": u16, "overflow_2": u16, "update active_2": u16, "update done_2": u16, "first sample out_2": u16, "exponent": FXP(4.0), "exponent_2": FXP(4.0), "elements read_2": u32}
  "modem_configuration.gtype" = cluster{"K-1": u16, "M-1": u8, "N-1": u16, "N": u16, "Npreamble+CP+CS": u16, "Npreamble": u16, "Nw": u16, "Modulator MUX config": u64[16], "K": u16, "fft_size_log2(K)": u8, "inverse_fft": bool, "Start with preamble": bool, "Burstmode": bool, "Ncs": u16, "Ncp": u16, "N-Ncp": u16, "N+Ncp": u16, "N+Ncp+Ncs": u16, "Demodulator MUX config": u64[16], "M": u8, "DFT SIZE": FXP(6.0), "Frame length": u32, "Super frame length": u32, "Ns_all_GFDM_blocks": u32, "Ns_all_preambles": u32}
uses:
  ::USRP::Interactive::channel equalizer wrapper 2.14 u32.gcdl
diagram:
  call "zero-mean.gvi"(Rx Preamble=$"Rx Preamble") -> (Rx signal=w1)
  call "norm CFX.gvi"(Input=$"Tx Preamble") -> (Output=w2)
  Build Array(w1, w2) -> w3
  Absolute Value(x=w3) -> w4
  $Preamble <- w4
  Property Node(instance in=$"GFDM parameter") -> ("Variable: K"=w5, "Variable: M"=w6)
  Multiply(w5, w6) -> w7
  call "Channel Estimation.gvi"(Rx signal=w1, Preamble=w2, Channel Length=$"Channel Length", preamble FFT size=64, index=1, data FFT size=w7) -> (Channel Freq. Resp.=w8)
  Absolute Value(x=w8) -> w9
  $channel <- w9
  call "zero-mean.gvi"(Rx Preamble=$"Rx Data") -> (Rx signal=w10)
  call "CDB array to 2.14 FXP u32.gvi"(input=w10) -> (output=w11)
  Reciprocal(x=w8) -> w12
  call "CDB array to 2.14 FXP u32.gvi"(input=w12) -> (output=w13)
  call "dft_core_config.gvi"(N=w7) -> (size=w14)
  Decrement(x=w5) -> w15
  Decrement(x=w6) -> w16
  Decrement(x=w7) -> w17
  Property Node(instance in="modem_configuration.gtype" {all zero or empty}, "K-1"=w15, "M-1"=w16, "N-1"=w17, "DFT SIZE"=w14) -> (instance out=w18)
  while (iteration -> i1) {
    Is Equal To 0(x=i1) -> w23
    Feedback Node(input=w24) -> w25
    call "toggle_output.gvi"(toggle=w25, reset=w23) -> (output=w26)
    call "fifo simulator_32.gvi"(ready for output=w26, Array=w11, reset=w23) -> (element=w27, valid=w28)
    Feedback Node(input=w23) -> w29
    call "toggle_output.gvi"(toggle=w29, reset=w23) -> (output=w30)
    call "fifo simulator_32_without reset.gvi"(ready for output=w30, Array=w13, reset=w23) -> (element=w31, valid=w32, addr=w33)
    Join Numbers(high(x)=w33, low(x)=w31) -> w34
    call "channel equalizer wrapper 2.14 u32.gcdl"(Modem config=w18, input valid=w28, input=w27, coefficients=w34, Reset=w23, coefficients valid=w32) -> (FIFO empty=w35, RX.equ.debug out=w36, Ready for data=w24, output_VALID=w37, output=w38, overflow=w39)
    call "detect falling edge.gvi"(in=w37) -> (out=w40)
    call "u32 to 2.14 CDB.gvi"(u32=w38) -> (CFX out=w41)
    call "fifo simulator_32.gvi"(ready for output=w30, Array=w13, reset=w23)
    $"RX.equ.debug out" <- w36
    $"loop iteration" <- i1
    append w41 to w19 if w37
    append w35 to w20
    append w39 to w21
    append w36 to w22
    stop if w40
  }
  call "Equalizer.gvi"(Rx data=w10, Channel Freq=w8, FFT size=w7) -> (equalized data=w42)
  Build Array(w19, w42, w10) -> w43
  Complex To Real Imaginary(x + iy=w43) -> (x=w44, y=w45)
  $Re <- w44
  $Im <- w45
  Absolute Value(x=w43) -> w46
  $Graph <- w46
  call "compare_elements.gvi"(reference=w42, array=w19, limit=$limit) -> (equal=w47)
  $equal <- w47
  $Array <- w22
  Or Array Elements(Boolean array=w20) -> (logical OR=w48)
  $empty <- w48
  Or Array Elements(Boolean array=w21) -> (logical OR=w49)
  $overflow <- w49
