vi "test_toplevel_CE.gvi"   [LabVIEW Communications System Design Suite 2.0.1]
panel controls:
  "configIDataIn": "CE_signalsType.gtype"
  "Parameters": "CE_configurationStameMashine.gtype"
  "debugState": i32
panel indicators:
  "dataOut": "CE_signalsType.gtype"
  "debugOut": "CE_signalsType.gtype"
  "readyForConfig": bool
types:
  "CE_signalsType.gtype" = cluster{"data": u32, "valid": bool, "index": u16}
  T1 = cluster{"config!": bool, "reset!": bool, "active!": bool}
  T2 = cluster{"NpayIsPowerOfTwo": bool, "KpreIsPowerOfTwo": bool, "Npay": u16, "Kpre": u16, "log2(Npay) or DftSizeIndex": u8, "B": u16, "log2(Kpre) or DftSizeIndex": u8, "L.ch.1": u16, "L.ch.2": u16, "shiftFactorDft": i16}
  "CE_configurationStameMashine.gtype" = cluster{"control": T1, "config": T2}
diagram:
  clock-driven loop (clock = "ChennalEstimationResource.grsc\\Clock250") forever {
    call "CE_channelEstimation.gcdl"(fifoPreamble="ChennalEstimationResource.grsc\\FIFO", fifoPayload="ChennalEstimationResource.grsc\\FIFO_2", configIDataIn=$configIDataIn, Parameters=$Parameters, debugState=$debugState) -> (readyForConfig=w1, dataOut=w2, debugOut=w3)
    Property Node(instance in=w2) -> ("data"=w4, "valid"=w5, "index"=w6, instance out=w7)
    Join Numbers(high(x)=w4, low(x)=w6) -> w8
    FIFO Write(Control Protocol Input=w5, data=w8, reference in="ChennalEstimationResource.grsc\\T2H_test")
    $readyForConfig <- w1
    $dataOut <- w7
    $debugOut <- w3
  }
  clock-driven loop (clock = "40 MHz Onboard Clock") forever {
    FIFO Read(Control Protocol Input=TRUE, reference in="ChennalEstimationResource.grsc\\H2T_test") -> (Control Protocol Output=w9, data=w10)
    FIFO Write(Control Protocol Input=w9, data=w10, reference in="ChennalEstimationResource.grsc\\FIFO")
    FIFO Write(Control Protocol Input=w9, data=w10, reference in="ChennalEstimationResource.grsc\\FIFO_2")
  }
