vi "Host_CS_RF.gvi"   [LabVIEW Communications System Design Suite 2.0.1]
panel controls:
  "GFDM parameter": "GFDM parameter.gtype" = {"Variable: K"=64, "Variable: M"=9, "Variable: a"=0, "filter type"="rc", "receive filter"="ZF", "inverse FFT"=FALSE, "Variable: b"=0, "Ncs"=16, "Ncp"=32}
  "USRP RIO device": string = "MXI1Port1Dev1"
  "Reference Frequency Source": string = "Internal"
  "Control Tab": i32 = 1
  "TX.Sample Rate [S/s]": f64 = 10000000
  "RX.Frequency [Hz]": f64 = 1990000000
  "TX.Frequency [Hz]": f64 = 1990000000
  "RX.Sample Rate [S/s]": f64 = 10000000
  "FPGA in": "FPGA interface.gtype"
  "milliseconds to wait": u32
  "stop_cs": bool
  "CCA.ch0/ch1": bool
  "stop rf": bool
  "configue": bool
  "CCA.Control": T2
  "DC correction.enable": bool[2]
  "Output Power RF 0 [dBm]": f64 = 26
  "Reference Level RF 1 [dBm]": f64
panel indicators:
  "received preamble": u32[]
  "error out": error
  "error out_2": error
  "rx.coerced configurations": T1
  "DC correction. applied": CFXP(1.17)[2]
  "DC correction. average": CFXP(15.17)[2]
  "CCA.status": T3
  "CCA.Noframes": u64
types:
  "GFDM parameter.gtype" = cluster{"Variable: K": i32, "Variable: M": i32, "Variable: a": f64, "filter type": enum{"rc", "rect"}, "receive filter": enum{"MF", "ZF"}, "inverse FFT": bool, "Variable: b": f64, "Ncs": u16, "Ncp": u16}
  T1 = cluster{"coerced frequencies": f64[], "coerced lo frequencies": f64[], "coerced levels": f64[], "coerced sample rates": f64[]}
  T2 = cluster{"reset measure": bool, "Power Offset": FXP(9.7), "Threshold": FXP(9.7)}
  T3 = cluster{"log power": FXP(9.7), "CCA": bool, "Current sample": u16}
  T4 = cluster{"Antenna RF 0": string, "Frequency RF 0 [Hz]": f64, "LO Frequency RF 0 [Hz]": f64, "Output Power RF 0 [dBm]": f64}
  T5 = cluster{"Antenna RF 1": string, "Frequency RF 1 [Hz]": f64, "LO Frequency RF 1 [Hz]": f64, "Output Power RF 1 [dBm]": f64}
  T6 = enum{"Software", "Digital Edge", "Rx Start Trigger", "Tx Start Trigger", "Immediate", "Future Time Event"}
  T7 = cluster{"rf enable 0": bool, "rf config 0": T4, "rf enable 1": bool, "rf config 1": T5, "Number of Samples is Finite": bool, "Sample Rate [S/s]": f64, "Number of Samples": u32, "Start Trigger": T6, "Tone Frequency [Hz]": f64}
  T8 = cluster{"Antenna RF 0": string, "Frequency RF 0 [Hz]": f64, "LO Frequency RF 0 [Hz]": f64, "Reference Level RF 0 [dBm]": f64}
  T9 = cluster{"Antenna RF 1": string, "Frequency RF 1 [Hz]": f64, "LO Frequency RF 1 [Hz]": f64, "Reference Level RF 1 [dBm]": f64}
  T10 = cluster{"rf enable 0": bool, "rf config 0": T8, "rf enable 1": bool, "rf config 1": T9, "Number of Samples is Finite": bool, "Sample Rate [S/s]": f64, "Number of Samples": u32, "Start Trigger": T6}
diagram:
  w1 = $"USRP RIO device"
  call "Reset FPGA.gvi"(USRP RIO device=w1, error out=no error) -> (error in=w2)
  FPGA Open Node[ProjectItem=":NullTarget:USRP_2\\-RF_sensing\\-0001\\.lvbitx"](RIO address=w1, error in=w2, run?=TRUE) -> (error out=w3, reference out=w4)
  while {
    Wait(time to wait=$"milliseconds to wait")
    Property Node(instance in=w4, "CCA.ch0/ch1"=$"CCA.ch0/ch1", "CCA.Control"=$"CCA.Control", "DC correction.enable"=$"DC correction.enable", error in=no error) -> (error out=w5, instance out=w6)
    Property Node(instance in=w6, error in=w5) -> ("CCA.status"=w7, "DC correction. applied"=w8, "DC correction. average"=w9, "CCA.Noframes"=w10, error out=w11)
    $"error out" <- w11
    $"CCA.status" <- w7
    $"CCA.Noframes" <- w10
    $"DC correction. applied" <- w8
    $"DC correction. average" <- w9
    stop if $stop_cs
  }
  Type Cast(type=$"FPGA in", x=w4) -> w12
  w13 = $"Reference Frequency Source"
  while (iteration -> i1) {
    Property Node(instance in=T4 {all zero or empty}, "Antenna RF 0"="TX1", "Frequency RF 0 [Hz]"=$"TX.Frequency [Hz]", "LO Frequency RF 0 [Hz]"=-1, "Output Power RF 0 [dBm]"=$"Output Power RF 0 [dBm]") -> (instance out=w14)
    Property Node(instance in=$"GFDM parameter") -> ("Variable: K"=w15, "Variable: M"=w16, "Ncs"=w17, "Ncp"=w18)
    Multiply(w15, w16) -> w19
    Add(w17, w18) -> w20
    Square(x=w20) -> w21
    Add(w19, 128, w21) -> w22
    w23 = T7 {"rf enable 0"=TRUE, "rf config 0"={"Antenna RF 0"="TX1", "Frequency RF 0 [Hz]"=1990000000, "LO Frequency RF 0 [Hz]"=-1, "Output Power RF 0 [dBm]"=20}, "rf enable 1"=FALSE, "rf config 1"={"Antenna RF 1"="TX1", "Frequency RF 1 [Hz]"=1990000000, "LO Frequency RF 1 [Hz]"=-1, "Output Power RF 1 [dBm]"=0}, "Number of Samples is Finite"=FALSE, "Sample Rate [S/s]"=20000000, "Number of Samples"=800, "Start Trigger"="Software", "Tone Frequency [Hz]"=100000}
    Property Node(instance in=w23, "rf enable 0"=FALSE, "rf config 0"=w14, "rf enable 1"=FALSE, "rf config 1"=w14, "Number of Samples is Finite"=FALSE, "Sample Rate [S/s]"=$"TX.Sample Rate [S/s]", "Number of Samples"=w22, "Start Trigger"="Software") -> (instance out=w24)
    w25 = "RX2"  # Antenna RF 1
    w26 = T8 {"Antenna RF 0"="RX2", "Frequency RF 0 [Hz]"=1990000000, "LO Frequency RF 0 [Hz]"=-1, "Reference Level RF 0 [dBm]"=0}
    Property Node(instance in=w26, "Antenna RF 0"=w25, "Frequency RF 0 [Hz]"=$"RX.Frequency [Hz]", "LO Frequency RF 0 [Hz]"=-1, "Reference Level RF 0 [dBm]"=$"Reference Level RF 1 [dBm]") -> (instance out=w27)
    w28 = T10 {"rf enable 0"=FALSE, "rf config 0"={"Antenna RF 0"="RX2", "Frequency RF 0 [Hz]"=1990000000, "LO Frequency RF 0 [Hz]"=-1, "Reference Level RF 0 [dBm]"=0}, "rf enable 1"=TRUE, "rf config 1"={"Antenna RF 1"="RX2", "Frequency RF 1 [Hz]"=2180000000, "LO Frequency RF 1 [Hz]"=-1, "Reference Level RF 1 [dBm]"=0}, "Number of Samples is Finite"=FALSE, "Sample Rate [S/s]"=20000000, "Number of Samples"=32000, "Start Trigger"="Immediate"}
    Property Node(instance in=w28, "rf enable 0"=TRUE, "rf config 0"=w27, "rf enable 1"=TRUE, "rf config 1"=w27, "Number of Samples is Finite"=FALSE, "Sample Rate [S/s]"=$"RX.Sample Rate [S/s]", "Number of Samples"=w22, "Start Trigger"="Immediate") -> (instance out=w29)
    Is Equal To 0(x=i1) -> w30
    Logical Or($configue, w30) -> w31
    Feedback Node(input=w32) -> w33
    case (w31) {
      frame False, Default {
        w34 = w3
        w32 = w33
      }
      frame True {
        $"received preamble" <- u32[] []
        call "Open and Configure Device_2.gvi"(FPGA in=w12, usrp rio device=w1, reference frequency source=w13, rx config=w29, tx config=w24, open=w30) -> (niusrprio session=w35, rx.coerced configurations=w36, error out=w37, rx channels=w38, tx channels=w39)
        call "Initiate and Generate (Single).gvi"(niusrprio session=w35, first iteration=TRUE, error in=w37, tx channels=w39) -> (niusrprio session 2=w40, error out=w41)
        Property Node(instance in=w40) -> ("FPGA Interface"=w42, instance out=w43)
        Dynamic Fpga Interface Cast(reference in=w42, type="FPGA interface.gtype" constant)
        call "Initiate and Fetch (Single).gvi"(niusrprio session=w43, first iteration=TRUE, error in=w41, rx channels=w38) -> (niusrprio session 2=w32, error out=w34)
        $"rx.coerced configurations" <- w36
        $"error out_2" <- w41
      }
    }
    Wait(time to wait=100)
    stop if $"stop rf"
  }
  call "Close Device.gvi"(niusrprio session=w32, error in=w34) -> (error out=w44)
  call "Display Error.gvi"(type of dialog="no dialog", error in=w44)
