vi "RF plus Sensing FIR.gvi"   [LabVIEW Communications System Design Suite 2.0.1]
panel controls:
  "rx.reset": bool = TRUE
  "rx.samples to acquire": u32
  "rx 0.output sample rate": UFXP(1.47)
  "rx 0.delay": FXP(0.16)
  "rx 0.frequency shift": FXP(0.48)
  "rx 0.phase": FXP(0.21)
  "rx 0.impairments": T1 = {"inline gain I"=0.999992370605, "inline gain Q"=0.999992370605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}
  "rx.abort": bool
  "tx.abort": bool
  "tx.reset": bool = TRUE
  "tx 0.input sample rate": UFXP(1.47)
  "tx 0delay": FXP(0.18)
  "tx 0.frequency shift": FXP(0.48)
  "tx 0.phase": FXP(0.21)
  "tx 0.impairments": T1 = {"inline gain I"=0.999992370605, "inline gain Q"=0.999992370605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}
  "tx.samples to generate": u32
  "tx 0.gain": T2 = {"gain I"=1, "gain Q"=1}
  "rx 1.impairments": T1 = {"inline gain I"=0.999992370605, "inline gain Q"=0.999992370605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}
  "rx 1.frequency shift": FXP(0.48)
  "rx 1.phase": FXP(0.21)
  "tx 1.impairments": T1 = {"inline gain I"=0.999992370605, "inline gain Q"=0.999992370605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}
  "tx 1.frequency shift": FXP(0.48)
  "tx 1.phase": FXP(0.21)
  "tx 1.gain": T2 = {"gain I"=1, "gain Q"=1}
  "rx 0.stream enable": bool
  "rx 1.stream enable": bool
  "tx 0.stream enable": bool
  "tx 1.stream enable": bool
  "rx.trigger select": T3 = "Immediate"
  "tx.trigger select": T3 = "Immediate"
  "rx.software trigger": bool
  "tx.software trigger": bool
  "rx.trigger enable": bool
  "tx.trigger enable": bool
  "TX.modem.configuration_in": "modem_configuration.gtype"
  "Reset": bool
  "Reset counter": bool
  "RX.switch channels": bool
  "RX.input delay": u16
  "reg.host read.go rcvd 0": bool
  "reg.notify host.go rcvd 0": bool
  "reg.reset 0": bool
  "RF 0/Rx/Enable": bool
  "RF 0/Tx/Enable": bool
  "RF 1/Rx/Enable": bool
  "RF 1/Tx/Enable": bool
  "CCA.ch0/ch1": bool
  "rx 1.delay": FXP(0.16)
  "rx 1.output sample rate": UFXP(1.47)
  "tx 1.delay": FXP(0.18)
  "tx 1.input sample rate": UFXP(1.47)
  "DC correction.enable": bool[2]
  "DC correction.n": i16[2]
  "CCA.Control": T4
panel indicators:
  "rx.samples processed": u32
  "rx.state": enum{"Idle", "Active"}
  "rx 0.number of IQ data overflows": u64
  "rx.number of overflows": u32
  "tx.samples processed": u32
  "tx.underflows": u32
  "tx 0.number of IQ data overflows": u64
  "tx.state": enum{"Idle", "Active"}
  "rx.dsp reset done": bool
  "tx.dsp reset done": bool
  "tx 1.number of IQ data overflows": u64
  "rx 1.number of IQ data overflows": u64
  "reg.notify host.go 0": bool
  "reg.host read.data 0": cluster{"go": bool, "data": u32}
  "DC correction. applied": CFXP(1.17)[2]
  "DC correction. average": CFXP(15.17)[2]
  "CCA.status": T5
  "CCA.Noframes": u64
types:
  T1 = cluster{"inline gain I": FXP(1.17), "inline gain Q": FXP(1.17), "cross gain I": FXP(1.17), "cross gain Q": FXP(1.17), "pre-gain offset I": FXP(1.17), "pre-gain offset Q": FXP(1.17), "post-gain offset I": FXP(1.17), "post-gain offset Q": FXP(1.17)}
  T2 = cluster{"gain I": FXP(3.21), "gain Q": FXP(3.21)}
  T3 = enum{"Software", "Digital Edge", "Rx Start Trigger", "Tx Start Trigger", "Immediate", "Future Time Event"}
  "modem_configuration.gtype" = cluster{"K-1": u16, "M-1": u8, "N-1": u16, "N": u16, "Npreamble+CP+CS": u16, "Npreamble": u16, "Nw": u16, "Modulator MUX config": u64[16], "K": u16, "fft_size_log2(K)": u8, "inverse_fft": bool, "Start with preamble": bool, "Burstmode": bool, "Ncs": u16, "Ncp": u16, "N-Ncp": u16, "N+Ncp": u16, "N+Ncp+Ncs": u16, "Demodulator MUX config": u64[16], "M": u8, "DFT SIZE": FXP(6.0), "Frame length": u32, "Super frame length": u32, "Ns_all_GFDM_blocks": u32, "Ns_all_preambles": u32}
  T4 = cluster{"reset measure": bool, "Power Offset": FXP(9.7), "Threshold": FXP(9.7)}
  T5 = cluster{"log power": FXP(9.7), "CCA": bool, "Current sample": u16}
  T6 = cluster{"output sample rate": UFXP(1.47), "delay": FXP(0.16), "frequency shift": FXP(0.48), "impairments": T1, "phase": FXP(0.21)}
  T7 = cluster{"frequency shift": FXP(0.48), "impairments": T1, "phase": FXP(0.21), "input sample rate": UFXP(1.47), "gain": T2, "delay": FXP(0.18)}
diagram:
  FIFO Create(data type=u64 0, depth=17) -> (reference out=w1)
  FIFO Create(data type=u64 0, depth=17) -> (reference out=w2)
  call "Create Resources.gvi"() -> (sync.resources=w3, config.resources=w4, time.resources=w5)
  Register Create(initial value="modem_configuration.gtype" {all zero or empty}) -> (reference out=w6)
  # Channel sensing
  clock-driven loop (clock = "40 MHz Onboard Clock") {
    Register Write(data=$"TX.modem.configuration_in", reference in=w6)
    # w1: Port1
    Build Array($Reset, $"Reset counter") -> w7
    Register Write(data=w7, reference in="Needed Resources.grsc\\Reset")
    Io Write(data=$"RF 1/Rx/Enable", reference in="RF 1/Rx/Enable")
    Io Write(data=$"RF 0/Tx/Enable", reference in="RF 0/Tx/Enable")
    Io Write(data=$"RF 0/Rx/Enable", reference in="RF 0/Rx/Enable")
    Io Write(data=$"RF 1/Tx/Enable", reference in="RF 1/Tx/Enable")
    # w2: Port0
    Feedback Node(input=w8) -> w9
    Property Node(instance in=w9) -> ("ready for port 0 input"=w10, "ready for port 1 input"=w11, "ready for port 2 input"=w12)
    Feedback Node(input=w13) -> w14
    call "niInstr Register Bus v1 FPGA.lvlib__Process.gcdl"(reg.notify host.go rcvd=$"reg.notify host.go rcvd 0", reg.host read.go rcvd=$"reg.host read.go rcvd 0", read completion=w14, reg.reset=$"reg.reset 0", reg.host instruction fifo="niInstr Register Bus v0.grsc\\reg.host instruction fifo 0", ready for output=w12) -> (reg.notify host.go=w15, reg.host read.data=w16, register instruction=w17)
    $"reg.notify host.go 0" <- w15
    $"reg.host read.data 0" <- w16
    FIFO Read(Control Protocol Input=w10, reference in=w2) -> (Control Protocol Output=w18, data=w19)
    call "Retrieve FPGA Scoped Instruction.gcdl"(number=w19, valid=w18) -> (output cluster=w20)
    # these FIFOs are for setting the Gain on FPGA side
    FIFO Read(Control Protocol Input=w11, reference in=w1) -> (Control Protocol Output=w21, data=w22)
    call "Retrieve FPGA Scoped Instruction.gcdl"(number=w22, valid=w21) -> (output cluster=w23)
    Feedback Node(input=w24) -> w25
    call "niInstr Register Bus v1 FPGA.lvlib__Register Instruction Arbiter (3 inputs).gcdl"(port 0=w20, port 1=w23, port 2=w17, reset=FALSE, ready for output=w25) -> (register instr out=w26, ready for input=w8)
    call "Registers.gcdl"(sync.resources=w3, register instruction=w26, config.resources=w4, time.resources=w5) -> (read completion out=w13, ready for input=w24)
    stop if FALSE
  }
  call "niUsrpRio Config v1 FPGA.lvlib__Process.gvi"(resources=w4)
  clock-driven loop (clock = "Data Clock") {
    Build Array($"rx 0.stream enable", $"rx 1.stream enable") -> w27
    # trigger from TX
    # frame generation
    Register Read(reference in="Needed Resources.grsc\\TX.start trigger") -> (data=w28)
    Logical Or($"tx.software trigger", w28) -> w29
    call "Start Triggers Time.gcdl"(rx 1.stream enabled=$"rx 1.stream enable", rx.software trigger=$"rx.software trigger", tx.trigger select=$"tx.trigger select", tx.enable trigger=$"tx.trigger enable", tx 0.stream enabled=$"tx 0.stream enable", tx 1.stream enabled=$"tx 1.stream enable", rx 0.stream enabled=$"rx 0.stream enable", rx.enable trigger=$"rx.trigger enable", rx.trigger select=$"rx.trigger select", tx.software trigger=w29, time.resources=w5) -> (rx.start trigger=w30, tx.start trigger=w31)
    Io Read(reference in="RF 0/Rx/I") -> (data=w32)
    Io Read(reference in="RF 0/Rx/Q") -> (data=w33)
    call "niInstr DSP v1 FPGA.lvlib__I16 to IQ.gcdl"(I=w32, Q=w33) -> (IQ data=w34)
    Io Read(reference in="RF 1/Rx/I") -> (data=w35)
    Io Read(reference in="RF 1/Rx/Q") -> (data=w36)
    call "niInstr DSP v1 FPGA.lvlib__I16 to IQ.gcdl"(I=w35, Q=w36) -> (IQ data=w37)
    Build Array(w34, w37) -> w38
    w39 = T6 {"0x800000000000", 0, 0, "0x1FFFF", "0x1FFFF", 0, 0, 0, 0, 0, 0, 0}
    Property Node(instance in=w39, "impairments"=$"rx 0.impairments", "frequency shift"=$"rx 0.frequency shift", "phase"=$"rx 0.phase", "output sample rate"=$"rx 0.output sample rate", "delay"=$"rx 0.delay") -> (instance out=w40)
    w41 = T6 {"0x800000000000", 0, 0, "0x1FFFF", "0x1FFFF", 0, 0, 0, 0, 0, 0, 0}
    Property Node(instance in=w41, "delay"=$"rx 1.delay", "output sample rate"=$"rx 1.output sample rate", "impairments"=$"rx 1.impairments", "frequency shift"=$"rx 1.frequency shift", "phase"=$"rx 1.phase") -> (instance out=w42)
    Build Array(w40, w42) -> w43
    call "DDC (Multi-Channel).gcdl"(enable DC correction=$"DC correction.enable", data in=w38, start trigger=w30, enabled=w27, DDC Parameters=w43, reset=$"rx.reset", n-DC=$"DC correction.n") -> (DC Average=w44, data out=w45, number of overflows=w46, output valid=w47, dsp reset done=w48, Dc correction=w49)
    # Streaming Transceiver Engine
    call "CCA_sources.gcdl"(data in=w45, enabled=w27, input valid=w47, ch0/ch1=$"CCA.ch0/ch1") -> (data valid=w50, data=w51)
    # #CodeRecommended - If you want to move the data directly to another LabVIEW FPGA device
    #  for further processing, you can replace the DMA FIFO with a Peer to Peer Writer FIFO.
    # WIFI Channel sensing: measure for 20MHz channel with sampling frequency 80MHz
    # If the sampling of the data channel is less then 80, the other RX channel must be used
    call "Sensing_FIR.gcdl"(data in=w51, input valid=w50, CS.Control=$"CCA.Control", CCS.reset register="Needed Resources.grsc\\CCA.Reset", CCS.Status="Needed Resources.grsc\\CCA.Status") -> (CS.status=w52, CS1.Noframes=w53)
    $"CCA.status" <- w52
    $"CCA.Noframes" <- w53
    # #CodeRecommended - For your custom data processing IP, you can add Target-Scoped FPGA FIFOs
    #  if you need to move data to a different clock domain.
    call "niInstr Basic Elements v1 FPGA.lvlib__Detect Rising Edge.gcdl"(signal=$"rx.abort") -> (edge detected=w54)
    Select(s=$"RX.switch channels", t=0, f=1) -> w55
    Array Index(array=w47) -> (out0[w55]=w56)
    Feedback Node(input=w57) -> w58
    Not(x=w58) -> w59
    call "Input Stream Control.gcdl"(input valid=w56, start trigger=w30, burst size=$"rx.samples to acquire", abort=w54, fifo timeout=w59, reset=$"rx.reset") -> (write stream=w60, state=w61, samples processed=w62, number of overflows=w63)
    call "Write FIFO (Multi-Channel).gcdl"(switch channels=$"RX.switch channels", data in=w45, enabled=w27, input valid=w60, reset=$"rx.reset", FIFO 0="Needed Resources.grsc\\RX.ADC to synch", T2H fifo reference="Needed Resources.grsc\\Dummy") -> (ready for input=w57)
    Array Index(array=w46) -> (out0[_]=w64, out1[_]=w65)
    $"rx 0.number of IQ data overflows" <- w64
    $"rx 1.number of IQ data overflows" <- w65
    $"rx.dsp reset done" <- w48
    $"rx.state" <- w61
    $"rx.samples processed" <- w62
    $"rx.number of overflows" <- w63
    $"DC correction. applied" <- w49
    $"DC correction. average" <- w44
    Build Array($"tx 0.stream enable", $"tx 1.stream enable") -> w66
    Build Array($"tx 0.stream enable", $"tx 1.stream enable") -> w67
    call "niInstr Basic Elements v1 FPGA.lvlib__Detect Rising Edge.gcdl"(signal=$"tx.abort") -> (edge detected=w68)
    Feedback Node(input=w69) -> w70
    Feedback Node(input=w71) -> w72
    call "Output Stream Control.gcdl"(start trigger=w31, burst size=$"tx.samples to generate", abort=w68, ready to read stream (T)=w72, fifo output valid=w70, reset=$"tx.reset") -> (read stream=w73, state=w74, samples processed=w75, number of underflows=w76)
    call "Read FIFO (Multi-Channel).gcdl"(enabled=w67, FIFO 0="Needed Resources.grsc\\TX.to DAC", ready for output=w73) -> (data out=w77, output valid=w69)
    # #CodeRecommended - If you want to pull data directly from another LabVIEW FPGA device,
    # you can replace the DMA FIFO with a Peer to Peer Reader FIFO.
    call "niInstr Basic Elements v1 FPGA.lvlib__Synchronous Latch.gcdl"(set=w69, clear=$"tx.reset") -> (out=w78)
    Logical And(w78, w72) -> w79
    w80 = T7 {0, "0x1FFFF", "0x1FFFF", 0, 0, 0, 0, 0, 0, 0, 0, "0x200000", "0x200000", 0}
    Property Node(instance in=w80, "gain"=$"tx 0.gain", "frequency shift"=$"tx 0.frequency shift", "phase"=$"tx 0.phase", "impairments"=$"tx 0.impairments", "input sample rate"=$"tx 0.input sample rate", "delay"=$"tx 0delay") -> (instance out=w81)
    w82 = T7 {0, "0x1FFFF", "0x1FFFF", 0, 0, 0, 0, 0, 0, 0, 0, "0x200000", "0x200000", 0}
    Property Node(instance in=w82, "delay"=$"tx 1.delay", "input sample rate"=$"tx 1.input sample rate", "gain"=$"tx 1.gain", "frequency shift"=$"tx 1.frequency shift", "phase"=$"tx 1.phase", "impairments"=$"tx 1.impairments") -> (instance out=w83)
    Build Array(w81, w83) -> w84
    call "DUC (Multi-Channel).gcdl"(data in=w77, enabled=w66, input valid=w79, DUC Parameters=w84, reset=$"tx.reset") -> (I data out=w85, Q data out=w86, number of overflows=w87, dsp reset done=w88, ready for input=w71)
    Array Index(array=w85) -> (out0[_]=w89, out1[_]=w90)
    # #CodeRecommended - For your custom data processing IP, you can add
    # Target-Scoped FPGA FIFOs if you need to move data to/from a different clock domain.
    Io Write(data=w89, reference in="RF 0/Tx/I")
    Io Write(data=w90, reference in="RF 1/Tx/I")
    Array Index(array=w86) -> (out0[_]=w91, out1[_]=w92)
    Io Write(data=w91, reference in="RF 0/Tx/Q")
    Io Write(data=w92, reference in="RF 1/Tx/Q")
    $"tx.state" <- w74
    Array Index(array=w87) -> (out0[_]=w93, out1[_]=w94)
    $"tx 0.number of IQ data overflows" <- w93
    $"tx.samples processed" <- w75
    $"tx 1.number of IQ data overflows" <- w94
    $"tx.dsp reset done" <- w88
    $"tx.underflows" <- w76
    stop if FALSE
  }
