vi "RF plus Sensing both.gvi"   [LabVIEW Communications System Design Suite 2.0.1]
panel controls:
  "rx.reset": bool = TRUE
  "rx.samples to acquire": u32
  "rx 0.output sample rate": UFXP(1.47)
  "rx 0.delay": FXP(0.16)
  "rx 0.frequency shift": FXP(0.48)
  "rx 0.phase": FXP(0.21)
  "rx 0.impairments": T1 = {"inline gain I"=0.999992370605, "inline gain Q"=0.999992370605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}
  "rx.abort": bool
  "tx.abort": bool
  "tx.reset": bool = TRUE
  "tx 0.input sample rate": UFXP(1.47)
  "tx 0delay": FXP(0.18)
  "tx 0.frequency shift": FXP(0.48)
  "tx 0.phase": FXP(0.21)
  "tx 0.impairments": T1 = {"inline gain I"=0.999992370605, "inline gain Q"=0.999992370605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}
  "tx.samples to generate": u32
  "tx 0.gain": T2 = {"gain I"=1, "gain Q"=1}
  "rx 1.impairments": T1 = {"inline gain I"=0.999992370605, "inline gain Q"=0.999992370605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}
  "rx 1.frequency shift": FXP(0.48)
  "rx 1.phase": FXP(0.21)
  "tx 1.impairments": T1 = {"inline gain I"=0.999992370605, "inline gain Q"=0.999992370605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}
  "tx 1.frequency shift": FXP(0.48)
  "tx 1.phase": FXP(0.21)
  "tx 1.gain": T2 = {"gain I"=1, "gain Q"=1}
  "rx 0.stream enable": bool
  "rx 1.stream enable": bool
  "tx 0.stream enable": bool
  "tx 1.stream enable": bool
  "rx.trigger select": T3 = "Immediate"
  "tx.trigger select": T3 = "Immediate"
  "rx.software trigger": bool
  "tx.software trigger": bool
  "rx.trigger enable": bool
  "tx.trigger enable": bool
  "TX.modem.configuration_in": "modem_configuration.gtype"
  "Reset": bool
  "Reset counter": bool
  "RX.switch channels": bool
  "RX.input delay": u16
  "reg.host read.go rcvd 0": bool
  "reg.notify host.go rcvd 0": bool
  "reg.reset 0": bool
  "RF 0/Rx/Enable": bool
  "RF 0/Tx/Enable": bool
  "RF 1/Rx/Enable": bool
  "RF 1/Tx/Enable": bool
  "CCA.ch0/ch1": bool
  "rx 1.delay": FXP(0.16)
  "rx 1.output sample rate": UFXP(1.47)
  "tx 1.delay": FXP(0.18)
  "tx 1.input sample rate": UFXP(1.47)
  "DC correction.enable": bool[2]
  "DC correction.n": i16[2]
  "CS1.Control": T5
  "CS.reset counters": bool
  "CS0.control": T6
panel indicators:
  "rx.samples processed": u32
  "rx.state": enum{"Idle", "Active"}
  "rx 0.number of IQ data overflows": u64
  "rx.number of overflows": u32
  "tx.samples processed": u32
  "tx.underflows": u32
  "tx 0.number of IQ data overflows": u64
  "tx.state": enum{"Idle", "Active"}
  "rx.dsp reset done": bool
  "tx.dsp reset done": bool
  "tx 1.number of IQ data overflows": u64
  "rx 1.number of IQ data overflows": u64
  "reg.notify host.go 0": bool
  "reg.host read.data 0": cluster{"go": bool, "data": u32}
  "CS0.channel status": T4
  "CS0.reset Done": bool
  "DC correction. applied": CFXP(1.17)[2]
  "DC correction. average": CFXP(15.17)[2]
  "CS FFT over flow": u64
  "CS1.Noframes": u64
  "CS1.status": T7
  "CS0.Noframes": u64
types:
  T1 = cluster{"inline gain I": FXP(1.17), "inline gain Q": FXP(1.17), "cross gain I": FXP(1.17), "cross gain Q": FXP(1.17), "pre-gain offset I": FXP(1.17), "pre-gain offset Q": FXP(1.17), "post-gain offset I": FXP(1.17), "post-gain offset Q": FXP(1.17)}
  T2 = cluster{"gain I": FXP(3.21), "gain Q": FXP(3.21)}
  T3 = enum{"Software", "Digital Edge", "Rx Start Trigger", "Tx Start Trigger", "Immediate", "Future Time Event"}
  "modem_configuration.gtype" = cluster{"K-1": u16, "M-1": u8, "N-1": u16, "N": u16, "Npreamble+CP+CS": u16, "Npreamble": u16, "Nw": u16, "Modulator MUX config": u64[16], "K": u16, "fft_size_log2(K)": u8, "inverse_fft": bool, "Start with preamble": bool, "Burstmode": bool, "Ncs": u16, "Ncp": u16, "N-Ncp": u16, "N+Ncp": u16, "N+Ncp+Ncs": u16, "Demodulator MUX config": u64[16], "M": u8, "DFT SIZE": FXP(6.0), "Frame length": u32, "Super frame length": u32, "Ns_all_GFDM_blocks": u32, "Ns_all_preambles": u32}
  T4 = cluster{"power array": FXP(9.7)[13], "free ch array": bool[13], "ch power": FXP(9.7), "ch free": bool}
  T5 = cluster{"reset measure": bool, "Power Offset": FXP(9.7), "Threshold": FXP(9.7)}
  T6 = cluster{"Reset measure": bool, "channel": i32, "threshold": FXP(9.7), "Power offset": FXP(9.7)}
  T7 = cluster{"log power": FXP(9.7), "CCA": bool, "Current sample": u16}
  T8 = cluster{"output sample rate": UFXP(1.47), "delay": FXP(0.16), "frequency shift": FXP(0.48), "impairments": T1, "phase": FXP(0.21)}
  T9 = cluster{"frequency shift": FXP(0.48), "impairments": T1, "phase": FXP(0.21), "input sample rate": UFXP(1.47), "gain": T2, "delay": FXP(0.18)}
diagram:
  FIFO Create(data type=u64 0, depth=17) -> (reference out=w1)
  FIFO Create(data type=u64 0, depth=17) -> (reference out=w2)
  call "Create Resources.gvi"() -> (sync.resources=w3, config.resources=w4, time.resources=w5)
  Register Create(initial value="modem_configuration.gtype" {all zero or empty}) -> (reference out=w6)
  # Channel sensing
  clock-driven loop (clock = "40 MHz Onboard Clock") {
    Register Write(data=$"TX.modem.configuration_in", reference in=w6)
    # w1: Port1
    Build Array($Reset, $"Reset counter") -> w7
    Register Write(data=w7, reference in="Needed Resources.grsc\\Reset")
    Io Write(data=$"RF 1/Rx/Enable", reference in="RF 1/Rx/Enable")
    Io Write(data=$"RF 0/Tx/Enable", reference in="RF 0/Tx/Enable")
    Io Write(data=$"RF 0/Rx/Enable", reference in="RF 0/Rx/Enable")
    Io Write(data=$"RF 1/Tx/Enable", reference in="RF 1/Tx/Enable")
    # w2: Port0
    Feedback Node(input=w8) -> w9
    Property Node(instance in=w9) -> ("ready for port 0 input"=w10, "ready for port 1 input"=w11, "ready for port 2 input"=w12)
    Feedback Node(input=w13) -> w14
    call "niInstr Register Bus v1 FPGA.lvlib__Process.gcdl"(reg.notify host.go rcvd=$"reg.notify host.go rcvd 0", reg.host read.go rcvd=$"reg.host read.go rcvd 0", read completion=w14, reg.reset=$"reg.reset 0", reg.host instruction fifo="niInstr Register Bus v0.grsc\\reg.host instruction fifo 0", ready for output=w12) -> (reg.notify host.go=w15, reg.host read.data=w16, register instruction=w17)
    $"reg.notify host.go 0" <- w15
    $"reg.host read.data 0" <- w16
    FIFO Read(Control Protocol Input=w10, reference in=w2) -> (Control Protocol Output=w18, data=w19)
    call "Retrieve FPGA Scoped Instruction.gcdl"(number=w19, valid=w18) -> (output cluster=w20)
    # these FIFOs are for setting the Gain on FPGA side
    FIFO Read(Control Protocol Input=w11, reference in=w1) -> (Control Protocol Output=w21, data=w22)
    call "Retrieve FPGA Scoped Instruction.gcdl"(number=w22, valid=w21) -> (output cluster=w23)
    Feedback Node(input=w24) -> w25
    call "niInstr Register Bus v1 FPGA.lvlib__Register Instruction Arbiter (3 inputs).gcdl"(port 0=w20, port 1=w23, port 2=w17, reset=FALSE, ready for output=w25) -> (register instr out=w26, ready for input=w8)
    call "Registers.gcdl"(sync.resources=w3, register instruction=w26, config.resources=w4, time.resources=w5) -> (read completion out=w13, ready for input=w24)
    stop if FALSE
  }
  call "niUsrpRio Config v1 FPGA.lvlib__Process.gvi"(resources=w4)
  call "PSD_256.gmrd"(Clock="Needed Resources.grsc\\250 MHz") -> (Input=w27, channel power=w28)
  clock-driven loop (clock = "Data Clock") {
    # Streaming Transceiver Engine
    Property Node(instance in=$"CS0.control") -> ("Reset measure"=w29)
    Feedback Node(input=w30) -> w31
    Logical And(w29, w31) -> w32
    call "Sensing_FFT.gcdl"(Cs.control=$"CS0.control", Reset=w32, stream signal=w27, stream power=w28, channel Register="Needed Resources.grsc\\CCA.Status") -> (Cs.channel status=w33, output valid=w34, Cs.reset Done=w35)
    $"CS0.channel status" <- w33
    $"CS0.reset Done" <- w35
    call "niInstr Basic Elements v1 FPGA.lvlib__Count Up U64.gcdl"(increment=w34, reset=$"CS.reset counters") -> (count out=w36)
    $"CS0.Noframes" <- w36
    Build Array($"rx 0.stream enable", $"rx 1.stream enable") -> w37
    # trigger from TX
    # frame generation
    Register Read(reference in="Needed Resources.grsc\\TX.start trigger") -> (data=w38)
    Logical Or($"tx.software trigger", w38) -> w39
    call "Start Triggers Time.gcdl"(rx 1.stream enabled=$"rx 1.stream enable", rx.software trigger=$"rx.software trigger", tx.trigger select=$"tx.trigger select", tx.enable trigger=$"tx.trigger enable", tx 0.stream enabled=$"tx 0.stream enable", tx 1.stream enabled=$"tx 1.stream enable", rx 0.stream enabled=$"rx 0.stream enable", rx.enable trigger=$"rx.trigger enable", rx.trigger select=$"rx.trigger select", tx.software trigger=w39, time.resources=w5) -> (rx.start trigger=w40, tx.start trigger=w41)
    Io Read(reference in="RF 0/Rx/I") -> (data=w42)
    Io Read(reference in="RF 0/Rx/Q") -> (data=w43)
    call "niInstr DSP v1 FPGA.lvlib__I16 to IQ.gcdl"(I=w42, Q=w43) -> (IQ data=w44)
    Io Read(reference in="RF 1/Rx/I") -> (data=w45)
    Io Read(reference in="RF 1/Rx/Q") -> (data=w46)
    call "niInstr DSP v1 FPGA.lvlib__I16 to IQ.gcdl"(I=w45, Q=w46) -> (IQ data=w47)
    Build Array(w44, w47) -> w48
    w49 = T8 {"0x800000000000", 0, 0, "0x1FFFF", "0x1FFFF", 0, 0, 0, 0, 0, 0, 0}
    Property Node(instance in=w49, "impairments"=$"rx 0.impairments", "frequency shift"=$"rx 0.frequency shift", "phase"=$"rx 0.phase", "output sample rate"=$"rx 0.output sample rate", "delay"=$"rx 0.delay") -> (instance out=w50)
    w51 = T8 {"0x800000000000", 0, 0, "0x1FFFF", "0x1FFFF", 0, 0, 0, 0, 0, 0, 0}
    Property Node(instance in=w51, "delay"=$"rx 1.delay", "output sample rate"=$"rx 1.output sample rate", "impairments"=$"rx 1.impairments", "frequency shift"=$"rx 1.frequency shift", "phase"=$"rx 1.phase") -> (instance out=w52)
    Build Array(w50, w52) -> w53
    call "DDC (Multi-Channel).gcdl"(enable DC correction=$"DC correction.enable", data in=w48, start trigger=w40, enabled=w37, DDC Parameters=w53, reset=$"rx.reset", n-DC=$"DC correction.n") -> (DC Average=w54, data out=w55, number of overflows=w56, output valid=w57, dsp reset done=w58, Dc correction=w59)
    call "CCA_ReadRX.gcdl"(data in=w55, enabled=w37, input valid=w57, FIFO in=w27, ch0/ch1=$"CCA.ch0/ch1") -> (ready for input=w60, data valid=w61, data=w62)
    call "IndexingCounter.gcdl"(signal=w60, N=256) -> (wrap back?=w30)
    call "Sensing_FIR.gcdl"(data in=w62, input valid=w61, CS.Control=$"CS1.Control", CCS.reset register="Needed Resources.grsc\\CCA.Reset", CCS.Status="Needed Resources.grsc\\CCA.Status") -> (CS.status=w63, valid_out=w64)
    $"CS1.status" <- w63
    call "niInstr Basic Elements v1 FPGA.lvlib__Count Up U64.gcdl"(increment=w64, reset=$"CS.reset counters") -> (count out=w65)
    $"CS1.Noframes" <- w65
    # #CodeRecommended - If you want to move the data directly to another LabVIEW FPGA device
    #  for further processing, you can replace the DMA FIFO with a Peer to Peer Writer FIFO.
    Not(x=w60) -> w66
    call "niInstr Basic Elements v1 FPGA.lvlib__Count Up U64.gcdl"(increment=w66, reset=$"CS.reset counters") -> (count out=w67)
    $"CS FFT over flow" <- w67
    # #CodeRecommended - For your custom data processing IP, you can add Target-Scoped FPGA FIFOs
    #  if you need to move data to a different clock domain.
    call "niInstr Basic Elements v1 FPGA.lvlib__Detect Rising Edge.gcdl"(signal=$"rx.abort") -> (edge detected=w68)
    Select(s=$"RX.switch channels", t=0, f=1) -> w69
    Array Index(array=w57) -> (out0[w69]=w70)
    Feedback Node(input=w71) -> w72
    Not(x=w72) -> w73
    call "Input Stream Control.gcdl"(input valid=w70, start trigger=w40, burst size=$"rx.samples to acquire", abort=w68, fifo timeout=w73, reset=$"rx.reset") -> (write stream=w74, state=w75, samples processed=w76, number of overflows=w77)
    call "Write FIFO (Multi-Channel).gcdl"(switch channels=$"RX.switch channels", data in=w55, enabled=w37, input valid=w74, reset=$"rx.reset", FIFO 0="Needed Resources.grsc\\RX.ADC to synch", T2H fifo reference="Needed Resources.grsc\\Dummy") -> (ready for input=w71)
    Array Index(array=w56) -> (out0[_]=w78, out1[_]=w79)
    $"rx 0.number of IQ data overflows" <- w78
    $"rx 1.number of IQ data overflows" <- w79
    $"rx.dsp reset done" <- w58
    $"rx.state" <- w75
    $"rx.samples processed" <- w76
    $"rx.number of overflows" <- w77
    $"DC correction. applied" <- w59
    $"DC correction. average" <- w54
    Build Array($"tx 0.stream enable", $"tx 1.stream enable") -> w80
    Build Array($"tx 0.stream enable", $"tx 1.stream enable") -> w81
    call "niInstr Basic Elements v1 FPGA.lvlib__Detect Rising Edge.gcdl"(signal=$"tx.abort") -> (edge detected=w82)
    Feedback Node(input=w83) -> w84
    Feedback Node(input=w85) -> w86
    call "Output Stream Control.gcdl"(start trigger=w41, burst size=$"tx.samples to generate", abort=w82, ready to read stream (T)=w86, fifo output valid=w84, reset=$"tx.reset") -> (read stream=w87, state=w88, samples processed=w89, number of underflows=w90)
    call "Read FIFO (Multi-Channel).gcdl"(enabled=w81, FIFO 0="Needed Resources.grsc\\TX.to DAC", ready for output=w87) -> (data out=w91, output valid=w83)
    # #CodeRecommended - If you want to pull data directly from another LabVIEW FPGA device,
    # you can replace the DMA FIFO with a Peer to Peer Reader FIFO.
    call "niInstr Basic Elements v1 FPGA.lvlib__Synchronous Latch.gcdl"(set=w83, clear=$"tx.reset") -> (out=w92)
    Logical And(w92, w86) -> w93
    w94 = T9 {0, "0x1FFFF", "0x1FFFF", 0, 0, 0, 0, 0, 0, 0, 0, "0x200000", "0x200000", 0}
    Property Node(instance in=w94, "gain"=$"tx 0.gain", "frequency shift"=$"tx 0.frequency shift", "phase"=$"tx 0.phase", "impairments"=$"tx 0.impairments", "input sample rate"=$"tx 0.input sample rate", "delay"=$"tx 0delay") -> (instance out=w95)
    w96 = T9 {0, "0x1FFFF", "0x1FFFF", 0, 0, 0, 0, 0, 0, 0, 0, "0x200000", "0x200000", 0}
    Property Node(instance in=w96, "delay"=$"tx 1.delay", "input sample rate"=$"tx 1.input sample rate", "gain"=$"tx 1.gain", "frequency shift"=$"tx 1.frequency shift", "phase"=$"tx 1.phase", "impairments"=$"tx 1.impairments") -> (instance out=w97)
    Build Array(w95, w97) -> w98
    call "DUC (Multi-Channel).gcdl"(data in=w91, enabled=w80, input valid=w93, DUC Parameters=w98, reset=$"tx.reset") -> (I data out=w99, Q data out=w100, number of overflows=w101, dsp reset done=w102, ready for input=w85)
    Array Index(array=w99) -> (out0[_]=w103, out1[_]=w104)
    # #CodeRecommended - For your custom data processing IP, you can add
    # Target-Scoped FPGA FIFOs if you need to move data to/from a different clock domain.
    Io Write(data=w103, reference in="RF 0/Tx/I")
    Io Write(data=w104, reference in="RF 1/Tx/I")
    Array Index(array=w100) -> (out0[_]=w105, out1[_]=w106)
    Io Write(data=w105, reference in="RF 0/Tx/Q")
    Io Write(data=w106, reference in="RF 1/Tx/Q")
    $"tx.state" <- w88
    Array Index(array=w101) -> (out0[_]=w107, out1[_]=w108)
    $"tx 0.number of IQ data overflows" <- w107
    $"tx.samples processed" <- w89
    $"tx 1.number of IQ data overflows" <- w108
    $"tx.dsp reset done" <- w102
    $"tx.underflows" <- w90
    stop if FALSE
  }
