vi "OFDM_reference.gvi"   [LabVIEW Communications System Design Suite 2.0.1]
outputs:
  "ofdm psd": waveform<f64>
  "Channel power host": f64[]
  "GFDM reference": u32[]
uses:
  NI::Analysis::Transforms::Complex FFT.gvi
diagram:
  for (N = 4) {
    call "gen_ref_OFDM.gvi"(N=512) -> (complex fixed-point=w3, unsigned=w4)
    append w4 to w1
    append w3 to w2
  }
  Reshape Array(inArray=w2, size=2048) -> w5
  To Double Precision Complex(number=w5) -> w6
  call "Complex FFT.gvi"(x=w6, shift?=TRUE, FFT size=2048) -> (FFT{x}=w7)
  Absolute Value(x=w7) -> w8
  Divide(x=w8, y=2048) -> w9
  Square(x=w9) -> w10
  Logarithm Base 10(x=w10) -> w11
  Multiply(w11, 10) -> w12
  Build Waveform Node(Y=w12, dt=39063) -> (output waveform=w13)
  $"ofdm psd" <- w13
  call "channel_power_float.gvi"(numeric array=w10) -> (Channel power db=w14)
  $"Channel power host" <- w14
  Reshape Array(inArray=w1, size=2048) -> w15
  $"GFDM reference" <- w15
