vi "Test_MRD to power.gvi"   [LabVIEW Communications System Design Suite 2.0.1]
panel controls:
  "stop": bool
  "in valid": bool
  "DC": FXP(9.6)
  "Threshold": FXP(9.6)
  "ch index": i32
  "reset": bool
panel indicators:
  "done": bool
  "nr.blocks": u32
  "ch array": bool[13]
  "Power array": FXP(9.6)[13]
  "ch power": FXP(9.6)
  "current sample": u16
  "ch ready": bool
  "reference power array": f64[]
uses:
  ::USRP::Interactive::MRD_to_Power_wrapper.gcdl
diagram:
  s1 = f64[] []  # shift register
  while (iteration -> i1) {
    Increment(x=i1) -> w1
    Reinterpret Number[RestrictToSameWordLength=True](data in=w1, type=UFXP(1.31) 0) -> (data out=w2)
    Logarithm Base 10(x=w2) -> w3
    Multiply(w3, 10) -> w4
    Build Array[ConcatenateInputs=True](s1, w4) -> w5
    $"reference power array" <- w5
    Wait(time to wait=1000)
    call "MRD_to_Power_wrapper.gcdl"(data in=w1, in valid=$"in valid", DC=$DC, Threshold=$Threshold, ch index=$"ch index", reset=$reset) -> (ch array=w6, Power array=w7, ch ready=w8, ch power=w9, done=w10, current sample=w11)
    Feedback Node(input=w10) -> w12
    Logical And(w10, not w12) -> w13
    case (w13) {
      frame False, Default { }
      frame True {
        Feedback Node(input=w14) -> w15
        Increment(x=w15) -> w14: u32
        $"nr.blocks" <- w14
      }
    }
    $"ch array" <- w6
    $"ch power" <- w9
    $done <- w10
    $"current sample" <- w11
    $"Power array" <- w7
    $"ch ready" <- w8
    next s1 = w5
    stop if $stop
  }
