vi "Test_PSD_256_reference.gvi"   [LabVIEW Communications System Design Suite 2.0.1]
panel controls:
  "Gain": f64
panel indicators:
  "Channel power": f64[]
  "PSD fixed": UFXP(0.32)[]
  "Channel power fixed": f64[13]
  "PSD": f64[]
  "error": f64
  "Graph fix": f64[]
  "Graph_2": f64[]
  "error_2": f64
  "sig": f64[][]
  "x / y": f64[]
  "log power": FXP(10.6)[10]
uses:
  ::USRP::Interactive::powerdB.gcdl
diagram:
  w1 = $Gain
  for (N = 4) {
    call "gen_ref_OFDM.gvi"(N=64, Gain=w1) -> (complex floating=w5, complex fixed-point=w6, error=w7)
    $error_2 <- w7
    append w5 to w2
    append w6 to w3
    append w5 to w4
  }
  Reshape Array(inArray=w3, size=256) -> w8
  call "PSD_256_fixed.gmrd"(Input=w8) -> (Output=w9)
  call "channel_power_fixed.gvi"(numeric array=w9) -> (Channel power=w10)
  for {
    w11 = each element of w10
    call "powerdB.gcdl"(linear power=w11, valid_in=TRUE) -> (log power=w13)
    append w13 to w12
  }
  Array Subset(array=w12, index0=3) -> w14
  Subtract(x=w14, y=-36) -> w15
  $"log power" <- w15
  Absolute Value(x=w4) -> w16
  $sig <- w16
  Logarithm Base 10(x=w10) -> w17
  Multiply(w17, 10) -> w18
  Subtract(x=w18, y=-36) -> w19
  $"Channel power fixed" <- w19
  Reshape Array(inArray=w2, size=256) -> w20
  call "PSD_256_float.gmrd"(Input=w20) -> (Output=w21)
  call "channel_power_float.gvi"(numeric array=w21) -> (Channel power=w22)
  To Double Precision Float(number=w10) -> w23
  Divide(x=w22, y=w23) -> w24
  $"x / y" <- w24
  $"PSD fixed" <- w9
  $PSD <- w21
  Subtract(x=w23, y=w22) -> w25
  Absolute Value(x=w25) -> w26
  Add Array Elements(numeric array=w26) -> (sum=w27)
  Divide(x=w27, y=13) -> w28
  $error <- w28
  Logarithm Base 10(x=w9) -> w29
  Multiply(w29, 10) -> w30
  Subtract(x=w30, y=-36) -> w31
  $"Graph fix" <- w31
  Logarithm Base 10(x=w21) -> w32
  Multiply(w32, 10) -> w33
  Max And Min(x=w33, y=-60) -> (max(x,y)=w34: f64[])
  $Graph_2 <- w34
  Logarithm Base 10(x=w22) -> w35
  Multiply(w35, 10) -> w36
  $"Channel power" <- w36
