vi "channel_power_fixed.gvi"   [LabVIEW Communications System Design Suite 2.0.1]
inputs:
  "numeric array": UFXP(1.31)[256]
outputs:
  "channel power": UFXP(2.30)[]
diagram:
  # 16 samples channel shift
  # 64 samples per channel
  for (N = 13) (iteration -> i1) {
    Scale By Power Of 2(n=4, x=i1) -> w2
    Array Subset(array=$"numeric array", index0=w2, length0=64) -> w3
    Add Array Elements(numeric array=w3) -> (sum=w4: UFXP(2.30) Saturate:ConvergentRounding)
    append w4 to w1
  }
  $"channel power" <- w1
