vi "channel_power_float.gvi"   [LabVIEW Communications System Design Suite 2.0.1]
inputs:
  "numeric array": f64[256]
outputs:
  "Channel power": f64[]
diagram:
  # 16 samples channel shift
  # 64 samples per channel
  for (N = 13) (iteration -> i1) {
    Scale By Power Of 2(n=4, x=i1) -> w2
    Array Subset(array=$"numeric array", index0=w2, length0=64) -> w3
    Add Array Elements(numeric array=w3) -> (sum=w4)
    append w4 to w1
  }
  $"Channel power" <- w1
