vi "gen_ref_OFDM.gvi"   [LabVIEW Communications System Design Suite 2.0.1]
inputs:
  "N": f64
  "error in": error
  "Gain": f64
outputs:
  "complex floating": c128[]
  "complex fixed-point": CFXP(1.15)[]
  "unsigned": u32[]
  "error out": error
  "error": f64
diagram:
  Math Node("N"=$N, "Gain"=$Gain, Error In=$"error in") -> ("x"=w1, Error Out=w2)
  ~~~
  d = zeros(N,1);
  x =[];
  for i=1:100
  d(1:N/8) = 2*(randi([0,1],N/8,1)-0.5)
  d(N-(1:N/8)+1) = 2*(randi([0,1],N/8,1)-0.5)
  x = Gain*1/sqrt(N)*ifft(d);
  end
  ~~~
  $"error out" <- w2
  Complex To Real Imaginary(x + iy=w1) -> (x=w3, y=w4)
  Real And Imaginary To Complex(x=w3, y=w4) -> w5
  To Complex Fixed Point(complex fixed-point type=CFXP(1.15) 0+0i, number=w5) -> w6
  Complex To Real Imaginary(x + iy=w6) -> (x=w7, y=w8)
  Reinterpret Number[RestrictToSameWordLength=True](data in=w8, type=u16 0) -> (data out=w9)
  Reinterpret Number[RestrictToSameWordLength=True](data in=w7, type=u16 0) -> (data out=w10)
  Join Numbers(high(x)=w9, low(x)=w10) -> w11
  $unsigned <- w11
  $"complex fixed-point" <- w6
  $"complex floating" <- w5
  To Double Precision Complex(number=w6) -> w12
  Subtract(x=w12, y=w5) -> w13
  Absolute Value(x=w13) -> w14
  Add Array Elements(numeric array=w14) -> (sum=w15)
  Divide(x=w15, y=$N) -> w16
  $error <- w16
