vi "test_FIR.gvi"   [LabVIEW Communications System Design Suite 2.0.1]
panel indicators:
  "Graph": f64[]
  "output": f64[][]
  "size(s)": i32
  "loop iteration": i32
  "selector": bool
  "Variable: x": c128[]
  "subarray": CFXP(1.15)[]
uses:
  ::USRP::Interactive::FIR20MHz.gcdl
  NI::Analysis::Transforms::Complex FFT.gvi
diagram:
  Math Node() -> ("x"=w1)
  ~~~
  N = 1024;
  d = zeros(N,1);
   d(1:256) = randi([-1,1],256,1);
   d(end-(0:255)) = randi([-1,1],256,1);
   x = zeros(N+2048+7+20,1);
   x(1:N) = ifft(d);

  ~~~
  To Complex Fixed Point(complex fixed-point type=CFXP(1.15) 0+0i, number=w1) -> w2
  s1 = CFXP(1.15)[] []  # shift register
  s2 = CFXP(7.33)[] []  # shift register
  for (iteration -> i1) {
    w3 = each element of w2
    call "FIR20MHz.gcdl"(sample in=w3, input valid=TRUE) -> (sample out=w4, output valid=w5, x + yi=w6)
    case (w5) {
      frame False, Default {
        w7 = s1
        w8 = s2
      }
      frame True {
        Build Array[ConcatenateInputs=True](s1, w4) -> w7
        Build Array[ConcatenateInputs=True](s2, w6) -> w8
        $selector <- w5
      }
    }
    $"loop iteration" <- i1
    next s1 = w7
    next s2 = w8
  }
  Array Size(array=s1) -> (size(s)=w9)
  $"size(s)" <- w9
  Array Subset(array=s1, index0=0, length0=1024) -> w10
  $subarray <- w10
  Array Subset(array=w2, index0=0, length0=1024) -> w11
  call "Complex FFT.gvi"(x=w11, shift?=TRUE, FFT size=1024) -> (FFT{x}=w12)
  Absolute Value(x=w12) -> w13
  Logarithm Base 10(x=w13) -> w14
  Multiply(w14, 10) -> w15
  $Graph <- w15
  Array Subset(array=s2, index0=0, length0=1024) -> w16
  call "Complex FFT.gvi"(x=w16, shift?=TRUE) -> (FFT{x}=w17)
  Absolute Value(x=w17) -> w18
  Logarithm Base 10(x=w18) -> w19
  Multiply(w19, 10) -> w20
  call "Complex FFT.gvi"(x=w10, shift?=TRUE) -> (FFT{x}=w21)
  Absolute Value(x=w21) -> w22
  Logarithm Base 10(x=w22) -> w23
  Multiply(w23, 10) -> w24
  Build Array(w24, w20) -> w25
  $output <- w25
