vi "test_Power_linear.gvi"   [LabVIEW Communications System Design Suite 2.0.1]
panel controls:
  "Variable: g": f64
  "milliseconds to wait": u32 = 100
panel indicators:
  "output valid": bool
  "x / y": f64
  "error out": error
  "x / y_2": f64
  "loop iteration": i32
  "Current index": u16
  "Pdb 1": f64
  "Pdb 1_2": f64
  "linear power_2": UFXP(2.36)[]
  "fixed 32": UFXP(2.30)[]
  "log powerarray": FXP(9.7)[]
  "log float": f64[]
  "Q": FXP(1.15)[]
  "I": FXP(1.15)[]
uses:
  ::USRP::Interactive::Power Measure.gcdl
  ::USRP::Interactive::powerDb_wrapper.gcdl
diagram:
  Math Node("g"=$"Variable: g") -> ("x"=w1, Error Out=w2)
  ~~~
  N=2*64;
  x = zeros(N+15,1);
  x (1:N) = randn(N,1)+i*rand(N,1)
  x= g*x /max(abs(x));
  ~~~
  for (iteration -> i1) {
    w3 = each element of w1
    Wait(time to wait=$"milliseconds to wait")
    call "Power Measure.gcdl"(sample in=w3, input valid=TRUE, reset=FALSE) -> (linear power=w4, output valid=w5, Current sample=w6)
    case (w5) {
      frame False, Default { }
      frame True {
        To Fixed Point(fixed-point type=UFXP(2.30) 0, number=w4) -> w7
        Feedback Node(input=w8) -> w9
        Build Array[ConcatenateInputs=True](w9, w7) -> w8
        $"fixed 32" <- w8
        Feedback Node(input=w10) -> w11
        Build Array[ConcatenateInputs=True](w11, w4) -> w10
        $"linear power_2" <- w10
        Logarithm Base 10(x=w4) -> w12
        Multiply(w12, 10) -> w13
        Feedback Node(input=w14) -> w15
        Build Array[ConcatenateInputs=True](w15, w13) -> w14
        $"log float" <- w14
      }
    }
    $"Current index" <- w6
    $"output valid" <- w5
    $"loop iteration" <- i1
    To Fixed Point(fixed-point type=UFXP(2.30) 0, number=w4) -> w16
    call "powerDb_wrapper.gcdl"(linear power=w16, valid_in=w5) -> (valid_out=w17, log power=w18)
    case (w17) {
      frame False, Default { }
      frame True {
        Feedback Node(input=w19) -> w20
        Build Array[ConcatenateInputs=True](w20, w18) -> w19
        $"log powerarray" <- w19
      }
    }
  }
  $"error out" <- w2
  Complex To Real Imaginary(x + iy=w1) -> (x=w21, y=w22)
  To Fixed Point(fixed-point type=FXP(1.15) 0, number=w21) -> w23
  $I <- w23
  To Fixed Point(fixed-point type=FXP(1.15) 0, number=w22) -> w24
  $Q <- w24
  Array Subset(array=w1, index0=0, length0=64) -> w25
  Absolute Value(x=w25) -> w26
  Square(x=w26) -> w27
  Add Array Elements(numeric array=w27) -> (sum=w28)
  Divide(x=w28, y=64) -> w29
  $"x / y" <- w29
  Logarithm Base 10(x=w29) -> w30
  Multiply(w30, 10) -> w31
  $"Pdb 1" <- w31
  Array Subset(array=w1, index0=64, length0=64) -> w32
  Absolute Value(x=w32) -> w33
  Square(x=w33) -> w34
  Add Array Elements(numeric array=w34) -> (sum=w35)
  Divide(x=w35, y=64) -> w36
  Logarithm Base 10(x=w36) -> w37
  Multiply(w37, 10) -> w38
  $"Pdb 1_2" <- w38
  $"x / y_2" <- w36
