vi "test_Sensing_FIR.gvi"   [LabVIEW Communications System Design Suite 2.0.1]
panel controls:
  "CS.Control": T1
panel indicators:
  "Graph": f64[]
  "output": f64[][]
  "size(s)": i32
  "loop iteration": i32
  "selector": bool
  "Variable: x": c128[]
  "subarray": c128[]
  "CS.status": T2
  "valid_out": bool
types:
  T1 = cluster{"reset measure": bool, "Power Offset": FXP(9.7), "Threshold": FXP(9.7)}
  T2 = cluster{"log power": FXP(9.7), "CCA": bool, "Current sample": u16}
uses:
  ::USRP::Interactive::FIR20MHz.gcdl
  ::USRP::Interactive::Sensing_FIR.gcdl
  NI::Analysis::Transforms::Complex FFT.gvi
diagram:
  Math Node() -> ("x"=w1)
  ~~~
  N = 1024;
  d = zeros(N,1);
   d(1:256) = randi([-1,1],256,1);
   d(end-(0:255)) = randi([-1,1],256,1);
   x = zeros(N+2048+7+20,1);
   x(1:N) = ifft(d);

  ~~~
  To Complex Fixed Point(complex fixed-point type=CFXP(1.15) 0+0i, number=w1) -> w2
  w3 = $"CS.Control"
  s1 = CFXP(1.15)[] []  # shift register
  s2 = CFXP(7.33)[] []  # shift register
  for (iteration -> i1) {
    w4 = each element of w2
    call "FIR20MHz.gcdl"(sample in=w4, input valid=TRUE) -> (sample out=w5, output valid=w6, full_debug=w7)
    case (w6) {
      frame False, Default {
        w8 = s1
        w9 = s2
      }
      frame True {
        Build Array[ConcatenateInputs=True](s1, w5) -> w8
        Build Array[ConcatenateInputs=True](s2, w7) -> w9
        $selector <- w6
      }
    }
    Complex To Real Imaginary(x + iy=w4) -> (x=w10, y=w11)
    Reinterpret Number[RestrictToSameWordLength=True](data in=w10, type=u16 0) -> (data out=w12)
    Reinterpret Number[RestrictToSameWordLength=True](data in=w11, type=u16 0) -> (data out=w13)
    Join Numbers(high(x)=w12, low(x)=w13) -> w14
    call "Sensing_FIR.gcdl"(data in=w14, input valid=TRUE, CS.Control=w3) -> (CS.status=w15, valid_out=w16)
    $"CS.status" <- w15
    $valid_out <- w16
    $"loop iteration" <- i1
    next s1 = w8
    next s2 = w9
  }
  Reciprocal(x=1024) -> w17
  Multiply(s1, w17) -> w18
  Array Size(array=w18) -> (size(s)=w19)
  $"size(s)" <- w19
  Array Subset(array=w18, index0=0, length0=1024) -> w20
  $subarray <- w20
  Array Subset(array=w2, index0=0, length0=1024) -> w21
  call "Complex FFT.gvi"(x=w21, shift?=TRUE, FFT size=1024) -> (FFT{x}=w22)
  Absolute Value(x=w22) -> w23
  Logarithm Base 10(x=w23) -> w24
  Multiply(w24, 10) -> w25
  $Graph <- w25
  Array Subset(array=s2, index0=0, length0=1024) -> w26
  call "Complex FFT.gvi"(x=w26, shift?=TRUE) -> (FFT{x}=w27)
  Absolute Value(x=w27) -> w28
  Logarithm Base 10(x=w28) -> w29
  Multiply(w29, 10) -> w30
  call "Complex FFT.gvi"(x=w20, shift?=TRUE) -> (FFT{x}=w31)
  Absolute Value(x=w31) -> w32
  Logarithm Base 10(x=w32) -> w33
  Multiply(w33, 10) -> w34
  Build Array(w34, w30) -> w35
  $output <- w35
