vi "test_abs.gvi"   [LabVIEW Communications System Design Suite 2.0.1]
panel controls:
  "stop": bool
  "in": CFXP(1.15)
panel indicators:
  "abs": UFXP(2.30)[]
  "absolute value": f64[]
  "loop iteration": i32
  "x^2": UFXP(2.30)
  "x^2_2": UFXP(2.30)
  "x": FXP(1.15)
  "y": FXP(1.15)
  "x_2": FXP(1.15)
  "y_2": FXP(1.15)
  "abs_2": UFXP(2.30)
  "abs_3": UFXP(2.30)
uses:
  ::USRP::Interactive::Abs squared.gcdl
diagram:
  Math Node() -> ("x"=w1)
  ~~~
  N=100;
  x = randn(N,1)+i*rand(N,1)
  x= x /max(abs(x));
  ~~~
  for {
    w2 = each element of w1
    call "Abs squared.gcdl"(in=w2, input valid=TRUE) -> (abs^2=w4)
    append w4 to w3
  }
  $abs <- w3
  Absolute Value(x=w1) -> w5
  Square(x=w5) -> w6
  $"absolute value" <- w6
  while (iteration -> i1) {
    call "Abs squared.gcdl"(in=$in, input valid=TRUE) -> (abs^2=w7)
    $abs_3 <- w7
    $abs_2 <- w7
    Complex To Real Imaginary(x + iy=$in) -> (x=w8, y=w9)
    $x <- w8
    $x_2 <- w8
    $y <- w9
    $y_2 <- w9
    Absolute Value(x=$in) -> w10
    Square(x=w10) -> w11
    $"x^2" <- w11
    $"x^2_2" <- w11
    $"loop iteration" <- i1
    stop if $stop
  }
