vi "multiplier_test.gvi"   [LabVIEW Communications System Design Suite 2.0.1]
inputs:
  "loop count": i32
  "Limit [%]": f64 = 0.1
outputs:
  "Test passed?": bool
panel indicators:
  "FPGA": CFXP(16.16)[]
  "Host": CFXP(16.16)[]
  "delta": CFXP(32.32)[]
  "FPGA_bin real": bool[][]
  "HOST_bin real": bool[][]
  "A": c128[]
  "B": c128[]
  "FPGA_bin imag": bool[][]
  "HOST_bin imag": bool[][]
uses:
  ::USRP::Interactive::modem_complex multiply_64bit.gcdl
diagram:
  for (N = $"loop count") (iteration -> i1) {
    Divide(x=i1, y=5) -> w10
    Random Number() -> (number (0 to 1)=w11)
    Random Number() -> (number (0 to 1)=w12)
    Subtract(x=w11, y=w12) -> w13
    Multiply(w10, w13) -> w14
    Random Number() -> (number (0 to 1)=w15)
    Random Number() -> (number (0 to 1)=w16)
    Subtract(x=w15, y=w16) -> w17
    Multiply(w10, w17) -> w18
    Real And Imaginary To Complex(x=w14, y=w18) -> w19
    To Complex Fixed Point(complex fixed-point type=CFXP(16.16) 0+0i, number=w19) -> w20: CFXP(16.16) Saturate:ConvergentRounding
    call "cfx_to_u64.gvi"(input=w20) -> (output=w21)
    Random Number() -> (number (0 to 1)=w22)
    Random Number() -> (number (0 to 1)=w23)
    Subtract(x=w22, y=w23) -> w24
    Multiply(w10, w24) -> w25
    Random Number() -> (number (0 to 1)=w26)
    Random Number() -> (number (0 to 1)=w27)
    Subtract(x=w26, y=w27) -> w28
    Multiply(w10, w28) -> w29
    Real And Imaginary To Complex(x=w25, y=w29) -> w30
    To Complex Fixed Point(complex fixed-point type=CFXP(16.16) 0+0i, number=w30) -> w31: CFXP(16.16) Saturate:ConvergentRounding
    call "cfx_to_u64.gvi"(input=w31) -> (output=w32)
    call "modem_complex multiply_64bit.gcdl"(valid in=TRUE, B=w32, A=w21) -> (data out=w33)
    Split Number(x=w33) -> (high(x)=w34, low(x)=w35)
    Number To Boolean Array(number=w34) -> (Boolean array=w36)
    Number To Boolean Array(number=w35) -> (Boolean array=w37)
    Feedback Node[DelayCount=10](input=w38) -> w39
    call "cfx_to_u64.gvi"(input=w39) -> (output=w40)
    Split Number(x=w40) -> (high(x)=w41, low(x)=w42)
    Number To Boolean Array(number=w41) -> (Boolean array=w43)
    Number To Boolean Array(number=w42) -> (Boolean array=w44)
    call "u64_to_cfx.gvi"(input=w33) -> (output=w45)
    Subtract(x=w45, y=w39) -> w46: CFXP(32.32) Saturate:ConvergentRounding
    Multiply(w19, w30) -> w47: c128
    To Complex Fixed Point(complex fixed-point type=CFXP(16.16) 0+0i, number=w47) -> w48: CFXP(16.16) Saturate:ConvergentRounding
    Complex To Real Imaginary(x + iy=w48) -> (x=w49, y=w50)
    Real And Imaginary To Complex(x=w49, y=w50) -> w38
    append w45 to w1
    append w39 to w2
    append w46 to w3
    append w36 to w4
    append w43 to w5
    append w19 to w6
    append w30 to w7
    append w37 to w8
    append w44 to w9
  }
  Delete From Array(inArray=w1, length (1)=10) -> w51
  $FPGA <- w51
  Delete From Array(inArray=w4, length (1)=10) -> w52
  $"FPGA_bin real" <- w52
  Delete From Array(inArray=w5, length (1)=10) -> w53
  $"HOST_bin real" <- w53
  Delete From Array(inArray=w2, length (1)=10) -> w54
  call "compare_elements.gvi"(reference=w54, array=w51, limit=$"Limit [%]") -> (equal=w55)
  $"Test passed?" <- w55
  Delete From Array(inArray=w3, length (1)=10) -> w56
  $delta <- w56
  $Host <- w54
  $A <- w6
  $B <- w7
  Delete From Array(inArray=w8, length (1)=10) -> w57
  $"FPGA_bin imag" <- w57
  Delete From Array(inArray=w9, length (1)=10) -> w58
  $"HOST_bin imag" <- w58
