vi "GFDM_counter_host.gvi"   [LabVIEW NXG]
inputs:
  "reset": bool
  "M-1": f64
  "K-1": f64
  "tick": bool
  "configuration_request": bool
outputs:
  "block_end": bool
  "block_start": bool
  "first subsymbol": bool
  "new subsymbol": bool
  "n": f64
  "m": f64
  "k": f64
  "ready_for_config": bool
diagram:
  Feedback Node(Input=w1) -> (Output=w2)
  Increment(x=w2) -> w3
  Select(s=$tick, t=w3, f=w2) -> w4
  Is Greater(x=w4, y=$"K-1") -> w5
  Logical Or(w5, $reset) -> w6
  Select(s=w6, t=0, f=w4) -> w1
  $k <- w1
  Is Equal To 0(x=w1) -> w7
  $"new subsymbol" <- w7
  Feedback Node(Input=w8) -> (Output=w9)
  Increment(x=w9) -> w10
  Logical And(w5, $tick) -> w11
  Select(s=w11, t=w10, f=w9) -> w12
  Is Greater(x=w12, y=$"M-1") -> w13
  Logical Or(w13, $reset) -> w14
  Select(s=w14, t=0, f=w12) -> w8
  $m <- w8
  Is Equal To 0(x=w8) -> w15
  $"first subsymbol" <- w15
  Is Equal(x=w8, y=$"M-1") -> w16
  Is Equal(x=w1, y=$"K-1") -> w17
  Logical And(w17, w16) -> w18
  $block_end <- w18
  Feedback Node(Input=w19) -> (Output=w20)
  Increment(x=w20) -> w21
  Select(s=$tick, t=w21, f=w20) -> w22
  Logical Or($reset, w14) -> w23
  Select(s=w23, t=0, f=w22) -> w19
  $n <- w19
  Is Equal To 0(x=w19) -> w24
  $block_start <- w24
  Logical And(w26, not w24) -> w25
  # store and reset signal
  Feedback Node(Input=w25) -> (Output=w27)
  Logical Or(w27, $configuration_request) -> w26
  Logical And(w26, w24) -> w28
  # store and reset signal
  Feedback Node(Input=w29) -> (Output=w30)
  Logical Or(w30, w28) -> w31
  Feedback Node(Input=w18) -> (Output=w32)
  Logical And(w31, not w32) -> w29
  $ready_for_config <- w29
