vi "GFDM_counter_test.gvi"   [LabVIEW Communications System Design Suite 2.0.1]
panel controls:
  "K-1": u16 = 3
  "M-1": u8 = 2
panel indicators:
  "Graph": i32[][]
uses:
  ::USRP::Interactive::GFDM_counter.gcdl
diagram:
  w1 = $"K-1"
  w2 = $"M-1"
  Increment(x=w1) -> w3
  Increment(x=w2) -> w4
  Multiply(w3, w4, 3) -> w5
  Initialize Array(element=TRUE, size=w5) -> w6
  Build Array[ConcatenateInputs=True]([FALSE, FALSE, FALSE], TRUE, FALSE, TRUE, FALSE, w6) -> w7
  for {
    w8 = each element of w7
    Feedback Node(input=w8) -> w17
    call "convert boolean to number.gvi"(Numeric Constant=5, boolean=w17) -> (element=w18)
    Feedback Node(input=w8) -> w19
    Is First Call() -> w20
    call "GFDM_counter.gcdl"(reset=w20, K-1=w1, tick=w19, M-1=w2) -> (is first subsymbol=w21, GFDM block end=w22, subsymbol start=w23, GFDM block start=w24, idx_m=w25, idx_k=w26, idx_n=w27)
    call "convert boolean to number.gvi"(Numeric Constant=1, boolean=w23) -> (element=w28)
    call "convert boolean to number.gvi"(Numeric Constant=2, boolean=w21) -> (element=w29)
    call "convert boolean to number.gvi"(Numeric Constant=3, boolean=w24) -> (element=w30)
    call "convert boolean to number.gvi"(Numeric Constant=4, boolean=w22) -> (element=w31)
    append w26 to w9
    append w25 to w10
    append w27 to w11
    append w28 to w12
    append w29 to w13
    append w30 to w14
    append w31 to w15
    append w18 to w16
  }
  Build Array(w9, w10, w11, w12, w13, w14, w15, w16) -> w32
  $Graph <- w32
