vi "count one gfdm block test.gvi"   [LabVIEW NXG]
panel indicators:
  "Graph": u32[][]
uses:
  ::Project::USRP::count one gfdm block.gcdl
  ::Project::USRP::resource_mapper_ctrl.gcdl
diagram:
  Math Node() -> ("K_1"=w1, "M_1"=w2, "N"=w3, "ready_for_output"=w4, "fetch_data"=w5, "reset"=w6, "resource_map"=w7)
  ~~~
  K = 4;
  M = 3;
  N = K * M;
  K_1 = K - 1;
  M_1 = M - 1;

  fetch_data = zeros(N*5, 1);
  fetch_data(5) = 1;
  fetch_data(6) = 1;
  fetch_data(7) = 1;
  fetch_data(20) = 1;
  fetch_data(35) = 1;
  reset = zeros(length(fetch_data), 1);
  reset(1) = 1;
  reset(25) = 1;
  ready_for_output = ones(length(fetch_data), 1);

  resource_map = zeros(1, N);
  pattern = [1 1 2];
  resource_map = repmat(pattern, 1, round(N / length(pattern)) + 1);
  ~~~
  for {
    w8 = each element of w5
    w9 = each element of w4
    w10 = each element of w6
    call "count one gfdm block.gcdl"(fetch data=w8, ready for output=w9, K-1=w1, M-1=w2, reset=w10) -> (idx_n=w16, block end=w17, valid=w18)
    Boolean To Integer(Boolean=w18) -> (0, 1=w19)
    Boolean To Integer(Boolean=w17) -> (0, 1=w20)
    Multiply(w20, 2) -> w21
    Array Index(array=w7) -> (out0[w16]=w22)
    call "resource_mapper_ctrl.gcdl"(resouce map item=w22, block end=w17, reset=w10, valid=w18) -> (get data=w23, trainings sequence address=w24)
    Boolean To Integer(Boolean=w23) -> (0, 1=w25)
    Multiply(3, w25) -> w26
    Is Greater(x=w24, y=w3) -> w27
    Select(s=w27, t=0, f=w24) -> w28
    append w16 to w11
    append w19 to w12
    append w21 to w13
    append w26 to w14
    append w28 to w15
  }
  Build Array(w11, w12, w13, w14, w15) -> w29
  $Graph <- w29
