vi "count_one_subsymbol_test.gvi"   [LabVIEW NXG]
inputs:
  "K": u16 = 4
panel indicators:
  "k_idx": u16[]
  "valid": i16[]
uses:
  ::Project::USRP::count_one_subsymbol.gcdl
diagram:
  Multiply(8, $K) -> w1
  Multiply($K, 4) -> w2
  for (N = w1) (iteration -> i1) {
    Is Equal(x=w2, y=i1) -> w5
    Is Equal(x=3, y=i1) -> w6
    Logical Or(w5, w6) -> w7
    Is First Call() -> w8
    call "count_one_subsymbol.gcdl"(Do it!=w7, reset=w8, K=$K) -> (valid=w9, k_idx=w10)
    Boolean To Integer(Boolean=w9) -> (0, 1=w11)
    append w10 to w3
    append w11 to w4
  }
  $valid <- w4
  $k_idx <- w3
