vi "last value counter test.gvi"   [LabVIEW NXG]
panel indicators:
  "Graph": u32[][]
uses:
  ::Project::USRP::last value counter.gcdl
diagram:
  Math Node() -> ("data"=w1, "K"=w2, "N"=w3, "reset"=w4)
  ~~~
  N = 60;
  K = 8;

  reset = zeros(1, N);
  reset(3) = 1;

  data = zeros(1,N);
  data(10:N) = 1
  ~~~
  for (N = w3) {
    w5 = each element of w1
    w6 = each element of w4
    call "last value counter.gcdl"(data_in_valid=w5, K=w2, reset=w6) -> (data_in_last out=w9, count=w10)
    append w9 to w7
    append w10 to w8
  }
  Boolean To Integer(Boolean=w7) -> (0, 1=w11)
  Multiply(w11, 1) -> w12
  Boolean To Integer(Boolean=w1) -> (0, 1=w13)
  Multiply(2, w13) -> w14
  Boolean To Integer(Boolean=w4) -> (0, 1=w15)
  Multiply(w15, 3) -> w16
  Build Array(w8, w12, w14, w16) -> w17
  $Graph <- w17
