vi "test toggle register.gvi"   [LabVIEW NXG]
panel indicators:
  "Graph": i16[][]
uses:
  ::Project::USRP::toggle register.gcdl
diagram:
  Math Node() -> ("falling_edge"=w1, "reset"=w2, "toggle"=w3)
  ~~~
  toggle = [0,1,0,1,1,0,0,1,0,0,0];

  falling_edge = [zeros(1, length(toggle)),ones(1, length(toggle))];

  toggle = repmat(toggle, 1, 2);

  reset = zeros(1, length(toggle));
  reset(9) = 1;
  reset(length(toggle) - 2) = 1;
  ~~~
  for {
    w4 = each element of w3
    w5 = each element of w1
    w6 = each element of w2
    Boolean To Integer(Boolean=w4) -> (0, 1=w11)
    Multiply(1, w11) -> w12
    Boolean To Integer(Boolean=w5) -> (0, 1=w13)
    Multiply(2, w13) -> w14
    Boolean To Integer(Boolean=w6) -> (0, 1=w15)
    Multiply(3, w15) -> w16
    call "toggle register.gcdl"(falling edge?=w5, toggle=w4, clear=w6) -> (output=w17)
    Boolean To Integer(Boolean=w17) -> (0, 1=w18)
    Multiply(4, w18) -> w19
    append w12 to w7
    append w14 to w8
    append w16 to w9
    append w19 to w10
  }
  Build Array(w7, w8, w9, w10) -> w20
  $Graph <- w20
