vi "Read Packet FIFO toplevel.gvi"   [LabVIEW Communications System Design Suite 2.0.1]
panel controls:
  "length": u32
  "reset": bool
panel indicators:
  "number of packets": u64
  "number of samples": u64
  "FIFO overflow": u64
  "number of invalid samples": u64
  "number of cycles": u64
diagram:
  clock-driven loop (clock = "USRP Resources.grsc\\210 MHz") forever {
    call "Read packet from FIFO 32 bit.gcdl"(length=$length, reference in="USRP Resources.grsc\\data in", reset=$reset) -> (data_out=w1, valid_out=w2)
    Not(x=w2) -> w3
    call "niInstr Basic Elements v1 FPGA.lvlib__Count Up U64.gcdl"(increment=w3, reset=$reset) -> (count out=w4)
    $"number of invalid samples" <- w4
    FIFO Write(Control Protocol Input=w2, data=w1, reference in="USRP Resources.grsc\\data out") -> (Control Protocol Output=w5)
    Logical And(not w5, w2) -> w6
    call "niInstr Basic Elements v1 FPGA.lvlib__Count Up U64.gcdl"(increment=w6, reset=$reset) -> (count out=w7)
    $"FIFO overflow" <- w7
    call "modem_DEBUG_counter_64.gcdl"(signal in=w2, reset counter=$reset) -> (number of changes=w8, high count out=w9)
    $"number of packets" <- w8
    $"number of samples" <- w9
    call "niInstr Basic Elements v1 FPGA.lvlib__Count Up U64.gcdl"(increment=TRUE, reset=$reset) -> (count out=w10)
    $"number of cycles" <- w10
  }
