vi "Read packet from FIFO 32 bit test.gvi"   [LabVIEW Communications System Design Suite 2.0.1]
panel controls:
  "loop count": i32 = 20
panel indicators:
  "Graph": u32[]
  "loop iteration": i32
uses:
  ::USRP::Interactive::Read packet from FIFO 32 bit wrapper.gcdl
diagram:
  Add($"loop count", 5) -> w1
  for (N = w1) (iteration -> i1) {
    append i1 to w2
  }
  Divide(x=$"loop count", y=2) -> w3
  while (iteration -> i2) {
    Feedback Node[DelayCount=10](input=TRUE) -> w5
    call "toggle_output.gvi"(toggle=w5) -> (output=w6)
    Is First Call() -> w7
    call "fifo simulator_32.gvi"(ready for output=w6, Array=w2, reset=w7) -> (element=w8, valid=w9)
    Feedback Node[DelayCount=65](input=TRUE) -> w10
    Is First Call() -> w11
    call "Read packet from FIFO 32 bit wrapper.gcdl"(input valid=w9, data=w8, reset=w11, length=w3, ready for packet=w10) -> (valid_out=w12, data_out=w13)
    $"loop iteration" <- i2
    Is Greater(x=i2, y=200) -> w14
    append w13 to w4 if w12
    stop if w14
  }
  $Graph <- w4
