vi "test frame repeater host.gvi"   [LabVIEW Communications System Design Suite 2.0.1]
panel controls:
  "miliseconds to wait": u32
  "n frames": i32
  "Nsleep": i32
  "akivate repeatiotion": bool
  "Preamble K": u16
  "Ncp": u16
  "Ncs": u16
  "GFDM M": u16
  "GFDM K": u16
  "RX.sync.config": T2
panel indicators:
  "data In": u32[][]
  "description": string  # source out indicates the source of the error.
  "error?": bool  # error? returns TRUE if an error occurs. If this VI finds an error, it sets the parameters in the error cluster.
  "error out": error
types:
  T1 = cluster{"missingSignalThresholdInSampels": u32, "GainIn": UFXP(5.1), "enableAnalogGainControl": bool, "enableDigitalGainController": bool, "enableDCremover": bool, "PiControl": UFXP(1.15), "setpointMaxAmplitude": UFXP(0.15), "NumbOfValidSamplesBetweenGainChange": u32, "permissibleControlError": UFXP(5.1)}
  T2 = cluster{"Metric peak threshold": UFXP(1.16), "MetricThresholdMode": bool, "CFO removal": bool, "ffoPiControlCte": FXP(2.17), "shift_threshold": i16, "min_threshold": UFXP(1.16), "  AGC": T1}
  T3 = cluster{"Preamble mu": u16, "GFDM B": u16, "Preamble K": u16, "Preamble Ncp": u16, "GFDM Ncp": u16, "GFDM M": u16, "Preamble Ncs": u16, "GFDM K": u16, "GFDM Ncs": u16, "Preamble M": u16}
diagram:
  w1 = $Ncp
  w2 = $Ncs
  Multiply($"GFDM M", $"GFDM K") -> w3
  Multiply($"Preamble K", 2) -> w4
  Add(w2, w1, w4) -> w5
  Add(w1, w2, w3) -> w6
  call "Reset FPGA.gvi"(USRP RIO device="RIO0") -> (error out=w7, USRP RIO device out=w8)
  FPGA Open Node[ProjectItem=":USRP:Bitfile_test", TopVITarget=":USRP:Bitfile_test:test\\ frame\\ repeater\\ top\\.gvi"](RIO address=w8, error in=w7, run?=TRUE) -> (error out=w9, reference out=w10)
  Host Fifo Configure Node[FifoName="Resource Mapper Resources.grsc\\TX.RM.H2T.payload in"](depth=1000000, error in=w9, reference in=w10) -> (actual depth=w11, error out=w12, reference out=w13)
  disable {
    frame Enabled {
      w14 = w13
      w15 = w12
    }
    frame Disabled {
      Host Fifo Configure Node[FifoName="Resource Mapper Resources.grsc\\TX.RM.H2T.payload in"](depth=w11, error in=w12, reference in=w13) -> (error out=w15, reference out=w14)
    }
  }
  Host Fifo Start Node[FifoName="Resource Mapper Resources.grsc\\TX.RM.H2T.payload in"](error in=w15, reference in=w14) -> (error out=w16, reference out=w17)
  disable {
    frame Enabled {
      w18 = w17
      w19 = w16
    }
    frame Disabled {
      Host Fifo Start Node[FifoName="Needed Resources.grsc\\Data out"](error in=w16, reference in=w17) -> (error out=w19, reference out=w18)
    }
  }
  # w5: preambleSize
  Add(w5, w6) -> w20
  Decrement(x=$Nsleep) -> w21
  Decrement(x=w21) -> w22
  Decrement(x=w22) -> w23
  In Range And Coerce(lower limit=2, upper limit=100000, x=w23) -> (coerced(x)=w24)
  call "[TX] UDP Source.gvi"(simulate=TRUE, PayloadSize=$"Preamble K") -> (DataOut=w25)
  To Unsigned Long Integer(number=w25) -> w26
  call "u32 array to 2.14 CFX.gvi"(data=w26) -> (Array=w27)
  call "norm_to_CFX_4.12.gvi"(Input=w27) -> (Output=w28)
  Property Node(instance in=T3 {all zero or empty}, "Preamble mu"=1, "GFDM B"=1, "Preamble K"=$"Preamble K", "Preamble Ncp"=w1, "GFDM Ncp"=w1, "GFDM M"=$"GFDM M", "Preamble Ncs"=w2, "GFDM K"=$"GFDM K", "GFDM Ncs"=w2) -> (instance out=w29)
  # w6: PayloadSize
  Property Node(instance in=w18, "B*NpayCpCs"=w6, "NpreCpCs"=w5, "waitForSamples"=TRUE, "Nsleep-3"=w24, "frame length"=w20, "aktivate repeatiotion"=$"akivate repeatiotion", "RX.sync.config"=$"RX.sync.config", "RX.sync.GFDM configuration cluster"=w29, "RX.sync.halfPreambleVectorIn"=w28, "RX.sync.input enable_in"=TRUE, error in=w19) -> (error out=w30, instance out=w31)
  call "[TX] UDP Source.gvi"(simulate=TRUE, PayloadSize=w5) -> (DataOut=w32)
  Dynamic Fpga Interface Cast(reference in=w31, type=any constant) -> (reference out=w33)
  call "configFMUX.gvi"(FPGA host interface out=w33, error out=w30, preamble=w32) -> (FPGA.Interface=w34, Error=w35)
  Dynamic Fpga Interface Cast(reference in=w34, type=w31) -> (reference out=w36)
  w37 = $"n frames"
  for (N = w37) (iteration -> i1) {
    Decrement(x=w3) -> w39
    call "[TX] UDP Source.gvi"(simulate=TRUE, error in=w35, PayloadSize=w39, generate.dataType=TRUE) -> (DataOut=w40, ErrorOut=w41)
    To Unsigned Byte Integer(number=i1) -> w42
    Build Array[ConcatenateInputs=True](w42, w40) -> w43
    disable {
      frame Enabled {
        To Unsigned Long Integer(number=w43) -> w44
      }
      frame Disabled {
        call "CP+CS.gvi"(data in=w43, Ncp=w1, Ncs=w2) -> (data out=w45)
        Complex To Real Imaginary(x + iy=w45) -> (x=w46)
        To Unsigned Long Integer(number=w46) -> w44
      }
    }
    Host Fifo Write Node[FifoName="Resource Mapper Resources.grsc\\TX.RM.H2T.payload in"](data=w44, error in=w41, reference in=w36, timeout (ms)=-1) -> (error out=w47, reference out=w48)
    $"error out" <- w47
    Wait(time to wait=$"miliseconds to wait")
    append w44 to w38
  }
  $"data In" <- w38
  while {
    Wait(time to wait=10000)
    stop if TRUE
  }
  FPGA Abort Node(error in=w47, reference in=w48)
  call "Display Error.gvi"(error in=w35) -> (error?=w49, description=w50)
  $"error?" <- w49
  $description <- w50
  call "CP+CS.gvi"(data in=w28, Ncp=w1, Ncs=w2) -> (data out=w51)
  for {
    w52 = each element of w51
    call "4.12_cfx_to_u32.gvi"(input=w52) -> (output=w53)
  }
