vi "test frame repeater top.gvi"   [LabVIEW Communications System Design Suite 2.0.1]
panel controls:
  "config.PreambleCpCsSampleIn": "CE_signalsType.gtype"
  "NpreCpCs": u16
  "B*NpayCpCs": u16
  "waitForSamples": bool
  "frame length": u16
  "Nsleep-3": u32
  "aktivate repeatiotion": bool
  "RX.sync.GFDM configuration cluster": T1 = {"Preamble mu"=1, "GFDM B"=3, "Preamble K"=128, "Preamble Ncp"=32, "GFDM Ncp"=32, "GFDM M"=5, "Preamble Ncs"=16, "GFDM K"=128, "GFDM Ncs"=16, "Preamble M"=2}
  "RX.sync.input enable_in": bool
  "RX.sync.halfPreambleVectorIn": CFXP(4.12)[64]
  "RX.sync.config": "SyncConfig.gtype"
  "AGC.config": T3 = {"Destination"="configRx", "antenna configuration"="TX1 RX1 transmits and RX2 receives", "daughterboard"="sbx", "spi address"=7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}
  "RX.sync.preambleOutFifoActive": bool
  "TX.sync.preambleOrAllData": bool
  "AGC.disableAGC": bool
panel indicators:
  "config.PreambleCpCsSampleOut": "CE_signalsType.gtype"
  "data out": u32
  "output valid": bool
  "count out": u16
  "RX.sync.sync found_out": u32
  "RX.sync.lastWrittenRxGain": UFXP(5.1)
  "RX.sync.syncPaketDicarded": u32
  "loop iteration": i32
  "data": u32
  "output valid_2": bool
types:
  "CE_signalsType.gtype" = cluster{"data": u32, "valid": bool, "index": u16}
  T1 = cluster{"Preamble mu": u16, "GFDM B": u16, "Preamble K": u16, "Preamble Ncp": u16, "GFDM Ncp": u16, "GFDM M": u16, "Preamble Ncs": u16, "GFDM K": u16, "GFDM Ncs": u16, "Preamble M": u16}
  T2 = cluster{"missingSignalThresholdInSampels": u32, "GainIn": UFXP(5.1), "enableAnalogGainControl": bool, "enableDigitalGainController": bool, "enableDCremover": bool, "PiControl": UFXP(1.15), "setpointMaxAmplitude": UFXP(0.15), "NumbOfValidSamplesBetweenGainChange": u32, "permissibleControlError": UFXP(5.1)}
  "SyncConfig.gtype" = cluster{"Metric peak threshold": UFXP(1.16), "MetricThresholdMode": bool, "CFO removal": bool, "ffoPiControlCte": FXP(2.17), "shift_threshold": i16, "min_threshold": UFXP(1.16), "  AGC": T2}
  "niUsrpRio Config v1 Host.lvlib__Antenna Configuration.gtype" = enum{"TX1 RX1 transmits and RX2 receives", "TX1 RX1 receives and RX2 is unused"}
  "niUsrpRio Config v1 Host.lvlib__DB Types.gtype" = enum{"sbx", "cbx", "wbx", "unknown", "ubx"}
  T3 = cluster{"set": bool, "lo lpf": bool, "cpld ": bool, "switchChannel": bool, "Destination": enum{"configRx", "configTx"}, "antenna configuration": "niUsrpRio Config v1 Host.lvlib__Antenna Configuration.gtype", "daughterboard": "niUsrpRio Config v1 Host.lvlib__DB Types.gtype", "GainIn": UFXP(5.1), "spi address": u8}
  T4 = cluster{"Data": u32, "frame first sample": bool, "frame last sample": bool}
diagram:
  w1 = T4 {"Data"=0, "frame first sample"=TRUE, "frame last sample"=FALSE}
  FIFO Create(data type=w1) -> (reference out=w2)
  clock-driven loop (clock = "Needed Resources.grsc\\150 MHz") (iteration -> i1) forever {
    Feedback Node(input=w3) -> w4
    call "Read packet from FIFO 32 bit.gcdl"(length=$"B*NpayCpCs", reference in="Resource Mapper Resources.grsc\\TX.RM.H2T.payload in", ready for packet=w4) -> (data_out=w5, valid_out=w6)
    Add($NpreCpCs, $"B*NpayCpCs") -> w7
    Feedback Node[DelayCount=10](input=w5) -> w8
    Feedback Node[DelayCount=10](input=w6) -> w9
    call "FMUX_preamble_insertion_pk.gcdl"(dataIn=w8, NpreCpCs=$NpreCpCs, B*NpayCpCs=$"B*NpayCpCs", dataValidIn=w9, waitForSamples=$waitForSamples, config.PreambleCpCsSampleIn=$"config.PreambleCpCsSampleIn") -> (DataOutValid=w10, DataOut=w11, frame first sample=w12, frame last sample=w13)
    w14 = T4 {"Data"=0, "frame first sample"=TRUE, "frame last sample"=FALSE}
    Property Node(instance in=w14, "Data"=w11, "frame first sample"=w12, "frame last sample"=w13) -> (instance out=w15)
    FIFO Write(Control Protocol Input=w10, data=w15, reference in=w2) -> (reference out=w16)
    Property Node(instance in=w16) -> ("free elements"=w17)
    Is Greater Or Equal(x=w17, y=w7) -> w3
    Feedback Node(input=$"config.PreambleCpCsSampleIn") -> w18
    $"config.PreambleCpCsSampleOut" <- w18
    $"loop iteration" <- i1
  }
  FIFO Create(data type=u32 0, depth=37) -> (reference out=w19)
  clock-driven loop (clock = "40 MHz Onboard Clock") forever {
    Feedback Node(input=w20) -> w21
    call "read FIFO & repeat.gcdl"(enabled=[TRUE, FALSE], ready for output=w21, FPGA.Fifo=w2, frame length=$"frame length", Nsleep-3 (min is 2)=$"Nsleep-3", akivate repeatiotion=$"aktivate repeatiotion") -> (data out=w22, output valid=w23)
    Array Index(array=w22) -> (out0[_]=w24)
    call "niInstr DSP v1 FPGA.lvlib__IQ Data to U32.gcdl"(IQ data=w24) -> (U32 data=w25)
    $"data out" <- w25
    $"output valid" <- w23
    call "SwitchIQ.gcdl"(data_in=w25) -> (data_out=w26)
    FIFO Write(Control Protocol Input=w23, data=w26, reference in=w19) -> (Control Protocol Output=w20)
    call "niInstr Basic Elements v1 FPGA.lvlib__Detect Rising Edge.gcdl"() -> (edge detected=w27)
    call "niInstr Basic Elements v1 FPGA.lvlib__Detect Falling Edge.gcdl"() -> (edge detected=w28)
    call "niInstr Basic Elements v1 FPGA.lvlib__Synchronous Latch.gcdl"(set=w28, clear=w27) -> (out=w29)
    call "niInstr Basic Elements v1 FPGA.lvlib__Count Up U16.gcdl"(increment=w29, reset=w27) -> (count out=w30)
    $"count out" <- w30
  }
  clock-driven loop (clock = "USRP Resources.grsc\\DerivedClock30") forever {
    FIFO Read(Control Protocol Input=TRUE, reference in=w19) -> (Control Protocol Output=w31, data=w32)
    $data <- w32
    $"output valid_2" <- w31
  }
  disable {
    frame Enabled { }
    frame Disabled {
      # w33: preamble
      FIFO Create(data type=u64 0, depth=2049) -> (reference out=w33)
      # w34: payload
      FIFO Create(data type=u64 0, depth=4097) -> (reference out=w34)
      clock-driven loop (clock = "40 MHz Onboard Clock") forever {
        Feedback Node(input=w35) -> w36
        call "4.12 cfx to u32.gcdl"(input=w36) -> (output=w37)
        Feedback Node(input=w38) -> w39
        Logical And(w39, $"RX.sync.preambleOutFifoActive") -> w40
        # to host
        FIFO Write(Control Protocol Input=w40, data=w37, reference in="Needed Resources.grsc\\RX.Preamble out")
        Feedback Node(input=$"RX.sync.GFDM configuration cluster") -> w41
        Feedback Node(input=w42) -> w43
        Feedback Node(input=w44) -> w45
        call "Sync_K64_TUDwrapper_pk.gcdl"(validIn=w45, GFDM configuration cluster=w41, dataIn=w43, Config=$"RX.sync.config", halfPreambleVectorIn=$"RX.sync.halfPreambleVectorIn") -> (dataOut=w35, dataValidOut=w46, SynchronizationFoundOut=w47, preambleStart=w48, preambleValid=w49, gfdmSymbolValid=w50, PreambleValidCount=w51, PayloadValidCount=w52, AnalogGainOut=w53, setAnalogGain=w54, Npay_withoutCpCs=w55)
        Select(s=$"TX.sync.preambleOrAllData", t=w46, f=w49) -> w38
        # Synchronizer + AGC
        FIFO Read(Control Protocol Input=TRUE, reference in=w19) -> (Control Protocol Output=w56, data=w57)
        call "SwitchIQ.gcdl"(data_in=w57) -> (data_out=w58)
        call "u32 to 4.12 cfx.gcdl"(data in=w58) -> (data out=w42)
        Logical And(w56, $"RX.sync.input enable_in") -> w44
        Feedback Node(input=w51) -> w59
        Join Numbers(high(x)=w59, low(x)=0) -> w60
        Join Numbers(high(x)=w37, low(x)=w60) -> w61
        Feedback Node(input=w49) -> w62
        call "Sync.avoidFifoOverflow.gcdl"(FPGA.Fifo=w34, paketLength=w55, firstSampleValid=w48) -> (packetDiscarded=w63, paketValidOut=w64)
        Logical And(w62, w64) -> w65
        # preamble
        FIFO Write(Control Protocol Input=w65, data=w61, reference in=w33)
        Feedback Node(input=w52) -> w66
        Join Numbers(high(x)=w66, low(x)=0) -> w67
        Join Numbers(high(x)=w37, low(x)=w67) -> w68
        Feedback Node(input=w50) -> w69
        Logical And(w69, w64) -> w70
        # payload
        FIFO Write(Control Protocol Input=w70, data=w68, reference in=w34)
        Feedback Node(input=w47) -> w71
        call "Reset.gcdl"() -> (reset counter=w72)
        call "niInstr Basic Elements v1 FPGA.lvlib__Count Up U32.gcdl"(increment=w71, reset=w72) -> (count out=w73)
        Feedback Node(input=w73) -> w74
        $"RX.sync.sync found_out" <- w74
        disable {
          frame Enabled {
            w75 = default
          }
          frame Disabled {
            Not(x=$"AGC.disableAGC") -> w76
            Logical And(w54, w76) -> w77
            call "setATRwrapper.gcdl"(RxGainIn=w53, setRxGainIn=w77, conf=$"AGC.config") -> (sync.lastWrittenRxGain=w75)
          }
        }
        $"RX.sync.lastWrittenRxGain" <- w75
        call "niInstr Basic Elements v1 FPGA.lvlib__Count Up U32.gcdl"(increment=w63, reset=w72) -> (count out=w78)
        Feedback Node(input=w78) -> w79
        $"RX.sync.syncPaketDicarded" <- w79
      }
    }
  }
