vi "test Transponse+QAM+RM.gvi"   [LabVIEW Communications System Design Suite 2.0.1]
panel controls:
  "times": i32
  "simulateRadyforInput": bool
  "max number of loops": u32 = 10000
  "A": u16
  "B": u16
panel indicators:
  "number of samples out": u32
  "dataIn": UFXP(2.0)[]
  "dataOut": UFXP(2.0)[]
  "loop iteration": i32
  "yahoo!": bool
uses:
  ::USRP::Interactive::TestWrapper_Transponse_Qam_RM.gcdl
diagram:
  w1 = $times
  w2 = $A
  w3 = $B
  Multiply(w2, w3) -> w4
  for (N = w1) {
    for (N = w4) {
      Random Number() -> (number (0 to 1)=w7)
      Is Greater(x=w7, y=0.5) -> w8
      Random Number() -> (number (0 to 1)=w9)
      Is Greater(x=w9, y=0.5) -> w10
      Build Array(w8, w10) -> w11
      Boolean Array To Number(Boolean array=w11) -> (number=w12: UFXP(2.0))
      append w12 to w6
    }
    concatenate w6 onto w5
  }
  $dataIn <- w5
  Multiply(w4, w1) -> w13
  To Unsigned Long Integer(number=w5) -> w14
  while (iteration -> i1) {
    Feedback Node[DelayCount=10](input=w16) -> w17
    case ($simulateRadyforInput) {
      frame False, Default {
        w18 = TRUE
      }
      frame True {
        Random Number() -> (number (0 to 1)=w19)
        Is Greater(x=w19, y=0.5) -> w18
      }
    }
    Is Greater(x=i1, y=10) -> w20
    Feedback Node(input=w21) -> w22
    Logical And(w22, w20, w18) -> w23
    call "fifo simulator_32.gvi"(ready for output=w23, Array=w14) -> (element=w24, valid=w25)
    To Fixed Point(number=w24) -> w26: UFXP(2.0) Saturate:ConvergentRounding
    call "TestWrapper_Transponse_Qam_RM.gcdl"(dataIn=w26, input valid=w25, A=w2, B=w3, AB=w4) -> (ready for input=w21, dataOut=w27, outputValid=w28)
    call "collect n samples.gvi"(max number of loops=$"max number of loops", loop iteration=i1, max samples=w13, increment=w28) -> (number of samples out=w29, stop=w16)
    $"number of samples out" <- w29
    $"loop iteration" <- i1
    append w27 to w15 if w28
    stop if w17
  }
  Is Equal(x=w5, y=w15) -> w30
  And Array Elements(Boolean array=w30) -> (logical AND=w31)
  Array Size(array=w5) -> (size(s)=w32)
  Array Size(array=w15) -> (size(s)=w33)
  Is Equal(x=w32, y=w33) -> w34
  Logical And(w31, w34) -> w35
  $"yahoo!" <- w35
  $dataOut <- w15
  $"yahoo!" <- FALSE
