vi "testMatrixTranspose.gvi"   [LabVIEW Communications System Design Suite 2.0.1]
panel controls:
  "A": i32
  "B": i32
  "times": i32
panel indicators:
  "number of samples out": u32
  "dataIn": i32[]
  "ref": u32[]
  "dataOut": u32[]
  "yohoo!": bool
uses:
  ::USRP::Interactive::MatrixTransposeU32_pk.gcdl
diagram:
  w1 = $B
  w2 = $A
  w3 = $times
  Multiply(w2, w1) -> w4
  for (N = w3) {
    for (N = w4) (iteration -> i1) {
      Increment(x=i1) -> w8
      append w8 to w7
    }
    Reshape Array(inArray=w7, size=w1, size=w2) -> w9
    Transpose 2D Array(2D array=w9) -> (transposed array=w10)
    Reshape Array(inArray=w10, size=w4) -> w11
    concatenate w7 onto w5
    concatenate w11 onto w6
  }
  To Unsigned Long Integer(number=w6) -> w12
  $ref <- w12
  Multiply(w4, w3) -> w13
  while (iteration -> i2) (after w1) (after w2) (after w4) {
    Feedback Node[DelayCount=10](input=w15) -> w16
    Is Greater(x=i2, y=10) -> w17
    Random Number() -> (number (0 to 1)=w18)
    Is Greater(x=w18, y=0.5) -> w19
    Logical And(w17, w19) -> w20
    call "fifo simulator_32.gvi"(ready for output=w20, Array=w5) -> (element=w21, valid=w22)
    call "MatrixTransposeU32_pk.gcdl"(ready for output=TRUE, input valid=w22, Data in=w21, AB=w4, A=w1, B=w2) -> (data out=w23, output valid=w24)
    call "collect n samples.gvi"(loop iteration=i2, max samples=w13, increment=w24) -> (number of samples out=w25, stop=w15)
    $"number of samples out" <- w25
    append w23 to w14 if w24
    stop if w16
  }
  Is Equal(x=w12, y=w14) -> w26
  And Array Elements(Boolean array=w26) -> (logical AND=w27)
  $"yohoo!" <- w27
  $dataIn <- w5
  $dataOut <- w14
