vi "AWGN_test.gvi"   [LabVIEW Communications System Design Suite 2.0.1]
panel controls:
  "length": i32
  "shift": u16
panel indicators:
  "result": CFXP(2.14)[]
  "noise": c128[]
  "shifted noise": CFXP(2.14)[]
  "SNR": f64
uses:
  ::USRP::Interactive::AWGN_test_wrapper.gcdl
diagram:
  w1 = $length
  call "create_random_samples.gvi"(Numeric=w1) -> (Array=w2)
  $noise <- w2
  Initialize Array(element=1+1i, size=w1) -> w3
  for (N = w1) {
    w4 = each element of w3
    w5 = each element of w2
    call "shift_signal_right.gvi"(shift=$shift, data in=w5) -> (data out=w8)
    To Complex Fixed Point(complex fixed-point type=CFXP(2.14) 0+0i, number=w4) -> w9
    Complex To Real Imaginary(x + iy=w9) -> (x=w10, y=w11)
    Reinterpret Number[RestrictToSameWordLength=True](data in=w10, type=u16 0) -> (data out=w12)
    Reinterpret Number[RestrictToSameWordLength=True](data in=w11, type=u16 0) -> (data out=w13)
    Join Numbers(high(x)=w12, low(x)=w13) -> w14
    call "AWGN_test_wrapper.gcdl"(valid in=TRUE, x=w14, noise valid=TRUE, noise=w8) -> (valid out=w15, y=w16)
    Boolean To Integer(Boolean=w15) -> (0, 1=w17)
    Multiply(w16, w17) -> w18
    Split Number(x=w18) -> (high(x)=w19, low(x)=w20)
    Reinterpret Number[RestrictToSameWordLength=True](data in=w19, type=FXP(2.14) 0) -> (data out=w21)
    Reinterpret Number[RestrictToSameWordLength=True](data in=w20, type=FXP(2.14) 0) -> (data out=w22)
    Real And Imaginary To Complex(x=w21, y=w22) -> w23
    Split Number(x=w8) -> (high(x)=w24, low(x)=w25)
    Reinterpret Number[RestrictToSameWordLength=True](data in=w24, type=FXP(2.14) 0) -> (data out=w26)
    Reinterpret Number[RestrictToSameWordLength=True](data in=w25, type=FXP(2.14) 0) -> (data out=w27)
    Real And Imaginary To Complex(x=w26, y=w27) -> w28
    Scale By Power Of 2(n=$shift, x=1) -> w29
    Logarithm Base 10(x=w29) -> w30
    Multiply(w30, 10) -> w31
    $SNR <- w31
    append w23 to w6
    append w28 to w7
  }
  $result <- w6
  $"shifted noise" <- w7
