vi "Modulator Demodulator Test.gvi"   [LabVIEW Communications System Design Suite 2.0.1]
panel controls:
  "GFDM parameter in": "GFDM parameter.gtype" = {"Variable: K"=8, "Variable: M"=3, "filter type"="rc", "receive filter"="MF"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}
  "bits per symbol": u8 = 1
  "RX.fft.bitshift_in": i16 = 14
  "RX.modem.bitshift_in": i16
  "TX.modem.bitshift_in": i16
panel indicators:
  "abs": f64[][]
  "real": f64[][]
  "imag": f64[][]
  "loop iteration": i32
types:
  "GFDM parameter.gtype" = cluster{"Variable: K": i32, "Variable: M": i32, "Variable: a": f64, "filter type": enum{"rc", "rect"}, "receive filter": enum{"MF", "ZF"}, "inverse FFT": bool, "Variable: b": f64, "Ncs": u16, "Ncp": u16}
uses:
  ::USRP::Interactive::Modulator-Demodulator Test Wrapper.gcdl
diagram:
  call "create FPGA config.gvi"(GFDM parameter=$"GFDM parameter in") -> (Modem Configuration=w1)
  call "create symbol map.gvi"(bits per symbol=$"bits per symbol") -> (symbol map=w2)
  call "Create coded bits.gvi"(GFDM parameter in=$"GFDM parameter in", symbol map=w2, bits per symbol=$"bits per symbol") -> (CDB symbols=w3)
  call "CDB array to 2.14 FXP u32.gvi"(input=w3) -> (output=w4)
  call "generate pulse shape.gvi"(GFDM parameter=$"GFDM parameter in", Norm filters=TRUE) -> (pulse shaping filter g=w5, receiver filter gamma=w6)
  call "CDB array to 16.16 u64.gvi"(FFT{x}=w5) -> (Array=w7)
  call "CDB array to 16.16 u64.gvi"(FFT{x}=w6) -> (Array=w8)
  while (iteration -> i1) {
    Is First Call() -> w11
    Feedback Node[DelayCount=10](input=w11) -> w12
    call "toggle_output.gvi"(toggle=w12, reset=w11) -> (output=w13)
    Is First Call() -> w14
    call "fifo simulator_64.gvi"(ready for output=w13, Array=w7, reset=w14) -> (element=w15, valid=w16)
    Is First Call() -> w17
    Feedback Node[DelayCount=10](input=w17) -> w18
    call "toggle_output.gvi"(toggle=w18, reset=w17) -> (output=w19)
    Is First Call() -> w20
    call "fifo simulator_64.gvi"(ready for output=w19, Array=w8, reset=w20) -> (element=w21, valid=w22)
    Feedback Node(input=w23) -> w24
    call "toggle_output.gvi"(toggle=w24, reset=w11) -> (output=w25)
    Is First Call() -> w26
    call "fifo simulator_32_without reset.gvi"(ready for output=w25, Array=w4, reset=w26) -> (element=w27, valid=w28)
    Feedback Node[DelayCount=10](input=TRUE) -> w29
    Is First Call() -> w30
    call "Modulator-Demodulator Test Wrapper.gcdl"(data valid=w28, data in=w27, TX.filter in=w15, TX.filter valid=w16, RX.filter valid=w22, RX.filter in=w21, reset!=w30, configure!=w29, RX.modem.fft.bitshift_in=$"RX.fft.bitshift_in", RX.modem.bitshift_in=$"RX.modem.bitshift_in", TX.modem.bitshift_in=$"TX.modem.bitshift_in", TX.modem.configuration_in=w1) -> (RX.modem.last sample_out=w31, RX.modem.data valid_out=w32, RX.modem.32 bit data_out=w33, RX.modem.64 bit data_out=w34, config done=w23)
    call "u64_to_cfx.gvi"(input=w34) -> (output=w35)
    call "u32 to 2.14 CDB.gvi"(u32=w33) -> (CFX out=w36)
    Feedback Node[DelayCount=10](input=w31) -> w37
    $"loop iteration" <- i1
    append w35 to w9 if w32
    append w36 to w10 if w32
    stop if w37
  }
  call "time-domain modulator.gvi"(GFDM parameter=$"GFDM parameter in", pulse shaping filter g=w5, data as a vector d=w3) -> (time signal x=w38, GFDM parameter out=w39)
  call "norm CFX.gvi"(Input=w38) -> (Output=w40)
  call "time-domain demodulator.gvi"(GFDM parameter in=w39, receive filter gamma=w6, received signal y=w40) -> (iq symbols=w41)
  call "norm CFX.gvi"(Input=w41) -> (Output=w42)
  call "norm CFX.gvi"(Input=w9) -> (Output=w43)
  Build Array(w43, w10, w42) -> w44
  Absolute Value(x=w44) -> w45
  $abs <- w45
  Complex To Real Imaginary(x + iy=w44) -> (x=w46, y=w47)
  $real <- w46
  $imag <- w47
