vi "Modulator test.gvi"   [LabVIEW Communications System Design Suite 2.0.1]
panel controls:
  "GFDM parameter in": "GFDM parameter.gtype" = {"Variable: K"=8, "Variable: M"=3, "filter type"="rc", "receive filter"="MF"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}
  "bits per symbol": u8 = 1
  "TX.bitshift_in": i16 = 14
  "use test vector": bool
panel indicators:
  "abs": f64[][]
  "real": f64[][]
  "imag": f64[][]
  "loop iteration": i32
  "mse": f64
  "rmse": f64
types:
  "GFDM parameter.gtype" = cluster{"Variable: K": i32, "Variable: M": i32, "Variable: a": f64, "filter type": enum{"rc", "rect"}, "receive filter": enum{"MF", "ZF"}, "inverse FFT": bool, "Variable: b": f64, "Ncs": u16, "Ncp": u16}
uses:
  ::USRP::Interactive::Modulator test wrapper.gcdl
diagram:
  case ($"use test vector") {
    frame True {
      Property Node(instance in=$"GFDM parameter in") -> ("Variable: K"=w4, "Variable: M"=w5)
      call "read test vector.gvi"(M=w5, direction="TX", K=w4) -> (input=w1, output=w3, g=w6)
      call "norm CFX.gvi"(Input=w6) -> (Output=w2)
    }
    frame False {
      call "generate pulse shape.gvi"(GFDM parameter=$"GFDM parameter in") -> (pulse shaping filter g=w7)
      call "norm CFX.gvi"(Input=w7) -> (Output=w2)
      call "create symbol map.gvi"(bits per symbol=$"bits per symbol") -> (symbol map=w8)
      call "Create coded bits.gvi"(GFDM parameter in=$"GFDM parameter in", symbol map=w8, bits per symbol=$"bits per symbol") -> (CDB symbols=w1)
      call "time-domain modulator.gvi"(GFDM parameter=$"GFDM parameter in", Bypass FFT=FALSE, pulse shaping filter g=w2, data as a vector d=w1) -> (time signal x=w3)
    }
  }
  call "norm CFX.gvi"(Input=w3) -> (Output=w9)
  call "create FPGA config.gvi"(GFDM parameter=$"GFDM parameter in") -> (Modem Configuration=w10)
  call "CDB array to 2.14 FXP u32.gvi"(input=w1) -> (output=w11)
  call "CDB array to 16.16 u64.gvi"(FFT{x}=w2) -> (Array=w12)
  while (iteration -> i1) {
    Is First Call() -> w15
    Feedback Node[DelayCount=10](input=w15) -> w16
    call "toggle_output.gvi"(toggle=w16, reset=w15) -> (output=w17)
    Is First Call() -> w18
    call "fifo simulator_64.gvi"(ready for output=w17, Array=w12, reset=w18) -> (element=w19, valid=w20)
    Is First Call() -> w21
    Feedback Node(input=w22) -> w23
    call "toggle_output.gvi"(toggle=w23, reset=w21) -> (output=w24)
    Is First Call() -> w25
    call "fifo simulator_32.gvi"(ready for output=w24, Array=w11, reset=w25) -> (element=w26, valid=w27)
    Feedback Node[DelayCount=10](input=TRUE) -> w28
    Is First Call() -> w29
    call "Modulator test wrapper.gcdl"(data=w26, data valid=w27, TX.reset_in=w29, TX.bitshift_in=$"TX.bitshift_in", TX.configure_in=w28, TX.Modem configuration_in=w10, filter valid=w20, filter=w19) -> (TX.32 bit data_out=w30, TX.64 bit data_out=w31, TX.config done_out=w22, TX.last sample_out=w32, TX. data valid_out=w33)
    call "u64_to_cfx.gvi"(input=w31) -> (output=w34)
    call "u32 to 2.14 CDB.gvi"(u32=w30) -> (CFX out=w35)
    Feedback Node[DelayCount=10](input=w32) -> w36
    $"loop iteration" <- i1
    append w34 to w13 if w33
    append w35 to w14 if w33
    stop if w36
  }
  call "norm CFX.gvi"(Input=w13) -> (Output=w37)
  Build Array(w37, w14, w9) -> w38
  Absolute Value(x=w38) -> w39
  $abs <- w39
  Complex To Real Imaginary(x + iy=w38) -> (x=w40, y=w41)
  $real <- w40
  $imag <- w41
  call "mean square error.gvi"(reference=w9, vector=w37) -> (rmse=w42, mse=w43)
  $mse <- w43
  $rmse <- w42
