vi "demod_write_control_test.gvi"   [LabVIEW NXG]
panel controls:
  "K-1": u16 = 4
  "M-1": u8 = 2
  "reset": bool
  "pulse shape valid": bool
  "stop": bool
  "pulse shape valid_2": bool
panel indicators:
  "write": i16
  "write_2": i16
  "write_3": i16
  "write_4": i16
  "config done": i16
  "config ongoing": i16
  "k": u16
  "valid out": i16
uses:
  ::Project::USRP::demod_write_control.gcdl
diagram:
  while {
    Wait Ms(msToWait=500)
    Is First Call() -> w1
    Logical Or($reset, w1) -> w2
    Feedback Node(Initializer=TRUE, Input=w1) -> (Output=w3)
    Logical Or($"pulse shape valid_2", $"pulse shape valid") -> w4
    Logical And(w4, not w3) -> w5
    call "demod_write_control.gcdl"(valid in=w5, K-1=$"K-1", M-1=$"M-1", reset=w2) -> (address=w6, write_enable=w7, last sample=w8, write block=w9, valid out=w10)
    Boolean To Integer(Boolean=w10) -> (0, 1=w11)
    $"valid out" <- w11
    $k <- w6
    Array Index(array=w7) -> (out0[_]=w12, out1[_]=w13, out2[_]=w14, out3[_]=w15)
    Boolean To Integer(Boolean=w12) -> (0, 1=w16)
    $write <- w16
    Boolean To Integer(Boolean=w13) -> (0, 1=w17)
    $write_2 <- w17
    Boolean To Integer(Boolean=w14) -> (0, 1=w18)
    $write_3 <- w18
    Boolean To Integer(Boolean=w15) -> (0, 1=w19)
    $write_4 <- w19
    Boolean To Integer(Boolean=w9) -> (0, 1=w20)
    $"config ongoing" <- w20
    Boolean To Integer(Boolean=w8) -> (0, 1=w21)
    $"config done" <- w21
    Select(s=w8, t=FALSE, f=$"pulse shape valid_2") -> w22
    $"pulse shape valid_2" <- w22
    stop if $stop
  }
