vi "Add Array Elements Toplevel.gvi"   [LabVIEW NXG]
panel controls:
  "array input": u64[16]
  "valid in": bool
panel indicators:
  "sum": u64
  "valid out": bool
diagram:
  clock-driven loop (clock = "192 MHz") forever {
    Feedback Node(Initializer=[0, 0, 0, 0, 0, 0, 0, 0, 0, 0, 0, 0, 0, 0, 0, 0], Input=$"array input") -> (Output=w1)
    Feedback Node(Input=$"valid in") -> (Output=w2)
    call "Add Array Elements.gcdl"(array input=w1, valid in=w2) -> (sum=w3, valid out=w4)
    $sum <- w3
    $"valid out" <- w4
  }
