vi "Add Array Elements test.gvi"   [LabVIEW NXG]
panel controls:
  "Variable: number": f64 = 1
  "Data generator?": T1 = "First Symbol"
  "Variable: M": f64 = 3
  "Variable: K": f64 = 4
  "Variable: random_g": bool
types:
  T1 = enum{"First Symbol", "Random", "Seeded", "Set datablock given in number to 1"}
uses:
  ::Project::USRP::Add Array Elements.gcdl
diagram:
  for {
    call "Add Array Elements.gcdl"()
  }
  call "GFDM RX signals.gvi"(Variable: K=$"Variable: K", Variable: M=$"Variable: M", Data generator?=$"Data generator?", Variable: number=$"Variable: number", Variable: random_g=$"Variable: random_g")
