vi "core modem Host test.gvi"   [LabVIEW Communications System Design Suite 2.0.1]
panel controls:
  "stop": bool
  "GFDM Parameter in": "GFDM parameter.gtype" = {"Variable: K"=8, "Variable: M"=3, "Variable: a"=0.5, "filter type"="rc", "receive filter"="ZF", "inverse FFT"=TRUE, "Variable: b"=0.5, "Ncs"=0, "Ncp"=0}
  "bits per symbol": u8 = 1
  "bitshift": i16
panel indicators:
  "error out": error
  "TX": f64[][]
  "RX": f64[][]
  "Packet correct": bool
  "uncoded BER": f64
  "coded BER": f64
  "Graph": c128[][]
  "dem_DEBUG counter out": T1
  "mod_DEBUG counter out": T1
  "TX packet size in": f64
  "TX packet size out": f64
  "RX packet size in_2": f64
  "RX packet size out_2": f64
  "mod first samples in": u64
  "mod first samples out": u64
  "mod first samples out_2": u64
  "mod last samples in": u64
  "mod last samples out": u64
  "mod last samples out_2": u64
  "number of cycles": u64
  "number of invalid samples": u64
  "number of invalid samples_2": u64
  "number of invalid samples_3": u64
  "unoccupied 1": f64
  "unoccupied 2": f64
  "unoccupied 3": f64
types:
  "GFDM parameter.gtype" = cluster{"Variable: K": i32, "Variable: M": i32, "Variable: a": f64, "filter type": enum{"rc", "rect"}, "receive filter": enum{"MF", "ZF"}, "inverse FFT": bool, "Variable: b": f64, "Ncs": u16, "Ncp": u16}
  T1 = cluster{"packets in_out": u16, "samples in_out": u16, "packets out_out": u16, "samples out_out": u16}
diagram:
  FPGA Open Node[ProjectItem=":NullTarget:USRP\\-core\\ modem\\ toplevel\\-0002\\.lvbitx"](RIO address="RIO0") -> (error out=w1, reference out=w2)
  FPGA Download Node(error in=w1, reference in=w2) -> (error out=w3, reference out=w4)
  FPGA Run Node(error in=w3, reference in=w4) -> (error out=w5, reference out=w6)
  Host Fifo Configure Node[FifoName="USRP Resources.grsc\\dem_data out 64 bit"](depth=65535, error in=w5, reference in=w6) -> (actual depth=w7, error out=w8, reference out=w9)
  Host Fifo Configure Node[FifoName="USRP Resources.grsc\\dem_filter in"](depth=w7, error in=w8, reference in=w9) -> (actual depth=w10, error out=w11, reference out=w12)
  Host Fifo Configure Node[FifoName="USRP Resources.grsc\\mod_64 bit data in"](depth=w10, error in=w11, reference in=w12) -> (actual depth=w13, error out=w14, reference out=w15)
  Host Fifo Configure Node[FifoName="USRP Resources.grsc\\mod_data out 32 bit"](depth=w13, error in=w14, reference in=w15) -> (actual depth=w16, error out=w17, reference out=w18)
  Host Fifo Configure Node[FifoName="USRP Resources.grsc\\mod_data out 64 bit"](depth=w16, error in=w17, reference in=w18) -> (actual depth=w19, error out=w20, reference out=w21)
  Host Fifo Configure Node[FifoName="USRP Resources.grsc\\mod_pulse shape in"](depth=w19, error in=w20, reference in=w21) -> (error out=w22, reference out=w23)
  Host Fifo Start Node[FifoName="USRP Resources.grsc\\dem_data out 64 bit"](error in=w22, reference in=w23) -> (error out=w24, reference out=w25)
  Host Fifo Start Node[FifoName="USRP Resources.grsc\\dem_filter in"](error in=w24, reference in=w25) -> (error out=w26, reference out=w27)
  Host Fifo Start Node[FifoName="USRP Resources.grsc\\mod_64 bit data in"](error in=w26, reference in=w27) -> (error out=w28, reference out=w29)
  Host Fifo Start Node[FifoName="USRP Resources.grsc\\mod_data out 32 bit"](error in=w28, reference in=w29) -> (error out=w30, reference out=w31)
  Host Fifo Start Node[FifoName="USRP Resources.grsc\\mod_data out 64 bit"](error in=w30, reference in=w31) -> (error out=w32, reference out=w33)
  Host Fifo Start Node[FifoName="USRP Resources.grsc\\mod_pulse shape in"](error in=w32, reference in=w33) -> (error out=w34, reference out=w35)
  case (w34) {
    frame No Error, Default {
      w38 = $"bits per symbol"
      w39 = $"GFDM Parameter in"
      call "generate pulse shape.gvi"(GFDM parameter=w39, Norm filters=TRUE) -> (pulse shaping filter g=w40, receiver filter gamma=w41)
      call "create symbol map.gvi"(bits per symbol=w38) -> (symbol map=w42)
      sequence {
        frame 0 {
          Property Node(instance in=w35, "reset_in"=TRUE, "reset_in"=FALSE, error in=w34) -> (error out=w43, instance out=w44)
        }
        frame 1 {
          Wait(time to wait=1000)
        }
      }
      call "create FPGA config.gvi"(GFDM parameter=w39) -> (Modem Configuration=w45)
      Property Node(instance in=w44, "Modem configuration_in"=w45, error in=w43) -> (error out=w46, instance out=w47)
      call "CDB array to 16.16 u64.gvi"(FFT{x}=w41) -> (Array=w48)
      Host Fifo Write Node[FifoName="USRP Resources.grsc\\dem_filter in"](data=w48, error in=w46, reference in=w47) -> (error out=w49, reference out=w50)
      call "CDB array to 16.16 u64.gvi"(FFT{x}=w40) -> (Array=w51)
      Host Fifo Write Node[FifoName="USRP Resources.grsc\\mod_pulse shape in"](data=w51, error in=w49, reference in=w50) -> (error out=w52, reference out=w53)
      while {
        Property Node(instance in=w53, "config"=TRUE, error in=w52) -> ("config done"=w54, error out=w55, instance out=w56)
        Wait(time to wait=100)
        stop if w54
      }
      while {
        call "Create coded bits.gvi"(GFDM parameter in=w39, symbol map=w42, bits per symbol=w38) -> (CDB symbols=w57, coded bit stream=w58, source bit stream=w59)
        call "CDB array to 16.16 u64.gvi"(FFT{x}=w57) -> (Array=w60)
        Array Size(array=w60) -> (size(s)=w61)
        Host Fifo Write Node[FifoName="USRP Resources.grsc\\mod_64 bit data in"](data=w60, error in=w55, reference in=w56) -> (error out=w62, reference out=w63)
        Host Fifo Read Node[FifoName="USRP Resources.grsc\\mod_data out 64 bit"](error in=w62, number of elements=w61, reference in=w63) -> (data=w64, error out=w65, reference out=w66)
        Host Fifo Read Node[FifoName="USRP Resources.grsc\\mod_data out 32 bit"](error in=w65, number of elements=w61, reference in=w66) -> (data=w67, error out=w68, reference out=w69)
        Host Fifo Read Node[FifoName="USRP Resources.grsc\\dem_data out 64 bit"](error in=w68, number of elements=w61, reference in=w69) -> (data=w70, error out=w37, reference out=w36)
        call "u64 array to 16.16 CFX.gvi"(data=w70) -> (Array=w71)
        Build Array(w57, w71) -> w72
        $Graph <- w72
        call "time-domain modulator.gvi"(GFDM parameter=w39, Bypass FFT=TRUE, pulse shaping filter g=w40, data as a vector d=w57) -> (time signal x=w73, GFDM parameter out=w74)
        call "u32 array to 2.14 CFX.gvi"(data=w67) -> (Array=w75)
        call "u64 array to 16.16 CFX.gvi"(data=w64) -> (Array=w76)
        Build Array(w76, w75, w73) -> w77
        Absolute Value(x=w77) -> w78
        $TX <- w78
        call "norm CFX.gvi"(Input=w73) -> (Output=w79)
        call "time-domain demodulator.gvi"(GFDM parameter in=w74, Bypass transform=TRUE, receive filter gamma=w41, received signal y=w79) -> (iq symbols=w80)
        Build Array(w71, w80) -> w81
        Absolute Value(x=w81) -> w82
        $RX <- w82
        call "mod_QAM Demod Symbol Demap.gvi"(symbols in=w71, symbol map=w42) -> (bits out=w83)
        call "BER.gvi"(Output=w83, Input=w58) -> (BER=w84)
        $"uncoded BER" <- w84
        call "Decoder.gvi"(received bit stream=w83, transmitted bit stream in=w59) -> (decoded bit stream=w85, transmitted bit stream out=w86, equal=w87)
        call "BER.gvi"(Output=w85, Input=w86) -> (BER=w88)
        $"coded BER" <- w88
        $"Packet correct" <- w87
        stop if $stop
      }
      while {
        Property Node(instance in=w56, "bitshift"=$bitshift, error in=w55) -> ("dem_DEBUG counter out"=w89, "mod_DEBUG counter out"=w90, "mod first samples in"=w91, "mod first samples out"=w92, "mod first samples out_2"=w93, "mod last samples in"=w94, "mod last samples out"=w95, "mod last samples out_2"=w96, "number of cycles"=w97, "number of invalid samples"=w98, "number of invalid samples_2"=w99, "number of invalid samples_3"=w100)
        $"dem_DEBUG counter out" <- w89
        $"mod_DEBUG counter out" <- w90
        $"mod first samples in" <- w91
        Property Node(instance in=w90) -> ("packets in_out"=w101, "samples in_out"=w102, "packets out_out"=w103, "samples out_out"=w104)
        Divide(x=w102, y=w101) -> w105
        $"TX packet size in" <- w105
        $"mod first samples out" <- w92
        $"mod first samples out_2" <- w93
        Divide(x=w104, y=w103) -> w106
        $"TX packet size out" <- w106
        $"mod last samples in" <- w94
        $"mod last samples out" <- w95
        $"mod last samples out_2" <- w96
        $"number of cycles" <- w97
        Property Node(instance in=w89) -> ("packets in_out"=w107, "samples in_out"=w108, "packets out_out"=w109, "samples out_out"=w110)
        Divide(x=w108, y=w107) -> w111
        $"RX packet size in_2" <- w111
        $"number of invalid samples" <- w98
        $"number of invalid samples_2" <- w99
        $"number of invalid samples_3" <- w100
        Divide(x=w98, y=w97) -> w112
        $"unoccupied 1" <- w112
        Divide(x=w99, y=w97) -> w113
        $"unoccupied 2" <- w113
        Divide(x=w100, y=w97) -> w114
        $"unoccupied 3" <- w114
        Divide(x=w110, y=w109) -> w115
        $"RX packet size out_2" <- w115
        Wait(time to wait=10)
        stop if $stop
      }
    }
    frame Error {
      w36 = w35
      w37 = w34
    }
  }
  Host Fifo Stop Node[FifoName="USRP Resources.grsc\\dem_data out 64 bit"](error in=w37, reference in=w36) -> (error out=w116, reference out=w117)
  Host Fifo Stop Node[FifoName="USRP Resources.grsc\\dem_filter in"](error in=w116, reference in=w117) -> (error out=w118, reference out=w119)
  Host Fifo Stop Node[FifoName="USRP Resources.grsc\\mod_64 bit data in"](error in=w118, reference in=w119) -> (error out=w120, reference out=w121)
  Host Fifo Stop Node[FifoName="USRP Resources.grsc\\mod_data out 32 bit"](error in=w120, reference in=w121) -> (error out=w122, reference out=w123)
  Host Fifo Stop Node[FifoName="USRP Resources.grsc\\mod_data out 64 bit"](error in=w122, reference in=w123) -> (error out=w124, reference out=w125)
  Host Fifo Stop Node[FifoName="USRP Resources.grsc\\mod_pulse shape in"](error in=w124, reference in=w125) -> (error out=w126, reference out=w127)
  FPGA Close Node(error in=w126, reference in=w127) -> (error out=w128)
  $"error out" <- w128
  $stop <- FALSE
