vi "core modem toplevel.gvi"   [LabVIEW Communications System Design Suite 2.0.1]
panel controls:
  "Modem configuration_in": "modem_configuration.gtype"
  "bitshift": i16
  "reset_in": bool
  "config": bool
panel indicators:
  "mod_DEBUG counter out": T1
  "dem_DEBUG counter out": T1
  "config done": bool
  "modem_configuration_out": "modem_configuration.gtype"
  "number of invalid samples": u64
  "mod first samples in": u64
  "mod last samples in": u64
  "number of cycles": u64
  "mod first samples out": u64
  "mod last samples out": u64
  "mod first samples out_2": u64
  "mod last samples out_2": u64
  "number of invalid samples_2": u64
  "number of invalid samples_3": u64
types:
  "modem_configuration.gtype" = cluster{"K-1": u16, "M-1": u8, "N-1": u16, "N": u16, "Npreamble+CP+CS": u16, "Npreamble": u16, "Nw": u16, "Modulator MUX config": u64[16], "CP start": u16[16], "Subsymbol end": u16[16], "Subsymbol start": u16[16], "K": u16, "fft_size_log2(K)": u8, "inverse_fft": bool, "Start with preamble": bool, "Burstmode": bool, "Ncs": u16, "Ncp": u16, "N-Ncp": u16, "N+Ncp": u16, "N+Ncp+Ncs": u16, "Demodulator MUX config": u64[16], "M": u8, "DFT SIZE": FXP(6.0), "Frame length": u32, "Super frame length": u32, "Ns_all_GFDM_blocks": u32, "Ns_all_preambles": u32}
  T1 = cluster{"packets in_out": u16, "samples in_out": u16, "packets out_out": u16, "samples out_out": u16}
diagram:
  Register Create(initial value="modem_configuration.gtype" {all zero or empty}) -> (reference out=w1)
  clock-driven loop (clock = "40 MHz Onboard Clock") forever {
    Register Write(data=$"Modem configuration_in", reference in=w1)
  }
  clock-driven loop (clock = "USRP Resources.grsc\\192 MHz") forever {
    Register Read(reference in=w1) -> (data=w2)
    FIFO Read(Control Protocol Input=$config, reference in="USRP Resources.grsc\\mod_pulse shape in") -> (Control Protocol Output=w3, data=w4)
    Property Node(instance in=w2) -> ("N"=w5)
    call "Read packet from FIFO 64 bit.gcdl"(length=w5, reference in="USRP Resources.grsc\\mod_64 bit data in", reset=$reset_in) -> (first sample_out=w6, last sample_out=w7, data_out=w8, valid_out=w9)
    call "core modem.gcdl"(64 bit data valid_in=w9, 64 bit data_in=w8, Modem configuration_in=w2, filter valid_in=w3, filter_in=w4, RX mode_in=FALSE, 32 bit data valid_in=FALSE, 32 bit data_in=0, first sample_in=w6, reset_in=$reset_in) -> (valid_out=w10, 64 bit data_out=w11, last sample_out=w12, first sample_out=w13, DEBUG counter out=w14, modem_configuration_out=w15)
    FIFO Write(Control Protocol Input=w10, data=w11, reference in="USRP Resources.grsc\\mod_data out 64 bit")
    call "scale by power of 2.gcdl"(valid in=w10, shift=$bitshift, data in=w11) -> (valid out=w16, 32 bit data out=w17)
    FIFO Write(Control Protocol Input=w16, data=w17, reference in="USRP Resources.grsc\\mod_data out 32 bit")
    Feedback Node(input=w13) -> w18
    FIFO Read(Control Protocol Input=$config, reference in="USRP Resources.grsc\\dem_filter in") -> (Control Protocol Output=w19, data=w20)
    call "core modem.gcdl"(64 bit data valid_in=FALSE, 64 bit data_in=0, Modem configuration_in=w2, filter valid_in=w19, filter_in=w20, RX mode_in=TRUE, 32 bit data valid_in=w16, 32 bit data_in=w17, first sample_in=w18, reset_in=$reset_in) -> (valid_out=w21, 64 bit data_out=w22, last sample_out=w23, first sample_out=w24, DEBUG counter out=w25)
    FIFO Write(Control Protocol Input=w21, data=w22, reference in="USRP Resources.grsc\\dem_data out 64 bit")
    $modem_configuration_out <- w15
    $"mod_DEBUG counter out" <- w14
    $"dem_DEBUG counter out" <- w25
    Logical And(not w3, not w19, $config) -> w26
    $"config done" <- w26
    Not(x=w9) -> w27
    call "niInstr Basic Elements v1 FPGA.lvlib__Count Up U64.gcdl"(increment=w27, reset=$reset_in) -> (count out=w28)
    $"number of invalid samples" <- w28
    call "niInstr Basic Elements v1 FPGA.lvlib__Count Up U64.gcdl"(increment=w24, reset=$reset_in) -> (count out=w29)
    $"mod first samples out_2" <- w29
    call "niInstr Basic Elements v1 FPGA.lvlib__Count Up U64.gcdl"(increment=w13, reset=$reset_in) -> (count out=w30)
    $"mod first samples out" <- w30
    call "niInstr Basic Elements v1 FPGA.lvlib__Count Up U64.gcdl"(increment=w6, reset=$reset_in) -> (count out=w31)
    $"mod first samples in" <- w31
    call "niInstr Basic Elements v1 FPGA.lvlib__Count Up U64.gcdl"(increment=w23, reset=$reset_in) -> (count out=w32)
    $"mod last samples out_2" <- w32
    call "niInstr Basic Elements v1 FPGA.lvlib__Count Up U64.gcdl"(increment=w12, reset=$reset_in) -> (count out=w33)
    $"mod last samples out" <- w33
    call "niInstr Basic Elements v1 FPGA.lvlib__Count Up U64.gcdl"(increment=w7, reset=$reset_in) -> (count out=w34)
    $"mod last samples in" <- w34
    Not(x=w21) -> w35
    call "niInstr Basic Elements v1 FPGA.lvlib__Count Up U64.gcdl"(increment=w35, reset=$reset_in) -> (count out=w36)
    $"number of invalid samples_3" <- w36
    call "niInstr Basic Elements v1 FPGA.lvlib__Count Up U64.gcdl"(increment=TRUE, reset=$reset_in) -> (count out=w37)
    $"number of cycles" <- w37
    Not(x=w10) -> w38
    call "niInstr Basic Elements v1 FPGA.lvlib__Count Up U64.gcdl"(increment=w38, reset=$reset_in) -> (count out=w39)
    $"number of invalid samples_2" <- w39
  }
