vi "core-modem RX test.gvi"   [LabVIEW Communications System Design Suite 2.0.1]
panel controls:
  "GFDM parameter in": "GFDM parameter.gtype" = {"Variable: K"=8, "Variable: M"=3, "filter type"="rc", "receive filter"="MF"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}
  "bits per symbol": u8 = 1
panel indicators:
  "abs": f64[][]
  "real": f64[][]
  "imag": f64[][]
  "loop iteration": i32
types:
  "GFDM parameter.gtype" = cluster{"Variable: K": i32, "Variable: M": i32, "Variable: a": f64, "filter type": enum{"rc", "rect"}, "receive filter": enum{"MF", "ZF"}, "inverse FFT": bool, "Variable: b": f64, "Ncs": u16, "Ncp": u16}
uses:
  ::USRP::Interactive::core modem.gcdl
diagram:
  call "create FPGA config.gvi"(GFDM parameter=$"GFDM parameter in") -> (Modem Configuration=w1)
  call "generate pulse shape.gvi"(GFDM parameter=$"GFDM parameter in") -> (pulse shaping filter g=w2, receiver filter gamma=w3)
  call "norm CFX.gvi"(Input=w3) -> (Output=w4)
  call "CDB array to 16.16 u64.gvi"(FFT{x}=w4) -> (Array=w5)
  call "norm CFX.gvi"(Input=w2) -> (Output=w6)
  call "create symbol map.gvi"(bits per symbol=$"bits per symbol") -> (symbol map=w7)
  call "Create coded bits.gvi"(GFDM parameter in=$"GFDM parameter in", symbol map=w7, bits per symbol=$"bits per symbol") -> (CDB symbols=w8)
  call "time-domain modulator.gvi"(GFDM parameter=$"GFDM parameter in", pulse shaping filter g=w6, data as a vector d=w8) -> (time signal x=w9)
  call "norm CFX.gvi"(Input=w9) -> (Output=w10)
  call "CDB array to 2.14 FXP u32.gvi"(input=w10) -> (output=w11)
  while (iteration -> i1) {
    Is First Call() -> w13
    Feedback Node(input=w14) -> w15
    call "toggle_output.gvi"(toggle=w15, reset=w13) -> (output=w16)
    Is First Call() -> w17
    call "fifo simulator_32.gvi"(ready for output=w16, Array=w11, reset=w17) -> (element=w18, valid=w19)
    Is First Call() -> w20
    Feedback Node[DelayCount=2](input=w20) -> w21
    call "toggle_output.gvi"(toggle=w21, reset=w20) -> (output=w22)
    Is First Call() -> w23
    call "fifo simulator_64.gvi"(ready for output=w22, Array=w5, reset=w23) -> (element=w24, valid=w25)
    call "detect rising edge.gvi"(in=w19) -> (out=w26)
    Is First Call() -> w27
    call "core modem.gcdl"(64 bit data valid_in=FALSE, 64 bit data_in=0, Modem configuration_in=w1, filter valid_in=w25, filter_in=w24, RX mode_in=TRUE, 32 bit data valid_in=w19, 32 bit data_in=w18, first sample_in=w26, reset_in=w27) -> (valid_out=w28, 64 bit data_out=w29, last sample_out=w30, last configuration sample read_out=w14)
    call "u64_to_cfx.gvi"(input=w29) -> (output=w31)
    Feedback Node[DelayCount=10](input=w30) -> w32
    $"loop iteration" <- i1
    append w31 to w12 if w28
    stop if w32
  }
  call "time-domain demodulator.gvi"(GFDM parameter in=$"GFDM parameter in", Bypass transform=TRUE, receive filter gamma=w4, received signal y=w10) -> (iq symbols=w33)
  Build Array(w12, w33) -> w34
  Absolute Value(x=w34) -> w35
  $abs <- w35
  Complex To Real Imaginary(x + iy=w34) -> (x=w36, y=w37)
  $real <- w36
  $imag <- w37
