vi "core-modem TX test.gvi"   [LabVIEW Communications System Design Suite 2.0.1]
panel controls:
  "GFDM parameter in": "GFDM parameter.gtype" = {"Variable: K"=8, "Variable: M"=3, "filter type"="rc", "receive filter"="MF"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}
  "bits per symbol": u8 = 1
panel indicators:
  "abs": f64[][]
  "real": f64[][]
  "imag": f64[][]
  "loop iteration": i32
types:
  "GFDM parameter.gtype" = cluster{"Variable: K": i32, "Variable: M": i32, "Variable: a": f64, "filter type": enum{"rc", "rect"}, "receive filter": enum{"MF", "ZF"}, "inverse FFT": bool, "Variable: b": f64, "Ncs": u16, "Ncp": u16}
uses:
  ::USRP::Interactive::core modem.gcdl
diagram:
  call "create FPGA config.gvi"(GFDM parameter=$"GFDM parameter in") -> (Modem Configuration=w1)
  call "create symbol map.gvi"(bits per symbol=$"bits per symbol") -> (symbol map=w2)
  call "Create coded bits.gvi"(GFDM parameter in=$"GFDM parameter in", symbol map=w2, bits per symbol=$"bits per symbol") -> (CDB symbols=w3)
  call "CDB array to 16.16 u64.gvi"(FFT{x}=w3) -> (Array=w4)
  call "generate pulse shape.gvi"(GFDM parameter=$"GFDM parameter in") -> (pulse shaping filter g=w5)
  call "norm CFX.gvi"(Input=w5) -> (Output=w6)
  call "CDB array to 16.16 u64.gvi"(FFT{x}=w6) -> (Array=w7)
  while (iteration -> i1) {
    Is First Call() -> w9
    Feedback Node(input=w10) -> w11
    call "toggle_output.gvi"(toggle=w11, reset=w9) -> (output=w12)
    Is First Call() -> w13
    call "fifo simulator_64.gvi"(ready for output=w12, Array=w4, reset=w13) -> (element=w14, valid=w15)
    Is First Call() -> w16
    Feedback Node[DelayCount=10](input=w16) -> w17
    call "toggle_output.gvi"(toggle=w17, reset=w16) -> (output=w18)
    Is First Call() -> w19
    call "fifo simulator_64.gvi"(ready for output=w18, Array=w7, reset=w19) -> (element=w20, valid=w21)
    call "detect rising edge.gvi"(in=w15) -> (out=w22)
    Is First Call() -> w23
    call "core modem.gcdl"(64 bit data valid_in=w15, 64 bit data_in=w14, Modem configuration_in=w1, filter valid_in=w21, filter_in=w20, RX mode_in=FALSE, 32 bit data valid_in=FALSE, 32 bit data_in=0, first sample_in=w22, reset_in=w23) -> (valid_out=w24, 64 bit data_out=w25, last sample_out=w26, last configuration sample read_out=w10)
    call "u64_to_cfx.gvi"(input=w25) -> (output=w27)
    Feedback Node[DelayCount=10](input=w26) -> w28
    $"loop iteration" <- i1
    append w27 to w8 if w24
    stop if w28
  }
  call "time-domain modulator.gvi"(GFDM parameter=$"GFDM parameter in", Bypass FFT=TRUE, pulse shaping filter g=w6, data as a vector d=w3) -> (time signal x=w29)
  Build Array(w8, w29) -> w30
  Absolute Value(x=w30) -> w31
  $abs <- w31
  Complex To Real Imaginary(x + iy=w30) -> (x=w32, y=w33)
  $real <- w32
  $imag <- w33
