vi "demod_pulse_haping test toplevel.gvi"   [LabVIEW NXG]
panel controls:
  "subsymbol_start": bool
  "filtervalid_in": bool
  "k": u32
  "filter_in": u64
  "reset": bool
  "K-1": u16
  "M-1": u8
  "input": u32[16]
panel indicators:
  "output": u64[16]
  "valid_out": bool
  "last sample": bool
diagram:
  clock-driven loop (clock = "192 MHz") forever {
    Feedback Node(Initializer=[0, 0, 0, 0, 0, 0, 0, 0, 0, 0, 0, 0, 0, 0, 0, 0], Input=$input) -> (Output=w1)
    Feedback Node(Input=$k) -> (Output=w2)
    Feedback Node(Input=$filtervalid_in) -> (Output=w3)
    Feedback Node(Input=$"M-1") -> (Output=w4)
    Feedback Node(Input=$subsymbol_start) -> (Output=w5)
    Feedback Node(Input=$filter_in) -> (Output=w6)
    Feedback Node(Input=$"K-1") -> (Output=w7)
    Feedback Node(Input=$reset) -> (Output=w8)
    call "demod_pulse_shape_test_wrapper.gcdl"(input=w1, k=w2, valid_in=w5, filter in=w6, filter valid=w3, K-1=w7, M-1=w4, reset=w8) -> (last sample=w9, valid out=w10, output=w11)
    $output <- w11
    $valid_out <- w10
    $"last sample" <- w9
  }
