vi "demod_pulse_shaping_test.gvi"   [LabVIEW Communications System Design Suite 2.0.1]
inputs:
  "Data generator?": T1 = "First Symbol"
  "Variable: number": f64 = 1
  "Variable: K": f64 = 4
  "Variable: M": f64 = 3
  "Limit [%]": f64 = 0.1
outputs:
  "Test passed?": bool
panel controls:
  "Variable: random_g": bool
panel indicators:
  "Output": CFXP(16.16)[][]
  "reference": CFXP(16.16)[][]
  "FPGA CDB result": CFXP(16.16)[][]
  "Line passed": bool[]
  "state": u16
  "n": f64
  "k": f64
  "m": f64
  "new subsymbol": i16
  "first subsymbol": i16
  "block end": i16
  "filter": UFXP(16.16)
  "write": i16
  "valid in": i16
  "data input": f64[][]
  "data output": f64[][]
  "valid out": i16
  "Results": UFXP(16.16)[][]
types:
  T1 = enum{"First Symbol", "Random", "Seeded", "Set datablock given in number to 1"}
uses:
  ::USRP::Interactive::demod_pulse_shape_test_wrapper.gcdl
diagram:
  call "GFDM RX signals.gvi"(Variable: K=$"Variable: K", Variable: M=$"Variable: M", Data generator?=$"Data generator?", Variable: number=$"Variable: number", Variable: random_g=$"Variable: random_g") -> (shifted_samples=w1, filter=w2, M-1=w3, K-1=w4, Variable: filtered_samples=w5)
  s1 = CFXP(16.16)[][] []  # shift register
  s2 = 0  # shift register
  while {
    Feedback Node(input=w6) -> w7
    Feedback Node(input=w8) -> w9
    case (s2) {
      frame 0, Default {
        Increment(x=s2) -> w10
        w11 = default
        w12 = default
        w13 = default
        w14 = TRUE
      }
      frame 1 {
        Boolean To Integer(Boolean=w9) -> (0, 1=w15)
        Add(w15, s2) -> w10
        w11 = TRUE
        w12 = default
        w13 = default
        w14 = default
      }
      frame 3 {
        Boolean To Integer(Boolean=w7) -> (0, 1=w16)
        Add(w16, s2) -> w10
        w11 = default
        w12 = TRUE
        w13 = default
        w14 = default
      }
      frame 4 {
        w10 = s2
        w11 = default
        w12 = default
        w13 = TRUE
        w14 = default
      }
    }
    Feedback Node(input=w12) -> w17
    call "GFDM_counter_host.gvi"(reset=w14, M-1=w3, K-1=w4, tick=w17) -> (block_end=w6, first subsymbol=w18, new subsymbol=w19, n=w20, m=w21, k=w22)
    Array Index(array=w1) -> (out0[w20, _]=w23)
    call "32 bit Array to chart graph.gvi"(Array=w23) -> (x=w24)
    $"data input" <- w24
    call "fifo simulator_64.gvi"(ready for output=w11, Array=w2) -> (element=w25, valid=w26)
    call "u64_to_cfx.gvi"(input=w25) -> (output=w27)
    Absolute Value(x=w27) -> w28
    $filter <- w28
    call "demod_pulse_shape_test_wrapper.gcdl"(input=w23, k=w22, valid_in=w12, filter in=w25, filter valid=w26, K-1=w4, M-1=w3, reset=w14) -> (last sample=w8, valid out=w29, output=w30)
    call "64 bit Array to chart graph.gvi"(Array=w30) -> (x=w31)
    $"data output" <- w31
    Boolean To Integer(Boolean=w29) -> (0, 1=w32)
    $"valid out" <- w32
    case (w29) {
      frame False, Default {
        w33 = s1
      }
      frame True {
        for {
          w34 = each element of w30
          call "u64_to_cfx.gvi"(input=w34) -> (output=w36)
          append w36 to w35
        }
        Insert Into Array(inArray=s1, new=w35) -> w33
      }
    }
    $Output <- w33
    $m <- w20
    $n <- w22
    $k <- w21
    Boolean To Integer(Boolean=w19) -> (0, 1=w37)
    $"new subsymbol" <- w37
    Boolean To Integer(Boolean=w18) -> (0, 1=w38)
    $"first subsymbol" <- w38
    Boolean To Integer(Boolean=w6) -> (0, 1=w39)
    $"block end" <- w39
    Boolean To Integer(Boolean=w26) -> (0, 1=w40)
    $write <- w40
    Feedback Node[DelayCount=20](input=w13) -> w41
    Boolean To Integer(Boolean=w12) -> (0, 1=w42)
    $"valid in" <- w42
    $state <- s2
    next s1 = w33
    next s2 = w10
    stop if w41
  }
  call "norm CFX-Array.gvi"(Input=s1) -> (Output=w43)
  call "norm CFX-Array.gvi"(Input=w5) -> (Output=w44)
  Build Array[ConcatenateInputs=True](w43, w44) -> w45
  Absolute Value(x=w45) -> w46
  Transpose 2D Array(2D array=w46) -> (transposed array=w47)
  $Results <- w47
  $"FPGA CDB result" <- w43
  $reference <- w44
  Divide(x=$"Limit [%]", y=100) -> w48
  for {
    w49 = each element of w43
    w50 = each element of w44
    call "compare_elements.gvi"(reference=w50, array=w49, limit=w48) -> (equal=w52)
    append w52 to w51
  }
  $"Line passed" <- w51
  And Array Elements(Boolean array=w51) -> (logical AND=w53)
  $"Test passed?" <- w53
