vi "demodulator test.gvi"   [LabVIEW Communications System Design Suite 2.0.1]
panel controls:
  "GFDM parameter in": "GFDM parameter.gtype" = {"Variable: K"=8, "Variable: M"=3, "filter type"="rc", "receive filter"="MF"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}
  "bits per symbol": u8 = 1
  "RX.fft.bitshift_in": i16 = 14
  "RX.modem.bitshift_in": i16
  "use testvectors": bool
panel indicators:
  "abs": f64[][]
  "real": f64[][]
  "imag": f64[][]
  "loop iteration": i32
types:
  "GFDM parameter.gtype" = cluster{"Variable: K": i32, "Variable: M": i32, "Variable: a": f64, "filter type": enum{"rc", "rect"}, "receive filter": enum{"MF", "ZF"}, "inverse FFT": bool, "Variable: b": f64, "Ncs": u16, "Ncp": u16}
uses:
  ::USRP::Interactive::Demodulator test wrapper.gcdl
diagram:
  case ($"use testvectors") {
    frame True {
      Property Node(instance in=$"GFDM parameter in") -> ("Variable: K"=w4, "Variable: M"=w5)
      call "read test vector.gvi"(M=w5, direction="RX", K=w4) -> (input=w2, output=w6, g=w3)
      call "norm CFX.gvi"(Input=w6) -> (Output=w1)
    }
    frame False {
      call "generate pulse shape.gvi"(GFDM parameter=$"GFDM parameter in", Norm filters=TRUE) -> (pulse shaping filter g=w7, receiver filter gamma=w3)
      call "create symbol map.gvi"(bits per symbol=$"bits per symbol") -> (symbol map=w8)
      call "Create coded bits.gvi"(GFDM parameter in=$"GFDM parameter in", symbol map=w8, bits per symbol=$"bits per symbol") -> (CDB symbols=w9)
      call "time-domain modulator.gvi"(GFDM parameter=$"GFDM parameter in", pulse shaping filter g=w7, data as a vector d=w9) -> (time signal x=w10)
      call "norm CFX.gvi"(Input=w10) -> (Output=w2)
      call "time-domain demodulator.gvi"(GFDM parameter in=$"GFDM parameter in", receive filter gamma=w3, received signal y=w2) -> (iq symbols=w1)
    }
  }
  call "create FPGA config.gvi"(GFDM parameter=$"GFDM parameter in") -> (Modem Configuration=w11)
  call "CDB array to 2.14 FXP u32.gvi"(input=w2) -> (output=w12)
  call "CDB array to 16.16 u64.gvi"(FFT{x}=w3) -> (Array=w13)
  while (iteration -> i1) {
    Is First Call() -> w16
    Feedback Node[DelayCount=10](input=w16) -> w17
    call "toggle_output.gvi"(toggle=w17, reset=w16) -> (output=w18)
    Is First Call() -> w19
    call "fifo simulator_64.gvi"(ready for output=w18, Array=w13, reset=w19) -> (element=w20, valid=w21)
    Feedback Node(input=w22) -> w23
    call "detect rising edge.gvi"(in=w23) -> (out=w24)
    Is First Call() -> w25
    call "toggle_output.gvi"(toggle=w24, reset=w25) -> (output=w26)
    Is First Call() -> w27
    call "fifo simulator_32.gvi"(ready for output=w26, Array=w12, reset=w27) -> (element=w28, valid=w29)
    Feedback Node[DelayCount=10](input=TRUE) -> w30
    Is First Call() -> w31
    call "Demodulator test wrapper.gcdl"(data=w28, data valid=w29, RX.reset_in=w31, RX.fft.bitshift_in=$"RX.fft.bitshift_in", RX.configure_in=w30, RX.Modem configuration_in=w11, filter valid=w21, filter=w20, RX.modem.bitshift_in=$"RX.modem.bitshift_in") -> (RX.32 bit data_out=w32, RX.64 bit data_out=w33, RX.config done_out=w22, RX.last sample_out=w34, RX. data valid_out=w35)
    call "u64_to_cfx.gvi"(input=w33) -> (output=w36)
    call "u32 to 2.14 CDB.gvi"(u32=w32) -> (CFX out=w37)
    Feedback Node[DelayCount=10](input=w34) -> w38
    $"loop iteration" <- i1
    append w36 to w14 if w35
    append w37 to w15 if w35
    stop if w38
  }
  call "norm CFX.gvi"(Input=w14) -> (Output=w39)
  Build Array(w39, w15, w1) -> w40
  Absolute Value(x=w40) -> w41
  $abs <- w41
  Complex To Real Imaginary(x + iy=w40) -> (x=w42, y=w43)
  $real <- w42
  $imag <- w43
