vi "fft_test.gvi"   [LabVIEW Communications System Design Suite 2.0.1]
panel indicators:
  "s_axis_data_tdata": f64[][]
  "control signals in": i16[][]
  "real": f64[][]
  "imag": f64[][]
  "control signals out": i16[][]
  "Graph": f64[][]
uses:
  ::USRP::Interactive::fft.gcdl
diagram:
  # N=512
  #
  # TRANSFORM LENGTH	TRANSFORM CYCLES
  # 8 			71
  # 16			140
  # 32			187
  # 64			305
  # 128			496
  # 256			901
  # 512			1668
  Math Node() -> ("data"=w1, "K"=w2, "M"=w3, "ready_for_output"=w4, "data_valid"=w5, "data_in_last"=w6, "config_valid"=w7, "result"=w8, "forward_fft"=w9, "K_1"=w10)
  ~~~
  bpsk = rand(8,1) * 2 - 1; %random BPSK signal
  laenge = 200;

  %%%%%%%%%%%%%%%%%%%%%%%%%%%%%%%%%%%%%%%%%%%%%%
  %define data signals for the periode laenge
  %%%%%%%%%%%%%%%%%%%%%%%%%%%%%%%%%%%%%%%%%%%%%%

  %defines the cycle when the data comes in
  start_1 = 8;
  start_2 = 100;
  start_3 = 108;
  start_4 = 120;

  %signal for the fft first
  data = zeros(laenge, 1);
  data(start_1:start_1 + 7) = bpsk;
  data(start_2:start_2 + 7) = bpsk;
  data(start_3:start_3 + 7) = bpsk;
  data(start_4:start_4 + 7) = bpsk;

  result = zeros(laenge, 1);
  result(start_1+63:start_1 + 70) = fft(bpsk);
  result(start_2+63:start_2 + 70) = ifft(bpsk);
  result(start_3+63:start_3 + 70) = ifft(bpsk);
  result(start_4+63:start_4 + 70) = ifft(bpsk);

  %signal to tell that data is valid
  data_valid = zeros(laenge, 1);
  data_valid(start_1:start_1 + 7) = 1;
  data_valid(start_2:start_2 + 7) = 1;
  data_valid(start_3:start_3 + 7) = 1;
  data_valid(start_4:start_4 + 7) = 1;

  %last valid signal entered fft
  data_in_last = zeros(laenge,1);
  data_in_last(start_1 + 7) = 1;
  data_in_last(start_2 + 7) = 1;
  data_in_last(start_4 + 7) = 1;

  %%%%%%%%%%%%%%%%%%%%%%%%%%%%%%%%%%%%%%%%%%%%%%
  %configuration signals
  %%%%%%%%%%%%%%%%%%%%%%%%%%%%%%%%%%%%%%%%%%%%%%
  M = ones(laenge, 1);
  M(90:laenge) = 2;
  forward_fft = ones(laenge,1);
  forward_fft(90:laenge) = 0;
  K = ones(laenge, 1) * 8;
  ready_for_output = ones(laenge, 1);
  config_valid = zeros(laenge, 1);
  config_valid(3:30) = 1;
  config_valid(91:95) = 1;

  K_1 = K - 1;
  M_1 = M - 1;
  ~~~
  Not(x=w9) -> w11
  for (after w3) (after w10) {
    w12 = each element of w1
    w13 = each element of w2
    w14 = each element of w4
    w15 = each element of w5
    w16 = each element of w7
    w17 = each element of w11
    Logarithm Base 2(x=w13) -> w32
    To Unsigned Byte Integer(number=w32) -> w33
    To Complex Fixed Point(complex fixed-point type=CFXP(9.7) 0+0i, number=w12) -> w34: CFXP(9.7) Saturate:ConvergentRounding
    call "cfx_to_u32.gvi"(input=w34) -> (output=w35)
    call "fft.gcdl"(config_valid=w16, data_in_valid=w15, fft_size_log2(K)=w33, data_in=w35, ready_for_output=w14, inverse FFT=w17, K=w13) -> (data_out_valid=w36, 32 bit data out=w37, ready_for_data=w38, halt=w39, last sample=w40, debug cluster=w41)
    call "u32_to_cfx.gvi"(input=w37) -> (output=w42)
    # data_out valid
    Boolean To Integer(Boolean=w36) -> (0, 1=w43)
    Boolean To Integer(Boolean=w38) -> (0, 1=w44)
    Multiply(2, w44) -> w45
    Boolean To Integer(Boolean=w40) -> (0, 1=w46)
    Multiply(3, w46) -> w47
    # ready for data
    # data_in_last
    Property Node(instance in=w41) -> ("event_data_out_channel_halt"=w48, "event_data_in_channel_halt"=w49, "event_status_channel_halt"=w50, "event_tlast_missing"=w51, "event_tlast_unexpected"=w52, "event_frame_started"=w53, "m_axis_data_tlast"=w54, "s_axis_config_tready"=w55, "s_axis_data_tready"=w56)
    Boolean To Integer(Boolean=w48) -> (0, 1=w57)
    Multiply(4, w57) -> w58
    Boolean To Integer(Boolean=w49) -> (0, 1=w59)
    Multiply(5, w59) -> w60
    Boolean To Integer(Boolean=w50) -> (0, 1=w61)
    Multiply(6, w61) -> w62
    Boolean To Integer(Boolean=w51) -> (0, 1=w63)
    Multiply(7, w63) -> w64
    Boolean To Integer(Boolean=w52) -> (0, 1=w65)
    Multiply(8, w65) -> w66
    Boolean To Integer(Boolean=w53) -> (0, 1=w67)
    Multiply(9, w67) -> w68
    Boolean To Integer(Boolean=w54) -> (0, 1=w69)
    Multiply(10, w69) -> w70
    Boolean To Integer(Boolean=w55) -> (0, 1=w71)
    Multiply(11, w71) -> w72
    Boolean To Integer(Boolean=w56) -> (0, 1=w73)
    Multiply(12, w73) -> w74
    Boolean To Integer(Boolean=w39) -> (0, 1=w75)
    Multiply(13, w75) -> w76
    append w42 to w18
    append w43 to w19
    append w45 to w20
    append w47 to w21
    append w58 to w22
    append w60 to w23
    append w62 to w24
    append w64 to w25
    append w66 to w26
    append w68 to w27
    append w70 to w28
    append w72 to w29
    append w74 to w30
    append w76 to w31
  }
  call "norm CFX.gvi"(Input=w18) -> (Output=w77)
  Complex To Real Imaginary(x + iy=w77) -> (x=w78, y=w79)
  call "norm CFX.gvi"(Input=w8) -> (Output=w80)
  Complex To Real Imaginary(x + iy=w80) -> (x=w81, y=w82)
  Build Array(w78, w81) -> w83
  $real <- w83
  Build Array(w79, w82) -> w84
  $imag <- w84
  Build Array(w19, w20, w21, w22, w23, w24, w25, w26, w27, w28, w29, w30, w31) -> w85
  $"control signals out" <- w85
  # s_axis_data_tlast
  Complex To Real Imaginary(x + iy=w1) -> (x=w86, y=w87)
  Build Array(w86, w87) -> w88
  $s_axis_data_tdata <- w88
  # ready_for_output = m_axis_data_tready
  Boolean To Integer(Boolean=w4) -> (0, 1=w89)
  Multiply(1, w89) -> w90
  Boolean To Integer(Boolean=w6) -> (0, 1=w91)
  Multiply(2, w91) -> w92
  # config_valid = s_axis_config_tvalid
  Boolean To Integer(Boolean=w7) -> (0, 1=w93)
  Multiply(3, w93) -> w94
  # data_in_valid = s_axis_data_tvalid
  Boolean To Integer(Boolean=w5) -> (0, 1=w95)
  Multiply(4, w95) -> w96
  Boolean To Integer(Boolean=w11) -> (0, 1=w97)
  Multiply(5, w97) -> w98
  Build Array(w90, w92, w94, w96, w98) -> w99
  $"control signals in" <- w99
