vi "16 x 4 bit to 64 bit.gvi"   [LabVIEW NXG]
inputs:
  "Variable: array_input": u8[][]
outputs:
  "Variable: multiplexer_config": u64[]
diagram:
  for {
    w1 = each element of $"Variable: array_input"
    Array Index(array=w1) -> (out0[_]=w3, out1[_]=w4, out2[_]=w5, out3[_]=w6, out4[_]=w7, out5[_]=w8, out6[_]=w9, out7[_]=w10, out8[_]=w11, out9[_]=w12, out10[_]=w13, out11[_]=w14, out12[_]=w15, out13[_]=w16, out14[_]=w17, out15[_]=w18)
    call "4 bit join numbers.gvi"(lower=w3, upper=w4) -> (out=w19)
    call "4 bit join numbers.gvi"(lower=w5, upper=w6) -> (out=w20)
    Join Numbers(high(x)=w19, low(x)=w20) -> w21
    call "4 bit join numbers.gvi"(lower=w7, upper=w8) -> (out=w22)
    call "4 bit join numbers.gvi"(lower=w9, upper=w10) -> (out=w23)
    Join Numbers(high(x)=w22, low(x)=w23) -> w24
    Join Numbers(high(x)=w21, low(x)=w24) -> w25
    call "4 bit join numbers.gvi"(lower=w11, upper=w12) -> (out=w26)
    call "4 bit join numbers.gvi"(lower=w13, upper=w14) -> (out=w27)
    Join Numbers(high(x)=w26, low(x)=w27) -> w28
    call "4 bit join numbers.gvi"(lower=w15, upper=w16) -> (out=w29)
    call "4 bit join numbers.gvi"(lower=w17, upper=w18) -> (out=w30)
    Join Numbers(high(x)=w29, low(x)=w30) -> w31
    Join Numbers(high(x)=w28, low(x)=w31) -> w32
    Join Numbers(high(x)=w25, low(x)=w32) -> w33
    append w33 to w2
  }
  $"Variable: multiplexer_config" <- w2
