vi "Multiplexing toplevel.gvi"   [LabVIEW Communications System Design Suite 2.0.1]
panel controls:
  "valid in": bool
  "array input": u64[16]
  "Multiplexer config": u64[16]
  "m": u8
panel indicators:
  "array output": u32[16]
  "valid out": bool
diagram:
  clock-driven loop (clock = "192 MHz") forever {
    Feedback Node(initial value=[0, 0, 0, 0, 0, 0, 0, 0, 0, 0, 0, 0, 0, 0, 0, 0], input=$"array input") -> w1
    Feedback Node(input=$m) -> w2
    Feedback Node(initial value=[0, 0, 0, 0, 0, 0, 0, 0, 0, 0, 0, 0, 0, 0, 0, 0], input=$"Multiplexer config") -> w3
    Feedback Node(input=$"valid in") -> w4
    call "flexible_multiplexer_32bit.gcdl"(Multiplexer config=w3, array input=w1, m=w2, valid in=w4) -> (array output=w5, valid out=w6)
    $"array output" <- w5
    $"valid out" <- w6
  }
