vi "flexible_multiplexer_64bit_test.gvi"   [LabVIEW Communications System Design Suite 2.0.1]
inputs:
  "Data generator?": T1 = "First Symbol"
  "Variable: number": f64 = 1
  "Variable: K": f64 = 4
  "Variable: M": f64 = 3
outputs:
  "Test passed?": bool
panel controls:
  "Variable: random_g": bool
  "limit": f64 = 0.1
panel indicators:
  "reference": c128[][]
  "FPGA Result": CFXP(2.14)[][]
  "Counter signals": bool[][]
  "Counter": f64[][]
  "m": f64[]
  "Input": c128[][]
types:
  T1 = enum{"First Symbol", "Random", "Seeded", "Set datablock given in number to 1", "Other"}
uses:
  ::USRP::Interactive::flexible_multiplexer_64bit.gcdl
diagram:
  call "GFDM RX signals.gvi"(Variable: K=$"Variable: K", Variable: M=$"Variable: M", Data generator?=$"Data generator?", Variable: number=$"Variable: number", Variable: random_g=$"Variable: random_g") -> (demodulator_mux=w1, splitted samples=w2, M-1=w3, K-1=w4, Variable: shifted_samples=w5)
  s1 = u32[][] []  # shift register
  for (N = $"Variable: M") {
    Build Array[ConcatenateInputs=True](s1, w2) -> w6
    next s1 = w6
  }
  while {
    w7 = each element of s1
    w8 = each element of w5
    Feedback Node(input=w7) -> w20
    for {
      w21 = each element of w20
      call "u32_to_cfx.gvi"(input=w21) -> (output=w23)
      append w23 to w22
    }
    Feedback Node[DelayCount=2](input=w8) -> w24
    Is First Call() -> w25
    Not(x=w25) -> w26
    Feedback Node(input=w26) -> w27
    call "GFDM_counter_host.gvi"(reset=w25, M-1=w3, K-1=w4, tick=w27) -> (block_end=w28, block_start=w29, first subsymbol=w30, new subsymbol=w31, n=w32, m=w33, k=w34)
    call "flexible_multiplexer_64bit.gcdl"(Multiplexer config=w1, array input=w20, m=w33, valid in=w26) -> (array output=w35, valid out=w36)
    Select(s=w36, t=w35, f=u32[16] default) -> w37
    for {
      w38 = each element of w37
      call "u32_to_cfx.gvi"(input=w38) -> (output=w40)
      append w40 to w39
    }
    call "compare_elements.gvi"(reference=w24, array=w39, limit=$limit) -> (equal=w41)
    append w39 to w9
    append w24 to w10
    append w31 to w11
    append w30 to w12
    append w29 to w13
    append w28 to w14
    append w32 to w15
    append w34 to w16
    append w33 to w17
    append w22 to w18
    append w41 to w19
    stop if w28
  }
  $reference <- w10
  $Input <- w18
  $"FPGA Result" <- w9
  And Array Elements(Boolean array=w19) -> (logical AND=w42)
  $"Test passed?" <- w42
  Build Array(w15, w16, w17) -> w43
  $Counter <- w43
  $m <- w17
  Build Array(w11, w12, w13, w14) -> w44
  $"Counter signals" <- w44
