vi "New Modem AWGN Toplevel.gvi"   [LabVIEW Communications System Design Suite 2.0.1]
panel controls:
  "Modem configuration_in": "modem_configuration.gtype"
  "configure!": bool
  "TX.modem.bitshift_in": i16
  "reset!": bool
  "RX.modem.fft.bitshift_in": i16
  "RX.modem.bitshift_in": i16
panel indicators:
  "TX.modem.config done_out": bool
  "TX.modem.DEBUG.cluster_out": T4
  "TX.modem.configuration_out": "modem_configuration.gtype"
  "RX.modem.DEBUG.cluster_out": T4
  "RX.modem.config done_out": bool
  "RX.modem.modem_configuration_out": "modem_configuration.gtype"
  "reset_active_out": bool
types:
  "modem_configuration.gtype" = cluster{"K-1": u16, "M-1": u8, "N-1": u16, "N": u16, "Npreamble+CP+CS": u16, "Npreamble": u16, "Nw": u16, "Modulator MUX config": u64[16], "K": u16, "fft_size_log2(K)": u8, "inverse_fft": bool, "Start with preamble": bool, "Burstmode": bool, "Ncs": u16, "Ncp": u16, "N-Ncp": u16, "N+Ncp": u16, "N+Ncp+Ncs": u16, "Demodulator MUX config": u64[16], "M": u8, "DFT SIZE": FXP(6.0), "Frame length": u32, "Super frame length": u32, "Ns_all_GFDM_blocks": u32, "Ns_all_preambles": u32}
  T1 = cluster{"packets in_out": u16, "samples in_out": u16, "packets out_out": u16, "samples out_out": u16, "number of invalid samples": u64, "mod first samples out": u64, "mod last samples out": u64}
  T2 = cluster{"FFT misalignment": u64, "FFT halt": u64, "FFT last sample": u64}
  T3 = cluster{"number of invalid samples": u64, "first samples out": u64, "last samples out": u64, "number of cycles": u64}
  T4 = cluster{"Element 1": T1, "Element 2": T2, "Element 3": T3}
diagram:
  Register Create(initial value="modem_configuration.gtype" {all zero or empty}) -> (reference out=w1)
  clock-driven loop (clock = "40 MHz Onboard Clock") forever {
    Register Write(data=$"Modem configuration_in", reference in=w1)
  }
  clock-driven loop (clock = "USRP Resources.grsc\\200 MHz") forever {
    Register Read(reference in=w1) -> (data=w2)
    call "Modulator.gcdl"(TX.modem.data fifo_in="USRP Resources.grsc\\mod_32 bit data in", TX.modem.bitshift_in=$"TX.modem.bitshift_in", TX.modem.configuration_in=w2, TX.modem.configure_in=$"configure!", TX.modem.filter fifo_in="USRP Resources.grsc\\mod_pulse shape in", TX.modem.reset_in=$"reset!") -> (TX.modem.64 bit data_out=w3, TX.modem.data valid_out=w4, TX.modem.32 bit data_out=w5, TX.modem.configuration_out=w6, TX.modem.DEBUG.cluster_out=w7, TX.modem.config done_out=w8, TX.modem.reset active_out=w9)
    call "AWGN.gcdl"(valid in=w4, AWGN FIFO="USRP Resources.grsc\\AWGN_in_32Bit", x=w5) -> (valid out=w10, y=w11)
    FIFO Write(Control Protocol Input=w10, data=w11, reference in="USRP Resources.grsc\\exchange") -> (reference out=w12)
    call "Demodulator.gcdl"(RX.modem.data fifo_in=w12, RX.modem.fft.bitshift_in=$"RX.modem.fft.bitshift_in", RX.modem.configuration_in=w2, RX.modem.configure_in=$"configure!", RX.modem.filter fifo_in="USRP Resources.grsc\\dem_filter in", RX.modem.reset_in=$"reset!", RX.modem.bitshift_in=$"RX.modem.bitshift_in") -> (RX.modem.64 bit data_out=w13, RX.modem.data valid_out=w14, RX.modem.32 bit data_out=w15, RX.modem.modem_configuration_out=w16, RX.modem.DEBUG.cluster_out=w17, RX.modem.config done_out=w18, RX.reset active_out=w19)
    FIFO Write(Control Protocol Input=w14, data=w13, reference in="USRP Resources.grsc\\dem_data out 64 bit")
    FIFO Write(Control Protocol Input=w4, data=w3, reference in="USRP Resources.grsc\\mod_data out 64 bit")
    FIFO Write(Control Protocol Input=w14, data=w15, reference in="USRP Resources.grsc\\dem_data out 32 bit")
    $"TX.modem.configuration_out" <- w6
    $"RX.modem.modem_configuration_out" <- w16
    $"TX.modem.config done_out" <- w8
    $"RX.modem.config done_out" <- w18
    $"TX.modem.DEBUG.cluster_out" <- w7
    $"RX.modem.DEBUG.cluster_out" <- w17
    Logical Or(w19, w9) -> w20
    $reset_active_out <- w20
  }
