vi "New Modem Click Test.gvi"   [LabVIEW Communications System Design Suite 2.0.1]
panel controls:
  "stop": bool
  "GFDM Parameter in": "GFDM parameter.gtype" = {"Variable: K"=64, "Variable: M"=9, "Variable: a"=0.5, "filter type"="rc", "receive filter"="ZF", "inverse FFT"=TRUE, "Variable: b"=0.5, "Ncs"=0, "Ncp"=0}
  "TX.modem.bitshift": i16 = 12
  "RX.modem.bitshift_in": i16 = 14
  "RX.modem.fft.bitshift_in": i16 = 14
  "write": bool
  "reset": bool
  "Tab": i32
panel indicators:
  "Graph": c128[][]
  "TX idle": f64
  "RX idle": f64
  "RX.modem.DEBUG.cluster_out": T4
  "TX.modem.DEBUG.cluster_out": T4
  "Bytes per Packet": f64
  "TX.modem.configuration_out": T5
  "RX.elements remaining": u32
  "TX input samples": UFXP(2.14)
  "TX out": f64[][]
  "TX elements remaining": u32
types:
  "GFDM parameter.gtype" = cluster{"Variable: K": i32, "Variable: M": i32, "Variable: a": f64, "filter type": enum{"rc", "rect"}, "receive filter": enum{"MF", "ZF"}, "inverse FFT": bool, "Variable: b": f64, "Ncs": u16, "Ncp": u16}
  T1 = cluster{"packets in_out": u16, "samples in_out": u16, "packets out_out": u16, "samples out_out": u16, "number of invalid samples": u64, "mod first samples out": u64, "mod last samples out": u64}
  T2 = cluster{"FFT misalignment": u64, "FFT halt": u64, "FFT last sample": u64}
  T3 = cluster{"number of invalid samples": u64, "first samples out": u64, "last samples out": u64, "number of cycles": u64}
  T4 = cluster{"Element 1": T1, "Element 2": T2, "Element 3": T3}
  T5 = cluster{"K-1": u16, "M-1": u8, "N-1": u16, "N": u16, "Npreamble+CP+CS": u16, "Npreamble": u16, "Nw": u16, "Modulator MUX config": u64[16], "K": u16, "fft_size_log2(K)": u8, "inverse_fft": bool, "Start with preamble": bool, "Burstmode": bool, "Ncs": u16, "Ncp": u16, "N-Ncp": u16, "N+Ncp": u16, "N+Ncp+Ncs": u16, "Demodulator MUX config": u64[16], "M": u8, "DFT SIZE": FXP(6.0), "Frame length": u32, "Super frame length": u32, "Ns_all_GFDM_blocks": u32, "Ns_all_preambles": u32}
diagram:
  FPGA Open Node[ProjectItem=":USRP:New\\ Modem\\ AWGN", TopVITarget=":USRP:New\\ Modem\\ AWGN:New\\ Modem\\ AWGN\\ Toplevel\\.gvi"](RIO address="RIO0") -> (error out=w1, reference out=w2)
  Get Execution Mode Node(reference in=w2) -> (execution mode=w3)
  case (w3) {
    frame "simulation" {
      w4 = w2
      w5 = w1
    }
    frame "hardware", Default {
      FPGA Download Node(error in=w1, reference in=w2) -> (error out=w5, reference out=w4)
    }
  }
  FPGA Run Node(error in=w5, reference in=w4) -> (error out=w6, reference out=w7)
  Host Fifo Configure Node[FifoName="USRP Resources.grsc\\dem_data out 32 bit"](depth=655535, error in=w6, reference in=w7) -> (actual depth=w8, error out=w9, reference out=w10)
  Host Fifo Configure Node[FifoName="USRP Resources.grsc\\dem_data out 64 bit"](depth=w8, error in=w9, reference in=w10) -> (actual depth=w11, error out=w12, reference out=w13)
  Host Fifo Configure Node[FifoName="USRP Resources.grsc\\dem_filter in"](depth=w11, error in=w12, reference in=w13) -> (actual depth=w14, error out=w15, reference out=w16)
  Host Fifo Configure Node[FifoName="USRP Resources.grsc\\mod_32 bit data in"](depth=w14, error in=w15, reference in=w16) -> (actual depth=w17, error out=w18, reference out=w19)
  Host Fifo Configure Node[FifoName="USRP Resources.grsc\\mod_data out 64 bit"](depth=w17, error in=w18, reference in=w19) -> (actual depth=w20, error out=w21, reference out=w22)
  Host Fifo Configure Node[FifoName="USRP Resources.grsc\\mod_pulse shape in"](depth=w20, error in=w21, reference in=w22) -> (actual depth=w23, error out=w24, reference out=w25)
  Host Fifo Configure Node[FifoName="USRP Resources.grsc\\AWGN_in_32Bit"](depth=w23, error in=w24, reference in=w25) -> (error out=w26, reference out=w27)
  Host Fifo Start Node[FifoName="USRP Resources.grsc\\AWGN_in_32Bit"](error in=w26, reference in=w27) -> (error out=w28, reference out=w29)
  Host Fifo Start Node[FifoName="USRP Resources.grsc\\dem_data out 32 bit"](error in=w28, reference in=w29) -> (error out=w30, reference out=w31)
  Host Fifo Start Node[FifoName="USRP Resources.grsc\\dem_data out 64 bit"](error in=w30, reference in=w31) -> (error out=w32, reference out=w33)
  Host Fifo Start Node[FifoName="USRP Resources.grsc\\dem_filter in"](error in=w32, reference in=w33) -> (error out=w34, reference out=w35)
  Host Fifo Start Node[FifoName="USRP Resources.grsc\\mod_32 bit data in"](error in=w34, reference in=w35) -> (error out=w36, reference out=w37)
  Host Fifo Start Node[FifoName="USRP Resources.grsc\\mod_data out 64 bit"](error in=w36, reference in=w37) -> (error out=w38, reference out=w39)
  Host Fifo Start Node[FifoName="USRP Resources.grsc\\mod_pulse shape in"](error in=w38, reference in=w39) -> (error out=w40, reference out=w41)
  case (w40) {
    frame No Error, Default {
      call "create FPGA config.gvi"(GFDM parameter=$"GFDM Parameter in") -> (Modem Configuration=w44)
      Property Node(instance in=w44) -> ("N"=w45)
      Divide(x=w45, y=8) -> w46
      call "create ramp.gvi"(x / y=w46) -> (data in=w47)
      call "Encode+QAMmapping.gvi"(input bit stream=w47) -> (data as a vector d=w48, data as a u32 vector=w49)
      sequence {
        frame 0 {
          Property Node(instance in=w41, "reset!"=TRUE, "configure!"=FALSE, error in=w40) -> (error out=w50, instance out=w51)
        }
        frame 1 {
          Wait(time to wait=1000)
        }
      }
      Property Node(instance in=w51, "Modem configuration_in"=w44, error in=w50) -> (error out=w52, instance out=w53)
      while {
        Property Node(instance in=w53, "reset!"=FALSE, error in=w52) -> ("reset_active_out"=w54, error out=w55, instance out=w56)
        Not(x=w54) -> w57
        Wait(time to wait=100)
        stop if w57
      }
      call "generate pulse shape.gvi"(GFDM parameter=$"GFDM Parameter in", Norm filters=TRUE) -> (pulse shaping filter g=w58, receiver filter gamma=w59)
      call "CDB array to 16.16 u64.gvi"(FFT{x}=w59) -> (Array=w60)
      Host Fifo Write Node[FifoName="USRP Resources.grsc\\dem_filter in"](data=w60, error in=w55, reference in=w56) -> (error out=w61, reference out=w62)
      call "CDB array to 16.16 u64.gvi"(FFT{x}=w58) -> (Array=w63)
      Host Fifo Write Node[FifoName="USRP Resources.grsc\\mod_pulse shape in"](data=w63, error in=w61, reference in=w62) -> (error out=w64, reference out=w65)
      while {
        Property Node(instance in=w65, "configure!"=TRUE, "TX.modem.bitshift_in"=$"TX.modem.bitshift", "RX.modem.bitshift_in"=$"RX.modem.bitshift_in", "RX.modem.fft.bitshift_in"=$"RX.modem.fft.bitshift_in", error in=w64) -> ("TX.modem.config done_out"=w66, "RX.modem.config done_out"=w67, "TX.modem.configuration_out"=w68, error out=w69, instance out=w70)
        Logical And(w66, w67) -> w71
        $"TX.modem.configuration_out" <- w68
        Wait(time to wait=100)
        stop if w71
      }
      Property Node(instance in=w70, "configure!"=FALSE, error in=w69) -> (error out=w72, instance out=w73)
      while {
        call "fifo simulator_32.gvi"(ready for output=$write, Array=w49, reset=$reset) -> (element=w74, valid=w75)
        case (w75) {
          frame False, Default {
            w42 = w73
          }
          frame True {
            Initialize Array(element=w74, size=1) -> w76
            Host Fifo Write Node[FifoName="USRP Resources.grsc\\mod_32 bit data in"](data=w76, error in=w72, reference in=w73) -> (reference out=w42)
            call "u32 to 2.14 CDB.gvi"(u32=w74) -> (CFX out=w77)
            Absolute Value(x=w77) -> w78
            $"TX input samples" <- w78
          }
        }
        Wait(time to wait=100)
        stop if $stop
      }
      $"Bytes per Packet" <- w46
      call "time-domain modulator.gvi"(GFDM parameter=$"GFDM Parameter in", pulse shaping filter g=w58, data as a vector d=w48) -> (time signal x=w79)
      while {
        Host Fifo Read Node[FifoName="USRP Resources.grsc\\dem_data out 64 bit"](error in=w72, number of elements=0, reference in=w73) -> (elements remaining=w80, error out=w81, reference out=w82)
        Is Not Equal To 0(x=w80) -> w83
        case (w83) {
          frame False, Default { }
          frame True {
            Host Fifo Read Node[FifoName="USRP Resources.grsc\\dem_data out 64 bit"](error in=w81, number of elements=w45, reference in=w82) -> (data=w84)
            call "u64 array to 16.16 CFX.gvi"(data=w84) -> (Array=w85)
            Build Array(w85, w48) -> w86
            $Graph <- w86
          }
        }
        $"RX.elements remaining" <- w80
        Host Fifo Read Node[FifoName="USRP Resources.grsc\\mod_data out 64 bit"](error in=w72, number of elements=0, reference in=w73) -> (elements remaining=w87, error out=w88, reference out=w89)
        Is Not Equal To 0(x=w87) -> w90
        case (w90) {
          frame False, Default { }
          frame True {
            Host Fifo Read Node[FifoName="USRP Resources.grsc\\mod_data out 64 bit"](error in=w88, number of elements=w45, reference in=w89) -> (data=w91)
            call "u64 array to 16.16 CFX.gvi"(data=w91) -> (Array=w92)
            Build Array(w92, w79) -> w93
            Absolute Value(x=w93) -> w94
            $"TX out" <- w94
          }
        }
        $"TX elements remaining" <- w87
        stop if $stop
      }
      while {
        Property Node(instance in=w73, "RX.modem.bitshift_in"=$"RX.modem.bitshift_in", "RX.modem.fft.bitshift_in"=$"RX.modem.fft.bitshift_in", "TX.modem.bitshift_in"=$"TX.modem.bitshift", error in=w72) -> ("RX.modem.DEBUG.cluster_out"=w95, "TX.modem.DEBUG.cluster_out"=w96, error out=w43)
        $"RX.modem.DEBUG.cluster_out" <- w95
        $"TX.modem.DEBUG.cluster_out" <- w96
        Property Node(instance in=w96) -> ("Element 3:number of invalid samples"=w97, "Element 3:number of cycles"=w98)
        Divide(x=w97, y=w98) -> w99
        $"TX idle" <- w99
        Property Node(instance in=w95) -> ("Element 3:number of invalid samples"=w100, "Element 3:number of cycles"=w101)
        Divide(x=w100, y=w101) -> w102
        $"RX idle" <- w102
        Wait(time to wait=100)
        stop if $stop
      }
    }
    frame Error {
      w42 = w41
      w43 = w40
    }
  }
  Host Fifo Stop Node[FifoName="USRP Resources.grsc\\dem_data out 32 bit"](error in=w43, reference in=w42) -> (error out=w103, reference out=w104)
  Host Fifo Stop Node[FifoName="USRP Resources.grsc\\dem_data out 64 bit"](error in=w103, reference in=w104) -> (error out=w105, reference out=w106)
  Host Fifo Stop Node[FifoName="USRP Resources.grsc\\dem_filter in"](error in=w105, reference in=w106) -> (error out=w107, reference out=w108)
  Host Fifo Stop Node[FifoName="USRP Resources.grsc\\mod_32 bit data in"](error in=w107, reference in=w108) -> (error out=w109, reference out=w110)
  Host Fifo Stop Node[FifoName="USRP Resources.grsc\\mod_data out 64 bit"](error in=w109, reference in=w110) -> (error out=w111, reference out=w112)
  Host Fifo Stop Node[FifoName="USRP Resources.grsc\\mod_pulse shape in"](error in=w111, reference in=w112) -> (error out=w113, reference out=w114)
  Host Fifo Stop Node[FifoName="USRP Resources.grsc\\AWGN_in_32Bit"](error in=w113, reference in=w114) -> (error out=w115, reference out=w116)
  Get Execution Mode Node(error in=w115, reference in=w116) -> (execution mode=w117)
  case (w117) {
    frame "simulation" {
      w118 = w116
      w119 = w115
      w120 = TRUE
    }
    frame "hardware", Default {
      w118 = w116
      w119 = w115
      w120 = FALSE
    }
  }
  FPGA Close Node(abort?=w120, error in=w119, reference in=w118)
  $stop <- FALSE
  # attempt to clear graphs
  # not sure if it works
  $"TX out" <- f64[][] []
  $Graph <- f64[][] []
