vi "New Modem Toplevel[Test].gvi"   [LabVIEW Communications System Design Suite 2.0.1]
panel controls:
  "Modem configuration_in": "modem_configuration.gtype"
  "configure!": bool
  "TX.modem.bitshift_in": i16
  "reset!": bool
  "RX.modem.fft.bitshift_in": i16
  "RX.modem.bitshift_in": i16
panel indicators:
  "TX.modem.config done_out": bool
  "TX.modem.DEBUG.cluster_out": T4
  "RX.modem.DEBUG.cluster_out": T4
  "RX.modem.config done_out": bool
  "RX.modem.modem_configuration_out": "modem_configuration.gtype"
  "config done": bool
types:
  "modem_configuration.gtype" = cluster{"K-1": u16, "M-1": u8, "N-1": u16, "N": u16, "Npreamble+CP+CS": u16, "Npreamble": u16, "Nw": u16, "Modulator MUX config": u64[16], "CP start": u16[16], "Subsymbol end": u16[16], "Subsymbol start": u16[16], "K": u16, "fft_size_log2(K)": u8, "inverse_fft": bool, "Start with preamble": bool, "Burstmode": bool, "Ncs": u16, "Ncp": u16, "N-Ncp": u16, "N+Ncp": u16, "N+Ncp+Ncs": u16, "Demodulator MUX config": u64[16], "M": u8, "DFT SIZE": FXP(6.0), "Frame length": u32, "Super frame length": u32, "Ns_all_GFDM_blocks": u32, "Ns_all_preambles": u32}
  T1 = cluster{"packets in_out": u16, "samples in_out": u16, "packets out_out": u16, "samples out_out": u16, "number of invalid samples": u64, "mod first samples out": u64, "mod last samples out": u64}
  T2 = cluster{"FFT misalignment": u64, "FFT halt": u64, "FFT last sample": u64}
  T3 = cluster{"number of invalid samples": u64, "first samples out": u64, "last samples out": u64, "number of cycles": u64}
  T4 = cluster{"Element 1": T1, "Element 2": T2, "Element 3": T3}
diagram:
  Register Create(initial value="modem_configuration.gtype" {all zero or empty}) -> (reference out=w1)
  clock-driven loop (clock = "40 MHz Onboard Clock") forever {
    Register Write(data=$"Modem configuration_in", reference in=w1)
  }
  clock-driven loop (clock = "USRP Resources.grsc\\200 MHz") forever {
    Register Read(reference in=w1) -> (data=w2)
    call "Modulator-Demodulator.gcdl"(TX.modem.configuration_in=w2, TX.modem.filter fifo_in="USRP Resources.grsc\\mod_pulse shape in", TX.modem.data fifo_in="USRP Resources.grsc\\mod_32 bit data in", reset!=$"reset!", TX.modem.bitshift_in=$"TX.modem.bitshift_in", configure!=$"configure!", RX.modem.bitshift_in=$"RX.modem.bitshift_in", RX.modem.fft.bitshift_in=$"RX.modem.fft.bitshift_in", RX.modem.filter fifo_in="USRP Resources.grsc\\dem_filter in") -> (RX.modem.data valid_out=w3, RX.modem.32 bit data_out=w4, RX.modem.64 bit data_out=w5, RX.modem.modem_configuration_out=w6, RX.modem.config done_out=w7, RX.modem.DEBUG.cluster_out=w8, TX.modem.DEBUG.cluster_out=w9, TX.modem.config done_out=w10, TX.modem.data valid_out=w11, TX.modem.64 bit data_out=w12, TX.modem.32 bit data_out=w13)
    FIFO Write(Control Protocol Input=w3, data=w5, reference in="USRP Resources.grsc\\dem_data out 64 bit")
    FIFO Write(Control Protocol Input=w3, data=w4, reference in="USRP Resources.grsc\\dem_data out 32 bit")
    $"RX.modem.modem_configuration_out" <- w6
    Logical And(w10, w7) -> w14
    $"config done" <- w14
    $"TX.modem.DEBUG.cluster_out" <- w9
    $"RX.modem.DEBUG.cluster_out" <- w8
    $"TX.modem.config done_out" <- w10
    $"RX.modem.config done_out" <- w7
    FIFO Write(Control Protocol Input=w11, data=w12, reference in="USRP Resources.grsc\\mod_data out 64 bit")
    FIFO Write(Control Protocol Input=w11, data=w13, reference in="USRP Resources.grsc\\mod_data out 32 bit")
  }
