vi "UDP-new modem-UDP Test_AWGN.gvi"   [LabVIEW Communications System Design Suite 2.0.1]
panel controls:
  "UDP receive port": u16 = 50000
  "stop": bool
  "bits per symbol": u8 = 6
  "UDP send.port or service name": u16 = 60000
  "GFDM Parameter in": "GFDM parameter.gtype" = {"Variable: K"=64, "Variable: M"=9, "Variable: a"=0.5, "filter type"="rc", "receive filter"="ZF", "inverse FFT"=TRUE, "Variable: b"=0.5, "Ncs"=0, "Ncp"=0}
  "TX.modem.bitshift": i16 = 12
  "RX symbols": CFXP(16.16)[]
  "TX symbols": c128[]
  "RX.modem.bitshift_in": i16 = 14
  "RX.modem.fft.bitshift_in": i16 = 14
  "SNR": f64 = 60
  "Signal Leistung": f64 = 1
  "Tab": i32
  "AWGN active": bool
panel indicators:
  "receive FIFO full": bool
  "UDP receive error": string  # source out indicates the source of the error.
  "TX.empty elements remaining": u32
  "RX.elements remaining": u32
  "Graph": c128[][]
  "TX idle": f64
  "RX idle": f64
  "RX.modem.DEBUG.cluster_out": T4
  "TX.modem.DEBUG.cluster_out": T4
  "Bytes per Packet": f64
  "UDP packet size": i32
  "FIFO symbols written": i32
  "TX.modem.configuration_out": T5
types:
  "GFDM parameter.gtype" = cluster{"Variable: K": i32, "Variable: M": i32, "Variable: a": f64, "filter type": enum{"rc", "rect"}, "receive filter": enum{"MF", "ZF"}, "inverse FFT": bool, "Variable: b": f64, "Ncs": u16, "Ncp": u16}
  T1 = cluster{"packets in_out": u16, "samples in_out": u16, "packets out_out": u16, "samples out_out": u16, "number of invalid samples": u64, "mod first samples out": u64, "mod last samples out": u64}
  T2 = cluster{"FFT misalignment": u64, "FFT halt": u64, "FFT last sample": u64}
  T3 = cluster{"number of invalid samples": u64, "first samples out": u64, "last samples out": u64, "number of cycles": u64}
  T4 = cluster{"Element 1": T1, "Element 2": T2, "Element 3": T3}
  T5 = cluster{"K-1": u16, "M-1": u8, "N-1": u16, "N": u16, "Npreamble+CP+CS": u16, "Npreamble": u16, "Nw": u16, "Modulator MUX config": u64[16], "K": u16, "fft_size_log2(K)": u8, "inverse_fft": bool, "Start with preamble": bool, "Burstmode": bool, "Ncs": u16, "Ncp": u16, "N-Ncp": u16, "N+Ncp": u16, "N+Ncp+Ncs": u16, "Demodulator MUX config": u64[16], "M": u8, "DFT SIZE": FXP(6.0), "Frame length": u32, "Super frame length": u32, "Ns_all_GFDM_blocks": u32, "Ns_all_preambles": u32}
diagram:
  call "config UDP.gvi"(receive port (from vlc player)=$"UDP receive port") -> (UDP receive=w1, UDP send=w2, error out=w3)
  FPGA Open Node[ProjectItem=":NullTarget:USRP\\-New\\ Modem\\ AWGN\\-0006\\.lvbitx"](RIO address="RIO0", error in=w3) -> (error out=w4, reference out=w5)
  FPGA Download Node(error in=w4, reference in=w5) -> (error out=w6, reference out=w7)
  FPGA Run Node(error in=w6, reference in=w7) -> (error out=w8, reference out=w9)
  Host Fifo Configure Node[FifoName="USRP Resources.grsc\\dem_data out 32 bit"](depth=655535, error in=w8, reference in=w9) -> (actual depth=w10, error out=w11, reference out=w12)
  Host Fifo Configure Node[FifoName="USRP Resources.grsc\\dem_data out 64 bit"](depth=w10, error in=w11, reference in=w12) -> (actual depth=w13, error out=w14, reference out=w15)
  Host Fifo Configure Node[FifoName="USRP Resources.grsc\\dem_filter in"](depth=w13, error in=w14, reference in=w15) -> (actual depth=w16, error out=w17, reference out=w18)
  Host Fifo Configure Node[FifoName="USRP Resources.grsc\\mod_32 bit data in"](depth=w16, error in=w17, reference in=w18) -> (actual depth=w19, error out=w20, reference out=w21)
  Host Fifo Configure Node[FifoName="USRP Resources.grsc\\mod_data out 64 bit"](depth=w19, error in=w20, reference in=w21) -> (actual depth=w22, error out=w23, reference out=w24)
  Host Fifo Configure Node[FifoName="USRP Resources.grsc\\mod_pulse shape in"](depth=w22, error in=w23, reference in=w24) -> (actual depth=w25, error out=w26, reference out=w27)
  Host Fifo Configure Node[FifoName="USRP Resources.grsc\\AWGN_in_32Bit"](depth=w25, error in=w26, reference in=w27) -> (error out=w28, reference out=w29)
  Host Fifo Start Node[FifoName="USRP Resources.grsc\\AWGN_in_32Bit"](error in=w28, reference in=w29) -> (error out=w30, reference out=w31)
  Host Fifo Start Node[FifoName="USRP Resources.grsc\\dem_data out 32 bit"](error in=w30, reference in=w31) -> (error out=w32, reference out=w33)
  Host Fifo Start Node[FifoName="USRP Resources.grsc\\dem_data out 64 bit"](error in=w32, reference in=w33) -> (error out=w34, reference out=w35)
  Host Fifo Start Node[FifoName="USRP Resources.grsc\\dem_filter in"](error in=w34, reference in=w35) -> (error out=w36, reference out=w37)
  Host Fifo Start Node[FifoName="USRP Resources.grsc\\mod_32 bit data in"](error in=w36, reference in=w37) -> (error out=w38, reference out=w39)
  Host Fifo Start Node[FifoName="USRP Resources.grsc\\mod_data out 64 bit"](error in=w38, reference in=w39) -> (error out=w40, reference out=w41)
  Host Fifo Start Node[FifoName="USRP Resources.grsc\\mod_pulse shape in"](error in=w40, reference in=w41) -> (error out=w42, reference out=w43)
  case (w42) {
    frame No Error, Default {
      sequence {
        frame 0 {
          Property Node(instance in=w43, "reset!"=TRUE, "reset!"=FALSE, error in=w42) -> (error out=w48, instance out=w49)
        }
        frame 1 {
          Wait(time to wait=1000)
        }
      }
      call "create FPGA config.gvi"(GFDM parameter=$"GFDM Parameter in") -> (Modem Configuration=w50)
      Property Node(instance in=w49, "Modem configuration_in"=w50, error in=w48) -> (error out=w51, instance out=w52)
      call "generate pulse shape.gvi"(GFDM parameter=$"GFDM Parameter in", Norm filters=TRUE) -> (pulse shaping filter g=w53, receiver filter gamma=w54)
      call "CDB array to 16.16 u64.gvi"(FFT{x}=w54) -> (Array=w55)
      Host Fifo Write Node[FifoName="USRP Resources.grsc\\dem_filter in"](data=w55, error in=w51, reference in=w52) -> (error out=w56, reference out=w57)
      call "CDB array to 16.16 u64.gvi"(FFT{x}=w53) -> (Array=w58)
      Host Fifo Write Node[FifoName="USRP Resources.grsc\\mod_pulse shape in"](data=w58, error in=w56, reference in=w57) -> (error out=w59, reference out=w60)
      while {
        Wait(time to wait=100)
        Property Node(instance in=w60, "configure!"=TRUE, "TX.modem.bitshift_in"=$"TX.modem.bitshift", "RX.modem.bitshift_in"=$"RX.modem.bitshift_in", "RX.modem.fft.bitshift_in"=$"RX.modem.fft.bitshift_in", error in=w59) -> ("TX.modem.config done_out"=w61, "RX.modem.config done_out"=w62, "TX.modem.configuration_out"=w63, error out=w64, instance out=w65)
        Logical And(w61, w62) -> w66
        $"TX.modem.configuration_out" <- w63
        stop if w66
      }
      Obtain Queue(element data type=u8 0) -> (queue out=w46)
      while {
        call "UDP read.gvi"(UDP connection=w1, Error=w64) -> (receive FIFO full=w67, data out=w68, UDP receive error=w69, error out=w70)
        Array Size(array=w68) -> (size(s)=w71)
        $"UDP packet size" <- w71
        $"receive FIFO full" <- w67
        for {
          w72 = each element of w68
          Enqueue Element(element=w72, error in=w70, queue=w46)
        }
        $"UDP receive error" <- w69
        stop if $stop
      }
      call "create symbol map.gvi"(bits per symbol=$"bits per symbol") -> (symbol map=w73)
      Property Node(instance in=w50) -> ("N"=w74)
      Multiply(w74, $"bits per symbol") -> w75
      Divide(x=w75, y=8) -> w76
      while {
        for (N = w76) {
          Dequeue Element(error in=w64, queue=w46) -> (element=w78, error out=w79)
          append w78 to w77
        }
        call "bits to QAM.gvi"(data in=w77, symbol map=w73) -> (symbols out=w80)
        $"TX symbols" <- w80
        call "CDB array to 2.14 FXP u32.gvi"(input=w80) -> (output=w81)
        Host Fifo Write Node[FifoName="USRP Resources.grsc\\mod_32 bit data in"](data=w81, error in=w79, reference in=w65) -> (empty elements remaining=w82, error out=w44, reference out=w45)
        $"TX.empty elements remaining" <- w82
        Array Size(array=w81) -> (size(s)=w83)
        $"FIFO symbols written" <- w83
        stop if $stop
      }
      $"Bytes per Packet" <- w76
      Obtain Queue(element data type=u8 0) -> (queue out=w47)
      s1 = w64  # shift register
      while {
        Host Fifo Read Node[FifoName="USRP Resources.grsc\\dem_data out 64 bit"](error in=s1, number of elements=w74, reference in=w65) -> (data=w84, elements remaining=w85, error out=w86)
        call "u64 array to 16.16 CFX.gvi"(data=w84) -> (Array=w87)
        call "QAM to bits.gvi"(symbol map=w73, symbols in=w87) -> (byte out=w88)
        for {
          w89 = each element of w88
          To Unsigned Byte Integer(number=w89) -> w90
          Enqueue Element(element=w90, error in=w86, queue=w47) -> (error out=w91)
        }
        $"RX.elements remaining" <- w85
        $"RX symbols" <- w87
        next s1 = w91
        stop if $stop
      }
      s2 = w64  # shift register
      while {
        w92 = $"UDP packet size"
        for (N = w92) {
          Dequeue Element(error in=s2, queue=w47) -> (element=w94, error out=w95)
          append w94 to w93
        }
        call "UDP send.gvi"(UDP send.port or service name=$"UDP send.port or service name", Input=w2, Array=w93, Error=w95) -> (Error_2=w96)
        next s2 = w96
        stop if $stop
      }
      while {
        Property Node(instance in=w65, "RX.modem.bitshift_in"=$"RX.modem.bitshift_in", "RX.modem.fft.bitshift_in"=$"RX.modem.fft.bitshift_in", "TX.modem.bitshift_in"=$"TX.modem.bitshift", error in=w64) -> ("RX.modem.DEBUG.cluster_out"=w97, "TX.modem.DEBUG.cluster_out"=w98)
        $"RX.modem.DEBUG.cluster_out" <- w97
        $"TX.modem.DEBUG.cluster_out" <- w98
        Property Node(instance in=w98) -> ("Element 3:number of invalid samples"=w99, "Element 3:number of cycles"=w100)
        Divide(x=w99, y=w100) -> w101
        $"TX idle" <- w101
        Property Node(instance in=w97) -> ("Element 3:number of invalid samples"=w102, "Element 3:number of cycles"=w103)
        Divide(x=w102, y=w103) -> w104
        $"RX idle" <- w104
        Build Array($"TX symbols", $"RX symbols") -> w105
        $Graph <- w105
        Wait(time to wait=100)
        stop if $stop
      }
      while {
        case ($"AWGN active") {
          frame False, Default { }
          frame True {
            call "create_noise.gvi"(length=w74, SNR=$SNR, Signal Leistung=$"Signal Leistung") -> (Noise=w106)
            call "CDB array to 2.14 FXP u32.gvi"(input=w106) -> (output=w107)
            Host Fifo Write Node[FifoName="USRP Resources.grsc\\AWGN_in_32Bit"](data=w107, error in=w64, reference in=w65)
          }
        }
        stop if $stop
      }
    }
    frame Error {
      w44 = w42
      w45 = w43
      w46 = default
      w47 = default
    }
  }
  Release Queue(error in=w44, queue=w46) -> (error out=w108)
  Release Queue(error in=w108, queue=w47) -> (error out=w109)
  Host Fifo Stop Node[FifoName="USRP Resources.grsc\\dem_data out 32 bit"](error in=w109, reference in=w45) -> (error out=w110, reference out=w111)
  Host Fifo Stop Node[FifoName="USRP Resources.grsc\\dem_data out 64 bit"](error in=w110, reference in=w111) -> (error out=w112, reference out=w113)
  Host Fifo Stop Node[FifoName="USRP Resources.grsc\\dem_filter in"](error in=w112, reference in=w113) -> (error out=w114, reference out=w115)
  Host Fifo Stop Node[FifoName="USRP Resources.grsc\\mod_32 bit data in"](error in=w114, reference in=w115) -> (error out=w116, reference out=w117)
  Host Fifo Stop Node[FifoName="USRP Resources.grsc\\mod_data out 64 bit"](error in=w116, reference in=w117) -> (error out=w118, reference out=w119)
  Host Fifo Stop Node[FifoName="USRP Resources.grsc\\mod_pulse shape in"](error in=w118, reference in=w119) -> (error out=w120, reference out=w121)
  Host Fifo Stop Node[FifoName="USRP Resources.grsc\\AWGN_in_32Bit"](error in=w120, reference in=w121) -> (error out=w122, reference out=w123)
  FPGA Close Node(error in=w122, reference in=w123)
  $stop <- FALSE
