vi "demod_subsmybol_split+multiplexer_test.gvi"   [LabVIEW NXG]
panel controls:
  "Variable: K": f64 = 4
  "Variable: M": f64 = 3
  "Data generator?": T1 = "First Symbol"
  "Variable: number": f64 = 1
  "Variable: random_g": bool
  "limit": f64 = 0.1
panel indicators:
  "Chart": i16
  "FPGA Output": CFXP(16.16)[][]
  "reference": c128[][]
  "Test passed": bool
types:
  T1 = enum{"First Symbol", "Random", "Seeded", "Set datablock given in number to 1"}
uses:
  ::Project::USRP::split+multiplexer.gcdl
diagram:
  call "GFDM RX signals.gvi"(Variable: K=$"Variable: K", Variable: M=$"Variable: M", Data generator?=$"Data generator?", Variable: number=$"Variable: number", Variable: random_g=$"Variable: random_g") -> (multiplexer config=w1, M-1=w2, K-1=w3, Variable: shifted_samples=w4, TX signal=w5)
  s1 = CFXP(16.16)[][] []  # shift register
  while {
    Is First Call() -> w6
    Not(x=w6) -> w7
    call "fifo simulator_32.gvi"(ready for output=w7, Array=w5) -> (element=w8, valid=w9)
    call "split+multiplexer.gcdl"(Multiplexer config=w1, ready for output=TRUE, valid in=w9, reset=w6, Input=w8, M-1=w2, K-1=w3) -> (array output=w10, valid out=w11)
    call "add array to array.gvi"(data=w10, valid=w11, Array=s1) -> (Array out=w12)
    Boolean To Integer(Boolean=w11) -> (0, 1=w13)
    $Chart <- w13
    call "detect falling edge.gvi"(in=w11) -> (out=w14)
    next s1 = w12
    stop if w14
  }
  $"FPGA Output" <- s1
  w15 = $limit
  for {
    w16 = each element of s1
    w17 = each element of w4
    call "compare_elements.gvi"(reference=w17, array=w16, limit=w15) -> (equal=w19)
    append w19 to w18
  }
  And Array Elements(Boolean array=w18) -> (logical AND=w20)
  $"Test passed" <- w20
  $reference <- w4
