vi "Preamble test.gvi"   [LabVIEW Communications System Design Suite 2.0.1]
panel controls:
  "preamble length": u16
  "data length": u32
panel indicators:
  "Array": u32[]
  "Graph": u32[]
  "loop iteration": i32
uses:
  ::USRP::Interactive::preamble_insertion_wrapper.gcdl
diagram:
  w1 = $"preamble length"
  for (N = w1) (iteration -> i1) {
    Increment(x=i1) -> w3
    append w3 to w2
  }
  Multiply(3, $"data length") -> w4
  for (N = w4) (iteration -> i2) {
    Increment(x=i2) -> w6
    Increment(x=w6) -> w7
    append w7 to w5
  }
  Decrement(x=w1) -> w8
  Decrement(x=$"data length") -> w9
  while (iteration -> i3) {
    Is First Call() -> w11
    Feedback Node(input=w11) -> w12
    call "toggle_output.gvi"(toggle=w12, reset=w11) -> (output=w13)
    call "fifo simulator_32.gvi"(ready for output=w13, Array=w2, reset=w11) -> (element=w14, valid=w15)
    Feedback Node(input=w16) -> w17
    call "toggle_output.gvi"(toggle=w17, reset=w11) -> (output=w18)
    call "fifo simulator_32.gvi"(ready for output=w18, Array=w5, reset=w11) -> (element=w19, valid=w20)
    call "preamble_insertion_wrapper.gcdl"(preamble valid=w15, preamble in=w14, data valid=w20, data=w19, preamble length=w8, data length=w9) -> (Preamble written=w16, output valid=w21, output=w22)
    Is Greater(x=i3, y=200) -> w23
    $"loop iteration" <- i3
    append w22 to w10 if w21
    stop if w23
  }
  $Array <- w10
  $Graph <- w10
