vi "test_FMUX_preamble_insertion.gvi"   [LabVIEW Communications System Design Suite 2.0.1]
panel controls:
  "Npre": i32
  "Npay": i32
  "times": i32
  "B": i32
panel indicators:
  "ref": u32[]
  "Graph": u32[][]
types:
  "CE_signalsType.gtype" = cluster{"data": u32, "valid": bool, "index": u16}
uses:
  ::USRP::Interactive::FMUX_preamble_insertion_pk.gcdl
diagram:
  w1 = $times
  w2 = $Npre
  for (N = w2) (iteration -> i1) {
    Increment(x=i1) -> w4
    To Unsigned Long Integer(number=w4) -> w5
    append w5 to w3
  }
  for (N = w1) {
    w9 = $B
    for (N = w9) {
      w12 = $Npay
      for (N = w12) (iteration -> i2) {
        Random Number() -> (number (0 to 1)=w15)
        Multiply(100, w15)
        Subtract(x=w12, y=i2) -> w16
        To Unsigned Long Integer(number=w16) -> w17
        append w17 to w13
        append i2 to w14
      }
      concatenate w13 onto w10
      concatenate w14 onto w11
    }
    Build Array[ConcatenateInputs=True](w3, w10) -> w18
    concatenate w10 onto w6
    concatenate w18 onto w7
    concatenate w11 onto w8
  }
  for (N = 1000) (iteration -> i3) (after w8) {
    # w6: data
    Random Number() -> (number (0 to 1)=w20)
    Is Greater(x=0.5, y=w20)
    Is Greater(x=i3, y=100) -> w21
    Logical And(w21, TRUE) -> w22
    call "fifo simulator_32.gvi"(ready for output=w22, Array=w6) -> (element=w23, valid=w24)
    call "fifo simulator_32.gvi"(ready for output=TRUE, Array=w3) -> (element=w25, valid=w26, address=w27)
    Decrement(x=w27) -> w28
    Property Node(instance in="CE_signalsType.gtype" {all zero or empty}, "data"=w25, "valid"=w26, "index"=w28) -> (instance out=w29)
    call "FMUX_preamble_insertion_pk.gcdl"(dataIn=w23, Npre=$Npre, dataValidIn=w24, Npay=$Npay, B=$B, config.PreambleCpCsSampleIn=w29, reset=FALSE) -> (DataOutValid=w30, DataOut=w31)
    append w31 to w19 if w30
  }
  Build Array(w7, w19) -> w32
  $Graph <- w32
  $ref <- w7
