vi "Detection Host Test.gvi"   [LabVIEW Communications System Design Suite 2.0.1]
panel controls:
  "Random data?": bool
  "Power distribution": bool = TRUE
  "Number ofPaths": i32 = 4
  "Max gain": f64
  "Min gain": f64 = -20
  "SNR (dB)": f64 = 60
  "GFDM parameter": "GFDM parameter.gtype" = {"Variable: K"=64, "Variable: M"=9, "Variable: a"=0.5, "filter type"="rc", "receive filter"="ZF", "inverse FFT"=TRUE, "Variable: b"=0, "Ncs"=16, "Ncp"=32}
  "RX.modem.bitshift_in": i16
  "equ.shift": i16
  "RX.modem.fft.bitshift_in": i16
panel indicators:
  "equ output": f64[][]
  "IQ": c128[][]
  "equ output RE": f64[][]
  "equ output IM": f64[][]
  "IQ output RE_2": f64[][]
  "IQ output IM_2": f64[][]
  "channel": f64[][]
  "time domain signal": f64[][]
  "RX.modem.DEBUG.cluster_out": T5
  "EQU elements remaining": u32
  "64 bit elements remaining": u32
  "32 bit elements remaining": u32
types:
  "GFDM parameter.gtype" = cluster{"Variable: K": i32, "Variable: M": i32, "Variable: a": f64, "filter type": enum{"rc", "rect"}, "receive filter": enum{"MF", "ZF"}, "inverse FFT": bool, "Variable: b": f64, "Ncs": u16, "Ncp": u16}
  T1 = cluster{"packets in_out": u16, "samples in_out": u16, "packets out_out": u16, "samples out_out": u16, "number of invalid samples": u64, "mod first samples out": u64, "mod last samples out": u64}
  T2 = cluster{"FFT misalignment": u64, "FFT halt": u64, "FFT last sample": u64}
  T3 = cluster{"number of invalid samples": u64, "first samples out": u64, "last samples out": u64, "number of cycles": u64}
  T4 = cluster{"FFT misalignment count": u8, "FFT halt count": u8, "block start": u16, "block end": u16, "overflow_2": u16, "update active_2": u16, "update done_2": u16, "first sample out_2": u16, "exponent": FXP(4.0), "exponent_2": FXP(4.0), "elements read_2": u32}
  T5 = cluster{"Element 1": T1, "Element 2": T2, "Element 3": T3, "Element 4": T4}
diagram:
  FPGA Open Node[ProjectItem=":NullTarget:USRP\\-Detection\\ toplevel\\-0008\\.lvbitx"](RIO address="RIO0") -> (error out=w1, reference out=w2)
  FPGA Download Node(error in=w1, reference in=w2) -> (error out=w3, reference out=w4)
  FPGA Run Node(error in=w3, reference in=w4) -> (error out=w5, reference out=w6)
  Host Fifo Configure Node[FifoName="Resources.grsc\\RX.channel Coefficients in"](depth=65500, error in=w5, reference in=w6) -> (actual depth=w7, error out=w8, reference out=w9)
  Host Fifo Configure Node[FifoName="Resources.grsc\\RX.Debug.Modem_32 bit samples out"](depth=w7, error in=w8, reference in=w9) -> (actual depth=w10, error out=w11, reference out=w12)
  Host Fifo Configure Node[FifoName="Resources.grsc\\RX.Debug.Modem_64 bit samples out"](depth=w10, error in=w11, reference in=w12) -> (actual depth=w13, error out=w14, reference out=w15)
  Host Fifo Configure Node[FifoName="Resources.grsc\\RX.Debug.Test data in"](depth=w13, error in=w14, reference in=w15) -> (actual depth=w16, error out=w17, reference out=w18)
  Host Fifo Configure Node[FifoName="Resources.grsc\\RX.pulse shape in"](depth=w16, error in=w17, reference in=w18) -> (actual depth=w19, error out=w20, reference out=w21)
  Host Fifo Configure Node[FifoName="Resources.grsc\\RX.Debug.Equ out"](depth=w19, error in=w20, reference in=w21) -> (error out=w22, reference out=w23)
  Host Fifo Start Node[FifoName="Resources.grsc\\RX.Debug.Equ out"](error in=w22, reference in=w23) -> (error out=w24, reference out=w25)
  Host Fifo Start Node[FifoName="Resources.grsc\\RX.channel Coefficients in"](error in=w24, reference in=w25) -> (error out=w26, reference out=w27)
  Host Fifo Start Node[FifoName="Resources.grsc\\RX.Debug.Modem_32 bit samples out"](error in=w26, reference in=w27) -> (error out=w28, reference out=w29)
  Host Fifo Start Node[FifoName="Resources.grsc\\RX.Debug.Modem_64 bit samples out"](error in=w28, reference in=w29) -> (error out=w30, reference out=w31)
  Host Fifo Start Node[FifoName="Resources.grsc\\RX.Debug.Test data in"](error in=w30, reference in=w31) -> (error out=w32, reference out=w33)
  Host Fifo Start Node[FifoName="Resources.grsc\\RX.pulse shape in"](error in=w32, reference in=w33) -> (error out=w34, reference out=w35)
  case (w34) {
    frame No Error, Default {
      Host Fifo Read Node[FifoName="Resources.grsc\\RX.Debug.Equ out"](error in=w34, number of elements=0, reference in=w35) -> (elements remaining=w38, error out=w39, reference out=w40)
      Host Fifo Read Node[FifoName="Resources.grsc\\RX.Debug.Equ out"](error in=w39, number of elements=w38, reference in=w40) -> (error out=w41, reference out=w42)
      Host Fifo Read Node[FifoName="Resources.grsc\\RX.Debug.Modem_64 bit samples out"](error in=w41, number of elements=0, reference in=w42) -> (elements remaining=w43, error out=w44, reference out=w45)
      Host Fifo Read Node[FifoName="Resources.grsc\\RX.Debug.Modem_64 bit samples out"](error in=w44, number of elements=w43, reference in=w45) -> (error out=w46, reference out=w47)
      Host Fifo Read Node[FifoName="Resources.grsc\\RX.Debug.Modem_32 bit samples out"](error in=w46, number of elements=0, reference in=w47) -> (elements remaining=w48, error out=w49, reference out=w50)
      Host Fifo Read Node[FifoName="Resources.grsc\\RX.Debug.Modem_32 bit samples out"](error in=w49, number of elements=w48, reference in=w50) -> (error out=w51, reference out=w52)
      call "GFDM generate parameter.gvi"(GFDM parameter=$"GFDM parameter") -> (receive filter=w53, Modem Configuration=w54, GFDM all parameters=w55)
      call "Detection test signal reference.gvi"(Random data?=$"Random data?", GFDM all parameters=w55, Power distribution=$"Power distribution", Number ofPaths=$"Number ofPaths", Max gain=$"Max gain", Min gain=$"Min gain", SNR (dB)=$"SNR (dB)") -> (received GFDM data=w56, channel coefficents=w57, TX symbols=w58, demodulator output=w59, GFDM block=w60, Equalizer output=w61, channel=w62, time domain signal=w63)
      sequence {
        frame 0 {
          Property Node(instance in=w52, "RX.modem.reset_in"=TRUE, "RX.modem.reset_in"=FALSE, error in=w51) -> (error out=w64, instance out=w65)
        }
        frame 1 {
          Wait(time to wait=100)
        }
        frame 2 {
          call "Calculate OR mask.gvi"(Input scaling=$"equ.shift") -> (OR Mask=w66)
          Property Node(instance in=w65, "TX.modem.configuration_in"=w54, "RX.modem.bitshift_in"=$"RX.modem.bitshift_in", "equ.shift"=$"equ.shift", "equ.OR Mask"=w66, "RX.modem.fft.bitshift_in"=$"RX.modem.fft.bitshift_in", error in=w64) -> (error out=w67, instance out=w68)
        }
        frame 3 {
          Host Fifo Write Node[FifoName="Resources.grsc\\RX.pulse shape in"](data=w53, error in=w67, reference in=w68) -> (error out=w69, reference out=w70)
          Host Fifo Write Node[FifoName="Resources.grsc\\RX.channel Coefficients in"](data=w57, error in=w69, reference in=w70) -> (error out=w71, reference out=w72)
        }
        frame 4 {
          while {
            Property Node(instance in=w72, "RX.modem.configure_in"=TRUE, error in=w71) -> ("RX.modem.config done_out"=w73, error out=w74, instance out=w75)
            Wait(time to wait=100)
            stop if w73
          }
        }
        frame 5 {
          Property Node(instance in=w75, "RX.modem.configure_in"=FALSE, error in=w74) -> (error out=w76, instance out=w77)
          Wait(time to wait=100)
        }
      }
      Host Fifo Write Node[FifoName="Resources.grsc\\RX.Debug.Test data in"](data=w56, error in=w76, reference in=w77) -> (error out=w78, reference out=w79)
      Array Size(array=w56) -> (size(s)=w80)
      Host Fifo Read Node[FifoName="Resources.grsc\\RX.Debug.Equ out"](error in=w78, number of elements=w80, reference in=w79) -> (data=w81, elements remaining=w82, error out=w83, reference out=w84)
      $"EQU elements remaining" <- w82
      Host Fifo Read Node[FifoName="Resources.grsc\\RX.Debug.Modem_64 bit samples out"](error in=w83, number of elements=w80, reference in=w84) -> (data=w85, elements remaining=w86, error out=w87, reference out=w88)
      $"64 bit elements remaining" <- w86
      Host Fifo Read Node[FifoName="Resources.grsc\\RX.Debug.Modem_32 bit samples out"](error in=w87, number of elements=w80, reference in=w88) -> (data=w89, elements remaining=w90, error out=w91, reference out=w92)
      $"32 bit elements remaining" <- w90
      Property Node(instance in=w92, error in=w91) -> ("RX.modem.DEBUG.cluster_out"=w93, error out=w37, instance out=w36)
      $"RX.modem.DEBUG.cluster_out" <- w93
      call "u64 array to 16.16 CFX.gvi"(data=w85) -> (Array=w94)
      call "u32 array to 2.14 CFX.gvi"(data=w89) -> (Array=w95)
      Build Array(w58, w94, w95, w59) -> w96
      $IQ <- w96
      Complex To Real Imaginary(x + iy=w96) -> (x=w97, y=w98)
      $"IQ output RE_2" <- w97
      $"IQ output IM_2" <- w98
      call "u32 array to 2.14 CFX.gvi"(data=w81) -> (Array=w99)
      Build Array(w60, w99, w61) -> w100
      Absolute Value(x=w100) -> w101
      $"equ output" <- w101
      Complex To Real Imaginary(x + iy=w100) -> (x=w102, y=w103)
      $"equ output RE" <- w102
      $"equ output IM" <- w103
      $channel <- w62
      $"time domain signal" <- w63
    }
    frame Error {
      w36 = w35
      w37 = w34
    }
  }
  Host Fifo Stop Node[FifoName="Resources.grsc\\RX.channel Coefficients in"](error in=w37, reference in=w36) -> (error out=w104, reference out=w105)
  Host Fifo Stop Node[FifoName="Resources.grsc\\RX.Debug.Equ out"](error in=w104, reference in=w105) -> (error out=w106, reference out=w107)
  Host Fifo Stop Node[FifoName="Resources.grsc\\RX.Debug.Modem_32 bit samples out"](error in=w106, reference in=w107) -> (error out=w108, reference out=w109)
  Host Fifo Stop Node[FifoName="Resources.grsc\\RX.Debug.Modem_64 bit samples out"](error in=w108, reference in=w109) -> (error out=w110, reference out=w111)
  Host Fifo Stop Node[FifoName="Resources.grsc\\RX.Debug.Test data in"](error in=w110, reference in=w111) -> (error out=w112, reference out=w113)
  Host Fifo Stop Node[FifoName="Resources.grsc\\RX.pulse shape in"](error in=w112, reference in=w113) -> (error out=w114, reference out=w115)
  FPGA Close Node(error in=w114, reference in=w115)
