vi "Detection test signal reference.gvi"   [LabVIEW Communications System Design Suite 2.0.1]
inputs:
  "Random data?": bool
  "GFDM all parameters": "GFDM all parameters.gtype"
  "Power distribution": bool = TRUE
  "Number ofPaths": i32 = 4
  "Max gain": f64
  "Min gain": f64 = -20
  "SNR (dB)": f64 = 60
outputs:
  "received GFDM data": u32[]
  "channel coefficents": u32[]
  "TX symbols": CFXP(2.14)[]
  "demodulator output": c128[]
  "GFDM block": c128[]
  "Equalizer output": c128[]
  "channel": f64[][]
  "time domain signal": f64[][]
  "FFT{x}": c128[]
  "product": c128[]
types:
  "GFDM parameter.gtype" = cluster{"Variable: K": i32, "Variable: M": i32, "Variable: a": f64, "filter type": enum{"rc", "rect"}, "receive filter": enum{"MF", "ZF"}, "inverse FFT": bool, "Variable: b": f64, "Ncs": u16, "Ncp": u16}
  T1 = cluster{"Preamble mu": u16, "GFDM B": u16, "Preamble K": u16, "Preamble Ncp": u16, "GFDM Ncp": u16, "GFDM M": u16, "Preamble Ncs": u16, "GFDM K": u16, "GFDM Ncs": u16, "Preamble M": u16}
  "modem_configuration.gtype" = cluster{"K-1": u16, "M-1": u8, "N-1": u16, "N": u16, "Npreamble+CP+CS": u16, "Npreamble": u16, "Nw": u16, "Modulator MUX config": u64[16], "K": u16, "fft_size_log2(K)": u8, "inverse_fft": bool, "Start with preamble": bool, "Burstmode": bool, "Ncs": u16, "Ncp": u16, "N-Ncp": u16, "N+Ncp": u16, "N+Ncp+Ncs": u16, "Demodulator MUX config": u64[16], "M": u8, "DFT SIZE": FXP(6.0), "Frame length": u32, "Super frame length": u32, "Ns_all_GFDM_blocks": u32, "Ns_all_preambles": u32}
  "GFDM all parameters.gtype" = cluster{"GFDM parameter": "GFDM parameter.gtype", "Sync config": T1, "Modem Configuration": "modem_configuration.gtype", "Preamble with CP, CS": c128[], "Preamble": c128[], "receiver filter gamma": c128[], "pulse shaping filter g": c128[], "rising window": c128[], "channel coefficients": c128[]}
uses:
  NI::Analysis::Transforms::Complex FFT.gvi
diagram:
  Property Node(instance in=$"GFDM all parameters") -> ("Modem Configuration:N"=w1)
  call "create bytes.gvi"(Modem Configuration:N=w1, Random data?=$"Random data?") -> (input bit stream=w2)
  call "Encode+QAMmapping.gvi"(input bit stream=w2) -> (data as a vector d=w3)
  $"TX symbols" <- w3
  call "TX reference.gvi"(data as a vector d=w3, GFDM all parameters=$"GFDM all parameters") -> (GFDM frame=w4, GFDM block=w5)
  $"GFDM block" <- w5
  Property Node(instance in=$"GFDM all parameters") -> ("Preamble"=w6, "Sync config:Preamble K"=w7, "Modem Configuration:N"=w8, "Modem Configuration:Ns_all_preambles"=w9, "Modem Configuration:Ncp"=w10, "Sync config:Preamble Ncp"=w11, instance out=w12)
  call "Create PDP.gvi"(Number ofPaths=$"Number ofPaths", Power distribution=$"Power distribution", Max gain=$"Max gain", Min gain=$"Min gain") -> (PDP_out=w13, Number of Paths=w14)
  call "MIMO Channel.gvi"(PDP=w13, Number of Paths=w14, MIMO config=cluster{"nT": i32, "nR": i32} {"nT"=1, "nR"=1}) -> (MimoChanGains=w15)
  for {
    w16 = each element of w15
    Array Index(array=w16) -> (out0[0]=w18)
    append w18 to w17
  }
  call "Apply Channel.gvi"(Time domain signal (SISO)=w4, ChanGains=w17, SNR (dB)=$"SNR (dB)") -> (Rx signal=w19)
  call "norm CFX.gvi"(Input=w6) -> (Output=w20)
  call "Channel Estimation.gvi"(Rx signal=w19, Preamble=w20, Channel Length=$"Number ofPaths", preamble FFT size=w7, index=w11, data FFT size=w8) -> (Channel Freq. Resp.=w21)
  Reciprocal(x=w21) -> w22
  call "CDB array to 2.14 FXP u32.gvi"(input=w22) -> (output=w23)
  $"channel coefficents" <- w23
  Add(w9, w10) -> w24
  Array Subset(array=w19, index0=w24, length0=w8) -> w25
  call "CDB array to 2.14 FXP u32.gvi"(input=w25) -> (output=w26)
  $"received GFDM data" <- w26
  call "Equalizer.gvi"(Rx data=w25, Channel Freq=w21, FFT size=w8) -> (equalized data=w27, FFT{x}=w28, product=w29)
  $"Equalizer output" <- w27
  call "norm CFX.gvi"(Input=w28) -> (Output=w30)
  $"FFT{x}" <- w30
  call "norm CFX.gvi"(Input=w29) -> (Output=w31)
  $product <- w31
  Property Node(instance in=w12) -> ("GFDM parameter"=w32, "receiver filter gamma"=w33)
  call "time-domain demodulator.gvi"(GFDM parameter in=w32, receive filter gamma=w33, received signal y=w27) -> (iq symbols=w34)
  call "norm CFX.gvi"(Input=w34) -> (Output=w35)
  $"demodulator output" <- w35
  call "Complex FFT.gvi"(x=w17, FFT size=w8) -> (FFT{x}=w36)
  Build Array(w36, w21) -> w37
  Absolute Value(x=w37) -> w38
  $channel <- w38
  Build Array(w4, w19) -> w39
  Absolute Value(x=w39) -> w40
  $"time domain signal" <- w40
