vi "Detection test.gvi"   [LabVIEW Communications System Design Suite 2.0.1]
panel controls:
  "GFDM parameter": "GFDM parameter.gtype" = {"Variable: K"=64, "Variable: M"=9, "Variable: a"=0.5, "filter type"="rc", "receive filter"="ZF", "inverse FFT"=TRUE, "Variable: b"=0, "Ncs"=16, "Ncp"=32}
  "Random data?": bool
  "stop": bool
  "RX.modem.bitshift_in": i16 = 17
  "SNR (dB)": f64 = 60
  "Number ofPaths": i32 = 4
  "RX.modem.fft.bitshift_in": i16 = 15
  "equ.shift": i16 = 2
  "Min gain": f64 = -20
  "Max gain": f64
  "Power distribution": bool = TRUE
panel indicators:
  "loop iteration": i32
  "channel": f64[][]
  "time domain signal": f64[][]
  "equ output": f64[][]
  "IQ": c128[][]
  "equ output RE": f64[][]
  "equ output IM": f64[][]
  "IQ output RE_2": f64[][]
  "IQ output IM_2": f64[][]
  "FFT output": f64[][]
  "FFT output RE": f64[][]
  "FFT output IM": f64[][]
  "multiply output": f64[][]
  "multiply output RE": f64[][]
  "multiply output IM": f64[][]
types:
  "GFDM parameter.gtype" = cluster{"Variable: K": i32, "Variable: M": i32, "Variable: a": f64, "filter type": enum{"rc", "rect"}, "receive filter": enum{"MF", "ZF"}, "inverse FFT": bool, "Variable: b": f64, "Ncs": u16, "Ncp": u16}
uses:
  ::USRP::Interactive::Detection test wrapper.gcdl
diagram:
  $stop <- FALSE
  call "GFDM generate parameter.gvi"(GFDM parameter=$"GFDM parameter") -> (receive filter=w1, Modem Configuration=w2, GFDM all parameters=w3)
  call "Detection test signal reference.gvi"(Random data?=$"Random data?", GFDM all parameters=w3, Power distribution=$"Power distribution", Number ofPaths=$"Number ofPaths", Max gain=$"Max gain", Min gain=$"Min gain", SNR (dB)=$"SNR (dB)") -> (received GFDM data=w4, channel coefficents=w5, TX symbols=w6, demodulator output=w7, GFDM block=w8, Equalizer output=w9, channel=w10, time domain signal=w11, FFT{x}=w12, product=w13)
  while (iteration -> i1) {
    Is First Call() -> w19
    Feedback Node(input=w20) -> w21
    call "detect falling edge.gvi"(in=w21) -> (out=w22)
    Logical Or(w22, w19) -> w23
    Feedback Node[DelayCount=10](input=w24) -> w25
    call "toggle_output.gvi"(toggle=w25, reset=w23) -> (output=w26)
    call "fifo simulator_32.gvi"(ready for output=w26, Array=w4, reset=w19) -> (element=w27, valid=w20)
    Feedback Node[DelayCount=10](input=w28) -> w29
    call "detect falling edge.gvi"(in=w29) -> (out=w30)
    call "toggle_output.gvi"(toggle=w30, reset=w19) -> (output=w31)
    call "fifo simulator_64.gvi"(ready for output=w31, Array=w1, reset=w19) -> (element=w32, valid=w33)
    call "fifo simulator_32_without reset.gvi"(ready for output=w31, Array=w5, reset=w19) -> (element=w34, valid=w35, addr=w36)
    Join Numbers(high(x)=w36, low(x)=w34) -> w37
    Feedback Node[DelayCount=10](input=w30) -> w38
    Feedback Node(input=w39) -> w24
    call "toggle_output.gvi"(toggle=w38, reset=w24) -> (output=w40)
    Feedback Node[DelayCount=10](initial value=TRUE, input=w41) -> w42
    call "Detection test wrapper.gcdl"(RX.modem.configure_in=w40, RX.modem.configuration_in=w2, RX.modem.bitshift_in=$"RX.modem.bitshift_in", RX.modem.reset_in=w42, RX.modem.fft.bitshift_in=$"RX.modem.fft.bitshift_in", channel coefficients valid=w35, filter valid=w33, data valid=w20, channel coefficients=w37, filter=w32, data=w27, equ.shift=$"equ.shift") -> (RX.modem.config done_out=w43, RX.modem.data valid_out=w44, RX.modem.32 bit data_out=w45, RX.modem.64 bit data_out=w46, equ data_out=w47, equ data valid_out=w48, RX.modem.reset active_out=w49, ifft in valid=w50, ifft in=w51, fft out valid=w52, fft out=w53)
    call "u64_to_cfx.gvi"(input=w46) -> (output=w54)
    call "u32 to 2.14 CDB.gvi"(u32=w45) -> (CFX out=w55)
    call "detect rising edge.gvi"(in=w43) -> (out=w39)
    call "u32 to 2.14 CDB.gvi"(u32=w47) -> (CFX out=w56)
    call "u32 to 2.14 CDB.gvi"(u32=w51) -> (CFX out=w57)
    call "u32 to 2.14 CDB.gvi"(u32=w53) -> (CFX out=w58)
    Is First Call() -> w59
    Feedback Node(input=w49) -> w28
    call "toggle_output.gvi"(toggle=w59, reset=w28) -> (output=w41)
    call "detect falling edge.gvi"(in=w44) -> (out=w60)
    Feedback Node[DelayCount=10](input=w60) -> w61
    Logical Or(w61, $stop) -> w62
    $"loop iteration" <- i1
    append w55 to w14 if w44
    append w54 to w15 if w44
    append w56 to w16 if w48
    append w57 to w17 if w50
    append w58 to w18 if w52
    stop if w62
  }
  Build Array(w6, w7, w15, w14) -> w63
  $IQ <- w63
  Complex To Real Imaginary(x + iy=w63) -> (x=w64, y=w65)
  $"IQ output RE_2" <- w64
  $"IQ output IM_2" <- w65
  Build Array(w8, w9, w16) -> w66
  Absolute Value(x=w66) -> w67
  $"equ output" <- w67
  $channel <- w10
  $"time domain signal" <- w11
  Complex To Real Imaginary(x + iy=w66) -> (x=w68, y=w69)
  $"equ output RE" <- w68
  $"equ output IM" <- w69
  call "norm CFX.gvi"(Input=w18) -> (Output=w70)
  Build Array(w12, w70) -> w71
  Absolute Value(x=w71) -> w72
  $"FFT output" <- w72
  Complex To Real Imaginary(x + iy=w71) -> (x=w73, y=w74)
  $"FFT output RE" <- w73
  $"FFT output IM" <- w74
  call "norm CFX.gvi"(Input=w17) -> (Output=w75)
  Build Array(w13, w75) -> w76
  Absolute Value(x=w76) -> w77
  $"multiply output" <- w77
  Complex To Real Imaginary(x + iy=w76) -> (x=w78, y=w79)
  $"multiply output RE" <- w78
  $"multiply output IM" <- w79
