vi "Detection toplevel.gvi"   [LabVIEW Communications System Design Suite 2.0.1]
panel controls:
  "RX.modem.configure_in": bool
  "RX.modem.fft.bitshift_in": i16
  "RX.modem.reset_in": bool
  "RX.modem.bitshift_in": i16
  "TX.modem.configuration_in": "modem_configuration.gtype"
  "equ.shift": i16
  "equ.OR Mask": u16
panel indicators:
  "RX.modem.config done_out": bool
  "RX.modem.DEBUG.cluster_out": T5
  "RX.modem.modem_configuration_out": "modem_configuration.gtype"
types:
  T1 = cluster{"packets in_out": u16, "samples in_out": u16, "packets out_out": u16, "samples out_out": u16, "number of invalid samples": u64, "mod first samples out": u64, "mod last samples out": u64}
  T2 = cluster{"FFT misalignment": u64, "FFT halt": u64, "FFT last sample": u64}
  T3 = cluster{"number of invalid samples": u64, "first samples out": u64, "last samples out": u64, "number of cycles": u64}
  T4 = cluster{"FFT misalignment count": u8, "FFT halt count": u8, "block start": u16, "block end": u16, "overflow_2": u16, "update active_2": u16, "update done_2": u16, "first sample out_2": u16, "exponent": FXP(4.0), "exponent_2": FXP(4.0), "elements read_2": u32}
  T5 = cluster{"Element 1": T1, "Element 2": T2, "Element 3": T3, "Element 4": T4}
  "modem_configuration.gtype" = cluster{"K-1": u16, "M-1": u8, "N-1": u16, "N": u16, "Npreamble+CP+CS": u16, "Npreamble": u16, "Nw": u16, "Modulator MUX config": u64[16], "K": u16, "fft_size_log2(K)": u8, "inverse_fft": bool, "Start with preamble": bool, "Burstmode": bool, "Ncs": u16, "Ncp": u16, "N-Ncp": u16, "N+Ncp": u16, "N+Ncp+Ncs": u16, "Demodulator MUX config": u64[16], "M": u8, "DFT SIZE": FXP(6.0), "Frame length": u32, "Super frame length": u32, "Ns_all_GFDM_blocks": u32, "Ns_all_preambles": u32}
diagram:
  Register Create(initial value="modem_configuration.gtype" {all zero or empty}) -> (reference out=w1)
  clock-driven loop (clock = "40 MHz Onboard Clock") forever {
    Register Write(data=$"TX.modem.configuration_in", reference in=w1)
  }
  clock-driven loop (clock = "Needed Resources.grsc\\200 MHz") forever {
    Register Read(reference in=w1) -> (data=w2)
    call "Detection.gcdl"(RX.modem.data fifo_in="Needed Resources.grsc\\RX.Debug.Test data in", RX.modem.fft.bitshift_in=$"RX.modem.fft.bitshift_in", RX.modem.configuration_in=w2, RX.modem.configure_in=$"RX.modem.configure_in", RX.modem.filter fifo_in="Needed Resources.grsc\\RX.pulse shape in", RX.modem.reset_in=$"RX.modem.reset_in", RX.modem.bitshift_in=$"RX.modem.bitshift_in", channel coefficients_in="Needed Resources.grsc\\RX.channel Coefficients in", equ.shift=$"equ.shift", L8=$"equ.OR Mask") -> (RX.modem.64 bit data_out=w3, RX.modem.data valid_out=w4, RX.modem.32 bit data_out=w5, RX.modem.modem_configuration_out=w6, RX.modem.DEBUG.cluster_out=w7, RX.modem.config done_out=w8, equ data valid_out=w9, equ data_out=w10)
    FIFO Write(Control Protocol Input=w4, data=w3, reference in="Needed Resources.grsc\\RX.Debug.Modem_64 bit samples out")
    FIFO Write(Control Protocol Input=w4, data=w5, reference in="Needed Resources.grsc\\RX.Debug.Modem_32 bit samples out")
    $"RX.modem.modem_configuration_out" <- w6
    $"RX.modem.config done_out" <- w8
    $"RX.modem.DEBUG.cluster_out" <- w7
    FIFO Write(Control Protocol Input=w9, data=w10, reference in="Needed Resources.grsc\\RX.Debug.Equ out")
  }
