vi "rm controller test.gvi"   [LabVIEW Communications System Design Suite 2.0.1]
panel controls:
  "write every x cycle": i32 = 1
  "ready for output always true": bool = TRUE
  "length": i32 = 10
panel indicators:
  "multiplexed sample graph": u32[]
  "multiplexed sample array": u32[]
  "input/output": u32[][]
  "n": u32[]
  "n graph": u32[]
  "tx data symbols": u32[]
  "payload length [bytes]": u16
  "payload length [sample]": u16
  "control channel length [samples]": u16
  "control channel length [bytes]": u16
uses:
  ::USRP::Interactive::rm controller test wrapper.gcdl
diagram:
  w1 = $length
  for (N = w1) (iteration -> i1) {
    call "limited counter.gvi"(increment=TRUE, limit=2) -> (number out=w5)
    To Unsigned Long Integer(number=i1) -> w6
    Add(w1, w6) -> w7
    Increment(x=w7) -> w8
    Increment(x=w6) -> w9
    append w8 to w2
    append w9 to w3
    append w5 to w4
  }
  $"multiplexed sample graph" <- w3
  Add(w1, 150) -> w10
  w11 = $"write every x cycle"
  Decrement(x=w1) -> w12
  while (iteration -> i2) {
    Is Equal To 0(x=i2) -> w15
    Feedback Node(input=w16) -> w17
    call "fifo simulator_32.gvi"(ready for output=w17, Array=w4, reset=w15) -> (element=w18, valid=w19)
    Feedback Node(input=w20) -> w21
    call "detect falling edge.gvi"(in=w21) -> (out=w22)
    call "toggle_output.gvi"(toggle=w22, reset=w15) -> (output=w23)
    Quotient And Remainder(x=i2, y=w11) -> (x-y*floor(x/y)=w24)
    Is Equal To 0(x=w24) -> w25
    Logical And(w25, w23) -> w26
    call "fifo simulator_32.gvi"(ready for output=w26, Array=w3, reset=w15) -> (element=w27, valid=w28)
    Logical And(w25, w23) -> w29
    call "fifo simulator_32.gvi"(ready for output=w29, Array=w2, reset=w15) -> (element=w30, valid=w31)
    Random Number() -> (number (0 to 1)=w32)
    Is Greater(x=w32, y=0.5) -> w33
    Logical Or(w33, $"ready for output always true") -> w34
    Feedback Node[DelayCount=20](input=w23) -> w35
    Feedback Node(input=w36) -> w37
    call "detect rising edge.gvi"(in=w37) -> (out=w38)
    call "toggle_output.gvi"(toggle=w38, reset=w15) -> (output=w20)
    call "rm controller test wrapper.gcdl"(payload valid=w28, cc valid=w31, cc in=w30, payload in=w27, ready for output_in=w34, N-1=w12, reset=w15, rm data valid_in=w19, rm_data_in=w18, config_in=w20, enable_in=w35) -> (ready for config input_out=w16, idle_out=w36, n_out=w39, output valid=w40, output=w41, payload length [sample]=w42, payload length [bytes]=w43, control channel length [samples]=w44, control channel length [bytes]=w45)
    Is Greater(x=i2, y=w10) -> w46
    append w41 to w13 if w40
    append w39 to w14 if w40
    stop if w46
  }
  $"multiplexed sample array" <- w13
  $n <- w14
  $"n graph" <- w14
  $"payload length [bytes]" <- w43
  $"payload length [sample]" <- w42
  $"control channel length [samples]" <- w44
  disable {
    frame Enabled { }
    frame Disabled {
      Build Array(w3, _, w2) -> w47
      $"input/output" <- w47
    }
  }
  $"control channel length [bytes]" <- w45
  call "select data_u32.gvi"(data_vector=w2, trainings sequence=w3, resource map as vector=w4) -> (tx data symbols=w48)
  $"tx data symbols" <- w48
