vi "rm+rdm controller test.gvi"   [LabVIEW Communications System Design Suite 2.0.1]
panel controls:
  "write every x cycle": i32 = 1
  "ready for output always true": bool = TRUE
  "length": i32 = 10
panel indicators:
  "multiplexed sample graph": u32[][]
  "multiplexed sample array": u32[][]
  "input/output": u32[][]
  "n": u32[]
  "n graph": u32[]
  "payload length [bytes]": u16
  "payload length [sample]": u16
  "control channel length [samples]": u16
  "control channel length [bytes]": u16
  "input/output array": u32[][]
uses:
  ::USRP::Interactive::rm controller test wrapper.gcdl
  ::USRP::Interactive::resource demapper test wrapper.gcdl
diagram:
  w1 = $length
  for (N = w1) (iteration -> i1) {
    call "limited counter.gvi"(increment=TRUE, limit=2) -> (number out=w5)
    To Unsigned Long Integer(number=i1) -> w6
    Add(w1, w6) -> w7
    Increment(x=w7) -> w8
    Increment(x=w6) -> w9
    append w8 to w2
    append w9 to w3
    append w5 to w4
  }
  w10 = $"write every x cycle"
  Decrement(x=w1) -> w11
  while (iteration -> i2) {
    Is Equal To 0(x=i2) -> w16
    Feedback Node(input=w17) -> w18
    call "fifo simulator_32.gvi"(ready for output=w18, Array=w4, reset=w16) -> (element=w19, valid=w20)
    Feedback Node(input=w21) -> w22
    call "detect falling edge.gvi"(in=w22) -> (out=w23)
    call "toggle_output.gvi"(toggle=w23, reset=w16) -> (output=w24)
    Quotient And Remainder(x=i2, y=w10) -> (x-y*floor(x/y)=w25)
    Is Equal To 0(x=w25) -> w26
    Logical And(w26, w24) -> w27
    call "fifo simulator_32.gvi"(ready for output=w27, Array=w3, reset=w16) -> (element=w28, valid=w29)
    Logical And(w26, w24) -> w30
    call "fifo simulator_32.gvi"(ready for output=w30, Array=w2, reset=w16) -> (element=w31, valid=w32)
    Feedback Node[DelayCount=20](input=w24) -> w33
    Feedback Node(input=w34) -> w35
    call "detect rising edge.gvi"(in=w35) -> (out=w36)
    call "toggle_output.gvi"(toggle=w36, reset=w16) -> (output=w21)
    Feedback Node(input=w37) -> w38
    call "rm controller test wrapper.gcdl"(payload valid=w29, cc valid=w32, cc in=w31, payload in=w28, ready for output_in=w38, N-1=w11, reset=w16, rm data valid_in=w20, rm_data_in=w19, config_in=w21, enable_in=w33) -> (ready for config input_out=w39, idle_out=w34, n_out=w40, last sample_out=w41, first sample_out=w42, output valid=w43, output=w44, payload length [sample]=w45, payload length [bytes]=w46, control channel length [samples]=w47, control channel length [bytes]=w48)
    Random Number() -> (number (0 to 1)=w49)
    Is Greater(x=w49, y=0.5) -> w50
    Logical Or(w50, $"ready for output always true") -> w51
    call "resource demapper test wrapper.gcdl"(N-1_in=w11, ready for output_in=w51, input valid=w43, sample in=w44, last sample_in=w41, first sample_in=w42, reset=w16, rm_data_in=w19, rm data valid_in=w20, config_in=w21) -> (control channel_out=w52, ready for input_out=w37, payload valid=w53, payload output=w54, control channel valid_out=w55, ready for config input_out=w56, last sample_out=w57)
    Logical And(w39, w56) -> w17
    call "detect rising edge.gvi"(in=w57) -> (out=w58)
    call "limited counter.gvi"(increment=w58, limit=2) -> (stop=w59)
    Is Greater(x=i2, y=1000) -> w60
    Feedback Node[DelayCount=99](input=w59) -> w61
    Logical Or(w61, w60) -> w62
    append w44 to w12 if w43
    append w40 to w13 if w43
    append w54 to w14 if w53
    append w52 to w15 if w55
    stop if w62
  }
  call "select data_u32.gvi"(data_vector=w2, trainings sequence=w3, resource map as vector=w4) -> (tx data symbols=w63)
  Build Array(w12, w63) -> w64
  $"multiplexed sample graph" <- w64
  Transpose 2D Array(2D array=w64) -> (transposed array=w65)
  $"multiplexed sample array" <- w65
  $n <- w13
  $"n graph" <- w13
  $"payload length [bytes]" <- w46
  $"payload length [sample]" <- w45
  $"control channel length [samples]" <- w47
  $"control channel length [bytes]" <- w48
  Build Array(w3, w14, w2, w15) -> w66
  $"input/output" <- w66
  Transpose 2D Array(2D array=w66) -> (transposed array=w67)
  $"input/output array" <- w67
