vi "MUX test.gvi"   [LabVIEW Communications System Design Suite 2.0.1]
panel controls:
  "write every x cycle": i32 = 5
  "ready for output always true": bool
  "length": i32 = 10
panel indicators:
  "multiplexed sample graph": u32[]
  "multiplexed sample array": u32[]
  "input/output": u32[][]
uses:
  ::USRP::Interactive::MUX test wrapper.gcdl
  ::USRP::Interactive::DEMUX.gcdl
diagram:
  w1 = $length
  for (N = w1) (iteration -> i1) {
    To Unsigned Long Integer(number=i1) -> w3
    Increment(x=w3) -> w4
    append w4 to w2
  }
  $"multiplexed sample graph" <- w2
  for (N = w1) (iteration -> i2) {
    To Unsigned Long Integer(number=i2) -> w6
    Add(10, w6) -> w7
    Increment(x=w7) -> w8
    append w8 to w5
  }
  w9 = $"write every x cycle"
  while (iteration -> i3) {
    Random Number() -> (number (0 to 1)=w13)
    Is Greater(x=w13, y=0.5) -> w14
    Logical Or(w14, $"ready for output always true") -> w15
    Is Equal To 0(x=i3) -> w16
    Quotient And Remainder(x=i3, y=w9) -> (x-y*floor(x/y)=w17)
    Is Equal To 0(x=w17) -> w18
    Logical And(w18, not w16) -> w19
    call "fifo simulator_32.gvi"(ready for output=w19, Array=w2, reset=w16) -> (element=w20, valid=w21)
    Logical And(w18, not w16) -> w22
    call "fifo simulator_32.gvi"(ready for output=w22, Array=w5, reset=w16) -> (element=w23, valid=w24)
    Feedback Node(input=w25) -> w26
    call "limited counter.gvi"(increment=w26, limit=2) -> (number out=w27)
    Feedback Node(input=w28) -> w29
    call "MUX test wrapper.gcdl"(cc valid=w24, cc in=w23, payload valid=w21, payload in=w20, reset=w16, selected channel=w27, ready for output=w29) -> (output valid=w30, ready for input=w25, output=w31)
    Feedback Node[DelayCount=2](enable?=w29, input=w27) -> w32
    call "DEMUX.gcdl"(selected channel_in=w32, ready for output_in=w15, input valid=w30, sample in=w31) -> (ready for input_out=w28, payload valid_out=w33, payload_out=w34, control channel valid_out=w35, control channel_out=w36)
    Is Greater(x=i3, y=150) -> w37
    append w31 to w10 if w30
    append w34 to w11 if w33
    append w36 to w12 if w35
    stop if w37
  }
  $"multiplexed sample array" <- w10
  Build Array(w2, w11, w5, w12) -> w38
  $"input/output" <- w38
