vi "Resource Mapper Test.gvi"   [LabVIEW Communications System Design Suite 2.0.1]
panel controls:
  "ready for output always true": bool = TRUE
  "K_set": i16[] = [1, 2, 3, 4, 5, 6]
  "M_set": i16[] = [1, 2, 3]
  "K": i16 = 8
  "M": i16 = 5
  "PayloadSize [Byte]": u16 = 1
  "ControlSize [Symbol]": u16
panel indicators:
  "N_Blocks": u16
  "amount of symbols": u8[]
  "N_BlockOverhead [Blocks]": u16
  "N_AvailableResources [Symbol]": u16
  "N_UsedResources [Symbol]": u16
  "CanNotFit": bool
  "InsufficientResources": bool
  "ControlPading [Symbol]": u16
  "ZeroPadding [bit]": u16
  "FixedIndexing": bool
  "multiplexed sample graph": u32[][]
  "multiplexed sample array": u32[][]
  "equal?": bool
  "loop iteration": i32
uses:
  ::USRP::Interactive::Resource Mapper Test Wrapper.gcdl
diagram:
  call "ResourceMapperOptimization.gvi"(K_set=$K_set, M_set=$M_set, PayloadSize [Byte]=$"PayloadSize [Byte]", ControlSize [Symbol]=$"ControlSize [Symbol]", K=$K, M=$M) -> (R_MAP=w1, N_Blocks [Blocks]=w2, N_DataSym_per_block [Symbol]=w3, N_ControlSym_per_block [Symbol]=w4, N_BlockOverhead [Blocks]=w5, N_AvailableResources [Symbol]=w6, FixedIndexing=w7, InsufficientResources=w8, ZeroPadding [bit]=w9, ControlPading [Symbol]=w10, N_UsedResources [Symbol]=w11, CanNotFit=w12)
  call "count the number of resources.gvi"(resource map as vector=w1) -> (amount of symbols=w13)
  $"amount of symbols" <- w13
  call "create ramp.gvi"(length=w3) -> (data in=w14)
  call "create ramp.gvi"(length=w4, offset=10) -> (data in=w15)
  Build Array(w1) -> w16
  Logical Or(w12, w8) -> w17
  Array Size(array=w1) -> (size(s)=w18)
  Decrement(x=w18) -> w19
  case (w17) {
    frame True {
      w20 = default
      w21 = default
    }
    frame False {
      call "select data_u32.gvi"(data_vector=w15, trainings sequence=w14, resource map as vector=w1) -> (tx data symbols=w22)
      Build Array[ConcatenateInputs=True](w22, w22) -> w21
      while (iteration -> i1) {
        $"loop iteration" <- i1
        Feedback Node[DelayCount=10](input=w23) -> w24
        Array Size(array=w21) -> (size(s)=w25)
        Feedback Node(input=w26) -> w27
        call "control state machine_SIMULATION.gvi"(loop iteration=i1, control signals_out=w27) -> (control signals out=w28, active_out=w29, configuration_out=w30, reset_out=w31)
        Feedback Node(input=w32) -> w33
        Logical Or(w33, w31) -> w34
        call "fifo simulator_32.gvi"(ready for output=w29, Array=w14, reset=w34) -> (element=w35, valid=w36)
        call "fifo simulator_32.gvi"(ready for output=w29, Array=w15, reset=w34) -> (element=w37, valid=w38)
        Feedback Node(input=w39) -> w40
        call "write configuration_SIMULATION.gvi"(ready for output_in=w40, Array_in=w16, active_in=w30) -> (configuration_out=w41)
        call "simulate random ready_for_output.gvi"(ready for output always true=$"ready for output always true") -> (ready for output_out=w42)
        call "Resource Mapper Test Wrapper.gcdl"(payload valid=w36, payload in=w35, cc in=w37, N-1=w19, cc valid=w38, Configuration data=w41, update id_const=1, control signals_in=w28, ready for output_in=w42) -> (ready for RM input_out=w39, control signals_out=w26, signals out=w43)
        Property Node(instance in=w43) -> ("u32 sample"=w44, "valid"=w45, "last sample"=w32)
        call "collect n samples.gvi"(loop iteration=i1, max samples=w25, increment=w45) -> (stop=w23)
        append w44 to w20 if w45
        stop if w24
      }
    }
  }
  Build Array(w20, w21) -> w46
  $"multiplexed sample graph" <- w46
  Transpose 2D Array(2D array=w46) -> (transposed array=w47)
  $"multiplexed sample array" <- w47
  $N_Blocks <- w2
  $"N_BlockOverhead [Blocks]" <- w5
  Is Equal[ComparisonMode=CompareAggregates](x=w20, y=w21) -> w48
  $"equal?" <- w48
  $"N_AvailableResources [Symbol]" <- w6
  $"N_UsedResources [Symbol]" <- w11
  $CanNotFit <- w12
  $InsufficientResources <- w8
  $"ControlPading [Symbol]" <- w10
  $"ZeroPadding [bit]" <- w9
  $FixedIndexing <- w7
