vi "FIFO read test.gvi"   [LabVIEW Communications System Design Suite 2.0.1]
panel controls:
  "write element every x cycle": i32 = 14
  "ready for output always true": bool
panel indicators:
  "Graph": u32[][]
uses:
  ::USRP::Interactive::FIFO read test wrapper.gcdl
diagram:
  for (N = 10) (iteration -> i1) {
    To Unsigned Long Integer(number=i1) -> w2
    append w2 to w1
  }
  w3 = $"write element every x cycle"
  while (iteration -> i2) {
    Feedback Node(input=w5) -> w6
    call "limited counter.gvi"(increment=w6, limit=3) -> (number out=w7)
    Is Equal(x=w7, y=1) -> w8
    Not(x=w8) -> w9
    Is Equal To 0(x=i2) -> w10
    Quotient And Remainder(x=i2, y=w3) -> (x-y*floor(x/y)=w11)
    Is Equal To 0(x=w11) -> w12
    call "fifo simulator_32.gvi"(ready for output=w12, Array=w1, reset=w10) -> (element=w13, valid=w14)
    Random Number() -> (number (0 to 1)=w15)
    Is Greater(x=w15, y=0.5) -> w16
    Logical Or(w16, $"ready for output always true") -> w17
    call "FIFO read test wrapper.gcdl"(input valid=w14, data in=w13, ready for output=w17, reset=w10, enable=w8) -> (ready for input=w18, output valid=w19, output=w20)
    Logical Or(w9, w18) -> w5
    Is Greater(x=i2, y=150) -> w21
    append w20 to w4 if w19
    stop if w21
  }
  Build Array(w1, w4) -> w22
  $Graph <- w22
