vi "RM config.gvi"   [LabVIEW Communications System Design Suite 2.0.1]
inputs:
  "FPGA interface in": "FPGA interface.gtype"
  "R_MAP": u8[]
  "error in": error
outputs:
  "FPGA reference out": "Updater FPGA reference.gtype"
  "Error": error
diagram:
  Dynamic Fpga Interface Cast(reference in=$"FPGA interface in", type="Updater FPGA reference.gtype" constant) -> (reference out=w1)
  call "start configuration.gvi"(FPGA interface=w1, Error_in=$"error in", timeout=2147483647) -> (Error_out=w2, FPGA reference_out=w3)
  Array Size(array=$R_MAP) -> (size(s)=w4)
  Decrement(x=w4) -> w5
  Property Node(instance in=$"FPGA interface in", "N-1_in"=w5, error in=w2) -> (error out=w6)
  call "write_array.gvi"(error in=w6, update id=1, Array=$R_MAP, FPGA reference_in=w3, time out=2147483647) -> (FPGA reference out=w7, error out=w8)
  call "write_array.gvi"(error in=w8, update id=2, Array=$R_MAP, FPGA reference_in=w7, time out=2147483647) -> (FPGA reference out=w9, error out=w10)
  call "stop configuration.gvi"(error in=w10, FPGA reference_in=w9, time out=2147483647) -> (FPGA reference out=w11, error out=w12)
  $"FPGA reference out" <- w11
  $Error <- w12
