vi "ResourceMapperOptimization2.gvi"   [LabVIEW Communications System Design Suite 2.0.1]
inputs:
  "K_set": i16[]
  "M_set": i16[]
  "PayloadSize [Byte]": u16
  "ControlSize per Block [Symbol]": u16
  "K": i16
  "M": i16
  "Replace Control with Pilots": bool
  "bits per symbol": u8
outputs:
  "R_MAP": u8[]
  "N_Blocks [Blocks]": u16
  "N_DataSym_per_block [Symbol]": u16
  "K_set_out": i16[]
  "M_set_out": i16[]
  "N_AvailableResources [Symbol]": u16
  "FixedIndexing": bool
  "InsufficientResources": bool
  "ZeroPadding [bit]": u16
  "N_UsedResources [Symbol]": u16
  "CanNotFit": bool
panel controls:
  "error in": error
panel indicators:
  "error out": error
diagram:
  Boolean To Integer(Boolean=$"Replace Control with Pilots") -> (0, 1=w1)
  # K_set shoud be a subset of -K/2:K/2-1. Modulo-K is applied to produces K_set_out
  # The function process the input to insure unique indexes
  #
  # M_Set should be a subset in 0:M-1.Modulo-M is applied to produces M_set_out
  # The function process the input to insure unique indexes.
  #
  # IndexingFixed will be on if it detects repeated indexes.
  # Zeropadding: required padding for the payload
  #
  #
  # N_AvailableResources: number of available resources
  # N_UsedResources:  number of used resources
  #
  # N_BlockOverhead: number of blocks added to fit the resources without padding
  #
  #
  # N_DataSym_per_block = 0, in case N_ControlSym_per_block > available resources.
  Math Node("K_set"=$K_set, "M_set"=$M_set, "K"=$K, "M"=$M, "PayloadSize"=$"PayloadSize [Byte]", "ControlSize"=$"ControlSize per Block [Symbol]", "Replace_Control_with_Pilots"=w1, "M_bps"=$"bits per symbol", Error In=$"error in") -> ("N_DataSym_per_block"=w2, "N_Blocks"=w3, "R_MAP"=w4, "IndexingFixed"=w5, "K_set_out"=w6, "M_set_out"=w7, "InsufficientResources"=w8, "ZeroPading"=w9, "N_AvailableResources"=w10, "N_UsedResources"=w11, "CanNotFit"=w12, Error Out=w13)
  ~~~
  if(PayloadSize > 0)
      CodeRate = 1/2;
     % M_bps = 2; % modulation bit per symbol
      CRC_size = 2; % CRC perfomd on FPGA [bytes]
      Code_tail = 8; % bits
      M_bps= double(M_bps);
      % Data symbols
      if(PayloadSize > 0)
          N_InfoBits = (PayloadSize + CRC_size)*8 + Code_tail;
      else
          N_InfoBits = uint16(0);
      end
      N_CodedBits = ceil(N_InfoBits/CodeRate);
      N_data_sym_per_frame = ceil(N_CodedBits/M_bps); % number of data symbols per frame

      % GFDM

      % Matlab index

      K_set_out = mod(K_set,K);
      M_set_out = mod(M_set,M);
      % to insure unique items:
      % Note: unique is not defined in mathscript
      K_set_out = union(K_set_out,K_set_out);
      M_set_out = union(M_set_out,M_set_out);
      IndexingFixed = false;
      if(length(K_set_out) ~= length(K_set)) || (length(M_set_out) ~= length(M_set))
          IndexingFixed = true;
      end
      N_on = length(K_set_out)*length(M_set_out); % number of active samples
      N_ind = zeros(N_on,1);
      n=1;
      for k = K_set_out
          for m = M_set_out
              N_ind(n) = k+m*K+1;
              n = n+1;
          end
      end

      %% Output
      % flags
      NULL = uint8(0);
      PAYLOAD = uint8(1);
      CONTROL = uint8(2);
      PILOT = uint8(3);

      R_MAP = zeros(K*M,1,'uint8');
      % % per block
      %N_ControlSym_per_block ;
      %N_DataSym_per_block ;
      % N_Blocks in the frame
      if N_on <= 1 % Limited avialable resources
          InsufficientResources = true;
          N_Blocks = uint16(0);
          N_ControlSym_per_block = uint16(0);
          N_DataSym_per_block =uint16(0);
      else % enough resources
          InsufficientResources = false;
          ZeroPading = uint16(1);
          N_on = N_on+1; % This is to work in the loop as matlab has no do-while
          while (ZeroPading > 0) && N_on > 0
              N_on = N_on -1;
              flag_fit_in_blocks = mod(N_data_sym_per_frame,N_on-ControlSize) == 0;
              %Reduce the number of resources to get integr multiple of blocks
              while ~flag_fit_in_blocks
                  N_on = N_on -1;
                  flag_fit_in_blocks = mod(N_data_sym_per_frame,N_on-ControlSize) == 0;
              end
              N_Blocks = (N_data_sym_per_frame)/(N_on-ControlSize);
              N_DataSym_per_block = N_on - ControlSize;
              % first available resource for control, the rest for data
              ZeroPading = N_Blocks*N_DataSym_per_block - N_data_sym_per_frame;
              ZeroPading = ZeroPading * M_bps * CodeRate;
          end
          if N_on > 1
              R_MAP(N_ind(N_on+1:end)) = NULL; %Update the mapping vector with updated N_on
              R_MAP(N_ind(1:ControlSize)) = CONTROL + uint8(Replace_Control_with_Pilots);
              R_MAP(N_ind(ControlSize+1:N_on)) = PAYLOAD;
              CanNotFit = false;
          else
              CanNotFit = true;
          end
          N_DataSym_per_block = uint16(N_DataSym_per_block);
          N_Blocks = uint16(N_Blocks); %in the frame
          ZeroPading = uint16(ZeroPading);
          N_UsedResources = uint16(N_on);
          N_AvailableResources = uint16(length(K_set_out)*length(M_set_out));
      end

  else % no payload
      N_ControlSym_per_block = uint16(0);
      N_DataSym_per_block = uint16(0);
      N_Blocks = uint16(0); %in the frame
      ZeroPading =uint16(0);
      N_UsedResources = uint16(0);
      N_AvailableResources = uint16(0);
  end
  ~~~
  $"error out" <- w13
  $"N_DataSym_per_block [Symbol]" <- w2
  $"N_Blocks [Blocks]" <- w3
  $R_MAP <- w4
  $K_set_out <- w6
  $M_set_out <- w7
  $"ZeroPadding [bit]" <- w9
  $"N_AvailableResources [Symbol]" <- w10
  $FixedIndexing <- w5
  $"N_UsedResources [Symbol]" <- w11
  $CanNotFit <- w12
  $InsufficientResources <- w8
