vi "count resource elements.gvi"   [LabVIEW Communications System Design Suite 2.0.1]
inputs:
  "RM in": "Resource Type.gtype"[]
outputs:
  "RM out": "Resource Type.gtype"[]
  "data elements": i16
  "control channel elements": i16
types:
  "Resource Type.gtype" = enum{"Null", "Data", "CC1", "Pilot"}
diagram:
  # count resource types
  for {
    w1 = each element of $"RM in"
    Is Equal(x=w1, y="Data") -> w5
    Boolean To Integer(Boolean=w5) -> (0, 1=w6)
    Is Equal(x=w1, y="CC1") -> w7
    Boolean To Integer(Boolean=w7) -> (0, 1=w8)
    append w6 to w2
    append w8 to w3
    append w1 to w4
  }
  $"RM out" <- w4
  Add Array Elements(numeric array=w2) -> (sum=w9)
  $"data elements" <- w9
  Add Array Elements(numeric array=w3) -> (sum=w10)
  $"control channel elements" <- w10
