vi "count the number of resources.gvi"   [LabVIEW Communications System Design Suite 2.0.1]
inputs:
  "resource map as vector": enum{"Null", "Pilot", "Data"}[]
  "Array/selector?": bool
  "array": u8[]
outputs:
  "amount of symbols": u8[]
diagram:
  To Unsigned Byte Integer(number=$"resource map as vector") -> w1
  Select(s=$"Array/selector?", t=$array, f=w1) -> w2
  Array Max And Min(array=w2) -> (max value=w3)
  Increment(x=w3) -> w4
  Initialize Array(element=0, size=w4) -> w5
  s1 = w5  # shift register
  for {
    w6 = each element of w2
    Array Index(array=s1) -> (out0[w6]=w7)
    Increment(x=w7) -> w8
    Replace Array Subset(inArray=s1, index=w6, new=w8) -> w9
    next s1 = w9
  }
  $"amount of symbols" <- s1
