vi "RM_RDM test.gvi"   [LabVIEW Communications System Design Suite 2.0.1]
panel controls:
  "K_set": i16[] = [1, 2, 3, 4, 5, 6]
  "M_set": i16[] = [1, 2, 3]
  "K": i16 = 8
  "M": i16 = 5
  "PayloadSize [Byte]": u16 = 1
  "ControlSize [Symbol]": u16
  "Replace Control with Pilots": bool
  "ready for output always true": bool = TRUE
panel indicators:
  "N_Blocks": u16
  "amount of symbols": u8[]
  "N_BlockOverhead [Blocks]": u16
  "N_AvailableResources [Symbol]": u16
  "N_UsedResources [Symbol]": u16
  "CanNotFit": bool
  "InsufficientResources": bool
  "ControlPading [Symbol]": u16
  "ZeroPadding [bit]": u16
  "FixedIndexing": bool
  "multiplexed sample graph": u32[][]
  "multiplexed sample array": u32[][]
  "equal?": bool
  "loop iteration": i32
  "RM properties": T1
  "input vs output": u32[][]
  "input vs output Graph": u32[][]
  "Output": u32
types:
  T1 = cluster{"Element 1": u16, "Element 2": u16, "Element 3": u16, "Element 4": u16}
uses:
  ::USRP::Interactive::RM+RDM test wrapper.gcdl
diagram:
  call "ResourceMapperOptimization.gvi"(K_set=$K_set, M_set=$M_set, PayloadSize [Byte]=$"PayloadSize [Byte]", ControlSize [Symbol]=$"ControlSize [Symbol]", K=$K, M=$M, Replace Control with Pilots=$"Replace Control with Pilots") -> (R_MAP=w1, N_Blocks [Blocks]=w2, N_DataSym_per_block [Symbol]=w3, N_ControlSym_per_block [Symbol]=w4, N_BlockOverhead [Blocks]=w5, N_AvailableResources [Symbol]=w6, FixedIndexing=w7, InsufficientResources=w8, ZeroPadding [bit]=w9, ControlPading [Symbol]=w10, N_UsedResources [Symbol]=w11, CanNotFit=w12)
  call "count the number of resources.gvi"(resource map as vector=w1) -> (amount of symbols=w13)
  $"amount of symbols" <- w13
  call "create ramp.gvi"(length=w3) -> (data in=w14)
  call "create ramp.gvi"(length=w4, offset=10) -> (data in=w15)
  Build Array(w1, w1) -> w16
  Logical Or(w12, w8) -> w17
  Array Size(array=w1) -> (size(s)=w18)
  Decrement(x=w18) -> w19
  case (w17) {
    frame True {
      w20 = default
      w21 = default
      w22 = default
      w23 = default
    }
    frame False {
      while (iteration -> i1) {
        Feedback Node(input=w24) -> w25
        call "control state machine_SIMULATION.gvi"(loop iteration=i1, control signals_out=w25) -> (control signals out=w26, active_out=w27, configuration_out=w28, reset_out=w29)
        Feedback Node(input=FALSE) -> w30
        Logical Or(w30, w29) -> w31
        call "fifo simulator_32.gvi"(ready for output=w27, Array=w14, reset=w31) -> (element=w32, valid=w33)
        call "fifo simulator_32.gvi"(ready for output=w27, Array=w15, reset=w31) -> (element=w34, valid=w35)
        Feedback Node(input=w36) -> w37
        call "write configuration_SIMULATION.gvi"(ready for output_in=w37, Array_in=w16, active_in=w28) -> (configuration_out=w38)
        call "simulate random ready_for_output.gvi"(ready for output always true=$"ready for output always true") -> (ready for output_out=w39)
        call "RM+RDM test wrapper.gcdl"(control channel_in=w34, N-1=w19, payload valid_in=w33, payload_in=w32, control channel valid_in=w35, ready for output=w39, configuration data=w38, control signals_in=w26) -> (RM valid_out=w40, payload_out=w41, payload valid_out=w42, control channel_out=w43, control signals_out=w24, control channel valid_out=w44, RM u32 sample_out=w45, ready for configuration_out=w36, RM properties=w46)
        $"RM properties" <- w46
        $"loop iteration" <- i1
        Feedback Node[DelayCount=50](input=w47) -> w48
        Array Size(array=w14) -> (size(s)=w49)
        call "collect n samples.gvi"(loop iteration=i1, max samples=w49, increment=w42) -> (stop=w47)
        append w45 to w20 if w40
        append w41 to w22 if w42
        append w43 to w23 if w44
        stop if w48
      }
      call "select data_u32.gvi"(Control Channel_in=w15, data_in=w14, resource map_in=w1) -> (tx data symbols_out=w50)
      Build Array[ConcatenateInputs=True](w50) -> w21
    }
  }
  Build Array(w14, w22, w15, w23) -> w51
  Transpose 2D Array(2D array=w51) -> (transposed array=w52)
  $"input vs output" <- w52
  $"input vs output Graph" <- w51
  Build Array(w20, w21) -> w53
  $"multiplexed sample graph" <- w53
  Transpose 2D Array(2D array=w53) -> (transposed array=w54)
  $"multiplexed sample array" <- w54
  $N_Blocks <- w2
  $"N_BlockOverhead [Blocks]" <- w5
  Is Equal[ComparisonMode=CompareAggregates](x=w20, y=w21) -> w55
  $"equal?" <- w55
  $"N_AvailableResources [Symbol]" <- w6
  $"N_UsedResources [Symbol]" <- w11
  $CanNotFit <- w12
  $InsufficientResources <- w8
  $"ControlPading [Symbol]" <- w10
  $"ZeroPadding [bit]" <- w9
  $FixedIndexing <- w7
  call "CDB to 2.14 FXP 32 bit.gvi"(Input=1+0i) -> (Output=w56)
  $Output <- w56
