vi "Resource (De-)Mapper Toplevel Host Test.gvi"   [LabVIEW Communications System Design Suite 2.0.1]
panel controls:
  "RIO address": string = "RIO0"
  "K_set": i16[] = [1, 2, 3, 4, 5, 6]
  "M_set": i16[] = [1, 2, 3]
  "K": i16 = 8
  "M": i16 = 5
  "PayloadSize [Byte]": u16 = 1
  "ControlSize [Symbol]": u16 = 1
  "next": bool
  "update": bool
  "stop": bool
  "Tab": i32
  "free running": bool
  "Replace Control with Pilots": bool
panel indicators:
  "error in control channel [nr]": i16
  "error in control channel [%]": f64
  "error in data channel [nr]": i16
  "error in data channel [%]": f64
  "Graph": u32[][]
  "description": string  # source out indicates the source of the error.
  "Graph_2": u32[][]
  "loop iteration": i32
diagram:
  $stop <- FALSE
  FPGA Open Node[ProjectItem=":USRP:Resource\\ Map\\ Toplevel", TopVITarget=":USRP:Resource\\ Map\\ Toplevel:Resource\\ \\(De\\-\\)Mapper\\ Toplevel\\.gvi"](RIO address=$"RIO address") -> (error out=w1, reference out=w2)
  Host Fifo Configure Node[FifoName="Updater Resources.grsc\\download"](depth=1000000, error in=w1, reference in=w2) -> (error out=w3, reference out=w4)
  Host Fifo Stop Node[FifoName="Updater Resources.grsc\\download"](error in=w3, reference in=w4) -> (error out=w5, reference out=w6)
  Host Fifo Start Node[FifoName="Updater Resources.grsc\\download"](error in=w5, reference in=w6) -> (error out=w7, reference out=w8)
  Host Fifo Configure Node[FifoName="Resource Mapper Resources.grsc\\TX.RM.Control Channel in"](depth=1000000, error in=w7, reference in=w8) -> (error out=w9, reference out=w10)
  Host Fifo Stop Node[FifoName="Resource Mapper Resources.grsc\\TX.RM.Control Channel in"](error in=w9, reference in=w10) -> (error out=w11, reference out=w12)
  Host Fifo Start Node[FifoName="Resource Mapper Resources.grsc\\TX.RM.Control Channel in"](error in=w11, reference in=w12) -> (error out=w13, reference out=w14)
  Host Fifo Configure Node[FifoName="Resource Mapper Resources.grsc\\TX.RM.payload in"](depth=1000000, error in=w13, reference in=w14) -> (error out=w15, reference out=w16)
  Host Fifo Stop Node[FifoName="Resource Mapper Resources.grsc\\TX.RM.payload in"](error in=w15, reference in=w16) -> (error out=w17, reference out=w18)
  Host Fifo Start Node[FifoName="Resource Mapper Resources.grsc\\TX.RM.payload in"](error in=w17, reference in=w18) -> (error out=w19, reference out=w20)
  Host Fifo Configure Node[FifoName="Resource Mapper Resources.grsc\\RX.RM.Payload out"](depth=1000000, error in=w19, reference in=w20) -> (error out=w21, reference out=w22)
  Host Fifo Stop Node[FifoName="Resource Mapper Resources.grsc\\RX.RM.Payload out"](error in=w21, reference in=w22) -> (error out=w23, reference out=w24)
  Host Fifo Start Node[FifoName="Resource Mapper Resources.grsc\\RX.RM.Payload out"](error in=w23, reference in=w24) -> (error out=w25, reference out=w26)
  Host Fifo Read Node[FifoName="Resource Mapper Resources.grsc\\RX.RM.Payload out"](error in=w25, number of elements=0, reference in=w26) -> (elements remaining=w27, error out=w28, reference out=w29)
  Host Fifo Read Node[FifoName="Resource Mapper Resources.grsc\\RX.RM.Payload out"](error in=w28, number of elements=w27, reference in=w29) -> (error out=w30, reference out=w31)
  Host Fifo Configure Node[FifoName="Resource Mapper Resources.grsc\\TX.RM.samples out"](depth=1000000, error in=w30, reference in=w31) -> (error out=w32, reference out=w33)
  Host Fifo Stop Node[FifoName="Resource Mapper Resources.grsc\\TX.RM.samples out"](error in=w32, reference in=w33) -> (error out=w34, reference out=w35)
  Host Fifo Start Node[FifoName="Resource Mapper Resources.grsc\\TX.RM.samples out"](error in=w34, reference in=w35) -> (error out=w36, reference out=w37)
  Host Fifo Read Node[FifoName="Resource Mapper Resources.grsc\\TX.RM.samples out"](error in=w36, number of elements=0, reference in=w37) -> (elements remaining=w38, error out=w39, reference out=w40)
  Host Fifo Read Node[FifoName="Resource Mapper Resources.grsc\\TX.RM.samples out"](error in=w39, number of elements=w38, reference in=w40) -> (error out=w41, reference out=w42)
  Host Fifo Configure Node[FifoName="Resource Mapper Resources.grsc\\RX.RM.control channel out"](depth=1000000, error in=w41, reference in=w42) -> (error out=w43, reference out=w44)
  Host Fifo Stop Node[FifoName="Resource Mapper Resources.grsc\\RX.RM.control channel out"](error in=w43, reference in=w44) -> (error out=w45, reference out=w46)
  Host Fifo Start Node[FifoName="Resource Mapper Resources.grsc\\RX.RM.control channel out"](error in=w45, reference in=w46) -> (error out=w47, reference out=w48)
  Host Fifo Read Node[FifoName="Resource Mapper Resources.grsc\\RX.RM.control channel out"](error in=w47, number of elements=0, reference in=w48) -> (elements remaining=w49, error out=w50, reference out=w51)
  Host Fifo Read Node[FifoName="Resource Mapper Resources.grsc\\RX.RM.control channel out"](error in=w50, number of elements=w49, reference in=w51) -> (error out=w52, reference out=w53)
  case (w52) {
    frame No Error, Default {
      Dynamic Fpga Interface Cast(reference in=w53, type="Updater FPGA reference.gtype" constant) -> (reference out=w56)
      call "wait for fpga start.gvi"(FPGA interface_in=w56, Error_in=w52) -> (FPGA.Interface_out=w57, Error_out=w58)
      call "reset.gvi"(FPGA interface_in=w57, Error_in=w58) -> (Error_out=w54)
      while {
        call "ResourceMapperOptimization.gvi"(K_set=$K_set, M_set=$M_set, PayloadSize [Byte]=$"PayloadSize [Byte]", ControlSize [Symbol]=$"ControlSize [Symbol]", K=$K, M=$M, Replace Control with Pilots=$"Replace Control with Pilots") -> (R_MAP=w59, N_DataSym_per_block [Symbol]=w60, N_ControlSym_per_block [Symbol]=w61, InsufficientResources=w62, CanNotFit=w63)
        Logical Or(w63, w62) -> w64
        case (w64) {
          frame True {
            w65 = w53
          }
          frame False {
            call "RM config.gvi"(FPGA.Interface=w53, R_MAP=w59, error in=w54) -> (Error=w66)
            Array Size(array=w59) -> (size(s)=w67)
            call "create ramp.gvi"(length=w61) -> (data in=w68)
            while {
              Host Fifo Write Node[FifoName="Resource Mapper Resources.grsc\\TX.RM.Control Channel in"](data=w68, error in=w66, reference in=w53) -> (error out=w69, reference out=w70)
              call "random data.gvi"(length=w60) -> (Array=w71)
              Host Fifo Write Node[FifoName="Resource Mapper Resources.grsc\\TX.RM.payload in"](data=w71, error in=w69, reference in=w70) -> (error out=w72, reference out=w73)
              Host Fifo Read Node[FifoName="Resource Mapper Resources.grsc\\TX.RM.samples out"](error in=w72, number of elements=w67, reference in=w73) -> (data=w74, error out=w75, reference out=w76)
              case ($"Replace Control with Pilots") {
                frame True {
                  w77 = w76
                  w78 = w75
                  w79 = default
                }
                frame False {
                  Host Fifo Read Node[FifoName="Resource Mapper Resources.grsc\\RX.RM.control channel out"](error in=w75, number of elements=w61, reference in=w76) -> (data=w79, error out=w78, reference out=w77)
                }
              }
              Host Fifo Read Node[FifoName="Resource Mapper Resources.grsc\\RX.RM.Payload out"](error in=w78, number of elements=w60, reference in=w77) -> (data=w80, error out=w81, reference out=w65)
              call "Display Error.gvi"(type of dialog="no dialog", error in=w81) -> (description=w82)
              $description <- w82
              Is Not Equal(x=w80, y=w71) -> w83
              Boolean To Integer(Boolean=w83) -> (0, 1=w84)
              Add Array Elements(numeric array=w84) -> (sum=w85)
              $"error in data channel [nr]" <- w85
              Divide(x=w85, y=w60) -> w86
              $"error in data channel [%]" <- w86
              Is Not Equal(x=w79, y=w68) -> w87
              Boolean To Integer(Boolean=w87) -> (0, 1=w88)
              Add Array Elements(numeric array=w88) -> (sum=w89)
              $"error in control channel [nr]" <- w89
              Divide(x=w89, y=w61) -> w90
              $"error in control channel [%]" <- w90
              Build Array(w79, w68, w80, w71) -> w91
              $Graph_2 <- w91
              while {
                Wait(time to wait=1)
                w92 = $stop
                w93 = $update
                Logical Or($"free running", w92, w93, $next) -> w94
                stop if w94
              }
              Logical Or(w92, w93) -> w95
              call "select data_u32.gvi"(Control Channel_in=w68, data_in=w71, resource map_in=w59) -> (tx data symbols_out=w96)
              Build Array(w74, w96) -> w97
              $Graph <- w97
              stop if w95
            }
          }
        }
        $update <- FALSE
        stop if $stop
      }
      while {
        Property Node(instance in=w53, error in=w54) -> ("loop iteration"=w98, error out=w99, instance out=w100)
        $"loop iteration" <- w98
        Wait(time to wait=1)
        stop if $stop
      }
      call "bits to QAM.gvi"()
      w55 = w53
    }
    frame Error {
      w54 = w52
      w55 = w53
    }
  }
  Host Fifo Stop Node[FifoName="Resource Mapper Resources.grsc\\RX.RM.Payload out"](error in=w54, reference in=w55) -> (error out=w101, reference out=w102)
  Host Fifo Stop Node[FifoName="Resource Mapper Resources.grsc\\TX.RM.payload in"](error in=w101, reference in=w102) -> (error out=w103, reference out=w104)
  Host Fifo Stop Node[FifoName="Resource Mapper Resources.grsc\\TX.RM.samples out"](error in=w103, reference in=w104) -> (error out=w105, reference out=w106)
  Host Fifo Stop Node[FifoName="Updater Resources.grsc\\download"](error in=w105, reference in=w106) -> (error out=w107, reference out=w108)
  Host Fifo Stop Node[FifoName="Resource Mapper Resources.grsc\\TX.RM.Control Channel in"](error in=w107, reference in=w108) -> (error out=w109, reference out=w110)
  Get Execution Mode Node(error in=w109, reference in=w110) -> (error out=w111, execution mode=w112, reference out=w113)
  case (w112) {
    frame "hardware", Default {
      FPGA Close Node(error in=w111, reference in=w113) -> (error out=w114)
    }
    frame "simulation" {
      FPGA Close Node(abort?=TRUE, error in=w111, reference in=w113) -> (error out=w114)
    }
  }
  call "Display Error.gvi"(error in=w114)
