vi "Resource (De-)Mapper Toplevel Host Test_Phase Correction.gvi"   [LabVIEW Communications System Design Suite 2.0.1]
panel controls:
  "RIO address": string = "RIO0"
  "K_set": i16[] = [1, 2, 3, 4, 5, 6]
  "M_set": i16[] = [1, 2, 3]
  "K": i16 = 8
  "M": i16 = 5
  "PayloadSize [Byte]": u16 = 1
  "ControlSize [Symbol]": u16 = 1
  "next": bool
  "update": bool
  "stop": bool
  "Tab": i32
  "free running": bool
  "Replace Control with Pilots": bool
  "angle": f64
panel indicators:
  "error in control channel [nr]": i16
  "error in control channel [%]": f64
  "error in data channel [nr]": i16
  "error in data channel [%]": f64
  "Abs Samples": UFXP(2.14)[][]
  "description": string  # source out indicates the source of the error.
  "Graph_2": u32[][]
  "loop iteration": i32
  "IQ received": CFXP(2.14)[]
  "IQ send": CFXP(2.14)[][]
diagram:
  $stop <- FALSE
  FPGA Open Node[ProjectItem=":USRP:Resource\\ Map\\ Toplevel", TopVITarget=":USRP:Resource\\ Map\\ Toplevel:Resource\\ \\(De\\-\\)Mapper\\ Toplevel\\.gvi"](RIO address=$"RIO address") -> (error out=w1, reference out=w2)
  Host Fifo Configure Node[FifoName="Updater Resources.grsc\\download"](depth=1000000, error in=w1, reference in=w2) -> (error out=w3, reference out=w4)
  Host Fifo Stop Node[FifoName="Updater Resources.grsc\\download"](error in=w3, reference in=w4) -> (error out=w5, reference out=w6)
  Host Fifo Start Node[FifoName="Updater Resources.grsc\\download"](error in=w5, reference in=w6) -> (error out=w7, reference out=w8)
  Host Fifo Configure Node[FifoName="Resource Mapper Resources.grsc\\TX.RM.Control Channel in"](depth=1000000, error in=w7, reference in=w8) -> (error out=w9, reference out=w10)
  Host Fifo Stop Node[FifoName="Resource Mapper Resources.grsc\\TX.RM.Control Channel in"](error in=w9, reference in=w10) -> (error out=w11, reference out=w12)
  Host Fifo Start Node[FifoName="Resource Mapper Resources.grsc\\TX.RM.Control Channel in"](error in=w11, reference in=w12) -> (error out=w13, reference out=w14)
  Host Fifo Configure Node[FifoName="Resource Mapper Resources.grsc\\TX.RM.payload in"](depth=1000000, error in=w13, reference in=w14) -> (error out=w15, reference out=w16)
  Host Fifo Stop Node[FifoName="Resource Mapper Resources.grsc\\TX.RM.payload in"](error in=w15, reference in=w16) -> (error out=w17, reference out=w18)
  Host Fifo Start Node[FifoName="Resource Mapper Resources.grsc\\TX.RM.payload in"](error in=w17, reference in=w18) -> (error out=w19, reference out=w20)
  Host Fifo Configure Node[FifoName="Resource Mapper Resources.grsc\\RX.RM.Payload out"](depth=1000000, error in=w19, reference in=w20) -> (error out=w21, reference out=w22)
  Host Fifo Stop Node[FifoName="Resource Mapper Resources.grsc\\RX.RM.Payload out"](error in=w21, reference in=w22) -> (error out=w23, reference out=w24)
  Host Fifo Start Node[FifoName="Resource Mapper Resources.grsc\\RX.RM.Payload out"](error in=w23, reference in=w24) -> (error out=w25, reference out=w26)
  Host Fifo Read Node[FifoName="Resource Mapper Resources.grsc\\RX.RM.Payload out"](error in=w25, number of elements=0, reference in=w26) -> (elements remaining=w27, error out=w28, reference out=w29)
  Host Fifo Read Node[FifoName="Resource Mapper Resources.grsc\\RX.RM.Payload out"](error in=w28, number of elements=w27, reference in=w29) -> (error out=w30, reference out=w31)
  Host Fifo Configure Node[FifoName="Resource Mapper Resources.grsc\\TX.RM.samples out"](depth=1000000, error in=w30, reference in=w31) -> (error out=w32, reference out=w33)
  Host Fifo Stop Node[FifoName="Resource Mapper Resources.grsc\\TX.RM.samples out"](error in=w32, reference in=w33) -> (error out=w34, reference out=w35)
  Host Fifo Start Node[FifoName="Resource Mapper Resources.grsc\\TX.RM.samples out"](error in=w34, reference in=w35) -> (error out=w36, reference out=w37)
  Host Fifo Read Node[FifoName="Resource Mapper Resources.grsc\\TX.RM.samples out"](error in=w36, number of elements=0, reference in=w37) -> (elements remaining=w38, error out=w39, reference out=w40)
  Host Fifo Read Node[FifoName="Resource Mapper Resources.grsc\\TX.RM.samples out"](error in=w39, number of elements=w38, reference in=w40) -> (error out=w41, reference out=w42)
  Host Fifo Configure Node[FifoName="Resource Mapper Resources.grsc\\RX.RM.control channel out"](depth=1000000, error in=w41, reference in=w42) -> (error out=w43, reference out=w44)
  Host Fifo Stop Node[FifoName="Resource Mapper Resources.grsc\\RX.RM.control channel out"](error in=w43, reference in=w44) -> (error out=w45, reference out=w46)
  Host Fifo Start Node[FifoName="Resource Mapper Resources.grsc\\RX.RM.control channel out"](error in=w45, reference in=w46) -> (error out=w47, reference out=w48)
  Host Fifo Read Node[FifoName="Resource Mapper Resources.grsc\\RX.RM.control channel out"](error in=w47, number of elements=0, reference in=w48) -> (elements remaining=w49, error out=w50, reference out=w51)
  Host Fifo Read Node[FifoName="Resource Mapper Resources.grsc\\RX.RM.control channel out"](error in=w50, number of elements=w49, reference in=w51) -> (error out=w52, reference out=w53)
  case (w52) {
    frame No Error, Default {
      Dynamic Fpga Interface Cast(reference in=w53, type="Updater FPGA reference.gtype" constant) -> (reference out=w56)
      call "wait for fpga start.gvi"(FPGA interface_in=w56, Error_in=w52) -> (FPGA.Interface_out=w57, Error_out=w58)
      call "reset.gvi"(FPGA interface_in=w57, Error_in=w58) -> (Error_out=w54)
      while {
        call "ResourceMapperOptimization.gvi"(K_set=$K_set, M_set=$M_set, PayloadSize [Byte]=$"PayloadSize [Byte]", ControlSize [Symbol]=$"ControlSize [Symbol]", K=$K, M=$M, Replace Control with Pilots=$"Replace Control with Pilots") -> (R_MAP=w59, N_DataSym_per_block [Symbol]=w60, N_ControlSym_per_block [Symbol]=w61, InsufficientResources=w62, CanNotFit=w63)
        Logical Or(w63, w62) -> w64
        case (w64) {
          frame True {
            w65 = w53
          }
          frame False {
            call "RM config.gvi"(FPGA.Interface=w53, R_MAP=w59, error in=w54) -> (Error=w66)
            Array Size(array=w59) -> (size(s)=w67)
            call "create ramp.gvi"(length=w61) -> (data in=w68)
            while {
              Host Fifo Write Node[FifoName="Resource Mapper Resources.grsc\\TX.RM.Control Channel in"](data=w68, error in=w66, reference in=w53) -> (error out=w69, reference out=w70)
              call "random data.gvi"(length=w60) -> (Array=w71)
              call "bits to QAM.gvi"(data in=w71, symbol map=[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]) -> (symbols out=w72)
              call "CDB array to 2.14 FXP u32.gvi"(input=w72) -> (output=w73)
              Host Fifo Write Node[FifoName="Resource Mapper Resources.grsc\\TX.RM.payload in"](data=w73, error in=w69, reference in=w70) -> (error out=w74, reference out=w75)
              Host Fifo Read Node[FifoName="Resource Mapper Resources.grsc\\TX.RM.samples out"](error in=w74, number of elements=w67, reference in=w75) -> (data=w76, error out=w77, reference out=w78)
              case ($"Replace Control with Pilots") {
                frame True {
                  w79 = w78
                  w80 = w77
                  w81 = default
                }
                frame False {
                  Host Fifo Read Node[FifoName="Resource Mapper Resources.grsc\\RX.RM.control channel out"](error in=w77, number of elements=w61, reference in=w78) -> (data=w81, error out=w80, reference out=w79)
                }
              }
              Host Fifo Read Node[FifoName="Resource Mapper Resources.grsc\\RX.RM.Payload out"](error in=w80, number of elements=w60, reference in=w79) -> (data=w82, error out=w83, reference out=w65)
              call "Display Error.gvi"(type of dialog="no dialog", error in=w83) -> (description=w84)
              $description <- w84
              Is Not Equal(x=w82, y=w73) -> w85
              Boolean To Integer(Boolean=w85) -> (0, 1=w86)
              Add Array Elements(numeric array=w86) -> (sum=w87)
              $"error in data channel [nr]" <- w87
              Divide(x=w87, y=w60) -> w88
              $"error in data channel [%]" <- w88
              Is Not Equal(x=w81, y=w68) -> w89
              Boolean To Integer(Boolean=w89) -> (0, 1=w90)
              Add Array Elements(numeric array=w90) -> (sum=w91)
              $"error in control channel [nr]" <- w91
              Divide(x=w91, y=w61) -> w92
              $"error in control channel [%]" <- w92
              Build Array(w81, w68, w82, w73) -> w93
              $Graph_2 <- w93
              while {
                Wait(time to wait=1)
                w94 = $stop
                w95 = $update
                Logical Or($"free running", w94, w95, $next) -> w96
                stop if w96
              }
              Logical Or(w94, w95) -> w97
              call "select data_u32.gvi"(Control Channel_in=w68, data_in=w73, resource map_in=w59) -> (tx data symbols_out=w98)
              call "u32 array to 2.14 CFX.gvi"(data=w98) -> (Array=w99)
              call "u32 array to 2.14 CFX.gvi"(data=w76) -> (Array=w100)
              Build Array(w100, w99) -> w101
              Absolute Value(x=w101) -> w102
              $"Abs Samples" <- w102
              call "u32 array to 2.14 CFX.gvi"(data=w82) -> (Array=w103)
              $"IQ received" <- w103
              $"IQ send" <- w101
              Multiply($angle, Pi) -> w104
              Divide(x=w104, y=180) -> w105
              Polar To Complex(r=1, theta=w105) -> (r * e^(i*theta)=w106)
              call "CDB to 2.14 FXP 32 bit.gvi"(Input=w106) -> (Output=w107)
              Property Node(instance in=w53, "factor"=w107)
              stop if w97
            }
          }
        }
        $update <- FALSE
        stop if $stop
      }
      while {
        Property Node(instance in=w53, error in=w54) -> ("loop iteration"=w108, error out=w109, instance out=w110)
        $"loop iteration" <- w108
        Wait(time to wait=1)
        stop if $stop
      }
      w55 = w53
    }
    frame Error {
      w54 = w52
      w55 = w53
    }
  }
  Host Fifo Stop Node[FifoName="Resource Mapper Resources.grsc\\RX.RM.Payload out"](error in=w54, reference in=w55) -> (error out=w111, reference out=w112)
  Host Fifo Stop Node[FifoName="Resource Mapper Resources.grsc\\TX.RM.payload in"](error in=w111, reference in=w112) -> (error out=w113, reference out=w114)
  Host Fifo Stop Node[FifoName="Resource Mapper Resources.grsc\\TX.RM.samples out"](error in=w113, reference in=w114) -> (error out=w115, reference out=w116)
  Host Fifo Stop Node[FifoName="Updater Resources.grsc\\download"](error in=w115, reference in=w116) -> (error out=w117, reference out=w118)
  Host Fifo Stop Node[FifoName="Resource Mapper Resources.grsc\\TX.RM.Control Channel in"](error in=w117, reference in=w118) -> (error out=w119, reference out=w120)
  Get Execution Mode Node(error in=w119, reference in=w120) -> (error out=w121, execution mode=w122, reference out=w123)
  case (w122) {
    frame "hardware", Default {
      FPGA Close Node(error in=w121, reference in=w123) -> (error out=w124)
    }
    frame "simulation" {
      FPGA Close Node(abort?=TRUE, error in=w121, reference in=w123) -> (error out=w124)
    }
  }
  call "Display Error.gvi"(error in=w124)
