vi "Resource (De-)Mapper Toplevel.gvi"   [LabVIEW Communications System Design Suite 2.0.1]
panel controls:
  "control signals_in": "Control Signals.gtype"
  "configuration_in": "Configuration Data.gtype"
  "N-1_in": u16
  "factor": u32
  "offset": CFXP(2.14)
panel indicators:
  "initial reset done_out": bool
  "control signals_out": "Control Signals.gtype"
  "ready for configuration_out": bool
  "RM properties": T1
  "loop iteration": i32
types:
  "Control Signals.gtype" = cluster{"reset!": bool, "reset done?": bool, "request for config!": bool, "config done?": bool, "set active!": bool, "active?": bool}
  "Configuration Data.gtype" = cluster{"data": u64, "data valid": bool, "length": u16, "switch bank after": u16, "address": u16, "bank": u16, "address offset": u16, "update id": u8, "start update": bool}
  T1 = cluster{"Element 1": u16, "Element 2": u16, "Element 3": u16, "Element 4": u16}
diagram:
  clock-driven loop (clock = "Updater Resources.grsc\\250 MHz") (iteration -> i1) forever {
    Feedback Node(input=w1) -> w2
    FIFO Read(Control Protocol Input=w2) -> (Control Protocol Output=w3, data=w4)
    FIFO Write(Control Protocol Input=w3, data=w4, reference in="Resource Mapper Resources.grsc\\RX.RM.T2H.Payload out") -> (Control Protocol Output=w1)
    w5 = "Resource Mapper Resources.grsc\\RX.RM.T2H.control channel out"
    Feedback Node(input=w6) -> w7
    FIFO Read(Control Protocol Input=w7) -> (Control Protocol Output=w8, data=w9)
    FIFO Write(Control Protocol Input=w8, data=w9, reference in=w5) -> (Control Protocol Output=w6)
    call "trigger reset logic.gcdl"(control signals_in=$"control signals_in", loop iteration=i1, cycles to keep in reset=100) -> (control signals_out=w10, initial reset done_out=w11)
    Feedback Node(input=w12) -> w13
    FIFO Read(Control Protocol Input=w13, reference in="Resource Mapper Resources.grsc\\TX.RM.H2T.payload in") -> (Control Protocol Output=w14, data=w15)
    FIFO Create(data type=u32 0, depth=1025) -> (reference out=w16)
    FIFO Write(Control Protocol Input=w14, data=w15, reference in=w16) -> (Control Protocol Output=w12, reference out=w17)
    w18 = "Resource Mapper Resources.grsc\\TX.RM.H2T.Control Channel in"
    Feedback Node(input=w19) -> w20
    FIFO Read(Control Protocol Input=w20, reference in=w18) -> (Control Protocol Output=w21, data=w22)
    FIFO Create(data type=u32 0, depth=1025) -> (reference out=w23)
    FIFO Write(Control Protocol Input=w21, data=w22, reference in=w23) -> (Control Protocol Output=w19, reference out=w24)
    Feedback Node(input=w25) -> w26
    FIFO Read(Control Protocol Input=w26, reference in="Updater Resources.grsc\\download") -> (Control Protocol Output=w27, data=w28)
    Property Node(instance in=$configuration_in, "data"=w28, "data valid"=w27) -> (instance out=w29)
    call "Resource Mapper.gcdl"(payload reference in=w17, control channel reference in=w24, N-1=$"N-1_in", Resource Mapper Fifo_out="Resource Mapper Resources.grsc\\TX.Resource Mapper_out", Configuration data=w29, control signals_in=w10, update id_const=1) -> (control signals_out=w30, ready for RM input_out=w31, control channel length [bytes]=w32, control channel length [samples]=w33, payload length [bytes]=w34, payload length [sample]=w35)
    Build Cluster(w32, w33, w34, w35) -> w36
    $"RM properties" <- w36
    call "Resource Demapper.gcdl"(update id_const=2, data in fifo_in="Resource Mapper Resources.grsc\\RX.Resource Demapper_in", configuration data=w29, control signals_in=w30, N-1_in=$"N-1_in") -> (control signals_out=w37, ready for config input_out=w38)
    $"control signals_out" <- w37
    Logical Or(w38, w31) -> w25
    $"ready for configuration_out" <- w26
    $"initial reset done_out" <- w11
    $"loop iteration" <- i1
  }
  clock-driven loop (clock = "Needed Resources.grsc\\180 MHz") forever {
    FIFO Read(Control Protocol Input=TRUE, reference in="Resource Mapper Resources.grsc\\TX.Resource Mapper_out") -> (Control Protocol Output=w39, data=w40)
    call "complex_multiply_2.14 u32.gcdl"(A=w40, B=$factor) -> (product=w41)
    call "2.14 u32 to cfx.gcdl"(data in=w41) -> (data out=w42)
    Add(w42, $offset) -> w43: CFXP(2.14) Saturate:ConvergentRounding
    Feedback Node(input=w44) -> w45
    Feedback Node(input=w43) -> w46
    call "2.14 cfx to u32.gcdl"(output=w46) -> (x_2=w47)
    FIFO Write(Control Protocol Input=w45, data=w47, reference in="Resource Mapper Resources.grsc\\RX.Resource Demapper_in")
    Feedback Node[DelayCount=4](input=w39) -> w44
    FIFO Write(Control Protocol Input=w45, data=w47, reference in="Resource Mapper Resources.grsc\\TX.RM.T2H.samples out")
  }
