vi "BranchMetricCalc.gvi"   [LabVIEW Communications System Design Suite 2.0.1]
inputs:
  "trellis(i, i+1)": u8
  "encoded symbol": UFXP(2.0)
outputs:
  "branch metric [i], 0": UFXP(2.0)
  "branch metric [j], 0": UFXP(2.0)
  "branch metric [i], 1": UFXP(2.0)
  "branch metric [j], 1": UFXP(2.0)
diagram:
  Number To Boolean Array(number=$"trellis(i, i+1)") -> (Boolean array=w1)
  # Branch Metric Unit (BMU)
  # It used to calculate branch metrics or normed distance between every possible symbol in the code alphabet and the received symbol.
  # This block makes a hard decision, which uses a Hamming distance as a metric.
  Array Index(array=w1) -> (out0[_]=w2, out1[_]=w3, out2[_]=w4, out3[_]=w5, out4[_]=w6, out5[_]=w7, out6[_]=w8, out7[_]=w9)
  Number To Boolean Array(number=$"encoded symbol") -> (Boolean array=w10)
  Array Index(array=w10) -> (out0[_]=w11, out1[_]=w12)
  Logical Exclusive Or(w2, w11) -> w13
  Logical Exclusive Or(w3, w12) -> w14
  Select(s=w14, t=2, f=1) -> w15
  Select(s=w14, t=1, f=0) -> w16
  Select(s=w13, t=w15, f=w16) -> w17
  $"branch metric [i], 0" <- w17
  Logical Exclusive Or(w4, w11) -> w18
  Logical Exclusive Or(w5, w12) -> w19
  Select(s=w19, t=2, f=1) -> w20
  Select(s=w19, t=1, f=0) -> w21
  Select(s=w18, t=w20, f=w21) -> w22
  $"branch metric [i], 1" <- w22
  Logical Exclusive Or(w6, w11) -> w23
  Logical Exclusive Or(w7, w12) -> w24
  Select(s=w24, t=2, f=1) -> w25
  Select(s=w24, t=1, f=0) -> w26
  Select(s=w23, t=w25, f=w26) -> w27
  $"branch metric [j], 0" <- w27
  Logical Exclusive Or(w8, w11) -> w28
  Logical Exclusive Or(w9, w12) -> w29
  Select(s=w29, t=2, f=1) -> w30
  Select(s=w29, t=1, f=0) -> w31
  Select(s=w28, t=w30, f=w31) -> w32
  $"branch metric [j], 1" <- w32
