vi "Packer.gvi"   [LabVIEW Communications System Design Suite 2.0.1]
inputs:
  "Numeric": u8
  "traceback info[j']": UFXP(40.0)
outputs:
  "n": UFXP(9.0)
diagram:
  To Unsigned Word Integer(number=$Numeric) -> w1
  Scale By Power Of 2(n=1, x=w1) -> w2
  Scale By Power Of 2(n=-39, x=$"traceback info[j']") -> w3
  To Unsigned Word Integer(number=w3) -> w4
  Logical Or(w2, w4) -> w5
  To Fixed Point(number=w5) -> w6: UFXP(9.0) Saturate:ConvergentRounding
  $n <- w6
