vi "PathMetricCalc.gvi"   [LabVIEW Communications System Design Suite 2.0.1]
inputs:
  "encoded symbol": UFXP(2.0)
  "trellis(i, i+1)": u8
  "path metric[i+1]": u8
  "path metric[i]": u8
  "traceback info [j]": UFXP(40.0)
  "traceback info [i]": UFXP(40.0)
outputs:
  "path metric [j']": u8
  "path metric [i']": u8
  "traceback infor [j']": UFXP(40.0)
  "traceback infor [i']": UFXP(40.0)
diagram:
  # Path Metric Unit(PMU)
  # used to summarize the branch metrics to get metrics for 2^(K-1) paths where one of the paths will be chosen as the optimal.
  # It is here that the trellis diagram of the code is referenced.
  call "BranchMetricCalc.gvi"(trellis(i, i+1)=$"trellis(i, i+1)", encoded symbol=$"encoded symbol") -> (branch metric [i], 0=w1, branch metric [j], 0=w2, branch metric [i], 1=w3, branch metric [j], 1=w4)
  Add($"path metric[i]", w1) -> w5
  Add($"path metric[i+1]", w3) -> w6
  Is Less Or Equal(x=w5, y=w6) -> w7
  Select(s=w7, t=$"traceback info [i]", f=$"traceback info [j]") -> w8
  Rotate Left With Carry(carry=FALSE, value in=w8) -> (value out=w9)
  $"traceback infor [i']" <- w9
  Select(s=w7, t=w5, f=w6) -> w10
  To Unsigned Byte Integer(number=w10) -> w11
  $"path metric [i']" <- w11
  Add($"path metric[i]", w2) -> w12
  Add($"path metric[i+1]", w4) -> w13
  Is Less Or Equal(x=w12, y=w13) -> w14
  Select(s=w14, t=$"traceback info [i]", f=$"traceback info [j]") -> w15
  Rotate Left With Carry(carry=TRUE, value in=w15) -> (value out=w16)
  $"traceback infor [j']" <- w16
  Select(s=w14, t=w12, f=w13) -> w17
  To Unsigned Byte Integer(number=w17) -> w18
  $"path metric [j']" <- w18
