vi "ResettableViterbiDecoder.gvi"   [LabVIEW Communications System Design Suite 2.0.1]
inputs:
  "encoded symbol": UFXP(2.0)
  "input valid": bool
  "reset": bool
outputs:
  "output valid": bool
  "decoded bit": UFXP(1.0)
  "debug vite internal counter": u16
  "debug reset": bool
  "debug vite internal counter2": u16
diagram:
  Feedback Node(initial value=0, input=w1) -> w2
  # The first valid decoded output is generated 40 VI iterations later. This is because
  # the trace back computation needs this many iterations. Once the first valid output
  # is genereated, any subsequent valid output is generated every iteration (pipelined executions).
  Is Less(x=w2, y=40) -> w3
  # * This is the Viterbi decoder decoding the convolution code with length 7, rate 1/2, and generator vectors {A, B} = {133, 171} octal
  #
  # * The Viterbi decoder consists of three major blocks
  # 1. Branch Metric Unit (BMU) - used to calculate a Hamming distance (hard-decision) between every possible symbol in the code alphabet and the received symbol.
  # 2. Path Metric Unit (PMU) - used to summarize the branch metrics to get metrics for 2^(K-1) paths where one of the paths will be chosen as the optimal.
  # 3. Traceback Unit (TBU) - used to restore, as close as possible, the maximum likelihood path from the decisions made in the PMU.
  Feedback Node(input=w4) -> w5
  Select(s=w3, t=0, f=w5) -> w6
  w7 = [60, 105, 60, 105, 195, 150, 195, 150, 195, 150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]  # Encoded trellis diagram
  # ping-pong memory toggler
  Feedback Node(initial value=FALSE, input=w8) -> w9
  Not(x=w9) -> w8
  # path metric array
  Feedback Node(initial value=[0, 0, 0, 0, 0, 0, 0, 0, 0, 0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], input=w10) -> w11
  # traceback info array
  Feedback Node(initial value=[0, 0, 0, 0, 0, 0, 0, 0, 0, 0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], input=w12) -> w13
  s1 = 511  # shift register
  s2 = w13  # shift register
  s3 = w11  # shift register
  for (N = 32) (iteration -> i1) {
    w14 = each element of w7
    Multiply(2, i1) -> w15
    Add(w15, 64) -> w16
    Select(s=w8, t=w15, f=w16) -> w17
    Array Index(array=s2) -> (out0[w17]=w18, out1[_]=w19)
    Scale By Power Of 2(n=-1, x=w6) -> w20
    To Unsigned Byte Integer(number=w20) -> w21
    Array Index(array=s3) -> (out0[w17]=w22, out1[_]=w23)
    Subtract(x=w22, y=w21) -> w24
    # Traceback Unit
    call "Packer.gvi"(traceback info [j']=w18, numeric=w24) -> (n=w25)
    Subtract(x=w23, y=w21) -> w26
    call "Packer.gvi"(traceback info [j']=w19, numeric=w26) -> (n=w27)
    Max And Min(x=w25, y=w27) -> (min(x,y)=w28: UFXP(9.0))
    Max And Min(x=w28, y=s1) -> (min(x,y)=w29: UFXP(9.0))
    Add(i1, 64) -> w30
    Not(x=w8) -> w31
    Select(s=w31, t=i1, f=w30) -> w32
    call "PathMetricCalc.gvi"(traceback info [i]=w18, traceback info [j]=w19, path metric [i]=w24, path metric [i+1]=w26, trellis(i, i+1)=w14, encoded symbol=$"encoded symbol") -> (traceback info [i']=w33, path metric [i']=w34, traceback info [j']=w35, path metric [j']=w36)
    Add(w32, 32) -> w37
    # Path Metric/Branch Metric Unit
    Replace Array Subset(inArray=s2, index=w32, new=w33, index=w37, new=w35) -> w38
    Replace Array Subset(inArray=s3, index=w32, new=w34, index=w37, new=w36) -> w39
    next s1 = w29
    next s2 = w38
    next s3 = w39
  }
  w4 = s1
  w12 = s2
  w10 = s3
  To Unsigned Word Integer(number=w4) -> w40
  Logical And(w40, 1) -> w41
  To Fixed Point(number=w41) -> w42: UFXP(1.0) Saturate:ConvergentRounding
  $"decoded bit" <- w42
  Feedback Node(input=$reset) -> w43
  $"debug reset" <- w43
  Feedback Node(input=w44) -> w45
  $"debug vite internal counter2" <- w45
  Select(s=$reset, t=0, f=w2) -> w44
  Increment(x=w44) -> w46
  Logical And(w3, $"input valid") -> w47
  Select(s=w47, t=w46, f=w44) -> w1
  Not(x=w3) -> w48
  $"output valid" <- w48
  Feedback Node(input=w2) -> w49
  $"debug vite internal counter" <- w49
