vi "Encoder_reference.gvi"   [LabVIEW Communications System Design Suite 2.0.1]
inputs:
  "Byte Array in": u8[]
  "padding byte size": i32 = 1
  "packet byte size": i32 = 72
outputs:
  "Host Mapper output": u32[]
  "Host Encoder output": UFXP(2.0)[]
  "debug padded array": u8[]
diagram:
  call "Add_PaddingByte.gvi"(Array in_2=$"Byte Array in", packet byte size=$"packet byte size", padding byte size=$"padding byte size") -> (Array=w1)
  Initialize Array(element=0) -> w2
  Initialize Array(element=0) -> w3
  s1 = w2  # shift register
  s2 = w3  # shift register
  for {
    w4 = each element of w1
    Number To Boolean Array(number=w4) -> (Boolean array=w5)
    for {
      w6 = each element of w5
      w9 = [0.707092285156+0.707092285156i, -0.707092285156+0.707092285156i, 0.707092285156-0.707092285156i, -0.707092285156-0.707092285156i]
      # encoding
      call "ConvolutionalEncoder.gvi"(dataIn=w6) -> (encodedSymbolOut=w10)
      To Long Integer(number=w10) -> w11
      # simple qpsk mapping
      Array Index(array=w9) -> (out0[w11]=w12)
      call "c2.14_to_u32.gvi"(input=w12) -> (output=w13)
      append w10 to w7
      append w13 to w8
    }
    Build Array[ConcatenateInputs=True](s1, w8) -> w14
    Build Array[ConcatenateInputs=True](s2, w7) -> w15
    next s1 = w14
    next s2 = w15
  }
  $"Host Mapper output" <- s1
  $"Host Encoder output" <- s2
  $"debug padded array" <- w1
