vi "Encoder_test.gvi"   [LabVIEW Communications System Design Suite 2.0.1]
inputs:
  "random?": bool
panel controls:
  "write to FPGA": bool
  "process": bool
  "Input Array Round": i32 = 3
  "input array length": i32 = 72
  "packet byte size": u32 = 72
  "stop": bool
panel indicators:
  "loop iteration": i32
  "valid in": i16
  "process in": i16
  "mapper compair": bool[]
  "Mapper Error Byte": i32
  "process out": i16
  "encode comair": bool[]
  "fpga encoder output": UFXP(2.0)[]
  "Host Encoder output": UFXP(2.0)[]
  "fpga mapper output": u32[]
  "Host Mapper output": u32[]
  "Mapper output Graph": u32[][]
  "padding byte size(constant )": i32
  "Encoder Error": i32
uses:
  ::USRP::Interactive::Encoder_Test_Wrapper.gcdl
diagram:
  call "Generate_Byte_Array.gvi"(Input Array Round=$"Input Array Round", input array length=$"input array length", random?=$"random?") -> (Array in=w1)
  w2 = $"packet byte size"
  while (iteration -> i1) {
    Boolean To Integer(Boolean=$process) -> (0, 1=w5)
    $"process in" <- w5
    call "fifo simulator_8.gvi"(ready for output=$"write to FPGA", Array=w1) -> (element=w6, valid=w7)
    Boolean To Integer(Boolean=w7) -> (0, 1=w8)
    $"valid in" <- w8
    call "Encoder_Test_Wrapper.gcdl"(data=w6, input valid=w7, packet length (Byte)=w2, ready for output=$process) -> (debug Encoder output vaild=w9, debug encoded U2=w10, output valid=w11, QPSK Sym out=w12)
    Boolean To Integer(Boolean=w11) -> (0, 1=w13)
    $"process out" <- w13
    Wait(time to wait=10)
    $"loop iteration" <- i1
    append w12 to w3 if w11
    append w10 to w4 if w9
    stop if $stop
  }
  $"fpga mapper output" <- w3
  call "Encoder_Reference.gvi"(Byte Array in=w1, padding byte size=1, packet byte size=w2) -> (Host Mapper output=w14, Host Encoder output=w15)
  Is Equal(x=w3, y=w14) -> w16
  $"mapper compair" <- w16
  $"Host Mapper output" <- w14
  Build Array(w3, w14) -> w17
  $"Mapper output Graph" <- w17
  Feedback Node(initial value=0, input=w18) -> w19
  s1 = w19  # shift register
  for {
    w20 = each element of w16
    Increment(x=s1) -> w21
    Select(s=w20, t=s1, f=w21) -> w22
    next s1 = w22
  }
  w18 = s1
  $"Mapper Error Byte" <- w18
  $"fpga encoder output" <- w4
  Is Equal(x=w4, y=w15) -> w23
  $"encode comair" <- w23
  $"padding byte size(constant )" <- 1
  $"Host Encoder output" <- w15
  Feedback Node(initial value=0, input=w24) -> w25
  s2 = w25  # shift register
  for {
    w26 = each element of w23
    Increment(x=s2) -> w27
    Select(s=w26, t=s2, f=w27) -> w28
    next s2 = w28
  }
  w24 = s2
  $"Encoder Error" <- w24
