vi "RefernzTestEncoderAndMapper_And Decoder.gvi"   [LabVIEW Communications System Design Suite 2.0.1]
inputs:
  "random?": bool
panel controls:
  "write to FPGA": bool
  "process": bool
  "Input Array Round": i32 = 3
  "input array length": i32 = 72
  "packet byte size": i32 = 72
  "padding byte size": i32 = 1
  "stop": bool
panel indicators:
  "loop iteration": i32
  "valid in": i16
  "process in": i16
  "mapper compair": bool[]
  "Mapper Error Byte": i32
  "process out": i16
  "array comair": bool[]
  "fpga decoder output": u8[]
  "Host input": u8[]
  "fpga mapper output": u32[]
  "Host Mapper output": u32[]
  "input output Array compair": u8[][]
  "fpga output size(s)": i32
  "host input size(s)": i32
uses:
  ::USRP::Interactive::RefernzTestEncoderAndMapper_And decoder_Wrapper.gcdl
diagram:
  call "Generate_Byte_Array.gvi"(Input Array Round=$"Input Array Round", input array length=$"input array length", random?=$"random?") -> (Array in=w1)
  while (iteration -> i1) {
    Boolean To Integer(Boolean=$process) -> (0, 1=w4)
    $"process in" <- w4
    call "fifo simulator_8.gvi"(ready for output=$"write to FPGA", Array=w1) -> (element=w5, valid=w6)
    Boolean To Integer(Boolean=w6) -> (0, 1=w7)
    $"valid in" <- w7
    call "RefernzTestEncoderAndMapper_And decoder_Wrapper.gcdl"(data=w5, input valid=w6, ready for output=$process) -> (output valid=w8, decoded Byte=w9, mapper output valid=w10, QPSK Sym out=w11)
    Boolean To Integer(Boolean=w8) -> (0, 1=w12)
    $"process out" <- w12
    Wait(time to wait=10)
    $"loop iteration" <- i1
    append w11 to w2 if w10
    append w9 to w3 if w8
    stop if $stop
  }
  $"fpga mapper output" <- w2
  call "Add_PaddingByte.gvi"(Array in_2=w1, packet byte size=$"packet byte size", padding byte size=$"padding byte size") -> (Array=w13)
  call "Encoder_Reference.gvi"(Byte Array in=w13) -> (Host Mapper output=w14)
  Is Equal(x=w2, y=w14) -> w15
  $"mapper compair" <- w15
  $"Host Mapper output" <- w14
  Feedback Node(initial value=0, input=w16) -> w17
  s1 = w17  # shift register
  for {
    w18 = each element of w15
    Increment(x=s1) -> w19
    Select(s=w18, t=s1, f=w19) -> w20
    next s1 = w20
  }
  w16 = s1
  $"Mapper Error Byte" <- w16
  Build Array(w3, w1) -> w21
  $"input output Array compair" <- w21
  Array Size(array=w3) -> (size(s)=w22)
  $"fpga output size(s)" <- w22
  $"fpga decoder output" <- w3
  Is Equal(x=w3, y=w1) -> w23
  $"array comair" <- w23
  $"Host input" <- w1
  Array Size(array=w1) -> (size(s)=w24)
  $"host input size(s)" <- w24
