vi "RefernzTestPadding_Ec_mp_dc.gvi"   [LabVIEW Communications System Design Suite 2.0.1]
inputs:
  "random?": bool
panel controls:
  "write to FPGA": bool
  "process": bool
  "Input Array Round": i32 = 3
  "input array length": i32 = 72
  "packet byte size": i32 = 72
  "padding byte size": i32 = 1
  "stop": bool
panel indicators:
  "loop iteration": i32
  "valid in": i16
  "process in": i16
  "mapper compair": bool[]
  "Mapper Error Byte": i32
  "process out": i16
  "array comair": bool[]
  "fpga decoder output": u8[]
  "Host input": u8[]
  "fpga mapper output": u32[]
  "Host Mapper output": u32[]
  "input output Array compair": u8[][]
  "FPGA output size(s)": i32
  "host input size(s)": i32
  "bits_out": i8[][]
  "coded bytes out": u8[]
  "decoder input_out": i32[]
uses:
  ::USRP::Interactive::Rt_padding_ec_mp_dc_Wrapper.gcdl
diagram:
  call "Generate_Byte_Array.gvi"(Input Array Round=$"Input Array Round", input array length=$"input array length", random?=$"random?") -> (Array in=w1)
  while (iteration -> i1) {
    Boolean To Integer(Boolean=$process) -> (0, 1=w4)
    $"process in" <- w4
    call "fifo simulator_8.gvi"(ready for output=$"write to FPGA", Array=w1) -> (element=w5, valid=w6)
    Boolean To Integer(Boolean=w6) -> (0, 1=w7)
    $"valid in" <- w7
    call "Rt_padding_ec_mp_dc_Wrapper.gcdl"(data=w5, input valid=w6, ready for output=$process) -> (output valid=w8, decoded Byte=w9, mapper output valid=w10, QPSK Sym out=w11)
    Boolean To Integer(Boolean=w8) -> (0, 1=w12)
    $"process out" <- w12
    Wait(time to wait=10)
    $"loop iteration" <- i1
    append w11 to w2 if w10
    append w9 to w3 if w8
    stop if $stop
  }
  $"fpga mapper output" <- w2
  call "Encoder_Reference.gvi"(Byte Array in=w1, padding byte size=$"padding byte size", packet byte size=$"packet byte size") -> (Host Mapper output=w13)
  Is Equal(x=w2, y=w13) -> w14
  $"mapper compair" <- w14
  $"Host Mapper output" <- w13
  Feedback Node(initial value=0, input=w15) -> w16
  s1 = w16  # shift register
  for {
    w17 = each element of w14
    Increment(x=s1) -> w18
    Select(s=w17, t=s1, f=w18) -> w19
    next s1 = w19
  }
  w15 = s1
  $"Mapper Error Byte" <- w15
  Build Array(w3, w1) -> w20
  $"input output Array compair" <- w20
  Array Size(array=w3) -> (size(s)=w21)
  $"FPGA output size(s)" <- w21
  $"fpga decoder output" <- w3
  Is Equal(x=w3, y=w1) -> w22
  $"array comair" <- w22
  $"Host input" <- w1
  Array Size(array=w1) -> (size(s)=w23)
  $"host input size(s)" <- w23
  To Double Precision Complex(number=w13) -> w24
  call "SampleToBit.gvi"(samples_in=w24) -> (bits_out=w25)
  call "ConcatenateByteArray.gvi"(Array_in=w25) -> (Array_out=w26)
  call "decoder_core_reference.gvi"(uncoded bits_in=w26, codewort length in bits=2) -> (coded bytes out=w27, decoder input_out=w28)
  $"coded bytes out" <- w27
  $bits_out <- w25
  $"decoder input_out" <- w28
