vi "decoder_HostreferenceVI_Test.gvi"   [LabVIEW Communications System Design Suite 2.0.1]
inputs:
  "random?": bool
panel controls:
  "Input Array Round": i32 = 3
  "input array length": i32 = 72
  "packet byte size": i32 = 72
  "padding byte size": i32 = 1
panel indicators:
  "Host input": u8[]
  "host input size(s)": i32
  "coded bytes out": u8[]
  "decoder input_out": i32[]
  "cdb size": i32
  "coded byte out size": i32
  "Host Mapper output": u32[]
  "mapper output size": i32
  "concatenate byte array size": i32
  "concatenate byte array size_out": i8[]
  "sample to bit _out": i8[][]
  "double precision complex": c128[]
  "sample to bit size(s)": i32[]
  "Array": CFXP(2.14)[]
  "Host Encoder output": UFXP(2.0)[]
  "Array_2": u8[]
  "size(s)": i32
  "debug padded array": u8[]
  "x = y?": bool[]
  "demapper out size": i32
diagram:
  call "Generate_Byte_Array.gvi"(Input Array Round=$"Input Array Round", input array length=$"input array length", random?=$"random?") -> (Array in=w1)
  call "Encoder_Reference.gvi"(Byte Array in=w1, padding byte size=$"padding byte size", packet byte size=$"packet byte size") -> (Host Mapper output=w2, Host Encoder output=w3, debug padded array=w4)
  $"Host Mapper output" <- w2
  $"Host input" <- w1
  Array Size(array=w2) -> (size(s)=w5)
  $"mapper output size" <- w5
  Array Size(array=w1) -> (size(s)=w6)
  $"host input size(s)" <- w6
  for {
    w7 = each element of w2
    # demapping
    call "u32_to_c2.14.gvi"(Numeric_2=w7) -> (Numeric=w9)
    append w9 to w8
  }
  To Double Precision Complex(number=w8) -> w10
  call "SampleToBit.gvi"(samples_in=w10) -> (bits_out=w11)
  $"sample to bit _out" <- w11
  call "ConcatenateByteArray.gvi"(Array_in=w11) -> (Array_out=w12)
  $"concatenate byte array size_out" <- w12
  $"double precision complex" <- w10
  Array Size(array=w12) -> (size(s)=w13)
  $"concatenate byte array size" <- w13
  Array Size(array=w11) -> (size(s)=w14)
  $"sample to bit size(s)" <- w14
  Array Size(array=w10) -> (size(s)=w15)
  $"cdb size" <- w15
  Add($"Input Array Round", $"host input size(s)") -> w16
  Multiply(w16, 8) -> w17
  call "decoder_core_reference.gvi"(uncoded bits_in=w12, codewort length in bits=w17) -> (coded bytes out=w18, decoder input_out=w19)
  Array Size(array=w18) -> (size(s)=w20)
  $"coded byte out size" <- w20
  $"decoder input_out" <- w19
  $"Host Encoder output" <- w3
  call "Remove_PaddingByte.gvi"(Array in=w18, packet byte size=$"packet byte size", padding byte size=$"padding byte size") -> (Array_2=w21, size(s)=w22)
  $Array_2 <- w21
  $Array <- w8
  $"size(s)" <- w22
  Array Size(array=w8) -> (size(s)=w23)
  $"demapper out size" <- w23
  $"debug padded array" <- w4
  $"coded bytes out" <- w18
  Is Equal(x=w4, y=w18) -> w24
  $"x = y?" <- w24
