vi "QAM_Constellation_Test.gvi"   [LabVIEW Communications System Design Suite 2.0.1]
panel controls:
  "N": i32
  "Gray_map?": bool
  "order": "QAM-Order.gtype" = "4-QAM"
panel indicators:
  "QAM": CFXP(2.14)[]
  "Graph": CFXP(2.14)[]
types:
  "QAM-Order.gtype" = enum{"4-QAM", "16-QAM", "64-QAM", "256-QAM"}
uses:
  ::USRP::Interactive::QAM_Mapper.gcdl
diagram:
  Increment(x=$N) -> w1
  for (N = w1) (iteration -> i1) {
    Quotient And Remainder(x=i1, y=w1) -> (x-y*floor(x/y)=w3)
    To Unsigned Byte Integer(number=w3) -> w4
    call "QAM_Mapper.gcdl"(order=$order, bits=w4, enable=TRUE, Gray_map?=$"Gray_map?", input valid=TRUE) -> (QAM-symbol=w5)
    append w5 to w2
  }
  Array Subset(array=w2, index0=2) -> w6
  $Graph <- w6
  $QAM <- w6
