vi "QAM_collectBits_Test.gvi"   [LabVIEW Communications System Design Suite 2.0.1]
panel controls:
  "order": "QAM-Order.gtype" = "4-QAM"
  "N": u32
panel indicators:
  "BitsOut": bool[][]
  "BitsIn": bool[][]
types:
  "QAM-Order.gtype" = enum{"4-QAM", "16-QAM", "64-QAM", "256-QAM"}
uses:
  ::USRP::Interactive::QAM_collectBits.gcdl
  ::USRP::Interactive::QAM_scatterBits.gcdl
diagram:
  w1 = $N
  w2 = $order
  while (iteration -> i1) {
    Random Number() -> (number (0 to 1)=w5)
    Is Greater(x=0.5, y=w5) -> w6
    Random Number() -> (number (0 to 1)=w7)
    Is Greater(x=0.5, y=w7) -> w8
    Random Number() -> (number (0 to 1)=w9)
    Is Greater(x=0.5, y=w9) -> w10
    Replace Array Subset(inArray=bool[2] default, index=_, new=w8, index=_, new=w10) -> w11
    call "QAM_collectBits.gcdl"(order=w2, bitsIn=w11, input valid=w6) -> (bitsOut=w12, ValidOut=w13)
    Number To Boolean Array(number=w12) -> (Boolean array=w14)
    call "QAM_scatterBits.gcdl"(bitsIn=w12, inputValid=w13) -> (output valid=w15)
    call "collect n samples.gvi"(loop iteration=i1, max samples=w1, increment=w15) -> (stop=w16)
    append w11 to w3 if w6
    append w14 to w4 if w13
    stop if w16
  }
  $BitsOut <- w4
  $BitsIn <- w3
