vi "QAM_scatterBits_Test.gvi"   [LabVIEW Communications System Design Suite 2.0.1]
panel controls:
  "order": "QAM-Order.gtype" = "4-QAM"
  "N": u32
panel indicators:
  "BitsOut": bool[][]
  "BitsIn": bool[][]
  "BitsOutReshaped": bool[]
  "BitsInReshaped": bool[]
  "correct!": bool
types:
  "QAM-Order.gtype" = enum{"4-QAM", "16-QAM", "64-QAM", "256-QAM"}
uses:
  ::USRP::Interactive::QAM_scatterBits.gcdl
diagram:
  w1 = $N
  w2 = $order
  Array Index(array=[2, 4, 6, 8]) -> (out0[w2]=w3)
  while (iteration -> i1) {
    Random Number() -> (number (0 to 1)=w6)
    Is Greater(x=0.5, y=w6) -> w7
    for (N = w3) {
      Random Number() -> (number (0 to 1)=w9)
      Is Greater(x=0.5, y=w9) -> w10
      append w10 to w8
    }
    Boolean Array To Number(Boolean array=w8) -> (number=w11: u8)
    call "QAM_scatterBits.gcdl"(bitsIn=w11, inputValid=w7, order=w2, reset=FALSE) -> (scatterdBitsU2=w12, output valid=w13)
    Number To Boolean Array(number=w12) -> (Boolean array=w14)
    call "collect n samples.gvi"(loop iteration=i1, max samples=w1, increment=w13) -> (stop=w15)
    append w8 to w4 if w7
    append w14 to w5 if w13
    stop if w15
  }
  $BitsOut <- w5
  Array Size(array=w5) -> (size(s)=w16)
  Multiply Array Elements(numeric array=w16) -> (product=w17)
  Reshape Array(inArray=w5, size=w17) -> w18
  $BitsOutReshaped <- w18
  Array Size(array=w4) -> (size(s)=w19)
  Multiply Array Elements(numeric array=w19) -> (product=w20)
  Reshape Array(inArray=w4, size=w20) -> w21
  Split 1D Array(array=w21, index=w17) -> (first subarray=w22)
  Is Equal(x=w18, y=w22) -> w23
  And Array Elements(Boolean array=w23) -> (logical AND=w24)
  $"correct!" <- w24
  $BitsIn <- w4
  $BitsInReshaped <- w22
