vi "QAM_simple_Test.gvi"   [LabVIEW Communications System Design Suite 2.0.1]
panel controls:
  "stop": bool
  "Index in": u8
  "gray_map?": bool
  "err": CFXP(2.14)
  "order": "QAM-Order.gtype" = "4-QAM"
  "enable": bool = TRUE
panel indicators:
  "Index out": u8
  "qam": CFXP(2.14)
  "qam err": CFXP(2.14)
  "QAM e": CFXP(2.14)
types:
  "QAM-Order.gtype" = enum{"4-QAM", "16-QAM", "64-QAM", "256-QAM"}
uses:
  ::USRP::Interactive::QAM_Mapper.gcdl
  ::USRP::Interactive::QAM_Demapper.gcdl
diagram:
  while {
    Wait(time to wait=100)
    call "QAM_Mapper.gcdl"(order=$order, bits=$"Index in", enable=$enable, Gray_map?=$"gray_map?", input valid=TRUE) -> (QAM-symbol=w1, output valid=w2)
    Add(w1, $err) -> w3: CFXP(2.14) Saturate:ConvergentRounding
    call "QAM_Demapper.gcdl"(QAM-symbol=w3, order=$order, enable=$enable, Gray_map?=$"gray_map?", input valid=w2) -> (bits=w4, output valid=w5)
    call "QAM_Mapper.gcdl"(order=$order, bits=w4, enable=TRUE, Gray_map?=w2, input valid=w5) -> (QAM-symbol=w6)
    $"QAM e" <- w6
    $"qam err" <- w3
    $qam <- w1
    $"Index out" <- w4
    stop if $stop
  }
