vi "Add_PaddingByte.gvi"   [LabVIEW Communications System Design Suite 2.0.1]
inputs:
  "Array in_2": u8[]
  "packet byte size": i32 = 72
  "padding byte size": i32 = 1
outputs:
  "Array": u8[]
diagram:
  Obtain Queue(element data type=u8 0) -> (queue out=w1)
  for {
    w2 = each element of $"Array in_2"
    Enqueue Element(element=w2, queue=w1)
  }
  Subtract(x=$"packet byte size", y=$"padding byte size") -> w3
  Initialize Array(element=0) -> w4
  Array Size(array=$"Array in_2") -> (size(s)=w5)
  Divide(x=w5, y=$"packet byte size") -> w6
  Round Toward Negative Infinity(x=w6) -> w7
  s1 = w4  # shift register
  for (N = w7) {
    Initialize Array(element=0, size=$"padding byte size") -> w8
    # padding
    for (N = w3) {
      Dequeue Element(queue=w1) -> (element=w10)
      append w10 to w9
    }
    Build Array[ConcatenateInputs=True](s1, w9, w8) -> w11
    next s1 = w11
  }
  $Array <- s1
