vi "Function_2.gvi"   [LabVIEW Communications System Design Suite 2.0.1]
panel indicators:
  "Graph": i32[]
  "Chart": i32
  "element": CFXP(2.14)
  "32-bit integer": i32
  "U2": UFXP(2.0)
  "number": UFXP(2.0)
diagram:
  for (N = 100) (iteration -> i1) {
    Wait(time to wait=100)
    $Chart <- i1
    append i1 to w1
  }
  $Graph <- w1
  w2 = [-0.707092285156-0.707092285156i, -0.707092285156+0.707092285156i, 0.707092285156-0.707092285156i, 0.707092285156+0.707092285156i]
  Boolean Array To Number(Boolean array=[TRUE, FALSE]) -> (number=w3)
  To Long Integer(number=w3) -> w4
  Array Index(array=w2) -> (out0[w4]=w5)
  $element <- w5
  $"32-bit integer" <- w4
  Boolean Array To Number(Boolean array=[TRUE, FALSE]) -> (number=w6: UFXP(2.0))
  $U2 <- w6
  Build Array(TRUE, FALSE) -> w7
  Boolean Array To Number(Boolean array=w7) -> (number=w8: UFXP(2.0))
  $number <- w8
