vi "Generate_Byte_Array.gvi"   [LabVIEW Communications System Design Suite 2.0.1]
inputs:
  "Input Array Round": i32 = 3
  "input array length": i32 = 72
  "random?": bool
outputs:
  "Array in": u8[]
diagram:
  Initialize Array(element=0) -> w1
  s1 = w1  # shift register
  for (N = $"Input Array Round") {
    for (N = $"input array length") (iteration -> i1) {
      case ($"random?") {
        frame False, Default {
          To Unsigned Byte Integer(number=i1) -> w3
        }
        frame True {
          Random Number() -> (number (0 to 1)=w4)
          Multiply(w4, 255) -> w5
          To Unsigned Byte Integer(number=w5) -> w3
        }
      }
      append w3 to w2
    }
    Build Array[ConcatenateInputs=True](s1, w2) -> w6
    next s1 = w6
  }
  $"Array in" <- s1
