vi "Remove_PaddingByte.gvi"   [LabVIEW Communications System Design Suite 2.0.1]
inputs:
  "Array in": u8[]
  "packet byte size": i32 = 72
  "padding byte size": i32 = 1
outputs:
  "Array": u8[]
  "Array_2": u8[]
  "size(s)": i32
diagram:
  Obtain Queue(element data type=u8 0) -> (queue out=w1)
  for {
    w2 = each element of $"Array in"
    Enqueue Element(element=w2, queue=w1)
  }
  Subtract(x=$"packet byte size", y=$"padding byte size") -> w3
  Initialize Array(element=0) -> w4
  Array Size(array=$"Array in") -> (size(s)=w5)
  Divide(x=w5, y=$"packet byte size") -> w6
  Round Toward Negative Infinity(x=w6) -> w7
  s1 = w4  # shift register
  for (N = w7) {
    # padding
    for (N = w3) {
      Dequeue Element(queue=w1) -> (element=w9)
      append w9 to w8
    }
    Initialize Array(element=0, size=$"padding byte size") -> w10
    Build Array[ConcatenateInputs=True](s1, w8, w10) -> w11
    next s1 = w11
  }
  $Array <- s1
  s2 = $"Array in"  # shift register
  for (N = w7) (iteration -> i1) {
    Decrement(x=$"packet byte size") -> w12
    Increment(x=i1) -> w13
    Multiply(w12, w13) -> w14
    Delete From Array(inArray=s2, index0=w14) -> w15
    next s2 = w15
  }
  $Array_2 <- s2
  Array Size(array=s2) -> (size(s)=w16)
  $"size(s)" <- w16
