vi "SampleToBit.gvi"   [LabVIEW Communications System Design Suite 2.0.1]
inputs:
  "samples_in": c128[]
outputs:
  "QAM mapped symbols_out": UFXP(2.0)[]
  "bits_out": i8[][]
diagram:
  for {
    w1 = each element of $samples_in
    Complex To Real Imaginary(x + iy=w1) -> (x=w4, y=w5)
    Is Greater Than 0(x=w4) -> w6
    Is Greater Than 0(x=w5) -> w7
    Build Array(w7, w6) -> w8
    Boolean Array To Number(Boolean array=w8) -> (number=w9: UFXP(2.0))
    Array Index(array=[3, 1, 2, 0]) -> (out0[w9]=w10)
    Array Subset(array=[[1, 1], [1, 0], [0, 1], [0, 0]], index0=w9, length0=1) -> w11
    append w10 to w2
    concatenate w11 onto w3
  }
  $"QAM mapped symbols_out" <- w2
  $bits_out <- w3
