vi "Send UDP test data.gvi"   [LabVIEW Communications System Design Suite 2.0.1]
panel controls:
  "stop": bool
  "Next": bool
  "bits per symbol": u8 = 1
  "Array": u8[]
panel indicators:
  "loop iteration": i32
  "data out": u8[]
  "output bit stream": i8[]
  "symbols": c128[]
  "Graph": c128[][]
  "bits out": i8[]
  "equal": bool
  "output integers": u8[]
  "equal_2": bool
diagram:
  w1 = "127.0.0.1"  # address
  String To Ip Address(name=w1) -> (net address=w2)
  Udp Open(net address=w2, port=12344, service name="ac") -> (connection ID=w3, error out=w4)
  while (iteration -> i1) {
    w5 = $stop
    while {
      Wait(time to wait=100)
      Logical Or($Next, w5) -> w6
      stop if w6
    }
    for (N = 10) (iteration -> i2) {
      Add(i2, i1) -> w8
      To Unsigned Byte Integer(number=w8) -> w9
      append w9 to w7
    }
    Udp Write Binary(address=w2, connection ID=w3, data in=w7, error in=w4, port or service name=12345) -> (connection ID out=w10, error out=w11)
    $Array <- w7
    $"loop iteration" <- i1
    stop if w5
  }
  Udp Close(connection ID=w10, error in=w11)
  $stop <- FALSE
  w12 = "127.0.0.1"  # address
  String To Ip Address(name=w12) -> (net address=w13)
  Udp Open(net address=w13, port=12345, service name="ac") -> (connection ID=w14)
  while {
    call "create symbol map.gvi"(bits per symbol=$"bits per symbol") -> (symbol map=w15)
    Udp Read I Pv 6 Binary(connection ID=w14, max size=10) -> (data out=w16, error out=w17)
    call "bits to QAM.gvi"(data in=w16, symbol map=w15) -> (output bit stream=w18, symbols out=w19)
    Random Number() -> (number (0 to 1)=w20)
    Divide(x=w20, y=100) -> w21
    Add(w19, w21) -> w22
    call "QAM to bits.gvi"(symbol map=w15, symbols in=w22) -> (byte out=w23, bits out=w24)
    for {
      w25 = each element of w23
      To Unsigned Byte Integer(number=w25) -> w27
      append w27 to w26
    }
    Is Equal[ComparisonMode=CompareAggregates](x=$Array, y=w26) -> w28
    $equal_2 <- w28
    $"data out" <- w16
    call "Clear Error Cluster.gvi"(error in=w17)
    $"output integers" <- w26
    $"output bit stream" <- w18
    Is Equal[ComparisonMode=CompareAggregates](x=w18, y=w24) -> w29
    $equal <- w29
    Build Array(w19, w22) -> w30
    $Graph <- w30
    $symbols <- w19
    $"bits out" <- w24
    stop if $stop
  }
