vi "Set Socket Option.gvi"   [LabVIEW NXG]
inputs:
  "connection in": UdpNetworkConnectionRefnum
  "level": i32 = 65535
  "option name": i32 = 4098
  "value": u32
  "error in": error
outputs:
  "error out": error
  "connection out": UdpNetworkConnectionRefnum
diagram:
  $"connection out" <- $"connection in"
  Type Cast(type=u32 0, x=$"connection in") -> w1
  Native Method Call(error in=$"error in", nc=w1) -> (error out=w2, rawnetobject out=w3, return=w4)  # LabVIEW:NCGetRawNetObject
  Is Equal To 0(x=w4) -> w5
  case (w5) {
    frame False, Default {
      Call Chain() -> (callchain=w7)
      Concatenate Strings(w7) -> w8
      Format Into String(formatString="NCGetRawObjectName failed: error code %d\r\nCall chain: %s", w4, w8) -> w9
      Property Node(instance in=no error, "status"=TRUE, "code"=-1, "source"=w9) -> (instance out=w10)
      Merge Errors(w2, w10) -> (error out=w6)
    }
    frame True {
      To Long Integer(number=w3) -> w11
      Native Method Call(error in=w2, level=$level, optname=$"option name", size=4, socket=w11, value in=$value) -> (error out=w12, return=w13)  # wsock32.dll:setsockopt
      Is Equal To 0(x=w13) -> w14
      case (w14) {
        frame True {
          w6 = w12
        }
        frame False {
          Call Chain() -> (callchain=w15)
          Concatenate Strings(w15) -> w16
          Format Into String(formatString="setsockopt failed: error code %d\r\nCall chain: %s", w13, w16) -> w17
          Property Node(instance in=no error, "status"=TRUE, "code"=-1, "source"=w17) -> (instance out=w18)
          Merge Errors(w12, w18) -> (error out=w6)
        }
      }
    }
  }
  $"error out" <- w6
