vi "UDP-FPGA-UDP Test.gvi"   [LabVIEW Communications System Design Suite 2.0.1]
panel controls:
  "UDP receive port": u16 = 50001
  "packet size": i32 = 576
  "stop": bool
  "bits per symbol": u8 = 1
  "UDP send.port or service name": u16 = 60000
panel indicators:
  "receive FIFO full": bool
  "UDP receive error": string  # source out indicates the source of the error.
  "TX.empty elements remaining": u32
  "RX.elements remaining": u32
  "RX elements read": u32
  "FIFO overflow": u64
  "number of packets": u64
  "number of samples": u64
  "number of cycles": u64
  "number of invalid samples": u64
  "time occupied": f64
  "time unoccupied": f64
  "packet size_2": f64
diagram:
  call "config UDP.gvi"(receive port (from vlc player)=$"UDP receive port") -> (UDP receive=w1, UDP send=w2, error out=w3)
  w4 = $"packet size"
  FPGA Open Node[ProjectItem=":NullTarget:USRP\\-Read\\ Packet\\ FIFO\\ toplevel\\-0003\\.lvbitx"](RIO address="RIO0", error in=w3) -> (error out=w5, reference out=w6)
  FPGA Download Node(error in=w5, reference in=w6) -> (error out=w7, reference out=w8)
  FPGA Run Node(error in=w7, reference in=w8) -> (error out=w9, reference out=w10)
  Host Fifo Configure Node[FifoName="USRP Resources.grsc\\data in"](depth=650000, error in=w9, reference in=w10) -> (error out=w11, reference out=w12)
  Host Fifo Start Node[FifoName="USRP Resources.grsc\\data in"](error in=w11, reference in=w12) -> (error out=w13, reference out=w14)
  Host Fifo Configure Node[FifoName="USRP Resources.grsc\\data out"](depth=650000, error in=w13, reference in=w14) -> (error out=w15, reference out=w16)
  Host Fifo Start Node[FifoName="USRP Resources.grsc\\data out"](error in=w15, reference in=w16) -> (error out=w17, reference out=w18)
  case (w17) {
    frame No Error, Default {
      sequence {
        frame 0 {
          Property Node(instance in=w18, "length"=w4, "reset"=TRUE, "reset"=FALSE, error in=w17) -> (error out=w21, instance out=w22)
          $stop <- FALSE
        }
        frame 1 {
          Wait(time to wait=1000)
        }
      }
      call "create symbol map.gvi"(bits per symbol=$"bits per symbol") -> (symbol map=w23)
      s1 = w21  # shift register
      while (after w4) {
        call "UDP read.gvi"(UDP connection=w1, Error=s1) -> (receive FIFO full=w24, data out=w25, UDP receive error=w26, error out=w27)
        call "bits to QAM.gvi"(data in=w25, symbol map=w23) -> (symbols out=w28)
        call "CDB array to 2.14 FXP u32.gvi"(input=w28) -> (output=w29)
        Host Fifo Write Node[FifoName="USRP Resources.grsc\\data in"](data=w29, error in=w27, reference in=w22) -> (empty elements remaining=w30, error out=w31, reference out=w20)
        $"TX.empty elements remaining" <- w30
        $"receive FIFO full" <- w24
        $"UDP receive error" <- w26
        next s1 = w31
        stop if $stop
      }
      s2 = w21  # shift register
      while (after w4) {
        Host Fifo Read Node[FifoName="USRP Resources.grsc\\data out"](error in=s2, number of elements=0, reference in=w22) -> (elements remaining=w32, error out=w33, reference out=w34)
        Host Fifo Read Node[FifoName="USRP Resources.grsc\\data out"](error in=w33, number of elements=w32, reference in=w34) -> (data=w35, elements remaining=w36)
        $"RX.elements remaining" <- w36
        for {
          w37 = each element of w35
          call "u32 to 2.14 CDB.gvi"(u32=w37) -> (CFX out=w39)
          append w39 to w38
        }
        call "QAM to bits.gvi"(symbol map=w23, symbols in=w38) -> (byte out=w40)
        for {
          w41 = each element of w40
          To Unsigned Byte Integer(number=w41) -> w43
          append w43 to w42
        }
        call "UDP send.gvi"(UDP send.port or service name=$"UDP send.port or service name", Input=w2, Array=w42, Error=w33) -> (Error_2=w44)
        $"RX elements read" <- w32
        next s2 = w44
        stop if $stop
      }
      while {
        Property Node(instance in=w22, error in=w21) -> ("FIFO overflow"=w45, "number of packets"=w46, "number of samples"=w47, "number of cycles"=w48, "number of invalid samples"=w49)
        $"FIFO overflow" <- w45
        $"number of packets" <- w46
        $"number of samples" <- w47
        $"number of cycles" <- w48
        $"number of invalid samples" <- w49
        Divide(x=w47, y=w48) -> w50
        $"time occupied" <- w50
        Divide(x=w49, y=w48) -> w51
        $"time unoccupied" <- w51
        Divide(x=w47, y=w46) -> w52
        $"packet size_2" <- w52
        Wait(time to wait=10)
        stop if $stop
      }
      w19 = s1
    }
    frame Error {
      w19 = w17
      w20 = w18
    }
  }
  Host Fifo Stop Node[FifoName="USRP Resources.grsc\\data in"](error in=w19, reference in=w20) -> (error out=w53, reference out=w54)
  Host Fifo Stop Node[FifoName="USRP Resources.grsc\\data out"](error in=w53, reference in=w54) -> (error out=w55, reference out=w56)
  FPGA Close Node(error in=w55, reference in=w56)
