vi "config UDP.gvi"   [LabVIEW Communications System Design Suite 2.0.1]
inputs:
  "receive port (from vlc player)": u16 = 12345
  "error in": error
outputs:
  "UDP receive": UdpNetworkConnectionRefnum
  "UDP send": UdpNetworkConnectionRefnum
  "error out": error
diagram:
  w1 = "localhost"  # address
  # initial
  String To Ip Address(name=w1) -> (net address=w2)
  # UDP receiver
  Udp Open(error in=$"error in", net address=w2, port=$"receive port (from vlc player)", service name="", timeout ms=25000) -> (connection ID=w3, error out=w4)
  Property Node(instance in=w4) -> ("code"=w5, instance out=w6)
  # configure data resource
  case (w5) {
    frame 0, Default {
      w9 = 0xFFFF  # level SOL_SOCKET
      w10 = 1024000  # buffer size in bytes
      w11 = 0x1002  # optname SO_RCVBUF
      call "Set Socket Option.gvi"(connection in=w3, level=w9, option name=w11, value=w10, error in=w6) -> (error out=w8, connection out=w7)
    }
    frame 60 {
      call "Clear Errors.gvi"(specific error code to clear=w5, error in=w6) -> (error out=w8)
      w12 = "The specified port or network address is currently in use, e.g. by another instance of this VI. Select an available port or network address."
      One Button Dialog(message=w12)
      w7 = w3
    }
  }
  $"UDP receive" <- w7
  Udp Open(error in=w8, net address=0, port=0, service name="", timeout ms=25000) -> (connection ID=w13, error out=w14)
  call "Set Socket Option.gvi"(connection in=w13, level=0xFFFF, option name=0x1001, value=1024000, error in=w14) -> (error out=w15, connection out=w16)
  $"UDP send" <- w16
  $"error out" <- w15
