vi "decoder_core_reference.gvi"   [LabVIEW Communications System Design Suite 2.0.1]
inputs:
  "uncoded bits_in": i8[]
  "codewort length in bits": i32
outputs:
  "uncoded bits out": i8[]
  "coded bytes out": u8[]
  "decoder input_out": i32[]
diagram:
  Array Size(array=$"uncoded bits_in") -> (size(s)=w1)
  while (iteration -> i1) {
    Multiply(i1, $"codewort length in bits") -> w5
    Array Subset(array=$"uncoded bits_in", index0=w5, length0=$"codewort length in bits") -> w6
    # add 40 padding bits
    Initialize Array(element=0, size=82) -> w7
    Build Array[ConcatenateInputs=True](w6, w7) -> w8
    call "MT Convolutional Decoder (Viterbi Hard Decision, Rate).gvi"(input bit stream=w8, rate="1/2", constraint length=7, traceback depth=40) -> (output bit stream=w9)
    call "MT Pack Bits.gvi"(input bit stream=w9, bits per integer=8, packed bit order="LSB first") -> (output integers=w10)
    call "getU8.gvi"(output integers=w10) -> (Array=w11)
    Array Size(array=w11) -> (size(s)=w12)
    Decrement(x=w12) -> w13
    Array Subset(array=w11, length0=w13) -> w14
    call "MT Pack Bits.gvi"(input bit stream=w8, bits per integer=2, packed bit order="LSB first") -> (output integers=w15)
    Add(w5, $"codewort length in bits") -> w16
    Is Greater Or Equal(x=w16, y=w1) -> w17
    concatenate w14 onto w2
    concatenate w6 onto w3
    concatenate w15 onto w4
    stop if w17
  }
  $"uncoded bits out" <- w3
  $"coded bytes out" <- w2
  $"decoder input_out" <- w4
