vi "fifo simulator_8.gvi"   [LabVIEW NXG]
inputs:
  "ready for output": bool
  "Array": u8[]
outputs:
  "element": u8
  "valid": bool
  "address": u32
diagram:
  Increment(x=w1) -> w2
  Select(s=$"ready for output", t=w2, f=w1) -> w3
  Feedback Node(Initializer=0, Input=w3) -> (Output=w1)
  Array Index(array=$Array) -> (out0[w1]=w4)
  $element <- w4
  Array Size(array=$Array) -> (size(s)=w5)
  Is Greater(x=w5, y=w1) -> w6
  Logical And(w6, $"ready for output") -> w7
  $valid <- w7
  $address <- w3
