vi "fifo simulator_u32.gvi"   [LabVIEW Communications System Design Suite 2.0.1]
inputs:
  "ready for output": bool
  "Array": u32[]
outputs:
  "element": u32
  "valid": bool
  "address": u32
diagram:
  Feedback Node(initial value=0, input=w1) -> w2
  Array Index(array=$Array) -> (out0[w2]=w3)
  $element <- w3
  Array Size(array=$Array) -> (size(s)=w4)
  Is Greater(x=w4, y=w2) -> w5
  Logical And(w5, $"ready for output") -> w6
  $valid <- w6
  Increment(x=w2) -> w7
  Select(s=$"ready for output", t=w7, f=w2) -> w1
  $address <- w1
