vi "Decoder_Reference.gvi"   [LabVIEW Communications System Design Suite 2.0.1]
inputs:
  "Mapped code": u32[]
  "code word length (bit)": i32
  "packet byte size": i32 = 72
  "padding byte size": i32 = 1
outputs:
  "coded bytes (with padding Byte)": u8[]
  "Decoder Reference Output": u8[]
  "Decoder Refernce size": i32
diagram:
  for {
    w1 = each element of $"Mapped code"
    # demapping
    call "u32_to_c2.14.gvi"(Numeric_2=w1) -> (Numeric=w3)
    append w3 to w2
  }
  To Double Precision Complex(number=w2) -> w4
  call "SampleToBit.gvi"(samples_in=w4) -> (bits_out=w5)
  call "ConcatenateByteArray.gvi"(Array_in=w5) -> (Array_out=w6)
  call "decoder_core_reference.gvi"(uncoded bits_in=w6, codewort length in bits=$"code word length (bit)") -> (coded bytes out=w7)
  $"coded bytes (with padding Byte)" <- w7
  call "Remove_PaddingByte.gvi"(Array in=w7, packet byte size=$"packet byte size", padding byte size=$"padding byte size") -> (Array_2=w8, size(s)=w9)
  $"Decoder Reference Output" <- w8
  $"Decoder Refernce size" <- w9
