vi "Decoder_Test.gvi"   [LabVIEW Communications System Design Suite 2.0.1]
inputs:
  "random?": bool
panel controls:
  "Input Array Round": i32 = 3
  "input array length": i32 = 72
  "packet byte size": i32 = 72
  "padding byte size": i32 = 1
  "Host input": u8[]
  "Decoder Reference Output": u8[]
  "write to FPGA": bool
  "process": bool
  "stop": bool
  "FPGA Decoder output": u8[]
  "Tab": i32
panel indicators:
  "host input size(s)": i32
  "Decoder Refernce size": i32
  "debug host padded array": u8[]
  "Decoder Reference (with padding Byte)": u8[]
  "loop iteration": i32
  "valid in": i16
  "process in": i16
  "process out": i16
  "Graph": u8[][]
  "FPGA Decoder output size": i32
  "debug host input size": i32
  "packed Byte size (with padding)": i32
uses:
  ::USRP::Interactive::Decoder_Test_Wrapper.gcdl
diagram:
  call "Generate_Byte_Array.gvi"(Input Array Round=$"Input Array Round", input array length=$"input array length", random?=$"random?") -> (Array in=w1)
  $"Host input" <- w1
  Array Size(array=w1) -> (size(s)=w2)
  $"host input size(s)" <- w2
  Build Array($"Host input", $"Decoder Reference Output", $"FPGA Decoder output") -> w3
  $Graph <- w3
  $"debug host input size" <- w2
  call "Encoder_Reference.gvi"(Byte Array in=w1, padding byte size=$"padding byte size", packet byte size=$"packet byte size") -> (Host Mapper output=w4, debug padded array=w5)
  $"debug host padded array" <- w5
  Array Size(array=w5) -> (size(s)=w6)
  call "Decoder_Reference.gvi"(Mapped code=w4, code word length (bit)=w6, packet byte size=$"packet byte size", padding byte size=$"padding byte size") -> (coded bytes (with padding Byte)=w7, Decoder Reference Output=w8, Decoder Refernce size=w9)
  $"Decoder Reference (with padding Byte)" <- w7
  Array Size(array=w5) -> (size(s)=w10)
  $"packed Byte size (with padding)" <- w10
  $"Decoder Reference Output" <- w8
  $"Decoder Refernce size" <- w9
  while (iteration -> i1) {
    Boolean To Integer(Boolean=$process) -> (0, 1=w12)
    $"process in" <- w12
    call "fifo simulator_u32.gvi"(ready for output=$"write to FPGA", Array=w4) -> (element=w13, valid=w14)
    Boolean To Integer(Boolean=w14) -> (0, 1=w15)
    $"valid in" <- w15
    call "Decoder_Test_Wrapper.gcdl"(data=w13, input valid=w14, ready for output=$process) -> (outputvalid=w16, decoded Byte=w17)
    Boolean To Integer(Boolean=w16) -> (0, 1=w18)
    $"process out" <- w18
    Wait(time to wait=10)
    $"loop iteration" <- i1
    append w17 to w11 if w16
    stop if $stop
  }
  $"FPGA Decoder output" <- w11
  Array Size(array=w11) -> (size(s)=w19)
  $"FPGA Decoder output size" <- w19
