vi "Encoder+QAM test.gvi"   [LabVIEW Communications System Design Suite 2.0.1]
panel controls:
  "QAM_order": "QAM-Order.gtype" = "4-QAM"
  "max samples out": u32
  "GFDM parameter": "GFDM parameter.gtype" = {"Variable: K"=64, "Variable: M"=9, "Variable: a"=0, "filter type"="rc", "receive filter"="ZF", "inverse FFT"=FALSE, "Variable: b"=0, "Ncs"=16, "Ncp"=32}
  "PayloadSize [Byte]": u16 = 9
  "RM:No DC": bool = TRUE
panel indicators:
  "DataOut": CFXP(2.14)[]
  "DataIn": u8[]
  "sizeDataOut": i32
  "sizeDataIn": i32
  "number of samples out": u32
  "Graph": CFXP(2.14)[]
  "loop iteration": i32
  "decodedByteOut": u8[]
  "sizeDecodedbyteOut": i32
  "Graph_2": UFXP(2.0)[][]
types:
  "QAM-Order.gtype" = enum{"4-QAM", "16-QAM", "64-QAM", "256-QAM"}
  "GFDM parameter.gtype" = cluster{"Variable: K": i32, "Variable: M": i32, "Variable: a": f64, "filter type": enum{"rc", "rect"}, "receive filter": enum{"MF", "ZF"}, "inverse FFT": bool, "Variable: b": f64, "Ncs": u16, "Ncp": u16}
uses:
  ::USRP::Interactive::Encoder_and_QAM_TestWrapper.gcdl
diagram:
  w1 = $QAM_order
  w2 = $"PayloadSize [Byte]"
  while (iteration -> i1) {
    Is Greater(x=i1, y=5) -> w8
    for (N = 8) {
      Random Number() -> (number (0 to 1)=w10)
      Is Greater(x=0.5, y=w10) -> w11
      append w11 to w9
    }
    Boolean Array To Number(Boolean array=w9) -> (number=w12: u8)
    call "Encoder_and_QAM_TestWrapper.gcdl"(dataIn=w12, dataValidIn=w8, packet length (Byte)=w2, QAM_order=w1) -> (output valid=w13, complex symbol out=w14, decodedByte=w15, decodedByteValid=w16, U2 Demap Mod Sym=w17, U2demapModValid=w18, debug encoded U2=w19, debug Encoder output vaild=w20)
    call "collect n samples.gvi"(loop iteration=i1, max samples=$"max samples out", increment=w16) -> (number of samples out=w21, stop=w22)
    $"number of samples out" <- w21
    $"loop iteration" <- i1
    append w12 to w3 if w8
    append w14 to w4 if w13
    append w15 to w5 if w16
    append w17 to w6 if w18
    append w19 to w7 if w20
    stop if w22
  }
  $Graph <- w4
  $DataOut <- w4
  Array Size(array=w4) -> (size(s)=w23)
  $sizeDataOut <- w23
  $decodedByteOut <- w5
  Increment(x=w1) -> w24
  Multiply(2, w24) -> w25
  call "getResourceMap.gvi"(RM:No DC=$"RM:No DC", GFDM parameter=$"GFDM parameter", Use Phase Tracking=TRUE, PayloadSize [Byte]=w2, bits per symbol=w25)
  Array Size(array=w5) -> (size(s)=w26)
  $sizeDecodedbyteOut <- w26
  Build Array(w6, w7) -> w27
  $Graph_2 <- w27
  $DataIn <- w3
  Array Size(array=w3) -> (size(s)=w28)
  $sizeDataIn <- w28
