vi "Encoder_test.gvi"   [LabVIEW Communications System Design Suite 2.0.1]
inputs:
  "random?": bool
panel controls:
  "write to FPGA": bool
  "process": bool
  "Input Array Round": i32 = 3
  "input array length": i32 = 72
  "packet byte size": u32 = 72
  "stop": bool
  "QAM_order": "QAM-Order.gtype" = "4-QAM"
panel indicators:
  "loop iteration": i32
  "valid in": i16
  "process in": i16
  "mapper compair": bool[]
  "Mapper Error Byte": i32
  "process out": i16
  "encode comair": bool[]
  "fpga encoder output": UFXP(2.0)[]
  "Host Encoder output": UFXP(2.0)[]
  "fpga mapper output": u32[]
  "Host Mapper output": u32[]
  "Mapper output Graph": u32[][]
  "padding byte size(constant )": i32
  "Encoder Error": i32
types:
  "QAM-Order.gtype" = enum{"4-QAM", "16-QAM", "64-QAM", "256-QAM"}
uses:
  ::USRP::Interactive::Encoder_Test_Wrapper.gcdl
diagram:
  call "Generate_Byte_Array.gvi"(Input Array Round=$"Input Array Round", input array length=$"input array length", random?=$"random?") -> (Array in=w1)
  w2 = $"packet byte size"
  w3 = $QAM_order
  while (iteration -> i1) {
    Boolean To Integer(Boolean=$process) -> (0, 1=w6)
    $"process in" <- w6
    call "fifo simulator_8.gvi"(ready for output=$"write to FPGA", Array=w1) -> (element=w7, valid=w8)
    Boolean To Integer(Boolean=w8) -> (0, 1=w9)
    $"valid in" <- w9
    call "Encoder_Test_Wrapper.gcdl"(data=w7, input valid=w8, packet length (Byte)=w2, ready for output=$process, QAM_order=w3) -> (debug Encoder output vaild=w10, debug encoded U2=w11, output valid=w12, QPSK Sym out=w13)
    Boolean To Integer(Boolean=w12) -> (0, 1=w14)
    $"process out" <- w14
    Wait(time to wait=10)
    $"loop iteration" <- i1
    append w13 to w4 if w12
    append w11 to w5 if w10
    stop if $stop
  }
  $"fpga mapper output" <- w4
  call "Encoder_Reference.gvi"(Byte Array in=w1, padding byte size=1, packet byte size=w2) -> (Host Mapper output=w15, Host Encoder output=w16)
  Is Equal(x=w4, y=w15) -> w17
  $"mapper compair" <- w17
  $"Host Mapper output" <- w15
  Build Array(w4, w15) -> w18
  $"Mapper output Graph" <- w18
  Feedback Node(initial value=0, input=w19) -> w20
  s1 = w20  # shift register
  for {
    w21 = each element of w17
    Increment(x=s1) -> w22
    Select(s=w21, t=s1, f=w22) -> w23
    next s1 = w23
  }
  w19 = s1
  $"Mapper Error Byte" <- w19
  $"fpga encoder output" <- w5
  Is Equal(x=w5, y=w16) -> w24
  $"encode comair" <- w24
  $"padding byte size(constant )" <- 1
  $"Host Encoder output" <- w16
  Feedback Node(initial value=0, input=w25) -> w26
  s2 = w26  # shift register
  for {
    w27 = each element of w24
    Increment(x=s2) -> w28
    Select(s=w27, t=s2, f=w28) -> w29
    next s2 = w29
  }
  w25 = s2
  $"Encoder Error" <- w25
