vi "Test_CalculateThreshold.gvi"   [LabVIEW Communications System Design Suite 2.0.1]
panel controls:
  "GFDM Configuration cluster": T1 = {"Preamble mu"=1, "GFDM B"=2, "Preamble K"=64, "Preamble Ncp"=32, "GFDM Ncp"=32, "GFDM M"=3, "Preamble Ncs"=16, "GFDM K"=64, "GFDM Ncs"=16, "Preamble M"=2}
  "debug metric in": UFXP(2.16)[] = [0, 0, 0, 0, 0, 0, 0, 0, 0, 0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]
  "scale_window (x)": u16 = 4
  "scale_threshold (/)": i16 = 2
  "min_threshold": f64 = 0.1
panel indicators:
  "metric before and after calc thr (delay)": UFXP(2.16)[][]
  "metric_out and threshold": FXP(16.16)[][]
  "metric_ref_file": f64[]
  "metric_in, threshold and sync peaks": UFXP(2.16)[][]
  "metric out and sync 1st version": FXP(16.16)[][]
types:
  T1 = cluster{"Preamble mu": u16, "GFDM B": u16, "Preamble K": u16, "Preamble Ncp": u16, "GFDM Ncp": u16, "GFDM M": u16, "Preamble Ncs": u16, "GFDM K": u16, "GFDM Ncs": u16, "Preamble M": u16}
uses:
  ::USRP::Interactive::CalculateThreshold.gcdl
  ::USRP::Interactive::PeakFindingAlgorithm_adapt.gcdl
  ::USRP::Interactive::PeakFindingAlgorithm_1ver.gcdl
diagram:
  w1 = path "C:\\git\\IPP16_SISO_PHY\\demos\\StreamingSyncWIFI_120MHz\\USRP RIO 120 MHz BW Single-Device Streaming\\Data\\product_metric.txt"
  call "ImportTxtFileToComplex_Signal.gvi"(file path=w1) -> (metric=w2)
  Divide(x=w2, y=4) -> w3
  $metric_ref_file <- w3
  w4 = $"scale_window (x)"
  w5 = $"scale_threshold (/)"
  w6 = $"GFDM Configuration cluster"
  w7 = $min_threshold
  for (after w3) {
    w8 = each element of $"debug metric in"
    call "CalculateThreshold.gcdl"(GFDM Configuration cluster=w6, scale_factor=w4, Metric in=w8, MetricValidIn=TRUE, Crosscor in=0, scale_threshold=w5, min_threshold=w7) -> (MetricValidOut=w19, Metric Out=w20, Threshold=w21)
    call "PeakFindingAlgorithm_adapt.gcdl"(dataIn=w20, dataValidIn=w19, peakThreshold=w21, GFDM configuration cluster=w6) -> (synchronizationFound=w22, metricPeakValue=w23)
    call "PeakFindingAlgorithm_1ver.gcdl"(dataIn=w20, dataValidIn=w19, peakThreshold=w21) -> (synchronizationFound=w24, metric out=w25)
    append w20 to w9 if w19
    append w21 to w10 if w19
    append w8 to w11
    append w23 to w12
    append w22 to w13
    append w20 to w14
    append w21 to w15
    append w23 to w16
    append w24 to w17
    append w25 to w18
  }
  Build Array(w11, w9) -> w26
  $"metric before and after calc thr (delay)" <- w26
  Boolean To Integer(Boolean=w13) -> (0, 1=w27)
  Build Array(w9, w10, w12, w27) -> w28
  $"metric_out and threshold" <- w28
  Build Array(w14, w15, w16) -> w29
  $"metric_in, threshold and sync peaks" <- w29
  Boolean To Integer(Boolean=w17) -> (0, 1=w30)
  Build Array(w30, w18) -> w31
  $"metric out and sync 1st version" <- w31
