vi "Test for Counter.gvi"   [LabVIEW Communications System Design Suite 2.0.1]
panel controls:
  "countUpTo": u32
panel indicators:
  "Chart": u32[]
uses:
  ::USRP::Interactive::Counter.gcdl
diagram:
  w1 = [0, 0, 0, 0, 4294967295, 4294967295, 4294967295, 0, 0, 0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]
  for {
    w2 = each element of w1
    Number To Boolean Array(number=w2) -> (Boolean array=w3)
  }
  w4 = [FALSE, TRUE, TRUE, TRUE, TRUE, TRUE, TRUE, TRUE, TRUE, TRUE, TRUE, TRUE, TRUE, TRUE, TRUE, TRUE, TRUE, TRUE, TRUE, TRUE, TRUE, TRUE, TRUE, TRUE, TRUE, TRUE]
  w5 = [FALSE, TRUE, FALSE, FALSE, TRUE, FALSE, FALSE, FALSE, FALSE, TRUE, FALSE, FALSE, FALSE, FALSE, TRUE, FALSE, FALSE, TRUE, FALSE, FALSE, FALSE, FALSE, TRUE, FALSE, FALSE, FALSE]
  w6 = $countUpTo
  for {
    w7 = each element of w4
    w8 = each element of w5
    call "Counter.gcdl"(increment=w7, countUpTo=w6, reset=w8) -> (countOut=w10)
    append w10 to w9
  }
  $Chart <- w9
