vi "SyncDebug.gvi"   [LabVIEW Communications System Design Suite 2.0.1]
inputs:
  "reference in": any
  "Error": error
  "stoOffset": i32
  "referencePreambleIn": c128[]
  "Plot 1": string = "Data block (real)"
  "Plot 2": string = "Sync indication"
  "Plot 3": string = "Preamble valid"
  "Plot 4": string = "GFDM symbol valid"
  "Plot 5": string = "Metric"
  "Plot 6": string = "Sync threshold"
  "Plot 7": string = "PI control error"
  "Plot 8": string = "Estimated FFO"
outputs:
  "Graph of sync metric": f64[][]
  "Graph of sync data and signals": f64[][]
  "Capture 01": bool
  "preambleNmse": f64
  "Graph of FFO": f64[][]
  "Graph of preambles": f64[][]
  "StoErrorInSamples": i32
  "Graph of Rxy": f64[][]
  "Histogram of STO errors": T1
  "FFO PI control error": f64
  "Capture 02": bool
  "Estimated FFO": f64
  "Capture 03": bool
  "est ch": f64[][]
panel indicators:
  "Graph preambles": f64[][]
types:
  T1 = cluster{"x values": f64[], "histogram h(x)": f64[]}
uses:
  NI::Analysis::Operations::1D Cross Correlation (CDB).gvi
  NI::Analysis::Transforms::Complex FFT.gvi
  NI::Analysis::Transforms::Inverse Complex FFT.gvi
diagram:
  call "fpga_cast.gvi"(ref in=$"reference in") -> (ref out=w1)
  # FIFO debug.sync.dataAndSignals
  Host Fifo Read Node[FifoName="DebugSyncResources.grsc\\debug.sync.dataAndSignals"](error in=$Error, number of elements=0, reference in=w1, timeout (ms)=-1) -> (elements remaining=w2, error out=w3, reference out=w4)
  Is Greater Or Equal(x=w2, y=4095) -> w5
  Feedback Node(input=w6) -> w7
  case (w5) {
    frame False, Default {
      w6 = w7
    }
    frame True {
      Host Fifo Read Node[FifoName="DebugSyncResources.grsc\\debug.sync.dataAndSignals"](error in=w3, number of elements=w2, reference in=w4) -> (data=w8)
      Split Number(x=w8) -> (high(x)=w9, low(x)=w10)
      for {
        w11 = each element of w9
        Number To Boolean Array(number=w11) -> (Boolean array=w13)
        append w13 to w12
      }
      # w14: Sync
      # w15: Preamble start
      # w16: Preamble end
      # w17: Preamble valid
      # w18: GFDM symbol start
      # w19: GFDM symbol end
      # w20: GFDM symbol valid
      # 0 - Sync
      # 1 - Preamble start
      # 2 - Preamble end
      # 3 - Preamble valid
      # 4 - GFDM symbol start
      # 5 - GFDM symbol end
      # 6 - GFDM symbol valid
      Array Index(array=w12) -> (out0[_, 0]=w14, out1[_, 1]=w15, out2[_, 2]=w16, out3[_, 3]=w17, out4[_, 4]=w18, out5[_, 5]=w19, out6[_, 6]=w20)
      Boolean To Integer(Boolean=w14) -> (0, 1=w21)
      To Double Precision Float(number=w21) -> w22
      Boolean To Integer(Boolean=w15) -> (0, 1=w23)
      To Double Precision Float(number=w23) -> w24
      Boolean To Integer(Boolean=w16) -> (0, 1=w25)
      To Double Precision Float(number=w25) -> w26
      Boolean To Integer(Boolean=w17) -> (0, 1=w27)
      To Double Precision Float(number=w27) -> w28
      Boolean To Integer(Boolean=w18) -> (0, 1=w29)
      To Double Precision Float(number=w29) -> w30
      Boolean To Integer(Boolean=w19) -> (0, 1=w31)
      To Double Precision Float(number=w31) -> w32
      Boolean To Integer(Boolean=w20) -> (0, 1=w33)
      To Double Precision Float(number=w33) -> w34
      Split Number(x=w10) -> (high(x)=w35, low(x)=w36)
      # U16 to C16 <1.15>
      Reinterpret Number[RestrictToSameWordLength=True](data in=w36) -> (data out=w37: FXP(1.15)[])
      Reinterpret Number[RestrictToSameWordLength=True](data in=w35) -> (data out=w38: FXP(1.15)[])
      Real And Imaginary To Complex(x=w37, y=w38) -> w39
      To Double Precision Complex(number=w39) -> w40
      Complex To Real Imaginary(x + iy=w40) -> (x=w41, y=w42)
      Build Cluster(w22, w24, w26, w28, w30, w32, w34, w41, w42) -> w43
      case ($"Plot 1") {
        frame "Idle", Default {
          w44 = f64[] []
        }
        frame "Data block (real)" {
          Property Node(instance in=w43) -> ("Element 8"=w44)
        }
        frame "Data block (imag)" {
          Property Node(instance in=w43) -> ("Element 9"=w44)
        }
        frame "Sync indication" {
          Property Node(instance in=w43) -> ("Element 1"=w44)
        }
        frame "Preamble valid" {
          Property Node(instance in=w43) -> ("Element 4"=w44)
        }
        frame "Preamble start" {
          Property Node(instance in=w43) -> ("Element 2"=w44)
        }
        frame "Preamble end" {
          Property Node(instance in=w43) -> ("Element 3"=w44)
        }
        frame "GFDM symbol valid" {
          Property Node(instance in=w43) -> ("Element 7"=w44)
        }
        frame "GFDM symbol start" {
          Property Node(instance in=w43) -> ("Element 5"=w44)
        }
        frame "GFDM symbol end" {
          Property Node(instance in=w43) -> ("Element 6"=w44)
        }
      }
      case ($"Plot 2") {
        frame "Idle", Default {
          w45 = f64[] []
        }
        frame "Data block (real)" {
          Property Node(instance in=w43) -> ("Element 8"=w45)
        }
        frame "Data block (imag)" {
          Property Node(instance in=w43) -> ("Element 9"=w45)
        }
        frame "Sync indication" {
          Property Node(instance in=w43) -> ("Element 1"=w45)
        }
        frame "Preamble valid" {
          Property Node(instance in=w43) -> ("Element 4"=w45)
        }
        frame "Preamble start" {
          Property Node(instance in=w43) -> ("Element 2"=w45)
        }
        frame "Preamble end" {
          Property Node(instance in=w43) -> ("Element 3"=w45)
        }
        frame "GFDM symbol valid" {
          Property Node(instance in=w43) -> ("Element 7"=w45)
        }
        frame "GFDM symbol start" {
          Property Node(instance in=w43) -> ("Element 5"=w45)
        }
        frame "GFDM symbol end" {
          Property Node(instance in=w43) -> ("Element 6"=w45)
        }
      }
      case ($"Plot 3") {
        frame "Idle", Default {
          w46 = f64[] []
        }
        frame "Data block (real)" {
          Property Node(instance in=w43) -> ("Element 8"=w46)
        }
        frame "Data block (imag)" {
          Property Node(instance in=w43) -> ("Element 9"=w46)
        }
        frame "Sync indication" {
          Property Node(instance in=w43) -> ("Element 1"=w46)
        }
        frame "Preamble valid" {
          Property Node(instance in=w43) -> ("Element 4"=w46)
        }
        frame "Preamble start" {
          Property Node(instance in=w43) -> ("Element 2"=w46)
        }
        frame "Preamble end" {
          Property Node(instance in=w43) -> ("Element 3"=w46)
        }
        frame "GFDM symbol valid" {
          Property Node(instance in=w43) -> ("Element 7"=w46)
        }
        frame "GFDM symbol start" {
          Property Node(instance in=w43) -> ("Element 5"=w46)
        }
        frame "GFDM symbol end" {
          Property Node(instance in=w43) -> ("Element 6"=w46)
        }
      }
      case ($"Plot 4") {
        frame "Idle", Default {
          w47 = f64[] []
        }
        frame "Data block (real)" {
          Property Node(instance in=w43) -> ("Element 8"=w47)
        }
        frame "Data block (imag)" {
          Property Node(instance in=w43) -> ("Element 9"=w47)
        }
        frame "Sync indication" {
          Property Node(instance in=w43) -> ("Element 1"=w47)
        }
        frame "Preamble valid" {
          Property Node(instance in=w43) -> ("Element 4"=w47)
        }
        frame "Preamble start" {
          Property Node(instance in=w43) -> ("Element 2"=w47)
        }
        frame "Preamble end" {
          Property Node(instance in=w43) -> ("Element 3"=w47)
        }
        frame "GFDM symbol valid" {
          Property Node(instance in=w43) -> ("Element 7"=w47)
        }
        frame "GFDM symbol start" {
          Property Node(instance in=w43) -> ("Element 5"=w47)
        }
        frame "GFDM symbol end" {
          Property Node(instance in=w43) -> ("Element 6"=w47)
        }
      }
      Build Array(w44, w45, w46, w47) -> w48
      $"Graph of sync data and signals" <- w48
      # Ncp - 1
      Add(31, $stoOffset) -> w49
      # 2*K
      Array Subset(array=w39, index0=w49, length0=128) -> w50
      Complex To Real Imaginary(x + iy=w50) -> (x=w51, y=w52)
      To Double Precision Float(number=w51) -> w53
      To Double Precision Float(number=w52) -> w54
      # w55: Received preamble
      Real And Imaginary To Complex(x=w53, y=w54) -> w55
      # To C16 <4.12>
      To Complex Fixed Point(number=$referencePreambleIn) -> w56: CFXP(4.12)[] Saturate:ConvergentRounding
      # C16 <4.12> to C16 <1.15>
      Complex To Real Imaginary(x + iy=w56) -> (x=w57, y=w58)
      Reinterpret Number[RestrictToSameWordLength=True](data in=w57) -> (data out=w59: FXP(1.15)[])
      Reinterpret Number[RestrictToSameWordLength=True](data in=w58) -> (data out=w60: FXP(1.15)[])
      Real And Imaginary To Complex(x=w59, y=w60) -> w61
      # w62: Reference preamble
      To Double Precision Complex(number=w61) -> w62
      Build Array(w62, w55) -> w63
      Complex To Real Imaginary(x + iy=w63) -> (x=w64)
      $"Graph preambles" <- w64
      # TODO:
      # - Só funciona se
      # STO for zero
      Math Node("referencePreamble"=w62, "receivedPreamble"=w55) -> ("referencePreamble"=w65, "reference"=w66, "measured"=w67)
      ~~~
      receivedPreamble = receivedPreamble(:);
      referencePreamble = referencePreamble(:);

      % A*x = B
      % x = A\B
      x = receivedPreamble \ referencePreamble;
      normalizedPreamble = receivedPreamble * x;

      % Analysis in frequency domain
      rxPRE = fft(receivedPreamble);
      refPRE = fft(referencePreamble);

      % Calculate normalized preamble NMSE
      x = abs(rxPRE) \ abs(refPRE);
      normPRE = abs(rxPRE) * x;

      reference = abs(refPRE);
      measured = normPRE;
      ~~~
      # w68: Reference
      Complex To Real Imaginary(x + iy=w65) -> (x=w68)
      # w69: Received and normalized
      Complex To Real Imaginary(x + iy=w55) -> (x=w69)
      Build Array(w68, w69) -> w70
      $"Graph of preambles" <- w70
      To Double Precision Complex(number=w66) -> w71
      To Double Precision Complex(number=w67) -> w72
      call "NMSE.gvi"(floatingPointData=w71, fixedPointData=w72) -> (MSE measured=w73)
      $preambleNmse <- w73
      call "1D Cross Correlation (CDB).gvi"(x=w55, y=w62) -> (Rxy=w74)
      Complex To Polar(r * e^(i*theta)=w74) -> (r=w75)
      w76 = 128  # 2*K
      Initialize Array(element=0, size=w76) -> w77
      w78 = 128  # 2*K
      w79 = 32  # Ncp
      Subtract(x=w78, y=w79) -> w80
      Array Max And Min(array=w75) -> (max value=w81)
      w82 = 32  # Ncp
      Initialize Array(element=w81, size=w82) -> w83
      # w84: Region of CP
      Replace Array Subset(inArray=w77, index=w80, new=w83) -> w84
      w85 = 144  # (2*K)+Ncs
      Initialize Array(element=0, size=w85) -> w86
      w87 = 127  # (2*K)-1
      Array Max And Min(array=w75) -> (max value=w88)
      w89 = 16  # Ncs
      Initialize Array(element=w88, size=w89) -> w90
      # w91: Region of CS
      Replace Array Subset(inArray=w86, index=w87, new=w90) -> w91
      Build Array(w84, w91, w75) -> w92
      $"Graph of Rxy" <- w92
      Array Max And Min(array=w75) -> (max index(es)=w93)
      w94 = 127  # (2*K)-1
      Subtract(x=w94, y=w93) -> w95
      # w75: Rxy
      # Positive error(s)   -> CP region/area
      # Negative error(s)  -> CS region/area
      $StoErrorInSamples <- w95
      To Double Precision Float(number=w95) -> w96
      call "SyncDebugHistogram.gvi"(dataIn=w96) -> (histogram=w97)
      $"Histogram of STO errors" <- w97
      for {
        w98 = each element of w9
        Number To Boolean Array(number=w98) -> (Boolean array=w100)
        append w100 to w99
      }
      # 0 - Sync
      # 1 - Preamble start
      # 2 - Preamble end
      # 3 - Preamble valid
      # 4 - GFDM symbol start
      # 5 - GFDM symbol end
      # 6 - GFDM symbol valid
      # w101: Preamble start
      # w102: Preamble end
      # w103: Preamble valid
      Array Index(array=w99) -> (out1[_, 1]=w101, out2[_, 2]=w102, out3[_, 3]=w103)
      disable {
        frame Disabled { }
        frame Enabled {
          # w105: 1st start index
          Search 1D Array(1D array=w101, element=TRUE) -> (index of element=w105)
          # w106: 1st end index
          Search 1D Array(1D array=w102, element=TRUE) -> (index of element=w106)
          Subtract(x=w106, y=w105) -> w107
          Increment(x=w107) -> w108
          Array Subset(array=w103, index0=w105, length0=w108) -> w109
          Array Subset(array=w39, index0=w105, length0=w108) -> w110
          To Double Precision Complex(number=w110) -> w111
          call "validArray.gvi"(valid Array=w109, array in=w111) -> (array out=w112)
          Array Subset(array=w112, index0=0, length0=64) -> w113
          call "Complex FFT.gvi"(x=w113, FFT size=64) -> (FFT{x}=w114)
          Array Subset(array=w62, index0=0, length0=64) -> w115
          call "Complex FFT.gvi"(x=w115, FFT size=64) -> (FFT{x}=w116)
          Reciprocal(x=w116) -> w117
          Multiply(w117, w114) -> w118
          call "Inverse Complex FFT.gvi"(FFT{x}=w118) -> (x=w119)
          Split 1D Array(array=w119, index=32) -> (first subarray=w120, second subarray=w121)
          Subtract(x=1536, y=64) -> w122
          Initialize Array(element=0+0i, size=w122) -> w123
          Build Array[ConcatenateInputs=True](w120, w123, w121) -> w124
          call "Complex FFT.gvi"(x=w124, FFT size=1536) -> (FFT{x}=w125)
          Complex To Polar(r * e^(i*theta)=w125) -> (r=w126, theta=w127)
          Logarithm Base 10(x=w126) -> w128
          Multiply(w128, 10) -> w129
          Build Array(w129, w127) -> w104
        }
      }
      $"est ch" <- w104
      Not(x=w7) -> w6
      $"Capture 01" <- w6
    }
  }
  # debug.sync.metricAndThreshold
  Host Fifo Read Node[FifoName="DebugSyncResources.grsc\\debug.sync.metricAndThreshold"](error in=$Error, number of elements=0, reference in=w1, timeout (ms)=-1) -> (elements remaining=w130, error out=w131, reference out=w132)
  Is Greater Or Equal(x=w130, y=4095) -> w133
  Feedback Node(input=w134) -> w135
  case (w133) {
    frame False, Default {
      w134 = w135
    }
    frame True {
      Host Fifo Read Node[FifoName="DebugSyncResources.grsc\\debug.sync.metricAndThreshold"](error in=w131, number of elements=w130, reference in=w132) -> (data=w136)
      Split Number(x=w136) -> (high(x)=w137, low(x)=w138)
      Split Number(x=w137) -> (high(x)=w139, low(x)=w140)
      Reinterpret Number[RestrictToSameWordLength=True](data in=w139) -> (data out=w141: UFXP(1.15)[])
      # w142: Autocorrelation
      To Double Precision Float(number=w141) -> w142
      Reinterpret Number[RestrictToSameWordLength=True](data in=w140) -> (data out=w143: FXP(7.9)[])
      # w144: Cross-correlation
      To Double Precision Float(number=w143) -> w144
      Multiply(w141, w143) -> w145
      # w146: Metric
      To Double Precision Float(number=w145) -> w146
      Split Number(x=w138) -> (high(x)=w147, low(x)=w148)
      Reinterpret Number[RestrictToSameWordLength=True](data in=w147) -> (data out=w149: UFXP(2.14)[])
      # w150: Sync threshold
      To Double Precision Float(number=w149) -> w150
      # w151: DistanceBetweenPeaks
      To Double Precision Float(number=w148) -> w151
      Build Cluster(w142, w144, w146, w150, w151) -> w152
      case ($"Plot 5") {
        frame "Idle", Default {
          w153 = f64[] []
        }
        frame "Autocorrelation" {
          Property Node(instance in=w152) -> ("Element 1"=w153)
        }
        frame "Cross-correlation" {
          Property Node(instance in=w152) -> ("Element 2"=w153)
        }
        frame "Metric" {
          Property Node(instance in=w152) -> ("Element 3"=w153)
        }
        frame "Sync threshold" {
          Property Node(instance in=w152) -> ("Element 4"=w153)
        }
        frame "Distance between syncs" {
          Property Node(instance in=w152) -> ("Element 5"=w153)
        }
      }
      case ($"Plot 6") {
        frame "Idle", Default {
          w154 = f64[] []
        }
        frame "Autocorrelation" {
          Property Node(instance in=w152) -> ("Element 1"=w154)
        }
        frame "Cross-correlation" {
          Property Node(instance in=w152) -> ("Element 2"=w154)
        }
        frame "Metric" {
          Property Node(instance in=w152) -> ("Element 3"=w154)
        }
        frame "Sync threshold" {
          Property Node(instance in=w152) -> ("Element 4"=w154)
        }
        frame "Distance between syncs" {
          Property Node(instance in=w152) -> ("Element 5"=w154)
        }
      }
      Build Array(w153, w154) -> w155
      $"Graph of sync metric" <- w155
      Not(x=w135) -> w134
      $"Capture 02" <- w134
    }
  }
  disable {
    frame Enabled { }
    frame Disabled {
      # debug.sync.cfo
      Host Fifo Read Node[FifoName="DebugSyncResources.grsc\\debug.sync.cfo"](error in=$Error, number of elements=0, reference in=w1, timeout (ms)=-1) -> (elements remaining=w156, error out=w157, reference out=w158)
      Is Greater Or Equal(x=w156, y=4095) -> w159
      Feedback Node(input=w160) -> w161
      Feedback Node(input=w162) -> w163
      Feedback Node(input=w164) -> w165
      Feedback Node(input=w166) -> w167
      case (w159) {
        frame False, Default {
          w160 = w161
          w166 = w167
          w164 = w165
          w162 = w163
        }
        frame True {
          Host Fifo Read Node[FifoName="DebugSyncResources.grsc\\debug.sync.cfo"](error in=w157, number of elements=w156, reference in=w158) -> (data=w168)
          Split Number(x=w168) -> (high(x)=w169, low(x)=w170)
          Reinterpret Number[RestrictToSameWordLength=True](data in=w169) -> (data out=w171: FXP(2.14))
          To Double Precision Float(number=w171) -> w172
          Reinterpret Number[RestrictToSameWordLength=True](data in=w170) -> (data out=w173: FXP(1.15))
          To Double Precision Float(number=w173) -> w174
          w175 = 40000000  # Sampling frequency
          w176 = 128  # Preamble M*K
          Waveform Array Size(waveform=w172) -> (size=w177)
          Decrement(x=w177) -> w178
          Waveform Index Array(array=w172, w178) -> (out0=w179)
          Divide(x=w179, y=w176) -> w180
          # w181: Estimated FFO or PI control error in Hz
          Multiply(w180, w175) -> w181
          Waveform Array Size(waveform=w174) -> (size=w182)
          Decrement(x=w182) -> w183
          Waveform Index Array(array=w174, w183) -> (out0=w184)
          # w172: Estimated FFO or PI control error
          # w174: Estimated FFO after PI control
          Divide(x=w184, y=w176) -> w185
          # w186: Estimated FFO after PI control in Hz
          Multiply(w185, w175) -> w186
          Build Cluster(w181, w186, w172, w174) -> w187
          Property Node(instance in=w187) -> ("Element 1"=w162, "Element 2"=w164)
          case ($"Plot 7") {
            frame "Idle", Default {
              w188 = f64[] []
            }
            frame "PI control error" {
              Property Node(instance in=w187) -> ("Element 3"=w188)
            }
            frame "Estimated FFO" {
              Property Node(instance in=w187) -> ("Element 4"=w188)
            }
          }
          case ($"Plot 8") {
            frame "Idle", Default {
              w189 = f64[] []
            }
            frame "PI control error" {
              Property Node(instance in=w187) -> ("Element 3"=w189)
            }
            frame "Estimated FFO" {
              Property Node(instance in=w187) -> ("Element 4"=w189)
            }
          }
          Build Array(w188, w189) -> w166
          Not(x=w161) -> w160
          $"Capture 03" <- w160
        }
      }
      $"FFO PI control error" <- w162
      $"Estimated FFO" <- w164
      $"Graph of FFO" <- w166
    }
  }
