vi "SyncDebugFifoStart.gvi"   [LabVIEW Communications System Design Suite 2.0.1]
inputs:
  "reference in": any
  "error in_2": error
outputs:
  "reference out": any
  "error out": error
diagram:
  call "fpga_cast.gvi"(ref in=$"reference in") -> (ref out=w1)
  # DMA FIFOs for debug of
  #  synchronization block
  # debug.sync.dataAndSignals
  Host Fifo Configure Node[FifoName="DebugSyncResources.grsc\\debug.sync.dataAndSignals"](depth=4095, error in=$"error in_2", reference in=w1) -> (error out=w2, reference out=w3)
  Host Fifo Stop Node[FifoName="DebugSyncResources.grsc\\debug.sync.dataAndSignals"](error in=w2, reference in=w3) -> (error out=w4, reference out=w5)
  Host Fifo Start Node[FifoName="DebugSyncResources.grsc\\debug.sync.dataAndSignals"](error in=w4, reference in=w5) -> (error out=w6, reference out=w7)
  # debug.sync.metricAndThreshold
  Host Fifo Configure Node[FifoName="DebugSyncResources.grsc\\debug.sync.metricAndThreshold"](depth=4095, error in=w6, reference in=w7) -> (error out=w8, reference out=w9)
  Host Fifo Stop Node[FifoName="DebugSyncResources.grsc\\debug.sync.metricAndThreshold"](error in=w8, reference in=w9) -> (error out=w10, reference out=w11)
  Host Fifo Start Node[FifoName="DebugSyncResources.grsc\\debug.sync.metricAndThreshold"](error in=w10, reference in=w11) -> (error out=w12, reference out=w13)
  $"reference out" <- w13
  $"error out" <- w12
