vi "SyncDebugFifoStop.gvi"   [LabVIEW Communications System Design Suite 2.0.1]
inputs:
  "reference in": any
  "error out_2": error
outputs:
  "reference out": any
  "error in_2": error
diagram:
  call "fpga_cast.gvi"(ref in=$"reference in") -> (ref out=w1)
  # DMA FIFOs for debug of
  #  synchronization block
  Host Fifo Stop Node[FifoName="DebugSyncResources.grsc\\debug.sync.dataAndSignals"](error in=$"error out_2", reference in=w1) -> (error out=w2, reference out=w3)
  Host Fifo Stop Node[FifoName="DebugSyncResources.grsc\\debug.sync.metricAndThreshold"](error in=w2, reference in=w3) -> (error out=w4, reference out=w5)
  $"reference out" <- w5
  $"error in_2" <- w4
