vi "SyncDebugHistogram.gvi"   [LabVIEW Communications System Design Suite 2.0.1]
inputs:
  "dataIn": f64
  "error in": error
outputs:
  "histogram": T1
  "error out": error
types:
  T1 = cluster{"x values": f64[], "histogram h(x)": f64[]}
uses:
  NI::Analysis::Statistics::Histogram (single-shot)(DBL Array).gvi
diagram:
  w1 = 100  # vectorSize
  Initialize Array(element=0, size=w1) -> w2
  Feedback Node(initial value=w2, input=w3) -> w4
  Rotate 1D Array(array=w4, n=1) -> (array (last n elements first)=w5)
  Replace Array Subset(inArray=w5, index=0, new=$dataIn) -> w3
  call "Histogram (single-shot)(DBL Array).gvi"(signal=w3, number of bins=201, maximum=100, minimum=-100, error in=$"error in", output representation="percent of total") -> (histogram=w6, error out=w7)
  Property Node(instance in=w6) -> ("histogram h(x)"=w8, instance out=w9)
  Feedback Node(initial value=[0, 0, 0, 0, 0, 0, 0, 0, 0, 0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], input=w10) -> w11
  Is First Call() -> w12
  Select(s=w12, t=[0, 0, 0, 0, 0, 0, 0, 0, 0, 0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], f=w11) -> w13
  Scale By Power Of 2(n=-9, x=w13) -> w14
  Property Node(instance in=w9, "histogram h(x)"=w14) -> (instance out=w15)
  $histogram <- w15
  Is First Call() -> w16
  Select(s=w16, t=[0, 0, 0, 0, 0, 0, 0, 0, 0, 0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], f=w8) -> w17
  Negate(x=w14) -> w18
  Add(w17, w18, w13) -> w10
  $"error out" <- w7
