vi "Sync_AdaptiveWrapper.gvi"   [LabVIEW Communications System Design Suite 2.0.1]
inputs:
  "validIn": bool
  "dataIn": CFXP(4.12)
  "CFO removal": bool
  "halfPreambleVectorIn": CFXP(4.12)[64]
  "GFDM configuration cluster": T1 = {"Preamble mu"=1, "GFDM B"=3, "Preamble K"=64, "Preamble Ncp"=32, "GFDM Ncp"=32, "GFDM M"=2, "Preamble Ncs"=16, "GFDM K"=64, "GFDM Ncs"=16, "Preamble M"=2}
  "Metric peak threshold mode": bool
  "Metric peak threshold": UFXP(2.16) = 1
  "ffoPiControlCte": FXP(2.17) = 0.5
  "min_threshold": UFXP(2.16)
  "Sync_scaleThreshold": i16
  "autocorrelation_energythreshold": UFXP(8.15) = 0.100006103516
outputs:
  "metricOut": UFXP(2.16)
  "gfdmSymbolEnd": bool
  "gfdmSymbolStart": bool
  "gfdmSymbolValid": bool
  "preambleValid": bool
  "preambleEnd": bool
  "preambleStart": bool
  "SynchronizationFoundOut": bool
  "dataValidOut": bool
  "MetricThreshold": UFXP(2.16)
  "signalEnergy": UFXP(4.15)
  "metricValidOut": bool
  "dataOut": CFXP(4.12)
types:
  T1 = cluster{"Preamble mu": u16, "GFDM B": u16, "Preamble K": u16, "Preamble Ncp": u16, "GFDM Ncp": u16, "GFDM M": u16, "Preamble Ncs": u16, "GFDM K": u16, "GFDM Ncs": u16, "Preamble M": u16}
diagram:
  Complex To Real Imaginary(x + iy=$dataIn) -> (x=w1, y=w2)
  # CFX <4.12> to U32
  Reinterpret Number[RestrictToSameWordLength=True](data in=w1) -> (data out=w3)
  Reinterpret Number[RestrictToSameWordLength=True](data in=w2) -> (data out=w4)
  Join Numbers(high(x)=w4, low(x)=w3) -> w5
  call "Synchronization_K64_adaptive.gcdl"(dataIn=w5, dataValidIn=$validIn, Metric peak threshold=$"Metric peak threshold", halfPreambleVectorIn=$halfPreambleVectorIn, Metric peak threshold mode=$"Metric peak threshold mode", GFDM configuration cluster=$"GFDM configuration cluster", autocorrelation_energythreshold=$autocorrelation_energythreshold, addToMultipathThreshold=7.99996948242, CFO removal=$"CFO removal", ffoPiControlCte=$ffoPiControlCte, mimoOrSiso=FALSE, ThresholdWindowScale=1, scale_threshold=$Sync_scaleThreshold, min_threshold=$min_threshold) -> (dataOut=w6, synchronizationDebugCluster=w7, Threshold=w8, signalEnergy=w9)
  Split Number(x=w6) -> w10
  # U32 to CFX <4.12>
  Split Number(x=w10) -> (high(x)=w11, low(x)=w12)
  Reinterpret Number[RestrictToSameWordLength=True](data in=w12) -> (data out=w13: FXP(4.12))
  Reinterpret Number[RestrictToSameWordLength=True](data in=w11) -> (data out=w14: FXP(4.12))
  Real And Imaginary To Complex(x=w13, y=w14) -> w15
  $dataOut <- w15
  Property Node(instance in=w7) -> ("debug.dataOutValid"=w16, "debug.synchronizationFoundOut"=w17, "debug.preambleStart"=w18, "debug.preambleEnd"=w19, "debug.preambleValid"=w20, "debug.gfdmSymbolValid"=w21, "debug.gfdmSymbolStart"=w22, "debug.gfdmSymbolEnd"=w23, "debug.metric"=w24, "debug.metricValid"=w25)
  $dataValidOut <- w16
  $SynchronizationFoundOut <- w17
  $preambleStart <- w18
  $preambleEnd <- w19
  $preambleValid <- w20
  call "Synchronization.gcdl"()
  $gfdmSymbolValid <- w21
  $gfdmSymbolStart <- w22
  $gfdmSymbolEnd <- w23
  $metricOut <- w24
  $metricValidOut <- w25
  $MetricThreshold <- w8
  $signalEnergy <- w9
