vi "sync+equalizer_test.gvi"   [LabVIEW Communications System Design Suite 2.0.1]
panel controls:
  "Metric peak threshold": UFXP(2.16) = 1
  "Cp and Cs removal": bool = TRUE
  "GFDM configuration": T1 = {"Preamble mu"=1, "GFDM B"=1, "Preamble K"=64, "Preamble Ncp"=32, "GFDM Ncp"=32, "GFDM M"=3, "Preamble Ncs"=16, "GFDM K"=64, "GFDM Ncs"=16, "Preamble M"=2}
panel indicators:
  "overflow": bool
  "preamble": f64[][]
  "data": UFXP(6.15)[][]
  "loop iteration": i32
  "SynchronizationFoundOut": bool
  "Signal": f64[]
  "elements read": u32
  "data output": CFXP(4.12)[]
  "data input": c128[]
  "appended array": c128[]
types:
  T1 = cluster{"Preamble mu": u16, "GFDM B": u16, "Preamble K": u16, "Preamble Ncp": u16, "GFDM Ncp": u16, "GFDM M": u16, "Preamble Ncs": u16, "GFDM K": u16, "GFDM Ncs": u16, "Preamble M": u16}
  "modem_configuration.gtype" = cluster{"K-1": u16, "M-1": u8, "N-1": u16, "N": u16, "Block CP": u16, "End of frame": u16, "Nw": u16, "Modulator MUX config": u64[16], "CP start": u16[16], "Subsymbol end": u16[16], "Subsymbol start": u16[16], "K": u16, "fft_size_log2(K)": u8, "inverse_fft": bool, "Create preamble": bool, "Burstmode": bool, "Ncs": u16, "Ncp": u16, "N-Ncp": u16, "N+Ncp": u16, "N+Ncp+Ncs": u16, "Demodulator MUX config": u64[16], "M": u8, "DFT SIZE": FXP(6.0)}
  "GFDM parameter.gtype" = cluster{"Variable: K": i32, "Variable: M": i32, "Variable: a": f64, "filter type": enum{"rc", "rect"}, "receive filter": enum{"MF", "ZF"}, "inverse FFT": bool, "Variable: b": f64, "Ncs": u16, "Ncp": u16}
uses:
  ::USRP::Interactive::sync+equalizer-wrapper.gcdl
diagram:
  Property Node(instance in=$"GFDM configuration") -> ("Preamble K"=w1, "Preamble Ncp"=w2, "GFDM Ncp"=w3, "GFDM M"=w4, "Preamble Ncs"=w5, "GFDM K"=w6, "GFDM Ncs"=w7, "Preamble M"=w8, instance out=w9)
  call "ImportTxtFileToComplex_Preamble.gvi"() -> (data=w10)
  Multiply(w1, w8) -> w11
  Subtract(x=w11, y=w2) -> w12
  call "CP+CS.gvi"(data in=w10, Ncp=w2, N-Ncp=w12, Ncs=w5) -> (data out=w13)
  for (after w13) {
  }
  call "Create Noise.gvi"(length=w6) -> (output=w14)
  Multiply(w6, w4) -> w15
  for (N = w15) (iteration -> i1) {
    Divide(x=i1, y=w15) -> w17
    append w17 to w16
  }
  Subtract(x=w15, y=w3) -> w18
  call "CP+CS.gvi"(data in=w16, Ncp=w3, N-Ncp=w18, Ncs=w7) -> (data out=w19)
  Build Array[ConcatenateInputs=True](w14, w13, w19, w14, w13, w19, w14) -> w20
  Build Array[ConcatenateInputs=True](w20, w20) -> w21
  $"appended array" <- w21
  $"data input" <- w19
  Absolute Value(x=w21) -> w22
  $Signal <- w22
  Decrement(x=w4) -> w23
  Decrement(x=w6) -> w24
  Decrement(x=w15) -> w25
  call "dft_core_config.gvi"(N=w15) -> (size=w26)
  Property Node(instance in="modem_configuration.gtype" {all zero or empty}, "K-1"=w24, "M-1"=w23, "N-1"=w25, "DFT SIZE"=w26) -> (instance out=w27)
  for (N = w15) {
    call "4.12_cfx_to_u32.gvi"(input=1+0i) -> (output=w30)
    append w30 to w28
    append 1+0i to w29
  }
  Array Size(array=w21) -> (size(s)=w31)
  s1 = -3  # shift register
  while (iteration -> i2) {
    w32 = each element of w21
    Is Equal To 0(x=i2) -> w37
    Is Less(x=i2, y=w31) -> w38
    Not(x=w37) -> w39
    call "fifo simulator_32.gvi"(ready for output=w39, Array=w28, reset=w37) -> (element=w40, valid=w41)
    call "sync+equalizer-wrapper.gcdl"(Modem config=w27, GFDM configuration cluster=w9, Cp and Cs removal=$"Cp and Cs removal", Metric peak threshold=$"Metric peak threshold", Reset=w37, channel coeff valid=w41, channel coeff=w40, validIn=w38, dataIn=w32) -> (overflow=w42, DATA_VALID=w43, u32_output=w44, preamble valid=w45, preamble out=w46, SynchronizationFoundOut=w47, elements read=w48, gfdmSymbolValid=w49, dataOut=w50)
    $SynchronizationFoundOut <- w47
    $"elements read" <- w48
    $"loop iteration" <- i2
    call "detect falling edge.gvi"(in=w43) -> (out=w51)
    Boolean To Integer(Boolean=w51) -> (0, 1=w52)
    Add(w52, s1) -> w53
    Is Greater Than 0(x=s1) -> w54
    append w44 to w33 if w43
    append w46 to w34 if w45
    append w42 to w35
    append w50 to w36 if w49
    next s1 = w53
    stop if w54
  }
  w55 = "GFDM parameter.gtype" {"Variable: K"=8, "Variable: M"=3, "Variable: a"=0.5, "filter type"="rc", "receive filter"="ZF", "inverse FFT"=FALSE, "Variable: b"=0.5, "Ncs"=0, "Ncp"=0}
  Property Node(instance in=w55, "Variable: K"=w6, "Variable: M"=w4, "Ncs"=w7, "Ncp"=w3) -> (instance out=w56)
  call "Channel Equalizer reference.gvi"(input=w16, GFDM parameter=w56, channel coefficients=w29) -> (Output=w57)
  Build Array(w57, w36, w33) -> w58
  Absolute Value(x=w58) -> w59
  $data <- w59
  Build Array(w10, w34) -> w60
  Absolute Value(x=w60) -> w61
  $preamble <- w61
  Or Array Elements(Boolean array=w35) -> (logical OR=w62)
  $overflow <- w62
  $"data output" <- w36
