vi "SISO-TX test_2.gvi"   [LabVIEW Communications System Design Suite 2.0.1]
panel controls:
  "GFDM parameter": "GFDM parameter.gtype" = {"Variable: K"=64, "Variable: M"=9, "Variable: a"=0.5, "filter type"="rc", "receive filter"="ZF", "inverse FFT"=TRUE, "Variable: b"=0, "Ncs"=16, "Ncp"=32}
  "Random data?": bool
  "stop": bool
  "TX.modem.bitshift_in": i16 = 14
  "GFDM B": u16
panel indicators:
  "GFDM block": f64[][]
  "loop iteration": i32
  "symbols": CFXP(2.14)[]
  "GFDM Frame": f64[][]
  "number of samples out": u32
types:
  "GFDM parameter.gtype" = cluster{"Variable: K": i32, "Variable: M": i32, "Variable: a": f64, "filter type": enum{"rc", "rect"}, "receive filter": enum{"MF", "ZF"}, "inverse FFT": bool, "Variable: b": f64, "Ncs": u16, "Ncp": u16}
uses:
  ::USRP::Interactive::SISO-TX test wrapper.gcdl
diagram:
  w1 = $"GFDM B"
  call "GFDM generate parameter.gvi"(GFDM parameter=$"GFDM parameter", GFDM B=w1) -> (pulse shape=w2, window=w3, preamble=w4, Modem Configuration=w5, GFDM all parameters=w6)
  Property Node(instance in=w6) -> ("Modem Configuration:N"=w7)
  Multiply(w7, w1) -> w8
  call "create bytes.gvi"(Modem Configuration:N=w8, Random data?=$"Random data?") -> (input bit stream=w9)
  call "Encode+QAMmapping.gvi"(input bit stream=w9) -> (data as a vector d=w10, data as a u32 vector=w11)
  $symbols <- w10
  Property Node(instance in=w5) -> ("N+Ncp+Ncs"=w12, "Npreamble+CP+CS"=w13)
  Multiply(w1, w12) -> w14
  Add(w14, w13) -> w15
  while (iteration -> i1) (after w1) {
    Is First Call() -> w18
    Feedback Node(input=w19) -> w20
    call "fifo simulator_32.gvi"(ready for output=w20, Array=w11, reset=w18) -> (element=w21, valid=w22)
    Feedback Node(input=TRUE) -> w23
    call "fifo simulator_64.gvi"(ready for output=w23, Array=w2, reset=w18) -> (element=w24, valid=w25)
    call "fifo simulator_32.gvi"(ready for output=w23, Array=w3, reset=w18) -> (element=w26, valid=w27)
    call "fifo simulator_32.gvi"(ready for output=w23, Array=w4, reset=w18) -> (element=w28, valid=w29)
    Feedback Node[DelayCount=10](input=TRUE) -> w30
    Is First Call() -> w31
    call "SISO-TX test wrapper.gcdl"(filter valid=w25, filter=w24, data valid=w22, data=w21, TX.modem.reset_in=w31, TX.modem.bitshift_in=$"TX.modem.bitshift_in", TX.modem.configure_in=w30, TX.modem.configuration_in=w5, preamble valid=w29, preamble=w28, window valid=w27, window=w26) -> (TX.frame_out=w32, TX.modem.data valid_out=w33, TX.modem.64 bit data_out=w34, TX.modem.config done_out=w19, TX.frame valid_out=w35, CP+CS valid_out=w36, CP+CS out=w37)
    call "u32 to 2.14 CDB.gvi"(u32=w32) -> (CFX out=w38)
    call "u32 to 2.14 CDB.gvi"(u32=w37) -> (CFX out=w39)
    call "u64_to_cfx.gvi"(input=w34) -> (output=w40)
    call "collect n samples.gvi"(loop iteration=i1, max samples=w15, increment=w35) -> (number of samples out=w41, stop=w42)
    $"number of samples out" <- w41
    Logical Or(w42, $stop) -> w43
    $"loop iteration" <- i1
    append w38 to w16 if w35
    append w40 to w17 if w33
    stop if w43
  }
  call "norm CFX.gvi"(Input=w16) -> (Output=w44)
  Complex To Real Imaginary(x + iy=w44) -> (x=w45, y=w46)
  Build Array(w45, w46) -> w47
  $"GFDM Frame" <- w47
  call "norm CFX.gvi"(Input=w17) -> (Output=w48)
  call "TX reference.gvi"(data as a vector d=w10, GFDM all parameters=w6) -> (GFDM block=w49)
  call "norm CFX.gvi"(Input=w49) -> (Output=w50)
  Build Array(w48, w50) -> w51
  Absolute Value(x=w51) -> w52
  $"GFDM block" <- w52
  $stop <- FALSE
