vi "SISO-TX toplevel.gvi"   [LabVIEW Communications System Design Suite 2.0.1]
panel controls:
  "TX.configuration_in": "modem_configuration.gtype" = {"Ncs"=2, "Ncp"=2, "N-Ncp"=2, "N+Ncp"=2, "N+Ncp+Ncs"=2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}
  "TX.RM.data elements": u32 = 1
  "TX.modem.bitshift_in": i16
  "TX.configure": bool
  "TX.RM.enable": bool
  "TX.modem.reset_in": bool
panel indicators:
  "TX.reset active": bool
  "TX.config done": bool
  "TX.modem.DEBUG.cluster_out": T4
  "TX.RM.active data elements_out": u16
  "TX.RM.idle_out": bool
types:
  "modem_configuration.gtype" = cluster{"K-1": u16, "M-1": u8, "N-1": u16, "N": u16, "Npreamble+CP+CS": u16, "Npreamble": u16, "Nw": u16, "Modulator MUX config": u64[16], "K": u16, "fft_size_log2(K)": u8, "inverse_fft": bool, "Start with preamble": bool, "Burstmode": bool, "Ncs": u16, "Ncp": u16, "N-Ncp": u16, "N+Ncp": u16, "N+Ncp+Ncs": u16, "Demodulator MUX config": u64[16], "M": u8, "DFT SIZE": FXP(6.0), "Frame length": u32, "Super frame length": u32, "Ns_all_GFDM_blocks": u32, "Ns_all_preambles": u32}
  T1 = cluster{"packets in_out": u16, "samples in_out": u16, "packets out_out": u16, "samples out_out": u16, "number of invalid samples": u64, "mod first samples out": u64, "mod last samples out": u64}
  T2 = cluster{"FFT misalignment": u64, "FFT halt": u64, "FFT last sample": u64}
  T3 = cluster{"number of invalid samples": u64, "first samples out": u64, "last samples out": u64, "number of cycles": u64}
  T4 = cluster{"Element 1": T1, "Element 2": T2, "Element 3": T3}
diagram:
  w1 = "modem_configuration.gtype" {"Ncs"=2, "Ncp"=2, "N-Ncp"=2, "N+Ncp"=2, "N+Ncp+Ncs"=2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}
  Register Create(initial value=w1) -> (reference out=w2)
  clock-driven loop (clock = "Needed Resources.grsc\\200 MHz") forever {
    Register Read(reference in=w2) -> (data=w3)
    FIFO Create(data type=u32 0, depth=2049) -> (reference out=w4)
    Feedback Node(input=w5) -> w6
    FIFO Read(Control Protocol Input=w6, reference in="Needed Resources.grsc\\TX.modem.data in") -> (Control Protocol Output=w7, data=w8)
    FIFO Write(Control Protocol Input=w7, data=w8, reference in=w4) -> (Control Protocol Output=w5, reference out=w9)
    FIFO Create(data type=u32 0, depth=129) -> (reference out=w10)
    Feedback Node(input=w11) -> w12
    FIFO Read(Control Protocol Input=w12, reference in="Needed Resources.grsc\\Control Channel in") -> (Control Protocol Output=w13, data=w14)
    FIFO Write(Control Protocol Input=w13, data=w14, reference in=w10) -> (Control Protocol Output=w11, reference out=w15)
    call "SISO-TX+RM.gcdl"(TX.modem.filter fifo_in="Needed Resources.grsc\\TX.pulse shape in", resource mapper config in="Needed Resources.grsc\\Resource Map in", Resource Map Memory="Needed Resources.grsc\\Resource Map Memory", TX.RM.data elements=$"TX.RM.data elements", TX.RM.control channel in=w15, TX.RM.data in=w9, TX.RM.enable=$"TX.RM.enable", TX.configure=$"TX.configure", Preamble_in="Needed Resources.grsc\\TX.Preamble in", window_in="Needed Resources.grsc\\TX.Window in", TX.modem.bitshift_in=$"TX.modem.bitshift_in", TX.modem.reset_in=$"TX.modem.reset_in", TX.modem.configuration_in=w3) -> (TX.config done=w16, TX.modem.data valid_out=w17, TX.modem.64 bit data_out=w18, TX.modem.DEBUG.cluster_out=w19, TX.reset active=w20, TX.frame valid_out=w21, TX.frame_out=w22, TX.RM.idle_out=w23, TX.RM.active data elements_out=w24)
    FIFO Write(Control Protocol Input=w21, data=w22, reference in="Needed Resources.grsc\\TX.Debug.frame out")
    FIFO Write(Control Protocol Input=w17, data=w18, reference in="Needed Resources.grsc\\RX.Debug.Modem_64 bit samples out")
    $"TX.RM.idle_out" <- w23
    $"TX.RM.active data elements_out" <- w24
    $"TX.modem.DEBUG.cluster_out" <- w19
    $"TX.config done" <- w16
    $"TX.reset active" <- w20
  }
  clock-driven loop (clock = "40 MHz Onboard Clock") forever {
    Register Write(data=$"TX.configuration_in", reference in=w2)
  }
