vi "Test_UART_simple.gvi"   [LabVIEW Communications System Design Suite 2.0.1]
panel controls:
  "stop": bool
  "baud_count": u16
  "txData": u8
  "txData valid": bool
  "reset": bool
  "rxEnable": bool
  "reset counter": bool
panel indicators:
  "loop iteration": i32
  "txRdy": bool
  "rxData": u8
  "rxData valid": bool
  "frame error": bool
  "tx": bool
  "Digital Graph": bool[][]
  "rx": bool
uses:
  ::USRP::Interactive::UART_Simple.gcdl
diagram:
  while {
    Feedback Node(input=w1) -> w2
    call "UART_Simple.gcdl"(baud_count=$baud_count, txData=$txData, txData valid=$"txData valid", reset=$reset, rxEnable=$rxEnable, rx=w2) -> (tx=w1, rxData=w3, rxData valid=w4, txRdy=w5, frame error=w6)
    $txRdy <- w5
    $rxData <- w3
    $"rxData valid" <- w4
    $"frame error" <- w6
    $rx <- w2
    Feedback Node(input=w7) -> w8
    Build Array[ConcatenateInputs=True](w8, w1) -> w7
    Feedback Node(input=w9) -> w10
    Build Array[ConcatenateInputs=True](w10, w4) -> w9
    Build Array(w9, w7) -> w11
    $"Digital Graph" <- w11
    $tx <- w1
    Wait(time to wait=1)
    Logical Or($"reset counter", w5) -> w12
    Feedback Node(input=w13) -> w14
    Increment(x=w14) -> w15
    Select(s=w12, t=0, f=w15) -> w13
    $"loop iteration" <- w13
    stop if $stop
  }
