vi "Test_UART_wrapper_tx_rx.gvi"   [LabVIEW Communications System Design Suite 2.0.1]
panel controls:
  "baud_count": u16
  "Reset_2": bool
  "Reset_1": bool
  "txEnable_1": bool
  "rxEnable_1": bool
  "txEnable_2": bool
  "rxEnable_2": bool
  "stop": bool
  "milliseconds to wait": u32
  "input_1": string
  "input_2": string
panel indicators:
  "output_1": string
  "output_2": string
  "element": u8
  "element_2": u8
  "out 1": u8[]
  "out 2": u8[]
  "error out": error
  "In 1": u8[]
  "in 2": u8[]
  "frame error": bool
  "frame error_2": bool
uses:
  ::USRP::Interactive::Test_UART_wrapper_tx_rx.gcdl
diagram:
  String To Byte Array(encoding="UTF-8", string=$input_2) -> (unsigned byte array=w1)
  String To Byte Array(encoding="UTF-8", string=$input_1) -> (unsigned byte array=w2)
  while {
    Feedback Node(input=w3) -> w4
    Increment(x=w4) -> w3: u8
    Is Equal(x=w3, y=0) -> w5
    case (w5) {
      frame False, Default {
        w6 = 0
        w7 = FALSE
      }
      frame True {
        Feedback Node(initial value=-1, input=w8) -> w9
        Increment(x=w9) -> w10: i32
        Array Index(array=w1) -> (out0[w10]=w6)
        $element_2 <- w6
        Array Size(array=w1) -> (size(s)=w11)
        Is Less(x=w10, y=w11) -> w7
        Select(s=w7, t=w10, f=-1) -> w8
      }
    }
    Feedback Node(input=w12) -> w13
    Increment(x=w13) -> w12: u8
    Is Equal(x=w12, y=0) -> w14
    case (w14) {
      frame False, Default {
        w15 = 0
        w16 = FALSE
      }
      frame True {
        Feedback Node(initial value=-1, input=w17) -> w18
        Increment(x=w18) -> w19: i32
        Array Index(array=w2) -> (out0[w19]=w15)
        $element <- w15
        Array Size(array=w2) -> (size(s)=w20)
        Is Less(x=w19, y=w20) -> w16
        Select(s=w16, t=w19, f=-1) -> w17
      }
    }
    call "Test_UART_wrapper_tx_rx.gcdl"(tx data_1=w15, txEnable_1=$txEnable_1, input valid_1=w16, rxEnable_1=$rxEnable_1, tx data_2=w6, input valid_2=w7, Reset_1=$Reset_1, Reset_2=$Reset_2, txEnable_2=$txEnable_2, rxEnable_2=$rxEnable_2, baud_count=$baud_count) -> (rx data_1=w21, rx data_2=w22, output valid_1=w23, output valid_2=w24, frame error=w25, frame error_2=w26)
    $"frame error" <- w25
    $"frame error_2" <- w26
    Logical And(w23, not $Reset_1) -> w27
    Feedback Node(input=w28) -> w29
    case (w27) {
      frame False, Default {
        w28 = w29
      }
      frame True {
        Build Array[ConcatenateInputs=True](w29, w21) -> w28
      }
    }
    $"out 1" <- w28
    Byte Array To String(unsigned byte array=w28) -> (error out=w30, string=w31)
    $output_1 <- w31
    $"error out" <- w30
    Feedback Node(input=w32) -> w33
    case (w24) {
      frame False, Default {
        w32 = w33
      }
      frame True {
        Build Array[ConcatenateInputs=True](w33, w22) -> w32
      }
    }
    $"out 2" <- w32
    Byte Array To String(unsigned byte array=w32) -> (string=w34)
    $output_2 <- w34
    Wait(time to wait=$"milliseconds to wait")
    stop if $stop
  }
  $"In 1" <- w2
  $"in 2" <- w1
