vi "Test_UART_wrapper_tx_rx_loop.gvi"   [LabVIEW Communications System Design Suite 2.0.1]
panel controls:
  "stop": bool
  "rxEnable": bool = TRUE
  "txEnable": bool = TRUE
  "Reset": bool
  "baud_count": u16 = 256
  "milliseconds to wait": u32 = 1
panel indicators:
  "loop iteration": i32
  "Tx": bool
  "frame error": bool
  "received": i32[]
  "input array": u8[10]
  "txRdy": bool
  "rxData valid": bool
  "tx ready edge detected": bool
  "rxData valid edge": bool
  "rxData": u8
  "TxData": u8
  "element": u8
  "FIFO output valid": bool
uses:
  ::USRP::Interactive::test_UART_wrapper.gcdl
diagram:
  while (iteration -> i1) {
    Wait(time to wait=$"milliseconds to wait")
    $"loop iteration" <- i1
    Feedback Node(input=w1) -> w2
    Increment(x=w2) -> w1: u8
    Is Equal(x=w1, y=0) -> w3
    case (w3) {
      frame False, Default {
        w4 = 0
        w5 = FALSE
      }
      frame True {
        Feedback Node(initial value=-1, input=w6) -> w7
        Increment(x=w7) -> w8: i32
        Array Index(array=[240, 30, 45, 60, 75, 90, 105, 120, 135, 150]) -> (out0[w8]=w4)
        $element <- w4
        Is Less(x=w8, y=10) -> w5
        Select(s=w5, t=w8, f=-1) -> w6
      }
    }
    Feedback Node(input=w9) -> w10
    call "test_UART_wrapper.gcdl"(rxEnable=$rxEnable, Rx=w10, txEnable=$txEnable, baud_count=$baud_count, Reset=$Reset, ready for rx output=TRUE, tx data=w4, input valid=w5) -> (Tx=w9, rx data=w11, output valid=w12, frame error=w13, debug txData=w14, debug rxData=w15, debug txRdy=w16, debug rxData valid=w17, rxData valid edge=w18, txReady edge=w19, FIFO output valid=w20)
    $"FIFO output valid" <- w20
    Feedback Node(input=w21) -> w22
    case (w12) {
      frame False, Default {
        w21 = w22
      }
      frame True {
        Build Array[ConcatenateInputs=True](w22, w11) -> w21
      }
    }
    $received <- w21
    $"frame error" <- w13
    $txRdy <- w16
    $Tx <- w9
    $"tx ready edge detected" <- w19
    $"rxData valid" <- w17
    $"rxData valid edge" <- w18
    $rxData <- w15
    $TxData <- w14
    stop if $stop
  }
  $"input array" <- [240, 30, 45, 60, 75, 90, 105, 120, 135, 150]
