vi "host_Top_level_test_rx_tx.gvi"   [LabVIEW Communications System Design Suite 2.0.1]
panel controls:
  "baud_rate": u32 = 12500
  "rxEnable": bool
  "Reset": bool
  "Select in _tx port": i8
  "Stop configuration loop": bool
  "stop status loop": bool
  "stop reading RX FIFO": bool
  "txEnable": bool
  "reset_Errr counter": bool
  "reset_rx count": bool
  "reset_tx count": bool
  "STOP tx FIFO": bool
  "tx string": string
panel indicators:
  "Ready": bool
  "count Error": u32
  "count rx [Byte]": u32
  "debug rxData": u8
  "debug rxData valid": bool
  "tx FIFO output valid": bool
  "debug txRdy": bool
  "debug txData": u8
  "count tx [Bytes]": u32
  "elements remaining": u32
  "data": u8[]
  "error out": error
  "Graph": u8[]
  "frame error": bool
  "string": string
  "String_2": string
  "empty elements remaining": u32
  "Tx": bool
  "unsigned byte array": u8[]
diagram:
  FPGA Open Node[ProjectItem=":NullTarget:USRP\\-Bitfile_tx_rx\\-0003\\.lvbitx"](RIO address="RIO0", run?=TRUE) -> (error out=w1, reference out=w2)
  Host Fifo Configure Node[FifoName="Resources.grsc\\Rx to host"](depth=2048, error in=w1, reference in=w2) -> (error out=w3, reference out=w4)
  Host Fifo Start Node[FifoName="Resources.grsc\\Rx to host"](error in=w3, reference in=w4) -> (error out=w5, reference out=w6)
  Host Fifo Configure Node[FifoName="Resources.grsc\\tx from host"](depth=2048, error in=w5, reference in=w6) -> (error out=w7, reference out=w8)
  Host Fifo Start Node[FifoName="Resources.grsc\\tx from host"](error in=w7, reference in=w8) -> (error out=w9, reference out=w10)
  case (w9) {
    frame Error {
      w11 = w10
      w12 = w9
    }
    frame No Error {
      $Ready <- TRUE
      while {
        call "BaudCount.gvi"(Baud rate=$baud_rate) -> (Baud_count=w13)
        Property Node(instance in=w10, "baud_count"=w13, "rxEnable"=$rxEnable, "txEnable"=$txEnable, "Reset"=$Reset, "Select  t_x"=$"Select in _tx port", "reset_Errr counter"=$"reset_Errr counter", "reset_rx count"=$"reset_rx count", "reset_tx count"=$"reset_tx count", error in=w9) -> (error out=w14)
        Wait(time to wait=50)
        stop if $"Stop configuration loop"
      }
      while {
        Wait(time to wait=50)
        Property Node(instance in=w10, error in=w9) -> ("count Error"=w15, "count rx [Byte]"=w16, "debug rxData"=w17, "debug rxData valid"=w18, "tx FIFO output valid"=w19, "debug txRdy"=w20, "debug txData"=w21, "count tx [Bytes]"=w22, "frame error"=w23, error out=w24)
        $"count Error" <- w15
        $"count rx [Byte]" <- w16
        $"debug rxData" <- w17
        $"debug rxData valid" <- w18
        $"tx FIFO output valid" <- w19
        $"debug txRdy" <- w20
        $"debug txData" <- w21
        $"count tx [Bytes]" <- w22
        $"frame error" <- w23
        stop if $"stop status loop"
      }
      while {
        Property Node(instance in=w10) -> ("rxEnable"=w25, "Reset"=w26, instance out=w27)
        Logical And(w25, not w26) -> w28
        case (w28) {
          frame False, Default {
            w29 = w9
            w11 = w27
            w30 = ""
          }
          frame True {
            Host Fifo Read Node[FifoName="Resources.grsc\\Rx to host"](error in=w9, number of elements=120, reference in=w27) -> (data=w31, elements remaining=w32, error out=w29, reference out=w11)
            Byte Array To String(unsigned byte array=w31) -> (error out=w33, string=w34)
            case (w33) {
              frame No Error, Default {
                w30 = w34
              }
              frame Error {
                w30 = ""
              }
            }
            $String_2 <- w30
            $data <- w31
            $Graph <- w31
            $"elements remaining" <- w32
          }
        }
        Feedback Node(initial value="", input=w35) -> w36
        Concatenate Strings(w36, w30) -> w35
        $string <- w35
        stop if $"stop reading RX FIFO"
      }
      while {
        Wait(time to wait=1)
        Property Node(instance in=w10, error in=w9) -> ("txEnable"=w37, "Reset"=w38, "Tx"=w39, error out=w40, instance out=w41)
        Logical And(w37, not w38) -> w42
        case (w42) {
          frame False, Default {
            w43 = w40
          }
          frame True {
            String To Byte Array(string=$"tx string") -> (unsigned byte array=w44)
            $"unsigned byte array" <- w44
            Host Fifo Write Node[FifoName="Resources.grsc\\tx from host"](data=w44, error in=w40, reference in=w41) -> (empty elements remaining=w45, error out=w43)
            $"empty elements remaining" <- w45
          }
        }
        $Tx <- w39
        stop if $"STOP tx FIFO"
      }
      call "Multiplex Errors.gvi"(error in 1=w29, error in 2=w43) -> (error out=w46)
      call "Multiplex Errors.gvi"(error in 1=w14, error in 2=w24, error in 3=w46) -> (error out=w12)
    }
  }
  Host Fifo Stop Node[FifoName="Resources.grsc\\tx from host"](error in=w12, reference in=w11) -> (error out=w47, reference out=w48)
  Host Fifo Stop Node[FifoName="Resources.grsc\\Rx to host"](error in=w47, reference in=w48) -> (error out=w49, reference out=w50)
  FPGA Close Node(abort?=FALSE, error in=w49, reference in=w50) -> (error out=w51)
  $"error out" <- w51
