vi "UART Host.gvi"   [LabVIEW Communications System Design Suite 2.0.1]
panel controls:
  "UART.control": T1
  "D2through9": u8
  "stop": bool
  "fetchRX": bool
panel indicators:
  "UART.status": T2
  "Rx IO in": u8[]
  "RX UART Bytes": u8[]
  "num loops": i32
  "num_loops rx": i32
  "UART string": string
  "fifo out error": string  # source out indicates the source of the error.
  "UART bytes remaining": u32
types:
  T1 = cluster{"txEnable": bool, "rxEnable": bool, "Reset": bool, "baud_count": u16, "reset frame counter": bool, "reset tx counter": bool, "reset rx counter": bool}
  T2 = cluster{"debug rxData": u8, "debug txData": u8, "debug rxData valid": bool, "tx FIFO output valid": bool, "debug txRdy": bool, "count Error": u32, "count tx [Bytes]": u32, "count rx [Byte]": u32}
diagram:
  FPGA Open Node[ProjectItem=":NullTarget:USRP\\-UART\\ Only\\-0001\\.lvbitx"](RIO address="RIO0", error in=no error, run?=TRUE) -> (error out=w1, reference out=w2)
  FPGA Download Node(error in=w1, reference in=w2) -> (error out=w3, reference out=w4)
  FPGA Run Node(error in=w3, reference in=w4) -> (error out=w5, reference out=w6)
  Host Fifo Configure Node[FifoName="Resources.grsc\\T2H UART RX"](depth=10000000, error in=w5, reference in=w6) -> (error out=w7, reference out=w8)
  Host Fifo Start Node[FifoName="Resources.grsc\\T2H UART RX"](error in=w7, reference in=w8) -> (error out=w9, reference out=w10)
  Host Fifo Configure Node[FifoName="Resources.grsc\\RX.Decoder.Byte.out"](depth=100000000, error in=w9, reference in=w10) -> (error out=w11, reference out=w12)
  Host Fifo Start Node[FifoName="Resources.grsc\\RX.Decoder.Byte.out"](error in=w11, reference in=w12) -> (error out=w13, reference out=w14)
  Host Fifo Read Node[FifoName="Resources.grsc\\RX.Decoder.Byte.out"](error in=w13, number of elements=0, reference in=w14) -> (elements remaining=w15, error out=w16, reference out=w17)
  Host Fifo Read Node[FifoName="Resources.grsc\\RX.Decoder.Byte.out"](error in=w16, number of elements=w15, reference in=w17) -> (error out=w18, reference out=w19)
  call "Display Error.gvi"(type of dialog="OK message", error in=w18)
  while {
    Property Node(instance in=w19, "UART.control"=$"UART.control", "D2through9"=$D2through9, error in=w18) -> ("UART.status"=w20, error out=w21, instance out=w22)
    $"UART.status" <- w20
    Wait(time to wait=20)
    stop if $stop
  }
  Host Fifo Stop Node[FifoName="Resources.grsc\\RX.Decoder.Byte.out"](error in=w21, reference in=w22) -> (error out=w23, reference out=w24)
  Host Fifo Stop Node[FifoName="Resources.grsc\\T2H UART RX"](error in=w23, reference in=w24) -> (error out=w25, reference out=w26)
  FPGA Close Node(error in=w25, reference in=w26) -> (error out=w27)
  call "Display Error.gvi"(error in=w27)
  s1 = 0  # shift register
  while {
    case ($fetchRX) {
      frame False, Default {
        w28 = default
      }
      frame True {
        Host Fifo Read Node[FifoName="Resources.grsc\\RX.Decoder.Byte.out"](error in=w18, number of elements=0, reference in=w19) -> (elements remaining=w29, error out=w30, reference out=w31)
        Host Fifo Read Node[FifoName="Resources.grsc\\RX.Decoder.Byte.out"](error in=w30, number of elements=w29, reference in=w31) -> (error out=w32, reference out=w33)
        Host Fifo Read Node[FifoName="Resources.grsc\\RX.Decoder.Byte.out"](error in=w32, number of elements=10000, reference in=w33) -> (data=w34)
        $"Rx IO in" <- w34
        Wait(time to wait=20)
        Increment(x=s1) -> w28
        $"num loops" <- w28
      }
    }
    next s1 = w28
    stop if $stop
  }
  s2 = 0  # shift register
  while {
    Host Fifo Read Node[FifoName="Resources.grsc\\T2H UART RX"](error in=w18, number of elements=100, reference in=w19) -> (data=w35, elements remaining=w36, error out=w37)
    call "Display Error.gvi"(type of dialog="no dialog", error in=w37) -> (description=w38)
    $"fifo out error" <- w38
    Type Cast(type=string EmptyString, x=w35) -> w39
    $"UART string" <- w39
    $"RX UART Bytes" <- w35
    $"UART bytes remaining" <- w36
    Wait(time to wait=10)
    Increment(x=s2) -> w40
    $"num_loops rx" <- w40
    next s2 = w40
    stop if $stop
  }
