vi "UART toplevel.gvi"   [LabVIEW Communications System Design Suite 2.0.1]
panel controls:
  "UART.control": T1
  "UART.Clear": bool
  "D2through9": u8
panel indicators:
  "UART.status": T2
  "UART.Clear done": bool
types:
  T1 = cluster{"txEnable": bool, "rxEnable": bool, "Reset": bool, "baud_count": u16, "reset frame counter": bool, "reset tx counter": bool, "reset rx counter": bool}
  T2 = cluster{"debug rxData": u8, "debug txData": u8, "debug rxData valid": bool, "tx FIFO output valid": bool, "debug txRdy": bool, "count Error": u32, "count tx [Bytes]": u32, "count rx [Byte]": u32}
diagram:
  clock-driven loop (clock = "40 MHz Onboard Clock") forever {
    call "IO_read.gcdl"(reference in="AUX I/O 1") -> (data=w1)
    call "UART_V2.0.gcdl"(Rx=w1, control=$"UART.control", Clear FIFOs=$"UART.Clear") -> (Tx=w2, Rx FIFO=w3, tx FIFO=w4, status=w5, Clear done=w6)
    call "IO_write.gcdl"(reference in="AUX I/O 0", data=w2)
    $"UART.status" <- w5
    $"UART.Clear done" <- w6
    Feedback Node(input=w7) -> w8
    FIFO Read(Control Protocol Input=w8, reference in=w3) -> (Control Protocol Output=w9, data=w10)
    FIFO Write(Control Protocol Input=w9, data=w10, reference in=w4) -> (Control Protocol Output=w7)
    FIFO Write(Control Protocol Input=w9, data=w10, reference in="Needed Resources.grsc\\T2H UART RX")
    Boolean To Integer(Boolean=w1) -> (0, 1=w11)
    To Unsigned Byte Integer(number=w11) -> w12
    FIFO Write(Control Protocol Input=TRUE, data=w12, reference in="Resources.grsc\\RX.Decoder.Byte.out")
    Number To Boolean Array(number=$D2through9) -> (Boolean array=w13)
    Array Index(array=w13) -> (out0[_]=w14, out1[_]=w15, out2[_]=w16, out3[_]=w17, out4[_]=w18, out5[_]=w19, out6[_]=w20, out7[_]=w21)
    call "IO_write.gcdl"(reference in="AUX I/O 2", data=w14)
    call "IO_write.gcdl"(reference in="AUX I/O 3", data=w15)
    call "IO_write.gcdl"(reference in="AUX I/O 5", data=w16)
    call "IO_write.gcdl"(reference in="AUX I/O 5", data=w17)
    call "IO_write.gcdl"(reference in="AUX I/O 6", data=w18)
    call "IO_write.gcdl"(reference in="AUX I/O 7", data=w19)
    call "IO_write.gcdl"(reference in="AUX I/O 8", data=w20)
    call "IO_write.gcdl"(reference in="AUX I/O 9", data=w21)
  }
