vi "read memory test.gvi"   [LabVIEW Communications System Design Suite 2.0.1]
panel controls:
  "ready for output always true": bool = TRUE
  "length": u16 = 10
panel indicators:
  "appended array": u16[][]
  "Graph": u16[][]
types:
  "Control Signals.gtype" = cluster{"reset!": bool, "reset done?": bool, "request for config!": bool, "config done?": bool, "set active!": bool, "active?": bool}
uses:
  ::USRP::Updater Toplevel::read memory logic.gcdl
diagram:
  w1 = $length
  call "create ramp.gvi"(length=w1) -> (data in=w2)
  while (iteration -> i1) {
    Is Equal To 0(x=i1) -> w4
    Is Equal(x=i1, y=10) -> w5
    Feedback Node[DelayCount=50](input=w6) -> w7
    Property Node(instance in="Control Signals.gtype" {all zero or empty}, "reset!"=w4, "set active!"=w5, "request for config!"=w7) -> (instance out=w8)
    call "simulate random ready_for_output.gvi"(ready for output always true=$"ready for output always true") -> (ready for output_out=w9)
    call "read memory logic.gcdl"(control signals_in=w8, length=w1, increment=w9) -> (control signals_out=w10, address_out=w11, valid_out=w12)
    Feedback Node(enable?=w12, input=w11) -> w13
    Feedback Node(enable?=w12, input=w12) -> w14
    Feedback Node[DelayCount=10](input=w15) -> w16
    Property Node(instance in=w10) -> ("active?"=w6)
    call "detect falling edge.gvi"(in=w6) -> (out=w15)
    append w13 to w3 if w14
    stop if w16
  }
  Build Array(w3, w2) -> w17
  $"appended array" <- w17
  $Graph <- w17
