vi "write and read sample to memory test.gvi"   [LabVIEW Communications System Design Suite 2.0.1]
panel controls:
  "write data into m banks": bool
  "m memory banks": u8 = 2
  "ready for output always true": bool = TRUE
  "length": u16[]
panel indicators:
  "appended array": u64[][]
  "Graph": u64[][]
  "Array": u32[]
types:
  "Control Signals.gtype" = cluster{"reset!": bool, "reset done?": bool, "request for config!": bool, "config done?": bool, "set active!": bool, "active?": bool}
  "Configuration Data.gtype" = cluster{"data": u64, "data valid": bool, "length": u16, "switch bank after": u16, "address": u16, "bank": u8, "address offset": u16, "update id": u8, "start update": bool}
uses:
  ::USRP::Updater Toplevel::write and read sample to memory.gcdl
diagram:
  for (iteration -> i1) {
    w1 = each element of $length
    Select(s=$"write data into m banks", t=$"m memory banks", f=0) -> w5
    w6 = $"ready for output always true"
    call "create ramp.gvi"(length=w1) -> (data in=w7)
    Is Equal To 0(x=i1) -> w8
    while (iteration -> i2) {
      call "simulate random ready_for_output.gvi"(ready for output always true=w6) -> (ready for output_out=w12)
      Is Greater(x=i2, y=11) -> w13
      Is Equal To 0(x=i2) -> w14
      Logical And(w8, w14) -> w15
      Is Equal(x=i2, y=3) -> w16
      Feedback Node(input=w17) -> w18
      call "toggle_output.gvi"(toggle=w16, reset=w18) -> (output=w19)
      Feedback Node(input=w20) -> w21
      Property Node(instance in="Control Signals.gtype" {all zero or empty}, "reset!"=w15, "request for config!"=w19, "config done?"=w13, "set active!"=w21) -> (instance out=w22)
      Feedback Node(input=w23) -> w24
      Logical And(w12, w24) -> w25
      call "fifo simulator_32.gvi"(ready for output=w25, Array=w7, reset=w14) -> (element=w26, valid=w27)
      w28 = "Configuration Data.gtype" {"update id"=1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}
      Property Node(instance in=w28, "data"=w26, "data valid"=w27, "length"=w1, "switch bank after"=w5) -> (instance out=w29)
      call "write and read sample to memory.gcdl"(control signals_in=w22, configuration_in=w29, update id_const=1, read length=w1, read enable=TRUE, ready for output=w12) -> (control signals_out=w30, output=w31, output valid=w32, address=w33, ready for configuration_out=w34)
      Property Node(instance in=w30) -> ("config done?"=w20, "request for config!"=w17, "active?"=w35)
      Logical And(not w35, w34) -> w23
      Multiply(w1, 2) -> w36
      call "limited counter.gvi"(increment=w32, reset=w19, limit=w36) -> (stop=w37, number out=w38)
      Feedback Node(input=w37) -> w39
      append w33 to w9 if w32
      append w31 to w10 if w32
      append w38 to w11 if w32
      stop if w39
    }
    concatenate w9 onto w2
    concatenate w10 onto w3
    concatenate w11 onto w4
  }
  Build Array(w2, w3) -> w40
  Transpose 2D Array(2D array=w40) -> (transposed array=w41)
  $"appended array" <- w41
  $Graph <- w40
  $Array <- w4
