vi "write and read to 3 memories test.gvi"   [LabVIEW Communications System Design Suite 2.0.1]
panel controls:
  "length": u16 = 10
  "ready for output always true": bool = TRUE
panel indicators:
  "Graph": u16[][]
  "loop iteration": i32
uses:
  ::USRP::Interactive::write and read to 3 memories.gcdl
diagram:
  call "create ramp.gvi"(length=$length) -> (data in=w1)
  call "create random number.gvi"(length=$length) -> (array=w2)
  Initialize Array(element=1, size=$length) -> w3
  Build Array(w1, w2, w3) -> w4
  To Unsigned Quad Integer(number=w4) -> w5
  while (iteration -> i1) {
    Feedback Node(input=w10) -> w11
    call "control state machine_SIMULATION.gvi"(loop iteration=i1, control signals_out=w11) -> (control signals out=w12, configuration_out=w13)
    Feedback Node(input=w14) -> w15
    call "write configuration_SIMULATION.gvi"(ready for output_in=w15, Array_in=w5, active_in=w13) -> (configuration_out=w16)
    call "simulate random ready_for_output.gvi"(ready for output always true=$"ready for output always true") -> (ready for output_out=w17)
    call "write and read to 3 memories.gcdl"(control signals_in=w12, configuration_in=w16, length=$length, ready for output=w17, read enable=TRUE) -> (control signals_out=w10, output valid=w18, ready for configuration_out=w14, output=w19)
    Split Number(x=w19) -> (high(x)=w20, low(x)=w21)
    Split Number(x=w20) -> (high(x)=w22, low(x)=w23)
    Split Number(x=w21) -> (high(x)=w24, low(x)=w25)
    $"loop iteration" <- i1
    Is First Call() -> w26
    Multiply($length, 2) -> w27
    call "limited counter.gvi"(increment=w18, reset=w26, limit=w27) -> (stop=w28)
    append w22 to w6 if w18
    append w23 to w7 if w18
    append w24 to w8 if w18
    append w25 to w9 if w18
    stop if w28
  }
  Build Array(w6, w7, w8, w9) -> w29
  $Graph <- w29
