vi "trigger reset logic test.gvi"   [LabVIEW Communications System Design Suite 2.0.1]
panel controls:
  "reset_in": bool
  "cycles to keep in reset": i32 = 10
panel indicators:
  "reset out": i16
  "reset done": i16
uses:
  ::USRP::Modem::trigger reset logic.gcdl
diagram:
  while (iteration -> i1) {
    Wait(time to wait=100)
    To Unsigned Byte Integer(number=i1) -> w1
    call "trigger reset logic.gcdl"(reset_in=$reset_in, loop iteration=w1, cycles to keep in reset=$"cycles to keep in reset") -> (reset_out=w2, initial reset done_out=w3)
    Boolean To Integer(Boolean=w2) -> (0, 1=w4)
    $"reset out" <- w4
    Boolean To Integer(Boolean=w3) -> (0, 1=w5)
    $"reset done" <- w5
    Is Greater(x=i1, y=300) -> w6
    stop if w6
  }
