vi "write sample to memory logic test.gvi"   [LabVIEW Communications System Design Suite 2.0.1]
panel controls:
  "length": u16 = 10
  "write data into m banks": bool
  "m memory banks": u8 = 2
  "ready for output always true": bool = TRUE
panel indicators:
  "appended array": u64[][]
types:
  "Control Signals.gtype" = cluster{"reset!": bool, "reset done?": bool, "request for config!": bool, "config done?": bool, "set active!": bool, "active?": bool}
  "Configuration Data.gtype" = cluster{"data": u64, "data valid": bool, "length": u16, "switch bank after": u16, "address": u16, "bank": u8, "address offset": u16, "update id": u8, "start update": bool}
uses:
  ::FPGA::Interactive::write sample to memory logic.gcdl
diagram:
  w1 = $length
  Select(s=$"write data into m banks", t=$"m memory banks", f=0) -> w2
  w3 = $"ready for output always true"
  call "create ramp.gvi"(length=w1) -> (data in=w4)
  while (iteration -> i1) {
    Is Greater(x=i1, y=11) -> w8
    Is Equal To 0(x=i1) -> w9
    In Range And Coerce(lower limit=5, upper limit=10, x=i1) -> (In Range?=w10)
    Property Node(instance in="Control Signals.gtype" {all zero or empty}, "reset!"=w9, "request for config!"=w10, "config done?"=w8) -> (instance out=w11)
    w12 = "Configuration Data.gtype" {"update id"=1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}
    call "simulate random ready_for_output.gvi"(ready for output always true=w3) -> (ready for output_out=w13)
    Feedback Node(input=w14) -> w15
    Logical And(w13, w15) -> w16
    call "fifo simulator_32.gvi"(ready for output=w16, Array=w4, reset=w9) -> (element=w17, valid=w18)
    Property Node(instance in=w12, "data"=w17, "data valid"=w18, "length"=w1, "switch bank after"=w2) -> (instance out=w19)
    call "write sample to memory logic.gcdl"(Configuration data=w19, update id_const=1, control signals_in=w11) -> (ready for input_out=w14, control signals_out=w20, configuration data out=w21)
    Property Node(instance in=w21) -> ("data"=w22, "data valid"=w23, "address"=w24, "bank"=w25)
    Property Node(instance in=w20) -> ("config done?"=w26)
    Feedback Node[DelayCount=10](input=w26) -> w27
    append w22 to w5 if w23
    append w24 to w6 if w23
    append w25 to w7 if w23
    stop if w27
  }
  Build Array(w5, w6, w7) -> w28
  Transpose 2D Array(2D array=w28) -> (transposed array=w29)
  $"appended array" <- w29
