vi "control state machine_SIMULATION.gvi"   [LabVIEW Communications System Design Suite 2.0.1]
inputs:
  "loop iteration": i32
  "control signals_out": "Control Signals.gtype"
  "Trigger reconfiguration": bool
  "Reset": bool
outputs:
  "control signals out": "Control Signals.gtype"
  "state_out": T1
  "active_out": bool
  "configuration_out": bool
  "reset_out": bool
types:
  "Control Signals.gtype" = cluster{"reset!": bool, "reset done?": bool, "request for config!": bool, "config done?": bool, "set active!": bool, "active?": bool}
  T1 = enum{"Reset", "Request for configuration", "configuration", "set active", "active"}
diagram:
  Property Node(instance in=$"control signals_out") -> ("reset!"=w1, "reset done?"=w2, "request for config!"=w3, "active?"=w4, "config done?"=w5, "set active!"=w6, instance out=w7)
  call "detect rising edge.gvi"(in=$"Trigger reconfiguration") -> (out=w8)
  Is Equal To 0(x=$"loop iteration") -> w9
  Logical Or(w9, $Reset) -> w10
  Feedback Node(initial value="Reset", input=w11) -> w12
  Select(s=w10, t="Reset", f=w12) -> w13
  Select(s=w8, t="Request for configuration", f=w13) -> w14
  case (w14) {
    frame "Reset", Default {
      Select(s=w2, t="Request for configuration", f=w14) -> w11
      # 1. Set reset signal high
      # 2. Wait until it as propagated through the block
      # 3. Ask if reset is done
      # 4. If yes switch to configuration
      w15 = TRUE
      w16 = w1
      w17 = default
      w18 = default
      w19 = default
      w20 = TRUE
      w21 = default
      w22 = default
    }
    frame "Request for configuration" {
      # 1. Ask all blocks to be ready for configuration
      # 2. Wait until the signal has propageted
      # 3. If yes, start the configuration
      Logical And(w3, not w4) -> w23
      Select(s=w23, t="configuration", f=w14) -> w11
      w15 = default
      w16 = default
      w17 = TRUE
      w18 = default
      w19 = default
      w20 = default
      w21 = default
      w22 = default
    }
    frame "configuration" {
      Select(s=w5, t="set active", f=w14) -> w11
      # 1. Ask if config is done
      # 2. If yes go to active state
      w15 = default
      w16 = default
      w17 = default
      w18 = TRUE
      w19 = default
      w20 = default
      w21 = TRUE
      w22 = default
    }
    frame "set active" {
      Select(s=w6, t="active", f=w14) -> w11
      # Force Moduls into active state.
      w15 = default
      w16 = default
      w17 = default
      w18 = default
      w19 = TRUE
      w20 = default
      w21 = default
      w22 = default
    }
    frame "active" {
      w15 = default
      w16 = default
      w11 = w14
      w17 = default
      w18 = default
      w19 = FALSE
      w20 = default
      w21 = default
      w22 = TRUE
    }
  }
  $state_out <- w11
  Property Node(instance in=w7, "reset!"=w15, "reset done?"=w16, "request for config!"=w17, "config done?"=w18, "set active!"=w19, "active?"=FALSE) -> (instance out=w24)
  $"control signals out" <- w24
  $reset_out <- w20
  $configuration_out <- w21
  $active_out <- w22
