vi "create random number.gvi"   [LabVIEW Communications System Design Suite 2.0.1]
inputs:
  "length": u16 = 10
outputs:
  "array": u8[]
diagram:
  for (N = $length) {
    Random Number() -> (number (0 to 1)=w2)
    Multiply($length, w2) -> w3
    To Unsigned Byte Integer(number=w3) -> w4
    append w4 to w1
  }
  $array <- w1
