vi "next checksum.gvi"   [LabVIEW Communications System Design Suite 2.0.1]
inputs:
  "checksum in": u8
outputs:
  "checksum out": u8
diagram:
  while {
    Random Number() -> (number (0 to 1)=w1)
    Multiply(w1, 255) -> w2: u8
    Is Not Equal(x=w2, y=$"checksum in") -> w3
    stop if w3
  }
  $"checksum out" <- w2
