vi "reset.gvi"   [LabVIEW Communications System Design Suite 2.0.1]
inputs:
  "FPGA interface_in": "Updater FPGA reference.gtype"
  "Error_in": error
outputs:
  "FPGA.Interface_out": "Updater FPGA reference.gtype"
  "Error_out": error
types:
  T1 = cluster{"reset!": bool, "reset done?": bool, "request for config!": bool, "config done?": bool, "set active!": bool, "active?": bool}
diagram:
  Dynamic Fpga Interface Cast(reference in=$"FPGA interface_in", type="Updater FPGA reference.gtype" constant) -> (reference out=w1)
  Property Node(instance in=w1, "control signals_in"=T1 {"reset!"=TRUE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}, error in=$Error_in) -> (error out=w2, instance out=w3)
  while (iteration -> i1) {
    Wait(time to wait=1)
    Is Less Or Equal(x=1000000000, y=i1) -> w4
    Property Node(instance in=w3, error in=w2) -> ("control signals_out"=w5, error out=w6, instance out=w7)
    Property Node(instance in=w5) -> ("reset!"=w8)
    Logical Or(w8, w4) -> w9
    stop if w9
  }
  Property Node(instance in=w7, "control signals_in"=T1 {"reset done?"=TRUE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}, error in=w6) -> (error out=w10, instance out=w11)
  while (iteration -> i2) {
    Wait(time to wait=1)
    Is Less Or Equal(x=1000000000, y=i2) -> w12
    Property Node(instance in=w11, error in=w10) -> ("control signals_out"=w13, error out=w14, instance out=w15)
    Property Node(instance in=w13) -> ("reset done?"=w16, "reset!"=w17)
    Logical And(w16, not w17) -> w18
    Logical Or(w18, w12) -> w19
    stop if w19
  }
  Property Node(instance in=w15, "control signals_in"=T1 {all zero or empty}, error in=w14) -> (error out=w20, instance out=w21)
  $"FPGA.Interface_out" <- w21
  $Error_out <- w20
