vi "setup configuration FIFOs.gvi"   [LabVIEW Communications System Design Suite 2.0.1]
inputs:
  "FPGA interface_in": "Updater FPGA reference.gtype"
  "Error_in": error
outputs:
  "FPGA.Interface_out": "Updater FPGA reference.gtype"
  "Error_out": error
diagram:
  Dynamic Fpga Interface Cast(reference in=$"FPGA interface_in", type="Updater FPGA reference.gtype" constant) -> (reference out=w1)
  Host Fifo Configure Node[FifoName="Resources.grsc\\download"](depth=1000000, error in=$Error_in, reference in=w1) -> (error out=w2, reference out=w3)
  Host Fifo Stop Node[FifoName="Resources.grsc\\download"](error in=w2, reference in=w3) -> (error out=w4, reference out=w5)
  Host Fifo Start Node[FifoName="Resources.grsc\\download"](error in=w4, reference in=w5) -> (error out=w6, reference out=w7)
  $"FPGA.Interface_out" <- w7
  $Error_out <- w6
