vi "start configuration.gvi"   [LabVIEW Communications System Design Suite 2.0.1]
inputs:
  "FPGA interface": "Updater FPGA reference.gtype"
  "Error_in": error
  "timeout": i32
outputs:
  "Error_out": error
  "FPGA reference_out": "Updater FPGA reference.gtype"
  "time out": bool
panel indicators:
  "ready for configuration_out": bool
types:
  T1 = cluster{"reset!": bool, "reset done?": bool, "request for config!": bool, "config done?": bool, "set active!": bool, "active?": bool}
diagram:
  w1 = T1 {"request for config!"=TRUE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}
  Dynamic Fpga Interface Cast(reference in=$"FPGA interface", type="Updater FPGA reference.gtype" constant) -> (reference out=w2)
  Property Node(instance in=w2, "control signals_in"=w1, error in=$Error_in) -> (error out=w3, instance out=w4)
  # ask all blocks in the chain to enter update mode
  # wait until signal has propagated.
  # check if one block in the daisy chain is still active
  s1 = w3  # shift register
  while (iteration -> i1) {
    Wait(time to wait=1)
    # Wait until request for config signal has been
    # propagated.
    Property Node(instance in=w4, error in=s1) -> ("control signals_out"=w5, "ready for configuration_out"=w6, error out=w7, instance out=w8)
    $"ready for configuration_out" <- w6
    Is Less Or Equal(x=$timeout, y=i1) -> w9
    Property Node(instance in=w5) -> ("request for config!"=w10, "active?"=w11)
    Logical And(w10, not w11) -> w12
    call "Is Error.gvi"(error in=w7) -> (is error?=w13)
    Logical Or(w12, w13, w9) -> w14
    next s1 = w7
    stop if w14
  }
  # Already ask all blocks if config is done
  Property Node(instance in=w8, "control signals_in"=T1 {"config done?"=TRUE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}, error in=s1) -> (error out=w15, instance out=w16)
  $"FPGA reference_out" <- w16
  $Error_out <- w15
  $"time out" <- w9
