vi "stop configuration.gvi"   [LabVIEW Communications System Design Suite 2.0.1]
inputs:
  "error in": error
  "FPGA reference_in": "Updater FPGA reference.gtype"
  "time out": i32
outputs:
  "FPGA reference out": "Updater FPGA reference.gtype"
  "error out": error
  "timeout": bool[]
types:
  T1 = cluster{"reset!": bool, "reset done?": bool, "request for config!": bool, "config done?": bool, "set active!": bool, "active?": bool}
diagram:
  Dynamic Fpga Interface Cast(reference in=$"FPGA reference_in", type="Updater FPGA reference.gtype" constant) -> (reference out=w1)
  # Set config done to high
  # and wait until it has
  # rippled to the blocks
  Property Node(instance in=w1, "control signals_in"=T1 {"config done?"=TRUE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}, error in=$"error in") -> (error out=w2, instance out=w3)
  s1 = w2  # shift register
  while (iteration -> i1) {
    Wait(time to wait=1)
    Is Less Or Equal(x=$"time out", y=i1) -> w4
    Property Node(instance in=w3, error in=s1) -> ("control signals_out"=w5, error out=w6, instance out=w7)
    Property Node(instance in=w5) -> ("config done?"=w8)
    call "Is Error.gvi"(error in=w6) -> (is error?=w9)
    Logical Or(w8, w9, w4) -> w10
    next s1 = w6
    stop if w10
  }
  # force all blocks into active mode
  Property Node(instance in=w7, "control signals_in"=T1 {"set active!"=TRUE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}, error in=s1) -> (error out=w11, instance out=w12)
  s2 = w11  # shift register
  while (iteration -> i2) {
    Wait(time to wait=1)
    Is Less Or Equal(x=$"time out", y=i2) -> w13
    Property Node(instance in=w12, error in=s2) -> ("control signals_out"=w14, error out=w15, instance out=w16)
    Property Node(instance in=w14) -> ("set active!"=w17)
    call "Is Error.gvi"(error in=w15) -> (is error?=w18)
    Logical Or(w17, w18, w13) -> w19
    next s2 = w15
    stop if w19
  }
  Property Node(instance in=w16, "control signals_in"=T1 {all zero or empty}, error in=s2) -> (error out=w20, instance out=w21)
  $"FPGA reference out" <- w21
  $"error out" <- w20
  Build Array(w4, w13) -> w22
  $timeout <- w22
