vi "wait for fpga start.gvi"   [LabVIEW Communications System Design Suite 2.0.1]
inputs:
  "FPGA interface_in": "Updater FPGA reference.gtype"
  "Error_in": error
outputs:
  "FPGA.Interface_out": "Updater FPGA reference.gtype"
  "Error_out": error
types:
  T1 = cluster{"reset!": bool, "reset done?": bool, "request for config!": bool, "config done?": bool, "set active!": bool, "active?": bool}
  T2 = cluster{"data": u64, "data valid": bool, "length": u16, "switch bank after": u16, "address": u16, "bank": u8, "address offset": u16, "update id": u8, "start update": bool}
diagram:
  Dynamic Fpga Interface Cast(reference in=$"FPGA interface_in", type="Updater FPGA reference.gtype" constant) -> (reference out=w1)
  Property Node(instance in=w1, "control signals_in"=T1 {all zero or empty}, "configuration_in"=T2 {all zero or empty}, error in=$Error_in) -> (error out=w2, instance out=w3)
  while {
    Property Node(instance in=w3, error in=w2) -> ("initial reset done_out"=w4, "loop iteration"=w5, error out=w6, instance out=w7)
    Is Not Equal To 0(x=w5) -> w8
    Logical And(w4, w8) -> w9
    call "Simple Error Handler.gvi"(type of dialog="OK message + warnings", error in=w6) -> (error?=w10)
    Logical Or(w9, w10) -> w11
    Wait(time to wait=1)
    stop if w11
  }
  $"FPGA.Interface_out" <- w7
  $Error_out <- w6
