vi "write configuration_SIMULATION.gvi"   [LabVIEW Communications System Design Suite 2.0.1]
inputs:
  "ready for output_in": bool
  "Array_in": u64[][]
  "active_in": bool
  "switch bank after": u16[]
outputs:
  "configuration_out": "Configuration Data.gtype"
types:
  "Configuration Data.gtype" = cluster{"data": u64, "data valid": bool, "length": u16, "switch bank after": u16, "address": u16, "bank": u16, "address offset": u16, "update id": u8, "start update": bool}
diagram:
  call "detect rising edge.gvi"(in=$active_in) -> (out=w1)
  case ($active_in) {
    frame False, Default {
      w2 = default
    }
    frame True {
      Feedback Node(input=w3) -> w4
      Logical Or(w4, w1) -> w5
      Array Size(array=$Array_in) -> (size(s)=w6)
      Array Index(array=w6) -> (out0[_]=w7)
      Increment(x=w7) -> w8
      call "limited counter.gvi"(increment=w4, reset=w1, limit=w8) -> (number out=w9)
      Increment(x=w9) -> w10
      Array Index(array=$Array_in) -> (out0[w9, _]=w11)
      call "fifo simulator_64.gvi"(ready for output=$"ready for output_in", Array=w11, reset=w5) -> (element=w12, valid=w13)
      # write data into several memories
      # consecutively
      Array Size(array=w11) -> (size(s)=w14)
      Array Index(array=$"switch bank after") -> (out0[w9]=w15)
      w16 = "Configuration Data.gtype" {"update id"=1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}
      Property Node(instance in=w16, "data"=w12, "data valid"=w13, "length"=w14, "update id"=w10, "start update"=w5, "switch bank after"=w15) -> (instance out=w17)
      Is Greater Or Equal(x=w10, y=w8) -> w18
      Select(s=w18, t="Configuration Data.gtype" {all zero or empty}, f=w17) -> w2
      call "detect falling edge.gvi"(in=w13) -> (out=w3)
    }
  }
  $configuration_out <- w2
