vi "write_array.gvi"   [LabVIEW Communications System Design Suite 2.0.1]
inputs:
  "error in": error
  "update id": u8
  "address offset": u16
  "switch bank after": u16
  "Array": u64[]
  "FPGA reference_in": "Updater FPGA reference.gtype"
  "time out": i32
outputs:
  "FPGA reference out": "Updater FPGA reference.gtype"
  "error out": error
  "address offset out": i32
  "timeout": bool[]
types:
  "Configuration Data.gtype" = cluster{"data": u64, "data valid": bool, "length": u16, "switch bank after": u16, "address": u16, "bank": u16, "address offset": u16, "update id": u8, "start update": bool}
diagram:
  # $"switch bank after": aka K
  Array Size(array=$Array) -> (size(s)=w1)
  Property Node(instance in="Configuration Data.gtype" {all zero or empty}, "length"=w1, "switch bank after"=$"switch bank after", "address offset"=$"address offset", "update id"=$"update id", "start update"=TRUE) -> (instance out=w2)
  Property Node(instance in=$"FPGA reference_in", "configuration_in"=w2, error in=$"error in") -> (error out=w3, instance out=w4)
  s1 = w3  # shift register
  while (iteration -> i1) {
    Wait(time to wait=1)
    # wait for start -> update logic has to go in update mode
    Property Node(instance in=w4, error in=s1) -> ("ready for configuration_out"=w5, error out=w6, instance out=w7)
    Is Less Or Equal(x=$"time out", y=i1) -> w8
    call "Is Error.gvi"(error in=w6) -> (is error?=w9)
    Logical Or(w5, w9, w8) -> w10
    next s1 = w6
    stop if w10
  }
  Property Node(instance in=w2, "start update"=FALSE) -> (instance out=w11)
  Property Node(instance in=w7, "configuration_in"=w11, error in=s1) -> (error out=w12, instance out=w13)
  Host Fifo Write Node[FifoName="Updater Resources.grsc\\download"](data=$Array, error in=w12, reference in=w13) -> (error out=w14, reference out=w15)
  s2 = w14  # shift register
  while (iteration -> i2) {
    Is Less Or Equal(x=$"time out", y=i2) -> w16
    # wait until fifo data has been written
    Property Node(instance in=w15, error in=s2) -> ("ready for configuration_out"=w17, error out=w18, instance out=w19)
    Not(x=w17) -> w20
    call "Is Error.gvi"(error in=w18) -> (is error?=w21)
    Logical Or(w20, w21, w16) -> w22
    Wait(time to wait=1)
    next s2 = w18
    stop if w22
  }
  $"FPGA reference out" <- w19
  $"error out" <- s2
  Build Array(w8, w16) -> w23
  $timeout <- w23
  Add(w1, $"address offset") -> w24
  $"address offset out" <- w24
