vi "Updater Host Test.gvi"   [LabVIEW Communications System Design Suite 2.0.1]
panel controls:
  "Simulation": bool = TRUE
  "RIO address": string = "RIO0"
  "Do a update!": bool
  "stop": bool
  "length": u16 = 10
  "3 Memory version": bool
panel indicators:
  "Graph": u32[][]
  "loop iteration": i32
  "number of reads": u32
diagram:
  $"Do a update!" <- TRUE
  case ($Simulation) {
    frame False, Default {
      FPGA Open Node[ProjectItem=":NullTarget:USRP\\-Empty\\-0002\\.lvbitx"](RIO address=$"RIO address") -> (error out=w3, reference out=w4)
      FPGA Download Node(error in=w3, reference in=w4) -> (error out=w5, reference out=w6)
      FPGA Run Node(error in=w5, reference in=w6) -> (error out=w7, reference out=w8)
      FPGA Close Node(error in=w7, reference in=w8) -> (error out=w9)
      case ($"3 Memory version") {
        frame True {
          FPGA Open Node[ProjectItem=":NullTarget:USRP\\-Updater\\ 3x\\ memory\\ Toplevel\\-0003\\.lvbitx"](RIO address=$"RIO address", error in=w9, run?=FALSE) -> (error out=w10, reference out=w11)
        }
        frame False {
          FPGA Open Node[ProjectItem=":NullTarget:USRP\\-Updater\\ Toplevel\\-0016\\.lvbitx"](RIO address=$"RIO address", error in=w9, run?=FALSE) -> (error out=w10, reference out=w11)
        }
      }
      FPGA Download Node(error in=w10, reference in=w11) -> (error out=w12, reference out=w13)
      FPGA Run Node(error in=w12, reference in=w13) -> (error out=w2, reference out=w1)
    }
    frame True {
      case ($"3 Memory version") {
        frame True {
          FPGA Open Node[ProjectItem=":USRP:Updater\\ 3x\\ memory\\ Toplevel", TopVITarget=":USRP:Updater\\ 3x\\ memory\\ Toplevel:Updater\\ Toplevel\\ \\-\\ 3\\ memories\\.gvi"](RIO address=$"RIO address") -> (error out=w2, reference out=w1)
        }
        frame False {
          FPGA Open Node[ProjectItem=":USRP:Updater\\ Toplevel", TopVITarget=":USRP:Updater\\ Toplevel:Updater\\ Toplevel\\ \\-\\ single\\ memory\\.gvi"](RIO address=$"RIO address") -> (error out=w2, reference out=w1)
        }
      }
    }
  }
  sequence {
    frame 0 {
      Dynamic Fpga Interface Cast(reference in=w1, type="Updater FPGA reference.gtype" constant) -> (reference out=w14)
      call "wait for fpga start.gvi"(FPGA interface_in=w14, Error_in=w2) -> (Error_out=w15)
    }
    frame 1 {
      Host Fifo Configure Node[FifoName="Resources.grsc\\upload"](depth=1000000, error in=w15, reference in=w1) -> (error out=w16, reference out=w17)
      Host Fifo Stop Node[FifoName="Resources.grsc\\upload"](error in=w16, reference in=w17) -> (error out=w18, reference out=w19)
      Host Fifo Start Node[FifoName="Resources.grsc\\upload"](error in=w18, reference in=w19) -> (error out=w20, reference out=w21)
      Host Fifo Read Node[FifoName="Resources.grsc\\upload"](error in=w20, number of elements=0, reference in=w21) -> (elements remaining=w22, error out=w23, reference out=w24)
      Host Fifo Read Node[FifoName="Resources.grsc\\upload"](error in=w23, number of elements=w22, reference in=w24) -> (error out=w25, reference out=w26)
    }
    frame 2 {
      Dynamic Fpga Interface Cast(reference in=w26, type="Updater FPGA reference.gtype" constant) -> (reference out=w27)
      call "setup configuration FIFOs.gvi"(FPGA interface_in=w27, Error_in=w25) -> (FPGA.Interface_out=w28, Error_out=w29)
      call "reset.gvi"(FPGA interface_in=w28, Error_in=w29) -> (FPGA.Interface_out=w30, Error_out=w31)
    }
  }
  s1 = 0  # shift register
  s2 = 0  # shift register
  while {
    case ($"Do a update!") {
      frame False, Default {
        Host Fifo Read Node[FifoName="Resources.grsc\\upload"](error in=w31, number of elements=s1, reference in=w1, timeout (ms)=-1) -> (data=w36, error out=w33, reference out=w32)
        case ($"3 Memory version") {
          frame True {
            Split Number(x=w36) -> (high(x)=w38, low(x)=w39)
            Split Number(x=w38) -> (high(x)=w40, low(x)=w41)
            Split Number(x=w39) -> (high(x)=w42, low(x)=w43)
            Build Array(w40, w41, w42, w43) -> w37
          }
          frame False {
            Split Number(x=w36) -> (high(x)=w44, low(x)=w45)
            Build Array(w44, w45) -> w37
          }
        }
        $Graph <- w37
        Increment(x=s2) -> w35
        $"number of reads" <- w35
        w34 = s1
      }
      frame True {
        call "create ramp.gvi"(length=$length) -> (data in=w46)
        Property Node(instance in=w1, "length"=$length, error in=w31) -> (error out=w47, instance out=w48)
        call "start configuration.gvi"(FPGA.Interface=w30, Error_in=w47) -> (Error_out=w49, FPGA reference_out=w50)
        while {
          Host Fifo Read Node[FifoName="Resources.grsc\\upload"](number of elements=0, reference in=w48) -> (elements remaining=w51, error out=w52, reference out=w53)
          Host Fifo Read Node[FifoName="Resources.grsc\\upload"](error in=w52, number of elements=w51, reference in=w53) -> (error out=w54)
          Is Equal To 0(x=w51) -> w55
          stop if w55
        }
        Merge Errors(w49, w54) -> (error out=w56)
        call "write_array.gvi"(error in=w56, update id=1, Array=w46, FPGA reference_in=w50) -> (FPGA reference out=w57, error out=w58)
        case ($"3 Memory version") {
          frame False, Default {
            w59 = w57
            w60 = w58
          }
          frame True {
            Increment(x=w46) -> w61
            call "write_array.gvi"(error in=w58, update id=2, Array=w61, FPGA reference_in=w57) -> (FPGA reference out=w62, error out=w63)
            Increment(x=w61) -> w64
            call "write_array.gvi"(error in=w63, update id=3, Array=w64, FPGA reference_in=w62) -> (FPGA reference out=w59, error out=w60)
          }
        }
        call "stop configuration.gvi"(error in=w60, FPGA reference_in=w59) -> (FPGA reference out=w32, error out=w33)
        $"Do a update!" <- FALSE
        w34 = $length
        w35 = s2
      }
    }
    next s1 = w34
    next s2 = w35
    stop if $stop
  }
  Get Execution Mode Node(error in=w33, reference in=w32) -> (error out=w65, execution mode=w66, reference out=w67)
  case (w66) {
    frame "hardware", Default {
      FPGA Close Node(error in=w65, reference in=w67) -> (error out=w68)
    }
    frame "simulation" {
      FPGA Close Node(abort?=TRUE, error in=w65, reference in=w67) -> (error out=w68)
    }
  }
  call "Display Error.gvi"(error in=w68)
  $stop <- FALSE
  while {
    Property Node(instance in=w1, "read enable"=TRUE) -> ("loop iteration"=w69)
    $"loop iteration" <- w69
    stop if $stop
  }
