vi "Updater Toplevel - 3 memories.gvi"   [LabVIEW Communications System Design Suite 2.0.1]
inputs:
  "read enable": bool
  "length": u16
panel controls:
  "control signals_in": "Control Signals.gtype"
  "configuration_in": "Configuration Data.gtype"
panel indicators:
  "loop iteration": i32
  "ready for configuration_out": bool
  "control signals_out": "Control Signals.gtype"
  "initial reset done_out": bool
  "reset!": bool
  "reset done?": bool
  "request for config!": bool
  "config done?": bool
  "set active!": bool
  "active?": bool
  "reset!_2": bool
  "reset done?_2": bool
  "request for config!_2": bool
  "config done?_2": bool
  "set active!_2": bool
  "active?_2": bool
types:
  "Control Signals.gtype" = cluster{"reset!": bool, "reset done?": bool, "request for config!": bool, "config done?": bool, "set active!": bool, "active?": bool}
  "Configuration Data.gtype" = cluster{"data": u64, "data valid": bool, "length": u16, "switch bank after": u16, "address": u16, "bank": u16, "address offset": u16, "update id": u8, "start update": bool}
diagram:
  clock-driven loop (clock = "Updater Resources.grsc\\200 MHz") (iteration -> i1) forever {
    call "trigger reset logic.gcdl"(control signals_in=$"control signals_in", loop iteration=i1, cycles to keep in reset=10) -> (control signals_out=w1, initial reset done_out=w2)
    Property Node(instance in=w1) -> ("reset!"=w3, "reset done?"=w4, "request for config!"=w5, "config done?"=w6, "set active!"=w7, "active?"=w8)
    $"reset!" <- w3
    $"reset done?" <- w4
    $"request for config!" <- w5
    Feedback Node(input=w9) -> w10
    FIFO Read(Control Protocol Input=w10, reference in="Updater Resources.grsc\\download") -> (Control Protocol Output=w11, data=w12)
    Property Node(instance in=$configuration_in, "data"=w12, "data valid"=w11) -> (instance out=w13)
    Feedback Node(input=w14) -> w15
    call "write and read to 3 memories.gcdl"(control signals_in=w1, configuration_in=w13, length=$length, ready for output=w15, read enable=$"read enable") -> (control signals_out=w16, output valid=w17, ready for configuration_out=w9, output=w18)
    FIFO Write(Control Protocol Input=w17, data=w18, reference in="Updater Resources.grsc\\upload") -> (Control Protocol Output=w14)
    $"config done?" <- w6
    $"set active!" <- w7
    $"active?" <- w8
    $"control signals_out" <- w16
    Property Node(instance in=w16) -> ("reset!"=w19, "reset done?"=w20, "request for config!"=w21, "config done?"=w22, "set active!"=w23, "active?"=w24)
    $"reset!_2" <- w19
    $"reset done?_2" <- w20
    $"request for config!_2" <- w21
    $"config done?_2" <- w22
    $"initial reset done_out" <- w2
    $"set active!_2" <- w23
    # req_for_config_in
    $"active?_2" <- w24
    $"ready for configuration_out" <- w10
    $"loop iteration" <- i1
  }
