vi "Updater Toplevel - single memory.gvi"   [LabVIEW Communications System Design Suite 2.0.1]
inputs:
  "read enable": bool
  "length": u16
panel controls:
  "control signals_in": "Control Signals.gtype"
  "configuration_in": "Configuration Data.gtype"
panel indicators:
  "loop iteration": i32
  "ready for configuration_out": bool
  "control signals_out": "Control Signals.gtype"
  "initial reset done_out": bool
types:
  "Control Signals.gtype" = cluster{"reset!": bool, "reset done?": bool, "request for config!": bool, "config done?": bool, "set active!": bool, "active?": bool}
  "Configuration Data.gtype" = cluster{"data": u64, "data valid": bool, "length": u16, "switch bank after": u16, "address": u16, "bank": u16, "address offset": u16, "update id": u8, "start update": bool}
diagram:
  clock-driven loop (clock = "Resources.grsc\\200 MHz") (iteration -> i1) forever {
    call "trigger reset logic.gcdl"(control signals_in=$"control signals_in", loop iteration=i1, cycles to keep in reset=10) -> (control signals_out=w1, initial reset done_out=w2)
    Feedback Node(input=w3) -> w4
    FIFO Read(Control Protocol Input=w4, reference in="Resources.grsc\\download") -> (Control Protocol Output=w5, data=w6)
    Property Node(instance in=$configuration_in, "data"=w6, "data valid"=w5) -> (instance out=w7)
    Feedback Node(input=w8) -> w9
    call "write and read sample to memory.gcdl"(control signals_in=w1, configuration_in=w7, update id_const=1, read length=$length, read enable=$"read enable", ready for output=w9) -> (control signals_out=w10, output=w11, output valid=w12, address=w13, ready for configuration_out=w3)
    To Unsigned Long Integer(number=w11) -> w14
    Join Numbers(high(x)=w14, low(x)=w13) -> w15
    FIFO Write(Control Protocol Input=w12, data=w15, reference in="Resources.grsc\\upload") -> (Control Protocol Output=w8)
    $"control signals_out" <- w10
    $"initial reset done_out" <- w2
    $"ready for configuration_out" <- w4
    $"loop iteration" <- i1
  }
