vi "Decoder Toplevel.gvi"   [LabVIEW Communications System Design Suite 2.0.1]
panel controls:
  "TX.Encoder.packet length(Byte,N/8)": u32 = 72
  "TX.Encoder.Switch I and Q": bool
  "TX.Encoder.shift": i16
  "TX.Encoder.OR Mask": u16
  "Block Size(bit,N)": u32 = 576
panel indicators:
  "RX.Decoder.Debug cluster": T1
types:
  T1 = cluster{"debug bit to Byte count out": u64, "debug decoder count out": u64, "debug fifo reader count out": u64, "debug viterbi core internal counter_2": u16, "debug padding count out_2": u8, "debug vite core input count_2": u32}
diagram:
  clock-driven loop (clock = "Needed Resources.grsc\\100 MHz") forever {
    call "Reset.gcdl"() -> (reset=w1, reset counter=w2)
    call "Decoder.gcdl"(FIFO Reference in="Needed Resources.grsc\\RX.Modem to decoder", Block Size(bit,N)=$"Block Size(bit,N)", FIFO reader reset=w1, debug counter reset=w2) -> (decoded Byte=w3, outputvalid=w4, debug count out cluster=w5)
    FIFO Write(Control Protocol Input=w4, data=w3, reference in="Resources.grsc\\RX.Decoder.Byte.out")
    $"RX.Decoder.Debug cluster" <- w5
  }
  FIFO Create(data type=u32 0, depth=2049) -> (reference out=w6)
  clock-driven loop (clock = "Needed Resources.grsc\\100 MHz") forever {
    call "EncoderMapperWrapper.gcdl"(FIFO reference in="Resources.grsc\\TX.Encoder.Data in", packet length (Byte)=$"TX.Encoder.packet length(Byte,N/8)") -> (QPSK Sym out=w7, output valid=w8)
    call "Adjust data format.gcdl"(data in=w7, input valid=w8, Switch I and Q=$"TX.Encoder.Switch I and Q", shift=$"TX.Encoder.shift", bypass=$"TX.Encoder.OR Mask", L5=FALSE) -> (data out=w9, output valid=w10)
    FIFO Write(Control Protocol Input=w10, data=w9, reference in=w6)
  }
