vi "FIFO limit test toplevel.gvi"   [LabVIEW Communications System Design Suite 2.0.1]
diagram:
  clock-driven loop (clock = "Needed Resources.grsc\\100 MHz") forever {
    FIFO Read(Control Protocol Input=TRUE, reference in="Needed Resources.grsc\\RX.Debug.Test data in") -> (Control Protocol Output=w1, data=w2)
    FIFO Write(Control Protocol Input=w1, data=w2, reference in="USRP Resources.grsc\\Rx Stream 0")
    FIFO Read(Control Protocol Input=TRUE, reference in="Needed Resources.grsc\\RX.channel Coefficients in") -> (Control Protocol Output=w3, data=w4)
    FIFO Write(Control Protocol Input=w3, data=w4, reference in="USRP Resources.grsc\\Rx Stream 1")
    FIFO Read(Control Protocol Input=TRUE, reference in="Needed Resources.grsc\\TX.pulse shape in") -> (Control Protocol Output=w5, data=w6)
    FIFO Write(Control Protocol Input=w5, data=w6, reference in="Needed Resources.grsc\\RX.Preamble out")
    FIFO Read(Control Protocol Input=TRUE, reference in="Needed Resources.grsc\\TX.Window in") -> (Control Protocol Output=w7, data=w8)
    FIFO Write(Control Protocol Input=w7, data=w8, reference in="Needed Resources.grsc\\Data out")
    FIFO Read(Control Protocol Input=TRUE, reference in="Needed Resources.grsc\\RX.pulse shape in") -> (Control Protocol Output=w9, data=w10)
    FIFO Write(Control Protocol Input=w9, data=w10, reference in="Needed Resources.grsc\\TX.Debug.Encoder out")
    FIFO Read(Control Protocol Input=TRUE, reference in="Needed Resources.grsc\\TX.Preamble in") -> (Control Protocol Output=w11, data=w12)
    FIFO Write(Control Protocol Input=w11, data=w12, reference in="Resources.grsc\\TX.Debug.Modem out")
    FIFO Read(Control Protocol Input=TRUE, reference in="Needed Resources.grsc\\TX.modem.data in") -> (Control Protocol Output=w13, data=w14)
    FIFO Write(Control Protocol Input=w13, data=w14, reference in="Needed Resources.grsc\\RX.Debug.Modem_32 bit samples out")
    FIFO Read(Control Protocol Input=TRUE, reference in="Needed Resources.grsc\\AWGN") -> (Control Protocol Output=w15, data=w16)
    FIFO Write(Control Protocol Input=w15, data=w16, reference in="Resources.grsc\\RX.data out")
    FIFO Create(data type=i32 0, depth=2049) -> (reference out=w17)
    FIFO Write(Control Protocol Input=TRUE, data=0, reference in=w17) -> (Control Protocol Output=w18, reference out=w19)
    FIFO Read(Control Protocol Input=w18, reference in=w19)
    FIFO Create(data type=i32 0, depth=2049) -> (reference out=w20)
    FIFO Write(Control Protocol Input=TRUE, data=0, reference in=w20) -> (Control Protocol Output=w21, reference out=w22)
    FIFO Read(Control Protocol Input=w21, reference in=w22)
    FIFO Create(data type=i32 0, depth=2049) -> (reference out=w23)
    FIFO Write(Control Protocol Input=TRUE, data=0, reference in=w23) -> (Control Protocol Output=w24, reference out=w25)
    FIFO Read(Control Protocol Input=w24, reference in=w25)
    FIFO Create(data type=i32 0, depth=2049) -> (reference out=w26)
    FIFO Write(Control Protocol Input=TRUE, data=0, reference in=w26) -> (Control Protocol Output=w27, reference out=w28)
    FIFO Read(Control Protocol Input=w27, reference in=w28)
    FIFO Create(data type=i32 0, depth=2049) -> (reference out=w29)
    FIFO Write(Control Protocol Input=TRUE, data=0, reference in=w29) -> (Control Protocol Output=w30, reference out=w31)
    FIFO Read(Control Protocol Input=w30, reference in=w31)
    FIFO Create(data type=i32 0, depth=2049) -> (reference out=w32)
    FIFO Write(Control Protocol Input=TRUE, data=0, reference in=w32) -> (Control Protocol Output=w33, reference out=w34)
    FIFO Read(Control Protocol Input=w33, reference in=w34)
    FIFO Create(data type=i32 0, depth=2049) -> (reference out=w35)
    FIFO Write(Control Protocol Input=TRUE, data=0, reference in=w35) -> (Control Protocol Output=w36, reference out=w37)
    FIFO Read(Control Protocol Input=w36, reference in=w37)
    FIFO Create(data type=i32 0, depth=2049) -> (reference out=w38)
    FIFO Write(Control Protocol Input=TRUE, data=0, reference in=w38) -> (Control Protocol Output=w39, reference out=w40)
    FIFO Read(Control Protocol Input=w39, reference in=w40)
    FIFO Create(data type=i32 0, depth=2049) -> (reference out=w41)
    FIFO Write(Control Protocol Input=TRUE, data=0, reference in=w41) -> (Control Protocol Output=w42, reference out=w43)
    FIFO Read(Control Protocol Input=w42, reference in=w43)
    FIFO Create(data type=i32 0, depth=2049) -> (reference out=w44)
    FIFO Write(Control Protocol Input=TRUE, data=0, reference in=w44) -> (Control Protocol Output=w45, reference out=w46)
    FIFO Read(Control Protocol Input=w45, reference in=w46)
    FIFO Create(data type=i32 0, depth=2049) -> (reference out=w47)
    FIFO Write(Control Protocol Input=TRUE, data=0, reference in=w47) -> (Control Protocol Output=w48, reference out=w49)
    FIFO Read(Control Protocol Input=w48, reference in=w49)
    FIFO Create(data type=i32 0, depth=2049) -> (reference out=w50)
    FIFO Write(Control Protocol Input=TRUE, data=0, reference in=w50) -> (Control Protocol Output=w51, reference out=w52)
    FIFO Read(Control Protocol Input=w51, reference in=w52)
    FIFO Create(data type=i32 0, depth=2049) -> (reference out=w53)
    FIFO Write(Control Protocol Input=TRUE, data=0, reference in=w53) -> (Control Protocol Output=w54, reference out=w55)
    FIFO Read(Control Protocol Input=w54, reference in=w55)
    FIFO Create(data type=i32 0, depth=2049) -> (reference out=w56)
    FIFO Write(Control Protocol Input=TRUE, data=0, reference in=w56) -> (Control Protocol Output=w57, reference out=w58)
    FIFO Read(Control Protocol Input=w57, reference in=w58)
    FIFO Create(data type=i32 0, depth=2049) -> (reference out=w59)
    FIFO Write(Control Protocol Input=TRUE, data=0, reference in=w59) -> (Control Protocol Output=w60, reference out=w61)
    FIFO Read(Control Protocol Input=w60, reference in=w61)
    FIFO Create(data type=i32 0, depth=2049) -> (reference out=w62)
    FIFO Write(Control Protocol Input=TRUE, data=0, reference in=w62) -> (Control Protocol Output=w63, reference out=w64)
    FIFO Read(Control Protocol Input=w63, reference in=w64)
    FIFO Create(data type=i32 0, depth=2049) -> (reference out=w65)
    FIFO Write(Control Protocol Input=TRUE, data=0, reference in=w65) -> (Control Protocol Output=w66, reference out=w67)
    FIFO Read(Control Protocol Input=w66, reference in=w67)
    FIFO Create(data type=i32 0, depth=2049) -> (reference out=w68)
    FIFO Write(Control Protocol Input=TRUE, data=0, reference in=w68) -> (Control Protocol Output=w69, reference out=w70)
    FIFO Read(Control Protocol Input=w69, reference in=w70)
    FIFO Create(data type=i32 0, depth=2049) -> (reference out=w71)
    FIFO Write(Control Protocol Input=TRUE, data=0, reference in=w71) -> (Control Protocol Output=w72, reference out=w73)
    FIFO Read(Control Protocol Input=w72, reference in=w73)
    FIFO Create(data type=i32 0, depth=2049) -> (reference out=w74)
    FIFO Write(Control Protocol Input=TRUE, data=0, reference in=w74) -> (Control Protocol Output=w75, reference out=w76)
    FIFO Read(Control Protocol Input=w75, reference in=w76)
    FIFO Create(data type=i32 0, depth=2049) -> (reference out=w77)
    FIFO Write(Control Protocol Input=TRUE, data=0, reference in=w77) -> (Control Protocol Output=w78, reference out=w79)
    FIFO Read(Control Protocol Input=w78, reference in=w79)
    FIFO Create(data type=i32 0, depth=2049) -> (reference out=w80)
    FIFO Write(Control Protocol Input=TRUE, data=0, reference in=w80) -> (Control Protocol Output=w81, reference out=w82)
    FIFO Read(Control Protocol Input=w81, reference in=w82)
    FIFO Create(data type=i32 0, depth=2049) -> (reference out=w83)
    FIFO Write(Control Protocol Input=TRUE, data=0, reference in=w83) -> (Control Protocol Output=w84, reference out=w85)
    FIFO Read(Control Protocol Input=w84, reference in=w85)
    FIFO Create(data type=i32 0, depth=2049) -> (reference out=w86)
    FIFO Write(Control Protocol Input=TRUE, data=0, reference in=w86) -> (Control Protocol Output=w87, reference out=w88)
    FIFO Read(Control Protocol Input=w87, reference in=w88)
    FIFO Create(data type=i32 0, depth=2049) -> (reference out=w89)
    FIFO Write(Control Protocol Input=TRUE, data=0, reference in=w89) -> (Control Protocol Output=w90, reference out=w91)
    FIFO Read(Control Protocol Input=w90, reference in=w91)
    FIFO Create(data type=i32 0, depth=2049) -> (reference out=w92)
    FIFO Write(Control Protocol Input=TRUE, data=0, reference in=w92) -> (Control Protocol Output=w93, reference out=w94)
    FIFO Read(Control Protocol Input=w93, reference in=w94)
    FIFO Create(data type=i32 0, depth=2049) -> (reference out=w95)
    FIFO Write(Control Protocol Input=TRUE, data=0, reference in=w95) -> (Control Protocol Output=w96, reference out=w97)
    FIFO Read(Control Protocol Input=w96, reference in=w97)
    FIFO Create(data type=i32 0, depth=2049) -> (reference out=w98)
    FIFO Write(Control Protocol Input=TRUE, data=0, reference in=w98) -> (Control Protocol Output=w99, reference out=w100)
    FIFO Read(Control Protocol Input=w99, reference in=w100)
    FIFO Create(data type=i32 0, depth=2049) -> (reference out=w101)
    FIFO Write(Control Protocol Input=TRUE, data=0, reference in=w101) -> (Control Protocol Output=w102, reference out=w103)
    FIFO Read(Control Protocol Input=w102, reference in=w103)
    FIFO Create(data type=i32 0, depth=2049) -> (reference out=w104)
    FIFO Write(Control Protocol Input=TRUE, data=0, reference in=w104) -> (Control Protocol Output=w105, reference out=w106)
    FIFO Read(Control Protocol Input=w105, reference in=w106)
    FIFO Create(data type=i32 0, depth=2049) -> (reference out=w107)
    FIFO Write(Control Protocol Input=TRUE, data=0, reference in=w107) -> (Control Protocol Output=w108, reference out=w109)
    FIFO Read(Control Protocol Input=w108, reference in=w109)
    FIFO Create(data type=i32 0, depth=2049) -> (reference out=w110)
    FIFO Write(Control Protocol Input=TRUE, data=0, reference in=w110) -> (Control Protocol Output=w111, reference out=w112)
    FIFO Read(Control Protocol Input=w111, reference in=w112)
  }
