vi "GFDM FPGA Toplevel.gvi"   [LabVIEW Communications System Design Suite 2.0.1]
inputs:
  "RX.sync.halfPreambleVectorIn": CFXP(4.12)[64]
  "RX.sync.GFDM configuration cluster": T4 = {"Preamble mu"=1, "GFDM B"=3, "Preamble K"=128, "Preamble Ncp"=32, "GFDM Ncp"=32, "GFDM M"=5, "Preamble Ncs"=16, "GFDM K"=128, "GFDM Ncs"=16, "Preamble M"=2}
panel controls:
  "rx.reset": bool = TRUE
  "rx.samples to acquire": u32
  "rx.output sample rate": UFXP(1.47)
  "rx.delay": FXP(0.16)
  "rx 0.frequency shift": FXP(0.48)
  "rx 0.phase": FXP(0.21)
  "rx 0.impairments": T1 = {"inline gain I"=0.999992370605, "inline gain Q"=0.999992370605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}
  "rx.abort": bool
  "tx.abort": bool
  "tx.reset": bool = TRUE
  "tx.input sample rate": UFXP(1.47)
  "tx.delay": FXP(0.18)
  "tx 0.frequency shift": FXP(0.48)
  "tx 0.phase": FXP(0.21)
  "tx 0.impairments": T1 = {"inline gain I"=0.999992370605, "inline gain Q"=0.999992370605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}
  "tx.samples to generate": u32
  "tx 0.gain": T2 = {"gain I"=1, "gain Q"=1}
  "rx 1.impairments": T1 = {"inline gain I"=0.999992370605, "inline gain Q"=0.999992370605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}
  "rx 1.frequency shift": FXP(0.48)
  "rx 1.phase": FXP(0.21)
  "tx 1.impairments": T1 = {"inline gain I"=0.999992370605, "inline gain Q"=0.999992370605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}
  "tx 1.frequency shift": FXP(0.48)
  "tx 1.phase": FXP(0.21)
  "tx 1.gain": T2 = {"gain I"=1, "gain Q"=1}
  "rx 0.stream enable": bool
  "rx 1.stream enable": bool
  "tx 0.stream enable": bool
  "tx 1.stream enable": bool
  "rx.trigger select": T3 = "Immediate"
  "tx.trigger select": T3 = "Immediate"
  "rx.software trigger": bool
  "tx.software trigger": bool
  "rx.trigger enable": bool
  "tx.trigger enable": bool
  "TX.modem.configuration_in": "modem_configuration.gtype"
  "TX.modem.configure_in": bool
  "TX.modem.bitshift_in": i16
  "Reset": bool
  "Reset counter": bool
  "RX.switch channels": bool
  "RX.modem.configure_in": bool
  "RX.modem.fft.bitshift_in": i16
  "RX.modem.bitshift_in": i16
  "RX.sync.input enable_in": bool
  "TX.modem.trigger limit": u64
  "TX.encoder.enabled": bool
  "UART.control": T9
  "UART.Clear": bool
  "control signals_in": "Control Signals.gtype"
  "configuration_in": "Configuration Data.gtype"
  "N-1_in": u16
  "Data Routing": T12 = "Data from Host"
  "RX.decoder.Block Size(bit,N)": u32 = 576
  "RX.sync.config": "SyncConfig.gtype"
  "AGC.config": T16 = {"Destination"="configRx", "antenna configuration"="TX1 RX1 transmits and RX2 receives", "daughterboard"="sbx", "spi address"=7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}
  "reg.host read.go rcvd 0": bool
  "reg.notify host.go rcvd 0": bool
  "reg.reset 0": bool
  "RF 0/Rx/Enable": bool
  "RF 0/Tx/Enable": bool
  "RF 1/Rx/Enable": bool
  "RF 1/Tx/Enable": bool
  "ChEst.Parameters": "CE_configurationStameMashine.gtype"
  "ChEst.debugState": i32
  "ChEst.configDataIn": u64
  "RX.sync.preambleOutFifoActive": bool
  "TX.switchTxChannel": bool
  "TX.sync.preambleOrAllData": bool
  "AGC.disableAGC": bool
  "TX.modem.PreambleCpCsSampleIn": "CE_signalsType.gtype"
  "TX.qamOrder": "QAM-Order.gtype" = "4-QAM"
  "TX.modem.preambleInsertion.waitForSamples": bool
  "TX.payload size [Byte]": u32 = 72
  "TX.modem.input shift_in": i16
  "TX.transpose A": u16
  "TX.transpose B": u16
  "transpose AB": u16
  "RX.payloadSize [byte]": u32
  "TX.akivateRepeatiotion": bool
  "TX.frameLength": u16
  "TX.Nsleep-3 (min.2)": u32
  "RX.forward repeated crc": bool
  "RX.forward broken crc": bool
panel indicators:
  "rx.samples processed": u32
  "rx.state": enum{"Idle", "Active"}
  "rx 0.number of IQ data overflows": u64
  "rx.number of overflows": u32
  "tx.samples processed": u32
  "tx.underflows": u32
  "tx 0.number of IQ data overflows": u64
  "tx.state": enum{"Idle", "Active"}
  "rx.dsp reset done": bool
  "tx.dsp reset done": bool
  "tx 1.number of IQ data overflows": u64
  "rx 1.number of IQ data overflows": u64
  "TX.modem.DEBUG.cluster_out": T8
  "TX.modem.config done_out": bool
  "RX.sync.sync found_out": u32
  "RX.modem.config done_out": bool
  "RX.modem.modem_configuration_out": "modem_configuration.gtype"
  "RX.modem.reset active_out": bool
  "TX.modem.reset active_out": bool
  "TX.modem.count out": u64
  "UART.status": T10
  "UART.Clear done": bool
  "initial reset done_out": bool
  "control signals_out": "Control Signals.gtype"
  "ready for configuration_out": bool
  "RM properties": T11
  "TX.RM.DEBUG.counter_out": T13
  "RX.RM.debug counter_out": T14
  "RX.sync.lastWrittenRxGain": UFXP(5.1)
  "reg.notify host.go 0": bool
  "reg.host read.data 0": cluster{"go": bool, "data": u32}
  "ChEst.readyForConfig": bool
  "ChEst.configDataOut": u64
  "ChEst.usedElementsPayload": u32
  "ChEst.usedElementsPreamble": u32
  "ChEst.globalStateOut": i32
  "ChEst.SamplesOut": u32
  "RX.modem.DEBUG.cluster_out": T8
  "RX.sync.syncPaketDicarded": u32
  "TX.modem.PreambleCpCsSampleOut": "CE_signalsType.gtype"
  "TX.AGC.debugOut": T11
  "TX.TXfifoOut_freeElements": u32
types:
  T1 = cluster{"inline gain I": FXP(1.17), "inline gain Q": FXP(1.17), "cross gain I": FXP(1.17), "cross gain Q": FXP(1.17), "pre-gain offset I": FXP(1.17), "pre-gain offset Q": FXP(1.17), "post-gain offset I": FXP(1.17), "post-gain offset Q": FXP(1.17)}
  T2 = cluster{"gain I": FXP(3.21), "gain Q": FXP(3.21)}
  T3 = enum{"Software", "Digital Edge", "Rx Start Trigger", "Tx Start Trigger", "Immediate", "Future Time Event"}
  T4 = cluster{"Preamble mu": u16, "GFDM B": u16, "Preamble K": u16, "Preamble Ncp": u16, "GFDM Ncp": u16, "GFDM M": u16, "Preamble Ncs": u16, "GFDM K": u16, "GFDM Ncs": u16, "Preamble M": u16}
  "modem_configuration.gtype" = cluster{"K-1": u16, "M-1": u8, "N-1": u16, "N": u16, "Npreamble+CP+CS": u16, "Npreamble": u16, "Nw": u16, "Modulator MUX config": u64[16], "K": u16, "fft_size_log2(K)": u8, "inverse_fft": bool, "Start with preamble": bool, "Burstmode": bool, "Ncs": u16, "Ncp": u16, "N-Ncp": u16, "N+Ncp": u16, "N+Ncp+Ncs": u16, "Demodulator MUX config": u64[16], "M": u8, "DFT SIZE": FXP(6.0), "Frame length": u32, "Super frame length": u32, "Ns_all_GFDM_blocks": u32, "Ns_all_preambles": u32}
  T5 = cluster{"packets in_out": u16, "samples in_out": u16, "packets out_out": u16, "samples out_out": u16, "number of invalid samples": u64, "mod first samples out": u64, "mod last samples out": u64}
  T6 = cluster{"FFT misalignment": u64, "FFT halt": u64, "FFT last sample": u64}
  T7 = cluster{"number of invalid samples": u64, "first samples out": u64, "last samples out": u64, "number of cycles": u64}
  T8 = cluster{"Element 1": T5, "Element 2": T6, "Element 3": T7}
  T9 = cluster{"txEnable": bool, "rxEnable": bool, "Reset": bool, "baud_count": u16, "reset frame counter": bool, "reset tx counter": bool, "reset rx counter": bool}
  T10 = cluster{"debug rxData": u8, "debug txData": u8, "debug rxData valid": bool, "tx FIFO output valid": bool, "debug txRdy": bool, "count Error": u32, "count tx [Bytes]": u32, "count rx [Byte]": u32}
  "Control Signals.gtype" = cluster{"reset!": bool, "reset done?": bool, "request for config!": bool, "config done?": bool, "set active!": bool, "active?": bool}
  "Configuration Data.gtype" = cluster{"data": u64, "data valid": bool, "length": u16, "switch bank after": u16, "address": u16, "bank": u16, "address offset": u16, "update id": u8, "start update": bool}
  T11 = cluster{"Element 1": u16, "Element 2": u16, "Element 3": u16, "Element 4": u16}
  T12 = enum{"Data from Host", "Data from UART", "UART Loopback", "RX TX Loopback"}
  T13 = cluster{"RM packets_out": u16, "RM samples_out": u16, "payload length [sample]": u16, "payload length [bytes]": u16, "control channel length [samples]": u16, "control channel length [bytes]": u16}
  T14 = cluster{"first samples in": u16, "samples input": u16, "samples multiplexed": u16, "samples divided in blocks before multiplexer": u16, "corrected samples": u16, "samples divided in blocks after multiplexer": u16, "overflow counter_out": u16, "lost samples_out": u16, "state": u8}
  T15 = cluster{"missingSignalThresholdInSampels": u32, "GainIn": UFXP(5.1), "enableAnalogGainControl": bool, "enableDigitalGainController": bool, "enableDCremover": bool, "PiControl": UFXP(1.15), "setpointMaxAmplitude": UFXP(0.15), "NumbOfValidSamplesBetweenGainChange": u32, "permissibleControlError": UFXP(5.1)}
  "SyncConfig.gtype" = cluster{"Metric peak threshold": UFXP(1.16), "MetricThresholdMode": bool, "CFO removal": bool, "ffoPiControlCte": FXP(2.17), "shift_threshold": i16, "min_threshold": UFXP(1.16), "  AGC": T15}
  "niUsrpRio Config v1 Host.lvlib__Antenna Configuration.gtype" = enum{"TX1 RX1 transmits and RX2 receives", "TX1 RX1 receives and RX2 is unused"}
  "niUsrpRio Config v1 Host.lvlib__DB Types.gtype" = enum{"sbx", "cbx", "wbx", "unknown", "ubx"}
  T16 = cluster{"set": bool, "lo lpf": bool, "cpld ": bool, "switchChannel": bool, "Destination": enum{"configRx", "configTx"}, "antenna configuration": "niUsrpRio Config v1 Host.lvlib__Antenna Configuration.gtype", "daughterboard": "niUsrpRio Config v1 Host.lvlib__DB Types.gtype", "GainIn": UFXP(5.1), "spi address": u8}
  T17 = cluster{"config!": bool, "reset!": bool, "active!": bool}
  T18 = cluster{"NpayIsPowerOfTwo": bool, "KpreIsPowerOfTwo": bool, "Npay": u16, "Kpre": u16, "log2(Npay) or DftSizeIndex": u8, "B": u16, "log2(Kpre) or DftSizeIndex": u8, "L.ch.1": u16, "L.ch.2": u16, "shiftFactorDft": i16, "DftLatency": u16}
  "CE_configurationStameMashine.gtype" = cluster{"control": T17, "config": T18}
  "CE_signalsType.gtype" = cluster{"data": u32, "valid": bool, "index": u16}
  "QAM-Order.gtype" = enum{"4-QAM", "16-QAM", "64-QAM", "256-QAM"}
  T19 = cluster{"Data": u32, "frame first sample": bool, "frame last sample": bool}
  T20 = cluster{"output sample rate": UFXP(1.47), "delay": FXP(0.16), "frequency shift": FXP(0.48), "impairments": T1, "phase": FXP(0.21)}
  T21 = cluster{"frequency shift": FXP(0.48), "impairments": T1, "phase": FXP(0.21), "input sample rate": UFXP(1.47), "gain": T2, "delay": FXP(0.18)}
diagram:
  clock-driven loop (clock = "40 MHz Onboard Clock") forever {
    Number To Boolean Array(number=255) -> (Boolean array=w1)
    Array Index(array=w1) -> (out0[_]=w2, out1[_]=w3, out2[_]=w4, out3[_]=w5, out4[_]=w6, out5[_]=w7, out6[_]=w8, out7[_]=w9)
    call "IO_write.gcdl"(reference in="AUX I/O 2", data=w2)
    call "IO_write.gcdl"(reference in="AUX I/O 3", data=w3)
    call "IO_read.gcdl"(reference in="AUX I/O 1") -> (data=w10)
    call "UART_V2.0.gcdl"(Rx=w10, control=$"UART.control", Clear FIFOs=$"UART.Clear") -> (Tx=w11, Rx FIFO=w12, tx FIFO=w13, status=w14, Clear done=w15)
    call "IO_write.gcdl"(reference in="AUX I/O 0", data=w11)
    call "IO_write.gcdl"(reference in="AUX I/O 4", data=w4)
    $"UART.status" <- w14
    call "IO_write.gcdl"(reference in="AUX I/O 5", data=w5)
    $"UART.Clear done" <- w15
    call "IO_write.gcdl"(reference in="AUX I/O 6", data=w6)
    call "IO_write.gcdl"(reference in="AUX I/O 7", data=w7)
    call "IO_write.gcdl"(reference in="AUX I/O 8", data=w8)
    call "IO_write.gcdl"(reference in="AUX I/O 9", data=w9)
    Feedback Node(input=w16) -> w17
    FIFO Read(Control Protocol Input=w17, reference in="Needed Resources.grsc\\TX.data in.H2T") -> (Control Protocol Output=w18, data=w19)
    FIFO Read(Control Protocol Input=w17, reference in=w12) -> (Control Protocol Output=w20, data=w21)
    Feedback Node(input=w22) -> w23
    FIFO Read(Control Protocol Input=w23, reference in="Needed Resources.grsc\\RX.DataFromDecoder") -> (Control Protocol Output=w24, data=w25)
    case ($"Data Routing") {
      frame "Data from Host", Default {
        w26 = w19
        w27 = w18
        w28 = w25
        w29 = w24
        w30 = TRUE
        w31 = 0
        w32 = FALSE
        w33 = default
      }
      frame "Data from UART" {
        Split Number(x=w25) -> w31
        w26 = w21
        w27 = w20
        w28 = w25
        w29 = w24
        w30 = default
        w32 = w24
        w33 = default
      }
      frame "UART Loopback" {
        To Unsigned Word Integer(number=w21) -> w28
        w26 = w21
        w27 = w20
        w29 = w20
        w30 = default
        w31 = w21
        w32 = w20
        w33 = TRUE
      }
      frame "RX TX Loopback" {
        Split Number(x=w25) -> w26
        w27 = w24
        w28 = w25
        w29 = w24
        w30 = TRUE
        w31 = default
        w32 = default
        w33 = default
      }
    }
    # Data Routing
    FIFO Write(Control Protocol Input=w27, data=w26, reference in="Needed Resources.grsc\\TX.DataToEncoder") -> (Control Protocol Output=w34)
    FIFO Write(Control Protocol Input=w29, data=w28, reference in="Needed Resources.grsc\\RX.Data out.T2H") -> (Control Protocol Output=w35)
    FIFO Write(Control Protocol Input=w32, data=w31, reference in=w13) -> (Control Protocol Output=w36)
    Select(s=w30, t=w35, f=w36) -> w22
    Not(x=w33) -> w37
    Select(s=w37, t=w34, f=w22) -> w16
  }
  clock-driven loop (clock = "Needed Resources.grsc\\90 MHz") forever {
    # CRC + Encoder
    # payload size [Byte]=(N_data_symb_per_frame*mu*code_rate-code_tail)/8;
    # code_rate=0.5
    # code_tail=8 [bit]
    call "CRCappend_Padding_Encoder_Wrapper.gcdl"(fifo.DataOut [u2]="Needed Resources.grsc\\TX.Data to Mapper", fifo.DataIn [u8]="Needed Resources.grsc\\TX.DataToEncoder", PayloadSize[byte]=$"TX.payload size [Byte]", enable=$"TX.encoder.enabled")
  }
  clock-driven loop (clock = "Needed Resources.grsc\\150 MHz") (iteration -> i1) forever {
    call "trigger reset logic.gcdl"(control signals_in=$"control signals_in", loop iteration=i1, cycles to keep in reset=100) -> (control signals_out=w38, initial reset done_out=w39)
    $"initial reset done_out" <- w39
    Feedback Node(input=w40) -> w41
    FIFO Read(Control Protocol Input=w41, reference in="Updater Resources.grsc\\download") -> (Control Protocol Output=w42, data=w43)
    Property Node(instance in=$configuration_in, "data"=w43, "data valid"=w42) -> (instance out=w44)
    call "Transpose_QAM_RM_Wrapper.gcdl"(fifo.DataIn[u2]="Needed Resources.grsc\\TX.Data to Mapper", N-1_in=$"N-1_in", fifo.controlChannelIn="Resource Mapper Resources.grsc\\TX.RM.control channel in", update id_const RM=1, fifo.DataOut="Resource Mapper Resources.grsc\\TX.Resource Mapper_out", config data in=w44, control signals_in=w38, transpose A=$"TX.transpose A", transpose B=$"TX.transpose B", transpose AB=$"transpose AB", QAMorder=$"TX.qamOrder") -> (RM properties=w45, control signals_out=w46, TX.RM.DEBUG.counter_out=w47, readyForConfigInput=w48)
    # Resource Mapper - Demapper
    call "RDM_deQAM_Transponse_Wrapper.gcdl"(fifo.DataIn="Resource Mapper Resources.grsc\\RX.Resource Demapper_in", fifo.DataOut="Needed Resources.grsc\\RX.Modem to decoder", N-1_in=$"N-1_in", update id_const RDM=2, qamOrder=$"TX.qamOrder", configData RDM=w44, control signals_in=w46, transponse AB=$"transpose AB", transponse B=$"TX.transpose B", transponse A=$"TX.transpose A") -> (control signals_out=w49, RX.RM.debug counter_out=w50, ready for config RDM=w51, RDM debugOut=w52, RDM debug out valid=w53)
    FIFO Write(Control Protocol Input=w53, data=w52, reference in="Needed Resources.grsc\\RX.Debug.Modem_64 bit samples out")
    $"RX.RM.debug counter_out" <- w50
    $"control signals_out" <- w49
    Logical Or(w51, w48) -> w40
    $"ready for configuration_out" <- w41
    $"TX.RM.DEBUG.counter_out" <- w47
    $"RM properties" <- w45
  }
  Register Create(initial value="modem_configuration.gtype" {all zero or empty}) -> (reference out=w54)
  clock-driven loop (clock = "Needed Resources.grsc\\90 MHz") (after w54) forever {
    # Decoder
    call "Decoder_CRC_Wrapper.gcdl"(fifo.dataIn="Needed Resources.grsc\\RX.Modem to decoder", payloadSize [byte]=$"RX.payloadSize [byte]", paketSize[bits]=$"RX.decoder.Block Size(bit,N)", fifo.dataOut="Needed Resources.grsc\\RX.DataFromDecoder", forward repeated crc=$"RX.forward repeated crc", forward broken crc=$"RX.forward broken crc")
  }
  clock-driven loop (clock = "Needed Resources.grsc\\150 MHz") forever {
    Register Read(reference in=w54) -> (data=w55)
    call "Reset.gcdl"() -> (reset=w56)
    # Detector
    call "Detection.gcdl"(RX.modem.data fifo_in="Needed Resources.grsc\\RX.gfdm data to equalizer", RX.modem.fft.bitshift_in=$"RX.modem.fft.bitshift_in", RX.modem.configuration_in=w55, RX.modem.configure_in=$"RX.modem.configure_in", RX.modem.filter fifo_in="Needed Resources.grsc\\RX.pulse shape in", RX.modem.reset_in=w56, RX.modem.bitshift_in=$"RX.modem.bitshift_in", equ.shift=1) -> (RX.modem.data valid_out=w57, RX.modem.32 bit data_out=w58, RX.modem.modem_configuration_out=w59, RX.modem.DEBUG.cluster_out=w60, RX.modem.config done_out=w61, RX.modem.reset active_out=w62)
    FIFO Write(Control Protocol Input=w57, data=w58, reference in="Needed Resources.grsc\\RX.Debug.Modem_32 bit samples out")
    FIFO Write(Control Protocol Input=w57, data=w58, reference in="Resource Mapper Resources.grsc\\RX.Resource Demapper_in")
    $"RX.modem.modem_configuration_out" <- w59
    $"RX.modem.config done_out" <- w61
    $"RX.modem.reset active_out" <- w62
    $"RX.modem.DEBUG.cluster_out" <- w60
  }
  FIFO Create(data type=T19 {all zero or empty}, depth=8193) -> (reference out=w63)
  clock-driven loop (clock = "Needed Resources.grsc\\150 MHz") forever {
    Register Read(reference in=w54) -> (data=w64)
    call "Reset.gcdl"() -> (reset=w65)
    Feedback Node(input=w66) -> w67
    Feedback Node(input=w68) -> w69
    Logical And(w69, w67) -> w70
    call "SISO-TX.gcdl"(TX.modem.data fifo_in="Resource Mapper Resources.grsc\\TX.Resource Mapper_out", TX.modem.reset_in=w65, TX.modem.bitshift_in=$"TX.modem.bitshift_in", TX.modem.configure_in=$"TX.modem.configure_in", TX.modem.configuration_in=w64, TX.modem.filter fifo_in="Needed Resources.grsc\\TX.pulse shape in", window_in="Needed Resources.grsc\\TX.Window in", TX.modem.PreambleCpCsSampleIn=$"TX.modem.PreambleCpCsSampleIn", TX.modem.enable=w70, TX.modem.preambleInsertion.waitForSamples=$"TX.modem.preambleInsertion.waitForSamples", TX.modem.input shift_in=$"TX.modem.input shift_in") -> (TX.modem.config done_out=w71, TX.frame valid_out=w72, TX.frame_out=w73, TX.modem.DEBUG.cluster_out=w74, TX.modem.reset active_out=w75)
    call "niInstr Basic Elements v1 FPGA.lvlib__Detect Rising Edge.gcdl"(signal=w72) -> (edge detected=w76)
    # trigger transmitter!
    Feedback Node[DelayCount=4](input=w76) -> w77
    Register Write(data=w77, reference in="Needed Resources.grsc\\TX.start trigger")
    # Modulator
    Property Node(instance in=w64) -> ("Super frame length"=w78)
    Property Node(instance in=w73) -> ("Data"=w79, instance out=w80)
    FIFO Write(Control Protocol Input=w72, data=w80, reference in=w63) -> (reference out=w81)
    Property Node(instance in=w81) -> ("free elements"=w82)
    Feedback Node(input=w78) -> w83
    Feedback Node(input=w82) -> w84
    Is Greater Or Equal(x=w84, y=w83) -> w68
    $"TX.modem.config done_out" <- w71
    FIFO Write(Control Protocol Input=w72, data=w79, reference in="Needed Resources.grsc\\TX.Debug.frame out")
    $"TX.TXfifoOut_freeElements" <- w84
    $"TX.modem.DEBUG.cluster_out" <- w74
    $"TX.modem.reset active_out" <- w75
    call "niInstr Basic Elements v1 FPGA.lvlib__Count Up U64.gcdl"(increment=TRUE, reset=w67) -> (count out=w85)
    $"TX.modem.count out" <- w85
    Is Greater Or Equal(x=w85, y=$"TX.modem.trigger limit") -> w66
    Feedback Node(input=$"TX.modem.PreambleCpCsSampleIn") -> w86
    $"TX.modem.PreambleCpCsSampleOut" <- w86
  }
  # w87: preamble
  FIFO Create(data type=u64 0, depth=2049) -> (reference out=w87)
  # w88: payload
  FIFO Create(data type=u64 0, depth=4097) -> (reference out=w88)
  clock-driven loop (clock = "Needed Resources.grsc\\200 MHz") forever {
    Feedback Node(input=w89) -> w90
    Feedback Node(input=$"ChEst.Parameters") -> w91
    Feedback Node(input=$"ChEst.debugState") -> w92
    disable {
      frame Enabled {
        call "CE_channelEstimation_K64R3and5.gcdl"(fifoPreamble=w87, fifoPayload=w88, configIDataIn=w90, Parameters=w91) -> (readyForConfig=w95, dataOut=w93, globalStateOut=w94)
      }
      frame Disabled {
        call "CE_channelEstimation.gcdl"(fifoPreamble=w87, fifoPayload=w88, configIDataIn=w90, Parameters=w91, debugState=w92) -> (readyForConfig=w95, dataOut=w93, globalStateOut=w94)
      }
    }
    Property Node(instance in=w93) -> ("data"=w96, "valid"=w97)
    Feedback Node(input=w96) -> w98
    Feedback Node(input=w97) -> w99
    FIFO Write(Control Protocol Input=w99, data=w98, reference in="Needed Resources.grsc\\RX.gfdm data to equalizer")
    Feedback Node(input=w95) -> w100
    $"ChEst.readyForConfig" <- w100
    # Channel Estimation +Equalizer
    Feedback Node(input=w94) -> w101
    $"ChEst.globalStateOut" <- w101
    Feedback Node(input=$"ChEst.configDataIn") -> w102
    Split Number(x=w102) -> (high(x)=w103, low(x)=w104)
    Split Number(x=w104) -> (high(x)=w105, low(x)=w106)
    Is Greater Than 0(x=w106) -> w107
    Property Node(instance in="CE_signalsType.gtype" {all zero or empty}, "data"=w103, "valid"=w107, "index"=w105) -> (instance out=w89)
    Feedback Node(input=$"ChEst.configDataIn") -> w108
    Feedback Node(input=w108) -> w109
    $"ChEst.configDataOut" <- w109
    call "niInstr Basic Elements v1 FPGA.lvlib__Count Up U32.gcdl"(increment=w99) -> (count out=w110)
    Feedback Node(input=w110) -> w111
    $"ChEst.SamplesOut" <- w111
    Property Node(instance in=w88) -> ("used elements"=w112)
    Feedback Node(input=w112) -> w113
    $"ChEst.usedElementsPayload" <- w113
    Property Node(instance in=w87) -> ("used elements"=w114)
    Feedback Node(input=w114) -> w115
    $"ChEst.usedElementsPreamble" <- w115
  }
  FIFO Create(data type=u64 0, depth=17) -> (reference out=w116)
  FIFO Create(data type=u64 0, depth=17) -> (reference out=w117)
  # w117: port 0
  # w116: port 1
  clock-driven loop (clock = "40 MHz Onboard Clock") forever {
    Feedback Node(input=w118) -> w119
    call "4.12 cfx to u32.gcdl"(input=w119) -> (output=w120)
    Feedback Node(input=w121) -> w122
    Logical And(w122, $"RX.sync.preambleOutFifoActive") -> w123
    # to host
    FIFO Write(Control Protocol Input=w123, data=w120, reference in="Needed Resources.grsc\\RX.Preamble out")
    Feedback Node(input=$"RX.sync.GFDM configuration cluster") -> w124
    Feedback Node(input=w125) -> w126
    Feedback Node(input=w127) -> w128
    # w117: Port0
    # w116: Port1
    call "Sync_K64_TUDwrapper_pk.gcdl"(validIn=w128, GFDM configuration cluster=w124, dataIn=w126, Config=$"RX.sync.config", halfPreambleVectorIn=$"RX.sync.halfPreambleVectorIn") -> (dataOut=w118, dataValidOut=w129, SynchronizationFoundOut=w130, preambleStart=w131, preambleValid=w132, gfdmSymbolValid=w133, PreambleValidCount=w134, PayloadValidCount=w135, AnalogGainOut=w136, setAnalogGain=w137, Npay_withoutCpCs=w138)
    Select(s=$"TX.sync.preambleOrAllData", t=w129, f=w132) -> w121
    # Synchronizer + AGC
    FIFO Read(Control Protocol Input=TRUE, reference in="Needed Resources.grsc\\RX.ADC to synch") -> (Control Protocol Output=w139, data=w140)
    call "SwitchIQ.gcdl"(data_in=w140) -> (data_out=w141)
    call "u32 to 4.12 cfx.gcdl"(data in=w141) -> (data out=w125)
    Logical And(w139, $"RX.sync.input enable_in") -> w127
    Feedback Node(input=w134) -> w142
    Join Numbers(high(x)=w142, low(x)=0) -> w143
    Join Numbers(high(x)=w120, low(x)=w143) -> w144
    Feedback Node(input=w132) -> w145
    call "Sync.avoidFifoOverflow.gcdl"(FPGA.Fifo=w88, paketLength=w138, firstSampleValid=w131) -> (packetDiscarded=w146, paketValidOut=w147)
    Logical And(w145, w147) -> w148
    # preamble
    FIFO Write(Control Protocol Input=w148, data=w144, reference in=w87)
    Feedback Node(input=w135) -> w149
    Join Numbers(high(x)=w149, low(x)=0) -> w150
    Join Numbers(high(x)=w120, low(x)=w150) -> w151
    Feedback Node(input=w133) -> w152
    Logical And(w152, w147) -> w153
    # payload
    FIFO Write(Control Protocol Input=w153, data=w151, reference in=w88)
    Feedback Node(input=w130) -> w154
    call "Reset.gcdl"() -> (reset counter=w155)
    call "niInstr Basic Elements v1 FPGA.lvlib__Count Up U32.gcdl"(increment=w154, reset=w155) -> (count out=w156)
    Feedback Node(input=w156) -> w157
    $"RX.sync.sync found_out" <- w157
    Not(x=$"AGC.disableAGC") -> w158
    Logical And(w137, w158) -> w159
    call "setATRwrapper.gcdl"(RxGainIn=w136, setRxGainIn=w159, Fifo.Port0=w117, Fifo.Port1=w116, conf=$"AGC.config") -> (sync.lastWrittenRxGain=w160)
    $"RX.sync.lastWrittenRxGain" <- w160
    call "niInstr Basic Elements v1 FPGA.lvlib__Count Up U32.gcdl"(increment=w146, reset=w155) -> (count out=w161)
    Feedback Node(input=w161) -> w162
    $"RX.sync.syncPaketDicarded" <- w162
  }
  call "Create Resources.gvi"() -> (sync.resources=w163, config.resources=w164, time.resources=w165)
  clock-driven loop (clock = "40 MHz Onboard Clock") {
    Register Write(data=$"TX.modem.configuration_in", reference in=w54)
    # w116: Port1
    Build Array($Reset, $"Reset counter") -> w166
    Register Write(data=w166, reference in="Needed Resources.grsc\\Reset")
    Io Write(data=$"RF 1/Rx/Enable", reference in="RF 1/Rx/Enable")
    Io Write(data=$"RF 0/Tx/Enable", reference in="RF 0/Tx/Enable")
    Io Write(data=$"RF 0/Rx/Enable", reference in="RF 0/Rx/Enable")
    Io Write(data=$"RF 1/Tx/Enable", reference in="RF 1/Tx/Enable")
    # w117: Port0
    Feedback Node(input=w167) -> w168
    Property Node(instance in=w168) -> ("ready for port 0 input"=w169, "ready for port 1 input"=w170, "ready for port 2 input"=w171)
    Feedback Node(input=w172) -> w173
    call "niInstr Register Bus v1 FPGA.lvlib__Process.gcdl"(reg.notify host.go rcvd=$"reg.notify host.go rcvd 0", reg.host read.go rcvd=$"reg.host read.go rcvd 0", read completion=w173, reg.reset=$"reg.reset 0", reg.host instruction fifo="niInstr Register Bus v0.grsc\\reg.host instruction fifo 0", ready for output=w171) -> (reg.notify host.go=w174, reg.host read.data=w175, register instruction=w176)
    $"reg.notify host.go 0" <- w174
    $"reg.host read.data 0" <- w175
    FIFO Read(Control Protocol Input=w169, reference in=w117) -> (Control Protocol Output=w177, data=w178)
    call "Retrieve FPGA Scoped Instruction.gcdl"(number=w178, valid=w177) -> (output cluster=w179)
    # these FIFOs are for setting the Gain on FPGA side
    FIFO Read(Control Protocol Input=w170, reference in=w116) -> (Control Protocol Output=w180, data=w181)
    call "Retrieve FPGA Scoped Instruction.gcdl"(number=w181, valid=w180) -> (output cluster=w182)
    Feedback Node(input=w183) -> w184
    call "niInstr Register Bus v1 FPGA.lvlib__Register Instruction Arbiter (3 inputs).gcdl"(port 0=w179, port 1=w182, port 2=w176, reset=FALSE, ready for output=w184) -> (register instr out=w185, ready for input=w167)
    call "Registers.gcdl"(sync.resources=w163, register instruction=w185, config.resources=w164, time.resources=w165) -> (read completion out=w172, ready for input=w183)
    stop if FALSE
  }
  call "niUsrpRio Config v1 FPGA.lvlib__Process.gvi"(resources=w164)
  clock-driven loop (clock = "Data Clock") {
    Build Array($"rx 0.stream enable", $"rx 1.stream enable") -> w186
    # Streaming Transceiver Engine
    # trigger from TX
    # frame generation
    Register Read(reference in="Needed Resources.grsc\\TX.start trigger") -> (data=w187)
    Logical Or($"tx.software trigger", w187) -> w188
    call "Start Triggers Time.gcdl"(rx 1.stream enabled=$"rx 1.stream enable", rx.software trigger=$"rx.software trigger", tx.trigger select=$"tx.trigger select", tx.enable trigger=$"tx.trigger enable", tx 0.stream enabled=$"tx 0.stream enable", tx 1.stream enabled=$"tx 1.stream enable", rx 0.stream enabled=$"rx 0.stream enable", rx.enable trigger=$"rx.trigger enable", rx.trigger select=$"rx.trigger select", tx.software trigger=w188, time.resources=w165) -> (rx.start trigger=w189, tx.start trigger=w190)
    Build Array($"rx 0.stream enable", $"rx 1.stream enable") -> w191
    Io Read(reference in="RF 0/Rx/I") -> (data=w192)
    Io Read(reference in="RF 0/Rx/Q") -> (data=w193)
    call "niInstr DSP v1 FPGA.lvlib__I16 to IQ.gcdl"(I=w192, Q=w193) -> (IQ data=w194)
    Io Read(reference in="RF 1/Rx/I") -> (data=w195)
    Io Read(reference in="RF 1/Rx/Q") -> (data=w196)
    call "niInstr DSP v1 FPGA.lvlib__I16 to IQ.gcdl"(I=w195, Q=w196) -> (IQ data=w197)
    Build Array(w194, w197) -> w198
    w199 = T20 {"0x800000000000", 0, 0, "0x1FFFF", "0x1FFFF", 0, 0, 0, 0, 0, 0, 0}
    Property Node(instance in=w199, "impairments"=$"rx 0.impairments", "frequency shift"=$"rx 0.frequency shift", "phase"=$"rx 0.phase", "output sample rate"=$"rx.output sample rate", "delay"=$"rx.delay") -> (instance out=w200)
    w201 = T20 {"0x800000000000", 0, 0, "0x1FFFF", "0x1FFFF", 0, 0, 0, 0, 0, 0, 0}
    Property Node(instance in=w201, "delay"=$"rx.delay", "output sample rate"=$"rx.output sample rate", "impairments"=$"rx 1.impairments", "frequency shift"=$"rx 1.frequency shift", "phase"=$"rx 1.phase") -> (instance out=w202)
    Build Array(w200, w202) -> w203
    call "DDC (Multi-Channel).gcdl"(data in=w198, start trigger=w189, enabled=w191, DDC Parameters=w203, reset=$"rx.reset") -> (data out=w204, number of overflows=w205, output valid=w206, dsp reset done=w207)
    # #CodeRecommended - If you want to move the data directly to another LabVIEW FPGA device
    #  for further processing, you can replace the DMA FIFO with a Peer to Peer Writer FIFO.
    # #CodeRecommended - For your custom data processing IP, you can add Target-Scoped FPGA FIFOs
    #  if you need to move data to a different clock domain.
    call "niInstr Basic Elements v1 FPGA.lvlib__Detect Rising Edge.gcdl"(signal=$"rx.abort") -> (edge detected=w208)
    Feedback Node(input=w209) -> w210
    Not(x=w210) -> w211
    call "Input Stream Control.gcdl"(input valid=w206, start trigger=w189, burst size=$"rx.samples to acquire", abort=w208, fifo timeout=w211, reset=$"rx.reset") -> (write stream=w212, state=w213, samples processed=w214, number of overflows=w215)
    call "Write FIFO (Multi-Channel).gcdl"(switch channels=$"RX.switch channels", data in=w204, enabled=w186, input valid=w212, reset=$"rx.reset", FIFO 0="Needed Resources.grsc\\RX.ADC to synch", T2H fifo reference="Needed Resources.grsc\\Dummy") -> (ready for input=w209)
    Array Index(array=w205) -> (out0[_]=w216, out1[_]=w217)
    $"rx 0.number of IQ data overflows" <- w216
    $"rx 1.number of IQ data overflows" <- w217
    $"rx.dsp reset done" <- w207
    $"rx.state" <- w213
    $"rx.samples processed" <- w214
    $"rx.number of overflows" <- w215
    Build Array($"tx 0.stream enable", $"tx 1.stream enable") -> w218
    Build Array($"tx 0.stream enable", $"tx 1.stream enable") -> w219
    call "niInstr Basic Elements v1 FPGA.lvlib__Detect Rising Edge.gcdl"(signal=$"tx.abort") -> (edge detected=w220)
    Feedback Node(input=w221) -> w222
    Feedback Node(input=w223) -> w224
    call "Output Stream Control.gcdl"(start trigger=w190, burst size=$"tx.samples to generate", abort=w220, ready to read stream (T)=w224, fifo output valid=w222, reset=$"tx.reset") -> (read stream=w225, state=w226, samples processed=w227, number of underflows=w228)
    call "read FIFO & repeat.gcdl"(enabled=w219, ready for output=w225, TX.switchTxChannel=$"TX.switchTxChannel", FPGA.Fifo=w63, frame length=$"TX.frameLength", Nsleep-3 (min is 2)=$"TX.Nsleep-3 (min.2)", akivate repeatiotion=$"TX.akivateRepeatiotion") -> (data out=w229, output valid=w221, debugOut=w230)
    # #CodeRecommended - If you want to pull data directly from another LabVIEW FPGA device,
    # you can replace the DMA FIFO with a Peer to Peer Reader FIFO.
    call "niInstr Basic Elements v1 FPGA.lvlib__Synchronous Latch.gcdl"(set=w221, clear=$"tx.reset") -> (out=w231)
    Logical And(w231, w224) -> w232
    w233 = T21 {0, "0x1FFFF", "0x1FFFF", 0, 0, 0, 0, 0, 0, 0, 0, "0x200000", "0x200000", 0}
    Property Node(instance in=w233, "gain"=$"tx 0.gain", "frequency shift"=$"tx 0.frequency shift", "phase"=$"tx 0.phase", "impairments"=$"tx 0.impairments", "input sample rate"=$"tx.input sample rate", "delay"=$"tx.delay") -> (instance out=w234)
    w235 = T21 {0, "0x1FFFF", "0x1FFFF", 0, 0, 0, 0, 0, 0, 0, 0, "0x200000", "0x200000", 0}
    Property Node(instance in=w235, "delay"=$"tx.delay", "input sample rate"=$"tx.input sample rate", "gain"=$"tx 1.gain", "frequency shift"=$"tx 1.frequency shift", "phase"=$"tx 1.phase", "impairments"=$"tx 1.impairments") -> (instance out=w236)
    Build Array(w234, w236) -> w237
    call "DUC (Multi-Channel).gcdl"(data in=w229, enabled=w218, input valid=w232, DUC Parameters=w237, reset=$"tx.reset") -> (I data out=w238, Q data out=w239, number of overflows=w240, dsp reset done=w241, ready for input=w223)
    Array Index(array=w238) -> (out0[_]=w242, out1[_]=w243)
    # #CodeRecommended - For your custom data processing IP, you can add
    # Target-Scoped FPGA FIFOs if you need to move data to/from a different clock domain.
    Io Write(data=w242, reference in="RF 0/Tx/I")
    Io Write(data=w243, reference in="RF 1/Tx/I")
    Array Index(array=w239) -> (out0[_]=w244, out1[_]=w245)
    Io Write(data=w244, reference in="RF 0/Tx/Q")
    Io Write(data=w245, reference in="RF 1/Tx/Q")
    $"TX.AGC.debugOut" <- w230
    $"tx.state" <- w226
    Array Index(array=w240) -> (out0[_]=w246, out1[_]=w247)
    $"tx 0.number of IQ data overflows" <- w246
    $"tx.samples processed" <- w227
    $"tx 1.number of IQ data overflows" <- w247
    $"tx.dsp reset done" <- w241
    $"tx.underflows" <- w228
    stop if FALSE
  }
