vi "GFDM Host.gvi"   [LabVIEW Communications System Design Suite 2.0.1]
inputs:
  "RX.Sync.rssi.log power": f64 = -18.3125
panel controls:
  "stop": bool = TRUE
  "GFDM parameter": "GFDM parameter.gtype" = {"Variable: K"=32, "Variable: M"=3, "Variable: a"=0, "filter type"="rc", "receive filter"="ZF", "inverse FFT"=FALSE, "Variable: b"=0, "Ncs"=16, "Ncp"=32}
  "Operation": i32
  "TX.modem.bitshift_in": i16 = 15
  "USRP RIO device": string = "RIO0"
  "Reference Frequency Source": string = "Internal"
  "TX.automatic trigger_in": bool = TRUE
  "RX.rssi.time constant": UFXP(5.0) = 14
  "RX.switch channels": bool
  "Channel Length": i32 = 10
  "RX.modem.bitshift_in": i16 = 17
  "RX.modem.fft.bitshift_in": i16 = 14
  "UDP receive port": u16 = 50000
  "RX.enable": bool = TRUE
  "TX.modem.transmission time interval": u64 = 20000
  "TX.enabled": bool = TRUE
  "Control Tab": i32 = 2
  "Sync Configuration Cluster": T11 = {"Metric peak threshold"=1, "halfPreambleVectorIn"=default, "Metric peak threshold mode"=TRUE, "CFO removal"=FALSE, "ffoPiControlCte"=0.0100021362305, "Sync_scaleThreshold"=-1, "min_threshold"=0.100006103516, "autocorrelation_energythreshold"=0.0199890136719, "ThresholdWindow"=1, "addToMultipath"=7.99996948242, "shift_threshold"=-1}
  "UART.control": T12 = {"txEnable"=TRUE, "rxEnable"=TRUE, "Reset"=FALSE, "baud_count"=200, "reset frame counter"=FALSE, "reset tx counter"=FALSE, "reset rx counter"=FALSE}
  "UDP send port": u16 = 60000
  "PayloadSize [Byte]": u16 = 9
  "Use Phase Tracking": bool = TRUE
  "Data Routing": T15 = "Data from Host"
  "Add frame counter": bool
  "Data panel": i32
  "Read UDP?": bool
  "RM:No DC": bool = TRUE
  "RX.Sync.rssi.time constant": UFXP(5.0) = 14
  "expected signal range upper bound": f64 = -18
  "expected signal range lower bound": f64 = -22
  "Fixed Gain Setting": bool = TRUE
  "AGC.milliseconds to wait": u32 = 25
  "gain in": f64 = 37
  "Cycles without transmission": u8
  "TX.Sample Rate [S/s]": f64 = 30000000
  "RX.Frequency [Hz]": f64 = 1990000000
  "TX.Frequency [Hz]": f64 = 1990000000
  "RX.Sample Rate [S/s]": f64 = 30000000
  "UseCAPIData": bool
  "Preamble path": path
  "Preamble mode": T18 = "Load from file"
  "preamble scale": f64 = 4
panel indicators:
  "general error description": string  # source out indicates the source of the error.
  "rx.number of overflows": u32
  "rx.output sample rate": UFXP(1.47)
  "RX.sync.DEBUG.counter_out": T1
  "rx 0.number of IQ data overflows": u64
  "rx.samples processed": u32
  "rx.samples to acquire": u32
  "rx.state": enum{"Idle", "Active"}
  "tx 0.number of IQ data overflows": u64
  "rx 1.number of IQ data overflows": u64
  "tx 1.number of IQ data overflows": u64
  "tx.input sample rate": UFXP(1.47)
  "TX.modem.DEBUG.cluster_out": T4
  "tx.RF.state": enum{"Idle", "Active"}
  "tx.underflows": u32
  "TX Coerced Configurations": T5
  "RX Coerced Configurations": T6
  "RX.sync.preambleEnd": u32
  "RX.sync.preambleStart": u32
  "RX.sync.symbolEnd": u32
  "RX.sync.symbolStart": u32
  "RX.sync.sync found_out": u32
  "correlation metric": UFXP(4.14)[][]
  "preamble": f64[][]
  "RX.sync.number of packets in": u64
  "RX.sync.number of samples in": u64
  "FPGA configuration": T7
  "RX.sync.GFDM configuration cluster": T8
  "channel freq domain": f64[][]
  "channel time domain": f64[][]
  "IQ": CFXP(2.14)[][]
  "RE_data": FXP(2.14)[]
  "IM_data": FXP(2.14)[]
  "RX.modem.DEBUG.cluster_out": T10
  "Channel Freq. Resp.": c128[]
  "Update of channel coefficients": bool
  "Number of channel coefficients update": f64
  "received preamble": u32[]
  "transmission interval [s]": f64
  "UART.status": T13
  "Received Bytes": u8[]
  "Decoder byte out": string
  "UDP send error": string  # source out indicates the source of the error.
  "current angle": string
  "angle over time": i32
  "K_set": i16[]
  "M_set": i16[]
  "RM properties": T14
  "UDP receive FIFO full": bool
  "UDP receive error": string  # source out indicates the source of the error.
  "UDP packet size [byte]": i32
  "transmission frame size [byte]": i32
  "half of the payload [byte]": f64
  "GFDM block payload size [byte]": u32
  "Number of GFDM blocks": u32
  "packet counter": u32
  "TX signal": FXP(3.14)[][]
  "RX.RM.debug counter_out": T16
  "RF Power": f64
  "Preamble Power": f64
  "Pilot-Betrag": UFXP(2.14)[]
  "Pilot-Phase": f64[]
  "TX byte": u8[]
  "received packets": u32
  "Overall AGC setting": f64
  "RF RX power setting": f64
  "RX digital gain": f64
  "AGC state": T17
  "Sync working": bool
  "RF gain_out": f64
  "RX digital gain_out": f64
  "Overall AGC": f64
  "rssi.log power": f64
  "empty elements remaining": u32
  "Minimum Receive Power": f64
  "rms value": f64
  "Preamble Power_Host": f64
  "Preamble Power_Host Chart": f64
types:
  "GFDM parameter.gtype" = cluster{"Variable: K": i32, "Variable: M": i32, "Variable: a": f64, "filter type": enum{"rc", "rect"}, "receive filter": enum{"MF", "ZF"}, "inverse FFT": bool, "Variable: b": f64, "Ncs": u16, "Ncp": u16}
  T1 = cluster{"number of invalid samples": u64, "first samples out": u64, "last samples out": u64, "number of cycles": u64}
  T2 = cluster{"packets in_out": u16, "samples in_out": u16, "packets out_out": u16, "samples out_out": u16, "number of invalid samples": u64, "mod first samples out": u64, "mod last samples out": u64}
  T3 = cluster{"FFT misalignment": u64, "FFT halt": u64, "FFT last sample": u64}
  T4 = cluster{"Element 1": T2, "Element 2": T3, "Element 3": T1}
  T5 = cluster{"Coerced Frequencies [Hz]": f64[], "Coerced LO Frequencies [Hz]": f64[], "Coerced Output Powers [dBm]": f64[], "Coerced Sample Rates [S/s]": f64[]}
  T6 = cluster{"Coerced Frequencies [Hz]": f64[], "Coerced LO Frequencies [Hz]": f64[], "Coerced Levels [dBm]": f64[], "Coerced Sample Rates [S/s]": f64[]}
  T7 = cluster{"K-1": u16, "M-1": u8, "N-1": u16, "N": u16, "Npreamble+CP+CS": u16, "Npreamble": u16, "Nw": u16, "Modulator MUX config": u64[16], "K": u16, "fft_size_log2(K)": u8, "inverse_fft": bool, "Start with preamble": bool, "Burstmode": bool, "Ncs": u16, "Ncp": u16, "N-Ncp": u16, "N+Ncp": u16, "N+Ncp+Ncs": u16, "Demodulator MUX config": u64[16], "M": u8, "DFT SIZE": FXP(6.0), "Frame length": u32, "Super frame length": u32, "Ns_all_GFDM_blocks": u32, "Ns_all_preambles": u32}
  T8 = cluster{"Preamble mu": u16, "GFDM B": u16, "Preamble K": u16, "Preamble Ncp": u16, "GFDM Ncp": u16, "GFDM M": u16, "Preamble Ncs": u16, "GFDM K": u16, "GFDM Ncs": u16, "Preamble M": u16}
  T9 = cluster{"FFT misalignment count": u8, "FFT halt count": u8, "block start": u16, "block end": u16, "overflow_2": u16, "update active_2": u16, "update done_2": u16, "first sample out_2": u16, "exponent": FXP(4.0), "exponent_2": FXP(4.0), "elements read_2": u32}
  T10 = cluster{"Element 1": T2, "Element 2": T3, "Element 3": T1, "Element 4": T9}
  T11 = cluster{"Metric peak threshold": UFXP(2.16), "halfPreambleVectorIn": CFXP(4.12)[64], "Metric peak threshold mode": bool, "CFO removal": bool, "ffoPiControlCte": FXP(2.17), "Sync_scaleThreshold": i16, "min_threshold": UFXP(2.16), "autocorrelation_energythreshold": UFXP(8.15), "ThresholdWindow": u16, "addToMultipath": FXP(4.15), "shift_threshold": i16}
  T12 = cluster{"txEnable": bool, "rxEnable": bool, "Reset": bool, "baud_count": u16, "reset frame counter": bool, "reset tx counter": bool, "reset rx counter": bool}
  T13 = cluster{"debug rxData": u8, "debug txData": u8, "debug rxData valid": bool, "tx FIFO output valid": bool, "debug txRdy": bool, "count Error": u32, "count tx [Bytes]": u32, "count rx [Byte]": u32}
  T14 = cluster{"Element 1": u16, "Element 2": u16, "Element 3": u16, "Element 4": u16}
  T15 = enum{"Data from Host", "Data from UART", "UART Loopback", "RX TX Loopback"}
  T16 = cluster{"first samples in": u16, "samples input": u16, "samples multiplexed": u16, "samples divided in blocks before multiplexer": u16, "corrected samples": u16, "samples divided in blocks after multiplexer": u16, "overflow counter_out": u16, "lost samples_out": u16, "state": u8}
  T17 = enum{"Initial Sync", "No Transmission", "Few Packets Found", "Transmission running", "Transmission stopped"}
  T18 = enum{"Load from file", "Generate GFDM based Preamble"}
  T19 = cluster{"Antenna RF 0": string, "Frequency RF 0 [Hz]": f64, "LO Frequency RF 0 [Hz]": f64, "Output Power RF 0 [dBm]": f64}
  T20 = cluster{"Antenna RF 1": string, "Frequency RF 1 [Hz]": f64, "LO Frequency RF 1 [Hz]": f64, "Output Power RF 1 [dBm]": f64}
  T21 = enum{"Software", "Digital Edge", "Rx Start Trigger", "Tx Start Trigger", "Immediate", "Future Time Event"}
  T22 = cluster{"rf enable 0": bool, "rf config 0": T19, "rf enable 1": bool, "rf config 1": T20, "Number of Samples is Finite": bool, "Sample Rate [S/s]": f64, "Number of Samples": u32, "Start Trigger": T21, "Tone Frequency [Hz]": f64}
  T23 = cluster{"Antenna RF 0": string, "Frequency RF 0 [Hz]": f64, "LO Frequency RF 0 [Hz]": f64, "Reference Level RF 0 [dBm]": f64}
  T24 = cluster{"Antenna RF 1": string, "Frequency RF 1 [Hz]": f64, "LO Frequency RF 1 [Hz]": f64, "Reference Level RF 1 [dBm]": f64}
  T25 = cluster{"rf enable 0": bool, "rf config 0": T23, "rf enable 1": bool, "rf config 1": T24, "Number of Samples is Finite": bool, "Sample Rate [S/s]": f64, "Number of Samples": u32, "Start Trigger": T21}
uses:
  NI::Analysis::Statistics::RMS (CDB).gvi
  NI::Analysis::Transforms::Inverse Complex FFT.gvi
diagram:
  $stop <- FALSE
  $"received preamble" <- u32[] []
  case ($UseCAPIData) {
    frame True {
      w1 = no error
      w2 = UdpNetworkConnectionRefnum constant
      w3 = UdpNetworkConnectionRefnum constant
    }
    frame False {
      call "config UDP.gvi"(receive port (from vlc player)=$"UDP receive port") -> (UDP receive=w2, UDP send=w3, error out=w1)
    }
  }
  call "Reset FPGA.gvi"(USRP RIO device=$"USRP RIO device", error out=w1) -> (error in=w4)
  FPGA Open Node[ProjectItem=":NullTarget:GFDM\\ FPGA\\ Toplevel\\ for\\ 40MHz\\ USRP\\.lvbitx"](RIO address=$"USRP RIO device", error in=w4, run?=TRUE) -> (error out=w5, reference out=w6)
  Property Node(instance in=T19 {all zero or empty}, "Antenna RF 0"="TX1", "Frequency RF 0 [Hz]"=$"TX.Frequency [Hz]", "LO Frequency RF 0 [Hz]"=-1, "Output Power RF 0 [dBm]"=26) -> (instance out=w7)
  Property Node(instance in=$"GFDM parameter") -> ("Variable: K"=w8, "Variable: M"=w9, "Ncs"=w10, "Ncp"=w11)
  Multiply(w8, w9) -> w12
  Add(w10, w11) -> w13
  Square(x=w13) -> w14
  Add(w12, 128, w14) -> w15
  w16 = T22 {"rf enable 0"=TRUE, "rf config 0"={"Antenna RF 0"="TX1", "Frequency RF 0 [Hz]"=1990000000, "LO Frequency RF 0 [Hz]"=-1, "Output Power RF 0 [dBm]"=20}, "rf enable 1"=FALSE, "rf config 1"={"Antenna RF 1"="TX1", "Frequency RF 1 [Hz]"=1990000000, "LO Frequency RF 1 [Hz]"=-1, "Output Power RF 1 [dBm]"=0}, "Number of Samples is Finite"=FALSE, "Sample Rate [S/s]"=20000000, "Number of Samples"=800, "Start Trigger"="Software", "Tone Frequency [Hz]"=100000}
  Property Node(instance in=w16, "rf enable 0"=TRUE, "rf config 0"=w7, "rf enable 1"=FALSE, "rf config 1"=w7, "Number of Samples is Finite"=FALSE, "Sample Rate [S/s]"=$"TX.Sample Rate [S/s]", "Number of Samples"=w15, "Start Trigger"="Software") -> (instance out=w17)
  w18 = "RX2"  # Antenna RF 1
  w19 = T23 {"Antenna RF 0"="RX2", "Frequency RF 0 [Hz]"=1990000000, "LO Frequency RF 0 [Hz]"=-1, "Reference Level RF 0 [dBm]"=0}
  Property Node(instance in=w19, "Antenna RF 0"=w18, "Frequency RF 0 [Hz]"=$"RX.Frequency [Hz]", "LO Frequency RF 0 [Hz]"=-1, "Reference Level RF 0 [dBm]"=0) -> (instance out=w20)
  w21 = T25 {"rf enable 0"=FALSE, "rf config 0"={"Antenna RF 0"="RX2", "Frequency RF 0 [Hz]"=1990000000, "LO Frequency RF 0 [Hz]"=-1, "Reference Level RF 0 [dBm]"=0}, "rf enable 1"=TRUE, "rf config 1"={"Antenna RF 1"="RX2", "Frequency RF 1 [Hz]"=2180000000, "LO Frequency RF 1 [Hz]"=-1, "Reference Level RF 1 [dBm]"=0}, "Number of Samples is Finite"=FALSE, "Sample Rate [S/s]"=20000000, "Number of Samples"=32000, "Start Trigger"="Immediate"}
  Property Node(instance in=w21, "rf enable 0"=TRUE, "rf config 0"=w20, "rf enable 1"=TRUE, "rf config 1"=w20, "Number of Samples is Finite"=FALSE, "Sample Rate [S/s]"=$"RX.Sample Rate [S/s]", "Number of Samples"=w15, "Start Trigger"="Immediate") -> (instance out=w22)
  call "Open and Configure Device.gvi"(FPGA in=w6, usrp rio device=$"USRP RIO device", reference frequency source=$"Reference Frequency Source", error in=w5, rx config=w22, tx config=w17) -> (niusrprio session=w23, rx.coerced configurations=w24, tx.coerced configurations=w25, error out=w26, rx channels=w27, tx channels=w28)
  call "Preset K+M set.gvi"(No DC=$"RM:No DC", M=w9, K=w8) -> (M_set=w29, K_set=w30)
  Boolean To Integer(Boolean=$"Use Phase Tracking") -> (0, 1=w31)
  call "ResourceMapperOptimization.gvi"(K_set=w30, M_set=w29, PayloadSize [Byte]=$"PayloadSize [Byte]", ControlSize [Symbol]=w31, K=w8, M=w9, Replace Control with Pilots=$"Use Phase Tracking") -> (R_MAP=w32, N_Blocks [Blocks]=w33, N_DataSym_per_block [Symbol]=w34, K_set_out=w35, M_set_out=w36, InsufficientResources=w37, CanNotFit=w38, N_UsedResources [Byte]=w39)
  call "Initiate and Generate (Single).gvi"(niusrprio session=w23, first iteration=TRUE, error in=w26, tx channels=w28) -> (niusrprio session 2=w40, error out=w41)
  Property Node(instance in=w40) -> ("FPGA Interface"=w42, instance out=w43)
  call "Initiate and Fetch (Single).gvi"(niusrprio session=w43, first iteration=TRUE, error in=w41, rx channels=w27) -> (niusrprio session 2=w44, error out=w45)
  Dynamic Fpga Interface Cast(reference in=w42, type="FPGA interface.gtype" constant) -> (reference out=w46)
  Is Equal(x=w33, y=1) -> w47
  Logical Or(not w47, w38, w37) -> w48
  Select(s=w48, t=error {"status"=TRUE, "code"=1, "source"="RM fault!"}, f=no error) -> w49
  Merge Errors(w45, w49) -> (error out=w50)
  call "Configure FIFOs.gvi"(FPGA interface in=w46, error in=w50, UseCAPIData=$UseCAPIData) -> (FPGA interface out=w51, error out=w52)
  case (w52) {
    frame No Error, Default {
      call "GFDM_Xcvr_configure FPGA.gvi"(FPGA interface in=w51, Error=w52, GFDM parameter=$"GFDM parameter", TX.Encoder.packet length(Byte,N/8)=w39, Kset_in=w35, Preamble path=$"Preamble path", Preamble mode=$"Preamble mode", preamble scale=$"preamble scale") -> (FPGA interface out=w56, Error out=w57, GFDM all parameters=w58)
      call "RM config.gvi"(FPGA interface in=w56, R_MAP=w32, error in=w57) -> (Error=w59)
      w60 = $"PayloadSize [Byte]"
      w61 = $"PayloadSize [Byte]"
      case ($UseCAPIData) {
        frame True { }
        frame False {
          s1 = w59  # shift register
          while (iteration -> i1) {
            Wait[Units=Microseconds](time to wait=100)
            case ($"Read UDP?") {
              frame False, Default {
                call "create ramp.gvi"(length=w60) -> (data in=w64)
                w62 = default
                w63 = default
                w65 = s1
              }
              frame True {
                call "UDP read.gvi"(UDP connection=w2, Error=s1) -> (receive FIFO full=w62, data out=w64, UDP receive error=w63, error out=w65)
              }
            }
            Array Size(array=w64) -> (size(s)=w66)
            $"UDP packet size [byte]" <- w66
            $"UDP receive FIFO full" <- w62
            case ($"Add frame counter") {
              frame False, Default {
                w67 = w64
              }
              frame True {
                call "TX packet generator.gvi"(input data=w64, packet_counter=i1, gfdm block size[byte]=w60, overhead[byte]]=7) -> (payload=w68, split at=w69, generated length=w70, gfdm data=w67, gfdm blocks needed=w71)
                $"GFDM block payload size [byte]" <- w68
                $"half of the payload [byte]" <- w69
                $"transmission frame size [byte]" <- w70
                $"Number of GFDM blocks" <- w71
              }
            }
            $"TX byte" <- w67
            $"UDP receive error" <- w63
            Host Fifo Write Node[FifoName="Needed Resources.grsc\\TX.data in.H2T"](data=w67, error in=w65, reference in=w56) -> (error out=w72)
            next s1 = w72
            stop if $stop
          }
          s2 = 0  # shift register
          while {
            Host Fifo Read Node[FifoName="Needed Resources.grsc\\RX.Data out.T2H"](error in=w59, number of elements=0, reference in=w56) -> (elements remaining=w73, error out=w74, reference out=w75)
            Is Not Equal To 0(x=w73) -> w76
            case (w76) {
              frame False, Default {
                w77 = s2
              }
              frame True {
                case ($"Add frame counter") {
                  frame True {
                    call "receive packet.gvi"(packet size[byte]=$"UDP packet size [byte]", payload=$"GFDM block payload size [byte]", split at_in=$"half of the payload [byte]", gfdm block size[byte]_in=w61, gfdm blocks needed_in=$"Number of GFDM blocks", Error_in=w74, stop=$stop, timeout in milliseconds_in=5000, FPGA reference in=w75) -> (packet_out=w78, error in=w79, frame counter=w80)
                  }
                  frame False {
                    Host Fifo Read Node[FifoName="Needed Resources.grsc\\RX.Data out.T2H"](error in=w74, number of elements=w61, reference in=w75) -> (data=w78, error out=w79)
                    w80 = default
                  }
                }
                $"Received Bytes" <- w78
                Type Cast(type=string EmptyString, x=w78) -> w81
                $"Decoder byte out" <- w81
                $"packet counter" <- w80
                call "UDP send.gvi"(UDP send.port or service name=$"UDP send port", Input=w3, Array=w78, Error=w79)
                call "Decode angle.gvi"(error out=w79, output=w81) -> (description=w82, current angle=w83, angle over time=w84)
                $"UDP send error" <- w82
                $"current angle" <- w83
                $"angle over time" <- w84
                Increment(x=s2) -> w77
                $"received packets" <- w77
              }
            }
            Wait[Units=Microseconds](time to wait=100)
            next s2 = w77
            stop if $stop
          }
        }
      }
      Property Node(instance in=w58) -> ("Modem Configuration:Super frame length"=w85)
      while {
        Host Fifo Read Node[FifoName="Needed Resources.grsc\\TX.Debug.frame out"](error in=w59, number of elements=0, reference in=w56) -> (elements remaining=w86, error out=w87, reference out=w88)
        Is Not Equal To 0(x=w86) -> w89
        case (w89) {
          frame False, Default { }
          frame True {
            call "Blocks in FIFO.gvi"(requested lenght=w85, number of elements in FIFO=w86) -> (number of elements=w90)
            Host Fifo Read Node[FifoName="Needed Resources.grsc\\TX.Debug.frame out"](error in=w87, number of elements=w90, reference in=w88) -> (error out=w91, reference out=w92)
            Host Fifo Read Node[FifoName="Needed Resources.grsc\\TX.Debug.frame out"](error in=w91, number of elements=w85, reference in=w92) -> (data=w93)
            call "u32 array to 2.14 CFX.gvi"(data=w93) -> (Array=w94)
            Complex To Real Imaginary(x + iy=w94) -> (x=w95, y=w96)
            Absolute Value(x=w94) -> w97
            Build Array(w95, w96, w97) -> w98
            $"TX signal" <- w98
          }
        }
        Wait[Units=Microseconds](time to wait=100)
        stop if $stop
      }
      Property Node(instance in=w58) -> ("Preamble"=w99)
      Array Size(array=w99) -> (size(s)=w100)
      Initialize Array(element=0, size=10) -> w101
      s3 = 0  # shift register
      s4 = w101  # shift register
      while {
        Host Fifo Write Node[FifoName="Needed Resources.grsc\\RX.channel Coefficients in"](data=u64[] [], error in=w59, reference in=w56) -> (empty elements remaining=w102)
        $"empty elements remaining" <- w102
        Wait[Units=Microseconds](time to wait=100)
        call "Preamble data available.gvi"(FPGA.Interface_in=w56, Error_in=w59, length=w100) -> (FPGA.Interface_out=w103, Error_out=w104, Data available=w105)
        case (w105) {
          frame False, Default {
            w106 = s3
            w107 = default
            w108 = s4
          }
          frame True {
            Host Fifo Read Node[FifoName="Needed Resources.grsc\\RX.Preamble out"](error in=w104, number of elements=w100, reference in=w103) -> (data=w109, error out=w110, reference out=w111)
            call "u32 4.12 CFX to CDB array.gvi"(appended array=w109) -> (x=w112)
            call "RMS (CDB).gvi"(x=w112) -> (rms value=w113)
            Replace Array Subset(inArray=s4, index=_, new=w113) -> w114
            Rotate 1D Array(array=w114, n=1) -> (array (last n elements first)=w108)
            Add Array Elements(numeric array=w108) -> (sum=w115)
            Array Size(array=w108) -> (size(s)=w116)
            Divide(x=w115, y=w116) -> w117
            Logarithm Base 10(x=w117) -> w118
            Multiply(w118, 10) -> w119
            $"Preamble Power_Host Chart" <- w119
            $"Preamble Power_Host" <- w119
            Property Node(instance in=w58) -> ("Preamble"=w120, "Modem Configuration:N"=w121, "Sync config:Preamble K"=w122)
            call "norm CFX.gvi"(Input=w112) -> (Output=w123)
            call "norm CFX.gvi"(Input=w120) -> (Output=w124)
            call "Channel Estimation.gvi"(Rx signal=w123, Preamble=w124, Channel Length=$"Channel Length", preamble FFT size=w122, index=0, data FFT size=w121) -> (Channel Freq. Resp.=w125)
            Array Size(array=w125) -> (size(s)=w126)
            Is Equal(x=w126, y=w121) -> w107
            case (w107) {
              frame False, Default {
                w106 = s3
              }
              frame True {
                Reciprocal(x=w125) -> w127
                call "CDB array to 2.14 FXP u32.gvi"(input=w127) -> (output=w128)
                for (iteration -> i2) {
                  w129 = each element of w128
                  Join Numbers(high(x)=i2, low(x)=w129) -> w131
                  append w131 to w130
                }
                Host Fifo Write Node[FifoName="Needed Resources.grsc\\RX.channel Coefficients in"](data=w130, error in=w110, reference in=w111)
                Increment(x=s3) -> w106
              }
            }
            $"rms value" <- w113
            Is Equal(x=$Operation, y=3) -> w132
            case (w132) {
              frame False, Default { }
              frame True {
                Build Array(w123, w124) -> w133
                Absolute Value(x=w133) -> w134
                $preamble <- w134
                $"Channel Freq. Resp." <- w125
                Absolute Value(x=w125) -> w135
                Complex To Polar(r * e^(i*theta)=w125) -> (theta=w136)
                Build Array(w135, w136) -> w137
                $"channel freq domain" <- w137
                call "Inverse Complex FFT.gvi"(FFT{x}=w125) -> (x=w138)
                Complex To Polar(r * e^(i*theta)=w138) -> (theta=w139)
                Absolute Value(x=w138) -> w140
                Build Array(w140, w139) -> w141
                $"channel time domain" <- w141
                $"Number of channel coefficients update" <- s3
              }
            }
          }
        }
        $"Update of channel coefficients" <- w107
        next s3 = w106
        next s4 = w108
        stop if $stop
      }
      while {
        Property Node(instance in=w56, error in=w59) -> ("rx.number of overflows"=w142, "rx.output sample rate"=w143, "RX.sync.DEBUG.counter_out"=w144, "rx 1.number of IQ data overflows"=w145, "rx 0.number of IQ data overflows"=w146, "rx.samples processed"=w147, "rx.samples to acquire"=w148, "rx.state"=w149, "tx 0.number of IQ data overflows"=w150, "tx 1.number of IQ data overflows"=w151, "tx.input sample rate"=w152, "TX.modem.DEBUG.cluster_out"=w153, "tx.state"=w154, "tx.underflows"=w155, "RX.sync.preambleEnd"=w156, "RX.sync.preambleStart"=w157, "RX.sync.symbolEnd"=w158, "RX.sync.symbolStart"=w159, "RX.sync.sync found_out"=w160, "RX.sync.number of packets in"=w161, "RX.sync.number of samples in"=w162, "TX.modem.configuration_in"=w163, "RX.sync.GFDM configuration cluster"=w164, "RX.modem.DEBUG.cluster_out"=w165, "UART.status"=w166, "RM properties"=w167, "RX.RM.debug counter_out"=w168, error out=w169, instance out=w170)
        $"rx.number of overflows" <- w142
        $"rx.output sample rate" <- w143
        Property Node(instance in=w58) -> ("Modem Configuration:N"=w171)
        Property Node(instance in=w170, "RX.sync.length"=100, "Sync Configuration Cluster"=$"Sync Configuration Cluster", "TX.modem.bitshift_in"=$"TX.modem.bitshift_in", "TX.automatic trigger_in"=$"TX.automatic trigger_in", "RX.sync.use received data"=TRUE, "RX.switch channels"=$"RX.switch channels", "RX.equ.shift"=1, "RX.modem.bitshift_in"=$"RX.modem.bitshift_in", "RX.modem.fft.bitshift_in"=$"RX.modem.fft.bitshift_in", "RX.Encoder.shift"=0, "RX.Encoder.Switch I and Q"=FALSE, "RX.input delay"=1, "TX.Encoder.shift"=0, "TX.Encoder.Switch I and Q"=FALSE, "RX.sync.input enable_in"=$"RX.enable", "TX.modem.trigger limit"=$"TX.modem.transmission time interval", "TX.modem.enabled"=TRUE, "TX.modem.force transmission"=FALSE, "TX.encoder.enabled"=$"TX.enabled", "TX.encoder.force"=FALSE, "TX.encoder.threshold"=w171, "UART.control"=$"UART.control", "D2through9"=255, "Data Routing"=$"Data Routing", "rssi.time constant"=$"RX.rssi.time constant", "RX.Sync.rssi.time constant"=$"RX.Sync.rssi.time constant", error in=w169) -> (error out=w54, instance out=w53)
        call "Display Error.gvi"(type of dialog="no dialog", error in=w54) -> (description=w172)
        $"general error description" <- w172
        $"RX.sync.DEBUG.counter_out" <- w144
        $"rx 1.number of IQ data overflows" <- w145
        $"rx 0.number of IQ data overflows" <- w146
        $"rx.samples processed" <- w147
        $"rx.samples to acquire" <- w148
        $"rx.state" <- w149
        $"tx 0.number of IQ data overflows" <- w150
        $"tx 1.number of IQ data overflows" <- w151
        $"tx.input sample rate" <- w152
        $"TX.modem.DEBUG.cluster_out" <- w153
        $"tx.RF.state" <- w154
        $"tx.underflows" <- w155
        $"RX.sync.preambleEnd" <- w156
        $"RX.sync.preambleStart" <- w157
        $"RX.sync.symbolEnd" <- w158
        $"RX.sync.symbolStart" <- w159
        $"RX.sync.sync found_out" <- w160
        $"RX.sync.number of packets in" <- w161
        Wait(time to wait=10)
        $"RX.sync.number of samples in" <- w162
        $"FPGA configuration" <- w163
        $"RX.sync.GFDM configuration cluster" <- w164
        $"RX.modem.DEBUG.cluster_out" <- w165
        $"UART.status" <- w166
        $"RM properties" <- w167
        $"RX.RM.debug counter_out" <- w168
        Divide(x=$"TX.modem.transmission time interval", y=180000000) -> w173
        $"transmission interval [s]" <- w173
        stop if $stop
      }
      call "Display Error.gvi"(type of dialog="no dialog", error in=w59) -> (description=w174)
      $"general error description" <- w174
      while {
        Wait[Units=Microseconds](time to wait=100)
        Property Node(instance in=w56, error in=w59) -> ("rssi.log power"=w175, "rssi.valid"=w176, "RX.Sync.rssi.log power"=w177, "RX.sync.sync found_out"=w178)
        Select(s=FALSE, t=$"Overall AGC", f=0) -> w179
        case (w176) {
          frame False, Default { }
          frame True {
            Subtract(x=w175, y=w179) -> w180
            $"RF Power" <- w180
            $"rssi.log power" <- w180
          }
        }
        Feedback Node(input=w177) -> w181
        Is Not Equal(x=w177, y=w181) -> w182
        case (w182) {
          frame False, Default { }
          frame True {
            Subtract(x=w177, y=w179) -> w183
            $"Preamble Power" <- w183
            $"RX.Sync.rssi.log power" <- w183
          }
        }
        # Transmission still running?
        Feedback Node(input=w178) -> w184
        Is Not Equal(x=w178, y=w184) -> w185
        Feedback Node(input=w186) -> w187
        case (w185) {
          frame False, Default {
            Increment(x=w187) -> w186
          }
          frame True {
            w186 = 0
          }
        }
        Is Less(x=w186, y=1000) -> w188
        $"Sync working" <- w188
        stop if $stop
      }
      s5 = 0  # shift register
      s6 = 0  # shift register
      s7 = w59  # shift register
      while (iteration -> i3) {
        call "Power adaption.gvi"(power measurement_in=$"RX.Sync.rssi.log power", expected signal range lower bound=$"expected signal range lower bound", expected signal range upper bound=$"expected signal range upper bound", gain in=s6) -> (gain_out=w189)
        Divide(x=$"Cycles without transmission", y=14) -> w190
        Add($"Minimum Receive Power", w190) -> w191
        Add(10, w191) -> w192
        call "Power adaption.gvi"(power measurement_in=$"rssi.log power", expected signal range lower bound=w191, expected signal range upper bound=w192, gain in=s5) -> (gain_out=w193)
        case ($"Fixed Gain Setting") {
          frame True {
            w194 = w193
            w195 = w189
            w196 = $"gain in"
          }
          frame False {
            Feedback Node(initial value="Initial Sync", input=w197) -> w198
            case (w198) {
              frame "Initial Sync", Default {
                $"Minimum Receive Power" <- $"rssi.log power"
                Select(s=$"Sync working", t="Few Packets Found", f=w198) -> w197
                w194 = w193
                w195 = w189
                w196 = w193
              }
              frame "No Transmission" {
                Increment(x=$"Cycles without transmission") -> w199
                $"Cycles without transmission" <- w199
                Select(s=$"Sync working", t="Few Packets Found", f=w198) -> w197
                w194 = w193
                w195 = w189
                w196 = w193
              }
              frame "Few Packets Found" {
                $"Cycles without transmission" <- 0
                w194 = w193
                w195 = w193
                w196 = w193
                w197 = "Transmission running"
              }
              frame "Transmission running" {
                Quotient And Remainder(x=i3, y=1000) -> (x-y*floor(x/y)=w200)
                Is Equal To 0(x=w200) -> w201
                case (w201) {
                  frame False, Default {
                    w195 = w189
                  }
                  frame True {
                    # Small adjustmentsIn case Synch is clipping or to small
                    # we reduce on increase AGC by  .5 dB
                    call "Power adaption.gvi"(power measurement_in=$"Preamble Power_Host", expected signal range lower bound=-12, expected signal range upper bound=-10, gain in=w189) -> (gain_out=w195)
                  }
                }
                Select(s=$"Sync working", t=w198, f="Transmission stopped") -> w197
                w194 = w193
                w196 = w195
              }
              frame "Transmission stopped" {
                w194 = w189
                w195 = w189
                w196 = w189
                w197 = "No Transmission"
              }
            }
            $"AGC state" <- w197
          }
        }
        call "Apply AGC Setting.gvi"(gain in=w196) -> (digital gain_out=w202, gain_out=w203)
        $"RX digital gain" <- w202
        $"RX digital gain_out" <- w202
        Property Node(instance in=w56, "RX.sync.shift"=w202, error in=s7) -> (error out=w204)
        call "niUsrpRio Config v1 Host.lvlib__Configure Gain.gvi"(niusrprio session in=w44, gain=w203, error in=w204, scope="rx") -> (coerced gain=w205, error out=w206)
        $"RF gain_out" <- w205
        $"RF RX power setting" <- w205
        $"Overall AGC setting" <- w196
        $"Overall AGC" <- w196
        Wait(time to wait=$"AGC.milliseconds to wait")
        next s5 = w194
        next s6 = w195
        next s7 = w206
        stop if $stop
      }
      $"Minimum Receive Power" <- -35
      while {
        Host Fifo Read Node[FifoName="Needed Resources.grsc\\RX.sync.correlation metric"](error in=w59, number of elements=0, reference in=w56) -> (elements remaining=w207, error out=w208, reference out=w209)
        Is Equal(x=$Operation, y=3) -> w210
        Is Greater(x=w207, y=20000) -> w211
        Logical And(w210, w211) -> w212
        case (w212) {
          frame False, Default { }
          frame True {
            call "Blocks in FIFO.gvi"(requested lenght=20000, number of elements in FIFO=w207) -> (number of elements=w213)
            Host Fifo Read Node[FifoName="Needed Resources.grsc\\RX.sync.correlation metric"](error in=w208, number of elements=w213, reference in=w209) -> (elements remaining=w214, error out=w215, reference out=w216)
            Host Fifo Read Node[FifoName="Needed Resources.grsc\\RX.sync.correlation metric"](error in=w215, number of elements=w214, reference in=w216) -> (data=w217)
            Split Number(x=w217) -> (high(x)=w218, low(x)=w219)
            Split Number(x=w218) -> (high(x)=w220, low(x)=w221)
            Reinterpret Number[RestrictToSameWordLength=True](data in=w220) -> (data out=w222: UFXP(2.14)[])
            Reinterpret Number[RestrictToSameWordLength=True](data in=w221) -> (data out=w223: UFXP(4.12)[])
            Split Number(x=w219) -> (high(x)=w224, low(x)=w225)
            Reinterpret Number[RestrictToSameWordLength=True](data in=w224) -> (data out=w226: UFXP(2.14)[])
            Split Number(x=w225) -> (high(x)=w227, low(x)=w228)
            Reinterpret Number[RestrictToSameWordLength=True](data in=w227) -> (data out=w229: UFXP(1.7)[])
            Reinterpret Number[RestrictToSameWordLength=True](data in=w228) -> (data out=w230: UFXP(2.6)[])
            Build Array(w222, w223, w226, w229, w230) -> w231
            $"correlation metric" <- w231
          }
        }
        Wait(time to wait=10)
        stop if $stop
      }
      while {
        Host Fifo Read Node[FifoName="Needed Resources.grsc\\RX.Debug.Modem_64 bit samples out"](error in=w59, number of elements=0, reference in=w56) -> (elements remaining=w232, error out=w233, reference out=w234)
        Host Fifo Read Node[FifoName="Needed Resources.grsc\\RX.Debug.Modem_32 bit samples out"](error in=w59, number of elements=0, reference in=w56) -> (elements remaining=w235, error out=w236, reference out=w237)
        Is Not Equal To 0(x=w232) -> w238
        Is Not Equal To 0(x=w235) -> w239
        Logical And(w238, w239) -> w240
        case (w240) {
          frame False, Default { }
          frame True {
            Host Fifo Read Node[FifoName="Needed Resources.grsc\\RX.Debug.Modem_64 bit samples out"](error in=w233, number of elements=w232, reference in=w234) -> (data=w241)
            Split Number(x=w241) -> (high(x)=w242, low(x)=w243)
            Is Equal(x=$Operation, y=0) -> w244
            case (w244) {
              frame False, Default { }
              frame True {
                call "Calculate Pilot Results.gvi"(received pilot array=w242) -> (Pilot-Betrag=w245, Pilot-Phase=w246)
                $"Pilot-Betrag" <- w245
                $"Pilot-Phase" <- w246
              }
            }
            call "u32 array to 2.14 CFX.gvi"(data=w243) -> (Array=w247)
            Is Equal(x=$Operation, y=4) -> w248
            case (w248) {
              frame False, Default { }
              frame True {
                Complex To Real Imaginary(x + iy=w247) -> (x=w249, y=w250)
                $RE_data <- w249
                $IM_data <- w250
              }
            }
            Host Fifo Read Node[FifoName="Needed Resources.grsc\\RX.Debug.Modem_32 bit samples out"](error in=w236, number of elements=w235, reference in=w237) -> (data=w251)
            call "u32 array to 2.14 CFX.gvi"(data=w251) -> (Array=w252)
            Is Equal(x=$Operation, y=0) -> w253
            case (w253) {
              frame False, Default { }
              frame True {
                Build Array(w247, w252) -> w254
                $IQ <- w254
              }
            }
          }
        }
        Wait[Units=Microseconds](time to wait=1000)
        stop if $stop
      }
      w55 = w23
    }
    frame Error {
      call "Display Error.gvi"(type of dialog="no dialog", error in=w52) -> (description=w255)
      $"general error description" <- w255
      w53 = w51
      w54 = w52
      w55 = w23
    }
  }
  case (w54) {
    frame No Error, Default { }
    frame Error {
      $stop <- FALSE
    }
  }
  call "stop FIFOs.gvi"(FPGA interface in=w53, Error=w54) -> (error in=w256)
  call "Close Device.gvi"(niusrprio session=w55, error in=w256) -> (error out=w257)
  call "Display Error.gvi"(type of dialog="no dialog", error in=w257) -> (description=w258)
  $"general error description" <- w258
  $"RX Coerced Configurations" <- w24
  $"TX Coerced Configurations" <- w25
  $M_set <- w36
  $K_set <- w35
