vi "Apply AGC Setting_2.gvi"   [LabVIEW Communications System Design Suite 2.0.1]
inputs:
  "gain in": f64  # Current gain, in dB, applied to the RX port.
outputs:
  "digital gain_out": f64
  "gain_out": f64
diagram:
  Subtract(x=$"gain in", y=37.5) -> w1
  Divide(x=w1, y=6) -> w2
  In Range And Coerce(lower limit=0, upper limit=12, x=w2) -> (coerced(x)=w3)
  Is Not Equal To 0(x=w3) -> w4
  case (w4) {
    frame False, Default {
      w5 = $"gain in"
      w6 = w3
    }
    frame True {
      Round Toward Positive Infinity(x=w3) -> w6
      Multiply(6, w6) -> w7
      Subtract(x=$"gain in", y=w7) -> w5
    }
  }
  In Range And Coerce(lower limit=0, upper limit=37.5, x=w5) -> (coerced(x)=w8)
  $gain_out <- w8
  $"digital gain_out" <- w6
