vi "LTE Control Power Gain.gvi"   [LabVIEW Communications System Design Suite 2.0.1]
# Converts the measured baseband input power into a logarithmic value and checks if this power level is within the desired range.
# Otherwise, the configured RX gain value is increased or decreased by 0.5 dB.
inputs:
  "expected signal range lower bound": f64 = -17  # Lower bound of the baseband input power control range.
  "use manual gain": bool  # If enabled, the calculated gain is be provided as gain output and the manual gain value [dB] value is used instead.
  "BB input power": f64  # BB input power measured on the FPGA
  "gain in": f64  # Current gain, in dB, applied to the RX port.
  "manual gain value [dB]": f64  # Manual gain value, in dB, to be applied for the RX port.
  "expected signal range upper bound": f64 = -15  # Upper bound of the baseband input power control range.
  "power calibration offset [dB]": f64  # Frequency-dependent power offset that is applied to the calculation of the RF input power.
outputs:
  "RF input power [dBm]": f64  # Calculated RF input power at the RX antenna based on measured baseband power, the provided power calibration offset, and the current gain.
  "power [dBFS]": f64  # Logarithmic baseband input power value, in dBFS.
  "gain out": f64  # Calculated RX gain output, in dB.
  "in range?": bool  # Indicates that the measured baseband input power is already within the desired range. The calculated output should be equal to the gain in value if manual gain is disabled.
diagram:
  # power in dBFS
  Logarithm Base 10(x=$"BB input power") -> w1
  Multiply(10, w1) -> w2
  # Expected signal range
  # in dBFS to cope with
  # PAPR of signal
  In Range And Coerce(lower limit=$"expected signal range lower bound", upper limit=$"expected signal range upper bound", x=w2) -> (In Range?=w3)
  Is Greater(x=w2, y=$"expected signal range upper bound") -> w4
  Subtract(x=$"gain in", y=0.5) -> w5
  Add($"gain in", 0.5) -> w6
  Select(s=w4, t=w5, f=w6) -> w7
  Select(s=w3, t=$"gain in", f=w7) -> w8
  In Range And Coerce(lower limit=0, upper limit=37.5, x=w8) -> (coerced(x)=w9)
  Select(s=$"use manual gain", t=$"manual gain value [dB]", f=w9) -> w10
  $"gain out" <- w10
  $"in range?" <- w3
  $"power [dBFS]" <- w2
  Add(w2, $"power calibration offset [dB]") -> w11
  Subtract(x=w11, y=$"gain in") -> w12
  $"RF input power [dBm]" <- w12
