vi "Power adaption.gvi"   [LabVIEW Communications System Design Suite 2.0.1]
inputs:
  "power measurement_in": f64
  "expected signal range lower bound": f64 = -17  # Lower bound of the baseband input power control range.
  "expected signal range upper bound": f64 = -15  # Upper bound of the baseband input power control range.
  "gain in": f64  # Current gain, in dB, applied to the RX port.
outputs:
  "gain_out": f64
  "in range?": bool
diagram:
  In Range And Coerce(lower limit=$"expected signal range lower bound", upper limit=$"expected signal range upper bound", x=$"power measurement_in") -> (In Range?=w1)
  Is Greater(x=$"power measurement_in", y=$"expected signal range upper bound") -> w2
  Subtract(x=$"gain in", y=0.5) -> w3
  Add($"gain in", 0.5) -> w4
  Select(s=w2, t=w3, f=w4) -> w5
  Select(s=w1, t=$"gain in", f=w5) -> w6
  In Range And Coerce(lower limit=0, upper limit=109.5, x=w6) -> (coerced(x)=w7)
  $gain_out <- w7
  $"in range?" <- w1
