vi "CE_configChennalEstimation.gvi"   [LabVIEW Communications System Design Suite 2.0.1]
inputs:
  "FPGA interface_in": "FPGA interface.gtype"
  "GFDM all parameters": "GFDM all parameters.gtype"
  "Error_in": error
  "configChEst": T3
outputs:
  "FPGA.Interface_out": "FPGA interface.gtype"
  "GFDM all parameters out": "GFDM all parameters.gtype"
  "Error_2": error
  "ChannelEstParamOut": cluster{"control": T4, "config": T5}
panel controls:
  "Dummy": cluster{"control": T4, "config": T5}
types:
  "GFDM parameter.gtype" = cluster{"Variable: K": i32, "Variable: M": i32, "Variable: a": f64, "filter type": enum{"rc", "rect"}, "receive filter": enum{"MF", "ZF"}, "inverse FFT": bool, "Variable: b": f64, "Ncs": u16, "Ncp": u16}
  T1 = cluster{"Preamble mu": u16, "GFDM B": u16, "Preamble K": u16, "Preamble Ncp": u16, "GFDM Ncp": u16, "GFDM M": u16, "Preamble Ncs": u16, "GFDM K": u16, "GFDM Ncs": u16, "Preamble M": u16}
  "modem_configuration.gtype" = cluster{"K-1": u16, "M-1": u8, "N-1": u16, "N": u16, "Npreamble+CP+CS": u16, "Npreamble": u16, "Nw": u16, "Modulator MUX config": u64[16], "K": u16, "fft_size_log2(K)": u8, "inverse_fft": bool, "Start with preamble": bool, "Burstmode": bool, "Ncs": u16, "Ncp": u16, "N-Ncp": u16, "N+Ncp": u16, "N+Ncp+Ncs": u16, "Demodulator MUX config": u64[16], "M": u8, "DFT SIZE": FXP(6.0), "Frame length": u32, "Super frame length": u32, "Ns_all_GFDM_blocks": u32, "Ns_all_preambles": u32}
  T2 = cluster{"amount of symbols": u16[], "data elements [bits]": u16, "payload [bits]": f64, "payload [bytes]": f64, "half payload [byte]": f64}
  "GFDM all parameters.gtype" = cluster{"GFDM parameter": "GFDM parameter.gtype", "Sync config": T1, "Modem Configuration": "modem_configuration.gtype", "Preamble with CP, CS": c128[], "Preamble": c128[], "receiver filter gamma": c128[], "pulse shaping filter g": c128[], "rising window": c128[], "channel coefficients": c128[], "resource map as vector": enum{"Null", "Pilot", "Data"}[], "Pilots": c128[], "packet length": T2}
  T3 = cluster{"L.ch.1": u16, "L.ch.2": u16, "shiftFactorDft": i16}
  T4 = cluster{"config!": bool, "reset!": bool, "active!": bool}
  T5 = cluster{"NpayIsPowerOfTwo": bool, "KpreIsPowerOfTwo": bool, "Npay": u16, "Kpre": u16, "log2(Npay) or DftSizeIndex": u8, "B": u16, "log2(Kpre) or DftSizeIndex": u8, "L.ch.1": u16, "L.ch.2": u16, "shiftFactorDft": i16, "DftLatency": u16}
uses:
  NI::Analysis::Transforms::Complex FFT.gvi
diagram:
  Property Node(instance in=$"GFDM all parameters") -> ("Sync config"=w1, "Preamble"=w2, instance out=w3)
  $"GFDM all parameters out" <- w3
  Property Node(instance in=w1) -> ("GFDM B"=w4, "GFDM K"=w5, "GFDM M"=w6, "Preamble K"=w7, instance out=w8)
  Array Subset(array=w2, length0=64) -> w9
  call "norm CFX.gvi"(Input=w9) -> (Output=w10)
  To Complex Fixed Point(number=w10) -> w11: CFXP(1.15)[] Saturate:ConvergentRounding
  Complex To Real Imaginary(x + iy=w11) -> (x=w12, y=w13)
  Reinterpret Number[RestrictToSameWordLength=True](data in=w12) -> (data out=w14: FXP(4.12)[])
  Reinterpret Number[RestrictToSameWordLength=True](data in=w13) -> (data out=w15: FXP(4.12)[])
  Real And Imaginary To Complex(x=w14, y=w15) -> w16
  Property Node(instance in=$configChEst) -> ("L.ch.1"=w17, "L.ch.2"=w18, "shiftFactorDft"=w19)
  Multiply(w5, w6) -> w20
  call "CE_getDftSizeIndex.gvi"(SizeIn=w20) -> (DftSizeIndexOut=w21)
  Logarithm Base 2(x=w7) -> w22
  To Unsigned Byte Integer(number=w22) -> w23
  call "CE_getDftLatency.gvi"(DftSizeIndexIn=w21) -> (dftLatencyOut=w24)
  Subtract(x=w24, y=0) -> w25
  Property Node(instance in=T5 {all zero or empty}, "NpayIsPowerOfTwo"=FALSE, "KpreIsPowerOfTwo"=TRUE, "Npay"=w20, "Kpre"=w7, "log2(Npay) or DftSizeIndex"=w21, "B"=w4, "log2(Kpre) or DftSizeIndex"=w23, "L.ch.1"=w17, "L.ch.2"=w18, "shiftFactorDft"=w19, "DftLatency"=w25) -> (instance out=w26)
  Property Node(instance in=$Dummy, "config"=w26) -> (instance out=w27)
  sequence (after w8) {
    frame 0 {
      Property Node(instance in=$"FPGA interface_in", "ChEst.Parameters"=w27, error in=$Error_in) -> (error out=w28, instance out=w29)
    }
    frame 1 {
      Property Node(instance in=w27, "control"=T4 {"config!"=FALSE, "reset!"=TRUE, "active!"=FALSE}) -> (instance out=w30)
      Property Node(instance in=w29, "ChEst.Parameters"=w30, error in=w28) -> (error out=w31, instance out=w32)
      Wait(time to wait=5)
    }
    frame 2 {
      Property Node(instance in=w30, "control"=T4 {"config!"=TRUE, "reset!"=FALSE, "active!"=FALSE}) -> (instance out=w33)
      Property Node(instance in=w32, "ChEst.Parameters"=w33, error in=w31) -> (error out=w34, instance out=w35)
      while {
        Property Node(instance in=w35, error in=w34) -> ("ChEst.readyForConfig"=w36, error out=w37, instance out=w38)
        stop if w36
      }
      Wait(time to wait=10)
    }
    frame 3 {
      call "Complex FFT.gvi"(x=w16) -> (FFT{x}=w39)
      Reciprocal(x=w39) -> w40
      call "norm CDB.gvi"(Array=w40) -> (out=w41)
      call "CDB to 1.15 CFP U32.gvi"(arrayIn=w41) -> (arrayOut=w42)
      for (iteration -> i1) {
        w43 = each element of w42
        while {
          Wait(time to wait=1)
          To Unsigned Word Integer(number=i1) -> w44
          Join Numbers(high(x)=w44, low(x)=1) -> w45
          Join Numbers(high(x)=w43, low(x)=w45) -> w46
          Property Node(instance in=w38, "ChEst.configDataIn"=w46, error in=w37) -> ("ChEst.configDataOut"=w47, error out=w48, instance out=w49)
          Is Equal(x=w47, y=w46) -> w50
          stop if w50
        }
      }
      Property Node(instance in=w49, "ChEst.configDataIn"=0, error in=w48) -> (error out=w51, instance out=w52)
    }
    frame 4 {
      Property Node(instance in=w33, "control"=T4 {"config!"=FALSE, "reset!"=FALSE, "active!"=TRUE}) -> (instance out=w53)
      Property Node(instance in=w52, "ChEst.Parameters"=w53, error in=w51) -> (error out=w54, instance out=w55)
      Wait(time to wait=10)
    }
  }
  $"FPGA.Interface_out" <- w55
  $Error_2 <- w54
  $ChannelEstParamOut <- w53
  Multiply(w7, 2)
