vi "BitArray2ByteArray.gvi"   [LabVIEW Communications System Design Suite 2.0.1]
inputs:
  "bits in": bool[]
outputs:
  "bytes out": u8[]
diagram:
  Array Size(array=$"bits in") -> (size(s)=w1)
  Quotient And Remainder(x=w1, y=8) -> (floor(x/y)=w2)
  Reshape Array(inArray=$"bits in", size=w2, size=8) -> w3
  for {
    w4 = each element of w3
    Boolean Array To Number(Boolean array=w4) -> (number=w6: u8)
    append w6 to w5
  }
  $"bytes out" <- w5
