vi "ByteArray2BitArray.gvi"   [LabVIEW Communications System Design Suite 2.0.1]
inputs:
  "Byte in": u8[]
outputs:
  "bit out": bool[]
diagram:
  for {
    w1 = each element of $"Byte in"
    Number To Boolean Array(number=w1) -> (Boolean array=w3)
    append w3 to w2
  }
  Array Size(array=w2) -> (size(s)=w4)
  Array Index(array=w4) -> (out0[_]=w5, out1[_]=w6)
  Multiply(w5, w6) -> w7
  Reshape Array(inArray=w2, size=w7) -> w8
  $"bit out" <- w8
