vi "CRC.gvi"   [LabVIEW Communications System Design Suite 2.0.1]
inputs:
  "g": bool[]
  "x": bool[]
  "initi value": bool
outputs:
  "r": bool[]
  "y": bool[]
diagram:
  # $x: Input data
  disable {
    frame Disabled {
      Math Node("g"=$g, "x"=$x) -> ("y"=w3, "r"=w4)
      ~~~
      K = length(x);
      Q = length(g);

      r = zeros(1,Q);
      y = zeros(1,K); % div result is already in MSB first
      % reverse g for indexing
      g =g(end:-1:1);
      for m=1:K
      y(m) = xor(r(Q),x(m));
      for q=Q:-1:2
          r(q) = xor(r(q-1), and(g(q), y(m)));
      end
      r(1) = and(g(1),y(m));
      end
      r = r(end:-1:1);
      % to store in MSB
      ~~~
      Is Not Equal To 0(x=w3) -> w1
      Is Not Equal To 0(x=w4) -> w2
    }
    frame Enabled {
      Array Size(array=$g) -> (size(s)=w5)
      Reverse 1D Array(array=$g) -> (reversed array=w6)
      Initialize Array(element=$"initi value", size=w5) -> w7
      # w7: Initial r
      s1 = w7  # shift register
      for {
        w8 = each element of $x
        # w5: Q
        # w6: g
        Decrement(x=w5) -> w9
        # w9: Q-1
        Decrement(x=w9) -> w10
        # w11: r(Q-1)
        # w8: x(m)
        Array Index(array=s1) -> (out0[w9]=w11)
        # w12: xor(r(Q-1), x(m))
        Logical Exclusive Or(w11, w8) -> w12
        s2 = s1  # shift register
        for (N = w10) (iteration -> i1) {
          Subtract(x=w9, y=i1) -> w13
          Decrement(x=w13) -> w14
          # w14: q-1
          Array Index(array=s2) -> (out0[w14]=w15)
          # w12: y(m)
          # w6: g
          # w16: g(q)
          Array Index(array=w6) -> (out0[w13]=w16)
          # w13: q
          Logical And(w12, w16) -> w17
          # w17: and(g(q), y(m))
          # w15: r(q-1)
          Logical Exclusive Or(w17, w15) -> w18
          # s2: r
          Replace Array Subset(inArray=s2, index=w13, new=w18) -> w19
          next s2 = w19
        }
        # y(m)
        # w20: g(0)
        Array Index(array=w6) -> (out0[0]=w20)
        Logical And(w12, w20) -> w21
        Replace Array Subset(inArray=s2, index=0, new=w21) -> w22
        append w12 to w1
        next s1 = w22
      }
      Reverse 1D Array(array=s1) -> (reversed array=w2)
    }
  }
  $y <- w1
  $r <- w2
