vi "CRC16.gvi"   [LabVIEW Communications System Design Suite 2.0.1]
inputs:
  "g": bool[]
  "x": bool[]
  "init val": bool
outputs:
  "r": bool[]
diagram:
  Array Index(array=$g) -> (out0[_]=w1, out1[_]=w2, out2[_]=w3, out3[_]=w4, out4[_]=w5, out5[_]=w6, out6[_]=w7, out7[_]=w8, out8[_]=w9, out9[_]=w10, out10[_]=w11, out11[_]=w12, out12[_]=w13, out13[_]=w14, out14[_]=w15, out15[_]=w16)
  Build Array[ConcatenateInputs=True]($x, FALSE) -> w17
  for (iteration -> i1) {
    w18 = each element of w17
    Is Equal To 0(x=i1) -> w19
    Not(x=w19) -> w20
    Feedback Node(initial value=FALSE, input=w21) -> w22
    Feedback Node(initial value=FALSE, input=w23) -> w24
    Logical Exclusive Or(w24, w18) -> w25
    Logical And(w25, w1) -> w26
    Logical Exclusive Or(w26, w22) -> w27
    Select(s=w20, t=w27, f=$"init val") -> w23
    Feedback Node(initial value=FALSE, input=w28) -> w29
    Logical And(w25, w4) -> w30
    Logical Exclusive Or(w30, w29) -> w31
    Select(s=w20, t=w31, f=$"init val") -> w32
    Feedback Node(initial value=FALSE, input=w33) -> w34
    Logical And(w25, w2) -> w35
    Logical Exclusive Or(w35, w34) -> w36
    Select(s=w20, t=w36, f=$"init val") -> w21
    Feedback Node(initial value=FALSE, input=w37) -> w38
    Logical And(w25, w8) -> w39
    Logical Exclusive Or(w39, w38) -> w40
    Select(s=w20, t=w40, f=$"init val") -> w41
    Feedback Node(initial value=FALSE, input=w41) -> w42
    Logical And(w25, w7) -> w43
    Logical Exclusive Or(w43, w42) -> w44
    Select(s=w20, t=w44, f=$"init val") -> w45
    Feedback Node(initial value=FALSE, input=w45) -> w46
    Logical And(w25, w6) -> w47
    Logical Exclusive Or(w47, w46) -> w48
    Select(s=w20, t=w48, f=$"init val") -> w49
    Feedback Node(initial value=FALSE, input=w49) -> w50
    Logical And(w25, w5) -> w51
    Logical Exclusive Or(w51, w50) -> w52
    Select(s=w20, t=w52, f=$"init val") -> w28
    Feedback Node(initial value=FALSE, input=w32) -> w53
    Logical And(w25, w3) -> w54
    Logical Exclusive Or(w54, w53) -> w55
    Select(s=w20, t=w55, f=$"init val") -> w33
    Logical And(w25, w9) -> w56
    Feedback Node(initial value=FALSE, input=w57) -> w58
    Logical Exclusive Or(w56, w58) -> w59
    Select(s=w20, t=w59, f=$"init val") -> w37
    Feedback Node(initial value=FALSE, input=w60) -> w61
    Logical And(w25, w13) -> w62
    Logical Exclusive Or(w62, w61) -> w63
    Select(s=w20, t=w63, f=$"init val") -> w64
    Feedback Node(initial value=FALSE, input=w65) -> w66
    Logical And(w25, w10) -> w67
    Logical Exclusive Or(w67, w66) -> w68
    Select(s=w20, t=w68, f=$"init val") -> w57
    Feedback Node(initial value=FALSE, input=w69) -> w70
    Logical And(w25, w14) -> w71
    Logical Exclusive Or(w71, w70) -> w72
    Select(s=w20, t=w72, f=$"init val") -> w60
    Feedback Node(initial value=FALSE, input=w64) -> w73
    Logical And(w25, w12) -> w74
    Logical Exclusive Or(w74, w73) -> w75
    Select(s=w20, t=w75, f=$"init val") -> w76
    Feedback Node(initial value=FALSE, input=w76) -> w77
    Logical And(w25, w11) -> w78
    Logical Exclusive Or(w78, w77) -> w79
    Select(s=w20, t=w79, f=$"init val") -> w65
    Logical And(w25, w16) -> w80
    Select(s=w20, t=w80, f=$"init val") -> w81
    Feedback Node(initial value=FALSE, input=w81) -> w82
    Logical And(w25, w15) -> w83
    Logical Exclusive Or(w83, w82) -> w84
    Select(s=w20, t=w84, f=$"init val") -> w69
  }
  Build Array(w24, w22, w34, w53, w29, w50, w46, w42, w38, w58, w66, w77, w73, w61, w70, w82) -> w85
  $r <- w85
