vi "CRC16_Append.gvi"   [LabVIEW Communications System Design Suite 2.0.1]
inputs:
  "Payload": u8[]
  "Poly": u16
  "initi value": bool
outputs:
  "CRC frame": u8[]
diagram:
  call "ByteArray2BitArray.gvi"(Byte in=$Payload) -> (bit out=w1)
  Number To Boolean Array(number=$Poly) -> (Boolean array=w2)
  call "CRC16.gvi"(g=w2, x=w1, init val=$"initi value") -> (r=w3)
  call "BitArray2ByteArray.gvi"(bits in=w3) -> (bytes out=w4)
  Build Array[ConcatenateInputs=True]($Payload, w4) -> w5
  $"CRC frame" <- w5
