vi "CRC16_Detect.gvi"   [LabVIEW Communications System Design Suite 2.0.1]
inputs:
  "CRC frame": u8[]
  "initi value": bool
  "Poly": u16
outputs:
  "Payload": u8[]
  "err": bool
diagram:
  Array Size(array=$"CRC frame") -> (size(s)=w1)
  Subtract(x=w1, y=2) -> w2
  Array Subset(array=$"CRC frame", index0=0, length0=w2) -> w3
  Array Subset(array=$"CRC frame", index0=w2, length0=2) -> w4
  call "ByteArray2BitArray.gvi"(Byte in=w3) -> (bit out=w5)
  Number To Boolean Array(number=$Poly) -> (Boolean array=w6)
  call "CRC16.gvi"(g=w6, x=w5, init val=$"initi value") -> (r=w7)
  call "BitArray2ByteArray.gvi"(bits in=w7) -> (bytes out=w8)
  Is Not Equal(x=w8, y=w4) -> w9
  Or Array Elements(Boolean array=w9) -> (logical OR=w10)
  case (w10) {
    frame False, Default {
      w11 = w3
    }
    frame True {
      w11 = u8[] []
    }
  }
  $Payload <- w11
  $err <- w10
