vi "CRC_Append.gvi"   [LabVIEW Communications System Design Suite 2.0.1]
inputs:
  "Payload": u8[]
  "Poly": u16
  "initi value": bool
outputs:
  "CRC frame": u8[]
panel indicators:
  "Boolean array": bool[]
diagram:
  Number To Boolean Array(number=$Poly) -> (Boolean array=w1)
  $"Boolean array" <- w1
  call "ByteArray2BitArray.gvi"(Byte in=$Payload) -> (bit out=w2)
  call "CRC.gvi"(g=w1, x=w2, initi value=$"initi value") -> (r=w3)
  call "BitArray2ByteArray.gvi"(bits in=w3) -> (bytes out=w4)
  Build Array[ConcatenateInputs=True]($Payload, w4) -> w5
  $"CRC frame" <- w5
