vi "test_CRC.gvi"   [LabVIEW Communications System Design Suite 2.0.1]
panel controls:
  "g_int": u16
  "data": u8[]
  "stop": bool
  "milliseconds to wait": u32
panel indicators:
  "y_out": bool[]
  "r_out (script)": u8[]
  "r_out (LV)": u8[]
  "error out": error
  "bit out": bool[]
  "g array": bool[]
  "err": bool
  "r_out shift": u8[]
  "err_2": bool
diagram:
  while {
    Wait(time to wait=$"milliseconds to wait")
    Number To Boolean Array(number=$g_int) -> (Boolean array=w1)
    $"g array" <- w1
    call "ByteArray2BitArray.gvi"(Byte in=$data) -> (bit out=w2)
    Math Node("g"=w1, "x"=w2, Error In=no error) -> ("y"=w3, "r"=w4, Error Out=w5)
    ~~~
    K = length(x);
    Q = length(g);

    r = zeros(1,Q);
    y = zeros(1,K); % div result is already in MSB first
    % reverse g for indexing
    g =g(end:-1:1);
    for m=1:K
    y(m) = xor(r(Q),x(m));
    for q=Q:-1:2
        r(q) = xor(r(q-1), and(g(q), y(m)));
    end
    r(1) = and(g(1),y(m));
    end
    r = r(end:-1:1);
    % to store in MSB
    ~~~
    $"error out" <- w5
    $"bit out" <- w2
    Is Not Equal To 0(x=w3) -> w6
    $y_out <- w6
    Is Not Equal To 0(x=w4) -> w7
    call "BitArray2ByteArray.gvi"(bits in=w7) -> (bytes out=w8)
    $"r_out (script)" <- w8
    call "CRC.gvi"(g=w1, x=w2) -> (r=w9)
    call "BitArray2ByteArray.gvi"(bits in=w9) -> (bytes out=w10)
    Is Not Equal(x=w8, y=w10) -> w11
    Or Array Elements(Boolean array=w11) -> (logical OR=w12)
    $err <- w12
    $"r_out (LV)" <- w10
    call "CRC16.gvi"(g=w1, x=w2) -> (r=w13)
    call "BitArray2ByteArray.gvi"(bits in=w13) -> (bytes out=w14)
    Is Not Equal(x=w8, y=w14) -> w15
    Or Array Elements(Boolean array=w15) -> (logical OR=w16)
    $err_2 <- w16
    $"r_out shift" <- w14
    stop if $stop
  }
