vi "test_CRC16_frame.gvi"   [LabVIEW Communications System Design Suite 2.0.1]
panel controls:
  "String in": string = """function [ r, y ] = CRC( x, g )
% x: input bits index zero is MSB
% g: polynomial index zero is MSB
% r: reminder  index zero is MSB
% y: div index zero is MSB
K = length(x);
Q = length(g);

r = zeros(1,Q);
y = zeros(1,K); % div result is already in MSB first
% reverse g for indexing 
g = flip(g); 
for m=1:K
y(m) = xor(r(Q),x(m));     
for q=Q:-1:2
    r(q) = xor(r(q-1), and(g(q), y(m)));
end    
r(1) = and(g(1),y(m));
end
% to store in MSB 
r = flip(r);
end

"""
  "encoding": enum{"UTF-8", "UTF-16", "Extended ASCII"} = "UTF-8"
  "Poly": u16 = 4129
  "stop TX": bool
  "Tx wait": u32
  "stop RX": bool
  "stop CH": bool
  "SNR": f64
  "Ch wait": u32
  "RX wait": u32
  "initi value": bool
  "AWGN/BSC?": bool
  "TH": f64 = 0.9999
panel indicators:
  "String reminder": string
  "Nof errors": u32
  "Nof correct": u32
  "RX string": string
  "N Tx packet": i32
  "Graph": c128[]
  "N_bit_err": i16
uses:
  NI::Analysis::Generation::Uniform White Noise Waveform.gvi
diagram:
  Obtain Queue(element data type=u8[10] [0, 0, 0, 0, 0, 0, 0, 0, 0, 0], error in=no error, name="RX") -> (queue out=w1)
  s1 = ""  # shift register
  while {
    Wait(time to wait=$"RX wait")
    Get Queue Status(queue=w1) -> (# elements in queue=w2, queue out=w3)
    Is Not Equal To 0(x=w2) -> w4
    case (w4) {
      frame False, Default {
        w5 = ""
        w6 = w3
      }
      frame True {
        Dequeue Element(queue=w3) -> (element=w7, queue out=w6)
        call "CRC16_Detect.gvi"(CRC frame=w7, initi value=$"initi value", Poly=$Poly) -> (Payload=w8, err=w9)
        case (w9) {
          frame False, Default {
            Feedback Node(initial value=0, input=w10) -> w11
            Increment(x=w11) -> w10
            $"Nof correct" <- w10
            Byte Array To String(unsigned byte array=w8) -> (string=w5)
          }
          frame True {
            Feedback Node(initial value=0, input=w12) -> w13
            Increment(x=w13) -> w12
            $"Nof errors" <- w12
            w5 = ""
          }
        }
      }
    }
    Concatenate Strings(s1, w5) -> w14
    $"RX string" <- w14
    next s1 = w14
    stop if $"stop RX"
  }
  Release Queue(queue=w6)
  Obtain Queue(element data type=u8[10] [0, 0, 0, 0, 0, 0, 0, 0, 0, 0], error in=no error, name="TX") -> (queue out=w15)
  while {
    Get Queue Status(queue=w15) -> (# elements in queue=w16)
    Is Not Equal To 0(x=w16) -> w17
    case (w17) {
      frame False, Default {
        w18 = w1
      }
      frame True {
        Dequeue Element(queue=w15) -> (element=w19)
        call "ByteArray2BitArray.gvi"(Byte in=w19) -> (bit out=w20)
        case ($"AWGN/BSC?") {
          frame False, Default {
            Array Size(array=w20) -> (size(s)=w22)
            for (N = w22) {
              Random Number() -> (number (0 to 1)=w24)
              append w24 to w23
            }
            Is Greater(x=w23, y=$TH) -> w25
            Logical Exclusive Or(w20, w25) -> w21
            Boolean To Integer(Boolean=w25) -> (0, 1=w26)
            Add Array Elements(numeric array=w26) -> (sum=w27)
            $N_bit_err <- w27
          }
          frame True {
            Divide(x=$SNR, y=-10) -> w28
            Power Of 10(x=w28) -> w29
            Array Size(array=w20) -> (size(s)=w30)
            call "Uniform White Noise Waveform.gvi"(amplitude=w29, sample rate=10000, samples=w30) -> (uniform white noise=w31)
            Property Node(instance in=w31) -> ("Y"=w32)
            Boolean To Integer(Boolean=w20) -> (0, 1=w33)
            Subtract(x=w33, y=0.5) -> w34
            Multiply(w34, 0.7071) -> w35
            Add(w35, w32) -> w36
            Is Greater Than 0(x=w36) -> w21
            Real And Imaginary To Complex(x=w36, y=0) -> w37
            $Graph <- w37
          }
        }
        call "BitArray2ByteArray.gvi"(bits in=w21) -> (bytes out=w38)
        Enqueue Element(element=w38, queue=w1) -> (queue out=w18)
      }
    }
    Wait[Units=Microseconds](time to wait=$"Ch wait")
    stop if $"stop CH"
  }
  Release Queue(queue=w18)
  s2 = uninitialised  # shift register
  while (iteration -> i1) {
    Wait[Units=Microseconds](time to wait=$"Tx wait")
    String Length(string=s2) -> (length=w39)
    Is Equal To 0(x=w39) -> w40
    Select(s=w40, t=$"String in", f=s2) -> w41
    String Subset(length (rest)=8, string=w41) -> w42
    String To Byte Array(encoding=$encoding, string=w42) -> (unsigned byte array=w43)
    call "CRC16_Append.gvi"(Payload=w43, Poly=$Poly, initi value=$"initi value") -> (CRC frame=w44)
    Enqueue Element(element=w44, queue=w15) -> (queue out=w45)
    String Subset(offset (0)=8, string=w41) -> w46
    $"String reminder" <- w46
    Increment(x=i1) -> w47
    $"N Tx packet" <- w47
    next s2 = w46
    stop if $"stop TX"
  }
  Release Queue(queue=w45)
