vi "Calculate Pilot Results.gvi"   [LabVIEW Communications System Design Suite 2.0.1]
inputs:
  "received pilot array": u32[]
outputs:
  "Pilot-Betrag": UFXP(2.14)[]
  "Pilot-Phase": f64[]
diagram:
  for {
    w1 = each element of $"received pilot array"
    Feedback Node(input=w1) -> w3
    Is Not Equal(x=w3, y=w1) -> w4
    append w1 to w2 if w4
  }
  call "u32 array to 2.14 CFX.gvi"(data=w2) -> (Array=w5)
  Complex To Polar(r * e^(i*theta)=w5) -> (r=w6, theta=w7)
  $"Pilot-Betrag" <- w6
  Multiply(w7, 180) -> w8
  Divide(x=w8, y=Pi) -> w9
  $"Pilot-Phase" <- w9
