vi "Check RM.gvi"   [LabVIEW Communications System Design Suite 2.0.1]
panel controls:
  "Use Phase Tracking": bool = TRUE
  "RM:No DC": bool = TRUE
  "K": i16
  "M": i16
  "Pazload siz1e": T2 = "30"
  "Text Ring": i32 = "30"(0)
panel indicators:
  "N_DataSym_per_block [Symbol]": u16
  "CanNotFit": bool
  "combination": T1[]
  "N_AvailableResources [Symbol]": u16
  "Numeric": u32
  "Numeric_2": i32
types:
  T1 = cluster{"Payload ": i32, "N blocks": u16, "Available resources": u16, "Used resources": u16}
  T2 = enum{"30", "61", "92", "250", "374", "464", "526", "624"}
diagram:
  s1 = uninitialised  # shift register
  for (N = 1000) (iteration -> i1) {
    Add(i1, 8) -> w1
    call "Preset K+M set.gvi"(No DC=$"RM:No DC", M=$M, K=$K) -> (M_set=w2, K_set=w3)
    Boolean To Integer(Boolean=$"Use Phase Tracking") -> (0, 1=w4)
    call "ResourceMapperOptimization.gvi"(K_set=w3, M_set=w2, PayloadSize [Byte]=w1, ControlSize per Block [Symbol]=w4, K=$K, M=$M, Replace Control with Pilots=$"Use Phase Tracking") -> (N_Blocks [Blocks]=w5, N_DataSym_per_block [Symbol]=w6, N_AvailableResources [Symbol]=w7, InsufficientResources=w8, N_UsedResources [Symbol]=w9, CanNotFit=w10)
    Subtract(x=w7, y=w9) -> w11
    Is Less(x=w11, y=3) -> w12
    Logical Or[output inverted](w10, w8) -> w13
    Logical And(w12, w13) -> w14
    case (w14) {
      frame False, Default {
        w15 = s1
      }
      frame True {
        Property Node(instance in=T1 {all zero or empty}, "Payload "=w1, "N blocks"=w5, "Available resources"=w7, "Used resources"=w9) -> (instance out=w16)
        Build Array[ConcatenateInputs=True](s1, w16) -> w15
      }
    }
    $"N_DataSym_per_block [Symbol]" <- w6
    $"N_AvailableResources [Symbol]" <- w7
    $CanNotFit <- w10
    next s1 = w15
  }
  $combination <- s1
  To Unsigned Word Integer(number=$"Pazload siz1e") -> w17
  $Numeric <- w17
  $Numeric_2 <- $"Text Ring"
