vi "WriteSamplesToFile.gvi"   [LabVIEW Communications System Design Suite 2.0.1]
inputs:
  "filename": string
  "format": string = "%.3f"
  "data": c128[]
diagram:
  Concatenate Strings($filename, "_real.txt") -> w1
  String To Path(string=w1) -> (path=w2)
  Concatenate Strings($filename, "_imag.txt") -> w3
  String To Path(string=w3) -> (path=w4)
  Path Type(path=w2) -> (type=w5)
  case (w5) {
    frame "absolute path", Default {
      w6 = w2
      w7 = w4
    }
    frame "relative path" {
      Get Component Directory() -> (Path=w8)
      Build Path(base path=w8, name or relative path=w2) -> (appended path=w6)
      Build Path(base path=w8, name or relative path=w4) -> (appended path=w7)
    }
  }
  Complex To Real Imaginary(x + iy=$data) -> (x=w9, y=w10)
  call "Write to Spreadsheet File (DBL).gvi"(format=$format, file path=w6, 1D data=w9, append to file?=TRUE, transpose?=TRUE)
  call "Write to Spreadsheet File (DBL).gvi"(format=$format, file path=w7, 1D data=w10, append to file?=TRUE, transpose?=TRUE)
