vi "average.gvi"   [LabVIEW Communications System Design Suite 2.0.1]
inputs:
  "signal": CFXP(4.12)[] = [-0.083251953125-0.07470703125i, -0.076171875-0.0859375i, -0.081787109375-0.088623046875i, -0.072021484375-0.0859375i, -0.07763671875-0.106689453125i, -0.07470703125-0.0859375i, -0.072021484375-0.098388671875i, -0.0693359375-0.09423828125i, -0.0595703125-0.08447265625i, -0.065185546875-0.088623046875i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]
outputs:
  "average": c128
diagram:
  Add Array Elements(numeric array=$signal) -> (sum=w1)
  Array Size(array=$signal) -> (size(s)=w2)
  Reciprocal(x=w2) -> w3
  Multiply(w1, w3) -> w4
  $average <- w4
