vi "check if K is power of two.gvi"   [LabVIEW Communications System Design Suite 2.0.1]
inputs:
  "GFDM Parameter in": "GFDM parameter.gtype" = {"Variable: K"=8, "Variable: M"=3, "Variable: a"=0.5, "filter type"="rc", "receive filter"="MF", "inverse FFT"=FALSE, "Variable: b"=0.5, "Ncs"=0, "Ncp"=0}
outputs:
  "GFDM Parameter out": "GFDM parameter.gtype"
types:
  "GFDM parameter.gtype" = cluster{"Variable: K": i32, "Variable: M": i32, "Variable: a": f64, "filter type": enum{"rc", "rect"}, "receive filter": enum{"MF", "ZF"}, "inverse FFT": bool, "Variable: b": f64, "Ncs": u16, "Ncp": u16}
diagram:
  Property Node(instance in=$"GFDM Parameter in") -> ("Variable: K"=w1, instance out=w2)
  Is Greater Or Equal(x=w1, y=8) -> w3
  Select(s=w3, t=w1, f=8) -> w4
  Logarithm Base 2(x=w4) -> w5
  To Unsigned Byte Integer(number=w5) -> w6
  Scale By Power Of 2(n=w6, x=1) -> w7
  Property Node(instance in=w2, "Variable: K"=w7) -> (instance out=w8)
  $"GFDM Parameter out" <- w8
