vi "extend matrix.gvi"   [LabVIEW NXG]
inputs:
  "resource map": enum{"Null", "Pilot", "Data"}[][]
  "K": i32
outputs:
  "complete resource map out": enum{"Null", "Pilot", "Data"}[][]
panel indicators:
  "zeilen K": i32
  "spalten M": i32
  "Array": enum{"Null", "Pilot", "Data"}[]
diagram:
  Quotient And Remainder(x=$K, y=8) -> (floor(x/y)=w1)
  Is Greater Than 0(x=w1) -> w2
  case (w2) {
    frame False, Default {
      w3 = $"resource map"
    }
    frame True {
      Array Size(array=$"resource map") -> (size(s)=w4)
      Array Index(array=w4) -> (out0[_]=w5, out1[_]=w6)
      Initialize Array(element="Null", size=$K, size=w6) -> w7
      s1 = w7  # shift register
      for (iteration -> i1) {
        w8 = each element of $"resource map"
        $Array <- w8
        Multiply(w1, i1) -> w9
        s2 = s1  # shift register
        for (N = w1) (iteration -> i2) {
          Add(w9, i2) -> w10
          Replace Array Subset(inArray=s2, w10, index=_, w8) -> w11
          next s2 = w11
        }
        next s1 = s2
      }
      $"zeilen K" <- w5
      $"spalten M" <- w6
      w3 = s1
    }
  }
  $"complete resource map out" <- w3
