vi "inverse repmat.gvi"   [LabVIEW NXG]
inputs:
  "M": i32
  "K": i32
  "array in": c128[]
outputs:
  "array out": c128[]
diagram:
  Initialize Array(element=0+0i, size=$K) -> w1
  s1 = w1  # shift register
  for (N = $M) (iteration -> i1) {
    Multiply($K, i1) -> w2
    Array Subset(array=$"array in", index0=w2, length0=$K) -> w3
    Add(w3, s1) -> w4
    next s1 = w4
  }
  $"array out" <- s1
