vi "reduce matrix.gvi"   [LabVIEW NXG]
inputs:
  "complete resource map": enum{"Null", "Pilot", "Data"}[][]
outputs:
  "reduced resource map out": enum{"Null", "Pilot", "Data"}[][]
panel indicators:
  "zeilen K": i32
  "spalten M": i32
  "Array": enum{"Null", "Pilot", "Data"}[]
diagram:
  Array Size(array=$"complete resource map") -> (size(s)=w1)
  Array Index(array=w1) -> (out0[_]=w2, out1[_]=w3)
  $"zeilen K" <- w2
  $"spalten M" <- w3
  Quotient And Remainder(x=w2, y=8) -> (floor(x/y)=w4)
  Is Greater(x=w2, y=8) -> w5
  case (w5) {
    frame False, Default {
      w6 = $"complete resource map"
    }
    frame True {
      Initialize Array(element="Null", size=8, size=w3) -> w7
      s1 = w7  # shift register
      for (iteration -> i1) {
        w8 = each element of $"complete resource map"
        $Array <- w8
        Quotient And Remainder(x=i1, y=w4) -> (floor(x/y)=w9, x-y*floor(x/y)=w10)
        Is Equal To 0(x=w10) -> w11
        case (w11) {
          frame False, Default {
            w12 = s1
          }
          frame True {
            Replace Array Subset(inArray=s1, w9, index=_, w8) -> w12
          }
        }
        next s1 = w12
      }
      w6 = s1
    }
  }
  $"reduced resource map out" <- w6
