vi "repmat.gvi"   [LabVIEW NXG]
inputs:
  "count": i32
  "array in": c128[]
outputs:
  "array out": c128[]
diagram:
  Decrement(x=$count) -> w1
  s1 = $"array in"  # shift register
  for (N = w1) {
    Build Array[ConcatenateInputs=True](s1, $"array in") -> w2
    next s1 = w2
  }
  $"array out" <- s1
