vi "zero-mean.gvi"   [LabVIEW Communications System Design Suite 2.0.1]
inputs:
  "Rx Preamble": CFXP(4.12)[] = [0.02490234375-0.105224609375i, 0.00830078125+0.013916015625i, 0.063720703125-0.21337890625i, 0.364501953125+0.105224609375i, 0.59716796875+0.76220703125i, -0.242431640625+0.022216796875i, -0.06787109375+0.04150390625i, -0.0234375-0.072021484375i, -0.063720703125+0.0498046875i, 0.0361328125-0.013916015625i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]
outputs:
  "Rx signal": c128[]
diagram:
  call "average.gvi"(signal=$"Rx Preamble") -> (average=w1)
  Subtract(x=$"Rx Preamble", y=w1) -> w2
  $"Rx signal" <- w2
