vi "ConfigureDevice.gvi"   [LabVIEW Communications System Design Suite 2.0.1]
inputs:
  "Reference Frequency Source": string = "Internal"
  "FPGA in": "FPGA interface.gtype"
  "error out": error
  "USRP RIO device": string = "RIO0"
  "GFDM parameter": "GFDM parameter.gtype" = {"Variable: K"=64, "Variable: M"=9, "Variable: a"=0, "filter type"="rc", "receive filter"="ZF", "inverse FFT"=FALSE, "Variable: b"=0, "Ncs"=16, "Ncp"=32}
  "TX.Frequency [Hz]": f64 = 1990000000
  "TX.Sample Rate [S/s]": f64 = 10000000
  "RX.Frequency [Hz]": f64 = 1990000000
  "RX.Sample Rate [S/s]": f64 = 10000000
  "RX Power [dBm]": f64
  "TX Power [dBm]": f64 = 25
outputs:
  "FPGA.Interface": "FPGA interface.gtype"
  "error in": error
  "RX Coerced Configurations": T2
  "TX Coerced Configurations": T1
  "ni usrp session 2": "niUsrpRio Config v1 Host.lvlib__niUsrpRio Session.gtype"
  "ni usrp session": "niUsrpRio Config v1 Host.lvlib__niUsrpRio Session.gtype"
types:
  T1 = cluster{"Coerced Frequencies [Hz]": f64[], "Coerced LO Frequencies [Hz]": f64[], "Coerced Output Powers [dBm]": f64[], "Coerced Sample Rates [S/s]": f64[]}
  T2 = cluster{"Coerced Frequencies [Hz]": f64[], "Coerced LO Frequencies [Hz]": f64[], "Coerced Levels [dBm]": f64[], "Coerced Sample Rates [S/s]": f64[]}
  "GFDM parameter.gtype" = cluster{"Variable: K": i32, "Variable: M": i32, "Variable: a": f64, "filter type": enum{"rc", "rect"}, "receive filter": enum{"MF", "ZF"}, "inverse FFT": bool, "Variable: b": f64, "Ncs": u16, "Ncp": u16}
  "niInstr Register Bus v0 Host.lvlib__Register Bus Session.gtype" = Queue<"niInstr Register Bus v0 Host.lvlib__Session Data.gtype">
  "Semaphore RefNum.gtype" = i32
  "niUsrpRio Config v1 Host.lvlib__DB Queue Reference.gtype" = Queue<"niUsrpRio Config v1 Host.lvlib__Daughterboard Data.gtype">
  "niUsrpRio Config v1 Host.lvlib__EEPROM Header.gtype" = cluster{"Checksum": u32, "Product Code": u16, "Hardware Current Version": u16, "Hardware Oldest Compatible Version": u16, "EEPROM Map Current Version": u16, "EEPROM Map Oldest Compatible Version": u16, "User Password": string, "Pointer to Factory Header": u32, "Pointer to User Header": u32, "Recommended Interval": u16, "Number of Reserved Bytes": i32, "Number of Daughterboards": u8, "Daughterboard IDs": u16[], "Daughterboard Serial Numbers": string[]}
  "niUsrpRio Config v1 Host.lvlib__EEPROM Device Data Header.gtype" = cluster{"Checksum": u32, "Number of Channels": u8, "Number of Gain Settings": u16[], "Pointer to Characterization Data": u32[], "Number of Reserved Bytes": i32, "Number of Frequencies": u16[]}
  "niUsrpRio Config v1 Host.lvlib__EEPROM Characterization Header.gtype" = cluster{"Checksum": u32, "Date": timestamp, "Temperature": f32, "Misc. Info": string, "Pointer to Device Data Header": u32, "Number of Reserved Bytes": i32}
  "niUsrpRio Config v1 Host.lvlib__Characterization Data.gtype" = cluster{"Gains[dB]": f64[], "Frequencies [Hz]": f64[], "IQ Imbalance Table": "niUsrpRio Config v1 Host.lvlib__IQ Imbalance.gtype"[], "Measured Gains[dB]": f64[][]}
  "niUsrpRio Config v1 Host.lvlib__niUsrpRio Session.gtype" = cluster{"FPGA Interface": any, "RIO Interface Number": u32, "Data Clock Rate": u32, "FPGA Data Clock Rate": u32, "Global Settings Register Bus": "niInstr Register Bus v0 Host.lvlib__Register Bus Session.gtype", "Radio 0 Settings Register Bus": "niInstr Register Bus v0 Host.lvlib__Register Bus Session.gtype", "Radio 1 Settings Register Bus": "niInstr Register Bus v0 Host.lvlib__Register Bus Session.gtype", "Radio Settings Bus Semaphore": "Semaphore RefNum.gtype", "DB Queues": "niUsrpRio Config v1 Host.lvlib__DB Queue Reference.gtype"[], "Characterization Data Valid?": bool, "EEPROM Header": "niUsrpRio Config v1 Host.lvlib__EEPROM Header.gtype", "Device Data Header": "niUsrpRio Config v1 Host.lvlib__EEPROM Device Data Header.gtype", "EEPROM Characterization Header": "niUsrpRio Config v1 Host.lvlib__EEPROM Characterization Header.gtype", "Characterization Data": "niUsrpRio Config v1 Host.lvlib__Characterization Data.gtype"[], "FPGA Current Version": u32, "FPGA Oldest Compatible Version": u32, "Fixed Logic Current Version": u32, "Fixed Logic Oldest Compatible Version": u32, "FPGA Radio Settings Bus Current Version": u32, "FPGA Radio Settings Bus Oldest Compatible Version": u32, "FPGA Board Config Current Version": u32, "FPGA Board Config Oldest Compatible Version": u32, "Daughterboard Clock Rate": u32}
  T3 = cluster{"Antenna RF 0": string, "Frequency RF 0 [Hz]": f64, "LO Frequency RF 0 [Hz]": f64, "Output Power RF 0 [dBm]": f64}
  T4 = cluster{"Antenna RF 1": string, "Frequency RF 1 [Hz]": f64, "LO Frequency RF 1 [Hz]": f64, "Output Power RF 1 [dBm]": f64}
  T5 = enum{"Software", "Digital Edge", "Rx Start Trigger", "Tx Start Trigger", "Immediate", "Future Time Event"}
  T6 = cluster{"rf enable 0": bool, "rf config 0": T3, "rf enable 1": bool, "rf config 1": T4, "Number of Samples is Finite": bool, "Sample Rate [S/s]": f64, "Number of Samples": u32, "Start Trigger": T5, "Tone Frequency [Hz]": f64}
  T7 = cluster{"Antenna RF 0": string, "Frequency RF 0 [Hz]": f64, "LO Frequency RF 0 [Hz]": f64, "Reference Level RF 0 [dBm]": f64}
  T8 = cluster{"Antenna RF 1": string, "Frequency RF 1 [Hz]": f64, "LO Frequency RF 1 [Hz]": f64, "Reference Level RF 1 [dBm]": f64}
  T9 = cluster{"rf enable 0": bool, "rf config 0": T7, "rf enable 1": bool, "rf config 1": T8, "Number of Samples is Finite": bool, "Sample Rate [S/s]": f64, "Number of Samples": u32, "Start Trigger": T5}
diagram:
  Property Node(instance in=T3 {all zero or empty}, "Antenna RF 0"="TX1", "Frequency RF 0 [Hz]"=$"TX.Frequency [Hz]", "LO Frequency RF 0 [Hz]"=-1, "Output Power RF 0 [dBm]"=$"TX Power [dBm]") -> (instance out=w1)
  Property Node(instance in=$"GFDM parameter") -> ("Variable: K"=w2, "Variable: M"=w3, "Ncs"=w4, "Ncp"=w5)
  Multiply(w2, w3) -> w6
  Add(w4, w5) -> w7
  Square(x=w7) -> w8
  Add(w6, 128, w8) -> w9
  w10 = T6 {"rf enable 0"=TRUE, "rf config 0"={"Antenna RF 0"="TX1", "Frequency RF 0 [Hz]"=1990000000, "LO Frequency RF 0 [Hz]"=-1, "Output Power RF 0 [dBm]"=20}, "rf enable 1"=FALSE, "rf config 1"={"Antenna RF 1"="TX1", "Frequency RF 1 [Hz]"=1990000000, "LO Frequency RF 1 [Hz]"=-1, "Output Power RF 1 [dBm]"=0}, "Number of Samples is Finite"=FALSE, "Sample Rate [S/s]"=20000000, "Number of Samples"=800, "Start Trigger"="Software", "Tone Frequency [Hz]"=100000}
  Property Node(instance in=w10, "rf enable 0"=TRUE, "rf config 0"=w1, "rf enable 1"=FALSE, "rf config 1"=w1, "Number of Samples is Finite"=FALSE, "Sample Rate [S/s]"=$"TX.Sample Rate [S/s]", "Number of Samples"=w9, "Start Trigger"="Immediate") -> (instance out=w11)
  w12 = "RX2"  # Antenna RF 1
  Negate(x=$"RX Power [dBm]") -> w13
  w14 = T7 {"Antenna RF 0"="RX2", "Frequency RF 0 [Hz]"=1990000000, "LO Frequency RF 0 [Hz]"=-1, "Reference Level RF 0 [dBm]"=0}
  Property Node(instance in=w14, "Antenna RF 0"=w12, "Frequency RF 0 [Hz]"=$"RX.Frequency [Hz]", "LO Frequency RF 0 [Hz]"=-1, "Reference Level RF 0 [dBm]"=w13) -> (instance out=w15)
  w16 = T9 {"rf enable 0"=FALSE, "rf config 0"={"Antenna RF 0"="RX2", "Frequency RF 0 [Hz]"=1990000000, "LO Frequency RF 0 [Hz]"=-1, "Reference Level RF 0 [dBm]"=0}, "rf enable 1"=TRUE, "rf config 1"={"Antenna RF 1"="RX2", "Frequency RF 1 [Hz]"=2180000000, "LO Frequency RF 1 [Hz]"=-1, "Reference Level RF 1 [dBm]"=0}, "Number of Samples is Finite"=FALSE, "Sample Rate [S/s]"=20000000, "Number of Samples"=32000, "Start Trigger"="Immediate"}
  Property Node(instance in=w16, "rf enable 0"=FALSE, "rf config 0"=w15, "rf enable 1"=TRUE, "rf config 1"=w15, "Number of Samples is Finite"=FALSE, "Sample Rate [S/s]"=$"RX.Sample Rate [S/s]", "Number of Samples"=w9, "Start Trigger"="Immediate") -> (instance out=w17)
  call "Open and Configure Device.gvi"(FPGA in=$"FPGA in", usrp rio device=$"USRP RIO device", reference frequency source=$"Reference Frequency Source", error in=$"error out", rx config=w17, tx config=w11) -> (niusrprio session=w18, rx.coerced configurations=w19, tx.coerced configurations=w20, error out=w21, rx channels=w22, tx channels=w23)
  call "Initiate and Generate (Single).gvi"(niusrprio session=w18, first iteration=TRUE, error in=w21, tx channels=w23) -> (niusrprio session 2=w24, error out=w25)
  Property Node(instance in=w24) -> ("FPGA Interface"=w26, instance out=w27)
  Dynamic Fpga Interface Cast(reference in=w26, type="FPGA interface.gtype" constant) -> (reference out=w28)
  $"FPGA.Interface" <- w28
  call "Initiate and Fetch (Single).gvi"(niusrprio session=w27, first iteration=TRUE, error in=w25, rx channels=w22) -> (niusrprio session 2=w29, error out=w30)
  $"error in" <- w30
  $"ni usrp session 2" <- w29
  $"ni usrp session" <- w18
  $"RX Coerced Configurations" <- w19
  $"TX Coerced Configurations" <- w20
