vi "Blocks in FIFO.gvi"   [LabVIEW Communications System Design Suite 2.0.1]
inputs:
  "requested lenght": i32
  "number of elements in FIFO": u32
outputs:
  "number of elements": f64
diagram:
  Divide(x=$"number of elements in FIFO", y=$"requested lenght") -> w1
  Round Toward Negative Infinity(x=w1) -> w2
  Multiply($"requested lenght", w2) -> w3
  $"number of elements" <- w3
