vi "Configure FIFOs.gvi"   [LabVIEW Communications System Design Suite 2.0.1]
inputs:
  "FPGA interface in": "FPGA interface.gtype"
  "error in": error
  "UseCAPIData": bool
outputs:
  "FPGA interface out": "FPGA interface.gtype"
  "error out": error
  "channel coefficients fifo depth": u32
diagram:
  Host Fifo Configure Node[FifoName="Needed Resources.grsc\\RX.channel Coefficients in"](depth=655000, error in=$"error in", reference in=$"FPGA interface in") -> (actual depth=w1, error out=w2, reference out=w3)
  $"channel coefficients fifo depth" <- w1
  case ($UseCAPIData) {
    frame True {
      w4 = w3
      w5 = w1
      w6 = w2
    }
    frame False {
      # data out
      Host Fifo Configure Node[FifoName="Needed Resources.grsc\\RX.Data out.T2H"](depth=w1, error in=w2, reference in=w3) -> (actual depth=w7, error out=w8, reference out=w9)
      # data in
      Host Fifo Configure Node[FifoName="Needed Resources.grsc\\TX.data in.H2T"](depth=w7, error in=w8, reference in=w9) -> (actual depth=w5, error out=w6, reference out=w4)
    }
  }
  Host Fifo Configure Node[FifoName="Needed Resources.grsc\\RX.Preamble out"](depth=w5, error in=w6, reference in=w4) -> (actual depth=w10, error out=w11, reference out=w12)
  Host Fifo Configure Node[FifoName="Needed Resources.grsc\\RX.pulse shape in"](depth=w10, error in=w11, reference in=w12) -> (actual depth=w13, error out=w14, reference out=w15)
  Host Fifo Configure Node[FifoName="Needed Resources.grsc\\RX.sync.correlation metric"](depth=w13, error in=w14, reference in=w15) -> (actual depth=w16, error out=w17, reference out=w18)
  Host Fifo Configure Node[FifoName="Needed Resources.grsc\\RX.Debug.Modem_64 bit samples out"](depth=w16, error in=w17, reference in=w18) -> (actual depth=w19, error out=w20, reference out=w21)
  Host Fifo Configure Node[FifoName="Needed Resources.grsc\\TX.Debug.frame out"](depth=w19, error in=w20, reference in=w21) -> (actual depth=w22, error out=w23, reference out=w24)
  Host Fifo Configure Node[FifoName="Needed Resources.grsc\\TX.Preamble in"](depth=w22, error in=w23, reference in=w24) -> (actual depth=w25, error out=w26, reference out=w27)
  Host Fifo Configure Node[FifoName="Needed Resources.grsc\\TX.pulse shape in"](depth=w25, error in=w26, reference in=w27) -> (actual depth=w28, error out=w29, reference out=w30)
  Host Fifo Configure Node[FifoName="Needed Resources.grsc\\TX.Window in"](depth=w28, error in=w29, reference in=w30) -> (actual depth=w31, error out=w32, reference out=w33)
  Host Fifo Configure Node[FifoName="Updater Resources.grsc\\download"](depth=w31, error in=w32, reference in=w33) -> (error out=w34, reference out=w35)
  call "stop FIFOs.gvi"(FPGA interface in=w35, Error=w34, UseCAPIData=$UseCAPIData) -> (FPGA interface out=w36, error in=w37)
  Host Fifo Start Node[FifoName="Needed Resources.grsc\\RX.channel Coefficients in"](error in=w37, reference in=w36) -> (error out=w38, reference out=w39)
  case ($UseCAPIData) {
    frame True {
      w40 = w39
      w41 = w38
    }
    frame False {
      # data out
      Host Fifo Start Node[FifoName="Needed Resources.grsc\\RX.Data out.T2H"](error in=w38, reference in=w39) -> (error out=w42, reference out=w43)
      # data in
      Host Fifo Start Node[FifoName="Needed Resources.grsc\\TX.data in.H2T"](error in=w42, reference in=w43) -> (error out=w41, reference out=w40)
    }
  }
  Host Fifo Start Node[FifoName="Needed Resources.grsc\\RX.Preamble out"](error in=w41, reference in=w40) -> (error out=w44, reference out=w45)
  Host Fifo Start Node[FifoName="Needed Resources.grsc\\RX.pulse shape in"](error in=w44, reference in=w45) -> (error out=w46, reference out=w47)
  Host Fifo Start Node[FifoName="Needed Resources.grsc\\RX.sync.correlation metric"](error in=w46, reference in=w47) -> (error out=w48, reference out=w49)
  Host Fifo Start Node[FifoName="Needed Resources.grsc\\RX.Debug.Modem_64 bit samples out"](error in=w48, reference in=w49) -> (error out=w50, reference out=w51)
  Host Fifo Start Node[FifoName="Needed Resources.grsc\\TX.Debug.frame out"](error in=w50, reference in=w51) -> (error out=w52, reference out=w53)
  Host Fifo Start Node[FifoName="Needed Resources.grsc\\TX.Preamble in"](error in=w52, reference in=w53) -> (error out=w54, reference out=w55)
  Host Fifo Start Node[FifoName="Needed Resources.grsc\\TX.pulse shape in"](error in=w54, reference in=w55) -> (error out=w56, reference out=w57)
  Host Fifo Start Node[FifoName="Needed Resources.grsc\\TX.Window in"](error in=w56, reference in=w57) -> (error out=w58, reference out=w59)
  Host Fifo Start Node[FifoName="Updater Resources.grsc\\download"](error in=w58, reference in=w59) -> (error out=w60, reference out=w61)
  # data out
  case ($UseCAPIData) {
    frame True {
      w62 = w61
      w63 = w60
    }
    frame False {
      Host Fifo Read Node[FifoName="Needed Resources.grsc\\RX.Data out.T2H"](error in=w60, number of elements=0, reference in=w61) -> (elements remaining=w64, error out=w65, reference out=w66)
      Host Fifo Read Node[FifoName="Needed Resources.grsc\\RX.Data out.T2H"](error in=w65, number of elements=w64, reference in=w66) -> (error out=w63, reference out=w62)
    }
  }
  Host Fifo Read Node[FifoName="Needed Resources.grsc\\RX.Debug.Modem_64 bit samples out"](error in=w63, number of elements=0, reference in=w62) -> (elements remaining=w67, error out=w68, reference out=w69)
  Host Fifo Read Node[FifoName="Needed Resources.grsc\\RX.Debug.Modem_64 bit samples out"](error in=w68, number of elements=w67, reference in=w69) -> (error out=w70, reference out=w71)
  Host Fifo Read Node[FifoName="Needed Resources.grsc\\RX.Preamble out"](error in=w70, number of elements=0, reference in=w71) -> (elements remaining=w72, error out=w73, reference out=w74)
  Host Fifo Read Node[FifoName="Needed Resources.grsc\\RX.Preamble out"](error in=w73, number of elements=w72, reference in=w74) -> (error out=w75, reference out=w76)
  Host Fifo Read Node[FifoName="Needed Resources.grsc\\RX.sync.correlation metric"](error in=w75, number of elements=0, reference in=w76) -> (elements remaining=w77, error out=w78, reference out=w79)
  Host Fifo Read Node[FifoName="Needed Resources.grsc\\RX.sync.correlation metric"](error in=w78, number of elements=w77, reference in=w79) -> (error out=w80, reference out=w81)
  Host Fifo Read Node[FifoName="Needed Resources.grsc\\TX.Debug.frame out"](error in=w80, number of elements=0, reference in=w81) -> (elements remaining=w82, error out=w83, reference out=w84)
  Host Fifo Read Node[FifoName="Needed Resources.grsc\\TX.Debug.frame out"](error in=w83, number of elements=w82, reference in=w84) -> (error out=w85, reference out=w86)
  $"FPGA interface out" <- w86
  $"error out" <- w85
