vi "Configure FIFOs_CCA.gvi"   [LabVIEW Communications System Design Suite 2.0.1]
inputs:
  "OpaqueRefnumLiteral": "OpaqueRefnumLiteral_2.gtype"
  "error in": error
  "UseCAPIData": bool
outputs:
  "reference out": "OpaqueRefnumLiteral_2.gtype"
  "error out": error
  "channel coefficients fifo depth": u32
diagram:
  Host Fifo Configure Node[FifoName="Needed Resources.grsc\\RX.channel Coefficients in"](depth=655000, error in=$"error in", reference in=$OpaqueRefnumLiteral) -> (actual depth=w1, error out=w2, reference out=w3)
  $"channel coefficients fifo depth" <- w1
  case ($UseCAPIData) {
    frame True {
      w4 = w3
      w5 = w1
      w6 = w2
    }
    frame False {
      # data out
      Host Fifo Configure Node[FifoName="Needed Resources.grsc\\RX.Data out.T2H"](depth=w1, error in=w2, reference in=w3) -> (actual depth=w7, error out=w8, reference out=w9)
      # data in
      Host Fifo Configure Node[FifoName="Needed Resources.grsc\\TX.data in.H2T"](depth=w7, error in=w8, reference in=w9) -> (actual depth=w5, error out=w6, reference out=w4)
    }
  }
  Host Fifo Configure Node[FifoName="Needed Resources.grsc\\RX.Preamble out"](depth=w5, error in=w6, reference in=w4) -> (actual depth=w10, error out=w11, reference out=w12)
  Host Fifo Configure Node[FifoName="Needed Resources.grsc\\RX.pulse shape in"](depth=w10, error in=w11, reference in=w12) -> (actual depth=w13, error out=w14, reference out=w15)
  Host Fifo Configure Node[FifoName="Needed Resources.grsc\\RX.Debug.Modem_64 bit samples out"](depth=w13, error in=w14, reference in=w15) -> (actual depth=w16, error out=w17, reference out=w18)
  Host Fifo Configure Node[FifoName="Needed Resources.grsc\\TX.Debug.frame out"](depth=w16, error in=w17, reference in=w18) -> (actual depth=w19, error out=w20, reference out=w21)
  Host Fifo Configure Node[FifoName="Needed Resources.grsc\\TX.Preamble in"](depth=w19, error in=w20, reference in=w21) -> (actual depth=w22, error out=w23, reference out=w24)
  Host Fifo Configure Node[FifoName="Needed Resources.grsc\\TX.pulse shape in"](depth=w22, error in=w23, reference in=w24) -> (actual depth=w25, error out=w26, reference out=w27)
  Host Fifo Configure Node[FifoName="Needed Resources.grsc\\TX.Window in"](depth=w25, error in=w26, reference in=w27) -> (actual depth=w28, error out=w29, reference out=w30)
  Host Fifo Configure Node[FifoName="Updater Resources.grsc\\download"](depth=w28, error in=w29, reference in=w30) -> (error out=w31, reference out=w32)
  disable {
    frame Enabled {
      call "stop FIFOs_CCA.gvi"(OpaqueRefnumLiteral=w32, Error=w31, UseCAPIData=$UseCAPIData) -> (reference out=w33, error in=w34)
    }
    frame Disabled {
      call "stop FIFOs.gvi"(FPGA interface in=w32, Error=w31, UseCAPIData=$UseCAPIData) -> (FPGA interface out=w33, error in=w34)
    }
  }
  Host Fifo Start Node[FifoName="Needed Resources.grsc\\RX.channel Coefficients in"](error in=w34, reference in=w33) -> (error out=w35, reference out=w36)
  case ($UseCAPIData) {
    frame True {
      w37 = w36
      w38 = w35
    }
    frame False {
      # data out
      Host Fifo Start Node[FifoName="Needed Resources.grsc\\RX.Data out.T2H"](error in=w35, reference in=w36) -> (error out=w39, reference out=w40)
      # data in
      Host Fifo Start Node[FifoName="Needed Resources.grsc\\TX.data in.H2T"](error in=w39, reference in=w40) -> (error out=w38, reference out=w37)
    }
  }
  Host Fifo Start Node[FifoName="Needed Resources.grsc\\RX.Preamble out"](error in=w38, reference in=w37) -> (error out=w41, reference out=w42)
  Host Fifo Start Node[FifoName="Needed Resources.grsc\\RX.pulse shape in"](error in=w41, reference in=w42) -> (error out=w43, reference out=w44)
  Host Fifo Start Node[FifoName="Needed Resources.grsc\\RX.Debug.Modem_64 bit samples out"](error in=w43, reference in=w44) -> (error out=w45, reference out=w46)
  Host Fifo Start Node[FifoName="Needed Resources.grsc\\TX.Debug.frame out"](error in=w45, reference in=w46) -> (error out=w47, reference out=w48)
  Host Fifo Start Node[FifoName="Needed Resources.grsc\\TX.Preamble in"](error in=w47, reference in=w48) -> (error out=w49, reference out=w50)
  Host Fifo Start Node[FifoName="Needed Resources.grsc\\TX.pulse shape in"](error in=w49, reference in=w50) -> (error out=w51, reference out=w52)
  Host Fifo Start Node[FifoName="Needed Resources.grsc\\TX.Window in"](error in=w51, reference in=w52) -> (error out=w53, reference out=w54)
  Host Fifo Start Node[FifoName="Updater Resources.grsc\\download"](error in=w53, reference in=w54) -> (error out=w55, reference out=w56)
  # data out
  case ($UseCAPIData) {
    frame True {
      w57 = w56
      w58 = w55
    }
    frame False {
      Host Fifo Read Node[FifoName="Needed Resources.grsc\\RX.Data out.T2H"](error in=w55, number of elements=0, reference in=w56) -> (elements remaining=w59, error out=w60, reference out=w61)
      Host Fifo Read Node[FifoName="Needed Resources.grsc\\RX.Data out.T2H"](error in=w60, number of elements=w59, reference in=w61) -> (error out=w58, reference out=w57)
    }
  }
  Host Fifo Read Node[FifoName="Needed Resources.grsc\\RX.Debug.Modem_64 bit samples out"](error in=w58, number of elements=0, reference in=w57) -> (elements remaining=w62, error out=w63, reference out=w64)
  Host Fifo Read Node[FifoName="Needed Resources.grsc\\RX.Debug.Modem_64 bit samples out"](error in=w63, number of elements=w62, reference in=w64) -> (error out=w65, reference out=w66)
  Host Fifo Read Node[FifoName="Needed Resources.grsc\\RX.Preamble out"](error in=w65, number of elements=0, reference in=w66) -> (elements remaining=w67, error out=w68, reference out=w69)
  Host Fifo Read Node[FifoName="Needed Resources.grsc\\RX.Preamble out"](error in=w68, number of elements=w67, reference in=w69) -> (error out=w70, reference out=w71)
  Host Fifo Read Node[FifoName="Needed Resources.grsc\\TX.Debug.frame out"](error in=w70, number of elements=0, reference in=w71) -> (elements remaining=w72, error out=w73, reference out=w74)
  Host Fifo Read Node[FifoName="Needed Resources.grsc\\TX.Debug.frame out"](error in=w73, number of elements=w72, reference in=w74) -> (error out=w75, reference out=w76)
  $"reference out" <- w76
  $"error out" <- w75
