vi "GFDM generate parameter.gvi"   [LabVIEW Communications System Design Suite 2.0.1]
inputs:
  "GFDM parameter": "GFDM parameter.gtype"
  "Apply Window": bool
  "GFDM B": u16
outputs:
  "channel coefficients": u32[]
  "pulse shape": u64[]
  "window": u32[]
  "preamble": u32[]
  "receive filter": u64[]
  "Modem Configuration": "modem_configuration.gtype"
  "RX.sync.GFDM configuration cluster": T1
  "GFDM all parameters": "GFDM all parameters.gtype"
types:
  "GFDM parameter.gtype" = cluster{"Variable: K": i32, "Variable: M": i32, "Variable: a": f64, "filter type": enum{"rc", "rect"}, "receive filter": enum{"MF", "ZF"}, "inverse FFT": bool, "Variable: b": f64, "Ncs": u16, "Ncp": u16}
  T1 = cluster{"Preamble mu": u16, "GFDM B": u16, "Preamble K": u16, "Preamble Ncp": u16, "GFDM Ncp": u16, "GFDM M": u16, "Preamble Ncs": u16, "GFDM K": u16, "GFDM Ncs": u16, "Preamble M": u16}
  "modem_configuration.gtype" = cluster{"K-1": u16, "M-1": u8, "N-1": u16, "N": u16, "Npreamble+CP+CS": u16, "Npreamble": u16, "Nw": u16, "Modulator MUX config": u64[16], "K": u16, "fft_size_log2(K)": u8, "inverse_fft": bool, "Start with preamble": bool, "Burstmode": bool, "Ncs": u16, "Ncp": u16, "N-Ncp": u16, "N+Ncp": u16, "N+Ncp+Ncs": u16, "Demodulator MUX config": u64[16], "M": u8, "DFT SIZE": FXP(6.0), "Frame length": u32, "Super frame length": u32, "Ns_all_GFDM_blocks": u32, "Ns_all_preambles": u32}
  T2 = cluster{"amount of symbols": u16[], "data elements [bits]": u16, "payload [bits]": f64, "payload [bytes]": f64, "half payload [byte]": f64}
  "GFDM all parameters.gtype" = cluster{"GFDM parameter": "GFDM parameter.gtype", "Sync config": T1, "Modem Configuration": "modem_configuration.gtype", "Preamble with CP, CS": c128[], "Preamble": c128[], "receiver filter gamma": c128[], "pulse shaping filter g": c128[], "rising window": c128[], "channel coefficients": c128[], "resource map as vector": enum{"Null", "Pilot", "Data"}[], "Pilots": c128[], "packet length": T2}
diagram:
  Property Node(instance in=$"GFDM parameter") -> ("Variable: K"=w1, "Variable: M"=w2, "Ncs"=w3, "Ncp"=w4)
  Property Node(instance in=T1 {all zero or empty}, "Preamble mu"=1, "GFDM B"=$"GFDM B", "Preamble K"=64, "Preamble Ncp"=32, "GFDM Ncp"=w4, "GFDM M"=w2, "Preamble Ncs"=16, "GFDM K"=w1, "GFDM Ncs"=w3, "Preamble M"=2) -> (instance out=w5)
  call "GFDM_Xcvr_create FPGA config.gvi"(GFDM parameter=$"GFDM parameter", Apply Window=$"Apply Window", GFDM config cluster=w5) -> (Modem Configuration=w6, rising window_u32=w7, rising window=w8)
  $"Modem Configuration" <- w6
  $"RX.sync.GFDM configuration cluster" <- w5
  Property Node(instance in=$"GFDM parameter") -> ("Variable: K"=w9, "Variable: M"=w10)
  Multiply(w9, w10) -> w11
  for (N = w11) {
    call "6.10_cfx_to_u32.gvi"(input=1+0i) -> (output=w14)
    append w14 to w12
    append 1+0i to w13
  }
  $"channel coefficients" <- w12
  $window <- w7
  call "generate pulse shape.gvi"(GFDM parameter=$"GFDM parameter", Norm filters=TRUE) -> (pulse shaping filter g=w15, receiver filter gamma=w16, pulse shape filter U64=w17, receive filter u64=w18)
  $"receive filter" <- w18
  $"pulse shape" <- w17
  call "ImportTxtFileToComplex_Preamble.gvi"() -> (data=w19)
  Property Node(instance in=w6) -> ("Npreamble"=w20)
  Subtract(x=w20, y=32) -> w21
  call "CP+CS.gvi"(data in=w19, Ncp=32, N-Ncp=w21, Ncs=16) -> (data out=w22)
  for {
    w23 = each element of w22
    call "4.12_cfx_to_u32.gvi"(input=w23) -> (output=w25)
    append w25 to w24
  }
  $preamble <- w24
  Property Node(instance in="GFDM all parameters.gtype" {all zero or empty}, "GFDM parameter"=$"GFDM parameter", "Sync config"=w5, "Modem Configuration"=w6, "Preamble with CP, CS"=w22, "Preamble"=w19, "receiver filter gamma"=w16, "pulse shaping filter g"=w15, "rising window"=w8, "channel coefficients"=w13) -> (instance out=w26)
  $"GFDM all parameters" <- w26
