vi "GFDM_Xcvr_configure FPGA.gvi"   [LabVIEW Communications System Design Suite 2.0.1]
inputs:
  "FPGA interface in": "FPGA interface.gtype"
  "Error": error
  "GFDM parameter": "GFDM parameter.gtype"
  "GFDM B": u16 = 1
  "packet length [byte]": u32
  "Kset_in": u8[]
  "Preamble path": path
  "Preamble mode": T3 = "Load from file"
  "preamble scale": f64
  "QAM order": enum{"4-QAM", "16-QAM", "64-QAM", "256-QAM"} = "4-QAM"
outputs:
  "FPGA interface out": "FPGA interface.gtype"
  "Error out": error
  "GFDM all parameters": "GFDM all parameters.gtype"
types:
  "GFDM parameter.gtype" = cluster{"Variable: K": i32, "Variable: M": i32, "Variable: a": f64, "filter type": enum{"rc", "rect"}, "receive filter": enum{"MF", "ZF"}, "inverse FFT": bool, "Variable: b": f64, "Ncs": u16, "Ncp": u16}
  T1 = cluster{"Preamble mu": u16, "GFDM B": u16, "Preamble K": u16, "Preamble Ncp": u16, "GFDM Ncp": u16, "GFDM M": u16, "Preamble Ncs": u16, "GFDM K": u16, "GFDM Ncs": u16, "Preamble M": u16}
  "modem_configuration.gtype" = cluster{"K-1": u16, "M-1": u8, "N-1": u16, "N": u16, "Npreamble+CP+CS": u16, "Npreamble": u16, "Nw": u16, "Modulator MUX config": u64[16], "K": u16, "fft_size_log2(K)": u8, "inverse_fft": bool, "Start with preamble": bool, "Burstmode": bool, "Ncs": u16, "Ncp": u16, "N-Ncp": u16, "N+Ncp": u16, "N+Ncp+Ncs": u16, "Demodulator MUX config": u64[16], "M": u8, "DFT SIZE": FXP(6.0), "Frame length": u32, "Super frame length": u32, "Ns_all_GFDM_blocks": u32, "Ns_all_preambles": u32}
  T2 = cluster{"amount of symbols": u16[], "data elements [bits]": u16, "payload [bits]": u16, "payload [bytes]": u16, "half payload [byte]": u16, "packet [byte]": u16}
  "GFDM all parameters.gtype" = cluster{"GFDM parameter": "GFDM parameter.gtype", "Sync config": T1, "Modem Configuration": "modem_configuration.gtype", "Preamble with CP, CS": c128[], "Preamble": c128[], "receiver filter gamma": c128[], "pulse shaping filter g": c128[], "rising window": c128[], "channel coefficients": c128[], "resource map as vector": enum{"Null", "Pilot", "Data"}[], "Pilots": c128[], "packet length": T2}
  T3 = enum{"Load from file", "Generate GFDM based Preamble"}
  T4 = cluster{"data": u32, "valid": bool, "index": u16}
diagram:
  Property Node(instance in=$"GFDM parameter") -> ("Variable: K"=w1, "Variable: M"=w2, "Ncs"=w3, "Ncp"=w4)
  disable {
    frame Enabled {
      call "genPreamble_fix.gvi"(preamble scale=$"preamble scale") -> (preambleOut=w5)
    }
    frame Disabled {
      call "Create preamble.gvi"(K=w1, Kset_in=$Kset_in, Preamble path=$"Preamble path", Preamble mode=$"Preamble mode", preamble scale=$"preamble scale") -> (Preamble=w5)
    }
  }
  Property Node(instance in=T1 {all zero or empty}, "Preamble mu"=1, "GFDM B"=$"GFDM B", "Preamble K"=64, "Preamble Ncp"=w4, "GFDM Ncp"=w4, "GFDM M"=w2, "Preamble Ncs"=w3, "GFDM K"=w1, "GFDM Ncs"=w3, "Preamble M"=2) -> (instance out=w6)
  Property Node(instance in=w6) -> ("Preamble K"=w7, "Preamble Ncp"=w8, "Preamble Ncs"=w9, "GFDM B"=w10, "Preamble M"=w11, instance out=w12)
  Multiply(w7, w11) -> w13
  Subtract(x=w13, y=w8) -> w14
  call "CP+CS.gvi"(data in=w5, Ncp=w8, N-Ncp=w14, Ncs=w9) -> (data out=w15)
  for {
    w16 = each element of w15
    call "4.12_cfx_to_u32.gvi"(input=w16) -> (output=w18)
    append w18 to w17
  }
  disable {
    frame Enabled {
      call "create FPGA config_fix.gvi"() -> (Modem Configuration=w25, rising window_u32=w19, rising window=w23)
      call "generate pulse shape_fix.gvi"(GFDM parameter=$"GFDM parameter") -> (pulse shaping filter g=w22, receiver filter gamma=w21, pulse shape filter U64=w20, receive filter u64=w24)
    }
    frame Disabled {
      call "create FPGA config.gvi"(GFDM parameter=$"GFDM parameter") -> (Modem Configuration=w25, rising window_u32=w19, rising window=w23)
      call "generate pulse shape.gvi"(GFDM parameter=$"GFDM parameter", Norm filters=TRUE) -> (pulse shaping filter g=w22, receiver filter gamma=w21, pulse shape filter U64=w20, receive filter u64=w24)
    }
  }
  sequence {
    frame 0 {
      Property Node(instance in=$"FPGA interface in", "Reset"=TRUE, "Reset counter"=TRUE, "Reset counter"=FALSE, error in=$Error) -> (error out=w26, instance out=w27)
    }
    frame 1 {
      Wait(time to wait=10)
    }
  }
  Add(w8, w9) -> w28
  Add(w13, w28) -> w29
  Property Node(instance in=w25) -> ("N"=w30, "N+Ncp+Ncs"=w31, instance out=w32)
  Multiply(w10, w31) -> w33
  Add(w33, w29) -> w34
  call "dft_core_config.gvi"(N=w30) -> (size=w35)
  Property Node(instance in=w32, "DFT SIZE"=w35, "Frame length"=w34, "Super frame length"=w34, "Ns_all_GFDM_blocks"=w33, "Ns_all_preambles"=w29, "Npreamble+CP+CS"=w29, "Npreamble"=w13) -> (instance out=w36)
  Array Subset(array=w5, length0=64) -> w37
  Add($"packet length [byte]", 3) -> w38
  Multiply(w38, 8) -> w39
  # XXX
  call "getInterleavingFactors.gvi"(AB=w39) -> (A=w40, B=w41)
  Multiply(w38, 8) -> w42
  Multiply(w40, w41) -> w43
  Property Node(instance in=w27, "TX.modem.configuration_in"=w36, "RX.sync.GFDM configuration cluster"=w12, "RX.sync.halfPreambleVectorIn"=w37, "RX.decoder.Block Size(bit,N)"=w42, "RX.sync.preambleOutFifoActive"=TRUE, "TX.payload size [Byte]"=$"packet length [byte]", "TX.qamOrder"=$"QAM order", "RX.payloadSize [byte]"=$"packet length [byte]", "TX.transpose A"=w40, "TX.transpose B"=w41, "transpose AB"=w43, "TX.frameLength"=w34, error in=w26) -> (error out=w44, instance out=w45)
  sequence {
    frame 0 {
      while {
        Property Node(instance in=w45, "Reset"=FALSE, error in=w44) -> ("RX.modem.reset active_out"=w46, "TX.modem.reset active_out"=w47, error out=w48, instance out=w49)
        Not(x=w46) -> w50
        Not(x=w47) -> w51
        Logical And(w50, w51) -> w52
        stop if w52
      }
    }
    frame 1 {
      Wait(time to wait=100)
    }
  }
  Host Fifo Write Node[FifoName="Needed Resources.grsc\\TX.pulse shape in"](data=w20, error in=w48, reference in=w49) -> (error out=w53, reference out=w54)
  Host Fifo Write Node[FifoName="Needed Resources.grsc\\TX.Window in"](data=w19, error in=w53, reference in=w54) -> (error out=w55, reference out=w56)
  disable (after w17) {
    frame Enabled {
      w57 = w56
      w58 = w55
    }
    frame Disabled {
      Host Fifo Write Node[FifoName="Needed Resources.grsc\\TX.Preamble in"](error in=w55, reference in=w56) -> (error out=w58, reference out=w57)
    }
  }
  Host Fifo Write Node[FifoName="Needed Resources.grsc\\RX.pulse shape in"](data=w24, error in=w58, reference in=w57) -> (error out=w59, reference out=w60)
  sequence {
    frame 0 {
      # write Preamble to TX modem
      for (iteration -> i1) {
        w61 = each element of w17
        while {
          To Unsigned Word Integer(number=i1) -> w62
          Property Node(instance in=T4 {all zero or empty}, "data"=w61, "valid"=TRUE, "index"=w62) -> (instance out=w63)
          Property Node(instance in=w60, "TX.modem.PreambleCpCsSampleIn"=w63, error in=w59) -> ("TX.modem.PreambleCpCsSampleOut"=w64, error out=w65, instance out=w66)
          Is Equal(x=w64, y=w63) -> w67
          Property Node(instance in=w67) -> ("data"=w68, "valid"=w69, "index"=w70)
          Logical And(w68, w69, w70) -> w71
          stop if w71
        }
      }
    }
    frame 1 {
      Wait(time to wait=10)
    }
    frame 2 {
      while {
        Property Node(instance in=w66, "TX.modem.configure_in"=TRUE, "RX.modem.configure_in"=TRUE, error in=w65) -> ("TX.modem.config done_out"=w72, "RX.modem.config done_out"=w73, error out=w74, instance out=w75)
        Logical And(w72, w73) -> w76
        Wait(time to wait=10)
        stop if w76
      }
    }
    frame 3 {
      Property Node(instance in=w75, "TX.modem.configure_in"=FALSE, "RX.modem.configure_in"=FALSE, error in=w74) -> (error out=w77, instance out=w78)
      Wait(time to wait=10)
    }
  }
  $"FPGA interface out" <- w78
  $"Error out" <- w77
  call "create FPGA config_fix.gvi"()
  Property Node(instance in=w25) -> ("N"=w79)
  for (N = w79) {
    call "6.10_cfx_to_u32.gvi"(input=-2+0i) -> (output=w81)
    append -2+0i to w80
  }
  Property Node(instance in="GFDM all parameters.gtype" {all zero or empty}, "GFDM parameter"=$"GFDM parameter", "Sync config"=w6, "Modem Configuration"=w36, "Preamble with CP, CS"=w15, "Preamble"=w5, "receiver filter gamma"=w21, "pulse shaping filter g"=w22, "rising window"=w23, "channel coefficients"=w80) -> (instance out=w82)
  $"GFDM all parameters" <- w82
