vi "GFDM_Xcvr_configure FPGA_CCA.gvi"   [LabVIEW Communications System Design Suite 2.0.1]
inputs:
  "OpaqueRefnumLiteral": "OpaqueRefnumLiteral_2.gtype"
  "Error": error
  "GFDM parameter": "GFDM parameter.gtype"
  "GFDM B": u16 = 1
  "TX.Encoder.packet length(Byte,N/8)": u32
  "Kset_in": u8[]
  "Preamble path": path
  "Preamble mode": T3 = "Load from file"
  "preamble scale": f64
outputs:
  "FPGA.Interface": "OpaqueRefnumLiteral_2.gtype"
  "Error out": error
  "GFDM all parameters": "GFDM all parameters.gtype"
types:
  "GFDM parameter.gtype" = cluster{"Variable: K": i32, "Variable: M": i32, "Variable: a": f64, "filter type": enum{"rc", "rect"}, "receive filter": enum{"MF", "ZF"}, "inverse FFT": bool, "Variable: b": f64, "Ncs": u16, "Ncp": u16}
  T1 = cluster{"Preamble mu": u16, "GFDM B": u16, "Preamble K": u16, "Preamble Ncp": u16, "GFDM Ncp": u16, "GFDM M": u16, "Preamble Ncs": u16, "GFDM K": u16, "GFDM Ncs": u16, "Preamble M": u16}
  "modem_configuration.gtype" = cluster{"K-1": u16, "M-1": u8, "N-1": u16, "N": u16, "Npreamble+CP+CS": u16, "Npreamble": u16, "Nw": u16, "Modulator MUX config": u64[16], "K": u16, "fft_size_log2(K)": u8, "inverse_fft": bool, "Start with preamble": bool, "Burstmode": bool, "Ncs": u16, "Ncp": u16, "N-Ncp": u16, "N+Ncp": u16, "N+Ncp+Ncs": u16, "Demodulator MUX config": u64[16], "M": u8, "DFT SIZE": FXP(6.0), "Frame length": u32, "Super frame length": u32, "Ns_all_GFDM_blocks": u32, "Ns_all_preambles": u32}
  T2 = cluster{"amount of symbols": u16[], "data elements [bits]": u16, "payload [bits]": f64, "payload [bytes]": f64, "half payload [byte]": f64}
  "GFDM all parameters.gtype" = cluster{"GFDM parameter": "GFDM parameter.gtype", "Sync config": T1, "Modem Configuration": "modem_configuration.gtype", "Preamble with CP, CS": c128[], "Preamble": c128[], "receiver filter gamma": c128[], "pulse shaping filter g": c128[], "rising window": c128[], "channel coefficients": c128[], "resource map as vector": enum{"Null", "Pilot", "Data"}[], "Pilots": c128[], "packet length": T2}
  T3 = enum{"Load from file", "Generate GFDM based Preamble"}
diagram:
  call "create FPGA config.gvi"(GFDM parameter=$"GFDM parameter") -> (Modem Configuration=w1, rising window_u32=w2, rising window=w3)
  Property Node(instance in=w1) -> ("N"=w4)
  for (N = w4) {
    call "6.10_cfx_to_u32.gvi"(input=-2+0i) -> (output=w7)
    append w7 to w5
    append -2+0i to w6
  }
  call "generate pulse shape.gvi"(GFDM parameter=$"GFDM parameter", Norm filters=TRUE) -> (pulse shaping filter g=w8, receiver filter gamma=w9, pulse shape filter U64=w10, receive filter u64=w11)
  Property Node(instance in=$"GFDM parameter") -> ("Variable: K"=w12, "Variable: M"=w13, "Ncs"=w14, "Ncp"=w15)
  call "Create preamble.gvi"(K=w12, Kset_in=$Kset_in, Preamble path=$"Preamble path", Preamble mode=$"Preamble mode", preamble scale=$"preamble scale") -> (Preamble=w16)
  Property Node(instance in=T1 {all zero or empty}, "Preamble mu"=1, "GFDM B"=$"GFDM B", "Preamble K"=64, "Preamble Ncp"=w15, "GFDM Ncp"=w15, "GFDM M"=w13, "Preamble Ncs"=w14, "GFDM K"=w12, "GFDM Ncs"=w14, "Preamble M"=2) -> (instance out=w17)
  Property Node(instance in=w17) -> ("Preamble K"=w18, "Preamble Ncp"=w19, "Preamble Ncs"=w20, "GFDM B"=w21, "Preamble M"=w22, instance out=w23)
  Multiply(w18, w22) -> w24
  Subtract(x=w24, y=w19) -> w25
  call "CP+CS.gvi"(data in=w16, Ncp=w19, N-Ncp=w25, Ncs=w20) -> (data out=w26)
  for {
    w27 = each element of w26
    call "4.12_cfx_to_u32.gvi"(input=w27) -> (output=w29)
    append w29 to w28
  }
  sequence {
    frame 0 {
      Property Node(instance in=$OpaqueRefnumLiteral, "Reset"=TRUE, "Reset counter"=TRUE, "Reset counter"=FALSE, error in=$Error) -> (error out=w30, instance out=w31)
    }
    frame 1 {
      Wait(time to wait=10)
    }
  }
  Property Node(instance in=w1) -> ("N"=w32, "N+Ncp+Ncs"=w33, instance out=w34)
  Add(w19, w20) -> w35
  Add(w24, w35) -> w36
  Multiply(w21, w33) -> w37
  call "dft_core_config.gvi"(N=w32) -> (size=w38)
  Add(w37, w36) -> w39
  Property Node(instance in=w34, "DFT SIZE"=w38, "Frame length"=w39, "Super frame length"=w39, "Ns_all_GFDM_blocks"=w37, "Ns_all_preambles"=w36, "Npreamble+CP+CS"=w36, "Npreamble"=w24) -> (instance out=w40)
  Array Subset(array=w16, length0=64) -> w41
  Multiply($"TX.Encoder.packet length(Byte,N/8)", 8) -> w42
  Property Node(instance in=w31, "TX.modem.configuration_in"=w40, "RX.sync.GFDM configuration cluster"=w23, "TX.Encoder.packet length(Byte,N/8)"=$"TX.Encoder.packet length(Byte,N/8)", "RX.sync.halfPreambleVectorIn"=w41, "RX.decoder.Block Size(bit,N)"=w42, error in=w30) -> (error out=w43, instance out=w44)
  sequence {
    frame 0 {
      while {
        Property Node(instance in=w44, "Reset"=FALSE, error in=w43) -> ("RX.modem.reset active_out"=w45, "TX.modem.reset active_out"=w46, error out=w47, instance out=w48)
        Not(x=w45) -> w49
        Not(x=w46) -> w50
        Logical And(w49, w50) -> w51
        stop if w51
      }
    }
    frame 1 {
      Wait(time to wait=100)
    }
  }
  Host Fifo Write Node[FifoName="Needed Resources.grsc\\TX.pulse shape in"](data=w10, error in=w47, reference in=w48) -> (error out=w52, reference out=w53)
  Host Fifo Write Node[FifoName="Needed Resources.grsc\\TX.Window in"](data=w2, error in=w52, reference in=w53) -> (error out=w54, reference out=w55)
  Host Fifo Write Node[FifoName="Needed Resources.grsc\\TX.Preamble in"](data=w28, error in=w54, reference in=w55) -> (error out=w56, reference out=w57)
  Host Fifo Write Node[FifoName="Needed Resources.grsc\\RX.pulse shape in"](data=w11, error in=w56, reference in=w57) -> (error out=w58, reference out=w59)
  Host Fifo Write Node[FifoName="Needed Resources.grsc\\RX.channel Coefficients in"](data=w5, error in=w58, reference in=w59) -> (error out=w60, reference out=w61)
  sequence {
    frame 0 {
      Wait(time to wait=10)
    }
    frame 1 {
      while {
        Property Node(instance in=w61, "TX.modem.configure_in"=TRUE, "RX.modem.configure_in"=TRUE, error in=w60) -> ("TX.modem.config done_out"=w62, "RX.modem.config done_out"=w63, error out=w64, instance out=w65)
        Logical And(w62, w63) -> w66
        Wait(time to wait=10)
        stop if w66
      }
    }
    frame 2 {
      Property Node(instance in=w65, "TX.modem.configure_in"=FALSE, "RX.modem.configure_in"=FALSE, error in=w64) -> (error out=w67, instance out=w68)
      Wait(time to wait=10)
    }
  }
  $"FPGA.Interface" <- w68
  $"Error out" <- w67
  Property Node(instance in="GFDM all parameters.gtype" {all zero or empty}, "GFDM parameter"=$"GFDM parameter", "Sync config"=w17, "Modem Configuration"=w40, "Preamble with CP, CS"=w26, "Preamble"=w16, "receiver filter gamma"=w9, "pulse shaping filter g"=w8, "rising window"=w3, "channel coefficients"=w6) -> (instance out=w69)
  $"GFDM all parameters" <- w69
