vi "GFDM_Xcvr_create FPGA config.gvi"   [LabVIEW Communications System Design Suite 2.0.1]
inputs:
  "GFDM parameter": "GFDM parameter.gtype"
  "Apply Window": bool
  "GFDM config cluster": T1
outputs:
  "Modem Configuration": "modem_configuration.gtype"
  "rising window_u32": u32[]
  "rising window": c128[]
types:
  "GFDM parameter.gtype" = cluster{"Variable: K": i32, "Variable: M": i32, "Variable: a": f64, "filter type": enum{"rc", "rect"}, "receive filter": enum{"MF", "ZF"}, "inverse FFT": bool, "Variable: b": f64, "Ncs": u16, "Ncp": u16}
  "modem_configuration.gtype" = cluster{"K-1": u16, "M-1": u8, "N-1": u16, "N": u16, "Npreamble+CP+CS": u16, "Npreamble": u16, "Nw": u16, "Modulator MUX config": u64[16], "K": u16, "fft_size_log2(K)": u8, "inverse_fft": bool, "Start with preamble": bool, "Burstmode": bool, "Ncs": u16, "Ncp": u16, "N-Ncp": u16, "N+Ncp": u16, "N+Ncp+Ncs": u16, "Demodulator MUX config": u64[16], "M": u8, "DFT SIZE": FXP(6.0), "Frame length": u32, "Super frame length": u32, "Ns_all_GFDM_blocks": u32, "Ns_all_preambles": u32}
  T1 = cluster{"Preamble mu": u16, "GFDM B": u16, "Preamble K": u16, "Preamble Ncp": u16, "GFDM Ncp": u16, "GFDM M": u16, "Preamble Ncs": u16, "GFDM K": u16, "GFDM Ncs": u16, "Preamble M": u16}
diagram:
  Property Node(instance in=$"GFDM parameter") -> ("Variable: K"=w1, "Variable: M"=w2, "inverse FFT"=w3, "Variable: b"=w4, "Ncs"=w5, "Ncp"=w6)
  Multiply(w1, w2) -> w7
  Property Node(instance in=$"GFDM config cluster") -> ("Preamble K"=w8, "Preamble M"=w9, "Preamble Ncp"=w10, "Preamble Ncs"=w11, "GFDM B"=w12)
  Multiply(w8, w9) -> w13
  Decrement(x=w1) -> w14
  Decrement(x=w7) -> w15
  Logarithm Base 2(x=w1) -> w16
  Decrement(x=w2) -> w17
  Add(w13, w10, w11) -> w18
  Math Node("M"=w2) -> ("mod_mux"=w19, "demod_mux"=w20)
  ~~~
  [mod_mux, demod_mux] = build_multiplexer(M);
  %demod_mux = pattern;
  %mod_mux = pattern2;
  %mod_mux = pattern2(1:M,1:M);
  %mod_mux = flipud(fliplr(mod_mux))
  ~~~
  call "calculate u64 multiplexer config.gvi"(Variable: pattern=w19) -> (Array=w21)
  Boolean To Integer(Boolean=$"Apply Window") -> (0, 1=w22)
  call "generate window.gvi"(K=w1, b=w4) -> (rising window=w23, Nw=w24)
  Multiply(w22, w24) -> w25
  call "calculate u64 multiplexer config.gvi"(Variable: pattern=w20) -> (Array=w26)
  Add(w7, w6) -> w27
  Add(w27, w5) -> w28
  Subtract(x=w7, y=w6) -> w29
  call "dft_core_config.gvi"(N=w7) -> (size=w30)
  Multiply(w28, w12) -> w31
  Add(w31, w18) -> w32
  Property Node(instance in="modem_configuration.gtype" {all zero or empty}, "M"=w2, "K-1"=w14, "M-1"=w17, "N-1"=w15, "N"=w7, "Nw"=w25, "Modulator MUX config"=w21, "Demodulator MUX config"=w26, "K"=w1, "fft_size_log2(K)"=w16, "inverse_fft"=w3, "Start with preamble"=TRUE, "Burstmode"=TRUE, "Ncs"=w5, "Ncp"=w6, "N-Ncp"=w29, "N+Ncp"=w27, "N+Ncp+Ncs"=w28, "DFT SIZE"=w30, "Frame length"=w32, "Super frame length"=w32, "Npreamble+CP+CS"=w18, "Npreamble"=w13, "Ns_all_GFDM_blocks"=w31, "Ns_all_preambles"=w18) -> (instance out=w33)
  $"Modem Configuration" <- w33
  for {
    w34 = each element of w23
    call "cfx_to_u32.gvi"(input=w34) -> (output=w36)
    append w36 to w35
  }
  $"rising window_u32" <- w35
  $"rising window" <- w23
