vi "Host Packet Coding.gvi"   [LabVIEW Communications System Design Suite 2.0.1]
panel controls:
  "N": f64
  "random?": bool
panel indicators:
  "valid config": bool
  "input bit stream": i8[]
  "output bit stream": i8[]
  "input elements": i32
  "output elements": i32
  "equal?": bool
  "Graph": u8[][]
diagram:
  w1 = $N
  for (N = w1) (iteration -> i1) {
    Random Number() -> (number (0 to 1)=w3)
    Multiply(w3, 255) -> w4
    Select(s=$"random?", t=w4, f=i1) -> w5
    To Unsigned Byte Integer(number=w5) -> w6
    append w6 to w2
  }
  Divide(x=w1, y=8) -> w7
  Round Toward Negative Infinity(x=w7) -> w8
  Subtract(x=w8, y=1) -> w9
  Array Subset(array=w2, length0=w9) -> w10
  Initialize Array(element=0, size=1) -> w11
  Build Array[ConcatenateInputs=True](w10, w11) -> w12
  call "MT UnPack Bits.gvi"(input integers=w12, bits per integer=8) -> (output bit stream=w13, error out=w14)
  Array Size(array=w13) -> (size(s)=w15)
  $"input elements" <- w15
  $"input bit stream" <- w13
  call "MT Convolutional Encoder (Rate).gvi"(input bit stream=w13, rate="1/2", constraint length=3, initial state=0, error in=w14, reset?=TRUE) -> (output bit stream=w16, error out=w17)
  Increment(x=7) -> w18
  Add(w18, 7) -> w19
  Initialize Array(element=0, size=w19) -> w20
  Build Array[ConcatenateInputs=True](w16, w20) -> w21
  call "MT Convolutional Decoder (Viterbi Hard Decision, Rate).gvi"(input bit stream=w21, rate="1/2", constraint length=3, initial state=0, error in=w17, traceback depth=7, reset?=TRUE) -> (output bit stream=w22)
  Is Equal[ComparisonMode=CompareAggregates](x=w13, y=w22) -> w23
  $"equal?" <- w23
  $"output bit stream" <- w22
  call "MT Pack Bits.gvi"(input bit stream=w22, bits per integer=8) -> (output integers=w24)
  for {
    w25 = each element of w24
    To Unsigned Byte Integer(number=w25) -> w27
    append w27 to w26
  }
  Array Subset(array=w26, length0=w9) -> w28
  Build Array(w2, w28) -> w29
  $Graph <- w29
  Array Size(array=w22) -> (size(s)=w30)
  $"output elements" <- w30
  Is Not Equal(x=w8, y=w7) -> w31
  $"valid config" <- w31
