vi "Preset K+M set.gvi"   [LabVIEW Communications System Design Suite 2.0.1]
inputs:
  "No DC": bool
  "M": u16
  "K": u16
outputs:
  "M_set": i32[]
  "K_set": i32[]
diagram:
  Divide(x=$K, y=2) -> w1
  Decrement(x=w1) -> w2
  for (N = $K) (iteration -> i1) {
    Decrement(x=$K) -> w4
    Is Equal(x=w4, y=i1) -> w5
    Not(x=w5) -> w6
    Is Equal(x=w1, y=i1) -> w7
    Not(x=w7) -> w8
    Is Equal(x=i1, y=w2) -> w9
    Not(x=w9) -> w10
    Is Equal To 0(x=i1) -> w11
    Logical And(w11, $"No DC") -> w12
    Not(x=w12) -> w13
    Logical And(w8, w10, w6, w13) -> w14
    append i1 to w3 if w14
  }
  $K_set <- w3
  for (N = $M) (iteration -> i2) {
    append i2 to w15
  }
  $M_set <- w15
