vi "Read Data from correlation Metric FIFO.gvi"   [LabVIEW Communications System Design Suite 2.0.1]
inputs:
  "length": u32 = 20000
  "FPGA.Interface_in": "FPGA interface.gtype"
  "Error_in": error
outputs:
  "Data available": bool
  "FPGA.Interface_out": "FPGA interface.gtype"
  "samples in FIFO_out": u32
  "Error_out": error
  "data_out": u64[]
diagram:
  Host Fifo Read Node[FifoName="Needed Resources.grsc\\RX.sync.correlation metric"](error in=$Error_in, number of elements=0, reference in=$"FPGA.Interface_in") -> (elements remaining=w1, error out=w2, reference out=w3)
  $"samples in FIFO_out" <- w1
  Is Greater Or Equal(x=w1, y=$length) -> w4
  $"Data available" <- w4
  case (w4) {
    frame False, Default {
      w5 = w3
      w6 = w2
      w7 = default
    }
    frame True {
      Host Fifo Read Node[FifoName="Needed Resources.grsc\\RX.sync.correlation metric"](error in=w2, number of elements=0, reference in=w3) -> (data=w7, error out=w6, reference out=w5)
    }
  }
  $"FPGA.Interface_out" <- w5
  $data_out <- w7
  $Error_out <- w6
