vi "Read debug FIFO.gvi"   [LabVIEW Communications System Design Suite 2.0.1]
inputs:
  "FIFO index": u32
  "Error": error
  "Enable": bool
  "length": u32
  "FPGA reference": "FPGA interface.gtype"
outputs:
  "reference out": "FPGA interface.gtype"
  "error out": error
  "data out": u64[]
  "active": bool
diagram:
  Feedback Node(input=$Enable) -> w1
  Is Not Equal(x=w1, y=$Enable) -> w2
  Logical And(w2, $Enable) -> w3
  case (w3) {
    frame False, Default {
      w4 = $"FPGA reference"
      w5 = $Error
      w6 = $"FIFO index"
    }
    frame True {
      # configure debug FIFO logic when activated
      sequence {
        frame 0 {
          # set to index 0 to stop all current reads
          Property Node(instance in=$"FPGA reference", "Request for debug signal"=0, error in=$Error) -> (error out=w7, instance out=w8)
        }
        frame 1 {
          # wait a bit
          Wait(time to wait=1)
        }
        frame 2 {
          # empty debug FIFO
          Host Fifo Read Node[FifoName="Resources.grsc\\Debug out"](error in=w7, number of elements=0, reference in=w8) -> (elements remaining=w9, error out=w10, reference out=w11)
          Host Fifo Read Node[FifoName="Resources.grsc\\Debug out"](error in=w10, number of elements=w9, reference in=w11) -> (error out=w12, reference out=w13)
        }
        frame 3 {
          # set to the wanted index
          Property Node(instance in=w13, "Request for debug signal"=$"FIFO index", error in=w12) -> (error out=w5, instance out=w4)
        }
      }
      w6 = $"FIFO index"
    }
  }
  case ($Enable) {
    frame False, Default {
      w14 = w4
      w15 = w5
      w16 = default
    }
    frame True {
      Property Node(instance in=w4, error in=w5) -> ("Request for debug signal"=w17, error out=w18, instance out=w19)
      Is Equal(x=w17, y=w6) -> w20
      case (w20) {
        frame False, Default {
          w14 = w19
          w15 = w18
          w16 = default
        }
        frame True {
          Host Fifo Read Node[FifoName="Resources.grsc\\Debug out"](error in=w18, number of elements=$length, reference in=w19, timeout (ms)=0) -> (data=w16, error out=w15, reference out=w14)
        }
      }
      $active <- w20
    }
  }
  $"reference out" <- w14
  $"data out" <- w16
  $"error out" <- w15
