vi "Remove DC subcarrier.gvi"   [LabVIEW Communications System Design Suite 2.0.1]
inputs:
  "GFDM parameter:Variable: K": i32
  "samples input": c128[]
  "RX.modem.Remove DC carrier": bool
outputs:
  "output": c128[]
diagram:
  case ($"RX.modem.Remove DC carrier") {
    frame False, Default {
      w1 = $"samples input"
    }
    frame True {
      for (iteration -> i1) {
        w2 = each element of $"samples input"
        Divide(x=$"GFDM parameter:Variable: K", y=2) -> w3
        Quotient And Remainder(x=i1, y=$"GFDM parameter:Variable: K") -> (x-y*floor(x/y)=w4)
        Is Not Equal(x=w3, y=w4) -> w5
        append w2 to w1 if w5
      }
    }
  }
  $output <- w1
