vi "Reset FPGA.gvi"   [LabVIEW Communications System Design Suite 2.0.1]
inputs:
  "USRP RIO device": string = "RIO0"
  "error in": error
outputs:
  "error out": error
  "USRP RIO device out": string
diagram:
  $"USRP RIO device out" <- $"USRP RIO device"
  sequence {
    frame 0 {
      FPGA Open Node[ProjectItem=":NullTarget:USRP\\-Empty\\-0002\\.lvbitx"](RIO address=$"USRP RIO device", error in=$"error in") -> (error out=w1, reference out=w2)
      FPGA Download Node(error in=w1, reference in=w2) -> (error out=w3, reference out=w4)
      FPGA Run Node(error in=w3, reference in=w4) -> (error out=w5, reference out=w6)
    }
    frame 1 {
      Wait(time to wait=1000)
    }
    frame 2 {
      FPGA Close Node(error in=w5, reference in=w6) -> (error out=w7)
    }
  }
  $"error out" <- w7
