vi "receive packet.gvi"   [LabVIEW Communications System Design Suite 2.0.1]
inputs:
  "packet size[byte]": u32 = 1316
  "payload": u32
  "split at_in": f64
  "gfdm block size[byte]_in": u32 = 71
  "gfdm blocks needed_in": u32
  "Error_in": error
  "stop": bool
  "timeout in milliseconds_in": i32 = -1
  "FPGA reference in": "FPGA interface.gtype"
outputs:
  "packet_out": u8[]
  "error in": error
  "frame counter": u32
  "gfdm block number": u32
  "element": u8
panel indicators:
  "frame counter_2": T1
types:
  T1 = cluster{"Element 1": u32, "Element 2": u32, "Element 3": i16, "Element 4": i32}
diagram:
  Decrement(x=$"gfdm blocks needed_in") -> w1
  Initialize Array(element=0, size=$"packet size[byte]") -> w2
  Feedback Node(input=w3) -> w4
  Array Size(array=w4) -> (size(s)=w5)
  Is Not Equal To 0(x=w5) -> w6
  Select(s=w6, t=w4, f=w2) -> w7
  s1 = w7  # shift register
  while (iteration -> i1) {
    Host Fifo Read Node[FifoName="Needed Resources.grsc\\RX.Data out.T2H"](error in=$Error_in, number of elements=$"gfdm block size[byte]_in", reference in=$"FPGA reference in", timeout (ms)=$"timeout in milliseconds_in") -> (data=w8, error out=w9)
    Array Subset(array=w8, index0=0, length0=2) -> w10
    Add($"split at_in", 2) -> w11
    Array Subset(array=w8, index0=w11, length0=2) -> w12
    Add(w11, 2) -> w13
    Array Subset(array=w8, index0=w13, length0=$"split at_in") -> w14
    Array Index(array=w14) -> (out0[_]=w15, out1[_]=w16, out2[_]=w17)
    Build Array(w15, w16) -> w18
    call "decode counter values.gvi"(first counter=w10, second counter=w12, third counter=w18) -> (frame counter=w19, gfdm block number=w20)
    Is Equal(x=w20, y=w1) -> w21
    Feedback Node(initial value=0, input=w19) -> w22
    Is Not Equal(x=w22, y=w19) -> w23
    Feedback Node(initial value=0, input=w20) -> w24
    Is Greater(x=w24, y=w20) -> w25
    Is Not Equal To 0(x=w20) -> w26
    Logical And(not w21, w23, w25, w26) -> w27
    Boolean To Integer(Boolean=w27) -> (0, 1=w28)
    Multiply(10, w28) -> w29
    Build Cluster(w19, w20, w29, i1) -> w30
    $"frame counter_2" <- w30
    $element <- w17
    Array Subset(array=w8, index0=2, length0=$"split at_in") -> w31
    Array Subset(array=w8, index0=w13, length0=$"split at_in") -> w32
    Build Array[ConcatenateInputs=True](w31, w32) -> w33
    Multiply(w20, $payload) -> w34
    case (w27) {
      frame True {
        Initialize Array(element=0, size=$"packet size[byte]") -> w36
        # data loss, next frame is coming
        Replace Array Subset(inArray=w36, index=w34, new=w33) -> w3
        w35 = s1
      }
      frame False {
        Replace Array Subset(inArray=s1, index=w34, new=w33) -> w35
        w3 = default
      }
    }
    call "Is Error.gvi"(error in=w9) -> (is error?=w37)
    Logical Or(w37, w21, w27, $stop) -> w38
    next s1 = w35
    stop if w38
  }
  $"error in" <- w9
  $"frame counter" <- w19
  $"gfdm block number" <- w20
  $packet_out <- s1
