vi "stop FIFOs.gvi"   [LabVIEW Communications System Design Suite 2.0.1]
inputs:
  "FPGA interface in": "FPGA interface.gtype"
  "Error": error
  "UseCAPIData": bool
outputs:
  "FPGA interface out": "FPGA interface.gtype"
  "error in": error
diagram:
  disable {
    frame Enabled {
      w1 = $"FPGA interface in"
      w2 = $Error
    }
    frame Disabled {
      Host Fifo Stop Node[FifoName="ChennalEstimationResource.grsc\\T2H.EqualizedPayladOut"](error in=$Error, reference in=$"FPGA interface in") -> (error out=w2, reference out=w1)
    }
  }
  case ($UseCAPIData) {
    frame True {
      w3 = w1
      w4 = w2
    }
    frame False {
      # data out
      Host Fifo Stop Node[FifoName="Needed Resources.grsc\\RX.Data out.T2H"](error in=w2, reference in=w1) -> (error out=w5, reference out=w6)
      # data in
      Host Fifo Stop Node[FifoName="Needed Resources.grsc\\TX.data in.H2T"](error in=w5, reference in=w6) -> (error out=w4, reference out=w3)
    }
  }
  Host Fifo Stop Node[FifoName="Needed Resources.grsc\\RX.Preamble out"](error in=w4, reference in=w3) -> (error out=w7, reference out=w8)
  Host Fifo Stop Node[FifoName="Needed Resources.grsc\\RX.pulse shape in"](error in=w7, reference in=w8) -> (error out=w9, reference out=w10)
  Host Fifo Stop Node[FifoName="Needed Resources.grsc\\RX.Debug.Modem_64 bit samples out"](error in=w9, reference in=w10) -> (error out=w11, reference out=w12)
  Host Fifo Stop Node[FifoName="Needed Resources.grsc\\TX.Debug.frame out"](error in=w11, reference in=w12) -> (error out=w13, reference out=w14)
  disable {
    frame Enabled {
      w15 = w14
      w16 = w13
    }
    frame Disabled {
      Host Fifo Stop Node[FifoName="Needed Resources.grsc\\TX.Preamble in"](error in=w13, reference in=w14) -> (error out=w16, reference out=w15)
    }
  }
  Host Fifo Stop Node[FifoName="Needed Resources.grsc\\TX.pulse shape in"](error in=w16, reference in=w15) -> (error out=w17, reference out=w18)
  Host Fifo Stop Node[FifoName="Needed Resources.grsc\\TX.Window in"](error in=w17, reference in=w18) -> (error out=w19, reference out=w20)
  Host Fifo Stop Node[FifoName="Updater Resources.grsc\\download"](error in=w19, reference in=w20) -> (error out=w21, reference out=w22)
  $"FPGA interface out" <- w22
  $"error in" <- w21
