vi "32 bit Array to chart graph.gvi"   [LabVIEW NXG]
inputs:
  "Array": u32[]
outputs:
  "x": f64[][]
diagram:
  for {
    w1 = each element of $Array
    call "u32_to_cfx.gvi"(input=w1) -> (output=w3)
    append w3 to w2
  }
  Insert Into Array(inArray=c128[][] [], new=w2) -> w4
  Absolute Value(x=w4) -> w5
  $x <- w5
