vi "4.12_cfx_to_u32.gvi"   [LabVIEW Communications System Design Suite 2.0.1]
inputs:
  "input": CFXP(4.12)
outputs:
  "output": u32
diagram:
  Complex To Real Imaginary(x + iy=$input) -> (x=w1, y=w2)
  # convert CDB data into FPGA data type
  Reinterpret Number[RestrictToSameWordLength=True](data in=w1, type=u16 0) -> (data out=w3)
  Reinterpret Number[RestrictToSameWordLength=True](data in=w2, type=u16 0) -> (data out=w4)
  Join Numbers(high(x)=w3, low(x)=w4) -> w5
  $output <- w5
