vi "CDB to 1.15 CFP U32.gvi"   [LabVIEW Communications System Design Suite 2.0.1]
inputs:
  "arrayIn": c128[]
outputs:
  "arrayOut": u32[]
panel indicators:
  "Array": CFXP(1.15)[]
diagram:
  for {
    w1 = each element of $arrayIn
    To Complex Fixed Point(complex fixed-point type=CFXP(1.15) 0+0i, number=w1) -> w3
    append w3 to w2
  }
  $Array <- w2
  Complex To Real Imaginary(x + iy=w2) -> (x=w4, y=w5)
  Reinterpret Number[RestrictToSameWordLength=True](data in=w4, type=i16 0) -> (data out=w6)
  Reinterpret Number[RestrictToSameWordLength=True](data in=w5, type=i16 0) -> (data out=w7)
  Join Numbers(high(x)=w6, low(x)=w7) -> w8
  $arrayOut <- w8
