vi "CDB to 16.16 FXP 64 bit.gvi"   [LabVIEW Communications System Design Suite 2.0.1]
inputs:
  "Input": c128
outputs:
  "Output": u64
diagram:
  To Complex Fixed Point(complex fixed-point type=CFXP(16.16) 0+0i, number=$Input) -> w1
  Complex To Real Imaginary(x + iy=w1) -> (x=w2, y=w3)
  Reinterpret Number[RestrictToSameWordLength=True](data in=w2, type=u32 0) -> (data out=w4)
  Reinterpret Number[RestrictToSameWordLength=True](data in=w3, type=u32 0) -> (data out=w5)
  Join Numbers(high(x)=w4, low(x)=w5) -> w6
  $Output <- w6
