vi "cfx_to_u64.gvi"   [LabVIEW NXG]
inputs:
  "input": CFXP(16.16)
outputs:
  "output": u64
diagram:
  Complex To Real Imaginary(x + iy=$input) -> (x=w1, y=w2)
  Reinterpret Number[RestrictToSameWordLength=True](data in=w1, type=u32 0) -> (data out=w3)
  Reinterpret Number[RestrictToSameWordLength=True](data in=w2, type=u32 0) -> (data out=w4)
  Join Numbers(high(x)=w3, low(x)=w4) -> w5
  $output <- w5
