vi "convert boolean to number.gvi"   [LabVIEW NXG]
inputs:
  "Numeric Constant": i32 = 2
  "boolean": bool
outputs:
  "element": i32
diagram:
  Boolean To Integer(Boolean=$boolean) -> (0, 1=w1)
  Multiply(w1, $"Numeric Constant") -> w2
  $element <- w2
