vi "convert u32 to dbl.gvi"   [LabVIEW Communications System Design Suite 2.0.1]
inputs:
  "data in": u32[]
outputs:
  "data out": c128[]
diagram:
  for {
    w1 = each element of $"data in"
    call "u32_to_cfx.gvi"(input=w1) -> (output=w3)
    append w3 to w2
  }
  call "norm CFX.gvi"(Input=w2) -> (Output=w4)
  $"data out" <- w4
