vi "file to array.gvi"   [LabVIEW Communications System Design Suite 2.0.1]
inputs:
  "path": path
  "replace dot by comma": bool
outputs:
  "array": f64[]
diagram:
  Open Or Create Or Replace File(access (0:read/write)="read-only", file path (use dialog)=$path) -> (error out=w1, refnum out=w2)
  Read From Text File(error in=w1, file (use dialog)=w2) -> (error out=w3, refnum out=w4, text=w5)
  case ($"replace dot by comma") {
    frame False, Default {
      w6 = w5
    }
    frame True {
      Search And Replace String(input string=w5, replace all? (F)=TRUE, replace string ("")=",", search string=".") -> (result string=w6)
    }
  }
  Close File(error in=w3, refnum=w4) -> (error out=w7)
  case (w7) {
    frame No Error, Default {
      Spreadsheet String To Array(array type=f64[][] [], format string="%e", spreadsheet string=w6) -> (array=w8)
    }
    frame Error {
      w8 = default
    }
  }
  Array Size(array=w8) -> (size(s)=w9)
  Array Index(array=w9) -> (out0[_]=w10)
  Reshape Array(inArray=w8, size=w10) -> w11
  $array <- w11
