vi "norm CFX-Array.gvi"   [LabVIEW NXG]
inputs:
  "Input": CFXP(16.16)[][]
outputs:
  "Output": CFXP(16.16)[][]
diagram:
  Absolute Value(x=$Input) -> w1
  Array Max And Min(array=w1) -> (max value=w2)
  Reciprocal(x=w2) -> w3: UFXP(16.15) Saturate:ConvergentRounding
  Multiply($Input, w3) -> w4: CFXP(16.16)[][] Saturate:ConvergentRounding
  $Output <- w4
