vi "norm CFX.gvi"   [LabVIEW Communications System Design Suite 2.0.1]
inputs:
  "Input": c128[]
outputs:
  "Output": c128[]
diagram:
  Absolute Value(x=$Input) -> w1
  Array Max And Min(array=w1) -> (max value=w2)
  Reciprocal(x=w2) -> w3: f64
  Multiply($Input, w3) -> w4: c128[]
  $Output <- w4
