vi "norm_to_CFX_1.15.gvi"   [LabVIEW Communications System Design Suite 2.0.1]
inputs:
  "Input": c128[]
outputs:
  "Output": CFXP(4.12)[]
diagram:
  Absolute Value(x=$Input) -> w1
  Array Max And Min(array=w1) -> (max value=w2)
  Reciprocal(x=w2) -> w3
  Multiply($Input, w3) -> w4
  $Output <- w4
