vi "u32_to_cfx.gvi"   [LabVIEW Communications System Design Suite 2.0.1]
inputs:
  "input": u32
outputs:
  "output": CFXP(2.14)
diagram:
  Split Number(x=$input) -> (high(x)=w1, low(x)=w2)
  Reinterpret Number[RestrictToSameWordLength=True](data in=w1, type=FXP(2.14) 0) -> (data out=w3)
  Reinterpret Number[RestrictToSameWordLength=True](data in=w2, type=FXP(2.14) 0) -> (data out=w4)
  Real And Imaginary To Complex(x=w3, y=w4) -> w5
  $output <- w5
