vi "u32array to 1.15 CDB.gvi"   [LabVIEW Communications System Design Suite 2.0.1]
inputs:
  "Array": u32[]
outputs:
  "arrayOut": CFXP(1.15)[]
diagram:
  Split Number(x=$Array) -> (high(x)=w1, low(x)=w2)
  Reinterpret Number[RestrictToSameWordLength=True](data in=w1, type=FXP(1.15) 0) -> (data out=w3)
  Reinterpret Number[RestrictToSameWordLength=True](data in=w2, type=FXP(1.15) 0) -> (data out=w4)
  Real And Imaginary To Complex(x=w3, y=w4) -> w5
  $arrayOut <- w5
