vi "u64_to_cfx.gvi"   [LabVIEW NXG]
inputs:
  "input": u64
outputs:
  "output": CFXP(16.16)
diagram:
  Split Number(x=$input) -> (high(x)=w1, low(x)=w2)
  Reinterpret Number[RestrictToSameWordLength=True](data in=w1, type=FXP(16.16) 0) -> (data out=w3)
  Reinterpret Number[RestrictToSameWordLength=True](data in=w2, type=FXP(16.16) 0) -> (data out=w4)
  Real And Imaginary To Complex(x=w3, y=w4) -> w5
  $output <- w5
