vi "Create preamble.gvi"   [LabVIEW Communications System Design Suite 2.0.1]
inputs:
  "K": u16 = 64
  "Kset_in": u8[]
  "Preamble path": path
  "Preamble mode": T1 = "Generate GFDM based Preamble"
  "preamble scale": f64
outputs:
  "Preamble": c128[]
panel indicators:
  "preamble Kset": i32[]
  "scale": i32
  "PSD": f64[]
  "abs": f64[]
  "real": f64[]
  "imag": f64[]
types:
  T1 = enum{"Load from file", "Generate GFDM based Preamble"}
diagram:
  case ($"Preamble mode") {
    frame "Generate GFDM based Preamble" {
      call "scale Kset.gvi"(K=$K, K preamble_in=64, Kset_in=$Kset_in) -> (K preamble_out=w2, scale=w3, Kset_out=w4)
      call "generate_flexible_preamble.gvi"(Kset_in=w4, K=w2) -> (samples_vector=w1)
      $scale <- w3
      $"preamble Kset" <- w4
    }
    frame "Load from file", Default {
      call "ImportTxtFileToComplex_Preamble.gvi"(Path=$"Preamble path") -> (data=w1)
    }
  }
  call "norm CFX.gvi"(Input=w1) -> (Output=w5)
  Multiply(w5, $"preamble scale") -> w6
  Absolute Value(x=w6) -> w7
  $abs <- w7
  Complex To Real Imaginary(x + iy=w6) -> (x=w8, y=w9)
  $real <- w8
  $imag <- w9
  $Preamble <- w6
  call "calculate psd.gvi"(time signal x=w6) -> (element=w10)
  $PSD <- w10
