vi "Create Modem test and reference data.gvi"   [LabVIEW Communications System Design Suite 2.0.1]
inputs:
  "Coding parameter": T2
  "GFDM Parameter in": "GFDM parameter.gtype" = {"Variable: K"=8, "Variable: M"=3, "Variable: a"=0.5, "filter type"="rc", "receive filter"="MF", "inverse FFT"=FALSE, "Variable: b"=0.5, "Ncs"=0, "Ncp"=0}
  "data generator": T1 = "Encoded data"
  "data symbol": i32 = 1
  "Bypass transform": bool
  "subsymbol": i32 = 1
  "Use modulator output for demodulator": bool
outputs:
  "receive filter": u64[]
  "FPGA config out": "modem_configuration.gtype"
  "data": c128[]
  "data_u32": u32[]
  "Demodulator output": c128[]
  "error out": error
  "transmit filter": u64[]
  "Modulator output": c128[]
panel indicators:
  "Absolute TX signal": f64[][]
types:
  T1 = enum{"Encoded data", "One data symbol equal 1", "One subsymbol equal 1", "Other", "Random"}
  T2 = cluster{"rate": enum{"1/2", "1/3", "1/4", "2/3", "3/4"}, "bits per symbol": u8, "symbol map": c128[], "total bits": i32, "PN sequence order": i32, "seed in": i32, "constraint length": i32, "initial state": u32, "Bits": i8[]}
  "GFDM parameter.gtype" = cluster{"Variable: K": i32, "Variable: M": i32, "Variable: a": f64, "filter type": enum{"rc", "rect"}, "receive filter": enum{"MF", "ZF"}, "inverse FFT": bool, "Variable: b": f64, "Ncs": u16, "Ncp": u16}
  "modem_configuration.gtype" = cluster{"K-1": u16, "M-1": u8, "N-1": u16, "N": u16, "Block CP": u16, "End of frame": u16, "Nw": u16, "Modulator MUX config": u64[16], "CP start": u16[16], "Subsymbol end": u16[16], "Subsymbol start": u16[16], "K": u16, "fft_size_log2(K)": u8, "inverse_fft": bool, "Create preamble": bool, "Burstmode": bool, "Ncs": u16, "Ncp": u16, "N-Ncp": u16, "N+Ncp": u16, "N+Ncp+Ncs": u16, "Demodulator MUX config": u64[16]}
diagram:
  call "check if K is power of two.gvi"(GFDM Parameter in=$"GFDM Parameter in") -> (GFDM Parameter out=w1)
  call "GFDM_Xcvr_create FPGA config.gvi"(GFDM parameter=w1) -> (Modem Configuration=w2)
  $"FPGA config out" <- w2
  case ($"data generator") {
    frame "Other" {
      Property Node(instance in=w1) -> ("Variable: K"=w12, "Variable: M"=w13)
      call "read test vector.gvi"(M=w13, direction="TX", K=w12) -> (input=w14, output=w15, g=w11)
      call "norm CFX.gvi"(Input=w11) -> (Output=w16)
      for {
        w17 = each element of w16
        call "cfx_to_u64.gvi"(input=w17) -> (output=w18)
        append w18 to w8
      }
      call "read test vector.gvi"(M=w13, direction="RX", K=w12) -> (output=w19, g=w10)
      call "norm CFX.gvi"(Input=w10) -> (Output=w20)
      for {
        w21 = each element of w20
        call "cfx_to_u64.gvi"(input=w21) -> (output=w22)
        append w22 to w3
      }
      call "norm CFX.gvi"(Input=w14)
      call "norm CFX.gvi"(Input=w19) -> (Output=w4)
      call "norm CFX.gvi"(Input=w15) -> (Output=w5)
      for {
        w23 = each element of w5
        call "cfx_to_u32.gvi"(input=w23) -> (output=w24)
        append w24 to w7
      }
      Array Size(array=w19) -> (size(s)=w25)
      Is Equal To 0(x=w25) -> w26
      case (w26) {
        frame False, Default {
          w9 = default
        }
        frame True {
          call "Build Error Cluster.gvi"(code=2, description="No test vector available.") -> (error out=w9)
        }
      }
      w6 = w5
    }
    frame "Encoded data", Default {
      call "Create test input data.gvi"(GFDM in=w1, number of GFDM blocks=1, data symbol=$"data symbol", coding parameter in=$"Coding parameter", data generator=$"data generator", subsymbol=$subsymbol) -> (Test data out=w27)
      Property Node(instance in=w27) -> ("pulse shape_u64"=w8, "receive_filter_u64"=w3, "GFDM parameter"=w28, "pulse shape"=w11, "data"=w29, "receive filter"=w10, "data_u32"=w30)
      call "time-domain modulator.gvi"(GFDM parameter=w28, Bypass FFT=$"Bypass transform", pulse shaping filter g=w11, data as a vector d=w29) -> (time signal x=w5, time signal x u32=w31, GFDM parameter out=w32)
      Select(s=$"Use modulator output for demodulator", t=w5, f=w29) -> w6
      call "time-domain demodulator.gvi"(GFDM parameter in=w32, Bypass transform=$"Bypass transform", receive filter gamma=w10, received signal y=w6) -> (iq symbols=w4)
      Select(s=$"Use modulator output for demodulator", t=w31, f=w30) -> w7
      w9 = default
    }
  }
  $"transmit filter" <- w8
  $"receive filter" <- w3
  $"Modulator output" <- w5
  $"Demodulator output" <- w4
  $data <- w6
  $data_u32 <- w7
  $"error out" <- w9
  Build Array(w10, w6, w5, w4, w11) -> w33
  Absolute Value(x=w33) -> w34
  $"Absolute TX signal" <- w34
