vi "Create Noise.gvi"   [LabVIEW Communications System Design Suite 2.0.1]
inputs:
  "length": u16
  "factor": f64 = 0.1
outputs:
  "output": c128[]
diagram:
  for (N = $length) {
    Random Number() -> (number (0 to 1)=w2)
    Random Number() -> (number (0 to 1)=w3)
    Subtract(x=w2, y=w3) -> w4
    Multiply($factor, w4) -> w5
    Random Number() -> (number (0 to 1)=w6)
    Random Number() -> (number (0 to 1)=w7)
    Subtract(x=w6, y=w7) -> w8
    Multiply($factor, w8) -> w9
    Real And Imaginary To Complex(x=w5, y=w9) -> w10
    append w10 to w1
  }
  $output <- w1
