vi "Create RX test frame.gvi"   [LabVIEW Communications System Design Suite 2.0.1]
inputs:
  "Array": c128[]
outputs:
  "element 1": u32[]
  "element 2": u32[]
diagram:
  for {
    w1 = each element of $Array
    call "4.12_cfx_to_u32.gvi"(input=0+0i) -> (output=w4)
    call "4.12_cfx_to_u32.gvi"(input=w1) -> (output=w5)
    append w5 to w2
    append w4 to w3
  }
  $"element 1" <- w3
  $"element 2" <- w2
