vi "Create coded bits.gvi"   [LabVIEW Communications System Design Suite 2.0.1]
inputs:
  "GFDM parameter in": "GFDM parameter.gtype"
  "symbol map": c128[]
  "bits per symbol": u8 = 1
  "reset?": bool = TRUE
outputs:
  "CDB symbols": c128[]
  "u32 symbols": u32[]
  "coded bit stream": i8[]
  "length": f64
  "source bit stream": i8[]
types:
  "GFDM parameter.gtype" = cluster{"Variable: K": i32, "Variable: M": i32, "Variable: a": f64, "filter type": enum{"rc", "rect"}, "receive filter": enum{"MF", "ZF"}, "inverse FFT": bool, "Variable: b": f64, "Ncs": u16, "Ncp": u16}
diagram:
  Property Node(instance in=$"GFDM parameter in") -> ("Variable: K"=w1, "Variable: M"=w2)
  Multiply(w1, w2) -> w3
  Multiply(w3, $"bits per symbol") -> w4
  Divide(x=w4, y=2) -> w5
  call "MT Generate Bits (Galois, PN Order).gvi"(total bits=w5, reset?=$"reset?") -> (output bit stream=w6, error out=w7)
  $"source bit stream" <- w6
  call "MT Convolutional Encoder (Rate).gvi"(input bit stream=w6, rate="1/2", constraint length=3, initial state=0, error in=w7, reset?=TRUE) -> (output bit stream=w8, error out=w9)
  call "mod_QAM Modulator Map Symbols.gvi"(input bit stream=w8, error in=w9, symbol map=$"symbol map", reset?=$"reset?") -> (symbols=w10)
  $"CDB symbols" <- w10
  for {
    w11 = each element of w10
    call "CDB to 2.14 FXP 32 bit.gvi"(Input=w11) -> (Output=w13)
    call "cfx_to_u32.gvi"(input=w11) -> (output=w14)
    append w14 to w12
  }
  $"u32 symbols" <- w12
  $"coded bit stream" <- w8
  $length <- w5
