vi "Create test frame.gvi"   [LabVIEW Communications System Design Suite 2.0.1]
inputs:
  "GFDM configuration": T1 = {"Preamble mu"=1, "GFDM B"=1, "Preamble K"=64, "Preamble Ncp"=32, "GFDM Ncp"=32, "GFDM M"=3, "Preamble Ncs"=16, "GFDM K"=64, "GFDM Ncs"=16, "Preamble M"=2}
outputs:
  "GFDM frame": c128[]
  "payload": c128[]
  "preamble": c128[]
types:
  T1 = cluster{"Preamble mu": u16, "GFDM B": u16, "Preamble K": u16, "Preamble Ncp": u16, "GFDM Ncp": u16, "GFDM M": u16, "Preamble Ncs": u16, "GFDM K": u16, "GFDM Ncs": u16, "Preamble M": u16}
diagram:
  call "ImportTxtFileToComplex_Preamble.gvi"() -> (data=w1)
  $preamble <- w1
  Property Node(instance in=$"GFDM configuration") -> ("Preamble K"=w2, "Preamble M"=w3, "Preamble Ncp"=w4, "Preamble Ncs"=w5, "GFDM K"=w6, "GFDM M"=w7, "GFDM Ncp"=w8, "GFDM Ncs"=w9)
  Multiply(w6, w7) -> w10
  for (N = w10) (iteration -> i1) {
    Divide(x=i1, y=w10) -> w12
    To Double Precision Complex(number=w12) -> w13
    append w13 to w11
  }
  $payload <- w11
  Multiply(w2, w3) -> w14
  Subtract(x=w14, y=w5) -> w15
  call "CP+CS.gvi"(data in=w1, Ncp=w4, N-Ncp=w15, Ncs=w5) -> (data out=w16)
  Subtract(x=w10, y=w9) -> w17
  call "CP+CS.gvi"(data in=w11, Ncp=w8, N-Ncp=w17, Ncs=w9) -> (data out=w18)
  Build Array[ConcatenateInputs=True](w16, w18) -> w19
  $"GFDM frame" <- w19
