vi "Create test input data.gvi"   [LabVIEW Communications System Design Suite 2.0.1]
inputs:
  "complex symbols": c128[]
  "GFDM in": "GFDM parameter.gtype" = {"Variable: K"=8, "Variable: M"=3, "Variable: a"=0.5, "filter type"="rc", "receive filter"="MF", "inverse FFT"=FALSE, "Variable: b"=0.5, "Ncs"=0, "Ncp"=0}
  "number of GFDM blocks": i32 = 1
  "data symbol": i32 = 1
  "coding parameter in": T2 = {"rate"="1/2", "bits per symbol"=1, "symbol map"=[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], "total bits"=128, "PN sequence order"=9, "seed in"=-692093454, "constraint length"=3, "initial state"=0, "Bits"=[]}
  "data generator": T1 = "Encoded data"
  "subsymbol": i32 = 1
outputs:
  "Test data out": "Modem_test_data.gtype"
panel indicators:
  "Filter": f64[][]
  "data": f64[]
types:
  T1 = enum{"Encoded data", "One data symbol equal 1", "One subsymbol equal 1", "Other", "Random"}
  T2 = cluster{"rate": enum{"1/2", "1/3", "1/4", "2/3", "3/4"}, "bits per symbol": u8, "symbol map": c128[], "total bits": i32, "PN sequence order": i32, "seed in": i32, "constraint length": i32, "initial state": u32, "Bits": i8[]}
  "GFDM parameter.gtype" = cluster{"Variable: K": i32, "Variable: M": i32, "Variable: a": f64, "filter type": enum{"rc", "rect"}, "receive filter": enum{"MF", "ZF"}, "inverse FFT": bool, "Variable: b": f64, "Ncs": u16, "Ncp": u16}
  "Modem_test_data.gtype" = cluster{"coding parameter": T2, "complex symbols": c128[], "subsymbol": i32, "data symbol": i32, "data generator": T1, "number of GFDM blocks": i32, "pulse shape": c128[], "receive filter": c128[], "data": c128[], "N": i32, "length": i32, "pulse shape_u64": u64[], "receive_filter_u64": u64[], "data_u32": u32[], "GFDM parameter": "GFDM parameter.gtype"}
uses:
  NI::Analysis::Generation::Uniform White Noise.gvi
diagram:
  Property Node(instance in=$"GFDM in") -> ("Variable: K"=w1, "Variable: M"=w2)
  call "number_of_symbols.gvi"(coding parameter in=$"coding parameter in", GFDM in=$"GFDM in", loop count=$"number of GFDM blocks") -> (coding parameter out=w3, GFDM out=w4)
  Multiply(w1, w2) -> w5
  Multiply(w5, $"number of GFDM blocks") -> w6
  case ($"data generator") {
    frame "Encoded data", Default {
      call "Encoding.gvi"(coding parameter in=w3) -> (complex symbols=w7)
    }
    frame "One data symbol equal 1" {
      Initialize Array(element=0+0i, size=w5) -> w8
      Replace Array Subset(inArray=w8, index=$"data symbol", new=1+0i) -> w7
    }
    frame "One subsymbol equal 1" {
      Multiply(w1, $subsymbol) -> w9
      Initialize Array(element=0+0i, size=w5) -> w10
      Initialize Array(element=1+0i, size=w1) -> w11
      Replace Array Subset(inArray=w10, index=w9, new=w11) -> w7
    }
    frame "Other" {
      w7 = $"complex symbols"
    }
    frame "Random" {
      Property Node(instance in=w3) -> ("seed in"=w12)
      call "Uniform White Noise.gvi"(samples=w6, seed=w12) -> (uniform white noise=w13)
      call "Uniform White Noise.gvi"(samples=w6, seed=w12) -> (uniform white noise=w14)
      Real And Imaginary To Complex(x=w13, y=w14) -> w7
    }
  }
  Absolute Value(x=w7) -> w15
  $data <- w15
  call "generate pulse shape.gvi"(GFDM parameter=w4) -> (pulse shaping filter g=w16, receiver filter gamma=w17, GFDM parameter out=w18)
  s1 = c128[] []  # shift register
  while {
    Decrement(x=w6) -> w19
    Build Array[ConcatenateInputs=True](s1, w7) -> w20
    Array Size(array=w20) -> (size(s)=w21)
    Is Greater Or Equal(x=w21, y=w19) -> w22
    next s1 = w20
    stop if w22
  }
  for {
    w23 = each element of w16
    call "cfx_to_u64.gvi"(input=w23) -> (output=w25)
    append w25 to w24
  }
  for {
    w26 = each element of w17
    call "cfx_to_u64.gvi"(input=w26) -> (output=w28)
    append w28 to w27
  }
  for {
    w29 = each element of s1
    call "cfx_to_u32.gvi"(input=w29) -> (output=w31)
    append w31 to w30
  }
  w32 = "Modem_test_data.gtype" {"coding parameter"={"rate"="1/2", "bits per symbol"=1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}, "subsymbol"=1, "data symbol"=1, "data generator"="Encoded data", "number of GFDM blocks"=1, "GFDM parameter"={"Variable: K"=8, "Variable: M"=3, "Variable: a"=0.5, "filter type"="rc", "receive filter"="MF", "inverse FFT"=FALSE, "Variable: b"=0.5, "Ncs"=0, "Ncp"=0}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}
  Property Node(instance in=w32, "GFDM parameter"=w18, "coding parameter"=w3, "complex symbols"=$"complex symbols", "subsymbol"=$subsymbol, "data symbol"=$"data symbol", "data generator"=$"data generator", "number of GFDM blocks"=$"number of GFDM blocks", "pulse shape"=w16, "receive filter"=w17, "data"=s1, "N"=w5, "length"=w21, "pulse shape_u64"=w24, "receive_filter_u64"=w27, "data_u32"=w30) -> (instance out=w33)
  $"Test data out" <- w33
  Build Array(w17, w16) -> w34
  Absolute Value(x=w34) -> w35
  $Filter <- w35
