vi "Create uncoded bits.gvi"   [LabVIEW Communications System Design Suite 2.0.1]
inputs:
  "GFDM parameter in": "GFDM parameter.gtype"
  "symbol map": c128[]
  "bits per symbol": u8 = 1
  "reset?": bool = TRUE
outputs:
  "CDB symbols": c128[]
  "u32 symbols": u32[]
  "output bit stream": i8[]
  "length": i32
types:
  "GFDM parameter.gtype" = cluster{"Variable: K": i32, "Variable: M": i32, "Variable: a": f64, "filter type": enum{"rc", "rect"}, "receive filter": enum{"MF", "ZF"}, "inverse FFT": bool, "Variable: b": f64, "Ncs": u16, "Ncp": u16}
diagram:
  Property Node(instance in=$"GFDM parameter in") -> ("Variable: K"=w1, "Variable: M"=w2)
  Multiply(w1, w2) -> w3
  Multiply(w3, $"bits per symbol") -> w4
  call "MT Generate Bits (Galois, PN Order).gvi"(total bits=w4, reset?=$"reset?") -> (output bit stream=w5, error out=w6)
  call "mod_QAM Modulator Map Symbols.gvi"(input bit stream=w5, error in=w6, symbol map=$"symbol map", reset?=$"reset?") -> (symbols=w7)
  $"CDB symbols" <- w7
  for {
    w8 = each element of w7
    call "CDB to 2.14 FXP 32 bit.gvi"(Input=w8) -> (Output=w10)
    append w10 to w9
  }
  $"u32 symbols" <- w9
  $"output bit stream" <- w5
  $length <- w4
