vi "De-Activate first and last subsymbol.gvi"   [LabVIEW NXG]
inputs:
  "GFDM properties": T1 = {"Number of subcarriers (K)"=8, "Number of subsymbols (M)"=5, "filter_type"="rc", "roll off factor (a)"=0.5, "seed for data generator"=1, "bits per symbol"=1, "source"="random", "receiver"="MF", "cyclic prefix Ncp"=4, "window Nw"=32, "window roll off factor b"=0.5, "window_type"="rc", "trainings_sequence_2"="Null", "seed for trainings sequence"=1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}
  "Do it": bool
  "Activate/Deactivate": bool
outputs:
  "Do it out": bool
  "Cluster": T1
types:
  T1 = cluster{"Number of subcarriers (K)": i32, "Number of subsymbols (M)": i32, "filter_type": string, "roll off factor (a)": f64, "N": i32, "seed for data generator": i32, "pulse shaping filter g": c128[], "data symbols as a vector d": c128[], "data symbols as a matrix D": c128[][], "bits per symbol": i32, "source": enum{"random", "zeros", "seeded"}, "receive filter gamma": c128[], "receiver": enum{"MF", "ZF", "MMSE"}, "symbol map": c128[], "bits d": i8[], "cyclic prefix Ncp": u16, "cyclic suffix Ncs": u16, "window Nw": u16, "window roll off factor b": f64, "window_type": string, "window": c128[], "resource map": enum{"Null", "Pilot", "Data"}[][], "trainings_sequence": c128[], "complete resource map": enum{"Null", "Pilot", "Data"}[][], "trainings_sequence_2": enum{"Null", "Ones", "Random", "Alternating"}, "seed for trainings sequence": i32}
diagram:
  case ($"Do it") {
    frame False, Default {
      w1 = $"GFDM properties"
      w2 = $"Do it"
    }
    frame True {
      Property Node(instance in=$"GFDM properties") -> (instance out=w3, "Number of subcarriers (K)"=w4, "Number of subsymbols (M)"=w5, "resource map"=w6)
      Select(s=$"Activate/Deactivate", t="Pilot", f="Null") -> w7
      Initialize Array(element=w7, size=w4) -> w8
      Subtract(x=w5, y=2) -> w9
      Transpose 2D Array(2D array=w6) -> (transposed array=w10)
      Array Subset(array=w10, index0=1, length0=w9) -> w11
      Build Array[ConcatenateInputs=True](w8, w11, w8) -> w12
      Transpose 2D Array(2D array=w12) -> (transposed array=w13)
      Property Node(instance in=w3, "resource map"=w13) -> (instance out=w1)
      w2 = FALSE
    }
  }
  $Cluster <- w1
  $"Do it out" <- w2
