vi "GFDM RX signals.gvi"   [LabVIEW Communications System Design Suite 2.0.1]
inputs:
  "Variable: K": f64 = 4
  "Variable: M": f64 = 3
  "Data generator?": T1 = "First Symbol"
  "Variable: number": f64 = 1
  "Variable: random_g": bool
  "RX Mode": bool
outputs:
  "demodulator_mux": u64[16]
  "shifted_samples": u32[][]
  "splitted samples": u32[][]
  "filtered samples": u64[][]
  "samples after superposition": u64[]
  "reference": c128[]
  "filter": u64[]
  "M-1": f64
  "N-1": f64
  "K-1": f64
  "Variable: filtered_samples": c128[][]
  "Variable: shifted_samples": c128[][]
  "Variable: splitted_samples": c128[][]
  "Variable: superposition_samples": c128[]
  "Variable: x": c128[]
  "TX signal": u32[]
  "Variable: gd": c128[]
  "transmitted data": c128[]
  "modulator_mux": u64[16]
panel controls:
  "limit": f64 = 0.1
panel indicators:
  "received data": f64[]
  "filter_2": f64[]
  "Graph": f64[][]
  "Demodulator test passed": bool
types:
  T1 = enum{"First Symbol", "Random", "Seeded", "Set datablock given in number to 1", "Other"}
diagram:
  case ($"Data generator?") {
    frame "First Symbol", Default {
      w1 = default
      w2 = default
      w3 = default
      w4 = default
    }
    frame "Other" {
      Select(s=$"RX Mode", t="RX", f="TX") -> w5
      call "read test vector.gvi"(M=$"Variable: M", direction=w5, K=$"Variable: K") -> (input=w1, output=w3, g=w2)
      w4 = TRUE
    }
  }
  Math Node("M"=$"Variable: M", "K"=$"Variable: K", "data_generator"=$"Data generator?", "number"=$"Variable: number", "random_g"=$"Variable: random_g", "input"=w1, "filter"=w2, "RX_Mode"=$"RX Mode") -> ("shifted_samples"=w6, "y_splitted"=w7, "filtered_samples"=w8, "recovered"=w9, "superposition_samples"=w10, "demod_mux"=w11, "gd"=w12, "K"=w13, "M"=w14, "N"=w15, "x"=w16, "s"=w17, "mod_mux"=w18)
  ~~~
  N = K * M
  a = 0.5
  s = zeros(N,1);
  if (number > N)
      number = N;
  end
  if (data_generator == 0)
      s(1) = 1;
  elseif (data_generator == 1)
      s = (randint(N,1)*2-1);
  elseif (data_generator == 2)
      s = (rand(N,1)*2-1);
  elseif (data_generator == 3)
      s(number) = 1;
  else
      s = input;
  end

  % Prepare Multiplexer
  [pattern, pattern2] = build_multiplexer(M);
  demod_mux = pattern;
  mod_mux = pattern2(1:M,1:M);
  mod_mux = flipud(fliplr(mod_mux))
  if (RX_Mode == 0)
      pattern = mod_mux;
  end

  if (data_generator ~= 4)
      %%%%%%%%%%%%%%%%%%%%%%%%%%%%%%%%%
      % Prepare
      %%%%%%%%%%%%%%%%%%%%%%%%%%%%%%%%%
      %Prepare pulseshape
      g = rc( a, K, M, 'time', false );
      if (random_g == 1)
          g = g + randn(N,1);
      end
      g = fftshift( g );

      % employ simplified algorithm for calculation of the canonical dual
      % gabor window in case of critical sampling.
      if (RX_Mode == 1)
          gm = reshape(g, K, M);
          Gm = fft(gm, [], 2);
          iGm = 1 ./ conj(Gm);
          gmd = ifft(iGm, [], 2);
          gd = reshape(gmd, N, 1) / K;
      else
          gd = g;
      end

      %%%%%%%%%%%%%%%%%%%%%%%%%%%%%%%%%
      % Reference TX
      %%%%%%%%%%%%%%%%%%%%%%%%%%%%%%%%%
  %    if (RX_Mode == 1)
  %        Data = reshape(s, [], M);
  %        x = zeros(N,1);
  %        for n=0:N-1
  %           for k=0:K-1
  %              for m=0:M-1
  %                pos_in_g = mod(n - m*K, N);
  %                x(n+1) = x(n+1) + Data(k + 1, m + 1) * g(pos_in_g + 1) * exp(1i*2*pi*k*n/K);
  %              end
  %           end
  %        end
  %        x = x ./ (max(abs(x)));
  %    else
  %        x = s;
  %    end

  %    if (RX_Mode == 0)
  %        x = [];
  %        for m = 1:M
  %            if ((data_generator == 0) && (m == 1))
  %                samples(1:K) = 1;
  %                samples = samples.';
  %            else
  %                %Apply FFT
  %                samples = ifft(s(K*(m - 1)+1:K*m));
  %            end
  %            x = [x;samples];
  %        end
          %x = reshape(x, [], N);
          %x = x.'
      %end

  else
      s = input;
      gd = filter;
  end
  x = s;
  %%%%%%%%%%%%%%%%%%%%%%%%%%%%%%%%%
  % Reference RX
  %%%%%%%%%%%%%%%%%%%%%%%%%%%%%%%%%

  gd_splitted = reshape(gd,K,M);
  y_splitted = reshape(s,K,M);

  shifted_samples = [];

  filtered_samples = [];
  superposition = [];
  recovered = [];
  superposition_samples = [];
  shifted=[];
  filter = [];
  for m = 1:M
      shifted = [];
      for i = 1:M
          shifted(i,1:K) = y_splitted(1:K,pattern(i,m));
      end
      shifted_samples = [shifted_samples; shifted.'];
      filter = gd_splitted .* shifted.';
      filtered_samples = [filtered_samples; filter];
      superposition = [];
      for k = 1:K
          superposition = [superposition, sum(filter(k,:))];
      end
      superposition_samples = [superposition_samples; superposition.'];
      if (RX_Mode == 1)
          recovered = [recovered fft(superposition)];
      else
          recovered = [recovered superposition];
      end
  end
  ~~~
  call "calculate u64 multiplexer config.gvi"(Variable: pattern=w18) -> (Array=w19)
  $modulator_mux <- w19
  $"Variable: gd" <- w12
  Decrement(x=w13) -> w20
  $"K-1" <- w20
  Decrement(x=w14) -> w21
  $"M-1" <- w21
  Decrement(x=w15) -> w22
  $"N-1" <- w22
  for {
    w23 = each element of w12
    call "cfx_to_u64.gvi"(input=w23) -> (output=w25)
    append w25 to w24
  }
  $filter <- w24
  Absolute Value(x=w12) -> w26
  $filter_2 <- w26
  call "calculate u64 multiplexer config.gvi"(Variable: pattern=w11) -> (Array=w27)
  $demodulator_mux <- w27
  $"Variable: x" <- w16
  for {
    w28 = each element of w16
    call "cfx_to_u32.gvi"(input=w28) -> (output=w30)
    append w30 to w29
  }
  $"TX signal" <- w29
  for {
    w31 = each element of w7
    for {
      w33 = each element of w31
      call "cfx_to_u32.gvi"(input=w33) -> (output=w35)
      append w35 to w34
    }
    append w34 to w32
  }
  $"splitted samples" <- w32
  $"Variable: splitted_samples" <- w7
  for {
    w36 = each element of w6
    for {
      w38 = each element of w36
      case (FALSE) {
        frame False, Default {
          call "cfx_to_u32.gvi"(input=w38) -> (output=w40)
        }
        frame True {
          Complex To Real Imaginary(x + iy=w38) -> (x=w41, y=w42)
          To Fixed Point(fixed-point type=FXP(2.14) 0, number=w41) -> w43
          Reinterpret Number[RestrictToSameWordLength=True](data in=w43, type=u16 0) -> (data out=w44)
          To Fixed Point(fixed-point type=FXP(2.14) 0, number=w42) -> w45
          Reinterpret Number[RestrictToSameWordLength=True](data in=w45, type=u16 0) -> (data out=w46)
          Join Numbers(high(x)=w44, low(x)=w46) -> w40
        }
      }
      append w40 to w39
    }
    append w39 to w37
  }
  $shifted_samples <- w37
  $"Variable: shifted_samples" <- w6
  for {
    w47 = each element of w8
    for {
      w49 = each element of w47
      call "cfx_to_u64.gvi"(input=w49) -> (output=w51)
      append w51 to w50
    }
    append w50 to w48
  }
  $"filtered samples" <- w48
  $"Variable: filtered_samples" <- w8
  for {
    w52 = each element of w10
    call "cfx_to_u64.gvi"(input=w52) -> (output=w54)
    append w54 to w53
  }
  $"samples after superposition" <- w53
  $"Variable: superposition_samples" <- w10
  Not(x=w4) -> w55
  Select(s=w55, t=w9, f=w3) -> w56
  $reference <- w56
  Absolute Value(x=w56) -> w57
  $"received data" <- w57
  $"transmitted data" <- w17
  case (w4) {
    frame False { }
    frame True {
      Build Array(w3, w9) -> w58
      Absolute Value(x=w58) -> w59
      $Graph <- w59
      call "compare_elements.gvi"(reference=w3, array=w9, limit=$limit) -> (equal=w60)
      $"Demodulator test passed" <- w60
    }
  }
