vi "TX packet generator.gvi"   [LabVIEW Communications System Design Suite 2.0.1]
inputs:
  "input data": u8[]
  "packet_counter": u8
  "gfdm block size[byte]": u32 = 71
  "overhead[byte]]": u32
outputs:
  "payload": u32
  "split at": f64
  "generated length": i32
  "Array": u32[]
  "gfdm data": u8[]
  "gfdm data length": i32
  "gfdm blocks needed": u32
  "frame number": u8
diagram:
  Subtract(x=$"gfdm block size[byte]", y=$"overhead[byte]]") -> w1
  $payload <- w1
  Divide(x=w1, y=2) -> w2
  $"split at" <- w2
  Array Size(array=$"input data") -> (size(s)=w3)
  Divide(x=w3, y=w1) -> w4
  Round Toward Positive Infinity(x=w4) -> w5
  Initialize Array(element=0, size=w2) -> w6
  for (N = w5) (iteration -> i1) {
    call "code counter.gvi"(gfdm_block_counter=i1, frame counter=$packet_counter) -> (coded=w9, number=w10, frame number=w11)
    Multiply(w1, i1) -> w12
    Array Subset(array=$"input data", index0=w12, length0=w1) -> w13
    Split 1D Array(array=w13, index=w2) -> (first subarray=w14, second subarray=w15)
    Replace Array Subset(inArray=w6, index=0, new=w15) -> w16
    Build Array[ConcatenateInputs=True](w9, w14, w9, w16, w9, w10) -> w17
    concatenate w17 onto w7
    append w12 to w8
  }
  Array Size(array=w7) -> (size(s)=w18)
  $"generated length" <- w18
  $Array <- w8
  # needed blocks
  Multiply($"gfdm block size[byte]", w5) -> w19
  # packet buffer
  Initialize Array(element=0, size=w19) -> w20
  Replace Array Subset(inArray=w20, index=_, new=w7) -> w21
  $"gfdm data" <- w21
  $"frame number" <- w11
  Array Size(array=w21) -> (size(s)=w22)
  $"gfdm data length" <- w22
  $"gfdm blocks needed" <- w5
