vi "calculate u64 multiplexer config.gvi"   [LabVIEW Communications System Design Suite 2.0.1]
inputs:
  "Variable: pattern": u8[][]
outputs:
  "Array": u64[16]
panel indicators:
  "written": u8[]
diagram:
  for {
    w1 = each element of $"Variable: pattern"
    s1 = 0  # shift register
    for (iteration -> i1) {
      w4 = each element of w1
      Decrement(x=w4) -> w6
      To Unsigned Quad Integer(number=w6) -> w7
      Subtract(x=15, y=i1) -> w8
      Multiply(w8, 4) -> w9
      Logical Shift(x=w7, y=w9) -> w10
      Add(w10, s1) -> w11
      append w6 to w5
      next s1 = w11
    }
    append s1 to w2
    concatenate w5 onto w3
  }
  $Array <- w2
  $written <- w3
