vi "create bytes.gvi"   [LabVIEW Communications System Design Suite 2.0.1]
inputs:
  "N bits": u16
  "Random data?": bool
outputs:
  "bytes out": u8[]
panel indicators:
  "Graph": u8[]
diagram:
  Divide(x=$"N bits", y=8) -> w1
  for (N = w1) (iteration -> i1) {
    Increment(x=i1) -> w3
    Random Number() -> (number (0 to 1)=w4)
    Multiply(w4, 255) -> w5
    Select(s=$"Random data?", t=w5, f=w3) -> w6
    To Unsigned Byte Integer(number=w6) -> w7
    append w7 to w2
  }
  $Graph <- w2
  $"bytes out" <- w2
