vi "create proper ressource map.gvi"   [LabVIEW Communications System Design Suite 2.0.1]
inputs:
  "resource map": enum{"Null", "Pilot", "Data"}[][] = [["Null", "Pilot", "Data", "Pilot", "Null"], ["Null", "Pilot", "Data", "Pilot", "Null"], ["Null", "Pilot", "Data", "Pilot", "Null"], ["Null", "Pilot", "Data", "Pilot", "Null"], ["Null", "Pilot", "Data", "Pilot", "Null"], ["Null", "Pilot", "Data", "Pilot", "Null"], ["Null", "Pilot", "Data", "Pilot", "Null"], ["Null", "Pilot", "Data", "Pilot", "Null"]]
  "Set All Resources": bool
  "De-/Activate subsymbols": bool
  "Activate/Deactivate": bool
  "GFDM parameter": "GFDM parameter.gtype" = {"Variable: K"=8, "Variable: M"=3, "Variable: a"=0.5, "filter type"="rc", "receive filter"="MF", "inverse FFT"=FALSE, "Variable: b"=0.5, "Ncs"=0, "Ncp"=0}
outputs:
  "reduced resource map": enum{"Null", "Pilot", "Data"}[][]
  "Set All Resources out": bool
  "De-/Activate subsymbols out": bool
  "resource map as vector": enum{"Null", "Pilot", "Data"}[]
  "complete resource map": enum{"Null", "Pilot", "Data"}[][]
types:
  "GFDM parameter.gtype" = cluster{"Variable: K": i32, "Variable: M": i32, "Variable: a": f64, "filter type": enum{"rc", "rect"}, "receive filter": enum{"MF", "ZF"}, "inverse FFT": bool, "Variable: b": f64, "Ncs": u16, "Ncp": u16}
diagram:
  Property Node(instance in=$"GFDM parameter") -> ("Variable: K"=w1, "Variable: M"=w2)
  # K
  case ($"Set All Resources") {
    frame True {
      Initialize Array(element="Data", size=w1, size=w2) -> w3
      w4 = FALSE
      w5 = w1
      w6 = w2
    }
    frame False {
      Initialize Array(element="Null", size=w1, size=w2) -> w7
      Array Size(array=w7) -> (size(s)=w8)
      Array Index(array=w8) -> (out0[_]=w9, out1[_]=w10)
      s1 = w7  # shift register
      for (N = w9) (iteration -> i1) {
        w11 = each element of $"resource map"
        s2 = s1  # shift register
        for (N = w10) (iteration -> i2) {
          w12 = each element of w11
          Replace Array Subset(inArray=s2, index=i1, index=i2, new=w12) -> w13
          next s2 = w13
        }
        next s1 = s2
      }
      w3 = s1
      w4 = FALSE
      w5 = w1
      w6 = w2
    }
  }
  # M
  # K
  # M
  case ($"De-/Activate subsymbols") {
    frame False, Default {
      w14 = $"De-/Activate subsymbols"
      w15 = w3
      w16 = w5
      w17 = w6
    }
    frame True {
      Select(s=$"Activate/Deactivate", t="Pilot", f="Null") -> w18
      Initialize Array(element=w18, size=w5) -> w19
      Subtract(x=w6, y=2) -> w20
      Transpose 2D Array(2D array=w3) -> (transposed array=w21)
      Array Subset(array=w21, index0=1, length0=w20) -> w22
      Build Array[ConcatenateInputs=True](w19, w22, w19) -> w23
      Transpose 2D Array(2D array=w23) -> (transposed array=w15)
      w14 = FALSE
      w16 = w5
      w17 = w6
    }
  }
  # create big resource map
  call "extend matrix.gvi"(resource map=w15, K=w16) -> (complete resource map out=w24)
  Array Subset(array=w24, length0=w16, length1=w17) -> w25
  $"complete resource map" <- w25
  Multiply(w1, w2) -> w26
  Transpose 2D Array(2D array=w25) -> (transposed array=w27)
  # generate vector
  # Order: subcarriers first
  Reshape Array(inArray=w27, size=w26) -> w28
  $"resource map as vector" <- w28
  # reduce the big map again to show it on the screen
  call "reduce matrix.gvi"(complete resource map=w25) -> (reduced resource map out=w29)
  $"reduced resource map" <- w29
  $"De-/Activate subsymbols out" <- w14
  $"Set All Resources out" <- w4
