vi "create ramp.gvi"   [LabVIEW Communications System Design Suite 2.0.1]
inputs:
  "length": u16
  "offset": i32
outputs:
  "data in": u8[]
diagram:
  for (N = $length) (iteration -> i1) {
    Increment(x=i1) -> w2
    Add(w2, $offset) -> w3
    To Unsigned Byte Integer(number=w3) -> w4
    Random Number() -> (number (0 to 1)=w5)
    Multiply(w5, $length) -> w6
    To Unsigned Byte Integer(number=w6)
    append w4 to w1
  }
  $"data in" <- w1
