vi "create symbol map.gvi"   [LabVIEW NXG]
inputs:
  "bits per symbol": u8 = 1
outputs:
  "symbol map": c128[]
panel indicators:
  "bits/symbol": i32
  "IQ": c128[]
diagram:
  Is Greater(x=$"bits per symbol", y=14) -> w1
  Select(s=w1, t=1, f=$"bits per symbol") -> w2
  Subtract(x=w2, y=2) -> w3
  Is Not Equal(x=1, y=w2) -> w4
  case (w4) {
    frame False, Default {
      # BPSK
      w5 = [1+0i, -1+0i]
      w6 = 1
    }
    frame True {
      call "mod_QAM M-to-Map.gvi"(M selection=w3) -> (symbol map=w5, bits/symbol=w6)
    }
  }
  $IQ <- w5
  $"symbol map" <- w5
  $"bits/symbol" <- w6
