vi "create_frame.gvi"   [LabVIEW Communications System Design Suite 2.0.1]
inputs:
  "modem_shift": i16
  "Error": error
  "data": u32[]
  "result": c128[]
  "FPGA.Interface": "FPGA.Demodulator.Interface.gtype"
  "fft shift": i16
outputs:
  "FPGA host interface out": "FPGA.Demodulator.Interface.gtype"
  "Error_out": error
  "mse": f64
  "rmse": f64
  "FPGA result": c128[]
  "reference": c128[]
  "latency": u32
diagram:
  Array Size(array=$data) -> (size(s)=w1)
  Property Node(instance in=$"FPGA.Interface", "fft shift"=$"fft shift", "modem_shift"=$modem_shift, error in=$Error) -> (error out=w2, instance out=w3)
  Host Fifo Write Node[FifoName="USRP Resources.grsc\\dem_32 bit data in"](data=$data, error in=w2, reference in=w3) -> (error out=w4, reference out=w5)
  Host Fifo Read Node[FifoName="USRP Resources.grsc\\dem_data out 32 bit"](error in=w4, number of elements=0, reference in=w5) -> (elements remaining=w6, error out=w7, reference out=w8)
  Host Fifo Read Node[FifoName="USRP Resources.grsc\\dem_data out 32 bit"](error in=w7, number of elements=w6, reference in=w8) -> (error out=w9, reference out=w10)
  call "wait for idle state.gvi"(FPGA.Interface in=w10, error in=w9) -> (FPGA.Interface out=w11, Error out=w12)
  Property Node(instance in=w11, "New GFDM block"=TRUE, "New GFDM block"=FALSE, error in=w12) -> (error out=w13, instance out=w14)
  Host Fifo Read Node[FifoName="USRP Resources.grsc\\dem_data out 32 bit"](error in=w13, number of elements=w1, reference in=w14) -> (data=w15, error out=w16, reference out=w17)
  Property Node(instance in=w17, error in=w16) -> ("latency"=w18, error out=w19, instance out=w20)
  $"FPGA host interface out" <- w20
  $Error_out <- w19
  $latency <- w18
  call "convert u32 to dbl.gvi"(data in=w15) -> (data out=w21)
  call "mean square error.gvi"(reference=$result, vector=w21) -> (rmse=w22, mse=w23)
  $mse <- w23
  $rmse <- w22
  $"FPGA result" <- w21
  $reference <- $result
