vi "create_noise.gvi"   [LabVIEW Communications System Design Suite 2.0.1]
inputs:
  "length": i32
  "reset": bool  # <Enter Description Here>
  "SNR": f64
  "Signal Leistung": f64 = 1
outputs:
  "Noise": c128[]
uses:
  NI::Analysis::Generation::Gaussian White Noise.gvi
diagram:
  Divide(x=$"Signal Leistung", y=10) -> w1
  Power Of 10(x=w1) -> w2
  Divide(x=w2, y=2) -> w3
  Square Root(x=w3) -> w4
  call "Gaussian White Noise.gvi"(samples=$length, standard deviation=w4, reset=$reset) -> (Gaussian white noise=w5)
  call "Gaussian White Noise.gvi"(samples=$length, standard deviation=w4, reset=$reset) -> (Gaussian white noise=w6)
  Real And Imaginary To Complex(x=w5, y=w6) -> w7
  Divide(x=$SNR, y=10) -> w8
  Power Of 10(x=w8) -> w9
  Reciprocal(x=w9) -> w10
  Square Root(x=w10) -> w11
  Multiply(w7, w11) -> w12
  $Noise <- w12
