vi "create_random_samples.gvi"   [LabVIEW Communications System Design Suite 2.0.1]
inputs:
  "Numeric": i32
  "Gauss": bool
outputs:
  "Array": c128[]
uses:
  NI::Analysis::Generation::Gaussian White Noise.gvi
  NI::Analysis::Generation::Uniform White Noise.gvi
diagram:
  case ($Gauss) {
    frame True {
      call "Gaussian White Noise.gvi"(samples=$Numeric) -> (Gaussian white noise=w2)
      call "Gaussian White Noise.gvi"(samples=$Numeric) -> (Gaussian white noise=w3)
      Real And Imaginary To Complex(x=w2, y=w3) -> w1
    }
    frame False {
      call "Uniform White Noise.gvi"(samples=$Numeric) -> (uniform white noise=w4)
      call "Uniform White Noise.gvi"(samples=$Numeric) -> (uniform white noise=w5)
      Real And Imaginary To Complex(x=w4, y=w5) -> w1
    }
  }
  $Array <- w1
