vi "create_test_data.gvi"   [LabVIEW Communications System Design Suite 2.0.1]
inputs:
  "GFDM parameter": "GFDM parameter.gtype"
  "number": i32
  "Data generator?": T1 = "First Symbol"
  "input": c128[]
outputs:
  "data": c128[]
types:
  T1 = enum{"First Symbol", "Random", "Seeded", "Set datablock given in number to 1", "Other"}
  "GFDM parameter.gtype" = cluster{"Variable: K": i32, "Variable: M": i32, "Variable: a": f64, "filter type": enum{"rc", "rect"}, "receive filter": enum{"MF", "ZF"}, "inverse FFT": bool, "Variable: b": f64, "Ncs": u16, "Ncp": u16}
uses:
  NI::Analysis::Generation::Uniform White Noise.gvi
diagram:
  Property Node(instance in=$"GFDM parameter") -> ("Variable: K"=w1, "Variable: M"=w2)
  Multiply(w1, w2) -> w3
  case ($"Data generator?") {
    frame "First Symbol", Default {
      Initialize Array(element=1+0i, size=w1) -> w5
      Initialize Array(element=0+0i, size=w3) -> w6
      Replace Array Subset(inArray=w6, index=0, new=w5) -> w4
    }
    frame "Random" {
      call "create_random_samples.gvi"(Numeric=w3) -> (Array=w4)
    }
    frame "Seeded" {
      call "Uniform White Noise.gvi"(samples=w3, seed=1) -> (uniform white noise=w7)
      call "Uniform White Noise.gvi"(samples=w3, seed=1) -> (uniform white noise=w8)
      Real And Imaginary To Complex(x=w7, y=w8) -> w4
    }
    frame "Set datablock given in number to 1" {
      Initialize Array(element=0+0i, size=w3) -> w9
      Replace Array Subset(inArray=w9, index=$number, new=1+0i) -> w4
    }
    frame "Other" {
      w4 = $input
    }
  }
  $data <- w4
