vi "random data.gvi"   [LabVIEW Communications System Design Suite 2.0.1]
inputs:
  "length": u16
outputs:
  "Array": u32[]
diagram:
  for (N = $length) {
    Random Number() -> (number (0 to 1)=w2)
    Multiply($length, w2) -> w3: u32
    append w3 to w1
  }
  $Array <- w1
