vi "Decode angle.gvi"   [LabVIEW Communications System Design Suite 2.0.1]
inputs:
  "error out": error
  "output": string
outputs:
  "description": string  # source out indicates the source of the error.
  "current angle": string
  "angle over time": i32
diagram:
  call "Display Error.gvi"(type of dialog="no dialog", error in=$"error out") -> (description=w1)
  $description <- w1
  Search Or Split String(search string/char="m", string=$output) -> (match + rest of string=w2)
  String Subset(offset (0)=1, string=w2) -> w3
  Search Or Split String(search string/char=EndOfLine, string=w3) -> (substring before match=w4)
  $"current angle" <- w4
  Decimal String To Number(string=w4) -> (number=w5)
  $"angle over time" <- w5
