vi "Encode+QAMmapping.gvi"   [LabVIEW Communications System Design Suite 2.0.1]
inputs:
  "input bit stream": u8[]
outputs:
  "data as a vector d": CFXP(2.14)[]
  "data as a u32 vector": u32[]
diagram:
  call "encode.gvi"(input bit stream=$"input bit stream") -> (input bit stream_2=w1)
  for {
    w2 = each element of w1
    w5 = [-0.707092285156-0.707092285156i, -0.707092285156+0.707092285156i, 0.707092285156-0.707092285156i, 0.707092285156+0.707092285156i]
    Array Index(array=w5) -> (out0[w2]=w6)
    call "cfx_to_u32.gvi"(input=w6)
    call "4.12_cfx_to_u32.gvi"(input=w6)
    call "CDB to 2.14 FXP 32 bit.gvi"(Input=w6) -> (Output=w7)
    append w6 to w3
    append w7 to w4
  }
  $"data as a vector d" <- w3
  $"data as a u32 vector" <- w4
