vi "BER.gvi"   [LabVIEW Communications System Design Suite 2.0.1]
inputs:
  "Output": i8[]
  "Input": i8[]
outputs:
  "length": i32
  "number of bits correct": u64
  "BER": f64
diagram:
  Array Size(array=$Output) -> (size(s)=w1)
  Is Not Equal To 0(x=w1) -> w2
  Array Subset(array=$Input, length0=w1) -> w3
  Is Equal(x=w3, y=$Output) -> w4
  Boolean To Integer(Boolean=w4) -> (0, 1=w5)
  To Unsigned Quad Integer(number=w5) -> w6
  Add Array Elements(numeric array=w6) -> (sum=w7)
  Select(s=w2, t=w7, f=0) -> w8
  $"number of bits correct" <- w8
  Divide(x=w7, y=w1) -> w9
  Subtract(x=1, y=w9) -> w10
  Select(s=w2, t=w10, f=0) -> w11
  $BER <- w11
  $length <- w1
