vi "calculate psd.gvi"   [LabVIEW Communications System Design Suite 2.0.1]
inputs:
  "time signal x": c128[]
  "shift?": bool
outputs:
  "element": f64[]
uses:
  NI::Analysis::Transforms::Complex FFT.gvi
diagram:
  Array Size(array=$"time signal x") -> (size(s)=w1)
  Multiply(w1, 4) -> w2
  call "Complex FFT.gvi"(x=$"time signal x", shift?=$"shift?", FFT size=w2) -> (FFT{x}=w3, error out=w4)
  Absolute Value(x=w3) -> w5
  Logarithm Base 10(x=w5) -> w6
  Multiply(20, w6) -> w7
  $element <- w7
  Property Node(instance in=w4)
