vi "compare_elements.gvi"   [LabVIEW Communications System Design Suite 2.0.1]
inputs:
  "reference": c128[]
  "array": c128[]
  "limit": f64
outputs:
  "equal": bool
diagram:
  Array Size(array=$reference) -> (size(s)=w1)
  Array Size(array=$array) -> (size(s)=w2)
  Is Equal(x=w1, y=w2) -> w3
  Absolute Value(x=$reference) -> w4
  Array Max And Min(array=w4) -> (max value=w5)
  Multiply(w5, $limit) -> w6
  Is Greater(x=w6, y=0.001) -> w7
  Select(s=w7, t=w6, f=0.001) -> w8
  s1 = w3  # shift register
  for {
    w9 = each element of $array
    w10 = each element of $reference
    Subtract(x=w9, y=w10) -> w11
    Absolute Value(x=w11) -> w12
    Is Less(x=w12, y=w8) -> w13
    Select(s=w13, t=s1, f=FALSE) -> w14
    next s1 = w14
  }
  $equal <- s1
