vi "mean square error.gvi"   [LabVIEW NXG]
inputs:
  "reference": c128[]
  "vector": c128[]
outputs:
  "rmse": f64
  "mse": f64
diagram:
  for {
    w1 = each element of $vector
    w2 = each element of $reference
    Subtract(x=w1, y=w2) -> w4
    Absolute Value(x=w4) -> w5
    Square(x=w5) -> w6
    append w6 to w3
  }
  Add Array Elements(numeric array=w3) -> (sum=w7)
  Array Size(array=w3) -> (size(s)=w8)
  Divide(x=w7, y=w8) -> w9
  $mse <- w9
  Square Root(x=w9) -> w10
  $rmse <- w10
