vi "read test vector.gvi"   [LabVIEW Communications System Design Suite 2.0.1]
inputs:
  "M": u32 = 5
  "direction": enum{"TX", "RX"} = "TX"
  "K": u32 = 128
outputs:
  "input": c128[]
  "output": c128[]
  "g": c128[]
panel indicators:
  "array": c128[]
  "absolute Signals": f64[][]
diagram:
  Is Equal(x=$direction, y="TX") -> w1
  Select(s=w1, t="tx_K", f="rx_K") -> w2
  Number To Decimal String(number=$K) -> (decimal integer string=w3)
  Number To Decimal String(number=$M) -> (decimal integer string=w4)
  Concatenate Strings("C:\\git\\IPP16_SISO_PHY\\references\\testvectors\\", w2, w3, "M", w4) -> w5
  Concatenate Strings(w5, "_real.txt") -> w6
  String To Path(string=w6) -> (path=w7)
  call "file to array.gvi"(path=w7) -> (array=w8)
  Concatenate Strings(w5, "_imag.txt") -> w9
  String To Path(string=w9) -> (path=w10)
  call "file to array.gvi"(path=w10) -> (array=w11)
  Real And Imaginary To Complex(x=w8, y=w11) -> w12
  $array <- w12
  Multiply($K, $M) -> w13
  Array Subset(array=w12, index0=3, length0=w13) -> w14
  $g <- w14
  Add(3, w13) -> w15
  Array Subset(array=w12, index0=w15, length0=w13) -> w16
  $input <- w16
  Add(w15, w13) -> w17
  Array Subset(array=w12, index0=w17, length0=w13) -> w18
  $output <- w18
  Build Array(w14, w16, w18) -> w19
  Absolute Value(x=w19) -> w20
  $"absolute Signals" <- w20
