vi "count until limit reached.gvi"   [LabVIEW Communications System Design Suite 2.0.1]
inputs:
  "start": bool
  "number in": u32
  "limit": u32
outputs:
  "stop": bool
  "number out": u32
diagram:
  Increment(x=$"number in") -> w1
  Is First Call() -> w2
  call "toggle_output.gvi"(toggle=$start, reset=w2) -> (output=w3)
  Select(s=w3, t=w1, f=$"number in") -> w4
  Is Equal(x=$limit, y=w4) -> w5
  $stop <- w5
  Select(s=w5, t=0, f=w4) -> w6
  $"number out" <- w6
