vi "counter.gvi"   [LabVIEW Communications System Design Suite 2.0.1]
inputs:
  "Signals in": "Signals.gtype"
  "reset": bool
  "N-1": u16
  "K-1": u16
outputs:
  "Signals out": "Signals.gtype"
types:
  "Signals.gtype" = cluster{"k-1_out": u16, "k_out": u16, "last sample of subsymbol_out": bool, "first sample of subsymbol_out": bool, "m-1_out": u8, "m_out": u8, "is first subsymbol": bool, "n-1_out": u16, "n_out": u16, "last sample-1": bool, "last sample": bool, "first sample": bool, "u32 sample": u32, "u64 sample": u64, "valid": bool}
diagram:
  Feedback Node(input=w1) -> w2
  Logical Or(w2, $reset) -> w3
  Feedback Node(input=w4) -> w5
  Select(s=w3, t=0, f=w5) -> w6
  Decrement(x=$"N-1") -> w7
  Is Equal(x=w6, y=w7) -> w8
  Property Node(instance in=$"Signals in") -> ("valid"=w9)
  Feedback Node(input=w10) -> w11
  Logical Or(w11, $reset) -> w12
  Feedback Node(input=w13) -> w14
  Select(s=w12, t=0, f=w14) -> w15
  Increment(x=w15) -> w16
  Select(s=w9, t=w16, f=w15) -> w13
  Increment(x=w6) -> w17
  Select(s=w9, t=w17, f=w6) -> w4
  Is Greater Or Equal(x=w6, y=$"N-1") -> w18
  Logical And(w9, w18) -> w1
  Is Greater Or Equal(x=w15, y=$"K-1") -> w19
  Logical And(w9, w19) -> w10
  Is Equal To 0(x=w15) -> w20
  Logical And(w9, w20) -> w21
  Logical Or($reset, w2) -> w22
  Feedback Node(input=w23) -> w24
  Select(s=w22, t=0, f=w24) -> w25
  Increment(x=w25) -> w26
  Select(s=w21, t=w26, f=w25) -> w23
  Is Equal To 0(x=w6) -> w27
  Decrement(x=w23) -> w28
  Is Equal To 0(x=w28) -> w29
  Decrement(x=w13) -> w30
  Decrement(x=w4) -> w31
  Property Node(instance in=$"Signals in", "k-1_out"=w30, "k_out"=w13, "last sample of subsymbol_out"=w10, "first sample of subsymbol_out"=w21, "m-1_out"=w28, "m_out"=w23, "is first subsymbol"=w29, "n-1_out"=w31, "n_out"=w4, "last sample-1"=w8, "last sample"=w1, "first sample"=w27) -> (instance out=w32)
  $"Signals out" <- w32
