vi "detect falling edge.gvi"   [LabVIEW NXG]
inputs:
  "in": bool
outputs:
  "out": bool
diagram:
  Feedback Node(Input=$in) -> (Output=w1)
  Is Not Equal(x=$in, y=w1) -> w2
  Logical And(w2, not $in) -> w3
  $out <- w3
