vi "detect rising edge.gvi"   [LabVIEW Communications System Design Suite 2.0.1]
inputs:
  "in": bool
outputs:
  "out": bool
diagram:
  Feedback Node(input=$in) -> w1
  Is Not Equal(x=$in, y=w1) -> w2
  Logical And(w2, $in) -> w3
  $out <- w3
