vi "fifo simulator_32.gvi"   [LabVIEW Communications System Design Suite 2.0.1]
inputs:
  "ready for output": bool
  "Array": u32[]
  "reset": bool
outputs:
  "element": u32
  "valid": bool
  "address": u32
  "first sample": bool
diagram:
  Feedback Node(initial value=0, input=w1) -> w2
  Select(s=$reset, t=0, f=w2) -> w3
  Array Index(array=$Array) -> (out0[w3]=w4)
  $element <- w4
  Array Size(array=$Array) -> (size(s)=w5)
  Is Greater(x=w5, y=w3) -> w6
  Logical And(w6, $"ready for output") -> w7
  $valid <- w7
  Increment(x=w3) -> w8
  Select(s=$"ready for output", t=w8, f=w3) -> w1
  $address <- w1
  Is Equal To 0(x=w3) -> w9
  Logical And(w7, w9) -> w10
  $"first sample" <- w10
