vi "fifo simulator_32_without reset.gvi"   [LabVIEW Communications System Design Suite 2.0.1]
inputs:
  "ready for output": bool
  "Array": u32[]
  "reset": bool
outputs:
  "element": u32
  "valid": bool
  "addr": u32
diagram:
  Feedback Node(input=w1) -> w2
  Array Index(array=$Array) -> (out0[w2]=w3)
  $element <- w3
  $addr <- w2
  Array Size(array=$Array) -> (size(s)=w4)
  Increment(x=w2) -> w5
  Select(s=$"ready for output", t=w5, f=w2) -> w6
  Is Less(x=w4, y=w6) -> w7
  Logical Or($reset, w7) -> w8
  Logical And($"ready for output", not w8) -> w9
  $valid <- w9
  Select(s=w8, t=0, f=w6) -> w1
