vi "limited counter.gvi"   [LabVIEW Communications System Design Suite 2.0.1]
inputs:
  "increment": bool
  "reset": bool
  "limit": u32
outputs:
  "stop": bool
  "number out": u32
diagram:
  Feedback Node(input=w1) -> w2
  Increment(x=w2) -> w3
  Select(s=$increment, t=w3, f=w2) -> w4
  Is Greater(x=w4, y=$limit) -> w5
  Logical And(w5, not $reset) -> w6
  $stop <- w6
  Logical Or($reset, w5) -> w7
  Select(s=w7, t=0, f=w4) -> w1
  $"number out" <- w1
