vi "mod N counter with reset.gvi"   [LabVIEW Communications System Design Suite 2.0.1]
inputs:
  "enable": bool  # Triggers increment of index. Do not trigger enable together with reset.
  "N": u64  # Modulo value at which the indexer should wrap. N is never reached by index.
  "reset": bool  # sets index back to zero.
  "repetitive": bool  # Triggers increment of index. Do not trigger enable together with reset.
outputs:
  "index": u64  # current index value in the interval [0,N)
  "wrap back/done?": bool  # signals a wrap back to zero
diagram:
  Feedback Node(input=w1) -> w2
  Not(x=w2) -> w3
  Logical Or(w3, $repetitive) -> w4
  Logical And($enable, w4) -> w5
  Feedback Node(initial value=0, input=w6) -> w7
  case (w5) {
    frame False, Default {
      w8 = w7
    }
    frame True {
      Increment(x=w7) -> w8
    }
  }
  Boolean To Integer(Boolean=$enable) -> (0, 1=w9)
  Logical Or($reset, w2) -> w10
  Select(s=w10, t=w9, f=w8) -> w6
  $index <- w6
  Is Equal(x=w6, y=$N) -> w1
  $"wrap back/done?" <- w1
