vi "probability.gvi"   [LabVIEW Communications System Design Suite 2.0.1]
inputs:
  "probability": f64
outputs:
  "signal": bool
diagram:
  Random Number() -> (number (0 to 1)=w1)
  Is Less(x=w1, y=$probability) -> w2
  $signal <- w2
