vi "simulate random ready_for_output.gvi"   [LabVIEW Communications System Design Suite 2.0.1]
inputs:
  "ready for output always true": bool = TRUE
outputs:
  "ready for output_out": bool
diagram:
  Random Number() -> (number (0 to 1)=w1)
  Is Greater(x=w1, y=0.5) -> w2
  Logical Or(w2, $"ready for output always true") -> w3
  $"ready for output_out" <- w3
