vi "toggle_output.gvi"   [LabVIEW NXG]
inputs:
  "toggle": bool
  "reset": bool
outputs:
  "output": bool
diagram:
  Feedback Node(Initializer=FALSE, Input=w1) -> (Output=w2)
  Not(x=w2) -> w3
  Select(s=$toggle, t=w3, f=w2) -> w4
  Select(s=$reset, t=FALSE, f=w4) -> w1
  $output <- w1
