vi "u64 data fifo.gvi"   [LabVIEW Communications System Design Suite 2.0.1]
inputs:
  "ready for output": bool
  "Array": u64[]
  "reset": bool
outputs:
  "data out": "Signals.gtype"
types:
  "Signals.gtype" = cluster{"k-1_out": u16, "k_out": u16, "last sample of subsymbol_out": bool, "first sample of subsymbol_out": bool, "m-1_out": u8, "m_out": u8, "is first subsymbol": bool, "n-1_out": u16, "n_out": u16, "last sample-1": bool, "last sample": bool, "first sample": bool, "u32 sample": u32, "u64 sample": u64, "valid": bool}
diagram:
  Feedback Node(initial value=0, input=w1) -> w2
  Select(s=$reset, t=0, f=w2) -> w3
  Array Index(array=$Array) -> (out0[w3]=w4)
  Array Size(array=$Array) -> (size(s)=w5)
  Is Greater(x=w5, y=w3) -> w6
  Logical And(w6, $"ready for output") -> w7
  Increment(x=w3) -> w8
  Select(s=$"ready for output", t=w8, f=w3) -> w1
  To Unsigned Long Integer(number=w4) -> w9
  Is Equal To 0(x=w3) -> w10
  Logical And(w10, w7) -> w11
  Is Equal(x=w8, y=w5) -> w12
  Logical And(w12, w7) -> w13
  Property Node(instance in="Signals.gtype" {all zero or empty}, "first sample"=w11, "u32 sample"=w9, "u64 sample"=w4, "valid"=w7, "n-1_out"=w3, "last sample"=w13, "n_out"=w1) -> (instance out=w14)
  $"data out" <- w14
