vi "ImportTxtFileToComplex_Preamble.gvi"   [LabVIEW Communications System Design Suite 2.0.1]
inputs:
  "Path": path
outputs:
  "data": c128[]
panel indicators:
  "Raw Comma-Separated Data": string
  "File Save Path": path
  "Table of data": string[][]
  "Graph of Data (real)": f64[]
  "Graph of Data (imaginary)": f64[]
diagram:
  Is Empty String Or Path(string/path=$Path) -> w1
  case (w1) {
    frame False, Default {
      w2 = $Path
    }
    frame True {
      # Load standard preamble
      Get Component Directory() -> (Path=w3)
      Build Path(base path=w3, name or relative path="Host\\Preamble.txt") -> (appended path=w2)
    }
  }
  # The Read from Text File function will read the contents of a text file and return them as a string. The Spreadsheet String To Array function converts that string into a 2D array of strings,
  # using commas as column separators, and line feeds as row separators. The first column of timestamps is pulled out, and the remaining data is displayed in the Graph of Data.
  $"File Save Path" <- w2
  Read From Text File(file (use dialog)=w2) -> (error out=w4, text=w5)
  $"Raw Comma-Separated Data" <- w5
  call "Simple Error Handler.gvi"(error in=w4) -> (error out=w6)
  Spreadsheet String To Array(array type=string[][] [], delimiter=",", format string="%f", spreadsheet string=w5) -> (array=w7)
  # First column (real)
  Array Index(array=w7) -> (out0[_, 0]=w8)
  Floating Point String To Number(string=w8, use system decimal point (T)=FALSE) -> (number=w9)
  # Second column (imaginary)
  Array Index(array=w7) -> (out0[_, 1]=w10)
  # File read/write performance is dependent upon the size of the data written to disk.  This optimum "chunk" size will depend upon your operating system and disk block size.
  # For example, in Windows, reading or writing in 65,000 byte chunks will often optimize performance.
  Floating Point String To Number(string=w10, use system decimal point (T)=FALSE) -> (number=w11)
  Real And Imaginary To Complex(x=w9, y=w11) -> w12
  case (w6) {
    frame No Error, Default {
      $"Table of data" <- w7
      $data <- w12
      Complex To Real Imaginary(x + iy=w12) -> (x=w13, y=w14)
      $"Graph of Data (real)" <- w13
      $"Graph of Data (imaginary)" <- w14
    }
    frame Error {
      # Do not display the data if an error occurred
      # when reading the file
    }
  }
