vi "IntegerMultipleOf.gvi"   [LabVIEW Communications System Design Suite 2.0.1]
inputs:
  "availableSize": u32
  "blockSize": u32
outputs:
  "multipleOfBlockSize": u32
  "numBlocks": u32
diagram:
  Quotient And Remainder(x=$availableSize, y=$blockSize) -> (floor(x/y)=w1)
  $numBlocks <- w1
  Multiply(w1, $blockSize) -> w2
  $multipleOfBlockSize <- w2
