vi "NormConstellation.gvi"   [LabVIEW Communications System Design Suite 2.0.1]
inputs:
  "QAM symbols per Frame": u32
  "ConstelationIn": c128[]
outputs:
  "ConstellationOut": c128[]
diagram:
  Array Size(array=$ConstelationIn) -> (size(s)=w1)
  Quotient And Remainder(x=w1, y=$"QAM symbols per Frame") -> (floor(x/y)=w2)
  Reshape Array(inArray=$ConstelationIn, size=w2, size=$"QAM symbols per Frame") -> w3
  for {
    w4 = each element of w3
    Absolute Value(x=w4) -> w6
    Square(x=w6) -> w7
    Add Array Elements(numeric array=w7) -> (sum=w8)
    Divide(x=w8, y=$"QAM symbols per Frame") -> w9
    Square Root(x=w9) -> w10
    Divide(x=w4, y=w10) -> w11
    append w11 to w5
  }
  Reshape Array(inArray=w5, size=w1) -> w12
  $ConstellationOut <- w12
