vi "Preamble data available.gvi"   [LabVIEW Communications System Design Suite 2.0.1]
inputs:
  "FPGA.Interface_in": "FPGA interface.gtype"
  "Error_in": error
  "length": i32
outputs:
  "FPGA.Interface_out": "FPGA interface.gtype"
  "Error_out": error
  "Data available": bool
diagram:
  Host Fifo Read Node[FifoName="Needed Resources.grsc\\RX.Preamble out"](error in=$Error_in, number of elements=0, reference in=$"FPGA.Interface_in") -> (elements remaining=w1, error out=w2, reference out=w3)
  Is Less[ComparisonMode=CompareAggregates](x=$length, y=w1) -> w4
  case (w4) {
    frame False, Default {
      Is Not Equal To 0(x=w1) -> w7
      w5 = w3
      w6 = w2
    }
    frame True {
      call "Blocks in FIFO.gvi"(Numeric=$length, Numeric_2=w1) -> (number of elements=w8)
      # too much data in the FIFO
      # dummy read to leave only
      # the newest data.
      Host Fifo Read Node[FifoName="Needed Resources.grsc\\RX.Preamble out"](error in=w2, number of elements=w8, reference in=w3) -> (error out=w6, reference out=w5)
      w7 = TRUE
    }
  }
  $"Data available" <- w7
  $"FPGA.Interface_out" <- w5
  $Error_out <- w6
