vi "Flexible_Preamble_Test.gvi"   [LabVIEW Communications System Design Suite 2.0.1]
panel controls:
  "Variable: Kon": i32 = 8
  "Variable: K": i32 = 64
panel indicators:
  "vector_symbols": c128[]
  "Numeric": f64[]
  "Abs": f64[]
  "Real": f64[]
  "Imag": f64[]
diagram:
  Math Node("usercase"=1, "Kon"=$"Variable: Kon", "K"=$"Variable: K") -> ("Kset"=w1)
  ~~~
  K_1 = double(K)-1;
  Kini = 3;
  Kend = 10;
  K1 = double(ceil(Kon/2))-1;
  K2 = double(K_1+1-floor(Kon/2));
  switch usercase
  case 1
  Kset = [0:K1 K2:K_1];
  case 2
  Kset = [K1:K2];
  otherwise
  null_K = zeros(56,1);
  act_K = ones(4,1);
  Kset = horzcat(act_K.', null_K.', act_K.');
  end
  ~~~
  call "generate_flexible_preamble.gvi"(Kset_in=w1, K=$"Variable: K") -> (samples_vector=w2)
  Absolute Value(x=w2) -> w3
  Array Max And Min(array=w3) -> (max value=w4)
  Reciprocal(x=w4) -> w5: f64
  Multiply(w2, w5) -> w6: c128[]
  Absolute Value(x=w6) -> w7
  $Abs <- w7
  $vector_symbols <- w6
  $Numeric <- w1
  Complex To Real Imaginary(x + iy=w6) -> (x=w8, y=w9)
  $Real <- w8
  $Imag <- w9
