vi "generate_flexible_preamble.gvi"   [LabVIEW Communications System Design Suite 2.0.1]
inputs:
  "Kset_in": u8[]
  "K": i32 = 64
outputs:
  "samples_vector": c128[]
diagram:
  # Kset is a vector containing 0s and 1s
  # Kset contains the indexes of the active subcarriers
  Array Size(array=$Kset_in) -> (size(s)=w1)
  for (N = w1) (iteration -> i1) {
    w2 = each element of $Kset_in
    Is Greater Than 0(x=w2) -> w4
    append i1 to w3 if w4
  }
  call "prepare_params_preamble.gvi"(Kset=w3, K=$K) -> (params_preamble_out=w5)
  Property Node(instance in=w5) -> ("Kon"=w6, "mu"=w7)
  Multiply(w6, w7) -> w8
  w9 = 1  # seed
  call "gen_bits.gvi"(source="seeded", number of bits N=w8, seed_in=w9) -> (random bits=w10)
  Build Array[ConcatenateInputs=True](w10, w10) -> w11
  call "do_qamModulate.gvi"(params_preamble=w5, bits=w11) -> (data_vector=w12)
  call "do_map.gvi"(data_vector=w12, params=w5) -> (mapped_data_vector=w13)
  call "modulate_time.gvi"(data_vector=w13, params=w5) -> (samples_vector=w14)
  $samples_vector <- w14
