vi "prepare_params_preamble.gvi"   [LabVIEW Communications System Design Suite 2.0.1]
inputs:
  "Kset": u8[]
  "K": i32 = 64
outputs:
  "params_preamble_out": T1
types:
  T1 = cluster{"Ncp": i32, "Nrise": i32, "Ncs": i32, "Nfall": i32, "Ncp+Nrise": i32, "Ncs+Nfall": i32, "N+Ncp+Nrise+Ncs+Nfall": i32, "N+Ncp+Nrise+Ncs": i32, "N-(Ncp+Nrise)": i32, "N+Ncp+Nrise": i32, "K": i32, "M": i32, "mu": i32, "qam_map": c128[], "N": i32, "Nov": i32, "N+Ncp+Nrise+Ncs+Nfall-Nov": i32, "Nb": i32, "Non": i32, "Mon": i32, "Kon": i32, "Nset": i32[], "Mset": i32[], "Kset": i32[], "alpha": f64, "beta": f64, "window_rise": c128[], "window_fall": c128[], "filter_coeff_tx": c128[], "filter_coeff_rx": c128[], "Np": i32, "filter_coeff_tx_2": c128[], "filter_coeff_rx_2": c128[], "rx_type": string, "filter_type": string, "OQAM": bool, "R": i32, "T": i32, "S": i32, "P": i32, "Q": i32, "P/R": i32, "Q/T": i32}
diagram:
  # params_preamble
  w1 = T1 {"M"=2, "mu"=2, "qam_map"=[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], "Mon"=2, "Nset"=[0], "Mset"=[0], "Kset"=[0], "window_rise"=[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], "window_fall"=[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], "filter_coeff_tx"=[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], "filter_coeff_rx"=[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], "filter_coeff_tx_2"=[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], "filter_coeff_rx_2"=[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]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}
  Array Size(array=$Kset) -> (size(s)=w2)
  Multiply(w2, 2) -> w3
  Property Node(instance in=w1, "Kset"=$Kset, "Kon"=w2, "Non"=w3, "Mon"=2, "M"=2, "mu"=2, "K"=$K) -> (instance out=w4)
  Property Node(instance in=w4) -> ("K"=w5, "M"=w6, "mu"=w7)
  # mu=1,2,4
  call "gen_qam_map.gvi"(order of modulation mu=w7) -> (symbol map=w8)
  call "get_rect_fd.gvi"(K=w5, M=w6) -> (filter_coeff_tx=w9)
  Multiply(w5, w6) -> w10
  Initialize Array(element=0, size=1) -> w11
  Initialize Array(element=1, size=1) -> w12
  # Mset
  Build Array(w11, w12) -> w13
  # calc Nset (subcarriers first)
  # for m=Mset
  #     for k=Kset
  #        Nset=[ Nset; m*K+k ];
  #     end
  # end
  for {
    w14 = each element of w13
    for {
      w16 = each element of $Kset
      Multiply($K, w14) -> w18
      Add(w18, w16) -> w19
      append w19 to w17
    }
    append w17 to w15
  }
  Array Size(array=w15) -> (size(s)=w20)
  Multiply Array Elements(numeric array=w20) -> (product=w21)
  Reshape Array(inArray=w15, size=w21) -> w22
  Property Node(instance in=w4, "N"=w10, "filter_coeff_tx"=w9, "qam_map"=w8, "Nset"=w22) -> (instance out=w23)
  $params_preamble_out <- w23
