vi "remove single entries.gvi"   [LabVIEW Communications System Design Suite 2.0.1]
inputs:
  "Array in": f64[]
outputs:
  "Array out": f64[]
diagram:
  for (iteration -> i1) {
    w1 = each element of $"Array in"
    Search 1D Array(1D array=$"Array in", element=w1) -> (index of element=w3)
    Is Less(x=w3, y=i1) -> w4
    append w1 to w2 if w4
  }
  $"Array out" <- w2
