vi "scale Kset.gvi"   [LabVIEW Communications System Design Suite 2.0.1]
inputs:
  "K": u16
  "K preamble_in": i32 = 64
  "Kset_in": u8[]
outputs:
  "K preamble_out": i32
  "scale": f64
  "Kset_out": f64[]
panel indicators:
  "preamble subcarrier mapping": u8[][]
diagram:
  $"K preamble_out" <- $"K preamble_in"
  Divide(x=$K, y=$"K preamble_in") -> w1
  Is Equal(x=1, y=w1) -> w2
  case (w2) {
    frame True {
      # equal: do nothing
      w3 = w1
      w4 = $Kset_in
    }
    frame False {
      Is Greater(x=w1, y=1) -> w5
      case (w5) {
        frame False, Default {
          Reciprocal(x=w1) -> w7
          To Unsigned Byte Integer(number=w7) -> w8
          # up sampling TODO
          # create subcarrier mapping
          for (N = $"K preamble_in") (iteration -> i1) {
            Quotient And Remainder(x=i1, y=w8) -> (floor(x/y)=w10)
            Build Array(i1, w10) -> w11
            append w11 to w6
            append w10 to w9
          }
          # select the subcarriers
          s1 = i32[] []  # shift register
          for {
            w12 = each element of $Kset_in
            s2 = s1  # shift register
            while (iteration -> i2) {
              Search 1D Array(1D array=w9, element=w12, start index (0)=i2) -> (index of element=w13)
              Is Equal(x=w13, y=-1) -> w14
              Not(x=w14) -> w15
              case (w15) {
                frame False, Default {
                  w16 = s2
                }
                frame True {
                  Build Array[ConcatenateInputs=True](s2, w13) -> w16
                }
              }
              next s2 = w16
              stop if w14
            }
            next s1 = s2
          }
          # remove doubles
          for (iteration -> i3) {
            w17 = each element of s1
            Increment(x=i3) -> w18
            Search 1D Array(1D array=s1, element=w17, start index (0)=w18) -> (index of element=w19)
            Is Equal(x=w19, y=-1) -> w20
            append w17 to w4 if w20
          }
          w3 = w1
        }
        frame True {
          # downsampling - Preamble smaller than data
          # create subcarrier mapping
          for (N = $K) (iteration -> i4) {
            Quotient And Remainder(x=i4, y=w1) -> (floor(x/y)=w22)
            Build Array(i4, w22) -> w23
            append w23 to w6
            append w22 to w21
          }
          # Keep the doubles!
          # select the subcarriers
          for {
            w24 = each element of $Kset_in
            Array Index(array=w21) -> (out0[w24]=w26)
            append w26 to w25
          }
          call "remove single entries.gvi"(Array in=w25) -> (Array out=w4)
          w3 = w1
        }
      }
      $"preamble subcarrier mapping" <- w6
    }
  }
  $scale <- w3
  $Kset_out <- w4
