vi "do_addCpCsWin.gvi"   [LabVIEW NXG]
inputs:
  "data_samples": c128[]
  "params": T1
outputs:
  "transmit_samples": c128[]
types:
  T1 = cluster{"Ncp": i32, "Nrise": i32, "Ncs": i32, "Nfall": i32, "Ncp+Nrise": i32, "Ncs+Nfall": i32, "N+Ncp+Nrise+Ncs+Nfall": i32, "N+Ncp+Nrise+Ncs": i32, "N-(Ncp+Nrise)": i32, "N+Ncp+Nrise": i32, "K": i32, "M": i32, "mu": i32, "qam_map": c128[], "N": i32, "Nov": i32, "N+Ncp+Nrise+Ncs+Nfall-Nov": i32, "Nb": i32, "Non": i32, "Mon": i32, "Kon": i32, "Nset": i32[], "Mset": i32[], "Kset": i32[], "alpha": f64, "beta": f64, "window_rise": c128[], "window_fall": c128[], "filter_coeff_tx": c128[], "filter_coeff_rx": c128[], "Np": i32, "filter_coeff_tx_2": c128[], "filter_coeff_rx_2": c128[], "rx_type": string, "filter_type": string, "OQAM": bool, "R": i32, "T": i32, "S": i32, "P": i32, "Q": i32, "P/R": i32, "Q/T": i32}
diagram:
  Property Node(instance in=$params) -> ("Nfall"=w1, "N+Ncp+Nrise+Ncs"=w2, "window_fall"=w3)
  Property Node(instance in=$params) -> ("Ncs+Nfall"=w4, "N+Ncp+Nrise"=w5)
  Property Node(instance in=$params) -> ("N+Ncp+Nrise+Ncs+Nfall"=w6, "Ncp+Nrise"=w7)
  # init new array of size N+Ncp+Nrise+Ncs+Nfall
  # and insert transmit samples at index Ncp+Nrise
  Initialize Array(element=0+0i, size=w6) -> w8
  Replace Array Subset(inArray=w8, w7, $data_samples) -> w9
  Property Node(instance in=$params) -> ("N-(Ncp+Nrise)"=w10, "Ncp+Nrise"=w11)
  Array Subset(array=$data_samples, index0=w10, length0=w11) -> w12
  # select samples and copy
  # to the beginning
  Replace Array Subset(inArray=w9, 0, w12) -> w13
  Array Subset(array=$data_samples, index0=0, length0=w4) -> w14
  # select samples and copy
  # to the end
  Replace Array Subset(inArray=w13, w5, w14) -> w15
  Property Node(instance in=$params) -> ("window_rise"=w16, "Nrise"=w17)
  # apply rising window flank
  Array Subset(array=w15, index0=0, length0=w17) -> w18
  Multiply(w18, w16) -> w19
  Replace Array Subset(inArray=w15, 0, w19) -> w20
  # apply falling window flank
  Array Subset(array=w20, index0=w2, length0=w1) -> w21
  Multiply(w21, w3) -> w22
  Replace Array Subset(inArray=w20, w2, w22) -> w23
  $transmit_samples <- w23
