vi "do_demodulate.gvi"   [LabVIEW NXG]
inputs:
  "params": T1
  "transmit_samples": c128[]
outputs:
  "received_data_vector": c128[]
types:
  T1 = cluster{"Ncp": i32, "Nrise": i32, "Ncs": i32, "Nfall": i32, "Ncp+Nrise": i32, "Ncs+Nfall": i32, "N+Ncp+Nrise+Ncs+Nfall": i32, "N+Ncp+Nrise+Ncs": i32, "N-(Ncp+Nrise)": i32, "N+Ncp+Nrise": i32, "K": i32, "M": i32, "mu": i32, "qam_map": c128[], "N": i32, "Nov": i32, "N+Ncp+Nrise+Ncs+Nfall-Nov": i32, "Nb": i32, "Non": i32, "Mon": i32, "Kon": i32, "Nset": i32[], "Mset": i32[], "Kset": i32[], "alpha": f64, "beta": f64, "window_rise": c128[], "window_fall": c128[], "filter_coeff_tx": c128[], "filter_coeff_rx": c128[], "Np": i32, "filter_coeff_tx_2": c128[], "filter_coeff_rx_2": c128[], "rx_type": string, "filter_type": string, "OQAM": bool, "R": i32, "T": i32, "S": i32, "P": i32, "Q": i32, "P/R": i32, "Q/T": i32}
diagram:
  Property Node(instance in=$params) -> ("OQAM"=w1)
  case (w1) {
    frame False, Default {
      w2 = default
    }
    frame True {
      call "demodulate_time_2.gvi"(received_samples=$transmit_samples, params=$params) -> (received_data=w2)
    }
  }
  call "demodulate_time.gvi"(received_samples=$transmit_samples, params=$params) -> (received_data=w3)
  Property Node(instance in=$params) -> ("OQAM"=w4)
  case (w4) {
    frame False, Default {
      w5 = w3
    }
    frame True {
      call "unshuffle_iq.gvi"(params=$params, shuffled_data_vector=w3, shuffled_data_vector_2=w2) -> (restored_data_vector=w5)
    }
  }
  $received_data_vector <- w5
