vi "do_map.gvi"   [LabVIEW Communications System Design Suite 2.0.1]
inputs:
  "data_vector": c128[]
  "params": T1
outputs:
  "mapped_data_vector": c128[]
types:
  T1 = cluster{"Ncp": i32, "Nrise": i32, "Ncs": i32, "Nfall": i32, "Ncp+Nrise": i32, "Ncs+Nfall": i32, "N+Ncp+Nrise+Ncs+Nfall": i32, "N+Ncp+Nrise+Ncs": i32, "N-(Ncp+Nrise)": i32, "N+Ncp+Nrise": i32, "K": i32, "M": i32, "mu": i32, "qam_map": c128[], "N": i32, "Nov": i32, "N+Ncp+Nrise+Ncs+Nfall-Nov": i32, "Nb": i32, "Non": i32, "Mon": i32, "Kon": i32, "Nset": i32[], "Mset": i32[], "Kset": i32[], "alpha": f64, "beta": f64, "window_rise": c128[], "window_fall": c128[], "filter_coeff_tx": c128[], "filter_coeff_rx": c128[], "Np": i32, "filter_coeff_tx_2": c128[], "filter_coeff_rx_2": c128[], "rx_type": string, "filter_type": string, "OQAM": bool, "R": i32, "T": i32, "S": i32, "P": i32, "Q": i32, "P/R": i32, "Q/T": i32}
diagram:
  Property Node(instance in=$params) -> ("N"=w1, "Nset"=w2)
  Initialize Array(element=0+0i, size=w1) -> w3
  s1 = w3  # shift register
  for {
    w4 = each element of w2
    w5 = each element of $data_vector
    Replace Array Subset(inArray=s1, index=w4, new=w5) -> w6
    next s1 = w6
  }
  $mapped_data_vector <- s1
