vi "do_modulate.gvi"   [LabVIEW Communications System Design Suite 2.0.1]
inputs:
  "params": T1
  "data_vector": c128[]
outputs:
  "transmit_samples": c128[]
types:
  T1 = cluster{"Ncp": i32, "Nrise": i32, "Ncs": i32, "Nfall": i32, "Ncp+Nrise": i32, "Ncs+Nfall": i32, "N+Ncp+Nrise+Ncs+Nfall": i32, "N+Ncp+Nrise+Ncs": i32, "N-(Ncp+Nrise)": i32, "N+Ncp+Nrise": i32, "K": i32, "M": i32, "mu": i32, "qam_map": c128[], "N": i32, "Nov": i32, "N+Ncp+Nrise+Ncs+Nfall-Nov": i32, "Nb": i32, "Non": i32, "Mon": i32, "Kon": i32, "Nset": i32[], "Mset": i32[], "Kset": i32[], "alpha": f64, "beta": f64, "window_rise": c128[], "window_fall": c128[], "filter_coeff_tx": c128[], "filter_coeff_rx": c128[], "Np": i32, "filter_coeff_tx_2": c128[], "filter_coeff_rx_2": c128[], "rx_type": string, "filter_type": string, "OQAM": bool, "R": i32, "T": i32, "S": i32, "P": i32, "Q": i32, "P/R": i32, "Q/T": i32}
diagram:
  Property Node(instance in=$params) -> ("OQAM"=w1)
  case (w1) {
    frame False, Default {
      w2 = $data_vector
      w3 = default
    }
    frame True {
      call "shuffle_iq.gvi"(params=$params, data_vector=$data_vector) -> (shuffled_data_vector=w2, shuffled_data_vector_2=w3)
    }
  }
  call "modulate_time.gvi"(data_vector=w2, params=$params) -> (samples_vector=w4)
  Property Node(instance in=$params) -> ("OQAM"=w5)
  case (w5) {
    frame False, Default {
      w6 = w4
    }
    frame True {
      call "modulate_preamble_time.gvi"(data_vector=w3, params=$params) -> (samples_vector=w7)
      Add(w4, w7) -> w6
    }
  }
  $transmit_samples <- w6
