vi "do_overlap.gvi"   [LabVIEW NXG]
inputs:
  "samples_new_block": c128[]
  "samples_packet_in": c128[]
  "params": T1
  "block_idx": i32
outputs:
  "samples_packet_out": c128[]
types:
  T1 = cluster{"Ncp": i32, "Nrise": i32, "Ncs": i32, "Nfall": i32, "Ncp+Nrise": i32, "Ncs+Nfall": i32, "N+Ncp+Nrise+Ncs+Nfall": i32, "N+Ncp+Nrise+Ncs": i32, "N-(Ncp+Nrise)": i32, "N+Ncp+Nrise": i32, "K": i32, "M": i32, "mu": i32, "qam_map": c128[], "N": i32, "Nov": i32, "N+Ncp+Nrise+Ncs+Nfall-Nov": i32, "Nb": i32, "Non": i32, "Mon": i32, "Kon": i32, "Nset": i32[], "Mset": i32[], "Kset": i32[], "alpha": f64, "beta": f64, "window_rise": c128[], "window_fall": c128[], "filter_coeff_tx": c128[], "filter_coeff_rx": c128[], "Np": i32, "filter_coeff_tx_2": c128[], "filter_coeff_rx_2": c128[], "rx_type": string, "filter_type": string, "OQAM": bool, "R": i32, "T": i32, "S": i32, "P": i32, "Q": i32, "P/R": i32, "Q/T": i32}
diagram:
  Property Node(instance in=$params) -> ("Nov"=w1, "N+Ncp+Nrise+Ncs+Nfall-Nov"=w2)
  Multiply(w2, $block_idx) -> w3
  # select overlapping part of new block
  Array Subset(array=$samples_new_block, length0=w1) -> w4
  # select overlapping part of packet
  Array Subset(array=$samples_packet_in, index0=w3, length0=w1) -> w5
  # overlap
  Add(w4, w5) -> w6
  # put back into packet
  Replace Array Subset(inArray=$samples_packet_in, w3, w6) -> w7
  Add(w3, w1) -> w8
  # select non-overlapping
  # part of new block
  Array Subset(array=$samples_new_block, index0=w1) -> w9
  # put into packet
  Replace Array Subset(inArray=w7, w8, w9) -> w10
  $samples_packet_out <- w10
