vi "do_split.gvi"   [LabVIEW NXG]
inputs:
  "params": T1
  "block_idx": i32
  "samples_packet": c128[]
outputs:
  "samples_block": c128[]
types:
  T1 = cluster{"Ncp": i32, "Nrise": i32, "Ncs": i32, "Nfall": i32, "Ncp+Nrise": i32, "Ncs+Nfall": i32, "N+Ncp+Nrise+Ncs+Nfall": i32, "N+Ncp+Nrise+Ncs": i32, "N-(Ncp+Nrise)": i32, "N+Ncp+Nrise": i32, "K": i32, "M": i32, "mu": i32, "qam_map": c128[], "N": i32, "Nov": i32, "N+Ncp+Nrise+Ncs+Nfall-Nov": i32, "Nb": i32, "Non": i32, "Mon": i32, "Kon": i32, "Nset": i32[], "Mset": i32[], "Kset": i32[], "alpha": f64, "beta": f64, "window_rise": c128[], "window_fall": c128[], "filter_coeff_tx": c128[], "filter_coeff_rx": c128[], "Np": i32, "filter_coeff_tx_2": c128[], "filter_coeff_rx_2": c128[], "rx_type": string, "filter_type": string, "OQAM": bool, "R": i32, "T": i32, "S": i32, "P": i32, "Q": i32, "P/R": i32, "Q/T": i32}
diagram:
  Property Node(instance in=$params) -> ("N+Ncp+Nrise+Ncs+Nfall"=w1, "N+Ncp+Nrise+Ncs+Nfall-Nov"=w2)
  Multiply(w2, $block_idx) -> w3
  Array Subset(array=$samples_packet, index0=w3, length0=w1) -> w4
  $samples_block <- w4
