vi "get_gaborDual.gvi"   [LabVIEW NXG]
inputs:
  "filter_coeff": c128[]
  "periods": i32 = 21
  "samples_per_period": i32 = 32
outputs:
  "dual_filter_coeff": c128[]
diagram:
  # $periods: M
  # $samples_per_period: K
  Multiply($periods, $samples_per_period) -> w1
  # gm = reshape(filter_coeff_tx, K, M);
  # Gm = fft(gm, [], 2);
  # iGm = 1./conj(Gm);
  # gmd = ifft(iGm, [], 2);
  # filter_coeff_rx = reshape(gmd, K*M, 1);
  # filter_coeff_rx = filter_coeff_rx(:);
  Reshape Array(inArray=$filter_coeff, size=$periods, size=$samples_per_period) -> w2
  Transpose 2D Array(2D array=w2) -> (transposed array=w3)
  # reshape KMx1 to KxM
  # M point DFT
  # w1: N
  for {
    w4 = each element of w3
    call "DFT.gvi"(x[n]=w4) -> (X[f]=w6)
    append w6 to w5
  }
  Complex Conjugate(x + iy=w5) -> w7
  To Double Precision Float(number=$periods) -> w8
  Real And Imaginary To Complex(x=w8, y=0) -> w9
  # transform+normalize
  Multiply(w7, w9) -> w10
  Reciprocal(x=w10) -> w11
  # M point IDFT
  # reshape KxM to KMx1
  for {
    w12 = each element of w11
    call "IDFT.gvi"(X[f]=w12) -> (x[n]=w14)
    append w14 to w13
  }
  Transpose 2D Array(2D array=w13) -> (transposed array=w15)
  Reshape Array(inArray=w15, size=w1) -> w16
  $dual_filter_coeff <- w16
