vi "get_params.gvi"   [LabVIEW NXG]
outputs:
  "params": T1
panel controls:
  "K": i32 = 128
  "M": i32 = 7
  "Ncp": i32 = 32
  "Ncs": i32
  "mu": string = "4"
  "Nb": i32 = 1
  "alpha": f64 = 1
  "beta": f64 = 0.5
  "Nov": i32
  "rx_type": string = "ZF"
  "filter_type": string = "RC-time"
  "OQAM?": bool
  "silent_subsymbols": string = "none"
  "guard_band": i32 = 10
  "whitespace": i32 = 10
  "symmetry": string = "both"
panel indicators:
  "N": i32
  "Nrise": i32
  "Ncp+Nrise": i32
  "Ncs+Nfall": i32
  "Nfall": i32
  "N+Ncp+Nrise": i32
  "Nset": c128[]
  "qam_map": c128[]
  "filter_coeff_tx": f64[][]
  "window_rise": f64[][]
  "N+Ncp+Nrise+Ncs+Nfall": i32
  "N+Ncp+Nrise+Ncs": i32
  "N-(Ncp+Nrise)": i32
  "Kset": c128[]
  "Mset": c128[]
  "filter_coeff_oqam": f64[][]
  "N+Ncp+Nrise+Ncs+Nfall-Nov": i32
  "Np": i32
  "filter_coeff_rx": f64[][]
  "window_fall": f64[][]
types:
  T1 = cluster{"Ncp": i32, "Nrise": i32, "Ncs": i32, "Nfall": i32, "Ncp+Nrise": i32, "Ncs+Nfall": i32, "N+Ncp+Nrise+Ncs+Nfall": i32, "N+Ncp+Nrise+Ncs": i32, "N-(Ncp+Nrise)": i32, "N+Ncp+Nrise": i32, "K": i32, "M": i32, "mu": i32, "qam_map": c128[], "N": i32, "Nov": i32, "N+Ncp+Nrise+Ncs+Nfall-Nov": i32, "Nb": i32, "Non": i32, "Mon": i32, "Kon": i32, "Nset": i32[], "Mset": i32[], "Kset": i32[], "alpha": f64, "beta": f64, "window_rise": c128[], "window_fall": c128[], "filter_coeff_tx": c128[], "filter_coeff_rx": c128[], "Np": i32, "filter_coeff_tx_2": c128[], "filter_coeff_rx_2": c128[], "rx_type": string, "filter_type": string, "OQAM": bool, "R": i32, "T": i32, "S": i32, "P": i32, "Q": i32, "P/R": i32, "Q/T": i32}
diagram:
  # precompute some
  # required numbers
  # UNUSED: Non, Kon, Mon, R, T, S, P, Q, P/R, Q/T
  w1 = T1 {"qam_map"=[0+0i], "Nset"=[0], "Mset"=[0], "Kset"=[0], "window_rise"=[0+0i], "window_fall"=[0+0i], "filter_coeff_tx"=[0+0i], "filter_coeff_rx"=[0+0i], "filter_coeff_tx_2"=[0+0i], "filter_coeff_rx_2"=[0+0i]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}
  Decimal String To Number(string=$mu) -> (number=w2)
  # TODO: should all integers
  # be I32 or is it worth restricting
  # the range, e.g. for mu to U8?
  Property Node(instance in=w1, "K"=$K, "M"=$M, "Ncs"=$Ncs, "Nb"=$Nb, "mu"=w2, "Ncp"=$Ncp, "alpha"=$alpha, "beta"=$beta, "Nov"=$Nov, "rx_type"=$rx_type, "filter_type"=$filter_type, "OQAM"=$"OQAM?") -> (instance out=w3)
  call "prepare_derived_params.gvi"(params_in=w3, symmetry=$symmetry, whitespace_subcarriers=$whitespace, guard_subcarriers=$guard_band, silent_subsymbols=$silent_subsymbols) -> (params_out=w4)
  # display paremters
  Property Node(instance in=w4) -> (instance out=w5, "N"=w6, "qam_map"=w7, "filter_coeff_tx"=w8, "Nrise"=w9, "Nfall"=w10, "Ncp+Nrise"=w11, "Ncs+Nfall"=w12, "N+Ncp+Nrise+Ncs+Nfall"=w13, "N+Ncp+Nrise+Ncs"=w14, "N-(Ncp+Nrise)"=w15, "N+Ncp+Nrise"=w16, "window_rise"=w17, "window_fall"=w18, "Nset"=w19, "filter_coeff_rx"=w20, "Kset"=w21, "Mset"=w22, "filter_coeff_tx_2"=w23, "filter_coeff_rx_2"=w24, "N+Ncp+Nrise+Ncs+Nfall-Nov"=w25, "Np"=w26)
  $params <- w5
  $N <- w6
  $qam_map <- w7
  Complex To Real Imaginary(x + iy=w8) -> (x=w27, y=w28)
  Build Array(w27, w28) -> w29
  $filter_coeff_tx <- w29
  Complex To Real Imaginary(x + iy=w20) -> (x=w30, y=w31)
  Build Array(w30, w31) -> w32
  $filter_coeff_rx <- w32
  $Nrise <- w9
  $Nfall <- w10
  $"Ncp+Nrise" <- w11
  $"Ncs+Nfall" <- w12
  $"N+Ncp+Nrise+Ncs+Nfall" <- w13
  $"N+Ncp+Nrise+Ncs" <- w14
  $"N-(Ncp+Nrise)" <- w15
  $"N+Ncp+Nrise" <- w16
  Complex To Real Imaginary(x + iy=w17) -> (x=w33, y=w34)
  Build Array(w33, w34) -> w35
  $window_rise <- w35
  Complex To Real Imaginary(x + iy=w18) -> (x=w36, y=w37)
  Build Array(w36, w37) -> w38
  $window_fall <- w38
  Real And Imaginary To Complex(x=w21, y=1) -> w39
  $Kset <- w39
  Real And Imaginary To Complex(x=w22, y=1) -> w40
  $Mset <- w40
  Real And Imaginary To Complex(x=w19, y=1) -> w41
  $Nset <- w41
  Complex To Real Imaginary(x + iy=w23) -> (x=w42, y=w43)
  Complex To Real Imaginary(x + iy=w24) -> (x=w44, y=w45)
  Build Array(w42, w43, w44, w45) -> w46
  $filter_coeff_oqam <- w46
  $"N+Ncp+Nrise+Ncs+Nfall-Nov" <- w25
  $Np <- w26
