vi "get_random_bits.gvi"   [LabVIEW NXG]
inputs:
  "params": T1
  "data_source": string = "random"
  "file_path_bits": path = path "C:\\NMi\\projects\\world_hi2u\\resources\\filter-coefficients\\b.txt"
outputs:
  "bits": i8[]
types:
  T1 = cluster{"Ncp": i32, "Nrise": i32, "Ncs": i32, "Nfall": i32, "Ncp+Nrise": i32, "Ncs+Nfall": i32, "N+Ncp+Nrise+Ncs+Nfall": i32, "N+Ncp+Nrise+Ncs": i32, "N-(Ncp+Nrise)": i32, "N+Ncp+Nrise": i32, "K": i32, "M": i32, "mu": i32, "qam_map": c128[], "N": i32, "Nov": i32, "N+Ncp+Nrise+Ncs+Nfall-Nov": i32, "Nb": i32, "Non": i32, "Mon": i32, "Kon": i32, "Nset": i32[], "Mset": i32[], "Kset": i32[], "alpha": f64, "beta": f64, "window_rise": c128[], "window_fall": c128[], "filter_coeff_tx": c128[], "filter_coeff_rx": c128[], "Np": i32, "filter_coeff_tx_2": c128[], "filter_coeff_rx_2": c128[], "rx_type": string, "filter_type": string, "OQAM": bool, "R": i32, "T": i32, "S": i32, "P": i32, "Q": i32, "P/R": i32, "Q/T": i32}
diagram:
  Property Node(instance in=$params) -> ("mu"=w1, "Non"=w2)
  Multiply(w1, w2) -> w3
  call "gen_bits.gvi"(source=$data_source, number of bits N=w3, file path=$file_path_bits) -> (array of random symbols=w4)
  $bits <- w4
