vi "get_rc.gvi"   [LabVIEW NXG]
inputs:
  "samples_per_period": i32
  "time_domain?": bool = TRUE
  "periods": i32 = 5
  "roll_off": f64 = 0.5
  "normalize": bool
outputs:
  "filter_coeff": c128[]
panel indicators:
  "transmit_samples_plot": f64[]
diagram:
  # Reference: matlab/rc.m
  # true=time
  # false=freq
  case ($"time_domain?") {
    frame True {
      To Double Precision Float(number=$samples_per_period) -> w2
      Reciprocal(x=w2) -> w3
      Multiply($samples_per_period, $periods) -> w4
      To Double Precision Float(number=w4) -> w5
      # prepare time vector
      Multiply(w5, 0.5) -> w6
      for (N = w4) (iteration -> i1) {
        append i1 to w7
      }
      To Double Precision Float(number=w7) -> w8
      Subtract(x=w8, y=w6) -> w9
      # w10: t/T
      Multiply(w3, w9) -> w10
      Multiply(-2, $roll_off) -> w11
      Reciprocal(x=w11) -> w12
      Search 1D Array(1D array=w10, element=w12, start index (0)=0) -> (index of element=w13)
      Reciprocal(x=$roll_off) -> w14
      Multiply(Pi, 0.5, w14) -> w15
      Sinc(x=w15) -> w16
      Multiply(Pi, 0.25, w16) -> w17
      Multiply(2, $roll_off) -> w18
      Reciprocal(x=w18) -> w19
      Search 1D Array(1D array=w10, element=w19, start index (0)=0) -> (index of element=w20)
      Multiply(Pi, w10) -> w21
      # calculate RC
      Sinc(x=w21) -> w22
      Multiply(w21, $roll_off) -> w23
      Cosine(x=w23) -> w24
      Multiply(w10, $roll_off, 2) -> w25
      Square(x=w25) -> w26
      Subtract(x=1, y=w26) -> w27
      Reciprocal(x=w27) -> w28
      Multiply(w22, w24, w28) -> w29
      Search 1D Array(1D array=w10, element=0, start index (0)=0) -> (index of element=w30)
      # fix discontinuities in RC function
      Replace Array Subset(inArray=w29, w30, 1) -> w31
      Replace Array Subset(inArray=w31, w20, w17) -> w32
      Replace Array Subset(inArray=w32, w13, w17) -> w1
    }
    frame False {
      Multiply($samples_per_period, $periods) -> w33
      To Double Precision Float(number=w33) -> w34
      Multiply(w34, 0.5) -> w35
      To Double Precision Float(number=$periods) -> w36
      Subtract(x=1, y=$roll_off) -> w37
      # w37: 1-a
      # w38: -M(1-a)/2
      Multiply(w36, w37, -0.5) -> w38
      Negate(x=w38) -> w39
      # w40: M(1-a)/2+N/2
      Add(w35, w39) -> w40
      Round Toward Positive Infinity(x=w40) -> w41
      # rising flank
      To Long Integer(number=w41) -> w42
      Initialize Array(element=0, size=w33) -> w43
      Add(1, $roll_off) -> w44
      # w44: 1+a
      Multiply(w36, w44, -0.5) -> w45
      # w46: -M(1+a)/2+N/2
      Add(w35, w45) -> w46
      Round Toward Positive Infinity(x=w46) -> w47
      To Long Integer(number=w47) -> w48
      Reciprocal(x=w36) -> w49
      # w50: -M(1-a)/2+N/2
      Add(w35, w38) -> w50
      Round Toward Negative Infinity(x=w50) -> w51
      To Long Integer(number=w51) -> w52
      Subtract(x=w52, y=w48) -> w53
      Increment(x=w53) -> w54
      for (N = w54) (iteration -> i2) {
        append i2 to w55
      }
      Increment(x=w55) -> w56
      Add(w56, w48) -> w57
      To Double Precision Float(number=w57) -> w58
      Subtract(x=w58, y=w35) -> w59
      Decrement(x=w59) -> w60
      Multiply(w60, w49) -> w61
      Multiply(w37, 0.5) -> w62
      Add(w61, w62) -> w63
      Reciprocal(x=$roll_off) -> w64
      Multiply(w63, Pi, w64) -> w65
      Cosine(x=w65) -> w66
      Increment(x=w66) -> w67
      Multiply(0.5, w67) -> w68
      Replace Array Subset(inArray=w43, w48, w68) -> w69
      Increment(x=w52) -> w70
      # ones
      Subtract(x=w42, y=w52) -> w71
      Decrement(x=w71) -> w72
      Initialize Array(element=1, size=w72) -> w73
      Replace Array Subset(inArray=w69, w70, w73) -> w74
      # falling flank
      Subtract(x=1, y=w68) -> w75
      Replace Array Subset(inArray=w74, w42, w75) -> w1
    }
  }
  Real And Imaginary To Complex(x=w1, y=0) -> w76
  call "fftshift.gvi"(vector_in=w76) -> (vector_out=w77)
  case ($normalize) {
    frame False, Default {
      w78 = w77
    }
    frame True {
      Square(x=w77) -> w79
      Add Array Elements(numeric array=w79) -> (sum=w80)
      Square Root(x=w80) -> w81
      Reciprocal(x=w81) -> w82
      Multiply(w77, w82) -> w78
    }
  }
  $filter_coeff <- w78
  Complex To Real Imaginary(x + iy=w78) -> (x=w83)
  $transmit_samples_plot <- w83
