vi "get_rect_fd.gvi"   [LabVIEW Communications System Design Suite 2.0.1]
inputs:
  "K": f64
  "M": f64
outputs:
  "filter_coeff_tx": c128[]
diagram:
  # Reference: matlab/rect_fd.m
  Multiply($K, $M) -> w1
  Subtract(x=w1, y=$M) -> w2
  Initialize Array(element=0+0i, size=w2) -> w3
  Divide(x=$M, y=2) -> w4
  Initialize Array(element=1+0i, size=w4) -> w5
  Build Array[ConcatenateInputs=True](w5, w3, w5) -> w6
  Array Size(array=w6) -> (size(s)=w7)
  call "IDFT.gvi"(X[f]=w6, nfft=w7) -> (x[n]=w8)
  w9 = TRUE  # normalize?
  case (w9) {
    frame False, Default {
      w10 = w8
    }
    frame True {
      Complex To Real Imaginary(x + iy=w8) -> (x=w11, y=w12)
      Multiply(w11, w11) -> w13
      Multiply(w12, w12) -> w14
      Add(w13, w14) -> w15
      Add Array Elements(numeric array=w15) -> (sum=w16)
      Square Root(x=w16) -> w17
      Reciprocal(x=w17) -> w18
      Multiply(w8, w18) -> w10
    }
  }
  $filter_coeff_tx <- w10
