vi "get_rrc.gvi"   [LabVIEW NXG]
inputs:
  "samples_per_period": i32
  "time_domain?": bool = TRUE
  "periods": i32 = 5
  "roll_off": f64 = 0.5
  "normalize": bool
outputs:
  "filter_coeff": c128[]
panel indicators:
  "transmit_samples_plot": f64[]
diagram:
  # Reference: matlab/rc.m
  # true=time
  # false=freq
  case ($"time_domain?") {
    frame True {
      To Double Precision Float(number=$samples_per_period) -> w2
      Reciprocal(x=w2) -> w3
      Multiply($samples_per_period, $periods) -> w4
      To Double Precision Float(number=w4) -> w5
      # prepare time vector
      Multiply(w5, 0.5) -> w6
      for (N = w4) (iteration -> i1) {
        append i1 to w7
      }
      To Double Precision Float(number=w7) -> w8
      Subtract(x=w8, y=w6) -> w9
      # w10: t/T
      Multiply(w3, w9) -> w10
      Multiply(-4, $roll_off) -> w11
      Reciprocal(x=w11) -> w12
      Search 1D Array(1D array=w10, element=w12, start index (0)=0) -> (index of element=w13)
      Square Root(x=2) -> w14
      Reciprocal(x=w14) -> w15
      Multiply(w15, $roll_off) -> w16
      Reciprocal(x=Pi) -> w17
      Multiply(w17, 2) -> w18
      Subtract(x=1, y=w18) -> w19
      Multiply(Pi, 0.25, $roll_off) -> w20
      Cosine(x=w20) -> w21
      Multiply(w19, w21) -> w22
      Add(w18, 1) -> w23
      Sine(x=w20) -> w24
      Multiply(w23, w24) -> w25
      Add(w22, w25) -> w26
      Multiply(w26, w16) -> w27
      Multiply(4, $roll_off) -> w28
      Reciprocal(x=w28) -> w29
      Search 1D Array(1D array=w10, element=w29, start index (0)=0) -> (index of element=w30)
      Search 1D Array(1D array=w10, element=0, start index (0)=0) -> (index of element=w31)
      # w32: pi t/T
      Multiply(Pi, w10) -> w32
      # w33: 1-a
      Subtract(x=1, y=$roll_off) -> w33
      Multiply(w32, w33) -> w34
      # calculate RC
      Sine(x=w34) -> w35
      # w36: 1+a
      Add($roll_off, 1) -> w36
      Multiply(w32, w36) -> w37
      Cosine(x=w37) -> w38
      # w39: 4a
      Multiply($roll_off, 4) -> w39
      # w40: 4at/T
      Multiply(w10, w39) -> w40
      Multiply(w38, w40) -> w41
      # w42: numerator
      Add(w35, w41) -> w42
      Square(x=w40) -> w43
      Subtract(x=1, y=w43) -> w44
      Multiply(w44, w32) -> w45
      # w46: denominator
      Reciprocal(x=w45) -> w46
      # fix discontinuities in RC function
      Multiply(w42, w46) -> w47
      Negate(x=$roll_off) -> w48
      Multiply(4, $roll_off, w17) -> w49
      Add(1, w48, w49) -> w50
      Replace Array Subset(inArray=w47, w31, w50) -> w51
      Replace Array Subset(inArray=w51, w30, w27) -> w52
      Replace Array Subset(inArray=w52, w13, w27) -> w1
    }
    frame False {
      Multiply($samples_per_period, $periods) -> w53
      To Double Precision Float(number=w53) -> w54
      Multiply(w54, 0.5) -> w55
      To Double Precision Float(number=$periods) -> w56
      Subtract(x=1, y=$roll_off) -> w57
      # w57: 1-a
      Multiply(w56, w57, -0.5) -> w58
      Negate(x=w58) -> w59
      # w60: M(1-a)/2+N/2
      Add(w55, w59) -> w60
      Round Toward Positive Infinity(x=w60) -> w61
      # rising flank
      To Long Integer(number=w61) -> w62
      Initialize Array(element=0, size=w53) -> w63
      Add(1, $roll_off) -> w64
      # w64: 1+a
      # w58: -M(1-a)/2
      Multiply(w56, w64, -0.5) -> w65
      # w66: -M(1+a)/2+N/2
      Add(w55, w65) -> w66
      Round Toward Positive Infinity(x=w66) -> w67
      To Long Integer(number=w67) -> w68
      Reciprocal(x=w56) -> w69
      # w70: -M(1-a)/2+N/2
      Add(w55, w58) -> w70
      Round Toward Negative Infinity(x=w70) -> w71
      To Long Integer(number=w71) -> w72
      Subtract(x=w72, y=w68) -> w73
      Increment(x=w73) -> w74
      for (N = w74) (iteration -> i2) {
        append i2 to w75
      }
      Increment(x=w75) -> w76
      Add(w76, w68) -> w77
      To Double Precision Float(number=w77) -> w78
      Subtract(x=w78, y=w55) -> w79
      Decrement(x=w79) -> w80
      Multiply(w80, w69) -> w81
      Multiply(w57, 0.5) -> w82
      Add(w81, w82) -> w83
      Reciprocal(x=$roll_off) -> w84
      Multiply(w83, Pi, w84) -> w85
      Cosine(x=w85) -> w86
      Increment(x=w86) -> w87
      Multiply(0.5, w87) -> w88
      Replace Array Subset(inArray=w63, w68, w88) -> w89
      Increment(x=w72) -> w90
      # ones
      Subtract(x=w62, y=w72) -> w91
      Decrement(x=w91) -> w92
      Initialize Array(element=1, size=w92) -> w93
      Replace Array Subset(inArray=w89, w90, w93) -> w94
      # falling flank
      Subtract(x=1, y=w88) -> w95
      Replace Array Subset(inArray=w94, w62, w95) -> w96
      Square Root(x=w96) -> w1
    }
  }
  Real And Imaginary To Complex(x=w1, y=0) -> w97
  call "fftshift.gvi"(vector_in=w97) -> (vector_out=w98)
  case ($normalize) {
    frame False, Default {
      w99 = w98
    }
    frame True {
      Square(x=w98) -> w100
      Add Array Elements(numeric array=w100) -> (sum=w101)
      Square Root(x=w101) -> w102
      Reciprocal(x=w102) -> w103
      Multiply(w98, w103) -> w99
    }
  }
  $filter_coeff <- w99
  Complex To Real Imaginary(x + iy=w99) -> (x=w104)
  $transmit_samples_plot <- w104
