vi "DFT.gvi"   [LabVIEW NXG]
inputs:
  "x[n]": c128[]
  "nfft": i32 = -1
outputs:
  "X[f]": c128[]
diagram:
  call "Complex FFT.gvi"(x=$"x[n]", FFT size=$nfft) -> (FFT {x}=w1)
  Array Size(array=$"x[n]") -> (size(s)=w2)
  To Double Precision Complex(number=w2) -> w3
  # workaround for complex N point IDFT
  Square Root(x=w3) -> w4
  Reciprocal(x=w4) -> w5
  Multiply(w5, w1) -> w6
  $"X[f]" <- w6
