vi "IDFT.gvi"   [LabVIEW NXG]
inputs:
  "X[f]": c128[]
  "nfft": i32 = -1
outputs:
  "x[n]": c128[]
diagram:
  Complex Conjugate(x + iy=$"X[f]") -> w1
  call "Complex FFT.gvi"(x=w1, FFT size=$nfft) -> (FFT {x}=w2)
  Complex Conjugate(x + iy=w2) -> w3
  Array Size(array=$"X[f]") -> (size(s)=w4)
  To Double Precision Complex(number=w4) -> w5
  # workaround for complex N point IDFT
  Square Root(x=w5) -> w6
  Reciprocal(x=w6) -> w7
  Multiply(w7, w3) -> w8
  $"x[n]" <- w8
