vi "circshift_filter_sum.gvi"   [LabVIEW NXG]
inputs:
  "number_of_periods": i32
  "received_signal": c128[]
  "filter_coeff": c128[]
  "samples_per_period": i32
  "shift_index": i32
outputs:
  "received_data": c128[]
diagram:
  # circshift modulated data
  # by shift_index*samples_per_period
  # sum subcarriers = decimate
  # multiply with
  # filter coefficients
  # init with samples_per_period zeros
  Multiply($samples_per_period, $shift_index) -> w1
  Rotate 1D Array(array=$received_signal, n=w1) -> (array (last n elements first)=w2)
  Multiply(w2, $filter_coeff) -> w3
  Initialize Array(element=0+0i, size=$samples_per_period) -> w4
  # for each sample
  s1 = w4  # shift register
  for (N = $samples_per_period) (iteration -> i1) {
    # for each period
    s2 = uninitialised  # shift register
    for (N = $number_of_periods) (iteration -> i2) {
      Multiply(i2, $samples_per_period) -> w5
      Add(i1, w5) -> w6
      Array Subset(array=w3, index0=w6, length0=1) -> w7
      Add(w7, s2) -> w8
      next s2 = w8
    }
    Replace Array Subset(inArray=s1, i1, s2) -> w9
    next s1 = w9
  }
  $received_data <- s1
