vi "demodulate_time_2.gvi"   [LabVIEW NXG]
inputs:
  "received_samples": c128[]
  "params": T1
outputs:
  "received_data": c128[]
types:
  T1 = cluster{"Ncp": i32, "Nrise": i32, "Ncs": i32, "Nfall": i32, "Ncp+Nrise": i32, "Ncs+Nfall": i32, "N+Ncp+Nrise+Ncs+Nfall": i32, "N+Ncp+Nrise+Ncs": i32, "N-(Ncp+Nrise)": i32, "N+Ncp+Nrise": i32, "K": i32, "M": i32, "mu": i32, "qam_map": c128[], "N": i32, "Nov": i32, "N+Ncp+Nrise+Ncs+Nfall-Nov": i32, "Nb": i32, "Non": i32, "Mon": i32, "Kon": i32, "Nset": i32[], "Mset": i32[], "Kset": i32[], "alpha": f64, "beta": f64, "window_rise": c128[], "window_fall": c128[], "filter_coeff_tx": c128[], "filter_coeff_rx": c128[], "Np": i32, "filter_coeff_tx_2": c128[], "filter_coeff_rx_2": c128[], "rx_type": string, "filter_type": string, "OQAM": bool, "R": i32, "T": i32, "S": i32, "P": i32, "Q": i32, "P/R": i32, "Q/T": i32}
diagram:
  # TODO: work only on Kset and Mset instead of receiving all K and M symbols
  Property Node(instance in=$params) -> ("M"=w1)
  # init register
  # with zeros
  Property Node(instance in=$params) -> ("N"=w2)
  Initialize Array(element=0+0i, size=w2) -> w3
  # only difference is that
  # this guy uses filter_coeff_rx_2
  # for m=0:M-1
  s1 = w3  # shift register
  for (N = w1) (iteration -> i1) {
    Property Node(instance in=$params) -> ("K"=w4)
    Multiply(i1, w4) -> w5
    Negate(x=w5) -> w6
    # circshift received vector by
    # m*K samples
    Rotate 1D Array(array=$received_samples, n=w6) -> (array (last n elements first)=w7)
    Property Node(instance in=$params) -> ("filter_coeff_rx_2"=w8)
    # apply rx filter
    Multiply(w8, w7) -> w9
    Property Node(instance in=$params) -> ("K"=w10, "M"=w11)
    Initialize Array(element=0+0i, size=w10) -> w12
    # for k=1:K
    # dm(k)=sum(x(k:M:end))
    s2 = w12  # shift register
    for (N = w10) (iteration -> i2) {
      # for k=0:K-1
      s3 = 0+0i  # shift register
      for (N = w11) (iteration -> i3) {
        Multiply(w10, i3) -> w13
        Add(w13, i2) -> w14
        # for m=0:M-1
        Array Index(array=w9) -> (out0[w14]=w15)
        Add(w15, s3) -> w16
        next s3 = w16
      }
      Replace Array Subset(inArray=s2, i2, s3) -> w17
      next s2 = w17
    }
    call "DFT.gvi"(x[n]=s2) -> (X[f]=w18)
    # dhat(m*K:(m+1)*K-1)=dm
    Replace Array Subset(inArray=s1, w5, w18) -> w19
    next s1 = w19
  }
  $received_data <- s1
