vi "fftshift.gvi"   [LabVIEW NXG]
inputs:
  "vector_in": c128[]
outputs:
  "vector_out": c128[]
diagram:
  Array Size(array=$vector_in) -> (size(s)=w1)
  To Double Precision Float(number=w1) -> w2
  Divide(x=w2, y=2) -> w3
  Round Toward Negative Infinity(x=w3) -> w4
  To Long Integer(number=w4) -> w5
  Rotate 1D Array(array=$vector_in, n=w5) -> (array (last n elements first)=w6)
  $vector_out <- w6
