vi "gen_bits.gvi"   [LabVIEW NXG]
inputs:
  "source": string = "random"
  "number of bits N": i32
  "file path": path = path "Z:\\NMi\\world_hi2u\\resources\\filter-coefficients\\test.txt"
  "seed_in": i32 = 1
outputs:
  "random bits": i8[]
diagram:
  # generate N random bits in the range [0,1] and collect them in an int8 array
  case ($source) {
    frame "random", Default {
      for (N = $"number of bits N") {
        Random Number() -> (number (0 to 1)=w2)
        Multiply(w2, 2) -> w3
        Round Toward Negative Infinity(x=w3) -> w4
        To Byte Integer(number=w4) -> w5
        append w5 to w1
      }
    }
    frame "file" {
      call "read_txt.gvi"(file path=$"file path") -> (float array=w6)
      To Byte Integer(number=w6) -> w1
    }
    frame "zeros" {
      for (N = $"number of bits N") {
        append 0 to w1
      }
    }
    frame "seeded" {
      call "MT Generate Bits (Galois, PN Order).gvi"(total bits=$"number of bits N", PN sequence order=11, seed in=$seed_in, reset?=TRUE) -> (output bit stream=w1)
    }
  }
  $"random bits" <- w1
