vi "gen_qam_map.gvi"   [LabVIEW NXG]
inputs:
  "order of modulation mu": i32 = 1
outputs:
  "symbol map": c128[]
diagram:
  # TODO:
  # + mu>2
  # + LUT or read from file?
  # return symbol map for different QAM modulations
  case ($"order of modulation mu") {
    frame 1, Default {
      # BPSK
      w1 = [1+0i, -1+0i]
    }
    frame 2 {
      # QPSK
      w2 = 0.7071+0i  # scaling factor
      Multiply([-1-1i, 1-1i, -1+1i, 1+1i], w2) -> w1
    }
    frame 4 {
      # 16QAM
      # map is applied to the symbols
      # 0...15 with the LSB being on the __LEFT__
      w3 = [-3+3i, 3+3i, -1+3i, 1+3i, -3-3i, 3-3i, -1-3i, 1-3i, -3+1i, 3+1i, -1+1i, 1+1i, -3-1i, 3-1i, -1-1i, 1-1i]
      w4 = 0.3162+0i  # scaling factor
      Multiply(w3, w4) -> w1
    }
  }
  $"symbol map" <- w1
