vi "gen_symbols.gvi"   [LabVIEW NXG]
inputs:
  "number of symbols": i32
  "order of modulation": i32
outputs:
  "array of random symbols": i8[]
diagram:
  To Double Precision Float(number=$"order of modulation") -> w1
  Power Of 2(x=w1) -> w2
  # generate N random integer symbols in the range 0...2^(mu-1) and collect them in an int8 array
  for (N = $"number of symbols") {
    Random Number() -> (number (0 to 1)=w4)
    Multiply(w4, w2) -> w5
    Round Toward Negative Infinity(x=w5) -> w6
    To Byte Integer(number=w6) -> w7
    append w7 to w3
  }
  $"array of random symbols" <- w3
