vi "modulate_freq.gvi"   [LabVIEW NXG]
inputs:
  "data_vector": c128[]
  "params": T1
outputs:
  "transmit_samples": c128[]
types:
  T1 = cluster{"K": i32, "mu": i32, "M": i32, "N": i32, "qam_map": c128[], "filter_coeff": c128[], "Nb": i32}
diagram:
  # TODO:
  # + precoding optional
  # + option to chose time or frequency convolution
  Property Node(instance in=$params) -> ("K"=w1, "N"=w2)
  Initialize Array(element=0+0i, size=w2) -> w3
  # for each subvector, process data in chunks of M samples each...
  # TODO: this is optional for time domain conv.
  # init with N zeros
  s1 = w3  # shift register
  for (N = w1) (iteration -> i1) {
    # select subvector
    Property Node(instance in=$params) -> ("M"=w4)
    Multiply(i1, w4) -> w5
    Array Subset(array=$data_vector, index0=w5, length0=w4) -> w6
    # precoding
    call "Complex FFT.gvi"(x=w6) -> (FFT {x}=w7)
    Property Node(instance in=$params) -> ("K"=w8, "M"=w9, "filter_coeff"=w10)
    # repeat, filter and circshift
    call "repeat_filter_circshift.gvi"(K=w8, data_vector=w7, filter_coeff=w10, M=w9, shift_index=i1) -> (filtered_signal=w11)
    # superposition
    # subcarriers in
    # a loop
    Add(w11, s1) -> w12
    next s1 = w12
  }
  # domain conversion
  call "IDFT.gvi"(X[f]=s1) -> (x[n]=w13)
  $transmit_samples <- w13
