vi "modulate_preamble_time.gvi"   [LabVIEW Communications System Design Suite 2.0.1]
inputs:
  "data_vector": c128[]
  "params_preamble": T1
outputs:
  "samples_vector": c128[]
types:
  T1 = cluster{"qam_map": c128[], "K": i32, "M": i32, "Kon": i32, "Kset": i32[], "filter_coeff_tx": c128[], "N": i32, "mu": string, "OQAM": bool}
diagram:
  Property Node(instance in=$params_preamble) -> ("M"=w1, "N"=w2)
  Initialize Array(element=0+0i, size=w2) -> w3
  # note that this guy uses the second set of filter coefficients.
  # NOTE:
  # for modualtion in time,
  # M and K are wired
  # to K and M respectively!!
  # for each symbol, process data in chunks of K samples each...
  # init with N zeros
  s1 = w3  # shift register
  for (N = w1) (iteration -> i1) {
    # select subvector
    Property Node(instance in=$params_preamble) -> ("K"=w4)
    Multiply(i1, w4) -> w5
    Array Subset(array=$data_vector, index0=w5, length0=w4) -> w6
    # domain conversion
    call "IDFT.gvi"(X[f]=w6) -> (x[n]=w7)
    Property Node(instance in=$params_preamble) -> ("M"=w8, "K"=w9, "filter_coeff_tx"=w10)
    # repeat, filter and circshift
    call "repeat_filter_circshift.gvi"(K=w8, data_vector=w7, filter_coeff=w10, M=w9, shift_index=i1) -> (filtered_signal=w11)
    # superposition with
    # previous subcarriers
    # in a loop
    Add(w11, s1) -> w12
    next s1 = w12
  }
  $samples_vector <- s1
