vi "modulate_time.gvi"   [LabVIEW Communications System Design Suite 2.0.1]
inputs:
  "data_vector": c128[]
  "params": T1
outputs:
  "samples_vector": c128[]
types:
  T1 = cluster{"Ncp": i32, "Nrise": i32, "Ncs": i32, "Nfall": i32, "Ncp+Nrise": i32, "Ncs+Nfall": i32, "N+Ncp+Nrise+Ncs+Nfall": i32, "N+Ncp+Nrise+Ncs": i32, "N-(Ncp+Nrise)": i32, "N+Ncp+Nrise": i32, "K": i32, "M": i32, "mu": i32, "qam_map": c128[], "N": i32, "Nov": i32, "N+Ncp+Nrise+Ncs+Nfall-Nov": i32, "Nb": i32, "Non": i32, "Mon": i32, "Kon": i32, "Nset": i32[], "Mset": i32[], "Kset": i32[], "alpha": f64, "beta": f64, "window_rise": c128[], "window_fall": c128[], "filter_coeff_tx": c128[], "filter_coeff_rx": c128[], "Np": i32, "filter_coeff_tx_2": c128[], "filter_coeff_rx_2": c128[], "rx_type": string, "filter_type": string, "OQAM": bool, "R": i32, "T": i32, "S": i32, "P": i32, "Q": i32, "P/R": i32, "Q/T": i32}
diagram:
  # TODO:
  # + is option to chose time or frequency convolution necessary?
  Property Node(instance in=$params) -> ("M"=w1, "N"=w2)
  Initialize Array(element=0+0i, size=w2) -> w3
  # NOTE:
  # for modualtion in time,
  # M and K are wired
  # to K and M respectively!!
  # for each symbol, process data in chunks of K samples each...
  # init with N zeros
  s1 = w3  # shift register
  for (N = w1) (iteration -> i1) {
    # select subvector
    Property Node(instance in=$params) -> ("K"=w4)
    Multiply(i1, w4) -> w5
    Array Subset(array=$data_vector, index0=w5, length0=w4) -> w6
    # domain conversion
    call "IDFT.gvi"(X[f]=w6) -> (x[n]=w7)
    Property Node(instance in=$params) -> ("M"=w8, "K"=w9, "filter_coeff_tx"=w10)
    # repeat, filter and circshift
    call "repeat_filter_circshift.gvi"(K=w8, data_vector=w7, filter_coeff=w10, M=w9, shift_index=i1) -> (filtered_signal=w11)
    # superposition with
    # previous subcarriers
    # in a loop
    Add(w11, s1) -> w12
    next s1 = w12
  }
  $samples_vector <- s1
