vi "prepare_derived_params.gvi"   [LabVIEW Communications System Design Suite 2.0.1]
inputs:
  "params_in": T1
  "symmetry": string = "both"
  "whitespace_subcarriers": i32 = 10
  "guard_subcarriers": i32 = 10
  "silent_subsymbols": string = "none"
outputs:
  "params_out": T1
types:
  T1 = cluster{"Ncp": i32, "Nrise": i32, "Ncs": i32, "Nfall": i32, "Ncp+Nrise": i32, "Ncs+Nfall": i32, "N+Ncp+Nrise+Ncs+Nfall": i32, "N+Ncp+Nrise+Ncs": i32, "N-(Ncp+Nrise)": i32, "N+Ncp+Nrise": i32, "K": i32, "M": i32, "mu": i32, "qam_map": c128[], "N": i32, "Nov": i32, "N+Ncp+Nrise+Ncs+Nfall-Nov": i32, "Nb": i32, "Non": i32, "Mon": i32, "Kon": i32, "Nset": i32[], "Mset": i32[], "Kset": i32[], "alpha": f64, "beta": f64, "window_rise": c128[], "window_fall": c128[], "filter_coeff_tx": c128[], "filter_coeff_rx": c128[], "Np": i32, "filter_coeff_tx_2": c128[], "filter_coeff_rx_2": c128[], "rx_type": string, "filter_type": string, "OQAM": bool, "R": i32, "T": i32, "S": i32, "P": i32, "Q": i32, "P/R": i32, "Q/T": i32}
diagram:
  Property Node(instance in=$params_in) -> ("K"=w1, "M"=w2, "mu"=w3)
  Multiply(w1, w2) -> w4
  call "gen_qam_map.gvi"(order of modulation mu=w3) -> (symbol map=w5)
  Property Node(instance in=$params_in, "qam_map"=w5, "N"=w4) -> (instance out=w6)
  # window and filter coefficients
  Property Node(instance in=w6) -> ("K"=w7, "M"=w8, "alpha"=w9, "beta"=w10, "rx_type"=w11, "filter_type"=w12)
  # tx filter
  # rx filter
  case (w12) {
    frame "RC-freq" {
      call "get_rc.gvi"(samples_per_period=w8, time_domain?=FALSE, periods=w7, roll_off=w9, normalize=FALSE) -> (filter_coeff=w13)
    }
    frame "RRC-time" {
      call "get_rrc.gvi"(samples_per_period=w7, time_domain?=TRUE, periods=w8, roll_off=w9, normalize=FALSE) -> (filter_coeff=w13)
    }
    frame "RRC-freq" {
      call "get_rrc.gvi"(samples_per_period=w8, time_domain?=FALSE, periods=w7, roll_off=w9, normalize=FALSE) -> (filter_coeff=w13)
    }
    frame "RC-time" {
      call "get_rc.gvi"(samples_per_period=w7, time_domain?=TRUE, periods=w8, roll_off=w9, normalize=FALSE) -> (filter_coeff=w13)
    }
    frame "Rect_fd", Default {
      call "get_rect_fd.gvi"(K=w7, M=w8) -> (filter_coeff_tx=w13)
    }
  }
  case (w11) {
    frame "ZF", Default {
      call "get_gaborDual.gvi"(filter_coeff=w13, periods=w8, samples_per_period=w7) -> (dual_filter_coeff=w14)
    }
    frame "MF" {
      Complex Conjugate(x + iy=w13) -> w14
    }
  }
  # window
  call "get_rc.gvi"(samples_per_period=2, time_domain?=FALSE, periods=w7, roll_off=w10, normalize=FALSE) -> (filter_coeff=w15)
  To Double Precision Float(number=w7) -> w16
  Multiply(w16, w10) -> w17
  Round Toward Positive Infinity(x=w17) -> w18
  Subtract(x=w16, y=w18) -> w19
  # idx1=ceil(b*K);
  # idx2=ceil((K-idx1)/2);
  Multiply(w19, 0.5) -> w20
  Round Toward Positive Infinity(x=w20) -> w21
  To Long Integer(number=w21) -> w22
  To Long Integer(number=w18) -> w23
  Array Subset(array=w15, index0=w22, length0=w23) -> w24
  # select the
  # non-zero part
  # of the rc flank
  Subtract(x=1+0i, y=w24) -> w25
  Array Size(array=w25) -> (size(s)=w26)
  Property Node(instance in=w6, "filter_coeff_tx"=w13, "window_fall"=w24, "window_rise"=w25, "Nrise"=w26, "Nfall"=w26, "filter_coeff_rx"=w14) -> (instance out=w27)
  # filters for OQAM
  Property Node(instance in=w27) -> ("filter_coeff_tx"=w28, "OQAM"=w29, "filter_type"=w30, "M"=w31, "N"=w32, "K"=w33, "rx_type"=w34)
  # TODO: filter_coeff_rx_2 unwired
  # RX filter for OQAM with ZF/MF?
  case (w29) {
    frame False, Default {
      Array Size(array=w28) -> (size(s)=w36)
      # second set of filters is zero if OQAM is off
      Initialize Array(element=0+0i, size=w36) -> w35
    }
    frame True {
      case (w30) {
        frame "RC-time", Default {
          To Double Precision Complex(number=w31) -> w37
          Reciprocal(x=w37) -> w38
          # prepare exponential function
          for (N = w32) (iteration -> i1) {
            append i1 to w39
          }
          # g2=ifft(fft(g).*exp(-1j*2*pi*0.5*transpose(0:N-1)/M));
          To Double Precision Complex(number=w39) -> w40
          Multiply(0-3.14159265359i, w38, 0.5+0i, w40) -> w41
          Exponential(x=w41) -> w42
          call "DFT.gvi"(x[n]=w28) -> (X[f]=w43)
          # apply in frequency domain
          Multiply(w43, w42) -> w44
          call "IDFT.gvi"(X[f]=w44) -> (x[n]=w35)
        }
        frame "RC-freq" {
          To Double Precision Complex(number=w31) -> w45
          Reciprocal(x=w45) -> w46
          # prepare exponential function
          for (N = w32) (iteration -> i2) {
            append i2 to w47
          }
          # G2 = G.*exp(1j*2*pi*1/(2*K)*transpose(0:N-1));
          To Double Precision Complex(number=w47) -> w48
          Multiply(0+3.14159265359i, w46, 0.5+0i, w48) -> w49
          Exponential(x=w49) -> w50
          # apply in time domain
          call "fftshift.gvi"(vector_in=w50) -> (vector_out=w51)
          Multiply(w28, w51) -> w35
        }
      }
    }
  }
  case (w34) {
    frame "ZF", Default {
      call "get_gaborDual.gvi"(filter_coeff=w35, periods=w31, samples_per_period=w33) -> (dual_filter_coeff=w52)
    }
    frame "MF" {
      Complex Conjugate(x + iy=w35) -> w52
    }
  }
  Property Node(instance in=w27, "filter_coeff_tx_2"=w35, "filter_coeff_rx_2"=w52) -> (instance out=w53)
  Property Node(instance in=w53) -> ("N"=w54, "Ncp"=w55, "Nrise"=w56, "Ncs"=w57, "Nfall"=w58)
  Add(w55, w56) -> w59
  Add(w57, w58) -> w60
  # derived numbers
  Subtract(x=w54, y=w59) -> w61
  Property Node(instance in=w53, "N-(Ncp+Nrise)"=w61, "Ncs+Nfall"=w60, "Ncp+Nrise"=w59) -> (instance out=w62)
  Property Node(instance in=w62) -> ("N"=w63, "Ncp+Nrise"=w64, "Ncs+Nfall"=w65, "Nfall"=w66)
  Add(w63, w64) -> w67
  Add(w67, w65) -> w68
  Subtract(x=w68, y=w66) -> w69
  Property Node(instance in=w62, "N+Ncp+Nrise"=w67, "N+Ncp+Nrise+Ncs"=w69, "N+Ncp+Nrise+Ncs+Nfall"=w68) -> (instance out=w70)
  Property Node(instance in=w70) -> ("N+Ncp+Nrise+Ncs+Nfall"=w71, "Nov"=w72, "Nb"=w73)
  Subtract(x=w71, y=w72) -> w74
  Multiply(w74, w73) -> w75
  Add(w75, w72) -> w76
  Property Node(instance in=w70, "N+Ncp+Nrise+Ncs+Nfall-Nov"=w74, "Np"=w76) -> (instance out=w77)
  Property Node(instance in=w77) -> ("K"=w78, "Ncp+Nrise"=w79, "Ncs+Nfall"=w80, "M"=w81)
  # Mset, Kset and Nset
  # Mset cases
  # chose between symmetric spectrum
  # and left/right half occupied
  # Kset calculation
  case ($silent_subsymbols) {
    frame "1st" {
      Decrement(x=w81) -> w83
      for (N = w83) (iteration -> i3) {
        append i3 to w84
      }
      Increment(x=w84) -> w82
    }
    frame "candy" {
      Decrement(x=w81) -> w85
      for (N = w85) (iteration -> i4) {
        append i4 to w86
      }
      Increment(x=w86) -> w87
      # w88: Mcs
      Quotient And Remainder(x=w80, y=w78) -> (floor(x/y)=w88)
      Search 1D Array(1D array=w87, element=w88) -> (index of element=w89)
      # Nrise+Ncp=Mcp*K
      # Nfall+Ncs=Mcs*K
      # Mset={0..M-1}\{0,Mcs,M-Mcp}
      Delete From Array(inArray=w87, index0=w89) -> w90
      # w91: Mcp
      Quotient And Remainder(x=w79, y=w78) -> (floor(x/y)=w91)
      # w92: M-Mcp
      Subtract(x=w81, y=w91) -> w92
      Search 1D Array(1D array=w90, element=w92) -> (index of element=w93)
      Delete From Array(inArray=w90, index0=w93) -> w82
    }
    frame "1st+2nd+last" {
      Subtract(x=w81, y=3) -> w94
      for (N = w94) (iteration -> i5) {
        append i5 to w95
      }
      Add(2, w95) -> w82
    }
    frame "none", Default {
      for (N = w81) (iteration -> i6) {
        append i6 to w82
      }
    }
  }
  Property Node(instance in=w77) -> ("K"=w96)
  Quotient And Remainder(x=w96, y=2) -> (floor(x/y)=w97)
  Subtract(x=w97, y=$guard_subcarriers) -> w98
  Subtract(x=w98, y=$whitespace_subcarriers) -> w99
  for (N = w99) (iteration -> i7) {
    append i7 to w100
  }
  Add(w100, $guard_subcarriers) -> w101
  Add($whitespace_subcarriers, w97) -> w102
  Add(w100, w102) -> w103
  case ($symmetry) {
    frame "both", Default {
      Insert Into Array(inArray=w101, new=w103) -> w104
    }
    frame "left" {
      w104 = w101
    }
    frame "right" {
      w104 = w103
    }
  }
  Array Size(array=w82) -> (size(s)=w105)
  Array Size(array=w104) -> (size(s)=w106)
  Multiply(w105, w106) -> w107
  Property Node(instance in=w77) -> ("K"=w108)
  # calc Nset (subcarriers first)
  # for m=Mset
  #     for k=Kset
  #        Nset=[ Nset; m*K+k ];
  #     end
  # end
  for {
    w109 = each element of w82
    for {
      w111 = each element of w104
      Multiply(w108, w109) -> w113
      Add(w113, w111) -> w114
      append w114 to w112
    }
    append w112 to w110
  }
  Array Size(array=w110) -> (size(s)=w115)
  Multiply Array Elements(numeric array=w115) -> (product=w116)
  Reshape Array(inArray=w110, size=w116) -> w117
  Property Node(instance in=w77, "Mset"=w82, "Kset"=w104, "Kon"=w106, "Mon"=w105, "Non"=w107, "Nset"=w117) -> (instance out=w118)
  $params_out <- w118
