vi "read_txt.gvi"   [LabVIEW NXG]
inputs:
  "file path": path
  "split string (regex)": string = "\\n"
outputs:
  "float array": f64[]
  "string array": string[]
diagram:
  Read From Text File(file (use dialog)=$"file path") -> (text=w1)
  # TODO: read_txt does not work with complex numbers
  # read text file line by line and convert to float
  s1 = w1  # shift register
  while {
    Match Pattern(regular expression=$"split string (regex)", string=s1) -> (after substring=w4, before substring=w5, offset past match=w6)
    Floating Point String To Number(string=w5, use system decimal point (T)=FALSE) -> (number=w7)
    Is Less Or Equal To 0(x=w6) -> w8
    append w5 to w2
    append w7 to w3
    next s1 = w4
    stop if w8
  }
  Array Size(array=w2) -> (size(s)=w9)
  # check last element
  Decrement(x=w9) -> w10
  Array Index(array=w2) -> (out0[w10]=w11)
  Is Empty String Or Path(string/path=w11) -> w12
  # note: every empty newline produces a zero in the returned array. this does
  # check if last element is empty line and removes it from the list if so.
  case (w12) {
    frame False, Default {
      w13 = w3
      w14 = w2
    }
    frame True {
      # remove
      # if true
      Delete From Array(inArray=w3, index0=w10) -> w13
      Delete From Array(inArray=w2, index0=w10) -> w14
    }
  }
  $"float array" <- w13
  $"string array" <- w14
