vi "repeat_filter_circshift.gvi"   [LabVIEW NXG]
inputs:
  "K": i32
  "data_vector": c128[]
  "filter_coeff": c128[]
  "M": i32
  "shift_index": i32
outputs:
  "filtered_signal": c128[]
diagram:
  # TODO: replace with "build array"
  # with concatenate option
  Decrement(x=$K) -> w1
  # repeat data (K-1) times
  s1 = $data_vector  # shift register
  for (N = w1) {
    Array Size(array=s1) -> (size(s)=w2)
    Insert Into Array(inArray=s1, index0=w2, new=$data_vector) -> w3
    next s1 = w3
  }
  # multiply with
  # filter coefficients
  Multiply(s1, $filter_coeff) -> w4
  Multiply($M, $shift_index) -> w5
  # circshift modulated data
  # by shift_index*M samples
  Rotate 1D Array(array=w4, n=w5) -> (array (last n elements first)=w6)
  $filtered_signal <- w6
