vi "shuffle_iq.gvi"   [LabVIEW NXG]
inputs:
  "params": T1
  "data_vector": c128[]
outputs:
  "shuffled_data_vector": c128[]
  "shuffled_data_vector_2": c128[]
types:
  T1 = cluster{"Ncp": i32, "Nrise": i32, "Ncs": i32, "Nfall": i32, "Ncp+Nrise": i32, "Ncs+Nfall": i32, "N+Ncp+Nrise+Ncs+Nfall": i32, "N+Ncp+Nrise+Ncs": i32, "N-(Ncp+Nrise)": i32, "N+Ncp+Nrise": i32, "K": i32, "M": i32, "mu": i32, "qam_map": c128[], "N": i32, "Nov": i32, "N+Ncp+Nrise+Ncs+Nfall-Nov": i32, "Nb": i32, "Non": i32, "Mon": i32, "Kon": i32, "Nset": i32[], "Mset": i32[], "Kset": i32[], "alpha": f64, "beta": f64, "window_rise": c128[], "window_fall": c128[], "filter_coeff_tx": c128[], "filter_coeff_rx": c128[], "Np": i32, "filter_coeff_tx_2": c128[], "filter_coeff_rx_2": c128[], "rx_type": string, "filter_type": string, "OQAM": bool, "R": i32, "T": i32, "S": i32, "P": i32, "Q": i32, "P/R": i32, "Q/T": i32}
diagram:
  Property Node(instance in=$params) -> ("filter_type"=w1, "K"=w2, "M"=w3, "N"=w4)
  # exchange subcarriers and subsymbols
  # for RC-freq pulse
  case (w1) {
    frame "RC-time", Default {
      w5 = $data_vector
    }
    frame "RC-freq" {
      Reshape Array(inArray=$data_vector, size=w2, size=w3) -> w6
      Transpose 2D Array(2D array=w6) -> (transposed array=w7)
      Reshape Array(inArray=w7, size=w4) -> w5
    }
  }
  # split array into
  # odd and even elements
  Decimate Array(array=w5) -> (out0=w8, out1=w9)
  Complex To Real Imaginary(x + iy=w8) -> (x=w10, y=w11)
  Real And Imaginary To Complex(x=w10, y=0) -> w12
  Complex To Real Imaginary(x + iy=w9) -> (x=w13, y=w14)
  # shuffle the I and Q parts
  Real And Imaginary To Complex(x=0, y=w14) -> w15
  Interleave Array(w12, w15) -> w16
  Property Node(instance in=$params) -> ("filter_type"=w17, "M"=w18, "K"=w19, "N"=w20)
  # exchange subcarriers and subsymbols
  # for RC-freq pulse
  case (w17) {
    frame "RC-time", Default {
      w21 = w16
    }
    frame "RC-freq" {
      Reshape Array(inArray=w16, size=w18, size=w19) -> w22
      Transpose 2D Array(2D array=w22) -> (transposed array=w23)
      Reshape Array(inArray=w23, size=w20) -> w21
    }
  }
  $shuffled_data_vector <- w21
  Real And Imaginary To Complex(x=0, y=w11) -> w24
  Real And Imaginary To Complex(x=w13, y=0) -> w25
  Interleave Array(w24, w25) -> w26
  # exchange subcarriers and subsymbols
  # for RC-freq pulse
  case (w17) {
    frame "RC-time", Default {
      w27 = w26
    }
    frame "RC-freq" {
      Reshape Array(inArray=w26, size=w18, size=w19) -> w28
      Transpose 2D Array(2D array=w28) -> (transposed array=w29)
      Reshape Array(inArray=w29, size=w20) -> w27
    }
  }
  $shuffled_data_vector_2 <- w27
