vi "unshuffle_iq.gvi"   [LabVIEW NXG]
inputs:
  "params": T1
  "shuffled_data_vector": c128[]
  "shuffled_data_vector_2": c128[]
outputs:
  "restored_data_vector": c128[]
types:
  T1 = cluster{"Ncp": i32, "Nrise": i32, "Ncs": i32, "Nfall": i32, "Ncp+Nrise": i32, "Ncs+Nfall": i32, "N+Ncp+Nrise+Ncs+Nfall": i32, "N+Ncp+Nrise+Ncs": i32, "N-(Ncp+Nrise)": i32, "N+Ncp+Nrise": i32, "K": i32, "M": i32, "mu": i32, "qam_map": c128[], "N": i32, "Nov": i32, "N+Ncp+Nrise+Ncs+Nfall-Nov": i32, "Nb": i32, "Non": i32, "Mon": i32, "Kon": i32, "Nset": i32[], "Mset": i32[], "Kset": i32[], "alpha": f64, "beta": f64, "window_rise": c128[], "window_fall": c128[], "filter_coeff_tx": c128[], "filter_coeff_rx": c128[], "Np": i32, "filter_coeff_tx_2": c128[], "filter_coeff_rx_2": c128[], "rx_type": string, "filter_type": string, "OQAM": bool, "R": i32, "T": i32, "S": i32, "P": i32, "Q": i32, "P/R": i32, "Q/T": i32}
diagram:
  Property Node(instance in=$params) -> ("filter_type"=w1, "K"=w2, "M"=w3, "N"=w4)
  case (w1) {
    frame "RC-time", Default {
      w5 = $shuffled_data_vector
    }
    frame "RC-freq" {
      Reshape Array(inArray=$shuffled_data_vector, size=w2, size=w3) -> w6
      Transpose 2D Array(2D array=w6) -> (transposed array=w7)
      Reshape Array(inArray=w7, size=w4) -> w5
    }
  }
  Decimate Array(array=w5) -> (out0=w8, out1=w9)
  Complex To Real Imaginary(x + iy=w8) -> (x=w10)
  # exchange subcarriers and subsymbols
  # for RC-freq pulse
  case (w1) {
    frame "RC-time", Default {
      w11 = $shuffled_data_vector_2
    }
    frame "RC-freq" {
      Reshape Array(inArray=$shuffled_data_vector_2, size=w2, size=w3) -> w12
      Transpose 2D Array(2D array=w12) -> (transposed array=w13)
      Reshape Array(inArray=w13, size=w4) -> w11
    }
  }
  Decimate Array(array=w11) -> (out0=w14, out1=w15)
  Complex To Real Imaginary(x + iy=w14) -> (y=w16)
  Real And Imaginary To Complex(x=w10, y=w16) -> w17
  Complex To Real Imaginary(x + iy=w9) -> (y=w18)
  # recombine I and Q parts
  Complex To Real Imaginary(x + iy=w15) -> (x=w19)
  Real And Imaginary To Complex(x=w19, y=w18) -> w20
  Interleave Array(w17, w20) -> w21
  Property Node(instance in=$params) -> ("filter_type"=w22, "M"=w23, "K"=w24, "N"=w25)
  # exchange subcarriers and subsymbols
  # for RC-freq pulse
  case (w22) {
    frame "RC-time", Default {
      w26 = w21
    }
    frame "RC-freq" {
      Reshape Array(inArray=w21, size=w23, size=w24) -> w27
      Transpose 2D Array(2D array=w27) -> (transposed array=w28)
      Reshape Array(inArray=w28, size=w25) -> w26
    }
  }
  $restored_data_vector <- w26
