vi "get_value_as_complex_double_array.gvi"   [LabVIEW NXG]
inputs:
  "array in": string[]
  "search string": string
  "delimiter": string = ";"
  "error in": error
outputs:
  "Array": c128[]
  "array out": string[]
  "Error out": error
diagram:
  call "get_value_as_string_array.gvi"(array in=$"array in", search string=$"search string", delimiter=$delimiter, error in=$"error in") -> (array=w1, array out=w2, Error out=w3)
  $"array out" <- w2
  case (w3) {
    frame No Error, Default {
      s1 = w3  # shift register
      for {
        w6 = each element of w1
        call "string_to_complex_double.gvi"(string in=w6, error in=s1) -> (number out=w7, error out=w8)
        append w7 to w5
        next s1 = w8
      }
      w4 = s1
    }
    frame Error {
      w4 = w3
      w5 = f64[] []
    }
  }
  $"Error out" <- w4
  $Array <- w5
