vi "get_value_as_string.gvi"   [LabVIEW NXG]
inputs:
  "array in": string[]
  "search string": string
  "error in": error
outputs:
  "string": string
  "array out": string[]
  "error out": error
diagram:
  $"array out" <- $"array in"
  Array Size(array=$"array in") -> (size(s)=w1)
  Is Greater Than 0(x=w1) -> w2
  case (w2) {
    frame False, Default {
      Merge Errors($"error in", error {"status"=TRUE, "code"=0, "source"="Array empty!"}) -> (error out=w4)
      w3 = EmptyString
    }
    frame True {
      Decimate Array(array=$"array in") -> (out0=w5, out1=w6)
      Search 1D Array(1D array=w5, element=$"search string") -> (index of element=w7)
      Is Greater Or Equal To 0(x=w7) -> w8
      case (w8) {
        frame False, Default {
          Merge Errors($"error in", error {"status"=TRUE, "code"=0, "source"="Value not found!"}) -> (error out=w4)
          w3 = EmptyString
        }
        frame True {
          Array Index(array=w6) -> (out0[w7]=w3)
          w4 = $"error in"
        }
      }
    }
  }
  $string <- w3
  $"error out" <- w4
