vi "get_value_as_complex_double.gvi"   [LabVIEW NXG]
inputs:
  "array in": string[]
  "search string": string
  "error in": error
outputs:
  "number": c128
  "array out": string[]
  "error out": error
diagram:
  call "get_value_as_string.gvi"(array in=$"array in", search string=$"search string", error in=$"error in") -> (string=w1, array out=w2, error out=w3)
  $"array out" <- w2
  call "string_to_complex_double.gvi"(string in=w1, error in=w3) -> (number out=w4, error out=w5)
  $number <- w4
  $"error out" <- w5
