vi "get_value_as_double.gvi"   [LabVIEW Communications System Design Suite 2.0.1]
inputs:
  "array in": string[]
  "search string": string
  "error in": error
outputs:
  "number": f64
  "array out": string[]
  "error out": error
diagram:
  call "get_value_as_string.gvi"(array in=$"array in", search string=$"search string", error in=$"error in") -> (string=w1, array out=w2, error out=w3)
  $"array out" <- w2
  call "string_to_double.gvi"(string=w1, error in=w3) -> (number=w4, error out=w5)
  $number <- w4
  $"error out" <- w5
