vi "get_value_as_string_array.gvi"   [LabVIEW NXG]
inputs:
  "array in": string[]
  "search string": string
  "delimiter": string = ";"
  "error in": error
outputs:
  "array": string[]
  "array out": string[]
  "Error out": error
diagram:
  call "get_value_as_string.gvi"(array in=$"array in", search string=$"search string", error in=$"error in") -> (string=w1, array out=w2, error out=w3)
  $"array out" <- w2
  case (w3) {
    frame Error {
      w4 = string[] []
      w5 = w3
    }
    frame No Error {
      Spreadsheet String To Array(array type (2D Dbl)=string[] [], delimiter (Tab)=$delimiter, format string="%s", spreadsheet string=w1) -> (array=w4)
      w5 = w3
    }
  }
  $array <- w4
  $"Error out" <- w5
