vi "read_file_to_array.gvi"   [LabVIEW NXG]
inputs:
  "filename": path
  "error in": error
outputs:
  "array": string[]
  "error out": error
diagram:
  Is Empty String Or Path(string/path=$filename) -> w1
  case (w1) {
    frame False, Default {
      w2 = $"error in"
      w3 = $filename
    }
    frame True {
      w4 = error {"status"=TRUE, "code"=0, "source"="No File selected!"}
      Merge Errors($"error in", w4) -> (error out=w5)
      Get Current Module() -> (Path=w6)
      File Dialog[FileDialogSelectionMode=File, NewOrExistingMode=New](error in=$"error in", prompt="Choose a File", start path=w6) -> (cancelled=w7, exists=w8, selected path=w3)
      Not(x=w8) -> w9
      Logical Or(w9, w7) -> w10
      Select(s=w10, t=w5, f=$"error in") -> w2
    }
  }
  case (w2) {
    frame No Error, Default {
      Read From Text File(error in=w2, file (use dialog)=w3) -> (error out=w12, text=w13)
      # Read text line by line
      s1 = w13  # shift register
      s2 = string[] []  # shift register
      while {
        Match Pattern(regular expression="[\\n]", string=s1) -> (after substring=w14, before substring=w15, offset past match=w16)
        # Search for
        # delimiter
        Is Less Or Equal To 0(x=w16) -> w17
        Match Pattern(regular expression="=", string=w15) -> (after substring=w18, before substring=w19, offset past match=w20)
        call "trim.gvi"(input=w19) -> (output=w21)
        # value
        call "trim.gvi"(input=w18) -> (output=w22)
        Is Less Than 0(x=w20) -> w23
        # Search for
        # comment
        Match Pattern(regular expression="#", string=w15) -> (offset past match=w24)
        # Skip line?
        Is Less Than 0(x=w24) -> w25
        Not(x=w25) -> w26
        Logical Or(w23, w26) -> w27
        # variable
        case (w27) {
          frame False, Default {
            Insert Into Array(inArray=s2, new=w21) -> w29
            Insert Into Array(inArray=w29, new=w22) -> w28
          }
          frame True {
            w28 = s2
          }
        }
        next s1 = w14
        next s2 = w28
        stop if w17
      }
      w11 = s2
    }
    frame Error {
      w11 = string[] []
      w12 = w2
    }
  }
  $array <- w11
  $"error out" <- w12
