vi "reader_test.gvi"   [LabVIEW NXG]
panel controls:
  "filename": path = path "U:\\NI\\CSDS Projects\\gfdm_transceiver_desktop\\reader\\test.ini"
  "search string": string = "wert"
  "search number string": string = "value"
  "search complex number string": string = "complex"
  "search array string": string = "string_array"
  "search double array string": string = "array"
  "search complex double array string": string = "complex_array"
panel indicators:
  "string": string
  "number": f64
  "complex": c128
  "String array": string[]
  "double array": f64[]
  "complex double array": c128[]
diagram:
  call "read_file_to_array.gvi"(filename=$filename) -> (array=w1, error out=w2)
  call "get_value_as_string.gvi"(array in=w1, search string=$"search string", error in=w2) -> (string=w3, array out=w4, error out=w5)
  call "get_value_as_double.gvi"(array in=w4, search string=$"search number string", error in=w5) -> (number=w6, array out=w7, error out=w8)
  $number <- w6
  call "get_value_as_complex_double.gvi"(array in=w7, search string=$"search complex number string", error in=w8) -> (number=w9, array out=w10, error out=w11)
  $complex <- w9
  call "get_value_as_string_array.gvi"(array in=w10, search string=$"search array string", error in=w11) -> (array=w12, array out=w13, Error out=w14)
  $"String array" <- w12
  $string <- w3
  call "get_value_as_double_array.gvi"(array in=w13, search string=$"search double array string", error in=w14) -> (Array=w15, array out=w16, Error out=w17)
  $"double array" <- w15
  call "get_value_as_complex_double_array.gvi"(array in=w16, search string=$"search complex double array string", error in=w17) -> (Array=w18)
  $"complex double array" <- w18
