vi "string_to_complex_double.gvi"   [LabVIEW NXG]
inputs:
  "string in": string
  "error in": error
outputs:
  "number out": c128
  "error out": error
diagram:
  case ($"error in") {
    frame Error {
      w1 = 0+0i
      w2 = $"error in"
    }
    frame No Error {
      To Lower Case(string=$"string in") -> w3
      Match Pattern(regular expression="+", string=w3) -> (after substring=w4, before substring=w5, offset past match=w6)
      Floating Point String To Number(string=w5, use system decimal point (T)=FALSE) -> (number=w7)
      Is Greater Or Equal To 0(x=w6) -> w8
      case (w8) {
        frame False, Default {
          w9 = "0"
        }
        frame True {
          Search And Replace String(input string=w4, search string="i") -> (result string=w10)
          Search And Replace String(input string=w10, search string="j") -> (result string=w11)
          Search And Replace String(input string=w11, search string="*") -> (result string=w9)
        }
      }
      Floating Point String To Number(string=w9) -> (number=w12)
      Real And Imaginary To Complex(x=w7, y=w12) -> w1
      w2 = $"error in"
    }
  }
  $"number out" <- w1
  $"error out" <- w2
