vi "Apply Channel.gvi"   [LabVIEW NXG]
inputs:
  "Time domain signal (SISO)": c128[]
  "ChanGains": c128[]
  "SNR (dB)": f64
outputs:
  "Rx signal": c128[]
diagram:
  Complex To Real Imaginary(x + iy=$"Time domain signal (SISO)") -> (x=w1, y=w2)
  Complex To Real Imaginary(x + iy=$ChanGains) -> (x=w3, y=w4)
  call "FIR Filter (DBL).gvi"(x=w1, FIR coefficients=w4) -> (filtered x=w5)
  call "FIR Filter (DBL).gvi"(x=w2, FIR coefficients=w3) -> (filtered x=w6)
  Add(w5, w6) -> w7
  call "FIR Filter (DBL).gvi"(x=w1, FIR coefficients=w3) -> (filtered x=w8)
  call "FIR Filter (DBL).gvi"(x=w2, FIR coefficients=w4) -> (filtered x=w9)
  Subtract(x=w8, y=w9) -> w10
  Real And Imaginary To Complex(x=w10, y=w7) -> w11
  for {
    w12 = each element of w11
    # AWGN
    Math Node("Signal_in"=w12, "snr"=$"SNR (dB)") -> ("Signal_out"=w14)
    ~~~
    w = complex(randn(1),randn(1))/sqrt(2);
    std_dev = sqrt(10^(-0.1*snr));
    Signal_out = Signal_in + std_dev*w;
    ~~~
    append w14 to w13
  }
  $"Rx signal" <- w13
