vi "CP+CS.gvi"   [LabVIEW Communications System Design Suite 2.0.1]
inputs:
  "data in": c128[]
  "Ncp": i32
  "N-Ncp": i32
  "Ncs": i32
outputs:
  "data out": c128[]
diagram:
  Array Size(array=$"data in") -> (size(s)=w1)
  Subtract(x=w1, y=$Ncp) -> w2
  Array Subset(array=$"data in", index0=w2, length0=$Ncp) -> w3
  Array Subset(array=$"data in", index0=0, length0=$Ncs) -> w4
  Build Array[ConcatenateInputs=True](w3, $"data in", w4) -> w5
  $"data out" <- w5
