vi "Channel.gvi"   [LabVIEW NXG]
inputs:
  "x1": c128[]
  "x2": c128[]
  "SNR": f64
outputs:
  "y1": c128[]
  "y2": c128[]
diagram:
  # T: Uniform
  # F: Exponential
  call "Create PDP.gvi"(Number ofPaths=16, Power distribution=FALSE, Max gain=0, Min gain=-20) -> (PDP_out=w1, Number of Paths=w2)
  call "MIMO Channel.gvi"(PDP=w1, Number of Paths=w2, MIMO config=cluster{"nT": i32, "nR": i32} {"nT"=2, "nR"=2}) -> (MimoChanGains=w3)
  # H11
  for {
    w4 = each element of w3
    Array Index(array=w4) -> (out0[0]=w6)
    append w6 to w5
  }
  call "Apply Channel.gvi"(Time domain signal (SISO)=$x1, ChanGains=w5, SNR (dB)=$SNR) -> (Rx signal=w7)
  # H21
  for {
    w8 = each element of w3
    Array Index(array=w8) -> (out0[1]=w10)
    append w10 to w9
  }
  call "Apply Channel.gvi"(Time domain signal (SISO)=$x2, ChanGains=w9, SNR (dB)=$SNR) -> (Rx signal=w11)
  Add(w7, w11) -> w12
  # H12
  for {
    w13 = each element of w3
    Array Index(array=w13) -> (out0[2]=w15)
    append w15 to w14
  }
  call "Apply Channel.gvi"(Time domain signal (SISO)=$x1, ChanGains=w14, SNR (dB)=$SNR) -> (Rx signal=w16)
  # H22
  for {
    w17 = each element of w3
    Array Index(array=w17) -> (out0[3]=w19)
    append w19 to w18
  }
  call "Apply Channel.gvi"(Time domain signal (SISO)=$x2, ChanGains=w18, SNR (dB)=$SNR) -> (Rx signal=w20)
  Add(w16, w20) -> w21
  # Synchronization Error
  call "SyncError.gvi"(xch2=w21, STO=-5, xch1=w12, CFO=0.5) -> (y1=w22, y2=w23)
  case (TRUE) {
    frame False, Default {
      w24 = w12
      w25 = w21
    }
    frame True {
      w24 = w22
      w25 = w23
    }
  }
  $y1 <- w24
  $y2 <- w25
