vi "Coding Test with Modem.gvi"   [LabVIEW Communications System Design Suite 2.0.1]
panel controls:
  "coding parameter in": T1 = {"rate"="1/2", "bits per symbol"=1, "symbol map"=[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], "total bits"=128, "PN sequence order"=9, "seed in"=-692093454, "constraint length"=3, "initial state"=0, "Bits"=[]}
  "Tab": i32
  "loop count": i32 = 3
  "GFDM in": "GFDM parameter.gtype" = {"Variable: K"=8, "Variable: M"=3, "Variable: a"=0.5, "filter type"="rc", "receive filter"="MF", "inverse FFT"=FALSE, "Variable: b"=0.5, "Ncs"=0, "Ncp"=0}
  "Norm filters": bool
panel indicators:
  "BER": f64
  "number of correct bits": u64
  "Filter": f64[][]
  "signal": f64[][]
  "IQ": c128[][]
  "iq symbols": c128[]
  "modulation error ratio, db": f64
  "phase error": T2
  "magnitude error": T3
  "evm": T3
  "coding parameters out": T1
types:
  T1 = cluster{"rate": enum{"1/2", "1/3", "1/4", "2/3", "3/4"}, "bits per symbol": u8, "symbol map": c128[], "total bits": i32, "PN sequence order": i32, "seed in": i32, "constraint length": i32, "initial state": u32, "Bits": i8[]}
  T2 = cluster{"RMS Measurement, deg": f64, "Peak Measurement, deg": f64, "Peak Symbol Index": i32, "Individual Symbol Measurements, deg": f64[]}
  T3 = cluster{"RMS Measurement, %": f64, "Peak Measurement, %": f64, "Peak Symbol Index": i32, "Individual Symbol Measurements, %": f64[]}
  "GFDM parameter.gtype" = cluster{"Variable: K": i32, "Variable: M": i32, "Variable: a": f64, "filter type": enum{"rc", "rect"}, "receive filter": enum{"MF", "ZF"}, "inverse FFT": bool, "Variable: b": f64, "Ncs": u16, "Ncp": u16}
diagram:
  w1 = $"loop count"
  call "number_of_symbols.gvi"(coding parameter in=$"coding parameter in", GFDM in=$"GFDM in", loop count=w1) -> (coding parameter out=w2, GFDM out=w3)
  call "generate pulse shape.gvi"(GFDM parameter=w3, Norm filters=$"Norm filters") -> (pulse shaping filter g=w4, receiver filter gamma=w5, GFDM parameter out=w6)
  Build Array(w5, w4) -> w7
  Absolute Value(x=w7) -> w8
  $Filter <- w8
  call "Encoding.gvi"(coding parameter in=w2) -> (coding parameters out=w9, complex symbols=w10)
  s1 = c128[] []  # shift register
  for (N = w1) (iteration -> i1) {
    Array Size(array=w4) -> (size(s)=w12)
    # fetch n chunks of
    # data
    Multiply(w12, i1) -> w13
    Array Subset(array=w10, index0=w13, length0=w12) -> w14
    call "time-domain modulator.gvi"(GFDM parameter=w6, pulse shaping filter g=w4, data as a vector d=w14) -> (time signal x=w15, GFDM parameter out=w16)
    call "time-domain demodulator.gvi"(GFDM parameter in=w16, receive filter gamma=w5, received signal y=w15) -> (iq symbols=w17)
    Insert Into Array(inArray=s1, new=w17) -> w18
    append w15 to w11
    next s1 = w18
  }
  Absolute Value(x=w11) -> w19
  $signal <- w19
  $"iq symbols" <- s1
  Build Array(w10, s1) -> w20
  $IQ <- w20
  call "Decoding.gvi"(coding parameter in=w9, symbols in=s1, original signal=w10) -> (number of correct bits=w21, coding parameters out=w22, BER=w23, modulation error ratio, db=w24, phase error=w25, magnitude error=w26, evm=w27)
  $"coding parameters out" <- w22
  $BER <- w23
  $"number of correct bits" <- w21
  $"modulation error ratio, db" <- w24
  $"phase error" <- w25
  $"magnitude error" <- w26
  $evm <- w27
