vi "CodingTest.gvi"   [LabVIEW Communications System Design Suite 2.0.1]
panel controls:
  "GFDM parameter in": "GFDM parameter.gtype" = {"Variable: K"=8, "Variable: M"=3, "filter type"="rc", "receive filter"="MF"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}
  "bits per symbol": u8 = 1
panel indicators:
  "output bit stream": i8[]
  "source bit stream": i8[]
  "equal": bool
  "coded bit stream": i8[]
  "Unterschied": i32[]
types:
  "GFDM parameter.gtype" = cluster{"Variable: K": i32, "Variable: M": i32, "Variable: a": f64, "filter type": enum{"rc", "rect"}, "receive filter": enum{"MF", "ZF"}, "inverse FFT": bool, "Variable: b": f64, "Ncs": u16, "Ncp": u16}
diagram:
  w1 = $"bits per symbol"
  w2 = $"GFDM parameter in"
  call "create symbol map.gvi"(bits per symbol=w1) -> (symbol map=w3)
  for (N = 15) {
    call "Create coded bits.gvi"(GFDM parameter in=w2, symbol map=w3, bits per symbol=w1) -> (coded bit stream=w9, source bit stream=w10)
    call "Decoder.gvi"(received bit stream=w9, transmitted bit stream in=w10) -> (decoded bit stream=w11, transmitted bit stream out=w12)
    Is Equal[ComparisonMode=CompareAggregates](x=w11, y=w12) -> w13
    Array Size(array=w12) -> (size(s)=w14)
    Array Size(array=w11) -> (size(s)=w15)
    Subtract(x=w14, y=w15) -> w16
    append w13 to w4
    append w16 to w5
    concatenate w9 onto w6
    concatenate w12 onto w7
    concatenate w11 onto w8
  }
  $"coded bit stream" <- w6
  $"output bit stream" <- w8
  And Array Elements(Boolean array=w4) -> (logical AND=w17)
  $equal <- w17
  $"source bit stream" <- w7
  $Unterschied <- w5
