vi "ConvolutionalEncoder.gvi"   [LabVIEW Platform Developer Preview 0.1.0]
inputs:
  "dataIn": bool
outputs:
  "encodedSymbolOut": UFXP(2.0)
diagram:
  Feedback Node(initial value=FALSE, input=w1) -> w2
  Feedback Node(initial value=FALSE, input=w2) -> w3
  Logical Exclusive Or(w2, w3) -> w4
  Feedback Node(initial value=FALSE, input=w5) -> w6
  Feedback Node(initial value=FALSE, input=w6) -> w7
  Logical Exclusive Or(w6, w7) -> w8
  Logical Exclusive Or(w4, w8) -> w9
  Logical Exclusive Or($dataIn, w9) -> w10
  Logical Exclusive Or(w3, w2) -> w11
  Feedback Node(initial value=FALSE, input=$dataIn) -> w1
  # Convolution code with length 7, rate 1/2, and generator vectors {A, B} = {133, 171} octal
  Logical Exclusive Or(w1, $dataIn) -> w12
  Logical Exclusive Or(w11, w12) -> w13
  Logical Exclusive Or(w7, w13) -> w14
  Build Array(w10, w14) -> w15
  Boolean Array To Number(Boolean array=w15) -> (number=w16: UFXP(2.0))
  $encodedSymbolOut <- w16
  Feedback Node(initial value=FALSE, input=w3) -> w5
