vi "Create PDP.gvi"   [LabVIEW NXG]
inputs:
  "Number ofPaths": i32
  "Power distribution": bool
  "Max gain": f64
  "Min gain": f64
outputs:
  "PDP_out": f64[]
  "Number of Paths": i32
panel indicators:
  "Graph": f64[]
diagram:
  $"Number of Paths" <- $"Number ofPaths"
  call "linspace.gvi"(Number of Paths=$"Number ofPaths", Max gain=$"Max gain", Min gain=$"Min gain") -> (Path Gains=w1)
  Initialize Array(element=0, size=$"Number ofPaths") -> w2
  Select(s=$"Power distribution", t=w2, f=w1) -> w3
  for {
    w4 = each element of w3
    Divide(x=w4, y=10) -> w6
    append w6 to w5
  }
  for {
    w7 = each element of w5
    Power Of 10(x=w7) -> w9
    append w9 to w8
  }
  call "Real Vector Norm.gvi"(input vector=w8, norm type=2) -> (norm=w10)
  for {
    w11 = each element of w8
    Divide(x=w11, y=w10) -> w13
    append w13 to w12
  }
  $Graph <- w12
  $PDP_out <- w12
