vi "Decoder.gvi"   [LabVIEW Communications System Design Suite 2.0.1]
inputs:
  "received bit stream": i8[]
  "transmitted bit stream in": i8[]
outputs:
  "decoded bit stream": i8[]
  "transmitted bit stream out": i8[]
  "equal": bool
diagram:
  Array Size(array=$"transmitted bit stream in") -> (size(s)=w1)
  Subtract(x=w1, y=5) -> w2
  Multiply(2, 15) -> w3
  Increment(x=w3) -> w4
  Initialize Array(element=0, size=w4) -> w5
  Build Array[ConcatenateInputs=True]($"received bit stream", w5) -> w6
  call "MT Convolutional Decoder (Viterbi Hard Decision, Rate).gvi"(input bit stream=w6, rate="1/2", constraint length=3, initial state=0, traceback depth=15, reset?=TRUE) -> (output bit stream=w7)
  Array Subset(array=w7, length0=w2) -> w8
  $"decoded bit stream" <- w8
  Array Size(array=w8) -> (size(s)=w9)
  Is Not Equal To 0(x=w9) -> w10
  Array Subset(array=$"transmitted bit stream in", length0=w2) -> w11
  Is Equal[ComparisonMode=CompareAggregates](x=w8, y=w11) -> w12
  Logical And(w10, w12) -> w13
  $equal <- w13
  $"transmitted bit stream out" <- w11
