vi "Decoding.gvi"   [LabVIEW NXG]
inputs:
  "coding parameter in": T1 = {"rate"="1/2", "bits per symbol"=1, "symbol map"=[0.707106781187+0.707106781187i, 0.612825877028+0.707106781187i, 0.424264068712+0.707106781187i, 0.51854497287+0.707106781187i, 0.0471404520791+0.707106781187i, 0.141421356237+0.707106781187i, 0.329983164554+0.707106781187i, 0.235702260396+0.707106781187i, -0.707106781187+0.707106781187i, -0.612825877028+0.707106781187i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], "total bits"=128, "PN sequence order"=9, "seed in"=-692093454, "constraint length"=3, "initial state"=0, "Bits"=[]}
  "symbols in": c128[]
  "error in": error
  "original signal": c128[]
outputs:
  "number of correct bits": i16
  "coding parameters out": T1
  "error out": error
  "BER": f64
  "modulation error ratio, db": f64
  "phase error": T3
  "magnitude error": T2
  "evm": T2
panel indicators:
  "IQ Symbols": c128[][]
types:
  T1 = cluster{"rate": enum{"1/2", "1/3", "1/4", "2/3", "3/4"}, "bits per symbol": u8, "symbol map": c128[], "total bits": i32, "PN sequence order": i32, "seed in": i32, "constraint length": i32, "initial state": u32, "Bits": i8[]}
  T2 = cluster{"RMS Measurement, %": f64, "Peak Measurement, %": f64, "Peak Symbol Index": i32, "Individual Symbol Measurements, %": f64[]}
  T3 = cluster{"RMS Measurement, deg": f64, "Peak Measurement, deg": f64, "Peak Symbol Index": i32, "Individual Symbol Measurements, deg": f64[]}
diagram:
  Property Node(instance in=$"coding parameter in") -> (instance out=w1, "constraint length"=w2, "rate"=w3, "initial state"=w4, "symbol map"=w5, "Bits"=w6)
  $"coding parameters out" <- w1
  call "mod_QAM Demod Symbol Demap.gvi"(symbols in=$"symbols in", error in=$"error in", symbol map=w5) -> (bits out=w7, error out=w8)
  call "MT Convolutional Decoder (Viterbi Hard Decision, Rate).gvi"(input bit stream=w7, rate=w3, constraint length=w2, initial state=w4, error in=w8) -> (output bit stream=w9, error out=w10)
  call "BER.gvi"(Output=w9, Input=w6) -> (number of bits correct=w11, BER=w12)
  $BER <- w12
  $"number of correct bits" <- w11
  call "mod_Measure EVM, Phase, Magnitude Error, MER.gvi"(recovered signal=$"symbols in", error in=w10, detected signal=$"original signal") -> (evm=w13, phase error=w14, modulation error ratio, db=w15, magnitude error=w16, error out=w17)
  $evm <- w13
  $"phase error" <- w14
  $"modulation error ratio, db" <- w15
  Build Array($"symbols in", w5) -> w18
  $"IQ Symbols" <- w18
  $"magnitude error" <- w16
  $"error out" <- w17
