vi "Encoding.gvi"   [LabVIEW Communications System Design Suite 2.0.1]
inputs:
  "coding parameter in": T1 = {"rate"="1/2", "bits per symbol"=1, "symbol map"=[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], "total bits"=128, "PN sequence order"=9, "seed in"=-692093454, "constraint length"=3, "initial state"=0, "Bits"=[]}
  "error in": error
outputs:
  "coding parameters out": T1
  "complex symbols": c128[]
  "error out": error
panel indicators:
  "IQ Symbols": c128[]
types:
  T1 = cluster{"rate": enum{"1/2", "1/3", "1/4", "2/3", "3/4"}, "bits per symbol": u8, "symbol map": c128[], "total bits": i32, "PN sequence order": i32, "seed in": i32, "constraint length": i32, "initial state": u32, "Bits": i8[]}
diagram:
  Property Node(instance in=$"coding parameter in") -> ("rate"=w1, "bits per symbol"=w2, "total bits"=w3, "PN sequence order"=w4, "seed in"=w5, "constraint length"=w6, "initial state"=w7, instance out=w8)
  call "MT Generate Bits (Galois, PN Order).gvi"(total bits=w3, PN sequence order=w4, seed in=w5, error in=$"error in") -> (output bit stream=w9, error out=w10)
  call "create symbol map.gvi"(bits per symbol=w2) -> (symbol map=w11)
  Property Node(instance in=w8, "symbol map"=w11, "Bits"=w9) -> (instance out=w12)
  $"coding parameters out" <- w12
  call "MT Convolutional Encoder (Rate).gvi"(input bit stream=w9, rate=w1, constraint length=w6, initial state=w7, error in=w10) -> (output bit stream=w13, error out=w14)
  call "mod_QAM Modulator Map Symbols.gvi"(input bit stream=w13, error in=w14, symbol map=w11) -> (symbols=w15, error out=w16)
  $"complex symbols" <- w15
  $"IQ Symbols" <- w15
  $"error out" <- w16
