vi "K-Point fourier transform.gvi"   [LabVIEW Communications System Design Suite 2.0.1]
inputs:
  "data in": c128[]
  "M": i32
  "Inverse FFT": bool
  "K": i32
outputs:
  "result": c128[]
uses:
  NI::Analysis::Transforms::Inverse Complex FFT.gvi
  NI::Analysis::Transforms::Complex FFT.gvi
diagram:
  for (N = $M) (iteration -> i1) {
    Multiply(i1, $K) -> w2
    # perform K-FFT M times
    Array Subset(array=$"data in", index0=w2, length0=$K) -> w3
    case ($"Inverse FFT") {
      frame True {
        call "Inverse Complex FFT.gvi"(FFT{x}=w3) -> (x=w5)
        Multiply(w5, $K) -> w4
      }
      frame False {
        call "Complex FFT.gvi"(x=w3, FFT size=$K) -> (FFT{x}=w4)
      }
    }
    concatenate w4 onto w1
  }
  $result <- w1
