vi "MIMO Channel.gvi"   [LabVIEW NXG]
inputs:
  "PDP": f64[]
  "Number of Paths": i32
  "MIMO config": cluster{"nT": i32, "nR": i32}
outputs:
  "MimoChanGains": c128[][]
panel indicators:
  "ChanGains": c128[][]
  "ChanGains_2": c128[]
diagram:
  for (N = 0) {
    w1 = each element of $PDP
    call "Gaussian White Noise.gvi"(samples=1, standard deviation=1, initialize?=TRUE) -> (gaussian noise pattern=w3)
    call "Gaussian White Noise.gvi"(samples=1, standard deviation=1, initialize?=TRUE) -> (gaussian noise pattern=w4)
    Real And Imaginary To Complex(x=w3, y=w4) -> w5
    Array Index(array=w5) -> (out0[0]=w6)
    Multiply(w1, w6) -> w7
    append w7 to w2
  }
  $ChanGains_2 <- w2
  Property Node(instance in=$"MIMO config") -> ("nT"=w8, "nR"=w9)
  Multiply(w8, w9) -> w10
  Initialize Array(element=0+0i, size=$"Number of Paths", size=w10) -> w11
  for (N = $"Number of Paths") {
    w12 = each element of $PDP
    w13 = each element of w11
    for (N = w10) {
      Math Node("PDP_in"=w12) -> ("tap_gain"=w17)
      ~~~
      tap_gain = PDP_in * complex(randn(1),randn(1))/sqrt(2);
      ~~~
      append w17 to w16
    }
    Insert Into Array(inArray=w13, index0=0, new=w16) -> w18
    append w16 to w14
    append w18 to w15
  }
  $ChanGains <- w14
  $MimoChanGains <- w15
