vi "QAM to bits.gvi"   [LabVIEW Communications System Design Suite 2.0.1]
inputs:
  "symbol map": c128[]
  "symbols in": c128[]
outputs:
  "byte out": u8[]
  "bits out": i8[]
diagram:
  call "mod_QAM Demod Symbol Demap.gvi"(symbols in=$"symbols in", symbol map=$"symbol map") -> (bits out=w1)
  $"bits out" <- w1
  call "MT Pack Bits.gvi"(input bit stream=w1, bits per integer=8) -> (output integers=w2)
  for {
    w3 = each element of w2
    To Unsigned Byte Integer(number=w3) -> w5
    append w5 to w4
  }
  $"byte out" <- w4
