vi "SyncError.gvi"   [LabVIEW NXG]
inputs:
  "xch2": c128[]
  "STO": i32
  "xch1": c128[]
  "CFO": f64
outputs:
  "y1": c128[]
  "y2": c128[]
diagram:
  Math Node("signal_in"=$xch1, "STO"=$STO, "CFO"=$CFO) -> ("signal_out"=w1)
  ~~~
  if STO >= 0
      signal_sto = [signal_in(STO+1:end).'; zeros(STO,1)];
  else
      signal_sto = [zeros(-STO,1); signal_in(1:end+STO-1).'];
  end
  b_length = length(signal_sto).';
  nn = (0:b_length-1)';
  signal_out = signal_sto.*exp(2i*pi*CFO*nn/b_length);
  ~~~
  $y1 <- w1
  Math Node("signal_in"=$xch2, "STO"=$STO, "CFO"=$CFO) -> ("signal_out"=w2)
  ~~~
  if STO >= 0
      signal_sto = [signal_in(STO+1:end).'; zeros(STO,1)];
  else
      signal_sto = [zeros(-STO,1); signal_in(1:end+STO-1).'];
  end
  b_length = length(signal_sto).';
  nn = (0:b_length-1)';
  signal_out = signal_sto.*exp(2i*pi*CFO*nn/b_length);
  ~~~
  $y2 <- w2
