vi "TX reference.gvi"   [LabVIEW Communications System Design Suite 2.0.1]
inputs:
  "data as a vector d": CFXP(2.14)[]
  "GFDM all parameters": "GFDM all parameters.gtype"
outputs:
  "GFDM frame": c128[]
  "GFDM + CPCS": c128[]
  "GFDM block": c128[]
types:
  "GFDM parameter.gtype" = cluster{"Variable: K": i32, "Variable: M": i32, "Variable: a": f64, "filter type": enum{"rc", "rect"}, "receive filter": enum{"MF", "ZF"}, "inverse FFT": bool, "Variable: b": f64, "Ncs": u16, "Ncp": u16}
  T1 = cluster{"Preamble mu": u16, "GFDM B": u16, "Preamble K": u16, "Preamble Ncp": u16, "GFDM Ncp": u16, "GFDM M": u16, "Preamble Ncs": u16, "GFDM K": u16, "GFDM Ncs": u16, "Preamble M": u16}
  "modem_configuration.gtype" = cluster{"K-1": u16, "M-1": u8, "N-1": u16, "N": u16, "Npreamble+CP+CS": u16, "Npreamble": u16, "Nw": u16, "Modulator MUX config": u64[16], "K": u16, "fft_size_log2(K)": u8, "inverse_fft": bool, "Start with preamble": bool, "Burstmode": bool, "Ncs": u16, "Ncp": u16, "N-Ncp": u16, "N+Ncp": u16, "N+Ncp+Ncs": u16, "Demodulator MUX config": u64[16], "M": u8, "DFT SIZE": FXP(6.0), "Frame length": u32, "Super frame length": u32, "Ns_all_GFDM_blocks": u32, "Ns_all_preambles": u32}
  "GFDM all parameters.gtype" = cluster{"GFDM parameter": "GFDM parameter.gtype", "Sync config": T1, "Modem Configuration": "modem_configuration.gtype", "Preamble with CP, CS": c128[], "Preamble": c128[], "receiver filter gamma": c128[], "pulse shaping filter g": c128[], "rising window": c128[], "channel coefficients": c128[]}
diagram:
  Property Node(instance in=$"GFDM all parameters") -> ("Modem Configuration:Nw"=w1, "rising window"=w2, "Modem Configuration:Ncp"=w3, "Modem Configuration:N-Ncp"=w4, "Modem Configuration:Ncs"=w5, "GFDM parameter"=w6, "pulse shaping filter g"=w7, "Preamble with CP, CS"=w8)
  call "time-domain modulator.gvi"(GFDM parameter=w6, pulse shaping filter g=w7, data as a vector d=$"data as a vector d") -> (time signal x=w9)
  call "norm CFX.gvi"(Input=w9) -> (Output=w10)
  $"GFDM block" <- w10
  call "CP+CS.gvi"(data in=w9, Ncp=w3, N-Ncp=w4, Ncs=w5) -> (data out=w11)
  call "window.gvi"(data in=w11, Nw=w1, window=w2) -> (data out=w12)
  call "norm CFX.gvi"(Input=w12) -> (Output=w13)
  call "norm CFX.gvi"(Input=w8) -> (Output=w14)
  Build Array[ConcatenateInputs=True](w14, w13) -> w15
  $"GFDM frame" <- w15
  $"GFDM + CPCS" <- w13
