vi "bits to QAM.gvi"   [LabVIEW Communications System Design Suite 2.0.1]
inputs:
  "data in": u8[]
  "symbol map": c128[]
outputs:
  "output bit stream": i8[]
  "symbols out": c128[]
diagram:
  call "MT UnPack Bits.gvi"(input integers=$"data in", bits per integer=8) -> (output bit stream=w1, error out=w2)
  $"output bit stream" <- w1
  call "mod_QAM Modulator Map Symbols.gvi"(input bit stream=w1, error in=w2, symbol map=$"symbol map") -> (symbols=w3)
  $"symbols out" <- w3
