vi "encode.gvi"   [LabVIEW Communications System Design Suite 2.0.1]
inputs:
  "input bit stream": u8[]
outputs:
  "input bit stream_2": UFXP(2.0)[]
diagram:
  for {
    w1 = each element of $"input bit stream"
    Number To Boolean Array(number=w1) -> (Boolean array=w3)
    for {
      w4 = each element of w3
      call "ConvolutionalEncoder.gvi"(dataIn=w4) -> (encodedSymbolOut=w6)
      append w6 to w5
    }
    concatenate w5 onto w2
  }
  $"input bit stream_2" <- w2
