vi "linspace.gvi"   [LabVIEW NXG]
inputs:
  "Number of Paths": i32
  "Max gain": f64
  "Min gain": f64
outputs:
  "Path Gains": f64[]
diagram:
  Decrement(x=$"Number of Paths") -> w1
  Subtract(x=$"Min gain", y=$"Max gain") -> w2
  Divide(x=w2, y=w1) -> w3
  Initialize Array(element=0, size=$"Number of Paths") -> w4
  for (N = $"Number of Paths") (iteration -> i1) {
    append i1 to w5
  }
  Replace Array Subset(inArray=w4, 0, w5) -> w6
  for {
    w7 = each element of w6
    Multiply(w7, w3) -> w9
    append w9 to w8
  }
  for {
    w10 = each element of w8
    Add(w10, $"Max gain") -> w12
    append w12 to w11
  }
  $"Path Gains" <- w11
