vi "read test vector.gvi"   [LabVIEW Communications System Design Suite 2.0.1]
inputs:
  "M": u32 = 5
  "direction": enum{"TX", "RX"} = "TX"
  "K": u32 = 128
outputs:
  "input": c128[]
  "output": c128[]
  "g": c128[]
panel indicators:
  "array": c128[]
  "absolute Signals": f64[][]
diagram:
  w1 = "C:\\git\\IPP16_SISO_PHY\\design\\FPGA\\Modem\\Host\\reference\\testvectors\\"
  Is Equal(x=$direction, y="TX") -> w2
  Select(s=w2, t="tx_K", f="rx_K") -> w3
  Number To Decimal String(number=$K) -> (decimal integer string=w4)
  Number To Decimal String(number=$M) -> (decimal integer string=w5)
  Concatenate Strings(w1, w3, w4, "M", w5) -> w6
  Concatenate Strings(w6, "_real.txt") -> w7
  String To Path(string=w7) -> (path=w8)
  call "file to array.gvi"(path=w8) -> (array=w9)
  Concatenate Strings(w6, "_imag.txt") -> w10
  String To Path(string=w10) -> (path=w11)
  call "file to array.gvi"(path=w11) -> (array=w12)
  Real And Imaginary To Complex(x=w9, y=w12) -> w13
  $array <- w13
  Multiply($K, $M) -> w14
  Array Subset(array=w13, index0=3, length0=w14) -> w15
  $g <- w15
  Add(3, w14) -> w16
  Array Subset(array=w13, index0=w16, length0=w14) -> w17
  $input <- w17
  Add(w16, w14) -> w18
  Array Subset(array=w13, index0=w18, length0=w14) -> w19
  $output <- w19
  Build Array(w15, w17, w19) -> w20
  Absolute Value(x=w20) -> w21
  $"absolute Signals" <- w21
