vi "select data_u32.gvi"   [LabVIEW Communications System Design Suite 2.0.1]
inputs:
  "data_vector": u32[]
  "trainings sequence": u32[]
  "resource map as vector": enum{"Null", "Pilot", "Data"}[]
outputs:
  "tx data symbols": u32[]
diagram:
  s1 = u32[] []  # shift register
  s2 = 0  # shift register
  s3 = 0  # shift register
  for {
    w1 = each element of $"resource map as vector"
    case (w1) {
      frame "Null", Default {
        Insert Into Array(inArray=s1, new=0) -> w2
        w3 = s2
        w4 = s3
      }
      frame "Pilot" {
        Array Index(array=$"trainings sequence") -> (out0[s2]=w5)
        Insert Into Array(inArray=s1, new=w5) -> w2
        Increment(x=s2) -> w3
        w4 = s3
      }
      frame "Data" {
        Array Index(array=$data_vector) -> (out0[s3]=w6)
        Insert Into Array(inArray=s1, new=w6) -> w2
        Increment(x=s3) -> w4
        w3 = s2
      }
    }
    next s1 = w2
    next s2 = w3
    next s3 = w4
  }
  $"tx data symbols" <- s1
