vi "time-domain demodulator.gvi"   [LabVIEW Communications System Design Suite 2.0.1]
inputs:
  "GFDM parameter in": "GFDM parameter.gtype" = {"Variable: K"=8, "Variable: M"=3, "Variable: a"=0.5, "filter type"="rc", "receive filter"="MF", "inverse FFT"=FALSE, "Variable: b"=0.5, "Ncs"=0, "Ncp"=0}
  "Bypass transform": bool
  "receive filter gamma": c128[]
  "received signal y": c128[]
outputs:
  "iq symbols": c128[]
  "GFDM parameter out": "GFDM parameter.gtype"
panel indicators:
  "Input signals": f64[][]
  "data": c128[]
  "shifted filter": f64[]
types:
  "GFDM parameter.gtype" = cluster{"Variable: K": i32, "Variable: M": i32, "Variable: a": f64, "filter type": enum{"rc", "rect"}, "receive filter": enum{"MF", "ZF"}, "inverse FFT": bool, "Variable: b": f64, "Ncs": u16, "Ncp": u16}
uses:
  NI::Analysis::Transforms::Inverse Complex FFT.gvi
  NI::Analysis::Transforms::Complex FFT.gvi
diagram:
  Property Node(instance in=$"GFDM parameter in") -> ("Variable: K"=w1, "Variable: M"=w2, "inverse FFT"=w3, instance out=w4)
  $"GFDM parameter out" <- w4
  Multiply(w1, w2) -> w5
  Initialize Array(element=0+0i, size=w5) -> w6
  s1 = w6  # shift register
  for (N = w2) (iteration -> i1) {
    Multiply(w1, i1) -> w8
    Multiply(w8, 1) -> w9
    Rotate 1D Array(array=$"receive filter gamma", n=w9) -> (array (last n elements first)=w10)
    Multiply(w10, $"received signal y") -> w11
    call "inverse repmat.gvi"(M=w2, K=w1, array in=w11) -> (array out=w12)
    case ($"Bypass transform") {
      frame True {
        w13 = w12
      }
      frame False {
        case (w3) {
          frame True {
            call "Inverse Complex FFT.gvi"(FFT{x}=w12) -> (x=w14)
            Multiply(w14, w1) -> w13
          }
          frame False {
            call "Complex FFT.gvi"(x=w12, FFT size=w1) -> (FFT{x}=w13)
          }
        }
      }
    }
    Replace Array Subset(inArray=s1, index=w8, new=w13) -> w15
    concatenate w10 onto w7
    next s1 = w15
  }
  Absolute Value(x=w7) -> w16
  $"shifted filter" <- w16
  $"iq symbols" <- s1
  Build Array($"received signal y", $"receive filter gamma") -> w17
  Absolute Value(x=w17) -> w18
  $"Input signals" <- w18
  $data <- s1
