vi "time-domain modulator.gvi"   [LabVIEW Communications System Design Suite 2.0.1]
inputs:
  "GFDM parameter": "GFDM parameter.gtype"
  "Bypass FFT": bool
  "pulse shaping filter g": c128[]
  "data as a vector d": c128[]
outputs:
  "time signal x": c128[]
  "time signal x u32": u32[]
  "GFDM parameter out": "GFDM parameter.gtype"
  "time signal x u64": u64[]
panel indicators:
  "Signals": f64[][]
  "data": c128[]
  "Signals_2": f64[]
types:
  "GFDM parameter.gtype" = cluster{"Variable: K": i32, "Variable: M": i32, "Variable: a": f64, "filter type": enum{"rc", "rect"}, "receive filter": enum{"MF", "ZF"}, "inverse FFT": bool, "Variable: b": f64, "Ncs": u16, "Ncp": u16}
uses:
  NI::Analysis::Transforms::Complex FFT.gvi
  NI::Analysis::Transforms::Inverse Complex FFT.gvi
diagram:
  Property Node(instance in=$"GFDM parameter") -> ("Variable: K"=w1, "Variable: M"=w2, "inverse FFT"=w3, instance out=w4)
  $"GFDM parameter out" <- w4
  Reshape Array(inArray=$"data as a vector d", size=w2, size=w1) -> w5
  Multiply(w1, w2) -> w6
  Initialize Array(element=0+0i, size=w6) -> w7
  Not(x=w3) -> w8
  s1 = w7  # shift register
  for (N = w2) (iteration -> i1) {
    w9 = each element of w5
    case (w8) {
      frame False {
        call "Complex FFT.gvi"(x=w9, shift?=FALSE, FFT size=w1) -> (FFT{x}=w11)
      }
      frame True {
        call "Inverse Complex FFT.gvi"(FFT{x}=w9, shift?=FALSE) -> (x=w12)
        Multiply(w12, w1) -> w11
      }
    }
    Not(x=$"Bypass FFT") -> w13
    Select(s=w13, t=w11, f=w9) -> w14
    call "repmat.gvi"(count=w2, array in=w14) -> (array out=w15)
    Multiply(w1, i1) -> w16
    Rotate 1D Array(array=$"pulse shaping filter g", n=w16) -> (array (last n elements first)=w17)
    Multiply(w17, w15) -> w18
    Add(w18, s1) -> w19
    concatenate w17 onto w10
    next s1 = w19
  }
  Absolute Value(x=w10) -> w20
  $Signals_2 <- w20
  disable {
    frame Enabled {
      w21 = default
      w22 = default
    }
    frame Disabled {
      for {
        w23 = each element of s1
        w24 = each element of s1
        call "CDB to 2.14 FXP 32 bit.gvi"(Input=w23) -> (Output=w25)
        call "cfx_to_u64.gvi"(input=w24) -> (output=w26)
        append w25 to w21
        append w26 to w22
      }
    }
  }
  $"time signal x u32" <- w21
  $"time signal x u64" <- w22
  $"time signal x" <- s1
  $data <- $"data as a vector d"
  Build Array(s1, $"pulse shaping filter g") -> w27
  Absolute Value(x=w27) -> w28
  $Signals <- w28
