vi "window.gvi"   [LabVIEW NXG]
inputs:
  "data in": c128[]
  "Nw": f64
  "window": c128[]
outputs:
  "data out": c128[]
diagram:
  Array Size(array=$"data in") -> (size(s)=w1)
  Is Not Equal To 0(x=$Nw) -> w2
  case (w2) {
    frame False, Default {
      w3 = $"data in"
    }
    frame True {
      Subtract(x=w1, y=$Nw) -> w4
      Initialize Array(element=1+0i, size=w1) -> w5
      Replace Array Subset(inArray=w5, 0, $window) -> w6
      Reverse 1D Array(array=$window) -> (reversed array=w7)
      Replace Array Subset(inArray=w6, w4, w7) -> w8
      Multiply($"data in", w8) -> w3
    }
  }
  $"data out" <- w3
