vi "UDP data generator and receiver.gvi"   [LabVIEW Communications System Design Suite 2.0.1]
panel controls:
  "Stop": bool
  "packet size": i32 = 1316
  "TX milliseconds to wait": u32 = 500
  "RX port": u16 = 60000
  "TX port or service name": u16 = 50000
panel indicators:
  "data input": u8[]
  "data output": u8[]
  "RX error out": error
  "TX error out": error
  "correct packets [%]": f64
  "TX vs RX data": u8[][]
  "correct": i32
  "total": i32
  "correct packets": f64
diagram:
  Udp Open(port=49999) -> (connection ID=w1, error out=w2)
  w3 = $"packet size"
  while {
    Wait(time to wait=$"TX milliseconds to wait")
    for (N = w3) (iteration -> i1) {
      To Unsigned Byte Integer(number=i1) -> w5
      append w5 to w4
    }
    $"data input" <- w4
    Udp Write Binary(address="localhost", connection ID=w1, data in=w4, error in=w2, port or service name=$"TX port or service name", timeout ms=100) -> (connection ID out=w6, error out=w7)
    $"TX error out" <- w7
    call "Is Error.gvi"(error in=w7) -> (is error?=w8)
    Logical Or(w8, $Stop) -> w9
    stop if w9
  }
  Udp Close(connection ID=w6, error in=w7)
  $Stop <- FALSE
  Udp Open(port=$"RX port") -> (connection ID=w10, error out=w11)
  s1 = 0  # shift register
  s2 = 0  # shift register
  while {
    Udp Read I Pv 6 Binary(connection ID=w10, error in=w11, max size=w3, timeout ms=100) -> (connection ID out=w12, data out=w13, error out=w14)
    case (FALSE) {
      frame True {
        w15 = s1
        w16 = s2
      }
      frame False {
        Increment(x=s2) -> w16
        Is Equal[ComparisonMode=CompareAggregates](x=$"data input", y=w13) -> w17
        Boolean To Integer(Boolean=w17) -> (0, 1=w18)
        Add(s1, w18) -> w15
        Divide(x=w15, y=w16) -> w19
        $"correct packets [%]" <- w19
        $"correct packets" <- w19
        $total <- w16
        $correct <- w15
        Build Array($"data input", w13) -> w20
        $"TX vs RX data" <- w20
        $"data output" <- w13
      }
    }
    $"RX error out" <- w14
    next s1 = w15
    next s2 = w16
    stop if $Stop
  }
  Udp Close(connection ID=w12)
