vi "Send UDP test data.gvi"   [LabVIEW Communications System Design Suite 2.0.1]
panel controls:
  "TXpaketSize": i32
  "RX paketSize": i32 = 548
  "next": bool
  "stop": bool
  "milliseconds to wait RX": u32
panel indicators:
  "loop iteration TX": i32
  "data out": u8[]
  "data In": u8[]
  "ReceivedSize": i32
  "loop iteration RX": i32
diagram:
  w1 = "127.0.0.1"  # address
  String To Ip Address(name=w1) -> (net address=w2)
  Udp Open(net address=w2, port=12344, service name="ac") -> (connection ID=w3, error out=w4)
  while (iteration -> i1) {
    while {
      Wait(time to wait=100)
      stop if $next
    }
    Decrement(x=$TXpaketSize) -> w5
    for (N = w5) (iteration -> i2) {
      To Unsigned Byte Integer(number=i2) -> w7
      append w7 to w6
    }
    To Unsigned Byte Integer(number=i1) -> w8
    Build Array[ConcatenateInputs=True](w8, w6) -> w9
    Udp Write Binary(address=w2, connection ID=w3, data in=w9, error in=w4, port or service name=12345) -> (connection ID out=w10, error out=w11)
    $"data In" <- w9
    $"loop iteration TX" <- i1
    stop if $stop
  }
  Udp Close(connection ID=w10, error in=w11)
  w12 = "127.0.0.1"  # address
  String To Ip Address(name=w12) -> (net address=w13)
  Udp Open(net address=w13, port=12345, service name="ac") -> (connection ID=w14)
  while (iteration -> i3) {
    Udp Read I Pv 6 Binary(connection ID=w14, max size=$"RX paketSize", timeout ms=100) -> (connection ID out=w15, data out=w16, error out=w17)
    Array Size(array=w16) -> (size(s)=w18)
    case (w18) {
      frame 0 { }
      frame 1, Default {
        $"data out" <- w16
        Array Size(array=w16) -> (size(s)=w19)
        $ReceivedSize <- w19
      }
    }
    Wait(time to wait=$"milliseconds to wait RX")
    $"loop iteration RX" <- i3
    stop if $stop
  }
  Udp Close(connection ID=w15, error in=w17)
  $stop <- FALSE
