vi "UDP read.gvi"   [LabVIEW Communications System Design Suite 2.0.1]
inputs:
  "UDP connection": UdpNetworkConnectionRefnum
  "Error": error
outputs:
  "empty": bool
  "data out": u8[]
  "UDP receive error": string  # source out indicates the source of the error.
  "error out": error
panel indicators:
  "receive FIFO full": bool
diagram:
  w1 = 548  # maximum UDP packet size
  Udp Read I Pv 6 Binary(connection ID=$"UDP connection", error in=$Error, max size=w1, timeout ms=1000) -> (data out=w2, error out=w3)
  Array Size(array=w2) -> (size(s)=w4)
  Is Equal To 0(x=w4) -> w5
  call "Clear Errors.gvi"(specific error code to clear=113, error in=w3) -> (specific error cleared?=w6, error out=w7)
  call "Clear Errors.gvi"(specific error code to clear=56, error in=w7) -> (specific error cleared?=w8, error out=w9)
  call "Clear Errors.gvi"(specific error code to clear=66, error in=w9) -> (specific error cleared?=w10, error out=w11)
  call "Clear Errors.gvi"(specific error code to clear=1, error in=w11) -> (specific error cleared?=w12, error out=w13)
  Logical Or(w5, w8, w10, w12) -> w14
  $empty <- w14
  $"receive FIFO full" <- w6
  $"error out" <- w13
  $"data out" <- w2
  call "Display Error.gvi"(type of dialog="no dialog", error in=w3) -> (description=w15)
  $"UDP receive error" <- w15
