vi "UDP send.gvi"   [LabVIEW Communications System Design Suite 2.0.1]
inputs:
  "UDP send.port or service name": u16
  "Input": UdpNetworkConnectionRefnum
  "Array": u8[]
  "Error": error
outputs:
  "Error_2": error
diagram:
  w1 = "127.0.0.1"  # address
  String To Ip Address(name=w1) -> (net address=w2)
  Udp Write Binary(address=w2, connection ID=$Input, data in=$Array, error in=$Error, port or service name=$"UDP send.port or service name") -> (error out=w3)
  call "Clear Errors.gvi"(specific error code to clear=1, error in=w3) -> (error out=w4)
  call "Clear Errors.gvi"(specific error code to clear=55, error in=w4) -> (error out=w5)
  $Error_2 <- w5
