vi "config UDP.gvi"   [LabVIEW Communications System Design Suite 2.0.1]
inputs:
  "receive port (from vlc player)": u16 = 12345
  "error in": error
outputs:
  "UDP receive": UdpNetworkConnectionRefnum
  "UDP send": UdpNetworkConnectionRefnum
  "error out": error
diagram:
  # initial
  # UDP receiver
  Udp Open(error in=$"error in", port=$"receive port (from vlc player)") -> (connection ID=w1, error out=w2)
  $"UDP receive" <- w1
  # configure data resource
  Udp Open(error in=w2, net address=0, port=0, service name="", timeout ms=25000) -> (connection ID=w3, error out=w4)
  $"UDP send" <- w3
  $"error out" <- w4
