vi "[RX] Data Sink.gvi"   [LabVIEW Communications System Design Suite 2.0.1]
inputs:
  "UDP send port": u16 = 60000
  "DataIn": u8[]
  "packet type": u8
  "packet count": u8
  "UDP conection (sink)": UdpNetworkConnectionRefnum
  "queue": Queue<u8[]>
  "simulate UDP?": bool
  "udp ipadress": u32 = 2130710000
diagram:
  Array Size(array=$DataIn) -> (size(s)=w1)
  Is Greater Than 0(x=w1) -> w2
  case (w2) {
    frame False, Default { }
    frame True {
      case ($"packet type") {
        frame 1 {
          # Dummy and test packets ...
          # are not repeated.
          Lossy Enqueue Element(element=$DataIn, queue=$queue)
        }
        frame 255 {
          Lossy Enqueue Element(element=$DataIn, queue=$queue)
        }
        frame 0 {
          Feedback Node(initial value=250, input=$"packet count") -> w3
          Is Not Equal(x=$"packet count", y=w3) -> w4
          Logical And(w4, not $"simulate UDP?") -> w5
          case (w5) {
            frame False, Default { }
            frame True {
              # only packets with different packet
              # number are sent to the network
              call "UDP send.gvi"(UDP send.port or service name=$"UDP send port", UDP connection=$"UDP conection (sink)", dataIn=$DataIn, adress=$"udp ipadress")
            }
          }
        }
        frame 2, Default { }
      }
    }
  }
  disable {
    frame Enabled { }
    frame Disabled {
      Obtain Queue(element data type=u8[] [], max queue size=10, name="RX Data")
    }
  }
