vi "[RX] prepare packet.gvi"   [LabVIEW Communications System Design Suite 2.0.1]
inputs:
  "dataIn": u16[]
  "packet type used?": bool
  "frame counter used?": bool
outputs:
  "DataOut": u8[]
  "packet type": u8
  "packet count": u8
  "Nof packets correct": u64
  "Nof packets wrong": u64
  "Nof packets": u64
  "recivedBytesWithoutCRC": u8[]
panel indicators:
  "Nof repeatet": u64
diagram:
  Array Size(array=$dataIn) -> (size(s)=w1)
  Is Greater Than 0(x=w1) -> w2
  case (w2) {
    frame False, Default {
      w3 = default
      w4 = default
      w5 = default
      w6 = default
      w7 = default
      w8 = default
    }
    frame True {
      Split Number(x=$dataIn) -> (high(x)=w9, low(x)=w10)
      $recivedBytesWithoutCRC <- w10
      Decrement(x=w1) -> w11
      Array Index(array=w9) -> (out0[w11]=w12)
      Number To Boolean Array(number=w12) -> (Boolean array=w13)
      Array Index(array=w13) -> (out2[_]=w14)
      Feedback Node(input=w10) -> w15
      Is Equal(x=w10, y=w15) -> w16
      And Array Elements(Boolean array=w16) -> (logical AND=w8)
      Logical And(not w8, w14) -> w17
      case (w17) {
        frame True {
          # extract packet number
          case ($"frame counter used?") {
            frame True, Default {
              Split 1D Array(array=w10, index=1) -> (first subarray=w19, second subarray=w18)
              # packet number
              Array Index(array=w19) -> (out0[_]=w7)
            }
            frame False {
              call "mod N counter with reset.gvi"(enable=TRUE, N=18446744073709551615, repetitive=TRUE) -> (index=w20)
              To Unsigned Byte Integer(number=w20) -> w7
              w18 = w10
            }
          }
          # extrackt packet type
          case ($"packet type used?") {
            frame False, Default {
              # all packets interpreted as data
              # if packet type not used
              w5 = w18
              w6 = 0
            }
            frame True {
              Split 1D Array(array=w18, index=1) -> (first subarray=w21, second subarray=w5)
              Array Index(array=w21) -> (out0[_]=w6)
            }
          }
          w3 = TRUE
          w4 = FALSE
        }
        frame False {
          # Packet with broken CRC
          Not(x=w14) -> w4
          w5 = default
          w6 = default
          w7 = default
          w3 = FALSE
        }
      }
    }
  }
  call "mod N counter with reset.gvi"(enable=w8, N=18446744073709551615) -> (index=w22)
  $"Nof repeatet" <- w22
  $DataOut <- w5
  $"packet type" <- w6
  $"packet count" <- w7
  call "mod N counter with reset.gvi"(enable=w3, N=18446744073709551615) -> (index=w23)
  $"Nof packets correct" <- w23
  call "mod N counter with reset.gvi"(enable=w4, N=18446744073709551615) -> (index=w24)
  Add(w23, w24) -> w25
  $"Nof packets" <- w25
  $"Nof packets wrong" <- w24
