vi "[RX]read demod debug 64bit data.gvi"   [LabVIEW Communications System Design Suite 2.0.1]
inputs:
  "requested length": u32
  "timeout (ms)": i32 = 1000
  "FPGA.Interface_in": "FPGA interface.gtype"
  "Error_In": error
  "queue in": Queue<cluster{"type": u8, "data": u64[]}>
outputs:
  "error_out": error
  "reference out": "FPGA interface.gtype"
diagram:
  Host Fifo Read Node[FifoName="Needed Resources.grsc\\RX.Debug.Modem_64 bit samples out"](error in=$Error_In, number of elements=0, reference in=$"FPGA.Interface_in", timeout (ms)=$"timeout (ms)") -> (elements remaining=w1, error out=w2, reference out=w3)
  Is Not Equal To 0(x=w1) -> w4
  case (w4) {
    frame False, Default {
      w5 = w2
      w6 = w3
    }
    frame True {
      call "Blocks in FIFO.gvi"(requested lenght=$"requested length", number of elements in FIFO=w1) -> (number of elements=w7)
      Host Fifo Read Node[FifoName="Needed Resources.grsc\\RX.Debug.Modem_64 bit samples out"](error in=w2, number of elements=w7, reference in=w3) -> (error out=w8, reference out=w9)
      Host Fifo Read Node[FifoName="Needed Resources.grsc\\RX.Debug.Modem_64 bit samples out"](error in=w8, number of elements=$"requested length", reference in=w9) -> (data=w10, error out=w11, reference out=w6)
      w12 = 4  # type
      Property Node(instance in=cluster{"type": u8, "data": u64[]} {all zero or empty}, "type"=w12, "data"=w10) -> (instance out=w13)
      Lossy Enqueue Element(element=w13, error in=w11, queue=$"queue in") -> (error out=w5)
    }
  }
  $"reference out" <- w6
  $error_out <- w5
