vi "[TX] UDP Source.gvi"   [LabVIEW Communications System Design Suite 2.0.1]
inputs:
  "simulate": bool
  "error in": error
  "UDP conection": UdpNetworkConnectionRefnum
  "PayloadSize": u16
  "generate.dataType": bool
outputs:
  "DataOut": u8[]
  "ErrorOut": error
  "UDP receive error": string  # source out indicates the source of the error.
  "Data available": bool
diagram:
  case ($simulate) {
    frame False, Default {
      call "UDP read.gvi"(UDP connection=$"UDP conection", Error=$"error in") -> (empty=w5, data out=w6, UDP receive error=w3, error out=w2)
      Array Size(array=w6) -> (size(s)=w7)
      Is Not Equal To 0(x=w7) -> w8
      # UDP
      Not(x=w5) -> w9
      Logical And(w9, w8) -> w4
      case (w8) {
        frame False, Default {
          w1 = w6
        }
        frame True {
          Initialize Array(element=0, size=$PayloadSize) -> w10
          Replace Array Subset(inArray=w10, index=_, new=w6) -> w11
          Array Subset(array=w11, length0=$PayloadSize) -> w1
        }
      }
    }
    frame True {
      Multiply($PayloadSize, 8) -> w12
      call "create bytes.gvi"(N bits=w12, Random data?=$"generate.dataType") -> (bytes out=w1)
      w2 = $"error in"
      w3 = default
      w4 = TRUE
    }
  }
  $"Data available" <- w4
  $DataOut <- w1
  $ErrorOut <- w2
  $"UDP receive error" <- w3
