vi "[TX] inject UDP data to queue.gvi"   [LabVIEW Communications System Design Suite 2.0.1]
inputs:
  "queu": Queue<u8[]>
  "simulate udp": bool
  "UDP": UdpNetworkConnectionRefnum
  "ErrorIm": error
  "PayloadSize [byte]": u16
  "data type": bool
outputs:
  "UDP receive error": string  # source out indicates the source of the error.
  "ErrorOut": error
diagram:
  call "[TX] UDP Source.gvi"(simulate=$"simulate udp", error in=$ErrorIm, UDP conection=$UDP, PayloadSize=$"PayloadSize [byte]", generate.dataType=$"data type") -> (DataOut=w1, ErrorOut=w2, UDP receive error=w3, Data available=w4)
  $"UDP receive error" <- w3
  case (w4) {
    frame False, Default {
      w5 = w2
    }
    frame True {
      Build Array[ConcatenateInputs=True](0, w1) -> w6
      Enqueue Element(element=w6, error in=w2, queue=$queu) -> (error out=w5)
    }
  }
  $ErrorOut <- w5
