vi "[TX] inject dummy data to queue.gvi"   [LabVIEW Communications System Design Suite 2.0.1]
inputs:
  "queue": Queue<u8[]>
  "Nof bytes": u16
  "data type": bool
  "enable": bool
diagram:
  case ($enable) {
    frame False, Default { }
    frame True {
      Multiply($"Nof bytes", 8) -> w1
      # Mark as dummy data
      call "create bytes.gvi"(N bits=w1, Random data?=$"data type") -> (bytes out=w2)
      Build Array[ConcatenateInputs=True](2, w2) -> w3
      Enqueue Element(element=w3, queue=$queue)
    }
  }
