vi "[TX] prepare packet.gvi"   [LabVIEW Communications System Design Suite 2.0.1]
inputs:
  "addFrameCounter": bool
  "dataIn": u8[]
outputs:
  "DataOut": u8[]
diagram:
  Array Size(array=$dataIn) -> (size(s)=w1)
  Is Not Equal To 0(x=w1) -> w2
  Logical And($addFrameCounter, w2) -> w3
  # add frame counter
  case (w3) {
    frame False, Default {
      w4 = $dataIn
    }
    frame True {
      Feedback Node(initial value=0, input=w5) -> w6
      Increment(x=w6) -> w5
      Build Array[ConcatenateInputs=True](w5, $dataIn) -> w4
    }
  }
  $DataOut <- w4
