vi "[TX]evaluate debug data.gvi"   [LabVIEW Communications System Design Suite 2.0.1]
inputs:
  "data": u32[]
outputs:
  "PSD": f64[]
  "TX signal": FXP(3.14)[][]
diagram:
  call "u32 array to 2.14 CFX.gvi"(data=$data) -> (Array=w1)
  call "calculate psd.gvi"(time signal x=w1, shift?=TRUE) -> (element=w2)
  Array Size(array=w1) -> (size(s)=w3)
  Multiply(w3, 0.1) -> w4
  Initialize Array(element=0, size=w4) -> w5
  Build Array[ConcatenateInputs=True](w5, w2, w5) -> w6
  $PSD <- w6
  Complex To Real Imaginary(x + iy=w1) -> (x=w7, y=w8)
  Absolute Value(x=w1) -> w9
  Build Array(w7, w8, w9) -> w10
  $"TX signal" <- w10
