vi "calibrate.gvi"   [LabVIEW Communications System Design Suite 2.0.1]
inputs:
  "bits per symbol": i32 = 1, required
  "GFDM Parameter in": "GFDM parameter.gtype" = {"Variable: K"=8, "Variable: M"=3, "Variable: a"=0.5, "filter type"="rc", "receive filter"="ZF", "inverse FFT"=TRUE, "Variable: b"=0.5, "Ncs"=0, "Ncp"=0}, required
  "FPGA Interface": "FPGA.Demodulator.Interface.gtype", required
  "file path": path = path "C:\\git\\IPP16_SISO_PHY\\design\\FPGA\\Modem\\Variables\\calibration.csv"
  "error in": error
outputs:
  "found": bool
  "error out": error
  "FPGA host interface out": "FPGA.Demodulator.Interface.gtype"
panel indicators:
  "data": f64[][]
types:
  "GFDM parameter.gtype" = cluster{"Variable: K": i32, "Variable: M": i32, "Variable: a": f64, "filter type": enum{"rc", "rect"}, "receive filter": enum{"MF", "ZF"}, "inverse FFT": bool, "Variable: b": f64, "Ncs": u16, "Ncp": u16}
diagram:
  call "Read from Spreadsheet File (DBL).gvi"(file path=$"file path", format="%f", delimiter=";") -> (all rows=w1)
  $data <- w1
  Property Node(instance in=$"GFDM Parameter in") -> ("Variable: K"=w2, "Variable: M"=w3)
  for {
    w4 = each element of w1
    Array Index(array=w4) -> (out0[0]=w9, out1[1]=w10, out2[3]=w11, out3[8]=w12, out4[9]=w13, out5[10]=w14, out6[11]=w15)
    Is Equal(x=w9, y=w2) -> w16
    Is Equal(x=w10, y=w3) -> w17
    Is Equal(x=w11, y=$"bits per symbol") -> w18
    Logical And(w16, w17, w18) -> w19
    w5 = w12 if w19
    w6 = w13 if w19
    w7 = w14 if w19
    w8 = w15 if w19
    stop if w19
  }
  case (w19) {
    frame False, Default {
      w20 = 15
      w21 = 9
      w22 = 9
      w23 = 13
    }
    frame True {
      w20 = w5
      w21 = w6
      w22 = w7
      w23 = w8
    }
  }
  Property Node(instance in=$"FPGA Interface", "dem_fft shift"=w20, "dem_modem_shift"=w21, "mod_fft shift"=w22, "mod_modem_shift"=w23, error in=$"error in") -> (error out=w24, instance out=w25)
  $"FPGA host interface out" <- w25
  $"error out" <- w24
  $found <- w19
