vi "closeAll.gvi"   [LabVIEW Communications System Design Suite 2.0.1]
inputs:
  "FPGA.Interface": "FPGA interface.gtype"
  "Error": error
  "usrp rio session": "niUsrpRio Config v1 Host.lvlib__niUsrpRio Session.gtype"
outputs:
  "error out": error
types:
  "niInstr Register Bus v0 Host.lvlib__Register Bus Session.gtype" = Queue<"niInstr Register Bus v0 Host.lvlib__Session Data.gtype">
  "Semaphore RefNum.gtype" = i32
  "niUsrpRio Config v1 Host.lvlib__DB Queue Reference.gtype" = Queue<"niUsrpRio Config v1 Host.lvlib__Daughterboard Data.gtype">
  "niUsrpRio Config v1 Host.lvlib__EEPROM Header.gtype" = cluster{"Checksum": u32, "Product Code": u16, "Hardware Current Version": u16, "Hardware Oldest Compatible Version": u16, "EEPROM Map Current Version": u16, "EEPROM Map Oldest Compatible Version": u16, "User Password": string, "Pointer to Factory Header": u32, "Pointer to User Header": u32, "Recommended Interval": u16, "Number of Reserved Bytes": i32, "Number of Daughterboards": u8, "Daughterboard IDs": u16[], "Daughterboard Serial Numbers": string[]}
  "niUsrpRio Config v1 Host.lvlib__EEPROM Device Data Header.gtype" = cluster{"Checksum": u32, "Number of Channels": u8, "Number of Gain Settings": u16[], "Pointer to Characterization Data": u32[], "Number of Reserved Bytes": i32, "Number of Frequencies": u16[]}
  "niUsrpRio Config v1 Host.lvlib__EEPROM Characterization Header.gtype" = cluster{"Checksum": u32, "Date": timestamp, "Temperature": f32, "Misc. Info": string, "Pointer to Device Data Header": u32, "Number of Reserved Bytes": i32}
  "niUsrpRio Config v1 Host.lvlib__Characterization Data.gtype" = cluster{"Gains[dB]": f64[], "Frequencies [Hz]": f64[], "IQ Imbalance Table": "niUsrpRio Config v1 Host.lvlib__IQ Imbalance.gtype"[], "Measured Gains[dB]": f64[][]}
  "niUsrpRio Config v1 Host.lvlib__niUsrpRio Session.gtype" = cluster{"FPGA Interface": any, "RIO Interface Number": u32, "Data Clock Rate": u32, "FPGA Data Clock Rate": u32, "Global Settings Register Bus": "niInstr Register Bus v0 Host.lvlib__Register Bus Session.gtype", "Radio 0 Settings Register Bus": "niInstr Register Bus v0 Host.lvlib__Register Bus Session.gtype", "Radio 1 Settings Register Bus": "niInstr Register Bus v0 Host.lvlib__Register Bus Session.gtype", "Radio Settings Bus Semaphore": "Semaphore RefNum.gtype", "DB Queues": "niUsrpRio Config v1 Host.lvlib__DB Queue Reference.gtype"[], "Characterization Data Valid?": bool, "EEPROM Header": "niUsrpRio Config v1 Host.lvlib__EEPROM Header.gtype", "Device Data Header": "niUsrpRio Config v1 Host.lvlib__EEPROM Device Data Header.gtype", "EEPROM Characterization Header": "niUsrpRio Config v1 Host.lvlib__EEPROM Characterization Header.gtype", "Characterization Data": "niUsrpRio Config v1 Host.lvlib__Characterization Data.gtype"[], "FPGA Current Version": u32, "FPGA Oldest Compatible Version": u32, "Fixed Logic Current Version": u32, "Fixed Logic Oldest Compatible Version": u32, "FPGA Radio Settings Bus Current Version": u32, "FPGA Radio Settings Bus Oldest Compatible Version": u32, "FPGA Board Config Current Version": u32, "FPGA Board Config Oldest Compatible Version": u32, "Daughterboard Clock Rate": u32}
  "debugQueueElementType_u32.gtype" = cluster{"sourceID": string, "data": cluster{"u32": u32[]}[]}
  "debugElementQueueType.gtype" = cluster{"sourceID": string, "JSONstring": string}
  "txDataQueueElementType.gtype" = cluster{"sourceID": string, "Bytes": u8[]}
diagram:
  call "stop FIFOs.gvi"(FPGA interface in=$"FPGA.Interface", Error=$Error) -> (error in=w1)
  call "Close Device.gvi"(niusrprio session=$"usrp rio session", error in=w1) -> (error out=w2)
  $"error out" <- w2
  Obtain Notifier(element data type=i32 1, name="PanelOperationNotifier") -> (notifier out=w3)
  Release Notifier(notifier=w3)
  Obtain Queue(element data type="debugQueueElementType_u32.gtype" {all zero or empty}, name="debugQueue") -> (queue out=w4)
  Release Queue(queue=w4)
  Obtain Queue(element data type="debugElementQueueType.gtype" {all zero or empty}, name="debugQueue2") -> (queue out=w5)
  Release Queue(queue=w5)
  Obtain Notifier(element data type=bool FALSE, name="globalStopNotifier") -> (notifier out=w6)
  Release Notifier(notifier=w6)
  Obtain Queue(element data type="txDataQueueElementType.gtype" {all zero or empty}, name="txDataQueue") -> (queue out=w7)
  Release Queue(queue=w7)
