vi "code counter.gvi"   [LabVIEW Communications System Design Suite 2.0.1]
inputs:
  "gfdm_block_counter": u8
  "frame counter": u8
outputs:
  "coded": u8[]
  "binary": bool[]
  "number": u8
  "frame number": u8
panel indicators:
  "lower": bool[]
  "upper": bool[]
diagram:
  Number To Boolean Array(number=$"frame counter") -> (Boolean array=w1)
  Array Index(array=w1) -> (out0[_]=w2, out1[_]=w3, out2[_]=w4)
  Build Array(w2, w3, w4) -> w5
  Boolean Array To Number(Boolean array=w5) -> (number=w6: u8)
  $"frame number" <- w6
  Number To Boolean Array(number=$gfdm_block_counter) -> (Boolean array=w7)
  Array Index(array=w7) -> (out0[_]=w8, out1[_]=w9, out2[_]=w10, out3[_]=w11, out4[_]=w12)
  Build Array(w2, w3, w4, w8, w9, w10, w11, w12) -> w13
  Boolean Array To Number(Boolean array=w13) -> (number=w14: u8)
  $number <- w14
  Interleave Array(w13, w13) -> w15
  $binary <- w15
  Array Subset(array=w15, index0=0, length0=8) -> w16
  Boolean Array To Number(Boolean array=w16) -> (number=w17: u8)
  Array Subset(array=w15, index0=8, length0=8) -> w18
  Boolean Array To Number(Boolean array=w18) -> (number=w19: u8)
  Build Array(w17, w19) -> w20
  $coded <- w20
  $lower <- w16
  $upper <- w18
