vi "completeSynchConfig.gvi"   [LabVIEW Communications System Design Suite 2.0.1]
inputs:
  "GfdmConfigurationCluster": T2 = {"Preamble mu"=1, "GFDM B"=1, "Preamble K"=64, "Preamble Ncp"=32, "GFDM Ncp"=32, "GFDM M"=9, "Preamble Ncs"=16, "GFDM K"=64, "GFDM Ncs"=16, "Preamble M"=2}
  "syncConfigIn": T3 = {"CFO removal"=FALSE, "ffoPiControlCte"=0, "Pi Control"=0.100006103516, "Analog Gain Controller"=TRUE, "setpoint (max. amplitude)"=0.702392578125, "numbOfBlocksBeforGainChange"=7, "Digital Gain Controller"=FALSE, " Gain [dB]"=20, "permissible error [dB]"=0.5}
outputs:
  "syncConfigOut": "SyncConfig.gtype"
panel controls:
  "syncConfigDefault": "SyncConfig.gtype" = {"0x42", TRUE, FALSE, "0x83", -2, "0x42", 100000000, "0x1E", TRUE, TRUE, FALSE, "0xCCD", "0x599A", 400, "0x1"}
  "dougtherboard": "niUsrpRio Config v1 Host.lvlib__DB Types.gtype" = "sbx"
types:
  T1 = cluster{"missingSignalThresholdInSampels": u32, "GainIn": UFXP(5.1), "enableAnalogGainControl": bool, "enableDigitalGainController": bool, "enableDCremover": bool, "PiControl": UFXP(1.15), "setpointMaxAmplitude": UFXP(0.15), "NumbOfValidSamplesBetweenGainChange": u32, "permissibleControlError": UFXP(5.1)}
  "SyncConfig.gtype" = cluster{"Metric peak threshold": UFXP(1.16), "MetricThresholdMode": bool, "CFO removal": bool, "ffoPiControlCte": FXP(2.17), "shift_threshold": i16, "min_threshold": UFXP(1.16), "  AGC": T1}
  T2 = cluster{"Preamble mu": u16, "GFDM B": u16, "Preamble K": u16, "Preamble Ncp": u16, "GFDM Ncp": u16, "GFDM M": u16, "Preamble Ncs": u16, "GFDM K": u16, "GFDM Ncs": u16, "Preamble M": u16}
  T3 = cluster{"CFO removal": bool, "ffoPiControlCte": FXP(2.17), "Pi Control": UFXP(1.15), "Analog Gain Controller": bool, "setpoint (max. amplitude)": UFXP(0.15), "numbOfBlocksBeforGainChange": u16, "Digital Gain Controller": bool, " Gain [dB]": UFXP(5.1), "permissible error [dB]": UFXP(5.1)}
  "niUsrpRio Config v1 Host.lvlib__DB Types.gtype" = enum{"sbx", "cbx", "wbx", "unknown", "ubx"}
diagram:
  Property Node(instance in=$syncConfigIn) -> ("numbOfBlocksBeforGainChange"=w1, "CFO removal"=w2, "ffoPiControlCte"=w3, " Gain [dB]"=w4, "Pi Control"=w5, "setpoint (max. amplitude)"=w6, "Analog Gain Controller"=w7, "Digital Gain Controller"=w8, "permissible error [dB]"=w9)
  Property Node(instance in=$syncConfigDefault) -> ("  AGC:enableDCremover"=w10, instance out=w11)
  Property Node(instance in=$GfdmConfigurationCluster) -> ("GFDM B"=w12, "Preamble K"=w13, "Preamble M"=w14, "GFDM K"=w15, "GFDM M"=w16)
  Multiply(w13, w14) -> w17
  Multiply(w15, w16) -> w18
  Add(w17, w18) -> w19
  Multiply(w12, w19, w1) -> w20
  Is Equal(x=$dougtherboard, y="ubx") -> w21
  Not(x=w21) -> w22
  Select(s=w22, t=w10, f=w22) -> w23
  Property Node(instance in=w11, "CFO removal"=w2, "ffoPiControlCte"=w3, "  AGC:GainIn"=w4, "  AGC:PiControl"=w5, "  AGC:setpointMaxAmplitude"=w6, "  AGC:enableAnalogGainControl"=w7, "  AGC:enableDigitalGainController"=w8, "  AGC:NumbOfValidSamplesBetweenGainChange"=w20, "  AGC:permissibleControlError"=w9, "  AGC:enableDCremover"=w23) -> (instance out=w24)
  $syncConfigOut <- w24
