vi "configFMUX.gvi"   [LabVIEW Communications System Design Suite 2.0.1]
inputs:
  "FPGA host interface out": any
  "error out": error
  "preamble": u32[]
outputs:
  "FPGA.Interface": any
  "Error": error
types:
  T1 = cluster{"data": u32, "valid": bool, "index": u16}
diagram:
  for (iteration -> i1) {
    w1 = each element of $preamble
    while {
      To Unsigned Long Integer(number=w1) -> w2
      To Unsigned Word Integer(number=i1) -> w3
      Property Node(instance in=T1 {all zero or empty}, "data"=w2, "valid"=TRUE, "index"=w3) -> (instance out=w4)
      Property Node(instance in=$"FPGA host interface out", "config.PreambleCpCsSampleIn"=w4, error in=$"error out") -> ("config.PreambleCpCsSampleOut"=w5, error out=w6, instance out=w7)
      Is Equal(x=w5, y=w4) -> w8
      Property Node(instance in=w8) -> ("data"=w9, "valid"=w10, "index"=w11)
      Logical And(w9, w10, w11) -> w12
      stop if w12
    }
  }
  $"FPGA.Interface" <- w7
  $Error <- w6
