vi "configFPGA.gvi"   [LabVIEW Communications System Design Suite 2.0.1]
inputs:
  "FPGA.InterfaceIn": "FPGA interface.gtype"
  "ErrorIn": error
  "Preamble path": path
  "Preamble mode": T1 = "Load from file"
  "preamble scale": f64 = 7
  "GFDM Parameter": "GFDM parameter.gtype"
  "RM:No DC": bool = TRUE
  "Use Phase Tracking": bool = TRUE
  "PayloadSize [Byte]": u16 = 9
  "QAM order": enum{"4-QAM", "16-QAM", "64-QAM", "256-QAM"} = "4-QAM"
  "use frame counter": bool
  "DataType_Host": T6 = "CAPI"
outputs:
  "ErrorOut": error
  "FPGA.InterfaceOut": "FPGA interface.gtype"
  "GfdmAllParametersOut": "GFDM all parameters.gtype"
  "M_set": i16[]
  "K_set": i16[]
  "Fully allocated?": bool
  "ChennalEstimationParameterOut": cluster{"control": T4, "config": T5}
  "GFDM B out": u16
  "bitsPerSymbol": u8
types:
  T1 = enum{"Load from file", "Generate GFDM based Preamble"}
  "GFDM parameter.gtype" = cluster{"Variable: K": i32, "Variable: M": i32, "Variable: a": f64, "filter type": enum{"rc", "rect"}, "receive filter": enum{"MF", "ZF"}, "inverse FFT": bool, "Variable: b": f64, "Ncs": u16, "Ncp": u16}
  T2 = cluster{"Preamble mu": u16, "GFDM B": u16, "Preamble K": u16, "Preamble Ncp": u16, "GFDM Ncp": u16, "GFDM M": u16, "Preamble Ncs": u16, "GFDM K": u16, "GFDM Ncs": u16, "Preamble M": u16}
  "modem_configuration.gtype" = cluster{"K-1": u16, "M-1": u8, "N-1": u16, "N": u16, "Npreamble+CP+CS": u16, "Npreamble": u16, "Nw": u16, "Modulator MUX config": u64[16], "K": u16, "fft_size_log2(K)": u8, "inverse_fft": bool, "Start with preamble": bool, "Burstmode": bool, "Ncs": u16, "Ncp": u16, "N-Ncp": u16, "N+Ncp": u16, "N+Ncp+Ncs": u16, "Demodulator MUX config": u64[16], "M": u8, "DFT SIZE": FXP(6.0), "Frame length": u32, "Super frame length": u32, "Ns_all_GFDM_blocks": u32, "Ns_all_preambles": u32}
  T3 = cluster{"amount of symbols": u16[], "data elements [bits]": u16, "payload [bits]": u16, "payload [bytes]": u16, "half payload [byte]": u16, "packet [byte]": u16}
  "GFDM all parameters.gtype" = cluster{"GFDM parameter": "GFDM parameter.gtype", "Sync config": T2, "Modem Configuration": "modem_configuration.gtype", "Preamble with CP, CS": c128[], "Preamble": c128[], "receiver filter gamma": c128[], "pulse shaping filter g": c128[], "rising window": c128[], "channel coefficients": c128[], "resource map as vector": enum{"Null", "Pilot", "Data"}[], "Pilots": c128[], "packet length": T3}
  T4 = cluster{"config!": bool, "reset!": bool, "active!": bool}
  T5 = cluster{"NpayIsPowerOfTwo": bool, "KpreIsPowerOfTwo": bool, "Npay": u16, "Kpre": u16, "log2(Npay) or DftSizeIndex": u8, "B": u16, "log2(Kpre) or DftSizeIndex": u8, "L.ch.1": u16, "L.ch.2": u16, "shiftFactorDft": i16, "DftLatency": u16}
  T6 = enum{"CAPI", "UDP or generate ", "UDP or generate over queue"}
diagram:
  # 1 byte
  # 1 byte
  Is Equal(x="UDP or generate over queue", y=$DataType_Host) -> w1
  Boolean To Integer(Boolean=w1) -> (0, 1=w2)
  Boolean To Integer(Boolean=$"use frame counter") -> (0, 1=w3)
  # 2 byte for CRC
  Add($"PayloadSize [Byte]", w3, w2) -> w4
  Array Index(array=[2, 4, 6, 8]) -> (out0[$"QAM order"]=w5)
  disable {
    frame Enabled {
      call "RessirceMape_fix.gvi"() -> (Kset=w8, Mset=w7, R_map=w6, B=w9)
    }
    frame Disabled {
      call "getResourceMap.gvi"(RM:No DC=$"RM:No DC", GFDM parameter=$"GFDM Parameter", Use Phase Tracking=$"Use Phase Tracking", PacketSize [Byte]=w4, bits per symbol=w5) -> (M_set=w7, K_set=w8, R_MAP=w6, GFDM B=w9)
    }
  }
  call "GFDM_Xcvr_configure FPGA.gvi"(FPGA interface in=$"FPGA.InterfaceIn", Error=$ErrorIn, GFDM parameter=$"GFDM Parameter", GFDM B=w9, packet length [byte]=w4, Kset_in=w8, Preamble path=$"Preamble path", Preamble mode=$"Preamble mode", preamble scale=$"preamble scale", QAM order=$"QAM order") -> (FPGA interface out=w10, Error out=w11, GFDM all parameters=w12)
  call "RM config.gvi"(FPGA interface in=w10, R_MAP=w6, error in=w11) -> (Error=w13)
  call "CE_configChennalEstimation.gvi"(FPGA interface_in=w10, GFDM all parameters=w12, Error_in=w13) -> (FPGA.Interface_out=w14, GFDM all parameters out=w15, Error_2=w16, ChannelEstParamOut=w17)
  $"FPGA.InterfaceOut" <- w14
  $ChennalEstimationParameterOut <- w17
  Property Node(instance in=w15, "packet length:payload [bytes]"=$"PayloadSize [Byte]", "packet length:packet [byte]"=w4) -> (instance out=w18)
  $GfdmAllParametersOut <- w18
  Is Greater(x=w9, y=25) -> w19
  case (w19) {
    frame False, Default {
      w20 = default
    }
    frame True {
      w21 = error {"status"=TRUE, "code"=0, "source"="configFPGA.getResourceMap"}
      call "Build Error Cluster.gvi"(code=777, description="can not fit payload", error in=w21) -> (error out=w20)
    }
  }
  Merge Errors(w16, w20) -> (error out=w22)
  $ErrorOut <- w22
  $M_set <- w7
  $K_set <- w8
  $"GFDM B out" <- w9
  $bitsPerSymbol <- w5
  Is Equal(x=$"Preamble mode", y="Load from file") -> w23
  $"Fully allocated?" <- w23
