vi "decode counter values.gvi"   [LabVIEW Communications System Design Suite 2.0.1]
inputs:
  "first counter": u8[]
  "second counter": u8[]
  "third counter": u8[]
outputs:
  "frame counter": u32
  "gfdm block number": u32
diagram:
  call "decode_one_counter_value.gvi"(subarray=$"first counter") -> (array=w1)
  call "decode_one_counter_value.gvi"(subarray=$"second counter") -> (array=w2)
  call "decode_one_counter_value.gvi"(subarray=$"third counter") -> (array=w3)
  Add(w1, w2, w3) -> w4
  Divide(x=w4, y=6) -> w5
  Round To Nearest(number=w5) -> w6
  Array Index(array=w6) -> (out0[_]=w7, out1[_]=w8, out2[_]=w9, out3[_]=w10, out4[_]=w11, out5[_]=w12, out6[_]=w13, out7[_]=w14)
  Is Not Equal To 0(x=w7) -> w15
  Is Not Equal To 0(x=w8) -> w16
  Is Not Equal To 0(x=w9) -> w17
  Build Array(w15, w16, w17) -> w18
  Boolean Array To Number(Boolean array=w18) -> (number=w19)
  $"frame counter" <- w19
  Is Not Equal To 0(x=w10) -> w20
  Is Not Equal To 0(x=w11) -> w21
  Is Not Equal To 0(x=w12) -> w22
  Is Not Equal To 0(x=w13) -> w23
  Is Not Equal To 0(x=w14) -> w24
  Build Array(w20, w21, w22, w23, w24) -> w25
  Boolean Array To Number(Boolean array=w25) -> (number=w26)
  $"gfdm block number" <- w26
