vi "decodeDebugDataIQ.gvi"   [LabVIEW Communications System Design Suite 2.0.1]
inputs:
  "debugDataIn": "debugQueueElementType_u32.gtype"
  "beforRDM/afterRDM": bool
outputs:
  "IQ": c128[]
  "Pilot-Betrag": UFXP(2.14)[]
  "Pilot-Phase": f64[]
  "RE_data": f64[]
  "IM_data": f64[]
types:
  "debugQueueElementType_u32.gtype" = cluster{"sourceID": string, "data": cluster{"u32": u32[]}[]}
diagram:
  Property Node(instance in=$debugDataIn) -> ("sourceID"=w1, "data"=w2)
  Is Equal(x=w1, y="rxDebugIqDataOut") -> w3
  case (w3) {
    frame False, Default {
      w4 = default
      w5 = default
      w6 = default
      w7 = default
      w8 = default
    }
    frame True {
      Array Index(array=w2) -> (out0[_]=w9, out1[_]=w10, out2[_]=w11)
      Property Node(instance in=w9) -> ("u32"=w12)
      call "Calculate Pilot Results.gvi"(received pilot array=w12) -> (Pilot-Betrag=w6, Pilot-Phase=w7)
      Property Node(instance in=w10) -> ("u32"=w13)
      call "u32 array to 2.14 CFX.gvi"(data=w13) -> (Array=w14)
      To Double Precision Complex(number=w14) -> w15
      Complex To Real Imaginary(x + iy=w15) -> (x=w4, y=w5)
      Property Node(instance in=w11) -> ("u32"=w16)
      call "u32 array to 2.14 CFX.gvi"(data=w16) -> (Array=w17)
      To Double Precision Complex(number=w17) -> w18
      Select(s=$"beforRDM/afterRDM", t=w15, f=w18) -> w8
    }
  }
  $"Pilot-Betrag" <- w6
  $"Pilot-Phase" <- w7
  $RE_data <- w4
  $IM_data <- w5
  $IQ <- w8
