vi "decodeDebugDataRx.gvi"   [LabVIEW Communications System Design Suite 2.0.1]
inputs:
  "debugDataIn": "debugElementQueueType.gtype"
outputs:
  "txDebugDataOut": cluster{"Element 1": T1, "Element 2": bool}
  "rxDebugDataOut": cluster{"Element 1": T2, "Element 2": bool}
types:
  "debugElementQueueType.gtype" = cluster{"sourceID": string, "JSONstring": string}
  T1 = cluster{"UDP receive error": string, "UDP packet size [byte]": i32, "transmission frame size [byte]": i32, "half of the payload [byte]": f64, "GFDM block payload size [byte]": u32, "TX byte": u8[], "Number of GFDM blocks": u32, "UDP receive FIFO full": bool}
  T2 = cluster{"current angle": string, "UDP send error": string, "received packets": u32, "paket counter": u32, "angle over time": i32, "rxBytes": u8[], "frameErrorRate": f64}
diagram:
  Property Node(instance in=$debugDataIn) -> ("sourceID"=w1, "JSONstring"=w2)
  Is Equal(x=w1, y="TxDebugData") -> w3
  Feedback Node(input=w4) -> w5
  case (w3) {
    frame False, Default {
      w4 = w5
      w6 = w3
    }
    frame True {
      Unflatten From JSON(JSON string=w2, type and defaults=T1 {all zero or empty}) -> (value=w4)
      w6 = w3
    }
  }
  Build Cluster(w4, w6) -> w7
  $txDebugDataOut <- w7
  Is Equal(x=w1, y="receiveData") -> w8
  Feedback Node(input=w9) -> w10
  case (w8) {
    frame False, Default {
      w9 = w10
      w11 = w8
    }
    frame True {
      w12 = T2 {"UDP send error"="No Error"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}
      Unflatten From JSON(JSON string=w2, type and defaults=w12) -> (value=w9)
      w11 = w8
    }
  }
  Build Cluster(w9, w11) -> w13
  $rxDebugDataOut <- w13
