vi "decodeDebugDataSync.gvi"   [LabVIEW Communications System Design Suite 2.0.1]
inputs:
  "DebugDataIn": "debugQueueElementType_u32.gtype"
  "Channel Length": i32 = 9
  "Fully allocated?": bool = TRUE
  "normalize preamble?": bool = TRUE
  "GFDM all parameters": "GFDM all parameters.gtype"
outputs:
  "rms value": f64
  "debugGraphSync": f64[][]
  "channel freq domain": f64[][]
  "channel time domain": f64[][]
  "Channel Freq. Resp.": c128[]
types:
  "GFDM parameter.gtype" = cluster{"Variable: K": i32, "Variable: M": i32, "Variable: a": f64, "filter type": enum{"rc", "rect"}, "receive filter": enum{"MF", "ZF"}, "inverse FFT": bool, "Variable: b": f64, "Ncs": u16, "Ncp": u16}
  T1 = cluster{"Preamble mu": u16, "GFDM B": u16, "Preamble K": u16, "Preamble Ncp": u16, "GFDM Ncp": u16, "GFDM M": u16, "Preamble Ncs": u16, "GFDM K": u16, "GFDM Ncs": u16, "Preamble M": u16}
  "modem_configuration.gtype" = cluster{"K-1": u16, "M-1": u8, "N-1": u16, "N": u16, "Npreamble+CP+CS": u16, "Npreamble": u16, "Nw": u16, "Modulator MUX config": u64[16], "K": u16, "fft_size_log2(K)": u8, "inverse_fft": bool, "Start with preamble": bool, "Burstmode": bool, "Ncs": u16, "Ncp": u16, "N-Ncp": u16, "N+Ncp": u16, "N+Ncp+Ncs": u16, "Demodulator MUX config": u64[16], "M": u8, "DFT SIZE": FXP(6.0), "Frame length": u32, "Super frame length": u32, "Ns_all_GFDM_blocks": u32, "Ns_all_preambles": u32}
  T2 = cluster{"amount of symbols": u16[], "data elements [bits]": u16, "payload [bits]": f64, "payload [bytes]": f64, "half payload [byte]": f64}
  "GFDM all parameters.gtype" = cluster{"GFDM parameter": "GFDM parameter.gtype", "Sync config": T1, "Modem Configuration": "modem_configuration.gtype", "Preamble with CP, CS": c128[], "Preamble": c128[], "receiver filter gamma": c128[], "pulse shaping filter g": c128[], "rising window": c128[], "channel coefficients": c128[], "resource map as vector": enum{"Null", "Pilot", "Data"}[], "Pilots": c128[], "packet length": T2}
  "debugQueueElementType_u32.gtype" = cluster{"sourceID": string, "data": cluster{"u32": u32[]}[]}
uses:
  NI::Analysis::Statistics::RMS (CDB).gvi
  NI::Analysis::Transforms::Inverse Complex FFT.gvi
diagram:
  Property Node(instance in=$DebugDataIn) -> ("sourceID"=w1, "data"=w2)
  Is Equal(x=w1, y="rxDebugSyncDataOut") -> w3
  case (w3) {
    frame True {
      Array Index(array=w2) -> (out0[_]=w4)
      Property Node(instance in=w4) -> ("u32"=w5)
      call "u32array to 1.15 CDB.gvi"(Array=w5) -> (arrayOut=w6)
      Complex To Real Imaginary(x + iy=w6) -> (x=w7, y=w8)
      Build Array(w7, w8) -> w9
      $debugGraphSync <- w9
    }
    frame False { }
  }
  Is Equal(x=w1, y="rxDebugPreambleOut") -> w10
  case (w10) {
    frame False, Default { }
    frame True {
      Array Index(array=w2) -> (out0[_]=w11)
      Property Node(instance in=w11) -> ("u32"=w12)
      Array Size(array=w12) -> (size(s)=w13)
      Is Greater Than 0(x=w13) -> w14
      case (w14) {
        frame False, Default { }
        frame True {
          call "u32 4.12 CFX to CDB array.gvi"(appended array=w12) -> (x=w15)
          call "RMS (CDB).gvi"(x=w15) -> (rms value=w16)
          $"rms value" <- w16
          Property Node(instance in=$"GFDM all parameters") -> ("Preamble"=w17, "Modem Configuration:N"=w18, "Sync config:Preamble K"=w19)
          call "norm CFX.gvi"(Input=w17) -> (Output=w20)
          call "norm CFX.gvi"(Input=w15) -> (Output=w21)
          Select(s=$"normalize preamble?", t=w21, f=w15) -> w22
          Build Array(w22, w20) -> w23
          Absolute Value(x=w23) -> w24
          $debugGraphSync <- w24
          call "Channel Estimation.gvi"(Rx signal=w21, Preamble=w20, Channel Length=$"Channel Length", preamble FFT size=w19, index=0, data FFT size=w18, Fully allocated?=$"Fully allocated?") -> (Channel Freq. Resp.=w25)
          $"Channel Freq. Resp." <- w25
          Absolute Value(x=w25) -> w26
          Complex To Polar(r * e^(i*theta)=w25) -> (theta=w27)
          Build Array(w26, w27) -> w28
          $"channel freq domain" <- w28
          call "Inverse Complex FFT.gvi"(FFT{x}=w25) -> (x=w29)
          Complex To Polar(r * e^(i*theta)=w29) -> (theta=w30)
          Absolute Value(x=w29) -> w31
          Build Array(w31, w30) -> w32
          $"channel time domain" <- w32
        }
      }
    }
  }
