vi "decodeDebugDataTxFrame.gvi"   [LabVIEW Communications System Design Suite 2.0.1]
inputs:
  "debugDataIn": "debugQueueElementType_u32.gtype" = {"sourceID"="txDebugFrameOut", "data"=[]}
outputs:
  "PSD": f64[]
  "TX signal": FXP(3.14)[][]
types:
  "debugQueueElementType_u32.gtype" = cluster{"sourceID": string, "data": cluster{"u32": u32[]}[]}
diagram:
  Property Node(instance in=$debugDataIn) -> ("sourceID"=w1, "data"=w2)
  Is Equal(x=w1, y="txDebugFrameOut") -> w3
  case (w3) {
    frame False, Default {
      w4 = default
      w5 = default
    }
    frame True {
      Array Index(array=w2) -> (out0[_]=w6)
      Property Node(instance in=w6) -> ("u32"=w7)
      call "u32 array to 2.14 CFX.gvi"(data=w7) -> (Array=w8)
      call "calculate psd.gvi"(time signal x=w8, shift?=TRUE) -> (element=w9)
      Array Size(array=w8) -> (size(s)=w10)
      Multiply(w10, 0.1) -> w11
      Initialize Array(element=0, size=w11) -> w12
      Build Array[ConcatenateInputs=True](w12, w9, w12) -> w5
      Complex To Real Imaginary(x + iy=w8) -> (x=w13, y=w14)
      Absolute Value(x=w8) -> w15
      Build Array(w13, w14, w15) -> w4
    }
  }
  $PSD <- w5
  $"TX signal" <- w4
