vi "decode_one_counter_value.gvi"   [LabVIEW Communications System Design Suite 2.0.1]
inputs:
  "subarray": u8[]
outputs:
  "sum_1": u8
  "sum_2": u8
  "sum_3": u8
  "sum_4": u8
  "sum_5": u8
  "sum_6": u8
  "sum_7": u8
  "sum_8": u8
  "array": u8[]
diagram:
  Array Index(array=$subarray) -> (out0[_]=w1, out1[_]=w2)
  Number To Boolean Array(number=w1) -> (Boolean array=w3)
  Array Index(array=w3) -> (out0[_]=w4, out1[_]=w5, out2[_]=w6, out3[_]=w7, out4[_]=w8, out5[_]=w9, out6[_]=w10, out7[_]=w11)
  Boolean To Integer(Boolean=w4) -> (0, 1=w12)
  Boolean To Integer(Boolean=w5) -> (0, 1=w13)
  Add(w12, w13) -> w14: u8
  Boolean To Integer(Boolean=w6) -> (0, 1=w15)
  Boolean To Integer(Boolean=w7) -> (0, 1=w16)
  Add(w15, w16) -> w17: u8
  Boolean To Integer(Boolean=w8) -> (0, 1=w18)
  Boolean To Integer(Boolean=w9) -> (0, 1=w19)
  Add(w18, w19) -> w20: u8
  Boolean To Integer(Boolean=w10) -> (0, 1=w21)
  Boolean To Integer(Boolean=w11) -> (0, 1=w22)
  Add(w21, w22) -> w23: u8
  Number To Boolean Array(number=w2) -> (Boolean array=w24)
  Array Index(array=w24) -> (out0[_]=w25, out1[_]=w26, out2[_]=w27, out3[_]=w28, out4[_]=w29, out5[_]=w30, out6[_]=w31, out7[_]=w32)
  Boolean To Integer(Boolean=w25) -> (0, 1=w33)
  Boolean To Integer(Boolean=w26) -> (0, 1=w34)
  Add(w33, w34) -> w35: u8
  Boolean To Integer(Boolean=w27) -> (0, 1=w36)
  Boolean To Integer(Boolean=w28) -> (0, 1=w37)
  Add(w36, w37) -> w38: u8
  Boolean To Integer(Boolean=w29) -> (0, 1=w39)
  Boolean To Integer(Boolean=w30) -> (0, 1=w40)
  Add(w39, w40) -> w41: u8
  Boolean To Integer(Boolean=w31) -> (0, 1=w42)
  Boolean To Integer(Boolean=w32) -> (0, 1=w43)
  Add(w42, w43) -> w44: u8
  Build Array(w14, w17, w20, w23, w35, w38, w41, w44) -> w45
  $array <- w45
  $sum_1 <- w14
  $sum_2 <- w17
  $sum_3 <- w20
  $sum_4 <- w23
  $sum_5 <- w35
  $sum_6 <- w38
  $sum_7 <- w41
  $sum_8 <- w44
