vi "discreteDelay.gvi"   [LabVIEW Communications System Design Suite 2.0.1]
inputs:
  "in": u32
  "N": i32
outputs:
  "out": u32
diagram:
  Initialize Array(element=0, size=$N) -> w1
  Feedback Node(initial value=w1, input=w2) -> w3
  Build Array[ConcatenateInputs=True]($in, w3) -> w4
  Delete From Array(inArray=w4, index0=$N) -> (outArray=w2, deleted=w5)
  $out <- w5
