vi "genPreamble_fix.gvi"   [LabVIEW Communications System Design Suite 2.0.1]
inputs:
  "preamble scale": f64
outputs:
  "preambleOut": c128[]
panel indicators:
  "Time": f64[][]
  "ferq": f64[][]
uses:
  NI::Analysis::Transforms::Inverse Complex FFT.gvi
diagram:
  Complex To Real Imaginary(x + iy=[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]) -> (x=w1, y=w2)
  Absolute Value(x=[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]) -> w3
  Build Array(w1, w2, w3) -> w4
  $ferq <- w4
  call "Inverse Complex FFT.gvi"(FFT{x}=[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]) -> (x=w5)
  Build Array[ConcatenateInputs=True](w5, w5) -> w6
  call "norm CFX.gvi"(Input=w6) -> (Output=w7)
  Multiply(w7, $"preamble scale") -> w8
  $preambleOut <- w8
  Complex To Real Imaginary(x + iy=w8) -> (x=w9, y=w10)
  Absolute Value(x=w8) -> w11
  Build Array(w9, w10, w11) -> w12
  $Time <- w12
