vi "getInterleavingFactors.gvi"   [LabVIEW Communications System Design Suite 2.0.1]
inputs:
  "AB": u32
outputs:
  "A": u32
  "B": u32
panel indicators:
  "product": u32
uses:
  NI::Analysis::SpecialFunc::Prime Factor.gvi
diagram:
  call "Prime Factor.gvi"(n=$AB) -> (prime factors=w1)
  To Unsigned Long Integer(number=w1) -> w2
  Array Size(array=w2) -> (size(s)=w3)
  case (w3) {
    frame 1 {
      Array Index(array=w2) -> (out0[_]=w4)
      w5 = 1
    }
    frame 2 {
      Array Index(array=w2) -> (out0[_]=w4, out1[_]=w5)
    }
    frame 3, Default {
      Reverse 1D Array(array=w2) -> (reversed array=w6)
      Delete From Array(inArray=w6) -> (outArray=w7, deleted=w8)
      s1 = w8  # shift register
      s2 = 1  # shift register
      for {
        w9 = each element of w7
        Is Greater(x=s1, y=s2) -> w10
        case (w10) {
          frame False, Default {
            Multiply(s1, w9) -> w12
            w11 = s2
          }
          frame True {
            Multiply(w9, s2) -> w11
            w12 = s1
          }
        }
        next s1 = w12
        next s2 = w11
      }
      w4 = s1
      w5 = s2
    }
  }
  $A <- w4
  $B <- w5
  Multiply(w4, w5) -> w13
  $product <- w13
