vi "getResourceMap.gvi"   [LabVIEW Communications System Design Suite 2.0.1]
inputs:
  "RM:No DC": bool = TRUE
  "GFDM parameter": "GFDM parameter.gtype" = {"Variable: K"=64, "Variable: M"=9, "Variable: a"=0, "filter type"="rc", "receive filter"="ZF", "inverse FFT"=FALSE, "Variable: b"=0, "Ncs"=16, "Ncp"=32}
  "Use Phase Tracking": bool = TRUE
  "PacketSize [Byte]": u16 = 9
  "bits per symbol": u8 = 2
outputs:
  "error out": error
  "M_set": i16[]
  "K_set": i16[]
  "R_MAP": u8[]
  "GFDM B": u16
panel indicators:
  "N_AvailableResources [Symbol]": u16
  "N_UsedResources [Symbol]": u16
  "sum": i16
  "N_DataSym_per_block [Symbol]": u16
types:
  "GFDM parameter.gtype" = cluster{"Variable: K": i32, "Variable: M": i32, "Variable: a": f64, "filter type": enum{"rc", "rect"}, "receive filter": enum{"MF", "ZF"}, "inverse FFT": bool, "Variable: b": f64, "Ncs": u16, "Ncp": u16}
diagram:
  Property Node(instance in=$"GFDM parameter") -> ("Variable: K"=w1, "Variable: M"=w2)
  call "Preset K+M set.gvi"(No DC=$"RM:No DC", M=w2, K=w1) -> (M_set=w3, K_set=w4)
  Boolean To Integer(Boolean=$"Use Phase Tracking") -> (0, 1=w5)
  disable {
    frame Enabled {
      call "ResourceMapperOptimization2.gvi"(K_set=w4, M_set=w3, PayloadSize [Byte]=$"PacketSize [Byte]", ControlSize per Block [Symbol]=w5, K=w1, M=w2, Replace Control with Pilots=$"Use Phase Tracking", bits per symbol=$"bits per symbol") -> (R_MAP=w9, N_Blocks [Blocks]=w6, N_DataSym_per_block [Symbol]=w14, K_set_out=w11, M_set_out=w10, N_AvailableResources [Symbol]=w12, InsufficientResources=w8, N_UsedResources [Symbol]=w13, CanNotFit=w7)
    }
    frame Disabled {
      call "ResourceMapperOptimization.gvi"(K_set=w4, M_set=w3, PayloadSize [Byte]=$"PacketSize [Byte]", ControlSize [Symbol]=w5, K=w1, M=w2, Replace Control with Pilots=$"Use Phase Tracking") -> (R_MAP=w9, N_Blocks [Blocks]=w6, K_set_out=w11, M_set_out=w10, InsufficientResources=w8, CanNotFit=w7)
    }
  }
  $K_set <- w11
  $M_set <- w10
  Is Equal(x=1, y=w9) -> w15
  Boolean To Integer(Boolean=w15) -> (0, 1=w16)
  Add Array Elements(numeric array=w16) -> (sum=w17)
  $sum <- w17
  $R_MAP <- w9
  $"N_DataSym_per_block [Symbol]" <- w14
  $"GFDM B" <- w6
  Logical Or(w7, w8) -> w18
  Select(s=w18, t=error {"status"=TRUE, "code"=1, "source"="RM fault!"}, f=no error) -> w19
  $"error out" <- w19
  $"N_AvailableResources [Symbol]" <- w12
  $"N_UsedResources [Symbol]" <- w13
