vi "getTXdata.gvi"   [LabVIEW Communications System Design Suite 2.0.1]
inputs:
  "Add frame counter": bool
  "sendDebugData": bool
  "PayloadSize [byte]": u16
  "UdpReference": UdpNetworkConnectionRefnum
  "Read UDP?": bool
  "debugDataQueueName": string = "debugQueue"
  "ErrorIn": error
  "stopNotifierName": string = "globalStopNotifier"
  "txDataQueueName": string = "txDataQueue"
  "Random data?": bool
outputs:
  "ErrorOut": error
  "txDataQueueQut": Queue<"txDataQueueElementType.gtype">
  "debugQueueOut": Queue<"debugElementQueueType.gtype">
panel indicators:
  "UDP packet size [byte]": i32
  "GFDM block payload size [byte]": u32
  "half of the payload [byte]": f64
  "transmission frame size [byte]": i32
  "UDP receive FIFO full": bool
  "TX byte": u8[]
  "UDP receive error": string  # source out indicates the source of the error.
  "Number of GFDM blocks": u32
types:
  "txDataQueueElementType.gtype" = cluster{"sourceID": string, "Bytes": u8[]}
  "debugElementQueueType.gtype" = cluster{"sourceID": string, "JSONstring": string}
  T1 = cluster{"UDP receive error": string, "UDP packet size [byte]": i32, "transmission frame size [byte]": i32, "half of the payload [byte]": f64, "GFDM block payload size [byte]": u32, "TX byte": u8[], "Number of GFDM blocks": u32, "UDP receive FIFO full": bool}
diagram:
  # debug data will be written in this queue
  Obtain Queue(element data type="debugElementQueueType.gtype" {all zero or empty}, name=$debugDataQueueName) -> (queue out=w1)
  $debugQueueOut <- w1
  # generated data will be written in this queue
  Obtain Queue(element data type="txDataQueueElementType.gtype" {all zero or empty}, name=$txDataQueueName) -> (queue out=w2)
  $txDataQueueQut <- w2
  Obtain Notifier(element data type=bool FALSE, name=$stopNotifierName) -> (notifier out=w3)
  # reads UDP or generate a ramp
  # and puts the date into queue
  s1 = $ErrorIn  # shift register
  s2 = 0  # shift register
  while (iteration -> i1) {
    Increment(x=s2) -> w4
    case ($"Read UDP?") {
      frame False, Default {
        Multiply($"PayloadSize [byte]", 8) -> w10
        call "create bytes.gvi"(N bits=w10, Random data?=$"Random data?") -> (bytes out=w7)
        w5 = default
        w6 = default
        w8 = s1
        w9 = "Host"
      }
      frame True {
        call "UDP read.gvi"(UDP connection=$UdpReference, Error=s1) -> (receive FIFO full=w5, data out=w7, UDP receive error=w6, error out=w8)
        w9 = "UDP"
      }
    }
    Array Size(array=w7) -> (size(s)=w11)
    case ($"Add frame counter") {
      frame False, Default {
        w12 = w7
        w13 = default
        w14 = default
        w15 = default
        w16 = default
      }
      frame True {
        call "TX packet generator.gvi"(input data=w7, packet_counter=i1, gfdm block size[byte]=$"PayloadSize [byte]", overhead[byte]]=7) -> (payload=w13, split at=w14, generated length=w16, gfdm data=w12, gfdm blocks needed=w15)
        $"GFDM block payload size [byte]" <- w13
        $"half of the payload [byte]" <- w14
        $"transmission frame size [byte]" <- w16
        $"Number of GFDM blocks" <- w15
      }
    }
    Is Equal To 0(x=s2) -> w17
    Logical And($sendDebugData, w17) -> w18
    case (w18) {
      frame False, Default { }
      frame True {
        w19 = T1 {"UDP receive error"="", "UDP packet size [byte]"=9, "transmission frame size [byte]"=1491, "half of the payload [byte]"=32, "GFDM block payload size [byte]"=64, "TX byte"=[1, 2, 3, 4, 5, 6, 7, 8, 9], "Number of GFDM blocks"=21, "UDP receive FIFO full"=FALSE}
        Property Node(instance in=w19, "UDP receive error"=w6, "UDP packet size [byte]"=w11, "transmission frame size [byte]"=w16, "half of the payload [byte]"=w14, "GFDM block payload size [byte]"=w13, "TX byte"=w12, "Number of GFDM blocks"=w15, "UDP receive FIFO full"=w5) -> (instance out=w20)
        Flatten To JSON(anything=w20) -> (JSON string=w21)
        Property Node(instance in="debugElementQueueType.gtype" {all zero or empty}, "sourceID"="TxDebugData", "JSONstring"=w21) -> (instance out=w22)
        Enqueue Element(element=w22, queue=w1)
      }
    }
    Get Notifier Status(notifier=w3) -> (latest notification=w23)
    Logical Or(w23, s1) -> w24
    Wait[Units=Microseconds](time to wait=100)
    $"UDP packet size [byte]" <- w11
    $"TX byte" <- w12
    $"UDP receive FIFO full" <- w5
    $"UDP receive error" <- w6
    Property Node(instance in="txDataQueueElementType.gtype" {all zero or empty}, "sourceID"=w9, "Bytes"=w12) -> (instance out=w25)
    Enqueue Element(element=w25, error in=w8, queue=w2) -> (error out=w26)
    next s1 = w26
    next s2 = w4
    stop if w24
  }
  $ErrorOut <- s1
  case (s1) {
    frame No Error, Default { }
    frame Error {
      Send Notification(notification=TRUE, notifier=w3)
    }
  }
