vi "norm CDB.gvi"   [LabVIEW Communications System Design Suite 2.0.1]
inputs:
  "Array": c128[]
outputs:
  "out": c128[]
diagram:
  Complex To Real Imaginary(x + iy=$Array) -> (x=w1, y=w2)
  Build Array[ConcatenateInputs=True](w1, w2) -> w3
  Absolute Value(x=w3) -> w4
  Array Max And Min(array=w4) -> (max value=w5)
  Divide(x=$Array, y=w5) -> w6
  $out <- w6
