vi "packet test.gvi"   [LabVIEW Communications System Design Suite 2.0.1]
panel controls:
  "packet size[byte]": u32 = 1316
  "gfdm block size[byte]": u32 = 71
  "overhead[byte]]": u32
  "frame_counter": u8
  "stop": bool
panel indicators:
  "gfdm blocks needed": u32
  "gfdm data indicator": u8[]
  "gfdm data length": i32
  "gfdm data graph": u8[]
  "generated length": i32
  "split at": f64
  "payload size": u32
  "created data": u8[][]
  "element": u8
  "frame counter": u32
  "gfdm block number": u32
  "gfdm block count": u32
  "gfdm frame count": u32
diagram:
  w1 = $"gfdm block size[byte]"
  w2 = $"packet size[byte]"
  call "create ramp.gvi"(x / y=w2) -> (data in=w3)
  call "TX packet generator.gvi"(input data=w3, packet_counter=$frame_counter, gfdm block size[byte]=w1, overhead[byte]]=$"overhead[byte]]") -> (payload=w4, split at=w5, generated length=w6, gfdm data=w7, gfdm data length=w8, gfdm blocks needed=w9)
  $"payload size" <- w4
  $"split at" <- w5
  $"generated length" <- w6
  $"gfdm data length" <- w8
  $"gfdm blocks needed" <- w9
  $"gfdm data graph" <- w7
  $"gfdm data indicator" <- w7
  w10 = $stop
  Increment(x=$frame_counter) -> w11
  Increment(x=w11) -> w12
  call "TX packet generator.gvi"(input data=w3, packet_counter=w12, gfdm block size[byte]=w1, overhead[byte]]=$"overhead[byte]]") -> (gfdm data=w13)
  call "TX packet generator.gvi"(input data=w3, packet_counter=w11, gfdm block size[byte]=w1, overhead[byte]]=$"overhead[byte]]") -> (gfdm data=w14)
  Obtain Queue(element data type=u8 0) -> (error out=w15, queue out=w16)
  call "data_to_queue.gvi"(gfdm data=w7, queue out=w16, error out=w15) -> (Output=w17, Error=w18)
  call "data_to_queue.gvi"(gfdm data=w14, queue out=w17, error out=w18) -> (Output=w19, Error=w20)
  call "data_to_queue.gvi"(gfdm data=w13, queue out=w19, error out=w20) -> (Output=w21, Error=w22)
  while {
    Get Queue Status(queue=w21) -> (# elements in queue=w24)
    Is Equal To 0(x=w24) -> w25
    case (w25) {
      frame False, Default {
        w26 = default
        w27 = w21
        w28 = w22
        w29 = default
        w30 = default
        w31 = default
      }
      frame True {
        call "receive packet.gvi"(packet size[byte]=w2, payload=w4, split at_2=w5, gfdm block size[byte]=w1, gfdm blocks needed_2=w9, Output=w21, Error=w22, stop=w10, timeout in milliseconds=100) -> (element 2=w26, queue=w27, error in=w28, frame counter=w29, gfdm block number=w30, element=w31)
      }
    }
    append w26 to w23
    stop if w25
  }
  Build Array[ConcatenateInputs=True](w3, w23) -> w32
  $"created data" <- w32
  Release Queue(error in=w28, queue=w27)
  $element <- w31
  $"gfdm frame count" <- w29
  $"frame counter" <- w29
  $"gfdm block number" <- w30
  $"gfdm block count" <- w30
