vi "readDebugData_RxDemod.gvi"   [LabVIEW Communications System Design Suite 2.0.1]
inputs:
  "OperationIn": i32
  "FPGA.Interface": "FPGA interface.gtype"
  "Error": error
  "blockSize": u32
  "32/64 bit out?": bool
outputs:
  "Pilot-Betrag": UFXP(2.14)[]
  "Pilot-Phase": f64[]
  "RE_data": f64[]
  "IM_data": f64[]
  "IQ": c128[][]
  "errorOut": error
  "outputValid": bool
diagram:
  Host Fifo Read Node[FifoName="Needed Resources.grsc\\RX.Debug.Modem_64 bit samples out"](error in=$Error, number of elements=0, reference in=$"FPGA.Interface") -> (elements remaining=w1, error out=w2, reference out=w3)
  Host Fifo Read Node[FifoName="Needed Resources.grsc\\RX.Debug.Modem_32 bit samples out"](error in=$Error, number of elements=0, reference in=$"FPGA.Interface") -> (elements remaining=w4, error out=w5, reference out=w6)
  call "IntegerMultipleOf.gvi"(availableSize=w1, blockSize=$blockSize) -> (multipleOfBlockSize=w7)
  call "IntegerMultipleOf.gvi"(availableSize=w4, blockSize=$blockSize) -> (multipleOfBlockSize=w8)
  Is Not Equal To 0(x=w7) -> w9
  Is Not Equal To 0(x=w8) -> w10
  Logical And(w9, w10) -> w11
  case (w11) {
    frame False, Default {
      w12 = w2
      w13 = w5
      w14 = default
    }
    frame True {
      Host Fifo Read Node[FifoName="Needed Resources.grsc\\RX.Debug.Modem_64 bit samples out"](error in=w2, number of elements=w7, reference in=w3) -> (data=w15, error out=w12)
      Split Number(x=w15) -> (high(x)=w16, low(x)=w17)
      Is Equal(x=$OperationIn, y=0) -> w18
      case (w18) {
        frame False, Default { }
        frame True {
          call "Calculate Pilot Results.gvi"(received pilot array=w16)
        }
      }
      call "u32 array to 2.14 CFX.gvi"(data=w17) -> (Array=w19)
      To Double Precision Complex(number=w19) -> w20
      Is Equal(x=$OperationIn, y=4) -> w21
      case (w21) {
        frame False, Default { }
        frame True {
          Complex To Real Imaginary(x + iy=w20) -> (x=w22, y=w23)
          $RE_data <- w22
          $IM_data <- w23
        }
      }
      Host Fifo Read Node[FifoName="Needed Resources.grsc\\RX.Debug.Modem_32 bit samples out"](error in=w5, number of elements=w8, reference in=w6) -> (data=w24, error out=w13)
      call "u32 array to 2.14 CFX.gvi"(data=w24) -> (Array=w25)
      To Double Precision Complex(number=w25) -> w26
      Select(s=$"32/64 bit out?", t=w26, f=w20) -> w27
      Is Equal(x=$OperationIn, y=0) -> w28
      case (w28) {
        frame False, Default { }
        frame True {
          Build Array(w27) -> w29
          $IQ <- w29
        }
      }
      w14 = w11
    }
  }
  $outputValid <- w14
  Merge Errors(w12, w13) -> (error out=w30)
  $errorOut <- w30
