vi "readDebugData_RxSync.gvi"   [LabVIEW Communications System Design Suite 2.0.1]
inputs:
  "data": u32[]
  "normalize preamble?": bool = TRUE
  "parameters in": "GFDM all parameters.gtype"
  "Channel Length": i32 = 10
  "Fully allocated?": bool = TRUE
  "TX.sync.debugType": bool
outputs:
  "debugGraphSync": f64[][]
  "rms value": f64
  "Channel Freq. Resp.": c128[]
  "channel freq domain": f64[][]
  "channel time domain": f64[][]
types:
  "GFDM parameter.gtype" = cluster{"Variable: K": i32, "Variable: M": i32, "Variable: a": f64, "filter type": enum{"rc", "rect"}, "receive filter": enum{"MF", "ZF"}, "inverse FFT": bool, "Variable: b": f64, "Ncs": u16, "Ncp": u16}
  T1 = cluster{"Preamble mu": u16, "GFDM B": u16, "Preamble K": u16, "Preamble Ncp": u16, "GFDM Ncp": u16, "GFDM M": u16, "Preamble Ncs": u16, "GFDM K": u16, "GFDM Ncs": u16, "Preamble M": u16}
  "modem_configuration.gtype" = cluster{"K-1": u16, "M-1": u8, "N-1": u16, "N": u16, "Npreamble+CP+CS": u16, "Npreamble": u16, "Nw": u16, "Modulator MUX config": u64[16], "K": u16, "fft_size_log2(K)": u8, "inverse_fft": bool, "Start with preamble": bool, "Burstmode": bool, "Ncs": u16, "Ncp": u16, "N-Ncp": u16, "N+Ncp": u16, "N+Ncp+Ncs": u16, "Demodulator MUX config": u64[16], "M": u8, "DFT SIZE": FXP(6.0), "Frame length": u32, "Super frame length": u32, "Ns_all_GFDM_blocks": u32, "Ns_all_preambles": u32}
  T2 = cluster{"amount of symbols": u16[], "data elements [bits]": u16, "payload [bits]": f64, "payload [bytes]": f64, "half payload [byte]": f64}
  "GFDM all parameters.gtype" = cluster{"GFDM parameter": "GFDM parameter.gtype", "Sync config": T1, "Modem Configuration": "modem_configuration.gtype", "Preamble with CP, CS": c128[], "Preamble": c128[], "receiver filter gamma": c128[], "pulse shaping filter g": c128[], "rising window": c128[], "channel coefficients": c128[], "resource map as vector": enum{"Null", "Pilot", "Data"}[], "Pilots": c128[], "packet length": T2}
uses:
  NI::Analysis::Statistics::RMS (CDB).gvi
  NI::Analysis::Transforms::Inverse Complex FFT.gvi
diagram:
  case ($"TX.sync.debugType") {
    frame True {
      call "u32array to 1.15 CDB.gvi"(Array=$data) -> (arrayOut=w2)
      Complex To Real Imaginary(x + iy=w2) -> (x=w3, y=w4)
      Build Array(w3, w4) -> w1
    }
    frame False {
      call "u32 4.12 CFX to CDB array.gvi"(appended array=$data) -> (x=w5)
      call "RMS (CDB).gvi"(x=w5) -> (rms value=w6)
      $"rms value" <- w6
      Property Node(instance in=$"parameters in") -> ("Preamble"=w7, "Modem Configuration:N"=w8, "Sync config:Preamble K"=w9)
      call "norm CFX.gvi"(Input=w7) -> (Output=w10)
      call "norm CFX.gvi"(Input=w5) -> (Output=w11)
      Select(s=$"normalize preamble?", t=w11, f=w5) -> w12
      Build Array(w12, w10) -> w13
      Absolute Value(x=w13) -> w1
      call "Channel Estimation.gvi"(Rx signal=w11, Preamble=w10, Channel Length=$"Channel Length", preamble FFT size=w9, index=0, data FFT size=w8, Fully allocated?=$"Fully allocated?") -> (Channel Freq. Resp.=w14)
      $"Channel Freq. Resp." <- w14
      Absolute Value(x=w14) -> w15
      Complex To Polar(r * e^(i*theta)=w14) -> (theta=w16)
      Build Array(w15, w16) -> w17
      $"channel freq domain" <- w17
      call "Inverse Complex FFT.gvi"(FFT{x}=w14) -> (x=w18)
      Complex To Polar(r * e^(i*theta)=w18) -> (theta=w19)
      Absolute Value(x=w18) -> w20
      Build Array(w20, w19) -> w21
      $"channel time domain" <- w21
    }
  }
  $debugGraphSync <- w1
