vi "readFpgaDebugData.gvi"   [LabVIEW Communications System Design Suite 2.0.1]
inputs:
  "bits per symbol": u16 = 9
  "PanelOperationNotifierName": string = "PanelOperationNotifier"
  "syncDataOutGraphLength": u32
  "globalStopNotifierName": string = "globalStopNotifier"
  "debugQueueName": string = "debugQueue"
  "numberOfFramesToDisplay": f64 = 1
  "RX.sync.debugOut": bool
  "PayloadSize [Byte]": u16 = 9
  "FPGA.Interface In": "FPGA interface.gtype"
  "ErrorIn": error
  "GFDM all parameters": "GFDM all parameters.gtype"
outputs:
  "ErrorOut": error
types:
  "GFDM parameter.gtype" = cluster{"Variable: K": i32, "Variable: M": i32, "Variable: a": f64, "filter type": enum{"rc", "rect"}, "receive filter": enum{"MF", "ZF"}, "inverse FFT": bool, "Variable: b": f64, "Ncs": u16, "Ncp": u16}
  T1 = cluster{"Preamble mu": u16, "GFDM B": u16, "Preamble K": u16, "Preamble Ncp": u16, "GFDM Ncp": u16, "GFDM M": u16, "Preamble Ncs": u16, "GFDM K": u16, "GFDM Ncs": u16, "Preamble M": u16}
  "modem_configuration.gtype" = cluster{"K-1": u16, "M-1": u8, "N-1": u16, "N": u16, "Npreamble+CP+CS": u16, "Npreamble": u16, "Nw": u16, "Modulator MUX config": u64[16], "K": u16, "fft_size_log2(K)": u8, "inverse_fft": bool, "Start with preamble": bool, "Burstmode": bool, "Ncs": u16, "Ncp": u16, "N-Ncp": u16, "N+Ncp": u16, "N+Ncp+Ncs": u16, "Demodulator MUX config": u64[16], "M": u8, "DFT SIZE": FXP(6.0), "Frame length": u32, "Super frame length": u32, "Ns_all_GFDM_blocks": u32, "Ns_all_preambles": u32}
  T2 = cluster{"amount of symbols": u16[], "data elements [bits]": u16, "payload [bits]": f64, "payload [bytes]": f64, "half payload [byte]": f64}
  "GFDM all parameters.gtype" = cluster{"GFDM parameter": "GFDM parameter.gtype", "Sync config": T1, "Modem Configuration": "modem_configuration.gtype", "Preamble with CP, CS": c128[], "Preamble": c128[], "receiver filter gamma": c128[], "pulse shaping filter g": c128[], "rising window": c128[], "channel coefficients": c128[], "resource map as vector": enum{"Null", "Pilot", "Data"}[], "Pilots": c128[], "packet length": T2}
  "debugQueueElementType_u32.gtype" = cluster{"sourceID": string, "data": cluster{"u32": u32[]}[]}
diagram:
  Obtain Notifier(element data type=bool FALSE, name=$globalStopNotifierName) -> (notifier out=w1)
  Obtain Queue(element data type="debugQueueElementType_u32.gtype" {all zero or empty}, name=$debugQueueName) -> (queue out=w2)
  Obtain Notifier(element data type=i32 0, name=$PanelOperationNotifierName) -> (notifier out=w3)
  Property Node(instance in=$"GFDM all parameters") -> ("Preamble"=w4)
  Array Size(array=w4) -> (size(s)=w5)
  s1 = $ErrorIn  # shift register
  while {
    Get Notifier Status(notifier=w3) -> (latest notification=w6)
    Is Equal(x=w6, y=3) -> w7
    case ($"RX.sync.debugOut") {
      frame True {
        Host Fifo Read Node[FifoName="Needed Resources.grsc\\RX.Preamble out"](error in=s1, number of elements=0, reference in=$"FPGA.Interface In") -> (elements remaining=w9, error out=w10, reference out=w11)
        Is Greater Or Equal(x=w9, y=$syncDataOutGraphLength) -> w12
        case (w12) {
          frame False, Default {
            w8 = w10
          }
          frame True {
            Host Fifo Read Node[FifoName="Needed Resources.grsc\\RX.Preamble out"](error in=w10, number of elements=w9, reference in=w11) -> (data=w13, error out=w8)
            Build Cluster Array(w13) -> (out=w14)
            case (w7) {
              frame False, Default { }
              frame True {
                w15 = "debugQueueElementType_u32.gtype" {"sourceID"="rxDebugSyncDataOut", "data"=[]}
                Property Node(instance in=w15, "data"=w14) -> (instance out=w16)
                Enqueue Element(element=w16, queue=w2)
              }
            }
          }
        }
      }
      frame False {
        call "Preamble data available.gvi"(FPGA.Interface_in=$"FPGA.Interface In", Error_in=s1, length=w5) -> (FPGA.Interface_out=w17, Error_out=w18, Data available=w19)
        case (w19) {
          frame False, Default {
            w8 = w18
          }
          frame True {
            Host Fifo Read Node[FifoName="Needed Resources.grsc\\RX.Preamble out"](error in=w18, number of elements=w5, reference in=w17) -> (data=w20, error out=w21)
            case (w7) {
              frame False, Default {
                w8 = w21
              }
              frame True {
                w22 = "debugQueueElementType_u32.gtype" {"sourceID"="rxDebugPreambleOut", "data"=[]}
                Build Cluster Array(w20) -> (out=w23)
                Property Node(instance in=w22, "data"=w23) -> (instance out=w24)
                Enqueue Element(element=w24, error in=w21, queue=w2, timeout in ms=1000) -> (error out=w8)
              }
            }
          }
        }
      }
    }
    Get Notifier Status(notifier=w1) -> (latest notification=w25)
    Wait[Units=Microseconds](time to wait=100)
    next s1 = w8
    stop if w25
  }
  Multiply($numberOfFramesToDisplay, $"PayloadSize [Byte]", 8) -> w26
  # w27: QAM symbols per Frame
  Divide(x=w26, y=$"bits per symbol") -> w27
  s2 = $ErrorIn  # shift register
  while {
    Get Notifier Status(notifier=w1) -> (latest notification=w28)
    Get Notifier Status(notifier=w3) -> (latest notification=w29)
    Host Fifo Read Node[FifoName="Needed Resources.grsc\\RX.Debug.Modem_64 bit samples out"](error in=s2, number of elements=0, reference in=$"FPGA.Interface In") -> (elements remaining=w30, error out=w31, reference out=w32)
    Host Fifo Read Node[FifoName="Needed Resources.grsc\\RX.Debug.Modem_32 bit samples out"](error in=s2, number of elements=0, reference in=$"FPGA.Interface In") -> (elements remaining=w33, error out=w34, reference out=w35)
    call "IntegerMultipleOf.gvi"(availableSize=w30, blockSize=w27) -> (multipleOfBlockSize=w36)
    call "IntegerMultipleOf.gvi"(availableSize=w33, blockSize=w27) -> (multipleOfBlockSize=w37)
    Is Not Equal To 0(x=w36) -> w38
    Is Not Equal To 0(x=w37) -> w39
    Logical And(w38, w39) -> w40
    case (w40) {
      frame False, Default {
        Merge Errors(w31, w34) -> (error out=w41)
      }
      frame True {
        Is Equal(x=w29, y=0) -> w42
        Is Equal(x=w29, y=4) -> w43
        Logical Or(w42, w43) -> w44
        Host Fifo Read Node[FifoName="Needed Resources.grsc\\RX.Debug.Modem_32 bit samples out"](error in=w34, number of elements=w37, reference in=w35) -> (data=w45, error out=w46)
        Host Fifo Read Node[FifoName="Needed Resources.grsc\\RX.Debug.Modem_64 bit samples out"](error in=w31, number of elements=w36, reference in=w32) -> (data=w47, error out=w48)
        Split Number(x=w47) -> (high(x)=w49, low(x)=w50)
        Build Cluster Array(w49, w50, w45) -> (out=w51)
        Merge Errors(w48, w46) -> (error out=w52)
        case (w44) {
          frame False, Default {
            w41 = w52
          }
          frame True {
            w53 = "debugQueueElementType_u32.gtype" {"sourceID"="rxDebugIqDataOut", "data"=[]}
            Property Node(instance in=w53, "data"=w51) -> (instance out=w54)
            Enqueue Element(element=w54, error in=w52, queue=w2, timeout in ms=1000) -> (error out=w41)
          }
        }
      }
    }
    Wait[Units=Microseconds](time to wait=100)
    next s2 = w41
    stop if w28
  }
  Property Node(instance in=$"GFDM all parameters") -> ("Modem Configuration:Super frame length"=w55)
  s3 = $ErrorIn  # shift register
  while {
    Get Notifier Status(notifier=w1) -> (latest notification=w56)
    Get Notifier Status(notifier=w3) -> (latest notification=w57)
    Host Fifo Read Node[FifoName="Needed Resources.grsc\\TX.Debug.frame out"](error in=s3, number of elements=0, reference in=$"FPGA.Interface In") -> (elements remaining=w58, error out=w59, reference out=w60)
    Is Not Equal To 0(x=w58) -> w61
    case (w61) {
      frame False, Default {
        w62 = w59
      }
      frame True {
        Is Equal(x=w57, y=1) -> w63
        call "Blocks in FIFO.gvi"(requested lenght=w55, number of elements in FIFO=w58) -> (number of elements=w64)
        Host Fifo Read Node[FifoName="Needed Resources.grsc\\TX.Debug.frame out"](error in=w59, number of elements=w64, reference in=w60) -> (error out=w65, reference out=w66)
        Host Fifo Read Node[FifoName="Needed Resources.grsc\\TX.Debug.frame out"](error in=w65, number of elements=w55, reference in=w66) -> (data=w67, error out=w62)
        Build Cluster Array(w67) -> (out=w68)
        case (w63) {
          frame False, Default { }
          frame True {
            w69 = "debugQueueElementType_u32.gtype" {"sourceID"="txDebugFrameOut", "data"=[]}
            Property Node(instance in=w69, "data"=w68) -> (instance out=w70)
            Enqueue Element(element=w70, queue=w2, timeout in ms=1000)
          }
        }
      }
    }
    Wait[Units=Microseconds](time to wait=100)
    next s3 = w62
    stop if w56
  }
  Merge Errors(s3, s1, s2) -> (error out=w71)
  $ErrorOut <- w71
