vi "receive frame.gvi"   [LabVIEW Communications System Design Suite 2.0.1]
inputs:
  "Add frame counter": bool
  "UDP packet size [byte]": i32 = 9
  "GFDM block payload size [byte]": u32 = 64
  "half of the payload [byte]": f64 = 32
  "FPGA.Interface": "FPGA interface.gtype"
  "payload size [byte]": u16
  "Number of GFDM blocks": u32 = 21
  "UDP send port": u16 = 60000
  "Error": error
  "use CRC?": bool
  "UDP port (out)": UdpNetworkConnectionRefnum
  "packetCounterIn": u32
  "stopIn": bool
  "numbOfFramesForErrorRate": i32
outputs:
  "Received Bytes": u8[]
  "Decoder byte out": string
  "error detected": bool
  "UDP send error": string  # source out indicates the source of the error.
  "packet counter": u32
  "current angle": string
  "angle over time": i32
  "packetCounterOut": u32
  "currentErrorRate": f64
  "ErrorOut": error
  "errorRateOverall": f64
panel indicators:
  "size(s)": i32
  "size(s)_2": i32
  "received packets": u32
diagram:
  case ($"use CRC?") {
    frame False, Default {
      w1 = $"payload size [byte]"
    }
    frame True {
      Add($"payload size [byte]", 2) -> w1
    }
  }
  case ($"Add frame counter") {
    frame True {
      call "receive packet.gvi"(packet size[byte]=$"UDP packet size [byte]", payload=$"GFDM block payload size [byte]", split at_in=$"half of the payload [byte]", gfdm block size[byte]_in=w1, gfdm blocks needed_in=$"Number of GFDM blocks", Error_in=$Error, stop=$stopIn, timeout in milliseconds_in=5000, FPGA reference in=$"FPGA.Interface") -> (packet_out=w2, error in=w3, frame counter=w4)
    }
    frame False {
      Host Fifo Read Node[FifoName="Needed Resources.grsc\\RX.Data out.T2H"](error in=$Error, number of elements=w1, reference in=$"FPGA.Interface") -> (data=w2, error out=w3)
      w4 = default
    }
  }
  case ($"use CRC?") {
    frame False, Default {
      w5 = w2
      w6 = FALSE
    }
    frame True {
      call "CRC16_Detect.gvi"(CRC frame=w2, Poly=1021) -> (Payload=w5, err=w6)
    }
  }
  Array Size(array=w5) -> (size(s)=w7)
  $"size(s)_2" <- w7
  Array Size(array=w2) -> (size(s)=w8)
  $"size(s)" <- w8
  $"Received Bytes" <- w5
  Type Cast(type=string EmptyString, x=w5) -> w9
  $"Decoder byte out" <- w9
  call "UDP send.gvi"(UDP send.port or service name=$"UDP send port", Input=$"UDP port (out)", Array=w5, Error=w3) -> (Error_2=w10)
  $ErrorOut <- w10
  call "Decode angle.gvi"(error out=w3, output=w9) -> (description=w11, current angle=w12, angle over time=w13)
  $"UDP send error" <- w11
  $"current angle" <- w12
  $"angle over time" <- w13
  Increment(x=$packetCounterIn) -> w14
  $packetCounterOut <- w14
  $"received packets" <- w14
  $"packet counter" <- w4
  $"error detected" <- w6
  case ($"use CRC?") {
    frame False, Default { }
    frame True {
      Boolean To Integer(Boolean=w6) -> (0, 1=w15)
      To Unsigned Long Integer(number=w15) -> w16
      call "discreteDelay.gvi"(in=w16, N=$numbOfFramesForErrorRate) -> (out=w17)
      Feedback Node(input=w18) -> w19
      Subtract(x=w19, y=w17) -> w20
      Add(w16, w20) -> w18
      Divide(x=w18, y=$numbOfFramesForErrorRate) -> w21
      $currentErrorRate <- w21
      Feedback Node(input=w22) -> w23
      Add(w16, w23) -> w22
      Divide(x=w22, y=w14) -> w24
      $errorRateOverall <- w24
    }
  }
