vi "receivedDataSink.gvi"   [LabVIEW Communications System Design Suite 2.0.1]
inputs:
  "UDP send port": u16 = 60000
  "InputUDP": UdpNetworkConnectionRefnum
  "ErrorIn": error
  "fromSourceID": string = "receiveData"
  "toSourceID": string
  "rxDataQueueName": string = "rxDataQueue"
outputs:
  "ErrorOut": error
types:
  "txDataQueueElementType.gtype" = cluster{"sourceID": string, "Bytes": u8[]}
diagram:
  Obtain Notifier(element data type=bool FALSE, name="globalStopNotifier") -> (error out=w1, notifier out=w2)
  Obtain Queue(element data type="txDataQueueElementType.gtype" {all zero or empty}, name=$rxDataQueueName) -> (error out=w3, queue out=w4)
  s1 = $ErrorIn  # shift register
  while {
    Flush Queue(error in=w3, queue=w4) -> (remaining elements=w5)
    for {
      w6 = each element of w5
      Property Node(instance in=w6) -> ("sourceID"=w7, "Bytes"=w8)
      Is Equal(x=w7, y=$fromSourceID) -> w9
      case (w9) {
        frame False, Default {
          w10 = s1
        }
        frame True {
          case ($toSourceID) {
            frame "none", Default {
              w10 = s1
            }
            frame "UDP" {
              call "UDP send.gvi"(UDP send.port or service name=$"UDP send port", Input=$InputUDP, Array=w8, Error=s1) -> (Error_2=w10)
            }
          }
        }
      }
    }
    Get Notifier Status(error in (no error)=w1, notifier=w2) -> (latest notification=w11)
    Logical Or(w11, s1) -> w12
    next s1 = w10
    stop if w12
  }
  $ErrorOut <- s1
  case (s1) {
    frame No Error, Default { }
    frame Error {
      Send Notification(notification=TRUE, notifier=w2)
    }
  }
