vi "select right stream.gvi"   [LabVIEW Communications System Design Suite 2.0.1]
inputs:
  "Y_3": c128[][] = [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]
  "index": i32
outputs:
  "Input": c128[]
diagram:
  Transpose 2D Array(2D array=$Y_3) -> (transposed array=w1)
  for {
    w2 = each element of w1
    Array Index(array=w2) -> (out0[$index]=w4)
    append w4 to w3
  }
  $Input <- w3
