vi "test [TX] prepare packet.gvi"   [LabVIEW Communications System Design Suite 2.0.1]
panel controls:
  "next": bool
  "dataIn": u8[]
  "use CRC?": bool
  "addFrameCounter": bool
  "repeat options": T1 = "repeat all packets"
panel indicators:
  "DataOut_TX": u8[]
  "DataOut_RX": u8[]
  "[RX] packet type": u8
  "[RX] packet count": u8
  "Nof packets": u64
  "Nof packets wrong": u64
  "Nof packets correct": u64
types:
  T1 = enum{"repeat all packets", "repeat only type 0", "do not repeat"}
diagram:
  while {
    call "[TX] prepare packet.gvi"(addFrameCounter=$addFrameCounter, dataIn=$dataIn, repeat options=$"repeat options", use CRC?=$"use CRC?") -> (DataOut=w1)
    $DataOut_TX <- w1
    call "[RX] prepare packet.gvi"(dataIn=w1, use CRC?=$"use CRC?", repeat options=$"repeat options", packet type used?=FALSE, frame counter used?=$addFrameCounter) -> (DataOut=w2, packet type=w3, packet count=w4, Nof packets correct=w5, Nof packets wrong=w6, Nof packets=w7)
    $DataOut_RX <- w2
    while {
      stop if $next
    }
    $"[RX] packet type" <- w3
    $"[RX] packet count" <- w4
    $"Nof packets" <- w7
    $"Nof packets wrong" <- w6
    $"Nof packets correct" <- w5
    stop if FALSE
  }
