vi "transmitData.gvi"   [LabVIEW Communications System Design Suite 2.0.1]
inputs:
  "FPGA.Interface": "FPGA interface.gtype"
  "witch sourceID?": string = "default"
  "error in": error
  "txDataQueueName": string = "txDataQueue"
  "stopNotifier": string = "globalStopNotifier"
outputs:
  "ErrorOut": error
types:
  "txDataQueueElementType.gtype" = cluster{"sourceID": string, "Bytes": u8[]}
diagram:
  # by default all sources are transmittet
  Obtain Notifier(element data type=bool FALSE, name=$stopNotifier) -> (notifier out=w1)
  Obtain Queue(element data type="txDataQueueElementType.gtype" {all zero or empty}, error in=$"error in", name=$txDataQueueName) -> (error out=w2, queue out=w3)
  s1 = w2  # shift register
  while {
    Wait[Units=Microseconds](time to wait=10)
    Get Notifier Status(notifier=w1) -> (latest notification=w4)
    Flush Queue(error in=s1, queue=w3) -> (error out=w5, remaining elements=w6)
    s2 = w5  # shift register
    for {
      w7 = each element of w6
      Property Node(instance in=w7) -> ("Bytes"=w8, "sourceID"=w9)
      Is Equal(x=w9, y=$"witch sourceID?") -> w10
      Is Equal(x=$"witch sourceID?", y="") -> w11
      Is Equal(x=$"witch sourceID?", y="default") -> w12
      Logical Or(w10, w12, w11) -> w13
      case (w13) {
        frame False, Default {
          w14 = s2
        }
        frame True {
          Host Fifo Write Node[FifoName="Needed Resources.grsc\\TX.data in.H2T"](data=w8, error in=s2, reference in=$"FPGA.Interface") -> (error out=w14)
        }
      }
      next s2 = w14
    }
    Logical Or(s2, w4) -> w15
    next s1 = s2
    stop if w15
  }
  $ErrorOut <- s1
  case (s1) {
    frame No Error, Default { }
    frame Error {
      Send Notification(notification=TRUE, notifier=w1)
    }
  }
