vi "transmitt frame.gvi"   [LabVIEW Communications System Design Suite 2.0.1]
inputs:
  "Add frame counter": bool
  "gfdm block size [byte]": u16
  "UDP port": UdpNetworkConnectionRefnum
  "Read UDP?": bool
  "FPGA.Interface": "FPGA interface.gtype"
  "data type": bool
  "error in": error
  "loop iteration": i32
  "use CRC?": bool
outputs:
  "UDP packet size [byte]": i32
  "GFDM block payload size [byte]": u32
  "half of the payload [byte]": f64
  "transmission frame size [byte]": i32
  "UDP receive FIFO full": bool
  "TX byte (without CRC)": u8[]
  "UDP receive error": string  # source out indicates the source of the error.
  "Number of GFDM blocks": u32
  "Error out": error
panel indicators:
  "size(s)": i32
  "size(s)_2": i32
diagram:
  case ($"Read UDP?") {
    frame False, Default {
      Multiply($"gfdm block size [byte]", 8) -> w5
      call "create bytes.gvi"(N bits=w5, Random data?=$"data type") -> (bytes out=w3)
      w1 = default
      w2 = default
      w4 = $"error in"
    }
    frame True {
      call "UDP read.gvi"(UDP connection=$"UDP port", Error=$"error in") -> (receive FIFO full=w1, data out=w3, UDP receive error=w2, error out=w4)
    }
  }
  case ($"Add frame counter") {
    frame False, Default {
      w6 = w3
    }
    frame True {
      call "TX packet generator.gvi"(input data=w3, packet_counter=$"loop iteration", gfdm block size[byte]=$"gfdm block size [byte]", overhead[byte]]=7) -> (payload=w7, split at=w8, generated length=w9, gfdm data=w6, gfdm blocks needed=w10)
      $"GFDM block payload size [byte]" <- w7
      $"half of the payload [byte]" <- w8
      $"transmission frame size [byte]" <- w9
      $"Number of GFDM blocks" <- w10
    }
  }
  Array Size(array=w6) -> (size(s)=w11)
  $"size(s)" <- w11
  case ($"use CRC?") {
    frame False, Default {
      w12 = w6
    }
    frame True {
      call "CRC16_Append.gvi"(Payload=w6, Poly=1021) -> (CRC frame=w12)
    }
  }
  Array Size(array=w12) -> (size(s)=w13)
  $"size(s)_2" <- w13
  Array Size(array=w3) -> (size(s)=w14)
  $"UDP packet size [byte]" <- w14
  $"UDP receive FIFO full" <- w1
  $"TX byte (without CRC)" <- w6
  $"UDP receive error" <- w2
  Host Fifo Write Node[FifoName="Needed Resources.grsc\\TX.data in.H2T"](data=w12, error in=w4, reference in=$"FPGA.Interface") -> (error out=w15)
  $"Error out" <- w15
