vi "transmittAndReceiveData.gvi"   [LabVIEW Communications System Design Suite 2.0.1]
inputs:
  "UDP packet size [byte]": i32 = 9
  "GFDM block payload size [byte]": u32 = 64
  "Add frame counter": bool
  "half of the payload [byte]": f64 = 32
  "FPGA.Interface": "FPGA interface.gtype"
  "PayloadSize [Byte]": u16
  "Number of GFDM blocks": u32 = 21
  "sendDebugData?": bool
  "Error": error
  "debugQueueName": string = "debugQueue"
  "numbOfFramesForErrorRate": i32 = 128
outputs:
  "ErrorOut": error
panel controls:
  "TX.witch sourceID?": string = "default"
  "txDataQueueName": string = "txDataQueue"
  "stopNotifier": string = "globalStopNotifier"
  "rxDataQueueName": string = "rxDataQueue"
panel indicators:
  "Received Bytes": u8[]
  "loop iteration": i32
  "loop iteration_2": i32
  "Decoder byte out": string
types:
  "debugElementQueueType.gtype" = cluster{"sourceID": string, "JSONstring": string}
  "txDataQueueElementType.gtype" = cluster{"sourceID": string, "Bytes": u8[]}
  T1 = cluster{"current angle": string, "UDP send error": string, "received packets": u32, "paket counter": u32, "angle over time": i32, "rxBytes": u8[], "frameErrorRate": f64}
diagram:
  Obtain Queue(element data type="debugElementQueueType.gtype" {all zero or empty}, error in=$Error, name=$debugQueueName) -> (queue out=w1)
  Obtain Notifier(element data type=bool FALSE, error in=$Error, name=$stopNotifier) -> (notifier out=w2)
  Obtain Queue(element data type="txDataQueueElementType.gtype" {all zero or empty}, name=$rxDataQueueName) -> (queue out=w3)
  Add($"PayloadSize [Byte]", 0) -> w4
  s1 = 0  # shift register
  s2 = 0  # shift register
  s3 = 0  # shift register
  while (iteration -> i1) {
    Host Fifo Read Node[FifoName="Needed Resources.grsc\\RX.Data out.T2H"](error in=$Error, number of elements=0, reference in=$"FPGA.Interface") -> (elements remaining=w5, error out=w6, reference out=w7)
    Get Notifier Status(notifier=w2) -> (latest notification=w8)
    Is Not Equal To 0(x=w5) -> w9
    # RECEIVE
    case (w9) {
      frame False, Default {
        w10 = s1
        w11 = w6
        w12 = s2
        w13 = s3
      }
      frame True {
        Increment(x=s2) -> w12
        Increment(x=s1) -> w10
        case ($"Add frame counter") {
          frame True {
            call "receive packet.gvi"(packet size[byte]=$"UDP packet size [byte]", payload=$"GFDM block payload size [byte]", split at_in=$"half of the payload [byte]", gfdm block size[byte]_in=w4, gfdm blocks needed_in=$"Number of GFDM blocks", Error_in=w6, stop=w8, timeout in milliseconds_in=5000, FPGA reference in=w7) -> (packet_out=w14, error in=w15, frame counter=w16)
          }
          frame False {
            Host Fifo Read Node[FifoName="Needed Resources.grsc\\RX.Data out.T2H"](error in=w6, number of elements=w4, reference in=w7) -> (data=w14, error out=w15)
            w16 = w10
          }
        }
        w17 = "debugElementQueueType.gtype" {"sourceID"="receiveData", "JSONstring"=""}
        w18 = T1 {"UDP send error"="No Error", "received packets"=10960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}
        disable {
          frame Enabled {
            w19 = w14
            w20 = default
          }
          frame Disabled {
            call "CRC_Detect.gvi"(CRC frame=w14, Poly=1021) -> (Payload=w19, err=w20)
          }
        }
        Type Cast(type=string EmptyString, x=w19) -> w21
        call "Decode angle.gvi"(error out=w15, output=w21) -> (description=w22, current angle=w23, angle over time=w24)
        Boolean To Integer(Boolean=w20) -> (0, 1=w25)
        To Unsigned Long Integer(number=w25) -> w26
        call "discreteDelay.gvi"(in=w26, N=$numbOfFramesForErrorRate) -> (out=w27)
        Subtract(x=s3, y=w27) -> w28
        Add(w26, w28) -> w13
        Divide(x=w13, y=$numbOfFramesForErrorRate) -> w29
        Property Node(instance in=w18, "paket counter"=w16, "UDP send error"=w22, "current angle"=w23, "angle over time"=w24, "received packets"=w10, "rxBytes"=w19, "frameErrorRate"=w29) -> (instance out=w30)
        Logical And($"sendDebugData?", FALSE) -> w31
        case (w31) {
          frame False, Default { }
          frame True {
            Flatten To JSON(anything=w30, error in (no error)=w15) -> (JSON string=w32)
            Property Node(instance in=w17, "JSONstring"=w32) -> (instance out=w33)
            Enqueue Element(element=w33, error in=w15, queue=w1)
          }
        }
        Is Equal To 0(x=s2)
        $"Received Bytes" <- w19
        $"Decoder byte out" <- w21
        Property Node(instance in="txDataQueueElementType.gtype" {all zero or empty}, "sourceID"="receiveData", "Bytes"=w19) -> (instance out=w34)
        Enqueue Element(element=w34, error in=w15, queue=w3) -> (error out=w35)
        Merge Errors(w35, w15) -> (error out=w11)
      }
    }
    Merge Errors(w11, $Error) -> (error out=w36)
    Wait[Units=Microseconds](time to wait=10)
    Logical Or(w8, $Error) -> w37
    $"loop iteration" <- i1
    next s1 = w10
    next s2 = w12
    next s3 = w13
    stop if w37
  }
  Obtain Queue(element data type="txDataQueueElementType.gtype" {all zero or empty}, error in=$Error, name=$txDataQueueName) -> (error out=w38, queue out=w39)
  w40 = $"TX.witch sourceID?"
  while (iteration -> i2) {
    Wait[Units=Microseconds](time to wait=10)
    Flush Queue(error in=w38, queue=w39) -> (error out=w41, remaining elements=w42)
    # by default all sources are transmittet
    s4 = w41  # shift register
    for {
      w43 = each element of w42
      Property Node(instance in=w43) -> ("Bytes"=w44, "sourceID"=w45)
      Is Equal(x=w45, y=w40) -> w46
      Is Equal(x=w40, y="") -> w47
      Is Equal(x=w40, y="default") -> w48
      Logical Or(w46, w48, w47) -> w49
      # TRANSMITT
      disable {
        frame Enabled {
          w50 = w44
        }
        frame Disabled {
          call "CRC_Append.gvi"(Payload=w44, Poly=1021) -> (CRC frame=w50)
        }
      }
      case (w49) {
        frame False, Default {
          w51 = s4
        }
        frame True {
          Host Fifo Write Node[FifoName="Needed Resources.grsc\\TX.data in.H2T"](data=w50, error in=s4, reference in=$"FPGA.Interface") -> (error out=w51)
        }
      }
      next s4 = w51
    }
    Get Notifier Status(notifier=w2) -> (latest notification=w52)
    Logical Or(w52, w38) -> w53
    $"loop iteration_2" <- i2
    stop if w53
  }
  Merge Errors(s4, w36) -> (error out=w54)
  $ErrorOut <- w54
  case (w54) {
    frame No Error, Default { }
    frame Error {
      Send Notification(notification=TRUE, notifier=w2)
    }
  }
