vi "Abort Stream.gvi"   [LabVIEW Communications System Design Suite 2.0.1]
inputs:
  "niUsrpRio Session": "niUsrpRio Config v1 Host.lvlib__niUsrpRio Session.gtype" = {"EEPROM Header"={"Number of Reserved Bytes"=9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}, "Device Data Header"={"Number of Reserved Bytes"=27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}, "EEPROM Characterization Header"={"Number of Reserved Bytes"=28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}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}
  "check stream status": bool
  "timeout": f64 = 10
  "error in": error
  "scope": string = "rx"
outputs:
  "niUsrpRio Session (out)": "niUsrpRio Config v1 Host.lvlib__niUsrpRio Session.gtype"
  "error out": error
panel controls:
  "ConstantData": any
panel indicators:
  "state": enum{"Idle", "Active"}
  "samples processed": u32
types:
  "niInstr Register Bus v0 Host.lvlib__Register Bus Session.gtype" = Queue<"niInstr Register Bus v0 Host.lvlib__Session Data.gtype">
  "Semaphore RefNum.gtype" = i32
  "niUsrpRio Config v1 Host.lvlib__DB Queue Reference.gtype" = Queue<"niUsrpRio Config v1 Host.lvlib__Daughterboard Data.gtype">
  "niUsrpRio Config v1 Host.lvlib__EEPROM Header.gtype" = cluster{"Checksum": u32, "Product Code": u16, "Hardware Current Version": u16, "Hardware Oldest Compatible Version": u16, "EEPROM Map Current Version": u16, "EEPROM Map Oldest Compatible Version": u16, "User Password": string, "Pointer to Factory Header": u32, "Pointer to User Header": u32, "Recommended Interval": u16, "Number of Reserved Bytes": i32, "Number of Daughterboards": u8, "Daughterboard IDs": u16[], "Daughterboard Serial Numbers": string[]}
  "niUsrpRio Config v1 Host.lvlib__EEPROM Device Data Header.gtype" = cluster{"Checksum": u32, "Number of Channels": u8, "Number of Gain Settings": u16[], "Pointer to Characterization Data": u32[], "Number of Reserved Bytes": i32, "Number of Frequencies": u16[]}
  "niUsrpRio Config v1 Host.lvlib__EEPROM Characterization Header.gtype" = cluster{"Checksum": u32, "Date": timestamp, "Temperature": f32, "Misc. Info": string, "Pointer to Device Data Header": u32, "Number of Reserved Bytes": i32}
  "niUsrpRio Config v1 Host.lvlib__Characterization Data.gtype" = cluster{"Gains[dB]": f64[], "Frequencies [Hz]": f64[], "IQ Imbalance Table": "niUsrpRio Config v1 Host.lvlib__IQ Imbalance.gtype"[], "Measured Gains[dB]": f64[][]}
  "niUsrpRio Config v1 Host.lvlib__niUsrpRio Session.gtype" = cluster{"FPGA Interface": any, "RIO Interface Number": u32, "Data Clock Rate": u32, "FPGA Data Clock Rate": u32, "Global Settings Register Bus": "niInstr Register Bus v0 Host.lvlib__Register Bus Session.gtype", "Radio 0 Settings Register Bus": "niInstr Register Bus v0 Host.lvlib__Register Bus Session.gtype", "Radio 1 Settings Register Bus": "niInstr Register Bus v0 Host.lvlib__Register Bus Session.gtype", "Radio Settings Bus Semaphore": "Semaphore RefNum.gtype", "DB Queues": "niUsrpRio Config v1 Host.lvlib__DB Queue Reference.gtype"[], "Characterization Data Valid?": bool, "EEPROM Header": "niUsrpRio Config v1 Host.lvlib__EEPROM Header.gtype", "Device Data Header": "niUsrpRio Config v1 Host.lvlib__EEPROM Device Data Header.gtype", "EEPROM Characterization Header": "niUsrpRio Config v1 Host.lvlib__EEPROM Characterization Header.gtype", "Characterization Data": "niUsrpRio Config v1 Host.lvlib__Characterization Data.gtype"[], "FPGA Current Version": u32, "FPGA Oldest Compatible Version": u32, "Fixed Logic Current Version": u32, "Fixed Logic Oldest Compatible Version": u32, "FPGA Radio Settings Bus Current Version": u32, "FPGA Radio Settings Bus Oldest Compatible Version": u32, "FPGA Board Config Current Version": u32, "FPGA Board Config Oldest Compatible Version": u32}
diagram:
  call "niUsrpRio Config v1 Host.lvlib__Parse Scope.gvi"(niUsrpRio Session=$"niUsrpRio Session", error in=$"error in", scope=$scope) -> (niUsrpRio Session (out)=w1, Device Subfunction=w2, error out=w3)
  $"niUsrpRio Session (out)" <- w1
  Property Node(instance in=w1) -> ("FPGA Interface"=w4)
  Dynamic Fpga Interface Cast(reference in=w4, type=$ConstantData) -> (reference out=w5)
  case (w2) {
    frame "tx" {
      Property Node(instance in=w5, "tx.abort"=TRUE, "tx.trigger enable"=FALSE, error in=w3) -> (error out=w10, instance out=w11)
      s1 = w10  # shift register
      while (iteration -> i1) {
        Property Node(instance in=w11, error in=s1) -> ("tx.samples processed"=w9, "tx.state"=w7, error out=w12)
        Is Equal To 0(x=i1) -> w13
        call "Elapsed Time.gvi"(Time Target (s)=$timeout, Reset=w13) -> (Time has Elapsed=w14)
        Is Equal(x=w7, y="Idle") -> w8
        Logical Or(w12, w8, w14) -> w15
        next s1 = w12
        stop if w15
      }
      w6 = s1
    }
    frame "rx", Default {
      Property Node(instance in=w5, "rx.abort"=TRUE, "rx.trigger enable"=FALSE, error in=w3) -> (error out=w16, instance out=w17)
      s2 = w16  # shift register
      while (iteration -> i2) {
        Property Node(instance in=w17, error in=s2) -> ("rx.samples processed"=w9, "rx.state"=w7, error out=w18)
        Is Equal To 0(x=i2) -> w19
        call "Elapsed Time.gvi"(Time Target (s)=$timeout, Reset=w19) -> (Time has Elapsed=w20)
        Is Equal(x=w7, y="Idle") -> w8
        Logical Or(w18, w8, w20) -> w21
        next s2 = w18
        stop if w21
      }
      w6 = s2
    }
  }
  case (w8) {
    frame True {
      w22 = w6
    }
    frame False {
      call "Error Cluster From Error Code.gvi"(error code=-1, error message="Abort Timeout", show call chain?=TRUE) -> (error out=w23)
      Merge Errors(w6, w23) -> (error out=w22)
    }
  }
  # Checking the stream status may report erroneous underflows/overflows when aborting continuous transfers. Do not check the stream status by default (to avoid erroneous warnings).
  case ($"check stream status") {
    frame False, Default {
      w24 = w22
    }
    frame True {
      call "Check Stream Status.gvi"(niUsrpRio Session=w1, error in=w22, scope=$scope) -> (error out=w24)
    }
  }
  $"error out" <- w24
  $"samples processed" <- w9
  $state <- w7
