vi "Calculate IQ Power Level.gvi"   [LabVIEW Communications System Design Suite 2.0.1]
inputs:
  "IQ data": c128[]
outputs:
  "power level (dBm)": f64[]
diagram:
  w1 = TRUE  # Enable
  Complex To Real Imaginary(x + iy=$"IQ data") -> (x=w2, y=w3)
  Square(x=w2) -> w4
  # Convert (Volts-peak)^2 to dBm
  #
  # dBm = 10 * log(1000 * Vrms sq / 50)
  #          = 10 * log(1000 * ((Vpeak sq)/2) / 50)
  #          = 10 * log(1000 * (Vpeak sq) / 100)
  #          = 10 * log(10 * Vpeak sq)
  Square(x=w3) -> w5
  Add(w4, w5) -> w6
  case (w1) {
    frame True, Default {
      Multiply(10, w6) -> w8
      Logarithm Base 10(x=w8) -> w9
      Multiply(10, w9) -> w7
    }
    frame False {
      w7 = default
    }
  }
  $"power level (dBm)" <- w7
