vi "Calculate Power Spectrum.gvi"   [LabVIEW Communications System Design Suite 2.0.1]
inputs:
  "iq data": cluster{"t0": timestamp, "dt": f64, "Y": c128[]}
outputs:
  "power spectrum": T1
types:
  T1 = cluster{"f0": f64, "df": f64, "magnitude": f64[]}
uses:
  NI::Analysis::Measurement::FFT Power Spectrum and PSD for 1 Chan Compatibility (CDB).gvi
diagram:
  call "FFT Power Spectrum and PSD for 1 Chan Compatibility (CDB).gvi"(signal=$"iq data") -> (power spectrum=w1)
  # Convert (Volts-peak)^2 to dBm
  #
  # dBm = 10 * log(1000 * Vrms sq / 50)
  #          = 10 * log(1000 * ((Vpeak sq)/2) / 50)
  #          = 10 * log(1000 * (Vpeak sq) / 100)
  #          = 10 * log(10 * Vpeak sq)
  # With the Spectral Measurements Toolkit, conversions like these can be done using the "SMT Spectrum Unit Conversion" VI. SMT also contains many optimized forms of FFT processing, which would increase the speed of forming the power spectrum shown here. See this page for more information:
  #
  # http://sine.ni.com/nips/cds/view/p/lang/en/nid/210567
  Property Node(instance in=w1) -> ("magnitude"=w2)
  Multiply(10, w2) -> w3
  Logarithm Base 10(x=w3) -> w4
  Multiply(10, w4) -> w5
  Property Node(instance in=w1, "magnitude"=w5) -> (instance out=w6)
  $"power spectrum" <- w6
