vi "Calculate Sample Rate.gvi"   [LabVIEW Communications System Design Suite 2.0.1]
inputs:
  "data clock rate": f64 = 120000000
  "sample rate": f64 = 10000000
outputs:
  "decimation sample rate": UFXP(1.47)
  "coerced sample rate": f64
diagram:
  # Fractional resampling is enabled.  You can use any I/Q rate within the valid range.
  # Compute the coerced I/Q rate.  The I/Q rate is coerced based upon the resolution of the fractional decimator.  When you coerce the value, always round up to guarantee enough signal bandwidth to accommodate the desired I/Q rate. This guarantees that we have enough signal bandwidth to accommodate the desired I/Q rate.  Notice that the coercion math uses extended precision. This provides enough precision to ensure that values round properly. The VI uses the following coercion algorithm:
  #
  # 1.  Compute the desired decimation output sample rate (using extended precision).
  # 2.  Convert the decimation output sample rate to fixed point.  Use the Truncate rounding mode.
  # 3.  Compare the fixed point decimation output sample rate with the original extended precision value.  If they differ, add one LSB to the fixed point number.  This ensures that we round up to the next highest value.
  # 4.  Calculate the coerced I/Q rate using the coerced decimation output sample rate.
  To Double Precision Float(number=65536) -> w1
  Divide(x=$"data clock rate", y=w1) -> w2
  In Range And Coerce[IncludeHighLimit=True](lower limit=w2, upper limit=$"data clock rate", x=$"sample rate") -> (coerced(x)=w3)
  Divide(x=w3, y=$"data clock rate") -> w4
  To Fixed Point(fixed-point type=UFXP(1.47) 0, number=w4) -> w5
  To Double Precision Float(number=w5) -> w6
  Is Equal(x=w4, y=w6) -> w7
  case (w7) {
    frame False, Default {
      Add(w5, 7.1054273576e-15) -> w8: UFXP(1.47) Saturate:ConvergentRounding
    }
    frame True {
      w8 = w5
    }
  }
  To Double Precision Float(number=w8) -> w9
  Multiply($"data clock rate", w9) -> w10
  To Double Precision Float(number=w10) -> w11
  $"coerced sample rate" <- w11
  $"decimation sample rate" <- w8
