vi "Check Stream Status.gvi"   [LabVIEW Communications System Design Suite 2.0.1]
inputs:
  "niUsrpRio Session": "niUsrpRio Config v1 Host.lvlib__niUsrpRio Session.gtype" = {"EEPROM Header"={"Number of Reserved Bytes"=9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}, "Device Data Header"={"Number of Reserved Bytes"=27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}, "EEPROM Characterization Header"={"Number of Reserved Bytes"=28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}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}
  "error in": error
  "scope": string = "rx"
  "reference frequency source": string = "Internal"
outputs:
  "niUsrpRio Session (out)": "niUsrpRio Config v1 Host.lvlib__niUsrpRio Session.gtype"
  "done": bool
  "error out": error
panel controls:
  "ConstantData": any
types:
  "niInstr Register Bus v0 Host.lvlib__Register Bus Session.gtype" = Queue<"niInstr Register Bus v0 Host.lvlib__Session Data.gtype">
  "Semaphore RefNum.gtype" = i32
  "niUsrpRio Config v1 Host.lvlib__DB Queue Reference.gtype" = Queue<"niUsrpRio Config v1 Host.lvlib__Daughterboard Data.gtype">
  "niUsrpRio Config v1 Host.lvlib__EEPROM Header.gtype" = cluster{"Checksum": u32, "Product Code": u16, "Hardware Current Version": u16, "Hardware Oldest Compatible Version": u16, "EEPROM Map Current Version": u16, "EEPROM Map Oldest Compatible Version": u16, "User Password": string, "Pointer to Factory Header": u32, "Pointer to User Header": u32, "Recommended Interval": u16, "Number of Reserved Bytes": i32, "Number of Daughterboards": u8, "Daughterboard IDs": u16[], "Daughterboard Serial Numbers": string[]}
  "niUsrpRio Config v1 Host.lvlib__EEPROM Device Data Header.gtype" = cluster{"Checksum": u32, "Number of Channels": u8, "Number of Gain Settings": u16[], "Pointer to Characterization Data": u32[], "Number of Reserved Bytes": i32, "Number of Frequencies": u16[]}
  "niUsrpRio Config v1 Host.lvlib__EEPROM Characterization Header.gtype" = cluster{"Checksum": u32, "Date": timestamp, "Temperature": f32, "Misc. Info": string, "Pointer to Device Data Header": u32, "Number of Reserved Bytes": i32}
  "niUsrpRio Config v1 Host.lvlib__Characterization Data.gtype" = cluster{"Gains[dB]": f64[], "Frequencies [Hz]": f64[], "IQ Imbalance Table": "niUsrpRio Config v1 Host.lvlib__IQ Imbalance.gtype"[], "Measured Gains[dB]": f64[][]}
  "niUsrpRio Config v1 Host.lvlib__niUsrpRio Session.gtype" = cluster{"FPGA Interface": any, "RIO Interface Number": u32, "Data Clock Rate": u32, "FPGA Data Clock Rate": u32, "Global Settings Register Bus": "niInstr Register Bus v0 Host.lvlib__Register Bus Session.gtype", "Radio 0 Settings Register Bus": "niInstr Register Bus v0 Host.lvlib__Register Bus Session.gtype", "Radio 1 Settings Register Bus": "niInstr Register Bus v0 Host.lvlib__Register Bus Session.gtype", "Radio Settings Bus Semaphore": "Semaphore RefNum.gtype", "DB Queues": "niUsrpRio Config v1 Host.lvlib__DB Queue Reference.gtype"[], "Characterization Data Valid?": bool, "EEPROM Header": "niUsrpRio Config v1 Host.lvlib__EEPROM Header.gtype", "Device Data Header": "niUsrpRio Config v1 Host.lvlib__EEPROM Device Data Header.gtype", "EEPROM Characterization Header": "niUsrpRio Config v1 Host.lvlib__EEPROM Characterization Header.gtype", "Characterization Data": "niUsrpRio Config v1 Host.lvlib__Characterization Data.gtype"[], "FPGA Current Version": u32, "FPGA Oldest Compatible Version": u32, "Fixed Logic Current Version": u32, "Fixed Logic Oldest Compatible Version": u32, "FPGA Radio Settings Bus Current Version": u32, "FPGA Radio Settings Bus Oldest Compatible Version": u32, "FPGA Board Config Current Version": u32, "FPGA Board Config Oldest Compatible Version": u32}
diagram:
  # #NOTE: If using GPS, make sure to wait for GPS to lock in order to not get false warnings related to the GPS becoming unlocked during execution.
  case ($"reference frequency source") {
    frame Default {
      w1 = $"niUsrpRio Session"
      w2 = $"error in"
    }
    frame "GPS" {
      call "niUsrpRio Config v1 Host.lvlib__Query Status.gvi"(niUsrpRio Session=$"niUsrpRio Session", What to Query for="GPS Ever Unlocked", Error In=$"error in", scope=$scope) -> (niUsrpRio Session (out)=w1, Status=w3, Error Out=w4)
      Select(s=w3, t=1, f=0) -> w5
      call "Error Cluster From Error Code.gvi"(error code=w5, error message="GPS became unlocked", error in=w4, show call chain?=TRUE, is warning?=TRUE) -> (error out=w2)
    }
  }
  call "niUsrpRio Config v1 Host.lvlib__Query Status.gvi"(niUsrpRio Session=w1, What to Query for="Clock Chip Ever Unlocked", Error In=w2, scope=$scope) -> (niUsrpRio Session (out)=w6, Status=w7, Error Out=w8)
  Select(s=w7, t=1, f=0) -> w9
  call "Error Cluster From Error Code.gvi"(error code=w9, error message="Clock chip became unlocked", error in=w8, show call chain?=TRUE, is warning?=TRUE) -> (error out=w10)
  call "niUsrpRio Config v1 Host.lvlib__Query Status.gvi"(niUsrpRio Session=w6, What to Query for="Data Clock PLL Ever Unlocked", Error In=w10, scope=$scope) -> (niUsrpRio Session (out)=w11, Status=w12, Error Out=w13)
  Select(s=w12, t=1, f=0) -> w14
  call "Error Cluster From Error Code.gvi"(error code=w14, error message="Data Clock PLL became unlocked", error in=w13, show call chain?=TRUE, is warning?=TRUE) -> (error out=w15)
  call "niUsrpRio Config v1 Host.lvlib__Query Status.gvi"(niUsrpRio Session=w11, What to Query for="ADC Clock PLL Ever Unlocked", Error In=w15, scope=$scope) -> (niUsrpRio Session (out)=w16, Status=w17, Error Out=w18)
  Select(s=w17, t=1, f=0) -> w19
  call "Error Cluster From Error Code.gvi"(error code=w19, error message="ADC Clock PLL became unlocked", error in=w18, show call chain?=TRUE, is warning?=TRUE) -> (error out=w20)
  call "niUsrpRio Config v1 Host.lvlib__Query Status.gvi"(niUsrpRio Session=w16, What to Query for="ADC Data Ever Invalid", Error In=w20, scope=$scope) -> (niUsrpRio Session (out)=w21, Status=w22, Error Out=w23)
  Select(s=w22, t=1, f=0) -> w24
  call "Error Cluster From Error Code.gvi"(error code=w24, error message="ADC data became invalid", error in=w23, show call chain?=TRUE, is warning?=TRUE) -> (error out=w25)
  call "niUsrpRio Config v1 Host.lvlib__Parse Scope.gvi"(niUsrpRio Session=w21, error in=w25, scope=$scope) -> (niUsrpRio Session (out)=w26, Device Subfunction=w27, Device Subfunction Channel=w28, error out=w29)
  $"niUsrpRio Session (out)" <- w26
  Property Node(instance in=w26) -> ("FPGA Interface"=w30)
  Dynamic Fpga Interface Cast(reference in=w30, type=$ConstantData) -> (reference out=w31)
  case (w27) {
    frame "tx" {
      Property Node(instance in=w31, error in=w29) -> ("tx.underflows"=w32, "tx 0.number of IQ data overflows"=w34, "tx 1.number of IQ data overflows"=w35, "tx.state"=w36, "tx.samples processed"=w37, "tx.samples to generate"=w38, error out=w33)
      w39 = "Tx FIFO Underflows (%d)"
    }
    frame "rx", Default {
      Property Node(instance in=w31, error in=w29) -> ("rx.number of overflows"=w32, "rx 0.number of IQ data overflows"=w34, "rx 1.number of IQ data overflows"=w35, "rx.state"=w36, "rx.samples processed"=w37, "rx.samples to acquire"=w38, error out=w33)
      w39 = "Rx FIFO Overflows (%d)"
    }
  }
  case (w32) {
    frame 0 {
      w40 = w33
    }
    frame Default {
      Format Into String(formatString=w39, w32) -> w41
      call "Error Cluster From Error Code.gvi"(error code=1, error message=w41, show call chain?=TRUE, is warning?=TRUE) -> (error out=w42)
      Merge Errors(w33, w42) -> (error out=w40)
    }
  }
  case (w28) {
    frame "0", Default {
      w43 = w34
    }
    frame "1" {
      w43 = w35
    }
    frame "All" {
      Add(w34, w35) -> w43
    }
  }
  case (w43) {
    frame 0 {
      w44 = w40
    }
    frame Default {
      call "Error Cluster From Error Code.gvi"(error code=1, error message="DSP Overflow", show call chain?=TRUE, is warning?=TRUE) -> (error out=w45)
      Merge Errors(w40, w45) -> (error out=w44)
    }
  }
  $"error out" <- w44
  Is Equal(x="Idle", y=w36) -> w46
  Is Equal(x=w37, y=w38) -> w47
  Logical And(w46, w47) -> w48
  $done <- w48
