vi "Close Device.gvi"   [LabVIEW Communications System Design Suite 2.0.1]
# Closes the niUsrpRio session to the device.
inputs:
  "niusrprio session": "niUsrpRio Config v1 Host.lvlib__niUsrpRio Session.gtype" = {"EEPROM Header"={"Number of Reserved Bytes"=9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}, "Device Data Header"={"Number of Reserved Bytes"=27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}, "EEPROM Characterization Header"={"Number of Reserved Bytes"=28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}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}
  "error in": error
outputs:
  "error out": error
types:
  "niInstr Register Bus v0 Host.lvlib__Register Bus Session.gtype" = Queue<"niInstr Register Bus v0 Host.lvlib__Session Data.gtype">
  "Semaphore RefNum.gtype" = i32
  "niUsrpRio Config v1 Host.lvlib__DB Queue Reference.gtype" = Queue<"niUsrpRio Config v1 Host.lvlib__Daughterboard Data.gtype">
  "niUsrpRio Config v1 Host.lvlib__EEPROM Header.gtype" = cluster{"Checksum": u32, "Product Code": u16, "Hardware Current Version": u16, "Hardware Oldest Compatible Version": u16, "EEPROM Map Current Version": u16, "EEPROM Map Oldest Compatible Version": u16, "User Password": string, "Pointer to Factory Header": u32, "Pointer to User Header": u32, "Recommended Interval": u16, "Number of Reserved Bytes": i32, "Number of Daughterboards": u8, "Daughterboard IDs": u16[], "Daughterboard Serial Numbers": string[]}
  "niUsrpRio Config v1 Host.lvlib__EEPROM Device Data Header.gtype" = cluster{"Checksum": u32, "Number of Channels": u8, "Number of Gain Settings": u16[], "Pointer to Characterization Data": u32[], "Number of Reserved Bytes": i32, "Number of Frequencies": u16[]}
  "niUsrpRio Config v1 Host.lvlib__EEPROM Characterization Header.gtype" = cluster{"Checksum": u32, "Date": timestamp, "Temperature": f32, "Misc. Info": string, "Pointer to Device Data Header": u32, "Number of Reserved Bytes": i32}
  "niUsrpRio Config v1 Host.lvlib__Characterization Data.gtype" = cluster{"Gains[dB]": f64[], "Frequencies [Hz]": f64[], "IQ Imbalance Table": "niUsrpRio Config v1 Host.lvlib__IQ Imbalance.gtype"[], "Measured Gains[dB]": f64[][]}
  "niUsrpRio Config v1 Host.lvlib__niUsrpRio Session.gtype" = cluster{"FPGA Interface": any, "RIO Interface Number": u32, "Data Clock Rate": u32, "FPGA Data Clock Rate": u32, "Global Settings Register Bus": "niInstr Register Bus v0 Host.lvlib__Register Bus Session.gtype", "Radio 0 Settings Register Bus": "niInstr Register Bus v0 Host.lvlib__Register Bus Session.gtype", "Radio 1 Settings Register Bus": "niInstr Register Bus v0 Host.lvlib__Register Bus Session.gtype", "Radio Settings Bus Semaphore": "Semaphore RefNum.gtype", "DB Queues": "niUsrpRio Config v1 Host.lvlib__DB Queue Reference.gtype"[], "Characterization Data Valid?": bool, "EEPROM Header": "niUsrpRio Config v1 Host.lvlib__EEPROM Header.gtype", "Device Data Header": "niUsrpRio Config v1 Host.lvlib__EEPROM Device Data Header.gtype", "EEPROM Characterization Header": "niUsrpRio Config v1 Host.lvlib__EEPROM Characterization Header.gtype", "Characterization Data": "niUsrpRio Config v1 Host.lvlib__Characterization Data.gtype"[], "FPGA Current Version": u32, "FPGA Oldest Compatible Version": u32, "Fixed Logic Current Version": u32, "Fixed Logic Oldest Compatible Version": u32, "FPGA Radio Settings Bus Current Version": u32, "FPGA Radio Settings Bus Oldest Compatible Version": u32, "FPGA Board Config Current Version": u32, "FPGA Board Config Oldest Compatible Version": u32}
diagram:
  call "niUsrpRio Config v1 Host.lvlib__Query Status.gvi"(niUsrpRio Session=$"niusrprio session", What to Query for="Data Clock PLL Lock Status", scope="") -> (niUsrpRio Session (out)=w1, Status=w2, Error Out=w3)
  Merge Errors($"error in", w3) -> (error out=w4)
  # Unconditionally abort the stream and turn off the device's front end--without losing error information--assuming the Data Clock is valid.
  case (w2) {
    frame False, Default {
      w5 = w1
      w6 = w4
    }
    frame True {
      call "Abort Stream.gvi"(niUsrpRio Session=w1, scope="rx") -> (niUsrpRio Session (out)=w7, error out=w8)
      call "Abort Stream.gvi"(niUsrpRio Session=w7, scope="tx") -> (niUsrpRio Session (out)=w5, error out=w9)
      Merge Errors(w4, w8, w9) -> (error out=w6)
    }
  }
  call "niUsrpRio Config v1 Host.lvlib__Enable Front End.gvi"(niUsrpRio Session=w5, enable=FALSE, scope="rx") -> (niUsrpRio Session (out)=w10, error out=w11)
  call "niUsrpRio Config v1 Host.lvlib__Enable Front End.gvi"(niUsrpRio Session=w10, enable=FALSE, scope="tx") -> (niUsrpRio Session (out)=w12, error out=w13)
  Merge Errors(w6, w11, w13) -> (error out=w14)
  call "niUsrpRio Config v1 Host.lvlib__Close.gvi"(niusrprio session=w12, error in=w14) -> (fpga ref=w15, error out=w16)
  FPGA Close Node(abort?=FALSE, error in=w16, reference in=w15) -> (error out=w17)
  $"error out" <- w17
