vi "Configure Bitfile.gvi"   [LabVIEW Communications System Design Suite 2.0.1]
inputs:
  "USRP RIO device": string
  "which bitfile": string = "Time"
  "error in": error
outputs:
  "USRP RIO device 2": string
  "bitfile": path
  "Data Clock rate": u32
  "error out": error
diagram:
  $"USRP RIO device 2" <- $"USRP RIO device"
  $"error out" <- $"error in"
  $"Data Clock rate" <- 200000000
  Get Component Directory() -> (Path=w1)
  Build Path(base path=w1, name or relative path=path "FPGA Bitfiles") -> (appended path=w2)
  Concatenate Strings("niUsrpRio", "200", "_Xcvr", $"which bitfile", ".lvbitx") -> w3
  Build Path(base path=w2, name or relative path=w3) -> (appended path=w4)
  $bitfile <- w4
