vi "Configure Frequency Shift.gvi"   [LabVIEW Communications System Design Suite 2.0.1]
inputs:
  "niusrprio session": "niUsrpRio Config v1 Host.lvlib__niUsrpRio Session.gtype", required
  "clock rate": f64 = 120000000, required  # is the frequency, in hertz, the DSP blocks are running at.
  "frequency shift": f64, required  # is the amount, in hertz, to shift the frequency by.
  "error in": error
  "scope": string = "rx", required
outputs:
  "niusrprio session 2": "niUsrpRio Config v1 Host.lvlib__niUsrpRio Session.gtype"
  "coerced frequency shift": f64
  "error out": error
types:
  "niInstr Register Bus v0 Host.lvlib__Register Bus Session.gtype" = Queue<"niInstr Register Bus v0 Host.lvlib__Session Data.gtype">
  "Semaphore RefNum.gtype" = i32
  "niUsrpRio Config v1 Host.lvlib__DB Queue Reference.gtype" = Queue<"niUsrpRio Config v1 Host.lvlib__Daughterboard Data.gtype">
  "niUsrpRio Config v1 Host.lvlib__EEPROM Header.gtype" = cluster{"Checksum": u32, "Product Code": u16, "Hardware Current Version": u16, "Hardware Oldest Compatible Version": u16, "EEPROM Map Current Version": u16, "EEPROM Map Oldest Compatible Version": u16, "User Password": string, "Pointer to Factory Header": u32, "Pointer to User Header": u32, "Recommended Interval": u16, "Number of Reserved Bytes": i32, "Number of Daughterboards": u8, "Daughterboard IDs": u16[], "Daughterboard Serial Numbers": string[]}
  "niUsrpRio Config v1 Host.lvlib__EEPROM Device Data Header.gtype" = cluster{"Checksum": u32, "Number of Channels": u8, "Number of Gain Settings": u16[], "Pointer to Characterization Data": u32[], "Number of Reserved Bytes": i32, "Number of Frequencies": u16[]}
  "niUsrpRio Config v1 Host.lvlib__EEPROM Characterization Header.gtype" = cluster{"Checksum": u32, "Date": timestamp, "Temperature": f32, "Misc. Info": string, "Pointer to Device Data Header": u32, "Number of Reserved Bytes": i32}
  "niUsrpRio Config v1 Host.lvlib__Characterization Data.gtype" = cluster{"Gains[dB]": f64[], "Frequencies [Hz]": f64[], "IQ Imbalance Table": "niUsrpRio Config v1 Host.lvlib__IQ Imbalance.gtype"[], "Measured Gains[dB]": f64[][]}
  "niUsrpRio Config v1 Host.lvlib__niUsrpRio Session.gtype" = cluster{"FPGA Interface": any, "RIO Interface Number": u32, "Data Clock Rate": u32, "FPGA Data Clock Rate": u32, "Global Settings Register Bus": "niInstr Register Bus v0 Host.lvlib__Register Bus Session.gtype", "Radio 0 Settings Register Bus": "niInstr Register Bus v0 Host.lvlib__Register Bus Session.gtype", "Radio 1 Settings Register Bus": "niInstr Register Bus v0 Host.lvlib__Register Bus Session.gtype", "Radio Settings Bus Semaphore": "Semaphore RefNum.gtype", "DB Queues": "niUsrpRio Config v1 Host.lvlib__DB Queue Reference.gtype"[], "Characterization Data Valid?": bool, "EEPROM Header": "niUsrpRio Config v1 Host.lvlib__EEPROM Header.gtype", "Device Data Header": "niUsrpRio Config v1 Host.lvlib__EEPROM Device Data Header.gtype", "EEPROM Characterization Header": "niUsrpRio Config v1 Host.lvlib__EEPROM Characterization Header.gtype", "Characterization Data": "niUsrpRio Config v1 Host.lvlib__Characterization Data.gtype"[], "FPGA Current Version": u32, "FPGA Oldest Compatible Version": u32, "Fixed Logic Current Version": u32, "Fixed Logic Oldest Compatible Version": u32, "FPGA Radio Settings Bus Current Version": u32, "FPGA Radio Settings Bus Oldest Compatible Version": u32, "FPGA Board Config Current Version": u32, "FPGA Board Config Oldest Compatible Version": u32}
  T1 = cluster{"inline gain I": FXP(1.17), "inline gain Q": FXP(1.17), "cross gain I": FXP(1.17), "cross gain Q": FXP(1.17), "pre-gain offset I": FXP(1.17), "pre-gain offset Q": FXP(1.17), "post-gain offset I": FXP(1.17), "post-gain offset Q": FXP(1.17)}
  T2 = cluster{"output sample rate": UFXP(1.47), "delay": FXP(0.16), "frequency shift": FXP(0.48), "impairments": T1, "phase": FXP(0.21)}
diagram:
  call "niUsrpRio Config v1 Host.lvlib__Parse Scope.gvi"(niUsrpRio Session=$"niusrprio session", error in=$"error in", scope=$scope) -> (niUsrpRio Session (out)=w1, Device Subfunction=w2, Device Subfunction Channel=w3, error out=w4)
  $"niusrprio session 2" <- w1
  Divide(x=$"frequency shift", y=$"clock rate") -> w5
  Property Node(instance in=w1) -> ("FPGA Interface"=w6)
  Dynamic Fpga Interface Cast(reference in=w6, type=any constant) -> (reference out=w7)
  case (w2) {
    frame "rx" {
      Negate(x=w5) -> w9
      case (w3) {
        frame "0" {
          Property Node(instance in=w7, "rx 0.frequency shift"=w9, error in=w4) -> (error out=w8)
        }
        frame "1" {
          Property Node(instance in=w7, "rx 1.frequency shift"=w9, error in=w4) -> (error out=w8)
        }
        frame "All" {
          Property Node(instance in=w7, "rx 0.frequency shift"=w9, "rx 1.frequency shift"=w9, error in=w4) -> (error out=w8)
        }
      }
    }
    frame "all" {
      Negate(x=w5) -> w10
      case (w3) {
        frame "0" {
          Property Node(instance in=w7, "rx 0.frequency shift"=w10, "tx 0.frequency shift"=w5, error in=w4) -> (error out=w8)
        }
        frame "1" {
          Property Node(instance in=w7, "rx 1.frequency shift"=w10, "tx 1.frequency shift"=w5, error in=w4) -> (error out=w8)
        }
        frame "All" {
          Property Node(instance in=w7, "rx 0.frequency shift"=w10, "rx 1.frequency shift"=w10, "tx 0.frequency shift"=w5, "tx 1.frequency shift"=w5, error in=w4) -> (error out=w8)
        }
      }
    }
    frame "tx" {
      case (w3) {
        frame "0" {
          Property Node(instance in=w7, "tx 0.frequency shift"=w5, error in=w4) -> (error out=w8)
        }
        frame "1" {
          Property Node(instance in=w7, "tx 1.frequency shift"=w5, error in=w4) -> (error out=w8)
        }
        frame "All" {
          Property Node(instance in=w7, "tx 0.frequency shift"=w5, "tx 1.frequency shift"=w5, error in=w4) -> (error out=w8)
        }
      }
    }
  }
  $"error out" <- w8
  # use a DSP typedef to get the fixed-point format of the frequency shift
  w11 = T2 {"0x800000000000", 0, 0, "0x1FFFF", "0x1FFFF", 0, 0, 0, 0, 0, 0, 0}  # DDC parameters typedef
  Property Node(instance in=w11) -> ("frequency shift"=w12)
  To Fixed Point(fixed-point type=w12, number=w5) -> w13
  Multiply(w13, $"clock rate") -> w14
  $"coerced frequency shift" <- w14
