vi "Configure Frequency.gvi"   [LabVIEW Communications System Design Suite 2.0.1]
inputs:
  "niusrprio session": "niUsrpRio Config v1 Host.lvlib__niUsrpRio Session.gtype" = {"EEPROM Header"={"Number of Reserved Bytes"=9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}, "Device Data Header"={"Number of Reserved Bytes"=27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}, "EEPROM Characterization Header"={"Number of Reserved Bytes"=28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}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}, required
  "wait for lo to lock": bool = TRUE
  "lo frequency": f64 = -1  # Tune this channel's LO to a specific frequency. Setting the value to -1 will tune the LO to the Frequency value.
  "frequency": f64 = 2450000000, required  # Set this channel's RF frequency.
  "error in": error
  "scope": string = "rx", required  # is the channel to configure the frequency for. The options are "rx/RF 0", "rx/RF 1", "tx/RF 0", and "tx/RF 1".
outputs:
  "niusrprio session 2": "niUsrpRio Config v1 Host.lvlib__niUsrpRio Session.gtype"
  "coerced lo frequency": f64
  "coerced frequency": f64
  "error out": error
types:
  "niInstr Register Bus v0 Host.lvlib__Register Bus Session.gtype" = Queue<"niInstr Register Bus v0 Host.lvlib__Session Data.gtype">
  "Semaphore RefNum.gtype" = i32
  "niUsrpRio Config v1 Host.lvlib__DB Queue Reference.gtype" = Queue<"niUsrpRio Config v1 Host.lvlib__Daughterboard Data.gtype">
  "niUsrpRio Config v1 Host.lvlib__EEPROM Header.gtype" = cluster{"Checksum": u32, "Product Code": u16, "Hardware Current Version": u16, "Hardware Oldest Compatible Version": u16, "EEPROM Map Current Version": u16, "EEPROM Map Oldest Compatible Version": u16, "User Password": string, "Pointer to Factory Header": u32, "Pointer to User Header": u32, "Recommended Interval": u16, "Number of Reserved Bytes": i32, "Number of Daughterboards": u8, "Daughterboard IDs": u16[], "Daughterboard Serial Numbers": string[]}
  "niUsrpRio Config v1 Host.lvlib__EEPROM Device Data Header.gtype" = cluster{"Checksum": u32, "Number of Channels": u8, "Number of Gain Settings": u16[], "Pointer to Characterization Data": u32[], "Number of Reserved Bytes": i32, "Number of Frequencies": u16[]}
  "niUsrpRio Config v1 Host.lvlib__EEPROM Characterization Header.gtype" = cluster{"Checksum": u32, "Date": timestamp, "Temperature": f32, "Misc. Info": string, "Pointer to Device Data Header": u32, "Number of Reserved Bytes": i32}
  "niUsrpRio Config v1 Host.lvlib__Characterization Data.gtype" = cluster{"Gains[dB]": f64[], "Frequencies [Hz]": f64[], "IQ Imbalance Table": "niUsrpRio Config v1 Host.lvlib__IQ Imbalance.gtype"[], "Measured Gains[dB]": f64[][]}
  "niUsrpRio Config v1 Host.lvlib__niUsrpRio Session.gtype" = cluster{"FPGA Interface": any, "RIO Interface Number": u32, "Data Clock Rate": u32, "FPGA Data Clock Rate": u32, "Global Settings Register Bus": "niInstr Register Bus v0 Host.lvlib__Register Bus Session.gtype", "Radio 0 Settings Register Bus": "niInstr Register Bus v0 Host.lvlib__Register Bus Session.gtype", "Radio 1 Settings Register Bus": "niInstr Register Bus v0 Host.lvlib__Register Bus Session.gtype", "Radio Settings Bus Semaphore": "Semaphore RefNum.gtype", "DB Queues": "niUsrpRio Config v1 Host.lvlib__DB Queue Reference.gtype"[], "Characterization Data Valid?": bool, "EEPROM Header": "niUsrpRio Config v1 Host.lvlib__EEPROM Header.gtype", "Device Data Header": "niUsrpRio Config v1 Host.lvlib__EEPROM Device Data Header.gtype", "EEPROM Characterization Header": "niUsrpRio Config v1 Host.lvlib__EEPROM Characterization Header.gtype", "Characterization Data": "niUsrpRio Config v1 Host.lvlib__Characterization Data.gtype"[], "FPGA Current Version": u32, "FPGA Oldest Compatible Version": u32, "Fixed Logic Current Version": u32, "Fixed Logic Oldest Compatible Version": u32, "FPGA Radio Settings Bus Current Version": u32, "FPGA Radio Settings Bus Oldest Compatible Version": u32, "FPGA Board Config Current Version": u32, "FPGA Board Config Oldest Compatible Version": u32}
diagram:
  case ($"lo frequency") {
    frame Default {
      w1 = $"lo frequency"
    }
    frame -1 {
      w1 = $frequency
    }
  }
  call "niUsrpRio Config v1 Host.lvlib__Enable Front End.gvi"(niUsrpRio Session=$"niusrprio session", enable=TRUE, error in=$"error in", scope=$scope) -> (niUsrpRio Session (out)=w2, error out=w3)
  call "niUsrpRio Config v1 Host.lvlib__Configure LO.gvi"(niUsrpRio Session=w2, frequency=w1, Error In=w3, scope=$scope) -> (niUsrpRio Session (out)=w4, coerced frequency=w5, Error Out=w6)
  Subtract(x=$frequency, y=w5) -> w7
  case ($"wait for lo to lock") {
    frame False, Default {
      w8 = w6
      w9 = w4
    }
    frame True {
      call "niUsrpRio Config v1 Host.lvlib__Wait until Done.gvi"(niUsrpRio Session=w4, what to wait for="LO Locked", timeout=10, Error In=w6, scope=$scope) -> (niUsrpRio Session (out)=w9, Error Out=w8)
    }
  }
  Property Node(instance in=w9) -> ("Data Clock Rate"=w10)
  call "Configure Frequency Shift.gvi"(niusrprio session=w9, clock rate=w10, frequency shift=w7, error in=w8, scope=$scope) -> (niusrprio session 2=w11, coerced frequency shift=w12, error out=w13)
  $"niusrprio session 2" <- w11
  $"error out" <- w13
  $"coerced lo frequency" <- w5
  Add(w5, w12) -> w14
  $"coerced frequency" <- w14
