vi "Configure Rx.gvi"   [LabVIEW Communications System Design Suite 2.0.1]
inputs:
  "niUsrpRio Session": "niUsrpRio Config v1 Host.lvlib__niUsrpRio Session.gtype" = {"EEPROM Header"={"Number of Reserved Bytes"=9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}, "Device Data Header"={"Number of Reserved Bytes"=27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}, "EEPROM Characterization Header"={"Number of Reserved Bytes"=28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}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}
  "rx config": T3 = {"rf enable 0"=FALSE, "rf config 0"={"antenna"="RX2", "frequency"=2000000000, "lo frequency"=-1, "level"=0}, "rf enable 1"=FALSE, "rf config 1"={"antenna"="RX2", "frequency"=2000000000, "lo frequency"=-1, "level"=0}, "number of samples is finite"=TRUE, "sample rate"=10000000, "number of samples"=8192, "start trigger"="Immediate"}
  "error in": error
outputs:
  "niUsrpRio Session (out)": "niUsrpRio Config v1 Host.lvlib__niUsrpRio Session.gtype"
  "rx.enabled channels": string[]
  "vertical range": f64[]
  "error out": error
  "rx.coerced configurations": T4
types:
  "niInstr Register Bus v0 Host.lvlib__Register Bus Session.gtype" = Queue<"niInstr Register Bus v0 Host.lvlib__Session Data.gtype">
  "Semaphore RefNum.gtype" = i32
  "niUsrpRio Config v1 Host.lvlib__DB Queue Reference.gtype" = Queue<"niUsrpRio Config v1 Host.lvlib__Daughterboard Data.gtype">
  "niUsrpRio Config v1 Host.lvlib__EEPROM Header.gtype" = cluster{"Checksum": u32, "Product Code": u16, "Hardware Current Version": u16, "Hardware Oldest Compatible Version": u16, "EEPROM Map Current Version": u16, "EEPROM Map Oldest Compatible Version": u16, "User Password": string, "Pointer to Factory Header": u32, "Pointer to User Header": u32, "Recommended Interval": u16, "Number of Reserved Bytes": i32, "Number of Daughterboards": u8, "Daughterboard IDs": u16[], "Daughterboard Serial Numbers": string[]}
  "niUsrpRio Config v1 Host.lvlib__EEPROM Device Data Header.gtype" = cluster{"Checksum": u32, "Number of Channels": u8, "Number of Gain Settings": u16[], "Pointer to Characterization Data": u32[], "Number of Reserved Bytes": i32, "Number of Frequencies": u16[]}
  "niUsrpRio Config v1 Host.lvlib__EEPROM Characterization Header.gtype" = cluster{"Checksum": u32, "Date": timestamp, "Temperature": f32, "Misc. Info": string, "Pointer to Device Data Header": u32, "Number of Reserved Bytes": i32}
  "niUsrpRio Config v1 Host.lvlib__Characterization Data.gtype" = cluster{"Gains[dB]": f64[], "Frequencies [Hz]": f64[], "IQ Imbalance Table": "niUsrpRio Config v1 Host.lvlib__IQ Imbalance.gtype"[], "Measured Gains[dB]": f64[][]}
  "niUsrpRio Config v1 Host.lvlib__niUsrpRio Session.gtype" = cluster{"FPGA Interface": any, "RIO Interface Number": u32, "Data Clock Rate": u32, "FPGA Data Clock Rate": u32, "Global Settings Register Bus": "niInstr Register Bus v0 Host.lvlib__Register Bus Session.gtype", "Radio 0 Settings Register Bus": "niInstr Register Bus v0 Host.lvlib__Register Bus Session.gtype", "Radio 1 Settings Register Bus": "niInstr Register Bus v0 Host.lvlib__Register Bus Session.gtype", "Radio Settings Bus Semaphore": "Semaphore RefNum.gtype", "DB Queues": "niUsrpRio Config v1 Host.lvlib__DB Queue Reference.gtype"[], "Characterization Data Valid?": bool, "EEPROM Header": "niUsrpRio Config v1 Host.lvlib__EEPROM Header.gtype", "Device Data Header": "niUsrpRio Config v1 Host.lvlib__EEPROM Device Data Header.gtype", "EEPROM Characterization Header": "niUsrpRio Config v1 Host.lvlib__EEPROM Characterization Header.gtype", "Characterization Data": "niUsrpRio Config v1 Host.lvlib__Characterization Data.gtype"[], "FPGA Current Version": u32, "FPGA Oldest Compatible Version": u32, "Fixed Logic Current Version": u32, "Fixed Logic Oldest Compatible Version": u32, "FPGA Radio Settings Bus Current Version": u32, "FPGA Radio Settings Bus Oldest Compatible Version": u32, "FPGA Board Config Current Version": u32, "FPGA Board Config Oldest Compatible Version": u32}
  T1 = cluster{"antenna": string, "frequency": f64, "lo frequency": f64, "level": f64}
  T2 = enum{"Software", "Digital Edge", "Rx Start Trigger", "Tx Start Trigger", "Immediate", "Future Time Event"}
  T3 = cluster{"rf enable 0": bool, "rf config 0": T1, "rf enable 1": bool, "rf config 1": T1, "number of samples is finite": bool, "sample rate": f64, "number of samples": u32, "start trigger": T2}
  T4 = cluster{"coerced frequencies": f64[], "coerced lo frequencies": f64[], "coerced levels": f64[], "coerced sample rates": f64[]}
diagram:
  Property Node(instance in=$"rx config") -> ("rf enable 0"=w1, "rf config 0"=w2, "rf enable 1"=w3, "rf config 1"=w4, "number of samples is finite"=w5, "sample rate"=w6, "number of samples"=w7, "start trigger"=w8)
  w9 = cluster{"rf enable 0": bool, "rf config 0": T1} {all zero or empty}
  Property Node(instance in=w9, "rf enable 0"=w1, "rf config 0"=w2) -> (instance out=w10)
  w11 = cluster{"rf enable 1": bool, "rf config 1": T1} {all zero or empty}
  Property Node(instance in=w11, "rf enable 1"=w3, "rf config 1"=w4) -> (instance out=w12)
  Build Array(w10, w12) -> w13
  call "Construct Channels.gvi"(channel configurations=w13, scope="rx") -> (enabled channels=w14, enabled channel configurations=w15)
  Array Size(array=w14) -> (size(s)=w16)
  case (w16) {
    frame 0 {
      w17 = default
      w18 = default
      w19 = default
      w20 = default
      w21 = $"niUsrpRio Session"
      w22 = $"error in"
      w23 = default
      w24 = default
    }
    frame Default {
      s1 = $"error in"  # shift register
      for {
        w25 = each element of w14
        w26 = each element of w15
        Property Node(instance in=w26) -> ("frequency"=w27, "level"=w28, "antenna"=w29, "lo frequency"=w30)
        call "Configure Signal (Level).gvi"(niUsrpRio Session=$"niUsrpRio Session", sample rate [S/s]=w6, frequency [Hz]=w27, level [dBm]=w28, error in=s1, scope=w25, Active Antenna=w29, LO frequency [Hz]=w30) -> (niUsrpRio Session (out)=w31, coerced sample rate [S/s]=w32, coerced frequency [Hz]=w33, coerced level [dBm]=w34, error out=w35, coerced vertical range [Vpp]=w36, coerced LO frequency [Hz]=w37)
        call "Configure Start Trigger.gvi"(niUsrpRio Session=w31, start trigger=w8, error in=w35, scope=w25) -> (niUsrpRio Session (out)=w38, error out=w39)
        call "Configure Stream.gvi"(niUsrpRio Session=w38, number of samples is finite=w5, number of samples=w7, error in=w39, scope=w25) -> (niUsrpRio Session (out)=w21, error out=w40)
        append w36 to w23
        append w32 to w17
        append w33 to w18
        append w34 to w19
        append w37 to w20
        append w25 to w24
        next s1 = w40
      }
      w22 = s1
    }
  }
  $"vertical range" <- w23
  $"rx.enabled channels" <- w24
  $"niUsrpRio Session (out)" <- w21
  $"error out" <- w22
  Property Node(instance in=T4 {all zero or empty}, "coerced sample rates"=w17, "coerced frequencies"=w18, "coerced levels"=w19, "coerced lo frequencies"=w20) -> (instance out=w41)
  $"rx.coerced configurations" <- w41
