vi "Configure Signal (Common).gvi"   [LabVIEW Communications System Design Suite 2.0.1]
inputs:
  "niusrprio session": "niUsrpRio Config v1 Host.lvlib__niUsrpRio Session.gtype" = {"EEPROM Header"={"Number of Reserved Bytes"=9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}, "Device Data Header"={"Number of Reserved Bytes"=27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}, "EEPROM Characterization Header"={"Number of Reserved Bytes"=28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}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}, required
  "signal parameters": T1 = {"gain/level"=0, "sample rate [S/s]"=10000000, "frequency [Hz]"=2450000000, "LO frequency [Hz]"=-1, "active antenna"="RX1"}
  "configure signal mode": enum{"Gain", "Level"} = "Gain"
  "error in": error
  "scope": string = "rx", required
  "correct impairments?": bool = TRUE
outputs:
  "niusrprio session 2": "niUsrpRio Config v1 Host.lvlib__niUsrpRio Session.gtype"
  "coerced signal parameters": T1
  "error out": error
types:
  "niInstr Register Bus v0 Host.lvlib__Register Bus Session.gtype" = Queue<"niInstr Register Bus v0 Host.lvlib__Session Data.gtype">
  "Semaphore RefNum.gtype" = i32
  "niUsrpRio Config v1 Host.lvlib__DB Queue Reference.gtype" = Queue<"niUsrpRio Config v1 Host.lvlib__Daughterboard Data.gtype">
  "niUsrpRio Config v1 Host.lvlib__EEPROM Header.gtype" = cluster{"Checksum": u32, "Product Code": u16, "Hardware Current Version": u16, "Hardware Oldest Compatible Version": u16, "EEPROM Map Current Version": u16, "EEPROM Map Oldest Compatible Version": u16, "User Password": string, "Pointer to Factory Header": u32, "Pointer to User Header": u32, "Recommended Interval": u16, "Number of Reserved Bytes": i32, "Number of Daughterboards": u8, "Daughterboard IDs": u16[], "Daughterboard Serial Numbers": string[]}
  "niUsrpRio Config v1 Host.lvlib__EEPROM Device Data Header.gtype" = cluster{"Checksum": u32, "Number of Channels": u8, "Number of Gain Settings": u16[], "Pointer to Characterization Data": u32[], "Number of Reserved Bytes": i32, "Number of Frequencies": u16[]}
  "niUsrpRio Config v1 Host.lvlib__EEPROM Characterization Header.gtype" = cluster{"Checksum": u32, "Date": timestamp, "Temperature": f32, "Misc. Info": string, "Pointer to Device Data Header": u32, "Number of Reserved Bytes": i32}
  "niUsrpRio Config v1 Host.lvlib__Characterization Data.gtype" = cluster{"Gains[dB]": f64[], "Frequencies [Hz]": f64[], "IQ Imbalance Table": "niUsrpRio Config v1 Host.lvlib__IQ Imbalance.gtype"[], "Measured Gains[dB]": f64[][]}
  "niUsrpRio Config v1 Host.lvlib__niUsrpRio Session.gtype" = cluster{"FPGA Interface": any, "RIO Interface Number": u32, "Data Clock Rate": u32, "FPGA Data Clock Rate": u32, "Global Settings Register Bus": "niInstr Register Bus v0 Host.lvlib__Register Bus Session.gtype", "Radio 0 Settings Register Bus": "niInstr Register Bus v0 Host.lvlib__Register Bus Session.gtype", "Radio 1 Settings Register Bus": "niInstr Register Bus v0 Host.lvlib__Register Bus Session.gtype", "Radio Settings Bus Semaphore": "Semaphore RefNum.gtype", "DB Queues": "niUsrpRio Config v1 Host.lvlib__DB Queue Reference.gtype"[], "Characterization Data Valid?": bool, "EEPROM Header": "niUsrpRio Config v1 Host.lvlib__EEPROM Header.gtype", "Device Data Header": "niUsrpRio Config v1 Host.lvlib__EEPROM Device Data Header.gtype", "EEPROM Characterization Header": "niUsrpRio Config v1 Host.lvlib__EEPROM Characterization Header.gtype", "Characterization Data": "niUsrpRio Config v1 Host.lvlib__Characterization Data.gtype"[], "FPGA Current Version": u32, "FPGA Oldest Compatible Version": u32, "Fixed Logic Current Version": u32, "Fixed Logic Oldest Compatible Version": u32, "FPGA Radio Settings Bus Current Version": u32, "FPGA Radio Settings Bus Oldest Compatible Version": u32, "FPGA Board Config Current Version": u32, "FPGA Board Config Oldest Compatible Version": u32}
  T1 = cluster{"gain/level": f64, "sample rate [S/s]": f64, "frequency [Hz]": f64, "LO frequency [Hz]": f64, "active antenna": string}
  T2 = cluster{"inline gain I": FXP(1.17), "inline gain Q": FXP(1.17), "cross gain I": FXP(1.17), "cross gain Q": FXP(1.17), "pre-gain offset I": FXP(1.17), "pre-gain offset Q": FXP(1.17), "post-gain offset I": FXP(1.17), "post-gain offset Q": FXP(1.17)}
  T3 = cluster{"gain I": FXP(3.21), "gain Q": FXP(3.21)}
diagram:
  Property Node(instance in=$"signal parameters") -> ("LO frequency [Hz]"=w1, "frequency [Hz]"=w2, "active antenna"=w3, "gain/level"=w4, "sample rate [S/s]"=w5)
  call "Configure Frequency.gvi"(niusrprio session=$"niusrprio session", wait for lo to lock=TRUE, lo frequency=w1, frequency=w2, error in=$"error in", scope=$scope) -> (niusrprio session 2=w6, coerced lo frequency=w7, coerced frequency=w8, error out=w9)
  call "niUsrpRio Config v1 Host.lvlib__Configure Active Antenna.gvi"(niusrprio session=w6, active antenna=w3, error in=w9, scope=$scope) -> (niusrprio session 2=w10, coerced active antenna=w11, error out=w12)
  case ($"configure signal mode") {
    frame "Gain", Default {
      w13 = w10
      w14 = w7
      w15 = w12
      w16 = w4
      w17 = w4
    }
    frame "Level" {
      call "niUsrpRio Config v1 Host.lvlib__Calculate Level Range.gvi"(niUsrpRio Session=w10, frequency=w7, error in=w12, scope=$scope) -> (niUsrpRio Session (out)=w18, Min Level=w19, Max Level=w20, error out=w21)
      In Range And Coerce[IncludeHighLimit=True](lower limit=w19, upper limit=w20, x=w4) -> (coerced(x)=w17)
      call "niUsrpRio Config v1 Host.lvlib__Calculate Gain Setting.gvi"(niUsrpRio Session=w18, level=w17, frequency=w7, error in=w21, scope=$scope) -> (niUsrpRio Session (out)=w13, gain=w16, error out=w15)
      w14 = w7
    }
  }
  call "niUsrpRio Config v1 Host.lvlib__Configure Gain.gvi"(niUsrpRio session=w13, gain=w16, Error In=w15, scope=$scope) -> (niUsrpRio session (out)=w22, coerced gain=w23, Error Out=w24)
  # coerced analog gain
  # desired analog gain
  # coerced level
  case ($"correct impairments?") {
    frame False, Default {
      w29 = T2 {"inline gain I"=0.999992370605, "inline gain Q"=0.999992370605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}
      Property Node(instance in=w29) -> ("inline gain I"=w30)
      To Double Precision Float(number=w30) -> w28
      w25 = w22
      w26 = w24
      w27 = w29
    }
    frame True {
      call "niUsrpRio Config v1 Host.lvlib__Calculate IQ Imbalance Correction.gvi"(niUsrpRio Session=w22, frequency=w14, error in=w24, scope=$scope) -> (niUsrpRio Session (out)=w25, IQ imbalance correction=w27, correction gain=w28, error out=w26)
    }
  }
  call "niUsrpRio Config v1 Host.lvlib__Parse Scope.gvi"(niUsrpRio Session=w25, error in=w26, scope=$scope) -> (niUsrpRio Session (out)=w31, Device Subfunction=w32, Device Subfunction Channel=w33, error out=w34)
  $"niusrprio session 2" <- w31
  Property Node(instance in=w25) -> ("Data Clock Rate"=w35)
  call "Calculate Sample Rate.gvi"(data clock rate=w35, sample rate=w5) -> (decimation sample rate=w36, coerced sample rate=w37)
  # coerced analog gain (dB)
  Property Node(instance in=w31) -> ("FPGA Interface"=w38)
  Dynamic Fpga Interface Cast(reference in=w38, type=any constant) -> (reference out=w39)
  # desired analog gain (dB)
  # desired level (dBm)
  # coerced LO frequency
  # coerced frequency
  # coerced sample rate
  # coerced active antenna
  case (w32) {
    frame "rx", Default {
      case (w33) {
        frame "0", Default {
          Property Node(instance in=w39, "rx.output sample rate"=w36, "rx 0.impairments"=w27, error in=w34) -> (error out=w40)
        }
        frame "1" {
          Property Node(instance in=w39, "rx.output sample rate"=w36, "rx 1.impairments"=w27, error in=w34) -> (error out=w40)
        }
      }
      Logarithm Base 10(x=w28) -> w42
      Multiply(20, w42) -> w43
      case ($"configure signal mode") {
        frame "Gain", Default {
          Add(w43, w23) -> w41
        }
        frame "Level" {
          Subtract(x=w23, y=w16) -> w44
          Add(w43, w44) -> w45
          Subtract(x=w17, y=w45) -> w41
        }
      }
    }
    frame "tx" {
      Reciprocal(x=w28) -> w46
      # compensate for the
      # gain of the imbalance
      # correction
      Absolute Value(x=w46) -> w47
      Is Greater(x=w47, y=4) -> w48
      # limit of DSP gain
      case (w48) {
        frame False, Default {
          w49 = no error
        }
        frame True {
          w50 = "5006: Requested correction exceeds gain range of onboard DSP."
          call "Error Cluster From Error Code.gvi"(error code=5006, error message=w50, show call chain?=TRUE, is warning?=FALSE) -> (error out=w49)
        }
      }
      Merge Errors(w34, w49) -> (error out=w51)
      Property Node(instance in=T3 {"gain I"=1, "gain Q"=1}, "gain I"=w46, "gain Q"=w46) -> (instance out=w52)
      case (w33) {
        frame "1" {
          Property Node(instance in=w39, "tx.input sample rate"=w36, "tx 1.impairments"=w27, "tx 1.gain"=w52, error in=w51) -> (error out=w40)
        }
        frame "0", Default {
          Property Node(instance in=w39, "tx.input sample rate"=w36, "tx 0.impairments"=w27, "tx 0.gain"=w52, error in=w51) -> (error out=w40)
        }
      }
      case ($"configure signal mode") {
        frame "Gain", Default {
          w41 = w23
        }
        frame "Level" {
          Subtract(x=w23, y=w16) -> w53
          Add(w53, w17) -> w41
        }
      }
    }
  }
  $"error out" <- w40
  w54 = T1 {"gain/level"=0, "sample rate [S/s]"=10000000, "frequency [Hz]"=2450000000, "LO frequency [Hz]"=-1, "active antenna"="RX1"}
  Property Node(instance in=w54, "gain/level"=w41, "LO frequency [Hz]"=w7, "frequency [Hz]"=w8, "sample rate [S/s]"=w37, "active antenna"=w11) -> (instance out=w55)
  $"coerced signal parameters" <- w55
