vi "Configure Signal (Level).gvi"   [LabVIEW Communications System Design Suite 2.0.1]
inputs:
  "niUsrpRio Session": "niUsrpRio Config v1 Host.lvlib__niUsrpRio Session.gtype" = {"EEPROM Header"={"Number of Reserved Bytes"=9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}, "Device Data Header"={"Number of Reserved Bytes"=27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}, "EEPROM Characterization Header"={"Number of Reserved Bytes"=28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}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}
  "sample rate [S/s]": f64 = 10000000
  "frequency [Hz]": f64 = 2450000000
  "level [dBm]": f64 = -10
  "error in": error
  "scope": string = "rx"
  "Correct Impairments?": bool = TRUE
  "Active Antenna": string = "RX1"
  "LO frequency [Hz]": f64 = -1
outputs:
  "niUsrpRio Session (out)": "niUsrpRio Config v1 Host.lvlib__niUsrpRio Session.gtype"
  "coerced sample rate [S/s]": f64
  "coerced frequency [Hz]": f64
  "coerced level [dBm]": f64
  "error out": error
  "coerced vertical range [Vpp]": f64
  "coerced LO frequency [Hz]": f64
types:
  "niInstr Register Bus v0 Host.lvlib__Register Bus Session.gtype" = Queue<"niInstr Register Bus v0 Host.lvlib__Session Data.gtype">
  "Semaphore RefNum.gtype" = i32
  "niUsrpRio Config v1 Host.lvlib__DB Queue Reference.gtype" = Queue<"niUsrpRio Config v1 Host.lvlib__Daughterboard Data.gtype">
  "niUsrpRio Config v1 Host.lvlib__EEPROM Header.gtype" = cluster{"Checksum": u32, "Product Code": u16, "Hardware Current Version": u16, "Hardware Oldest Compatible Version": u16, "EEPROM Map Current Version": u16, "EEPROM Map Oldest Compatible Version": u16, "User Password": string, "Pointer to Factory Header": u32, "Pointer to User Header": u32, "Recommended Interval": u16, "Number of Reserved Bytes": i32, "Number of Daughterboards": u8, "Daughterboard IDs": u16[], "Daughterboard Serial Numbers": string[]}
  "niUsrpRio Config v1 Host.lvlib__EEPROM Device Data Header.gtype" = cluster{"Checksum": u32, "Number of Channels": u8, "Number of Gain Settings": u16[], "Pointer to Characterization Data": u32[], "Number of Reserved Bytes": i32, "Number of Frequencies": u16[]}
  "niUsrpRio Config v1 Host.lvlib__EEPROM Characterization Header.gtype" = cluster{"Checksum": u32, "Date": timestamp, "Temperature": f32, "Misc. Info": string, "Pointer to Device Data Header": u32, "Number of Reserved Bytes": i32}
  "niUsrpRio Config v1 Host.lvlib__Characterization Data.gtype" = cluster{"Gains[dB]": f64[], "Frequencies [Hz]": f64[], "IQ Imbalance Table": "niUsrpRio Config v1 Host.lvlib__IQ Imbalance.gtype"[], "Measured Gains[dB]": f64[][]}
  "niUsrpRio Config v1 Host.lvlib__niUsrpRio Session.gtype" = cluster{"FPGA Interface": any, "RIO Interface Number": u32, "Data Clock Rate": u32, "FPGA Data Clock Rate": u32, "Global Settings Register Bus": "niInstr Register Bus v0 Host.lvlib__Register Bus Session.gtype", "Radio 0 Settings Register Bus": "niInstr Register Bus v0 Host.lvlib__Register Bus Session.gtype", "Radio 1 Settings Register Bus": "niInstr Register Bus v0 Host.lvlib__Register Bus Session.gtype", "Radio Settings Bus Semaphore": "Semaphore RefNum.gtype", "DB Queues": "niUsrpRio Config v1 Host.lvlib__DB Queue Reference.gtype"[], "Characterization Data Valid?": bool, "EEPROM Header": "niUsrpRio Config v1 Host.lvlib__EEPROM Header.gtype", "Device Data Header": "niUsrpRio Config v1 Host.lvlib__EEPROM Device Data Header.gtype", "EEPROM Characterization Header": "niUsrpRio Config v1 Host.lvlib__EEPROM Characterization Header.gtype", "Characterization Data": "niUsrpRio Config v1 Host.lvlib__Characterization Data.gtype"[], "FPGA Current Version": u32, "FPGA Oldest Compatible Version": u32, "Fixed Logic Current Version": u32, "Fixed Logic Oldest Compatible Version": u32, "FPGA Radio Settings Bus Current Version": u32, "FPGA Radio Settings Bus Oldest Compatible Version": u32, "FPGA Board Config Current Version": u32, "FPGA Board Config Oldest Compatible Version": u32}
  T1 = cluster{"gain/level": f64, "sample rate [S/s]": f64, "frequency [Hz]": f64, "LO frequency [Hz]": f64, "active antenna": string}
diagram:
  w1 = T1 {"gain/level"=0, "sample rate [S/s]"=10000000, "frequency [Hz]"=2450000000, "LO frequency [Hz]"=-1, "active antenna"="RX1"}
  Property Node(instance in=w1, "gain/level"=$"level [dBm]", "sample rate [S/s]"=$"sample rate [S/s]", "frequency [Hz]"=$"frequency [Hz]", "LO frequency [Hz]"=$"LO frequency [Hz]", "active antenna"=$"Active Antenna") -> (instance out=w2)
  call "Configure Signal (Common).gvi"(niusrprio session=$"niUsrpRio Session", signal parameters=w2, configure signal mode="Level", error in=$"error in", scope=$scope, correct impairments?=$"Correct Impairments?") -> (niusrprio session 2=w3, coerced signal parameters=w4, error out=w5)
  Property Node(instance in=w4) -> ("gain/level"=w6, "sample rate [S/s]"=w7, "frequency [Hz]"=w8, "LO frequency [Hz]"=w9)
  w10 = TRUE  # Enable
  case (w10) {
    frame True, Default {
      Divide(x=w6, y=10) -> w12
      Power Of 10(x=w12) -> w13
      Divide(x=w13, y=10) -> w14
      Square Root(x=w14) -> w15
      Multiply(w15, 2) -> w11
    }
    frame False {
      w11 = default
    }
  }
  $"coerced vertical range [Vpp]" <- w11
  $"niUsrpRio Session (out)" <- w3
  $"error out" <- w5
  $"coerced level [dBm]" <- w6
  $"coerced sample rate [S/s]" <- w7
  $"coerced frequency [Hz]" <- w8
  $"coerced LO frequency [Hz]" <- w9
