vi "Configure Synchronization.gvi"   [LabVIEW Communications System Design Suite 2.0.1]
# Configures and synchronizes NI USRP-294x/295x devices.
inputs:
  "niusrprio sessions": "niUsrpRio Config v1 Host.lvlib__niUsrpRio Session.gtype"[], required
  "error in": error
  "scope": string = "rx", required
outputs:
  "niusrprio sessions 2": "niUsrpRio Config v1 Host.lvlib__niUsrpRio Session.gtype"[]
  "error out": error
types:
  "niInstr Register Bus v0 Host.lvlib__Register Bus Session.gtype" = Queue<"niInstr Register Bus v0 Host.lvlib__Session Data.gtype">
  "Semaphore RefNum.gtype" = i32
  "niUsrpRio Config v1 Host.lvlib__DB Queue Reference.gtype" = Queue<"niUsrpRio Config v1 Host.lvlib__Daughterboard Data.gtype">
  "niUsrpRio Config v1 Host.lvlib__EEPROM Header.gtype" = cluster{"Checksum": u32, "Product Code": u16, "Hardware Current Version": u16, "Hardware Oldest Compatible Version": u16, "EEPROM Map Current Version": u16, "EEPROM Map Oldest Compatible Version": u16, "User Password": string, "Pointer to Factory Header": u32, "Pointer to User Header": u32, "Recommended Interval": u16, "Number of Reserved Bytes": i32, "Number of Daughterboards": u8, "Daughterboard IDs": u16[], "Daughterboard Serial Numbers": string[]}
  "niUsrpRio Config v1 Host.lvlib__EEPROM Device Data Header.gtype" = cluster{"Checksum": u32, "Number of Channels": u8, "Number of Gain Settings": u16[], "Pointer to Characterization Data": u32[], "Number of Reserved Bytes": i32, "Number of Frequencies": u16[]}
  "niUsrpRio Config v1 Host.lvlib__EEPROM Characterization Header.gtype" = cluster{"Checksum": u32, "Date": timestamp, "Temperature": f32, "Misc. Info": string, "Pointer to Device Data Header": u32, "Number of Reserved Bytes": i32}
  "niUsrpRio Config v1 Host.lvlib__Characterization Data.gtype" = cluster{"Gains[dB]": f64[], "Frequencies [Hz]": f64[], "IQ Imbalance Table": "niUsrpRio Config v1 Host.lvlib__IQ Imbalance.gtype"[], "Measured Gains[dB]": f64[][]}
  "niUsrpRio Config v1 Host.lvlib__niUsrpRio Session.gtype" = cluster{"FPGA Interface": any, "RIO Interface Number": u32, "Data Clock Rate": u32, "FPGA Data Clock Rate": u32, "Global Settings Register Bus": "niInstr Register Bus v0 Host.lvlib__Register Bus Session.gtype", "Radio 0 Settings Register Bus": "niInstr Register Bus v0 Host.lvlib__Register Bus Session.gtype", "Radio 1 Settings Register Bus": "niInstr Register Bus v0 Host.lvlib__Register Bus Session.gtype", "Radio Settings Bus Semaphore": "Semaphore RefNum.gtype", "DB Queues": "niUsrpRio Config v1 Host.lvlib__DB Queue Reference.gtype"[], "Characterization Data Valid?": bool, "EEPROM Header": "niUsrpRio Config v1 Host.lvlib__EEPROM Header.gtype", "Device Data Header": "niUsrpRio Config v1 Host.lvlib__EEPROM Device Data Header.gtype", "EEPROM Characterization Header": "niUsrpRio Config v1 Host.lvlib__EEPROM Characterization Header.gtype", "Characterization Data": "niUsrpRio Config v1 Host.lvlib__Characterization Data.gtype"[], "FPGA Current Version": u32, "FPGA Oldest Compatible Version": u32, "Fixed Logic Current Version": u32, "Fixed Logic Oldest Compatible Version": u32, "FPGA Radio Settings Bus Current Version": u32, "FPGA Radio Settings Bus Oldest Compatible Version": u32, "FPGA Board Config Current Version": u32, "FPGA Board Config Oldest Compatible Version": u32}
diagram:
  $"niusrprio sessions 2" <- $"niusrprio sessions"
  Array Size(array=$"niusrprio sessions") -> (size(s)=w1)
  # Only perform multi-device synchronization if there are multiple devices.
  case (w1) {
    frame ..1 {
      w2 = $"error in"
    }
    frame Default {
      s1 = $"error in"  # shift register
      for {
        w3 = each element of $"niusrprio sessions"
        call "Configure Trigger Synchronization.gvi"(niUsrpRio Session=w3, enable trigger synchronization=FALSE, error in=s1, scope=$scope) -> (niUsrpRio Session (out)=w5, error out=w6)
        append w5 to w4
        next s1 = w6
      }
      call "niUsrpRio Synchronization v1 Host.lvlib__Host Driven Synchronization.gvi"(niUsrpRio Sessions=w4, error in=s1) -> (niUsrpRio Sessions (out)=w7, error out=w8)
      s2 = w8  # shift register
      for {
        w9 = each element of w7
        call "Configure Trigger Synchronization.gvi"(niUsrpRio Session=w9, enable trigger synchronization=TRUE, error in=s2, scope=$scope) -> (error out=w10)
        next s2 = w10
      }
      w2 = s2
    }
  }
  $"error out" <- w2
