vi "Configure Tx.gvi"   [LabVIEW Communications System Design Suite 2.0.1]
inputs:
  "niUsrpRio Session": "niUsrpRio Config v1 Host.lvlib__niUsrpRio Session.gtype" = {"EEPROM Header"={"Number of Reserved Bytes"=9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}, "Device Data Header"={"Number of Reserved Bytes"=27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}, "EEPROM Characterization Header"={"Number of Reserved Bytes"=28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}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}
  "tx config": T3 = {"rf enable 0"=FALSE, "rf config 0"={"antenna"="TX1", "frequency"=2000000000, "lo frequency"=-1, "level"=0}, "rf enable 1"=FALSE, "rf config 1"={"antenna"="TX1", "frequency"=2000000000, "lo frequency"=-1, "level"=0}, "number of samples is finite"=TRUE, "sample rate"=10000000, "number of samples"=8192, "start trigger"="Immediate", "tone frequency"=100000}
  "error in": error
outputs:
  "niUsrpRio Session (out)": "niUsrpRio Config v1 Host.lvlib__niUsrpRio Session.gtype"
  "tx.enabled channels": string[]
  "I": i16[]
  "Q": i16[]
  "error out": error
  "tx.output waveform": waveform<f64>[]
  "tx.coerced configurations": T4
types:
  "niInstr Register Bus v0 Host.lvlib__Register Bus Session.gtype" = Queue<"niInstr Register Bus v0 Host.lvlib__Session Data.gtype">
  "Semaphore RefNum.gtype" = i32
  "niUsrpRio Config v1 Host.lvlib__DB Queue Reference.gtype" = Queue<"niUsrpRio Config v1 Host.lvlib__Daughterboard Data.gtype">
  "niUsrpRio Config v1 Host.lvlib__EEPROM Header.gtype" = cluster{"Checksum": u32, "Product Code": u16, "Hardware Current Version": u16, "Hardware Oldest Compatible Version": u16, "EEPROM Map Current Version": u16, "EEPROM Map Oldest Compatible Version": u16, "User Password": string, "Pointer to Factory Header": u32, "Pointer to User Header": u32, "Recommended Interval": u16, "Number of Reserved Bytes": i32, "Number of Daughterboards": u8, "Daughterboard IDs": u16[], "Daughterboard Serial Numbers": string[]}
  "niUsrpRio Config v1 Host.lvlib__EEPROM Device Data Header.gtype" = cluster{"Checksum": u32, "Number of Channels": u8, "Number of Gain Settings": u16[], "Pointer to Characterization Data": u32[], "Number of Reserved Bytes": i32, "Number of Frequencies": u16[]}
  "niUsrpRio Config v1 Host.lvlib__EEPROM Characterization Header.gtype" = cluster{"Checksum": u32, "Date": timestamp, "Temperature": f32, "Misc. Info": string, "Pointer to Device Data Header": u32, "Number of Reserved Bytes": i32}
  "niUsrpRio Config v1 Host.lvlib__Characterization Data.gtype" = cluster{"Gains[dB]": f64[], "Frequencies [Hz]": f64[], "IQ Imbalance Table": "niUsrpRio Config v1 Host.lvlib__IQ Imbalance.gtype"[], "Measured Gains[dB]": f64[][]}
  "niUsrpRio Config v1 Host.lvlib__niUsrpRio Session.gtype" = cluster{"FPGA Interface": any, "RIO Interface Number": u32, "Data Clock Rate": u32, "FPGA Data Clock Rate": u32, "Global Settings Register Bus": "niInstr Register Bus v0 Host.lvlib__Register Bus Session.gtype", "Radio 0 Settings Register Bus": "niInstr Register Bus v0 Host.lvlib__Register Bus Session.gtype", "Radio 1 Settings Register Bus": "niInstr Register Bus v0 Host.lvlib__Register Bus Session.gtype", "Radio Settings Bus Semaphore": "Semaphore RefNum.gtype", "DB Queues": "niUsrpRio Config v1 Host.lvlib__DB Queue Reference.gtype"[], "Characterization Data Valid?": bool, "EEPROM Header": "niUsrpRio Config v1 Host.lvlib__EEPROM Header.gtype", "Device Data Header": "niUsrpRio Config v1 Host.lvlib__EEPROM Device Data Header.gtype", "EEPROM Characterization Header": "niUsrpRio Config v1 Host.lvlib__EEPROM Characterization Header.gtype", "Characterization Data": "niUsrpRio Config v1 Host.lvlib__Characterization Data.gtype"[], "FPGA Current Version": u32, "FPGA Oldest Compatible Version": u32, "Fixed Logic Current Version": u32, "Fixed Logic Oldest Compatible Version": u32, "FPGA Radio Settings Bus Current Version": u32, "FPGA Radio Settings Bus Oldest Compatible Version": u32, "FPGA Board Config Current Version": u32, "FPGA Board Config Oldest Compatible Version": u32}
  T1 = cluster{"antenna": string, "frequency": f64, "lo frequency": f64, "level": f64}
  T2 = enum{"Software", "Digital Edge", "Rx Start Trigger", "Tx Start Trigger", "Immediate", "Future Time Event"}
  T3 = cluster{"rf enable 0": bool, "rf config 0": T1, "rf enable 1": bool, "rf config 1": T1, "number of samples is finite": bool, "sample rate": f64, "number of samples": u32, "start trigger": T2, "tone frequency": f64}
  T4 = cluster{"coerced frequencies": f64[], "coerced lo frequencies": f64[], "coerced levels": f64[], "coerced sample rates": f64[]}
diagram:
  Property Node(instance in=$"tx config") -> ("rf enable 0"=w1, "rf config 0"=w2, "rf enable 1"=w3, "rf config 1"=w4, "number of samples is finite"=w5, "sample rate"=w6, "number of samples"=w7, "start trigger"=w8, "tone frequency"=w9)
  w10 = cluster{"rf enable 0": bool, "rf config 0": T1} {all zero or empty}
  Property Node(instance in=w10, "rf enable 0"=w1, "rf config 0"=w2) -> (instance out=w11)
  w12 = cluster{"rf enable 1": bool, "rf config 1": T1} {all zero or empty}
  Property Node(instance in=w12, "rf enable 1"=w3, "rf config 1"=w4) -> (instance out=w13)
  Build Array(w11, w13) -> w14
  call "Construct Channels.gvi"(channel configurations=w14, scope="tx") -> (enabled channels=w15, enabled channel configurations=w16)
  Array Size(array=w15) -> (size(s)=w17)
  case (w17) {
    frame 0 {
      w18 = default
      w19 = default
      w20 = default
      w21 = default
      w22 = default
      w23 = $"niUsrpRio Session"
      w24 = $"error in"
      w25 = default
      w26 = default
      w27 = default
    }
    frame Default {
      s1 = $"error in"  # shift register
      for {
        w28 = each element of w16
        w29 = each element of w15
        Property Node(instance in=w28) -> ("frequency"=w30, "level"=w31, "antenna"=w32, "lo frequency"=w33)
        call "Configure Signal (Level).gvi"(niUsrpRio Session=$"niUsrpRio Session", sample rate [S/s]=w6, frequency [Hz]=w30, level [dBm]=w31, error in=s1, scope=w29, Active Antenna=w32, LO frequency [Hz]=w33) -> (niUsrpRio Session (out)=w34, coerced sample rate [S/s]=w35, coerced frequency [Hz]=w36, coerced level [dBm]=w37, error out=w38, coerced LO frequency [Hz]=w39)
        call "Configure Start Trigger.gvi"(niUsrpRio Session=w34, start trigger=w8, error in=w38, scope=w29) -> (niUsrpRio Session (out)=w40, error out=w41)
        call "Configure Stream.gvi"(niUsrpRio Session=w40, number of samples is finite=w5, number of samples=w7, error in=w41, scope=w29) -> (niUsrpRio Session (out)=w23, error out=w42)
        append w39 to w21
        append w37 to w20
        append w36 to w19
        append w35 to w18
        append w29 to w22
        next s1 = w42
      }
      Array Index(array=w18) -> (out0[_]=w43)
      call "Generate Waveform (Multi-Array).gvi"(number of samples=w7, sample rate=w43, tone frequency=w9, amplitude=0.5) -> (i=w25, q=w26, waveform=w27, error out=w44)
      Merge Errors(s1, w44) -> (error out=w24)
    }
  }
  $"tx.enabled channels" <- w22
  $"niUsrpRio Session (out)" <- w23
  $"error out" <- w24
  $I <- w25
  $Q <- w26
  $"tx.output waveform" <- w27
  Property Node(instance in=T4 {all zero or empty}, "coerced sample rates"=w18, "coerced frequencies"=w19, "coerced levels"=w20, "coerced lo frequencies"=w21) -> (instance out=w45)
  $"tx.coerced configurations" <- w45
