vi "Construct Channels.gvi"   [LabVIEW Communications System Design Suite 2.0.1]
inputs:
  "channel configurations": T2[]
  "scope": string
outputs:
  "enabled channels": string[]
  "enabled channel configurations": T1[]
types:
  T1 = cluster{"antenna": string, "frequency": f64, "lo frequency": f64, "level": f64}
  T2 = cluster{"channel enable": bool, "channel configuration": T1}
diagram:
  s1 = T1[] []  # shift register
  s2 = string[] []  # shift register
  for (iteration -> i1) {
    w1 = each element of $"channel configurations"
    Property Node(instance in=w1) -> ("channel enable"=w2, "channel configuration"=w3)
    Number To Decimal String(number=i1) -> (decimal integer string=w4)
    Concatenate Strings($scope, "/RF", Space, w4) -> w5
    case (w2) {
      frame False, Default {
        w6 = s2
      }
      frame True {
        Build Array[ConcatenateInputs=True](s2, w5) -> w6
      }
    }
    case (w2) {
      frame False, Default {
        w7 = s1
      }
      frame True {
        Build Array[ConcatenateInputs=True](s1, w3) -> w7
      }
    }
    next s1 = w7
    next s2 = w6
  }
  $"enabled channels" <- s2
  $"enabled channel configurations" <- s1
