vi "Fetch Rx Data (U32).gvi"   [LabVIEW Communications System Design Suite 2.0.1]
inputs:
  "niusrprio session": "niUsrpRio Config v1 Host.lvlib__niUsrpRio Session.gtype" = {"EEPROM Header"={"Number of Reserved Bytes"=9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}, "Device Data Header"={"Number of Reserved Bytes"=27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}, "EEPROM Characterization Header"={"Number of Reserved Bytes"=28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}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}
  "number of samples": u32 = 8192
  "timeout": f64 = 10
  "error in": error
  "scope": string
  "vertical range [vpp]": f64 = 2
  "leading samples to trim": u32
outputs:
  "niusrprio session 2": "niUsrpRio Config v1 Host.lvlib__niUsrpRio Session.gtype"
  "waveform data": u32[]
  "error out": error
  "scaling": f64
panel controls:
  "constantdata": any
types:
  "niInstr Register Bus v0 Host.lvlib__Register Bus Session.gtype" = Queue<"niInstr Register Bus v0 Host.lvlib__Session Data.gtype">
  "Semaphore RefNum.gtype" = i32
  "niUsrpRio Config v1 Host.lvlib__DB Queue Reference.gtype" = Queue<"niUsrpRio Config v1 Host.lvlib__Daughterboard Data.gtype">
  "niUsrpRio Config v1 Host.lvlib__EEPROM Header.gtype" = cluster{"Checksum": u32, "Product Code": u16, "Hardware Current Version": u16, "Hardware Oldest Compatible Version": u16, "EEPROM Map Current Version": u16, "EEPROM Map Oldest Compatible Version": u16, "User Password": string, "Pointer to Factory Header": u32, "Pointer to User Header": u32, "Recommended Interval": u16, "Number of Reserved Bytes": i32, "Number of Daughterboards": u8, "Daughterboard IDs": u16[], "Daughterboard Serial Numbers": string[]}
  "niUsrpRio Config v1 Host.lvlib__EEPROM Device Data Header.gtype" = cluster{"Checksum": u32, "Number of Channels": u8, "Number of Gain Settings": u16[], "Pointer to Characterization Data": u32[], "Number of Reserved Bytes": i32, "Number of Frequencies": u16[]}
  "niUsrpRio Config v1 Host.lvlib__EEPROM Characterization Header.gtype" = cluster{"Checksum": u32, "Date": timestamp, "Temperature": f32, "Misc. Info": string, "Pointer to Device Data Header": u32, "Number of Reserved Bytes": i32}
  "niUsrpRio Config v1 Host.lvlib__Characterization Data.gtype" = cluster{"Gains[dB]": f64[], "Frequencies [Hz]": f64[], "IQ Imbalance Table": "niUsrpRio Config v1 Host.lvlib__IQ Imbalance.gtype"[], "Measured Gains[dB]": f64[][]}
  "niUsrpRio Config v1 Host.lvlib__niUsrpRio Session.gtype" = cluster{"FPGA Interface": any, "RIO Interface Number": u32, "Data Clock Rate": u32, "FPGA Data Clock Rate": u32, "Global Settings Register Bus": "niInstr Register Bus v0 Host.lvlib__Register Bus Session.gtype", "Radio 0 Settings Register Bus": "niInstr Register Bus v0 Host.lvlib__Register Bus Session.gtype", "Radio 1 Settings Register Bus": "niInstr Register Bus v0 Host.lvlib__Register Bus Session.gtype", "Radio Settings Bus Semaphore": "Semaphore RefNum.gtype", "DB Queues": "niUsrpRio Config v1 Host.lvlib__DB Queue Reference.gtype"[], "Characterization Data Valid?": bool, "EEPROM Header": "niUsrpRio Config v1 Host.lvlib__EEPROM Header.gtype", "Device Data Header": "niUsrpRio Config v1 Host.lvlib__EEPROM Device Data Header.gtype", "EEPROM Characterization Header": "niUsrpRio Config v1 Host.lvlib__EEPROM Characterization Header.gtype", "Characterization Data": "niUsrpRio Config v1 Host.lvlib__Characterization Data.gtype"[], "FPGA Current Version": u32, "FPGA Oldest Compatible Version": u32, "Fixed Logic Current Version": u32, "Fixed Logic Oldest Compatible Version": u32, "FPGA Radio Settings Bus Current Version": u32, "FPGA Radio Settings Bus Oldest Compatible Version": u32, "FPGA Board Config Current Version": u32, "FPGA Board Config Oldest Compatible Version": u32}
diagram:
  call "niUsrpRio Config v1 Host.lvlib__Parse Scope.gvi"(niUsrpRio Session=$"niusrprio session", error in=$"error in", scope=$scope) -> (niUsrpRio Session (out)=w1, Device Subfunction Channel=w2, error out=w3)
  $"niusrprio session 2" <- w1
  Multiply($timeout, 1000) -> w4
  Property Node(instance in=w1) -> ("FPGA Interface"=w5)
  Dynamic Fpga Interface Cast(reference in=w5, type=$constantdata) -> (reference out=w6)
  case (FALSE) {
    frame False, Default {
      Initialize Array(element=0, size=$"number of samples") -> w7
      w8 = w6
      w9 = w3
    }
    frame True {
      case (w2) {
        frame "0", Default {
          Host Fifo Read Node[FifoName="USRP Resources.grsc\\Rx Stream 0"](error in=w3, number of elements=$"number of samples", reference in=w6, timeout (ms)=w4) -> (data=w7, error out=w9, reference out=w8)
        }
        frame "1" {
          Host Fifo Read Node[FifoName="USRP Resources.grsc\\Rx Stream 1"](error in=w3, number of elements=$"number of samples", reference in=w6, timeout (ms)=w4) -> (data=w7, error out=w9, reference out=w8)
        }
      }
    }
  }
  Array Size(array=w7) -> (size(s)=w10)
  Is Less(x=w10, y=$"number of samples") -> w11
  case (w11) {
    frame False, Default {
      w12 = w9
      w13 = w7
    }
    frame True {
      call "Error Cluster From Error Code.gvi"(error code=-1, error message="Timeout waiting\nfor samples.", show call chain?=TRUE) -> (error out=w14)
      Merge Errors(w9, w14) -> (error out=w12)
      w13 = w7
    }
  }
  $"error out" <- w12
  Delete From Array(inArray=w13, length (1)=$"leading samples to trim", index0=0) -> w15
  $"waveform data" <- w15
  Scale By Power Of 2(n=16, x=1) -> w16
  Divide(x=$"vertical range [vpp]", y=w16) -> w17
  $scaling <- w17
