vi "Generate Waveform (Interleaved).gvi"   [LabVIEW Communications System Design Suite 2.0.1]
inputs:
  "number of samples": u32 = 300000
  "sample rate": f64 = 10000000
  "tone frequency": f64 = 130000
  "amplitude": f64 = 1
outputs:
  "interleaved waveform": i16[]
  "waveform": waveform<f64>[]
  "error out": error
diagram:
  call "Generate Waveform (Multi-Array).gvi"(number of samples=$"number of samples", sample rate=$"sample rate", tone frequency=$"tone frequency", amplitude=$amplitude) -> (i=w1, q=w2, waveform=w3, error out=w4)
  Interleave Array(w1, w2) -> w5
  $"interleaved waveform" <- w5
  $waveform <- w3
  $"error out" <- w4
