vi "Initiate Stream.gvi"   [LabVIEW Communications System Design Suite 2.0.1]
inputs:
  "niusrprio session": "niUsrpRio Config v1 Host.lvlib__niUsrpRio Session.gtype" = {"EEPROM Header"={"Number of Reserved Bytes"=9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}, "Device Data Header"={"Number of Reserved Bytes"=27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}, "EEPROM Characterization Header"={"Number of Reserved Bytes"=28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}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}, required
  "error in": error
  "scope": string = "rx", required  # is the channel on which stream is to be initiated. The options are "rx/RF 0", "rx/RF 1", "tx/RF 0", and "tx/RF 1".
outputs:
  "niusrprio session 2": "niUsrpRio Config v1 Host.lvlib__niUsrpRio Session.gtype"
  "error out": error
types:
  "niInstr Register Bus v0 Host.lvlib__Register Bus Session.gtype" = Queue<"niInstr Register Bus v0 Host.lvlib__Session Data.gtype">
  "Semaphore RefNum.gtype" = i32
  "niUsrpRio Config v1 Host.lvlib__DB Queue Reference.gtype" = Queue<"niUsrpRio Config v1 Host.lvlib__Daughterboard Data.gtype">
  "niUsrpRio Config v1 Host.lvlib__EEPROM Header.gtype" = cluster{"Checksum": u32, "Product Code": u16, "Hardware Current Version": u16, "Hardware Oldest Compatible Version": u16, "EEPROM Map Current Version": u16, "EEPROM Map Oldest Compatible Version": u16, "User Password": string, "Pointer to Factory Header": u32, "Pointer to User Header": u32, "Recommended Interval": u16, "Number of Reserved Bytes": i32, "Number of Daughterboards": u8, "Daughterboard IDs": u16[], "Daughterboard Serial Numbers": string[]}
  "niUsrpRio Config v1 Host.lvlib__EEPROM Device Data Header.gtype" = cluster{"Checksum": u32, "Number of Channels": u8, "Number of Gain Settings": u16[], "Pointer to Characterization Data": u32[], "Number of Reserved Bytes": i32, "Number of Frequencies": u16[]}
  "niUsrpRio Config v1 Host.lvlib__EEPROM Characterization Header.gtype" = cluster{"Checksum": u32, "Date": timestamp, "Temperature": f32, "Misc. Info": string, "Pointer to Device Data Header": u32, "Number of Reserved Bytes": i32}
  "niUsrpRio Config v1 Host.lvlib__Characterization Data.gtype" = cluster{"Gains[dB]": f64[], "Frequencies [Hz]": f64[], "IQ Imbalance Table": "niUsrpRio Config v1 Host.lvlib__IQ Imbalance.gtype"[], "Measured Gains[dB]": f64[][]}
  "niUsrpRio Config v1 Host.lvlib__niUsrpRio Session.gtype" = cluster{"FPGA Interface": any, "RIO Interface Number": u32, "Data Clock Rate": u32, "FPGA Data Clock Rate": u32, "Global Settings Register Bus": "niInstr Register Bus v0 Host.lvlib__Register Bus Session.gtype", "Radio 0 Settings Register Bus": "niInstr Register Bus v0 Host.lvlib__Register Bus Session.gtype", "Radio 1 Settings Register Bus": "niInstr Register Bus v0 Host.lvlib__Register Bus Session.gtype", "Radio Settings Bus Semaphore": "Semaphore RefNum.gtype", "DB Queues": "niUsrpRio Config v1 Host.lvlib__DB Queue Reference.gtype"[], "Characterization Data Valid?": bool, "EEPROM Header": "niUsrpRio Config v1 Host.lvlib__EEPROM Header.gtype", "Device Data Header": "niUsrpRio Config v1 Host.lvlib__EEPROM Device Data Header.gtype", "EEPROM Characterization Header": "niUsrpRio Config v1 Host.lvlib__EEPROM Characterization Header.gtype", "Characterization Data": "niUsrpRio Config v1 Host.lvlib__Characterization Data.gtype"[], "FPGA Current Version": u32, "FPGA Oldest Compatible Version": u32, "Fixed Logic Current Version": u32, "Fixed Logic Oldest Compatible Version": u32, "FPGA Radio Settings Bus Current Version": u32, "FPGA Radio Settings Bus Oldest Compatible Version": u32, "FPGA Board Config Current Version": u32, "FPGA Board Config Oldest Compatible Version": u32}
diagram:
  call "niUsrpRio Config v1 Host.lvlib__Parse Scope.gvi"(niUsrpRio Session=$"niusrprio session", error in=$"error in", scope=$scope) -> (niUsrpRio Session (out)=w1, Device Subfunction=w2, Device Subfunction Channel=w3, error out=w4)
  $"niusrprio session 2" <- w1
  Property Node(instance in=w1) -> ("FPGA Interface"=w5)
  Dynamic Fpga Interface Cast(reference in=w5, type=any constant) -> (reference out=w6)
  case (w2) {
    frame "tx" {
      Property Node(instance in=w6, "tx.trigger enable"=FALSE, error in=w4) -> (error out=w8, instance out=w9)
      Property Node(instance in=w9, "tx 0.stream enable"=FALSE, "tx 1.stream enable"=FALSE, error in=w8) -> (error out=w10, instance out=w11)
      # an extra read transaction adds delay to ensure the reset propagates to the dsp logic and the reset done indicator
      Property Node(instance in=w11, "tx.abort"=FALSE, error in=w10) -> (error out=w12, instance out=w13)
      Property Node(instance in=w13, "tx.reset"=TRUE, "tx.reset"=FALSE, error in=w12) -> (error out=w14, instance out=w15)
      # wait for DSP to reset
      s1 = FALSE  # shift register
      while (iteration -> i1) {
        Property Node(instance in=w15, error in=w14) -> ("tx.dsp reset done"=w16, error out=w17, instance out=w18)
        Logical Or(w17, w16, s1) -> w19
        Is Equal To 0(x=i1) -> w20
        # using a shift register ensures the loop runs once more after a timeout in case this thread went to sleep
        call "Elapsed Time.gvi"(Time Target (s)=1, Reset=w20) -> (Time has Elapsed=w21)
        next s1 = w21
        stop if w19
      }
      call "Error Cluster From Error Code.gvi"(error code=-1, error message="-1: Tx DSP failed to reset within time limit.", show call chain?=TRUE, is warning?=FALSE) -> (error out=w22)
      Select(s=w16, t=no error, f=w22) -> w23
      Merge Errors(w17, w23) -> (error out=w24)
      case (w3) {
        frame "0", Default {
          Property Node(instance in=w18, "tx 0.stream enable"=TRUE, error in=w24) -> (error out=w25, instance out=w26)
        }
        frame "All" {
          Property Node(instance in=w18, "tx 0.stream enable"=TRUE, "tx 1.stream enable"=TRUE, error in=w24) -> (error out=w25, instance out=w26)
        }
        frame "1" {
          Property Node(instance in=w18, "tx 1.stream enable"=TRUE, error in=w24) -> (error out=w25, instance out=w26)
        }
      }
      Property Node(instance in=w26, "tx.trigger enable"=TRUE, error in=w25) -> (error out=w7)
    }
    frame "rx", Default {
      Property Node(instance in=w6, "rx.trigger enable"=FALSE, error in=w4) -> (error out=w27, instance out=w28)
      Property Node(instance in=w28, "rx 0.stream enable"=FALSE, "rx 1.stream enable"=FALSE, error in=w27) -> (error out=w29, instance out=w30)
      # an extra read transaction adds delay to ensure the reset propagates to the dsp logic and the reset done indicator
      Property Node(instance in=w30, "rx.abort"=FALSE, error in=w29) -> (error out=w31, instance out=w32)
      Property Node(instance in=w32, "rx.reset"=TRUE, "rx.reset"=FALSE, error in=w31) -> (error out=w33, instance out=w34)
      # wait for DSP to reset
      s2 = FALSE  # shift register
      while (iteration -> i2) {
        Property Node(instance in=w34, error in=w33) -> ("rx.dsp reset done"=w35, error out=w36, instance out=w37)
        Logical Or(w36, w35, s2) -> w38
        Is Equal To 0(x=i2) -> w39
        # using a shift register ensures the loop runs once more after a timeout in case this thread went to sleep
        call "Elapsed Time.gvi"(Time Target (s)=1, Reset=w39) -> (Time has Elapsed=w40)
        next s2 = w40
        stop if w38
      }
      call "Error Cluster From Error Code.gvi"(error code=-1, error message="-1: Rx DSP failed to reset within time limit.", show call chain?=TRUE, is warning?=FALSE) -> (error out=w41)
      Select(s=w35, t=no error, f=w41) -> w42
      Merge Errors(w36, w42) -> (error out=w43)
      case (w3) {
        frame "0", Default {
          Property Node(instance in=w37, "rx 0.stream enable"=TRUE, error in=w43) -> (error out=w44, instance out=w45)
        }
        frame "All" {
          Property Node(instance in=w37, "rx 0.stream enable"=TRUE, "rx 1.stream enable"=TRUE, error in=w43) -> (error out=w44, instance out=w45)
        }
        frame "1" {
          Property Node(instance in=w37, "rx 1.stream enable"=TRUE, error in=w43) -> (error out=w44, instance out=w45)
        }
      }
      Property Node(instance in=w45, "rx.trigger enable"=TRUE, error in=w44) -> (error out=w7)
    }
  }
  $"error out" <- w7
