vi "Initiate and Fetch Time (Multi).gvi"   [LabVIEW Communications System Design Suite 2.0.1]
# Initiates acquisition and then fetches data from the device.
# Nodes that must execute before this node:
# Open and Configure.gvi
# Input Parameters
# niUsrpRio Session is the object created by the Open node and used as the session handle for the USRP RIO design library.
# start trigger delay specifies the amount of time, in seconds, to delay the start trigger by. Only applies when the start trigger is set to Future Event.
# retrigger delay specifies the amount of time, in seconds, between retriggering. Only applies for finite acquisition. Only applies when the start trigger is set to Future Event.
# first iteration is used to determine if the device needs to be triggered. If this node is in a loop, wire the iteration count to Equals Zero and then to this terminal. If this node is not in a loop, wire a TRUE constant to this this terminal.
# error in describes error conditions that occur before this node runs. This input provides standard 'error in' functionality.
# Output Parameters
# niUsrpRio Session (out) is the niUsrpRio session used in all subsequent USRP RIO design library host nodes.
# Complex Baseband Data received by the device.
# error out contains error information. This output provides standard 'error out' functionality.
inputs:
  "niusrprio sessions": "niUsrpRio Config v1 Host.lvlib__niUsrpRio Session.gtype"[]
  "start trigger delay": f64 = 1
  "retrigger delay": f64 = 0.1
  "first iteration": bool
  "error in": error
  "rx channels": T5[]
  "leading samples to trim": u32
outputs:
  "complex baseband data": cluster{"t0": timestamp, "dt": f64, "Y": c128[]}[]
  "niusrprio sessions 2": "niUsrpRio Config v1 Host.lvlib__niUsrpRio Session.gtype"[]
  "error out": error
types:
  "niInstr Register Bus v0 Host.lvlib__Register Bus Session.gtype" = Queue<"niInstr Register Bus v0 Host.lvlib__Session Data.gtype">
  "Semaphore RefNum.gtype" = i32
  "niUsrpRio Config v1 Host.lvlib__DB Queue Reference.gtype" = Queue<"niUsrpRio Config v1 Host.lvlib__Daughterboard Data.gtype">
  "niUsrpRio Config v1 Host.lvlib__EEPROM Header.gtype" = cluster{"Checksum": u32, "Product Code": u16, "Hardware Current Version": u16, "Hardware Oldest Compatible Version": u16, "EEPROM Map Current Version": u16, "EEPROM Map Oldest Compatible Version": u16, "User Password": string, "Pointer to Factory Header": u32, "Pointer to User Header": u32, "Recommended Interval": u16, "Number of Reserved Bytes": i32, "Number of Daughterboards": u8, "Daughterboard IDs": u16[], "Daughterboard Serial Numbers": string[]}
  "niUsrpRio Config v1 Host.lvlib__EEPROM Device Data Header.gtype" = cluster{"Checksum": u32, "Number of Channels": u8, "Number of Gain Settings": u16[], "Pointer to Characterization Data": u32[], "Number of Reserved Bytes": i32, "Number of Frequencies": u16[]}
  "niUsrpRio Config v1 Host.lvlib__EEPROM Characterization Header.gtype" = cluster{"Checksum": u32, "Date": timestamp, "Temperature": f32, "Misc. Info": string, "Pointer to Device Data Header": u32, "Number of Reserved Bytes": i32}
  "niUsrpRio Config v1 Host.lvlib__Characterization Data.gtype" = cluster{"Gains[dB]": f64[], "Frequencies [Hz]": f64[], "IQ Imbalance Table": "niUsrpRio Config v1 Host.lvlib__IQ Imbalance.gtype"[], "Measured Gains[dB]": f64[][]}
  "niUsrpRio Config v1 Host.lvlib__niUsrpRio Session.gtype" = cluster{"FPGA Interface": any, "RIO Interface Number": u32, "Data Clock Rate": u32, "FPGA Data Clock Rate": u32, "Global Settings Register Bus": "niInstr Register Bus v0 Host.lvlib__Register Bus Session.gtype", "Radio 0 Settings Register Bus": "niInstr Register Bus v0 Host.lvlib__Register Bus Session.gtype", "Radio 1 Settings Register Bus": "niInstr Register Bus v0 Host.lvlib__Register Bus Session.gtype", "Radio Settings Bus Semaphore": "Semaphore RefNum.gtype", "DB Queues": "niUsrpRio Config v1 Host.lvlib__DB Queue Reference.gtype"[], "Characterization Data Valid?": bool, "EEPROM Header": "niUsrpRio Config v1 Host.lvlib__EEPROM Header.gtype", "Device Data Header": "niUsrpRio Config v1 Host.lvlib__EEPROM Device Data Header.gtype", "EEPROM Characterization Header": "niUsrpRio Config v1 Host.lvlib__EEPROM Characterization Header.gtype", "Characterization Data": "niUsrpRio Config v1 Host.lvlib__Characterization Data.gtype"[], "FPGA Current Version": u32, "FPGA Oldest Compatible Version": u32, "Fixed Logic Current Version": u32, "Fixed Logic Oldest Compatible Version": u32, "FPGA Radio Settings Bus Current Version": u32, "FPGA Radio Settings Bus Oldest Compatible Version": u32, "FPGA Board Config Current Version": u32, "FPGA Board Config Oldest Compatible Version": u32}
  T1 = cluster{"antenna": string, "frequency": f64, "lo frequency": f64, "level": f64}
  T2 = enum{"Software", "Digital Edge", "Rx Start Trigger", "Tx Start Trigger", "Immediate", "Future Time Event"}
  T3 = cluster{"rf enable 0": bool, "rf config 0": T1, "rf enable 1": bool, "rf config 1": T1, "number of samples is finite": bool, "sample rate": f64, "number of samples": u32, "start trigger": T2}
  T4 = cluster{"coerced frequencies": f64[], "coerced lo frequencies": f64[], "coerced levels": f64[], "coerced sample rates": f64[]}
  T5 = cluster{"rx config": T3, "reference frequency source": string, "rx.enabled channels": string[], "vertical range": f64[], "rx.coerced configurations": T4}
diagram:
  Array Index(array=$"rx channels") -> (out0[_]=w1)
  Property Node(instance in=w1) -> ("rx.enabled channels"=w2, "rx config:start trigger"=w3, "rx config:number of samples is finite"=w4)
  Array Size(array=w2) -> (size(s)=w5)
  case (w5) {
    frame 0 {
      # do nothing if there are zero enabled channels
      w6 = $"niusrprio sessions"
      w7 = $"error in"
      w8 = default
    }
    frame Default {
      Logical Or(w4, $"first iteration") -> w9
      case (w9) {
        frame False, Default {
          w10 = $"error in"
          w11 = $"niusrprio sessions"
        }
        frame True {
          Select(s=$"first iteration", t=$"start trigger delay", f=$"retrigger delay") -> w12
          call "Initiate and Trigger.gvi"(niusrprio sessions=$"niusrprio sessions", start trigger=w3, trigger delay=w12, error in=$"error in", scope="rx") -> (niusrprio sessions 2=w11, error out=w10)
        }
      }
      # For continuous acquisitions, only send the trigger the first time.
      # Sending another trigger would re-initiate an acquisition
      #  that has already started/completed.
      s1 = w10  # shift register
      for {
        w13 = each element of w11
        w14 = each element of $"rx channels"
        Property Node(instance in=w14) -> ("rx.coerced configurations:coerced sample rates"=w15, "reference frequency source"=w16, "vertical range"=w17, "rx.enabled channels"=w18, "rx config:number of samples"=w19)
        s2 = s1  # shift register
        for {
          w20 = each element of w18
          w21 = each element of w17
          w22 = each element of w15
          call "Fetch Rx Data (CDB WDT).gvi"(niusrprio session=w13, number of samples=w19, sample rate=w22, error in=s2, scope=w20, vertical range [vpp]=w21, leading samples to trim=$"leading samples to trim") -> (niusrprio session 2=w24, waveform=w25, error out=w26)
          append w25 to w23
          next s2 = w26
        }
        call "Check Stream Status.gvi"(niUsrpRio Session=w24, error in=s2, scope="rx", reference frequency source=w16) -> (niUsrpRio Session (out)=w27, error out=w28)
        append w27 to w6
        concatenate w23 onto w8
        next s1 = w28
      }
      w7 = s1
    }
  }
  $"niusrprio sessions 2" <- w6
  $"error out" <- w7
  $"complex baseband data" <- w8
