vi "Initiate and Generate Time (Multi).gvi"   [LabVIEW Communications System Design Suite 2.0.1]
inputs:
  "niusrprio sessions": "niUsrpRio Config v1 Host.lvlib__niUsrpRio Session.gtype"[]
  "start trigger delay": f64 = 1
  "retrigger delay": f64 = 0.1
  "first iteration": bool
  "error in": error
  "tx channels": T5[]
outputs:
  "niusrprio sessions 2": "niUsrpRio Config v1 Host.lvlib__niUsrpRio Session.gtype"[]
  "error out": error
types:
  "niInstr Register Bus v0 Host.lvlib__Register Bus Session.gtype" = Queue<"niInstr Register Bus v0 Host.lvlib__Session Data.gtype">
  "Semaphore RefNum.gtype" = i32
  "niUsrpRio Config v1 Host.lvlib__DB Queue Reference.gtype" = Queue<"niUsrpRio Config v1 Host.lvlib__Daughterboard Data.gtype">
  "niUsrpRio Config v1 Host.lvlib__EEPROM Header.gtype" = cluster{"Checksum": u32, "Product Code": u16, "Hardware Current Version": u16, "Hardware Oldest Compatible Version": u16, "EEPROM Map Current Version": u16, "EEPROM Map Oldest Compatible Version": u16, "User Password": string, "Pointer to Factory Header": u32, "Pointer to User Header": u32, "Recommended Interval": u16, "Number of Reserved Bytes": i32, "Number of Daughterboards": u8, "Daughterboard IDs": u16[], "Daughterboard Serial Numbers": string[]}
  "niUsrpRio Config v1 Host.lvlib__EEPROM Device Data Header.gtype" = cluster{"Checksum": u32, "Number of Channels": u8, "Number of Gain Settings": u16[], "Pointer to Characterization Data": u32[], "Number of Reserved Bytes": i32, "Number of Frequencies": u16[]}
  "niUsrpRio Config v1 Host.lvlib__EEPROM Characterization Header.gtype" = cluster{"Checksum": u32, "Date": timestamp, "Temperature": f32, "Misc. Info": string, "Pointer to Device Data Header": u32, "Number of Reserved Bytes": i32}
  "niUsrpRio Config v1 Host.lvlib__Characterization Data.gtype" = cluster{"Gains[dB]": f64[], "Frequencies [Hz]": f64[], "IQ Imbalance Table": "niUsrpRio Config v1 Host.lvlib__IQ Imbalance.gtype"[], "Measured Gains[dB]": f64[][]}
  "niUsrpRio Config v1 Host.lvlib__niUsrpRio Session.gtype" = cluster{"FPGA Interface": any, "RIO Interface Number": u32, "Data Clock Rate": u32, "FPGA Data Clock Rate": u32, "Global Settings Register Bus": "niInstr Register Bus v0 Host.lvlib__Register Bus Session.gtype", "Radio 0 Settings Register Bus": "niInstr Register Bus v0 Host.lvlib__Register Bus Session.gtype", "Radio 1 Settings Register Bus": "niInstr Register Bus v0 Host.lvlib__Register Bus Session.gtype", "Radio Settings Bus Semaphore": "Semaphore RefNum.gtype", "DB Queues": "niUsrpRio Config v1 Host.lvlib__DB Queue Reference.gtype"[], "Characterization Data Valid?": bool, "EEPROM Header": "niUsrpRio Config v1 Host.lvlib__EEPROM Header.gtype", "Device Data Header": "niUsrpRio Config v1 Host.lvlib__EEPROM Device Data Header.gtype", "EEPROM Characterization Header": "niUsrpRio Config v1 Host.lvlib__EEPROM Characterization Header.gtype", "Characterization Data": "niUsrpRio Config v1 Host.lvlib__Characterization Data.gtype"[], "FPGA Current Version": u32, "FPGA Oldest Compatible Version": u32, "Fixed Logic Current Version": u32, "Fixed Logic Oldest Compatible Version": u32, "FPGA Radio Settings Bus Current Version": u32, "FPGA Radio Settings Bus Oldest Compatible Version": u32, "FPGA Board Config Current Version": u32, "FPGA Board Config Oldest Compatible Version": u32}
  T1 = cluster{"antenna": string, "frequency": f64, "lo frequency": f64, "level": f64}
  T2 = enum{"Software", "Digital Edge", "Rx Start Trigger", "Tx Start Trigger", "Immediate", "Future Time Event"}
  T3 = cluster{"rf enable 0": bool, "rf config 0": T1, "rf enable 1": bool, "rf config 1": T1, "number of samples is finite": bool, "sample rate": f64, "number of samples": u32, "start trigger": T2, "tone frequency": f64}
  T4 = cluster{"coerced frequencies": f64[], "coerced lo frequencies": f64[], "coerced levels": f64[], "coerced sample rates": f64[]}
  T5 = cluster{"tx config": T3, "reference frequency source": string, "tx.enabled channels": string[], "I": i16[], "Q": i16[], "tx.coerced configurations": T4}
diagram:
  # #NOTE: To ameliorate Tx underflows during continuous generation, Check Stream Status does not need to run every loop iteration.
  Select(s=$"first iteration", t=$"start trigger delay", f=$"retrigger delay") -> w1
  Array Index(array=$"tx channels") -> (out0[_]=w2)
  Property Node(instance in=w2) -> ("tx.enabled channels"=w3, "tx config:start trigger"=w4, "tx config:number of samples is finite"=w5, "reference frequency source"=w6)
  Array Size(array=w3) -> (size(s)=w7)
  case (w7) {
    frame 0 {
      # do nothing if there are zero enabled channels
      w8 = $"niusrprio sessions"
      w9 = $"error in"
    }
    frame Default {
      s1 = $"error in"  # shift register
      for {
        w10 = each element of $"niusrprio sessions"
        call "Check Stream Status.gvi"(niUsrpRio Session=w10, error in=s1, scope="tx", reference frequency source=w6) -> (niUsrpRio Session (out)=w13, done=w14, error out=w15)
        append w14 to w11
        append w13 to w12
        next s1 = w15
      }
      And Array Elements(Boolean array=w11) -> (logical AND=w16)
      case (w5) {
        frame True {
          Logical Or(w16, $"first iteration") -> w17
          # finite/bursty generation
          case (w17) {
            frame False, Default {
              # Do nothing until the previous finite generation finishes before reinitiating.
              w8 = w12
              w9 = s1
            }
            frame True {
              s2 = s1  # shift register
              for {
                w18 = each element of w12
                w19 = each element of $"tx channels"
                Property Node(instance in=w19) -> ("tx.enabled channels"=w21, "I"=w22, "Q"=w23)
                s3 = s2  # shift register
                for {
                  w24 = each element of w21
                  call "Write Tx Data (I16 multi).gvi"(niusrprio session=w18, i=w22, q=w23, error in=s3, scope=w24) -> (niusrprio session 2=w25, error out=w26)
                  next s3 = w26
                }
                append w25 to w20
                next s2 = s3
              }
              call "Initiate and Trigger.gvi"(niusrprio sessions=w20, start trigger=w4, trigger delay=w1, error in=s2, scope="tx") -> (niusrprio sessions 2=w8, error out=w9)
            }
          }
        }
        frame False {
          # continuous generation
          s4 = s1  # shift register
          for {
            w27 = each element of w12
            w28 = each element of $"tx channels"
            Property Node(instance in=w28) -> ("tx.enabled channels"=w30, "I"=w31, "Q"=w32)
            s5 = s4  # shift register
            for {
              w33 = each element of w30
              call "Write Tx Data (I16 multi).gvi"(niusrprio session=w27, i=w31, q=w32, error in=s5, scope=w33) -> (niusrprio session 2=w34, error out=w35)
              next s5 = w35
            }
            append w34 to w29
            next s4 = s5
          }
          case ($"first iteration") {
            frame False, Default {
              # Only initiate on first iteration.
              w8 = w29
              w9 = s4
            }
            frame True {
              call "Initiate and Trigger.gvi"(niusrprio sessions=w29, start trigger=w4, trigger delay=w1, error in=s4, scope="tx") -> (niusrprio sessions 2=w8, error out=w9)
            }
          }
        }
      }
    }
  }
  $"niusrprio sessions 2" <- w8
  $"error out" <- w9
