vi "Scale IQ Data.gvi"   [LabVIEW Communications System Design Suite 2.0.1]
inputs:
  "raw waveform data": u32[]
  "scaling": f64
outputs:
  "scaled data": c128[]
diagram:
  for {
    w1 = each element of $"raw waveform data"
    # I is in the lower bits,
    # Q is in the higher
    Split Number(x=w1) -> (high(x)=w3, low(x)=w4)
    To Word Integer(number=w4) -> w5
    To Double Precision Float(number=w5) -> w6
    Multiply(w6, $scaling) -> w7
    To Word Integer(number=w3) -> w8
    To Double Precision Float(number=w8) -> w9
    Multiply(w9, $scaling) -> w10
    Real And Imaginary To Complex(x=w7, y=w10) -> w11
    append w11 to w2
  }
  $"scaled data" <- w2
