vi "Self Correct Rx IQ Offset.gvi"   [LabVIEW Communications System Design Suite 2.0.1]
panel controls:
  "usrp rio device": string = "Select USRP RIO Device"
  "commit update to device?": bool = TRUE
  "reference frequency source": string = "Internal"
  "tuning settle": u32 = 100
diagram:
  call "Open Device.gvi"(usrp rio device=$"usrp rio device", reference frequency source=$"reference frequency source") -> (niusrprio session=w1, error out=w2)
  # Rx and Tx channels on
  # each daughterboard
  Property Node(instance in=w1) -> ("EEPROM Header:Number of Daughterboards"=w3)
  Multiply(2, w3) -> w4
  Property Node(instance in=w1) -> ("Characterization Data Valid?"=w5)
  Not(x=w5) -> w6
  # characterization data invalid
  case (w6) {
    frame False, Default {
      w7 = w2
    }
    frame True {
      w8 = "-5000: The correction data on this device cannot be updated because the existing data is incompatible with the update."
      call "Error Cluster From Error Code.gvi"(error code=-5000, error message=w8, show call chain?=TRUE, is warning?=FALSE) -> (error out=w9)
      Merge Errors(w2, w9) -> (error out=w7)
    }
  }
  sequence {
    frame 0 {
      Two Button Dialog(F button name ("Cancel")="No", T button name ("OK")="Yes", message="Backup the existing correction data first?") -> (T Button?=w10)
    }
  }
  w11 = $"tuning settle"
  s1 = w7  # shift register
  s2 = w1  # shift register
  for (N = w4) (iteration -> i1) {
    Quotient And Remainder(x=i1, y=2) -> (x-y*floor(x/y)=w12)
    Is Equal To 0(x=w12) -> w13
    case (w13) {
      frame False, Default {
        # Tx Channel
        # nothing needs to be
        # corrected for Tx
        w14 = s1
        w15 = s2
      }
      frame True {
        # Rx channel
        call "Backup and Self Correct Rx Offset.gvi"(niusrprio session=s2, channel to update=i1, tuning settle=w11, backup existing data?=w10, error in=s1) -> (niusrprio session 2=w15, error out=w14)
      }
    }
    Coerce To Type(type=no error, x=w14) -> w16
    next s1 = w16
    next s2 = w15
  }
  case ($"commit update to device?") {
    frame False, Default {
      w17 = s1
      w18 = s2
    }
    frame True {
      call "niUsrpRio Config v1 Host.lvlib__Store Persistent Device Data.gvi"(niUsrpRio session=s2, offset=0x0, EEPROM Data Section="Factory Data", Error In=s1) -> (niUsrpRio session (out)=w18, Error Out=w17)
    }
  }
  call "Close Device.gvi"(niusrprio session=w18, error in=w17) -> (error out=w19)
  call "Simple Error Handler.gvi"(type of dialog=3, error in=w19)
