vi "Self Measure Rx IQ Offset.gvi"   [LabVIEW Communications System Design Suite 2.0.1]
inputs:
  "niusrprio session": "niUsrpRio Config v1 Host.lvlib__niUsrpRio Session.gtype" = {"EEPROM Header"={"Number of Reserved Bytes"=9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}, "Device Data Header"={"Number of Reserved Bytes"=27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}, "EEPROM Characterization Header"={"Number of Reserved Bytes"=28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}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}
  "carrier freq": f64 = 2400000000
  "iq rate": f64 = 10000000
  "gain": f64 = 15
  "error in": error
  "channel": string = "rx/RF 0"
  "tuning settle": u32 = 100
  "number of samples": u32 = 10000
  "transient samples to throw out": i32 = 4000
outputs:
  "niusrprio session 2": "niUsrpRio Config v1 Host.lvlib__niUsrpRio Session.gtype"
  "coerced frequency": f64
  "error out": error
  "offset": c128
panel controls:
  "constantdata": any
  "active antenna": string = "RX1"
panel indicators:
  "waveform graph": waveform<f64>[]
types:
  "niInstr Register Bus v0 Host.lvlib__Register Bus Session.gtype" = Queue<"niInstr Register Bus v0 Host.lvlib__Session Data.gtype">
  "Semaphore RefNum.gtype" = i32
  "niUsrpRio Config v1 Host.lvlib__DB Queue Reference.gtype" = Queue<"niUsrpRio Config v1 Host.lvlib__Daughterboard Data.gtype">
  "niUsrpRio Config v1 Host.lvlib__EEPROM Header.gtype" = cluster{"Checksum": u32, "Product Code": u16, "Hardware Current Version": u16, "Hardware Oldest Compatible Version": u16, "EEPROM Map Current Version": u16, "EEPROM Map Oldest Compatible Version": u16, "User Password": string, "Pointer to Factory Header": u32, "Pointer to User Header": u32, "Recommended Interval": u16, "Number of Reserved Bytes": i32, "Number of Daughterboards": u8, "Daughterboard IDs": u16[], "Daughterboard Serial Numbers": string[]}
  "niUsrpRio Config v1 Host.lvlib__EEPROM Device Data Header.gtype" = cluster{"Checksum": u32, "Number of Channels": u8, "Number of Gain Settings": u16[], "Pointer to Characterization Data": u32[], "Number of Reserved Bytes": i32, "Number of Frequencies": u16[]}
  "niUsrpRio Config v1 Host.lvlib__EEPROM Characterization Header.gtype" = cluster{"Checksum": u32, "Date": timestamp, "Temperature": f32, "Misc. Info": string, "Pointer to Device Data Header": u32, "Number of Reserved Bytes": i32}
  "niUsrpRio Config v1 Host.lvlib__Characterization Data.gtype" = cluster{"Gains[dB]": f64[], "Frequencies [Hz]": f64[], "IQ Imbalance Table": "niUsrpRio Config v1 Host.lvlib__IQ Imbalance.gtype"[], "Measured Gains[dB]": f64[][]}
  "niUsrpRio Config v1 Host.lvlib__niUsrpRio Session.gtype" = cluster{"FPGA Interface": any, "RIO Interface Number": u32, "Data Clock Rate": u32, "FPGA Data Clock Rate": u32, "Global Settings Register Bus": "niInstr Register Bus v0 Host.lvlib__Register Bus Session.gtype", "Radio 0 Settings Register Bus": "niInstr Register Bus v0 Host.lvlib__Register Bus Session.gtype", "Radio 1 Settings Register Bus": "niInstr Register Bus v0 Host.lvlib__Register Bus Session.gtype", "Radio Settings Bus Semaphore": "Semaphore RefNum.gtype", "DB Queues": "niUsrpRio Config v1 Host.lvlib__DB Queue Reference.gtype"[], "Characterization Data Valid?": bool, "EEPROM Header": "niUsrpRio Config v1 Host.lvlib__EEPROM Header.gtype", "Device Data Header": "niUsrpRio Config v1 Host.lvlib__EEPROM Device Data Header.gtype", "EEPROM Characterization Header": "niUsrpRio Config v1 Host.lvlib__EEPROM Characterization Header.gtype", "Characterization Data": "niUsrpRio Config v1 Host.lvlib__Characterization Data.gtype"[], "FPGA Current Version": u32, "FPGA Oldest Compatible Version": u32, "Fixed Logic Current Version": u32, "Fixed Logic Oldest Compatible Version": u32, "FPGA Radio Settings Bus Current Version": u32, "FPGA Radio Settings Bus Oldest Compatible Version": u32, "FPGA Board Config Current Version": u32, "FPGA Board Config Oldest Compatible Version": u32}
  T1 = cluster{"inline gain I": FXP(1.17), "inline gain Q": FXP(1.17), "cross gain I": FXP(1.17), "cross gain Q": FXP(1.17), "pre-gain offset I": FXP(1.17), "pre-gain offset Q": FXP(1.17), "post-gain offset I": FXP(1.17), "post-gain offset Q": FXP(1.17)}
uses:
  NI::Analysis::Statistics::Mean (CDB).gvi
diagram:
  case ($"error in") {
    frame No Error {
      # coerced IQ rate
      # overloaded to mean gain
      call "niUsrpRio Config v1 Host.lvlib__Enable Front End.gvi"(niUsrpRio Session=$"niusrprio session", enable=TRUE, error in=$"error in", scope=$channel) -> (niUsrpRio Session (out)=w3, error out=w4)
      # number of Samples
      call "niUsrpRio Config v1 Host.lvlib__Configure LO.gvi"(niUsrpRio Session=w3, frequency=$"carrier freq", Error In=w4, scope=$channel) -> (niUsrpRio Session (out)=w5, coerced frequency=w6, Error Out=w7)
      $"coerced frequency" <- w6
      call "niUsrpRio Config v1 Host.lvlib__Wait until Done.gvi"(niUsrpRio Session=w5, what to wait for="LO Locked", Error In=w7, scope=$channel) -> (niUsrpRio Session (out)=w8, Error Out=w9)
      Property Node(instance in=w8) -> ("Data Clock Rate"=w10)
      call "Calculate Sample Rate.gvi"(data clock rate=w10, sample rate=$"iq rate") -> (decimation sample rate=w11, coerced sample rate=w12)
      Add($"number of samples", $"transient samples to throw out") -> w13
      w14 = T1 {"inline gain I"=0.999992370605, "inline gain Q"=0.999992370605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}
      Property Node(instance in=w8) -> ("FPGA Interface"=w15)
      Dynamic Fpga Interface Cast(reference in=w15, type=$constantdata) -> (reference out=w16)
      Property Node(instance in=w16, "rx.output sample rate"=w11, "rx 0.impairments"=w14, "rx 1.impairments"=w14, "rx 0.frequency shift"=0, "rx 1.frequency shift"=0, error in=w9) -> (error out=w17)
      call "niUsrpRio Config v1 Host.lvlib__Configure Active Antenna.gvi"(niusrprio session=w8, active antenna=$"active antenna", error in=w17, scope=$channel) -> (niusrprio session 2=w18, error out=w19)
      call "niUsrpRio Config v1 Host.lvlib__Configure Gain.gvi"(niUsrpRio session=w18, gain=$gain, Error In=w19, scope=$channel) -> (niUsrpRio session (out)=w20, Error Out=w21)
      # Configure Rx Stream
      sequence {
        frame 0 {
          # Wait for the RF filter to settle.  This can be removed if you are certain the RF filter setting did not change.
          Wait(time to wait=$"tuning settle")
        }
      }
      call "Configure Stream.gvi"(niUsrpRio Session=w20, number of samples is finite=TRUE, number of samples=w13, error in=w21, scope=$channel) -> (niUsrpRio Session (out)=w22, error out=w23)
      call "Initiate Stream.gvi"(niusrprio session=w22, error in=w23, scope=$channel) -> (niusrprio session 2=w24, error out=w25)
      call "Fetch Rx Data (CDB WDT).gvi"(niusrprio session=w24, number of samples=w13, sample rate=w12, error in=w25, scope=$channel, vertical range [vpp]=2, leading samples to trim=$"transient samples to throw out") -> (niusrprio session 2=w26, waveform=w27, error out=w28)
      Property Node(instance in=w27) -> ("dt"=w29, "Y"=w30)
      Complex To Real Imaginary(x + iy=w30) -> (x=w31, y=w32)
      Build Waveform Node(Y=w31, dt=w29) -> (output waveform=w33)
      Build Waveform Node(Y=w32, dt=w29) -> (output waveform=w34)
      Build Array(w33, w34) -> w35
      $"waveform graph" <- w35
      call "Check Stream Status.gvi"(niUsrpRio Session=w26, error in=w28, scope=$channel) -> (niUsrpRio Session (out)=w2, error out=w1)
      call "Mean (CDB).gvi"(x=w30) -> (mean=w36, error out=w37)
      $offset <- w36
      Property Node(instance in=w37)
    }
    frame Error {
      w1 = $"error in"
      w2 = $"niusrprio session"
    }
  }
  $"niusrprio session 2" <- w2
  Coerce To Type(type=no error, x=w1) -> w38
  $"error out" <- w38
