vi "Open and Configure Device_2.gvi"   [LabVIEW Communications System Design Suite 2.0.1]
# Writes baseband waveform to the device then initiates generation.
# Nodes that must execute before this node:
# Open and Configure.gvi
# Input Parameters
# niUsrpRio Session is the object created by the Open node and used as the session handle for the USRP RIO design library.
# first iteration is used to determine if the device needs to be triggered. If this node is in a loop, wire the iteration count to Equals Zero and then to this terminal. If this node is not in a loop, wire a TRUE constant to this this terminal.
# error in describes error conditions that occur before this node runs. This input provides standard 'error in' functionality.
# Output Parameters
# niUsrpRio Session (out) is the niUsrpRio session used in all subsequent USRP RIO design library host nodes.
# error out contains error information. This output provides standard 'error out' functionality.
inputs:
  "FPGA in": "FPGA interface.gtype"
  "usrp rio device": string
  "reference frequency source": string = "Internal"
  "which bitfile": string = "Time"
  "wait for gps lock?": bool
  "error in": error
  "rx config": T4 = {"rf enable 0"=FALSE, "rf config 0"={"antenna"="RX2", "frequency"=2000000000, "lo frequency"=-1, "level"=0}, "rf enable 1"=FALSE, "rf config 1"={"antenna"="RX2", "frequency"=2000000000, "lo frequency"=-1, "level"=0}, "number of samples is finite"=TRUE, "sample rate"=10000000, "number of samples"=8192, "start trigger"="Immediate"}
  "tx config": T6 = {"rf enable 0"=FALSE, "rf config 0"={"antenna"="TX1", "frequency"=2000000000, "lo frequency"=-1, "level"=0}, "rf enable 1"=FALSE, "rf config 1"={"antenna"="TX1", "frequency"=2000000000, "lo frequency"=-1, "level"=0}, "number of samples is finite"=TRUE, "sample rate"=10000000, "number of samples"=8192, "start trigger"="Immediate", "tone frequency"=100000}
  "open": bool
outputs:
  "niusrprio session": "niUsrpRio Config v1 Host.lvlib__niUsrpRio Session.gtype"
  "rx.coerced configurations": T1
  "tx.coerced configurations": T1
  "tx.output waveform": waveform<f64>[]
  "error out": error
  "rx channels": T5
  "tx channels": T7
types:
  "niInstr Register Bus v0 Host.lvlib__Register Bus Session.gtype" = Queue<"niInstr Register Bus v0 Host.lvlib__Session Data.gtype">
  "Semaphore RefNum.gtype" = i32
  "niUsrpRio Config v1 Host.lvlib__DB Queue Reference.gtype" = Queue<"niUsrpRio Config v1 Host.lvlib__Daughterboard Data.gtype">
  "niUsrpRio Config v1 Host.lvlib__EEPROM Header.gtype" = cluster{"Checksum": u32, "Product Code": u16, "Hardware Current Version": u16, "Hardware Oldest Compatible Version": u16, "EEPROM Map Current Version": u16, "EEPROM Map Oldest Compatible Version": u16, "User Password": string, "Pointer to Factory Header": u32, "Pointer to User Header": u32, "Recommended Interval": u16, "Number of Reserved Bytes": i32, "Number of Daughterboards": u8, "Daughterboard IDs": u16[], "Daughterboard Serial Numbers": string[]}
  "niUsrpRio Config v1 Host.lvlib__EEPROM Device Data Header.gtype" = cluster{"Checksum": u32, "Number of Channels": u8, "Number of Gain Settings": u16[], "Pointer to Characterization Data": u32[], "Number of Reserved Bytes": i32, "Number of Frequencies": u16[]}
  "niUsrpRio Config v1 Host.lvlib__EEPROM Characterization Header.gtype" = cluster{"Checksum": u32, "Date": timestamp, "Temperature": f32, "Misc. Info": string, "Pointer to Device Data Header": u32, "Number of Reserved Bytes": i32}
  "niUsrpRio Config v1 Host.lvlib__Characterization Data.gtype" = cluster{"Gains[dB]": f64[], "Frequencies [Hz]": f64[], "IQ Imbalance Table": "niUsrpRio Config v1 Host.lvlib__IQ Imbalance.gtype"[], "Measured Gains[dB]": f64[][]}
  "niUsrpRio Config v1 Host.lvlib__niUsrpRio Session.gtype" = cluster{"FPGA Interface": any, "RIO Interface Number": u32, "Data Clock Rate": u32, "FPGA Data Clock Rate": u32, "Global Settings Register Bus": "niInstr Register Bus v0 Host.lvlib__Register Bus Session.gtype", "Radio 0 Settings Register Bus": "niInstr Register Bus v0 Host.lvlib__Register Bus Session.gtype", "Radio 1 Settings Register Bus": "niInstr Register Bus v0 Host.lvlib__Register Bus Session.gtype", "Radio Settings Bus Semaphore": "Semaphore RefNum.gtype", "DB Queues": "niUsrpRio Config v1 Host.lvlib__DB Queue Reference.gtype"[], "Characterization Data Valid?": bool, "EEPROM Header": "niUsrpRio Config v1 Host.lvlib__EEPROM Header.gtype", "Device Data Header": "niUsrpRio Config v1 Host.lvlib__EEPROM Device Data Header.gtype", "EEPROM Characterization Header": "niUsrpRio Config v1 Host.lvlib__EEPROM Characterization Header.gtype", "Characterization Data": "niUsrpRio Config v1 Host.lvlib__Characterization Data.gtype"[], "FPGA Current Version": u32, "FPGA Oldest Compatible Version": u32, "Fixed Logic Current Version": u32, "Fixed Logic Oldest Compatible Version": u32, "FPGA Radio Settings Bus Current Version": u32, "FPGA Radio Settings Bus Oldest Compatible Version": u32, "FPGA Board Config Current Version": u32, "FPGA Board Config Oldest Compatible Version": u32, "Daughterboard Clock Rate": u32}
  T1 = cluster{"coerced frequencies": f64[], "coerced lo frequencies": f64[], "coerced levels": f64[], "coerced sample rates": f64[]}
  T2 = cluster{"antenna": string, "frequency": f64, "lo frequency": f64, "level": f64}
  T3 = enum{"Software", "Digital Edge", "Rx Start Trigger", "Tx Start Trigger", "Immediate", "Future Time Event"}
  T4 = cluster{"rf enable 0": bool, "rf config 0": T2, "rf enable 1": bool, "rf config 1": T2, "number of samples is finite": bool, "sample rate": f64, "number of samples": u32, "start trigger": T3}
  T5 = cluster{"rx config": T4, "reference frequency source": string, "rx.enabled channels": string[], "vertical range": f64[], "rx.coerced configurations": T1}
  T6 = cluster{"rf enable 0": bool, "rf config 0": T2, "rf enable 1": bool, "rf config 1": T2, "number of samples is finite": bool, "sample rate": f64, "number of samples": u32, "start trigger": T3, "tone frequency": f64}
  T7 = cluster{"tx config": T6, "reference frequency source": string, "tx.enabled channels": string[], "I": i16[], "Q": i16[], "tx.coerced configurations": T1}
diagram:
  Feedback Node(input=w1) -> w2
  case ($open) {
    frame False, Default {
      w3 = $"error in"
      w1 = w2
    }
    frame True {
      call "Open Device.gvi"(FPGA in=$"FPGA in", usrp rio device=$"usrp rio device", reference frequency source=$"reference frequency source", which bitfile=$"which bitfile", error in=$"error in") -> (niusrprio session=w1, error out=w3)
    }
  }
  # #NOTE: Set "Wait for GPS Lock?" to true for GPSDO to lock to a satellite.
  # The process may take up to 10 minutes.
  case ($"reference frequency source") {
    frame Default {
      w4 = w1
      w5 = w3
    }
    frame "GPS" {
      case ($"wait for gps lock?") {
        frame True {
          call "Lock to GPS.gvi"(niusrprio session=w1, error in=w3) -> (niusrprio session 2=w6, error out=w7)
        }
        frame False {
          w6 = w1
          w7 = w3
        }
      }
      call "Configure Clocks.gvi"(niUsrpRio Session=w6, Reference Frequency Source="GPS", error in=w7) -> (niUsrpRio Session (out)=w4, error out=w5)
    }
  }
  call "Configure Tx.gvi"(niUsrpRio Session=w4, tx config=$"tx config", error in=w5) -> (niUsrpRio Session (out)=w8, tx.enabled channels=w9, I=w10, Q=w11, error out=w12, tx.output waveform=w13, tx.coerced configurations=w14)
  Property Node(instance in=T7 {all zero or empty}, "tx config"=$"tx config", "reference frequency source"=$"reference frequency source", "tx.enabled channels"=w9, "I"=w10, "Q"=w11, "tx.coerced configurations"=w14) -> (instance out=w15)
  $"tx channels" <- w15
  call "Configure Rx.gvi"(niUsrpRio Session=w8, rx config=$"rx config", error in=w12) -> (niUsrpRio Session (out)=w16, rx.enabled channels=w17, vertical range=w18, error out=w19, rx.coerced configurations=w20)
  Property Node(instance in=T5 {all zero or empty}, "rx config"=$"rx config", "reference frequency source"=$"reference frequency source", "rx.enabled channels"=w17, "vertical range"=w18, "rx.coerced configurations"=w20) -> (instance out=w21)
  $"rx channels" <- w21
  $"niusrprio session" <- w16
  $"error out" <- w19
  $"rx.coerced configurations" <- w20
  $"tx.coerced configurations" <- w14
  $"tx.output waveform" <- w13
