vi "Rx Streaming (Host).gvi"   [LabVIEW Communications System Design Suite 2.0.1]
panel controls:
  "USRP RIO device": string = "RIO0"
  "rx config": T4 = {"rf enable 0"=TRUE, "rf config 0"={"Antenna RF 0"="RX2", "Frequency RF 0 [Hz]"=2000000000, "LO Frequency RF 0 [Hz]"=-1, "Reference Level RF 0 [dBm]"=0}, "rf enable 1"=TRUE, "rf config 1"={"Antenna RF 1"="RX2", "Frequency RF 1 [Hz]"=2000000000, "LO Frequency RF 1 [Hz]"=-1, "Reference Level RF 1 [dBm]"=0}, "Number of Samples is Finite"=TRUE, "Sample Rate [S/s]"=10000000, "Number of Samples"=8192, "Start Trigger"="Immediate"}
  "Tab": i32
  "rx.stop": bool
  "Reference Frequency Source": string = "Internal"
panel indicators:
  "Power Spectrum": T5[]
  "Power Level": f64[][]
  "I & Q Data": f64[][]
  "RX Coerced Configurations": T6
  "Acquiring": bool
types:
  T1 = cluster{"Antenna RF 0": string, "Frequency RF 0 [Hz]": f64, "LO Frequency RF 0 [Hz]": f64, "Reference Level RF 0 [dBm]": f64}
  T2 = cluster{"Antenna RF 1": string, "Frequency RF 1 [Hz]": f64, "LO Frequency RF 1 [Hz]": f64, "Reference Level RF 1 [dBm]": f64}
  T3 = enum{"Software", "Digital Edge", "Rx Start Trigger", "Tx Start Trigger", "Immediate", "Future Time Event"}
  T4 = cluster{"rf enable 0": bool, "rf config 0": T1, "rf enable 1": bool, "rf config 1": T2, "Number of Samples is Finite": bool, "Sample Rate [S/s]": f64, "Number of Samples": u32, "Start Trigger": T3}
  T5 = cluster{"f0": f64, "df": f64, "magnitude": f64[]}
  T6 = cluster{"Coerced Frequencies [Hz]": f64[], "Coerced LO Frequencies [Hz]": f64[], "Coerced Levels [dBm]": f64[], "Coerced Sample Rates [S/s]": f64[]}
diagram:
  # 1. Open and configure device
  # 2. Receive data
  # 3. Close device
  # 1.
  call "Open and Configure Device.gvi"(usrp rio device=$"USRP RIO device", reference frequency source=$"Reference Frequency Source", rx config=$"rx config") -> (niusrprio session=w1, rx.coerced configurations=w2, error out=w3, rx channels=w4)
  s1 = w3  # shift register
  while (iteration -> i1) {
    Is Equal To 0(x=i1) -> w5
    call "Initiate and Fetch (Single).gvi"(niusrprio session=w1, first iteration=w5, error in=s1, rx channels=w4) -> (complex baseband data=w6, niusrprio session 2=w7, error out=w8)
    call "Elapsed Time.gvi"(Time Target (s)=0.05) -> (Time has Elapsed=w9)
    # 2.
    case (w9) {
      frame False, Default { }
      frame True {
        for {
          w10 = each element of w6
          call "Calculate Power Spectrum.gvi"(iq data=w10) -> (power spectrum=w14)
          Property Node(instance in=w10) -> ("Y"=w15)
          call "Calculate IQ Power Level.gvi"(IQ data=w15) -> (power level (dBm)=w16)
          Complex To Real Imaginary(x + iy=w15) -> (x=w17, y=w18)
          Build Array(w17, w18) -> w19
          append w16 to w11
          append w14 to w12
          concatenate w19 onto w13
        }
        $"Power Spectrum" <- w12
        $"Power Level" <- w11
        $"I & Q Data" <- w13
      }
    }
    Logical Or(w8, $"rx.stop") -> w20
    Not(x=w20) -> w21
    $Acquiring <- w21
    next s1 = w8
    stop if w20
  }
  # 3.
  call "Close Device.gvi"(niusrprio session=w7, error in=s1) -> (error out=w22)
  call "Simple Error Handler.gvi"(type of dialog="OK message + warnings", error in=w22)
  $"RX Coerced Configurations" <- w2
