vi "Rx Streaming Time (Host).gvi"   [LabVIEW Communications System Design Suite 2.0.1]
panel controls:
  "USRP RIO device": string = "RIO0"
  "rx config": T4 = {"rf enable 0"=TRUE, "rf config 0"={"Antenna RF 0"="RX2", "Frequency RF 0 [Hz]"=2000000000, "LO Frequency RF 0 [Hz]"=-1, "Reference Level RF 0 [dBm]"=0}, "rf enable 1"=TRUE, "rf config 1"={"Antenna RF 1"="RX2", "Frequency RF 1 [Hz]"=2000000000, "LO Frequency RF 1 [Hz]"=-1, "Reference Level RF 1 [dBm]"=0}, "Number of Samples is Finite"=TRUE, "Sample Rate [S/s]"=10000000, "Number of Samples"=8192, "Start Trigger"="Future Time Event"}
  "rx.stop": bool
  "Tab": i32
  "Reference Frequency Source": string = "Internal"
panel indicators:
  "RX Coerced Configurations": T5
  "Acquiring": bool
  "Power Spectrum": T6[]
  "Power Level": f64[][]
  "I & Q Data": f64[][]
types:
  T1 = cluster{"Antenna RF 0": string, "Frequency RF 0 [Hz]": f64, "LO Frequency RF 0 [Hz]": f64, "Reference Level RF 0 [dBm]": f64}
  T2 = cluster{"Antenna RF 1": string, "Frequency RF 1 [Hz]": f64, "LO Frequency RF 1 [Hz]": f64, "Reference Level RF 1 [dBm]": f64}
  T3 = enum{"Software", "Digital Edge", "Rx Start Trigger", "Tx Start Trigger", "Immediate", "Future Time Event"}
  T4 = cluster{"rf enable 0": bool, "rf config 0": T1, "rf enable 1": bool, "rf config 1": T2, "Number of Samples is Finite": bool, "Sample Rate [S/s]": f64, "Number of Samples": u32, "Start Trigger": T3}
  T5 = cluster{"Coerced Frequencies [Hz]": f64[], "Coerced LO Frequencies [Hz]": f64[], "Coerced Levels [dBm]": f64[], "Coerced Sample Rates [S/s]": f64[]}
  T6 = cluster{"f0": f64, "df": f64, "magnitude": f64[]}
diagram:
  # 1. Open and configure device
  # 2. Configure Time
  # 3. Receive data
  # 4. Close device
  # 1.
  call "Open and Configure Device.gvi"(usrp rio device=$"USRP RIO device", reference frequency source=$"Reference Frequency Source", rx config=$"rx config") -> (niusrprio session=w1, rx.coerced configurations=w2, error out=w3, rx channels=w4)
  # 2.
  call "Configure Time (Single).gvi"(niUsrpRio Session=w1, error in=w3) -> (niUsrpRio Session (out)=w5, error out=w6)
  # 4.
  s1 = w6  # shift register
  while (iteration -> i1) {
    Is Equal To 0(x=i1) -> w7
    call "Initiate and Fetch Time (Single).gvi"(niusrprio session=w5, start trigger delay=1, retrigger delay=0.1, first iteration=w7, error in=s1, rx channels=w4) -> (complex baseband data=w8, niusrprio session 2=w9, error out=w10)
    call "Elapsed Time.gvi"(Time Target (s)=0.05) -> (Time has Elapsed=w11)
    # 3.
    case (w11) {
      frame False, Default { }
      frame True {
        for {
          w12 = each element of w8
          call "Calculate Power Spectrum.gvi"(iq data=w12) -> (power spectrum=w16)
          Property Node(instance in=w12) -> ("Y"=w17)
          call "Calculate IQ Power Level.gvi"(IQ data=w17) -> (power level (dBm)=w18)
          Complex To Real Imaginary(x + iy=w17) -> (x=w19, y=w20)
          Build Array(w19, w20) -> w21
          append w18 to w13
          append w16 to w14
          concatenate w21 onto w15
        }
        $"Power Spectrum" <- w14
        $"Power Level" <- w13
        $"I & Q Data" <- w15
      }
    }
    Logical Or(w10, $"rx.stop") -> w22
    Not(x=w22) -> w23
    $Acquiring <- w23
    next s1 = w10
    stop if w22
  }
  call "Close Device.gvi"(niusrprio session=w9, error in=s1) -> (error out=w24)
  call "Simple Error Handler.gvi"(type of dialog="OK message + warnings", error in=w24)
  $"RX Coerced Configurations" <- w2
