vi "Streaming Xcvr (FPGA).gvi"   [LabVIEW Communications System Design Suite 2.0.1]
panel controls:
  "reg.host read.go rcvd 0": bool
  "reg.notify host.go rcvd 0": bool
  "reg.reset 0": bool
  "RF 0/Rx/Enable": bool
  "RF 0/Tx/Enable": bool
  "RF 1/Rx/Enable": bool
  "RF 1/Tx/Enable": bool
  "rx.reset": bool = TRUE
  "rx.samples to acquire": u32
  "rx.output sample rate": UFXP(1.47)
  "rx.delay": FXP(0.16)
  "rx 0.frequency shift": FXP(0.48)
  "rx 0.phase": FXP(0.21)
  "rx 0.impairments": T1 = {"inline gain I"=0.999992370605, "inline gain Q"=0.999992370605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}
  "rx.abort": bool
  "tx.abort": bool
  "tx.reset": bool = TRUE
  "tx.input sample rate": UFXP(1.47)
  "tx.delay": FXP(0.18)
  "tx 0.frequency shift": FXP(0.48)
  "tx 0.phase": FXP(0.21)
  "tx 0.impairments": T1 = {"inline gain I"=0.999992370605, "inline gain Q"=0.999992370605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}
  "tx.samples to generate": u32
  "tx 0.gain": T2 = {"gain I"=1, "gain Q"=1}
  "rx 1.impairments": T1 = {"inline gain I"=0.999992370605, "inline gain Q"=0.999992370605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}
  "rx 1.frequency shift": FXP(0.48)
  "rx 1.phase": FXP(0.21)
  "tx 1.impairments": T1 = {"inline gain I"=0.999992370605, "inline gain Q"=0.999992370605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}
  "tx 1.frequency shift": FXP(0.48)
  "tx 1.phase": FXP(0.21)
  "tx 1.gain": T2 = {"gain I"=1, "gain Q"=1}
  "rx 0.stream enable": bool
  "rx 1.stream enable": bool
  "tx 0.stream enable": bool
  "tx 1.stream enable": bool
  "rx.trigger select": T3 = "Immediate"
  "tx.trigger select": T3 = "Immediate"
  "rx.software trigger": bool
  "tx.software trigger": bool
  "rx.trigger enable": bool
  "tx.trigger enable": bool
panel indicators:
  "reg.notify host.go 0": bool
  "reg.host read.data 0": cluster{"go": bool, "data": u32}
  "rx.samples processed": u32
  "rx.state": enum{"Idle", "Active"}
  "rx 0.number of IQ data overflows": u64
  "rx.number of overflows": u32
  "tx.samples processed": u32
  "tx.underflows": u32
  "tx 0.number of IQ data overflows": u64
  "tx.state": enum{"Idle", "Active"}
  "rx.dsp reset done": bool
  "tx.dsp reset done": bool
  "tx 1.number of IQ data overflows": u64
  "rx 1.number of IQ data overflows": u64
types:
  T1 = cluster{"inline gain I": FXP(1.17), "inline gain Q": FXP(1.17), "cross gain I": FXP(1.17), "cross gain Q": FXP(1.17), "pre-gain offset I": FXP(1.17), "pre-gain offset Q": FXP(1.17), "post-gain offset I": FXP(1.17), "post-gain offset Q": FXP(1.17)}
  T2 = cluster{"gain I": FXP(3.21), "gain Q": FXP(3.21)}
  T3 = enum{"Software", "Digital Edge", "Rx Start Trigger", "Tx Start Trigger", "Immediate", "Future Time Event"}
  T4 = cluster{"output sample rate": UFXP(1.47), "delay": FXP(0.16), "frequency shift": FXP(0.48), "impairments": T1, "phase": FXP(0.21)}
  T5 = cluster{"frequency shift": FXP(0.48), "impairments": T1, "phase": FXP(0.21), "input sample rate": UFXP(1.47), "gain": T2, "delay": FXP(0.18)}
diagram:
  call "Create Resources.gvi"() -> (sync.resources=w1, config.resources=w2, time.resources=w3)
  clock-driven loop (clock = "40 MHz Onboard Clock") {
    # Register Bus and Required Controls/Indicators
    Io Write(data=$"RF 1/Rx/Enable", reference in="RF 1/Rx/Enable")
    Io Write(data=$"RF 0/Tx/Enable", reference in="RF 0/Tx/Enable")
    Io Write(data=$"RF 0/Rx/Enable", reference in="RF 0/Rx/Enable")
    Io Write(data=$"RF 1/Tx/Enable", reference in="RF 1/Tx/Enable")
    Feedback Node(input=w4) -> w5
    Feedback Node(input=w6) -> w7
    call "niInstr Register Bus v1 FPGA.lvlib__Process.gcdl"(reg.notify host.go rcvd=$"reg.notify host.go rcvd 0", reg.host read.go rcvd=$"reg.host read.go rcvd 0", read completion=w5, reg.reset=$"reg.reset 0", reg.host instruction fifo="niInstr Register Bus v0.grsc\\reg.host instruction fifo 0", ready for output=w7) -> (reg.notify host.go=w8, reg.host read.data=w9, register instruction=w10)
    $"reg.notify host.go 0" <- w8
    $"reg.host read.data 0" <- w9
    call "Registers.gcdl"(sync.resources=w1, register instruction=w10, config.resources=w2, time.resources=w3) -> (read completion out=w4, ready for input=w6)
    stop if FALSE
  }
  call "niUsrpRio Config v1 FPGA.lvlib__Process.gvi"(resources=w2)
  clock-driven loop (clock = "Data Clock") {
    Build Array($"rx 0.stream enable", $"rx 1.stream enable") -> w11
    # Streaming Transceiver Engine
    call "Start Triggers Time.gcdl"(rx 1.stream enabled=$"rx 1.stream enable", rx.software trigger=$"rx.software trigger", tx.trigger select=$"tx.trigger select", tx.enable trigger=$"tx.trigger enable", tx 0.stream enabled=$"tx 0.stream enable", tx 1.stream enabled=$"tx 1.stream enable", rx 0.stream enabled=$"rx 0.stream enable", rx.enable trigger=$"rx.trigger enable", rx.trigger select=$"rx.trigger select", tx.software trigger=$"tx.software trigger", time.resources=w3) -> (rx.start trigger=w12, tx.start trigger=w13)
    Build Array($"rx 0.stream enable", $"rx 1.stream enable") -> w14
    Io Read(reference in="RF 0/Rx/I") -> (data=w15)
    Io Read(reference in="RF 0/Rx/Q") -> (data=w16)
    call "niInstr DSP v1 FPGA.lvlib__I16 to IQ.gcdl"(I=w15, Q=w16) -> (IQ data=w17)
    Io Read(reference in="RF 1/Rx/I") -> (data=w18)
    Io Read(reference in="RF 1/Rx/Q") -> (data=w19)
    call "niInstr DSP v1 FPGA.lvlib__I16 to IQ.gcdl"(I=w18, Q=w19) -> (IQ data=w20)
    Build Array(w17, w20) -> w21
    w22 = T4 {"0x800000000000", 0, 0, "0x1FFFF", "0x1FFFF", 0, 0, 0, 0, 0, 0, 0}
    Property Node(instance in=w22, "impairments"=$"rx 0.impairments", "frequency shift"=$"rx 0.frequency shift", "phase"=$"rx 0.phase", "output sample rate"=$"rx.output sample rate", "delay"=$"rx.delay") -> (instance out=w23)
    w24 = T4 {"0x800000000000", 0, 0, "0x1FFFF", "0x1FFFF", 0, 0, 0, 0, 0, 0, 0}
    Property Node(instance in=w24, "delay"=$"rx.delay", "output sample rate"=$"rx.output sample rate", "impairments"=$"rx 1.impairments", "frequency shift"=$"rx 1.frequency shift", "phase"=$"rx 1.phase") -> (instance out=w25)
    Build Array(w23, w25) -> w26
    call "DDC (Multi-Channel).gcdl"(data in=w21, start trigger=w12, enabled=w14, DDC Parameters=w26, reset=$"rx.reset") -> (data out=w27, number of overflows=w28, output valid=w29, dsp reset done=w30)
    # #CodeRecommended - If you want to move the data directly to another LabVIEW FPGA device
    #  for further processing, you can replace the DMA FIFO with a Peer to Peer Writer FIFO.
    # #CodeRecommended - For your custom data processing IP, you can add Target-Scoped FPGA FIFOs
    #  if you need to move data to a different clock domain.
    call "niInstr Basic Elements v1 FPGA.lvlib__Detect Rising Edge.gcdl"(signal=$"rx.abort") -> (edge detected=w31)
    Feedback Node(input=w32) -> w33
    Not(x=w33) -> w34
    call "Input Stream Control.gcdl"(input valid=w29, start trigger=w12, burst size=$"rx.samples to acquire", abort=w31, fifo timeout=w34, reset=$"rx.reset") -> (write stream=w35, state=w36, samples processed=w37, number of overflows=w38)
    call "Write FIFO (Multi-Channel).gcdl"(data in=w27, enabled=w11, input valid=w35, reset=$"rx.reset", FIFO 0="USRP Resources.grsc\\Rx Stream 0", FIFO 1="USRP Resources.grsc\\Rx Stream 1") -> (ready for input=w32)
    Array Index(array=w28) -> (out0[_]=w39, out1[_]=w40)
    $"rx 0.number of IQ data overflows" <- w39
    $"rx 1.number of IQ data overflows" <- w40
    $"rx.dsp reset done" <- w30
    $"rx.state" <- w36
    $"rx.samples processed" <- w37
    $"rx.number of overflows" <- w38
    Build Array($"tx 0.stream enable", $"tx 1.stream enable") -> w41
    # #CodeRecommended - If you want to pull data directly from another LabVIEW FPGA device,
    # you can replace the DMA FIFO with a Peer to Peer Reader FIFO.
    Build Array($"tx 0.stream enable", $"tx 1.stream enable") -> w42
    call "niInstr Basic Elements v1 FPGA.lvlib__Detect Rising Edge.gcdl"(signal=$"tx.abort") -> (edge detected=w43)
    Feedback Node(input=w44) -> w45
    Feedback Node(input=w46) -> w47
    call "Output Stream Control.gcdl"(start trigger=w13, burst size=$"tx.samples to generate", abort=w43, ready to read stream (T)=w47, fifo output valid=w45, reset=$"tx.reset") -> (read stream=w48, state=w49, samples processed=w50, number of underflows=w51)
    call "Read FIFO (Multi-Channel).gcdl"(enabled=w42, FIFO 0="USRP Resources.grsc\\Tx Stream 0", FIFO 1="USRP Resources.grsc\\Tx Stream 1", ready for output=w48) -> (data out=w52, output valid=w44)
    call "niInstr Basic Elements v1 FPGA.lvlib__Synchronous Latch.gcdl"(set=w44, clear=$"tx.reset") -> (out=w53)
    Logical And(w53, w47) -> w54
    w55 = T5 {0, "0x1FFFF", "0x1FFFF", 0, 0, 0, 0, 0, 0, 0, 0, "0x200000", "0x200000", 0}
    Property Node(instance in=w55, "gain"=$"tx 0.gain", "frequency shift"=$"tx 0.frequency shift", "phase"=$"tx 0.phase", "impairments"=$"tx 0.impairments", "input sample rate"=$"tx.input sample rate", "delay"=$"tx.delay") -> (instance out=w56)
    w57 = T5 {0, "0x1FFFF", "0x1FFFF", 0, 0, 0, 0, 0, 0, 0, 0, "0x200000", "0x200000", 0}
    Property Node(instance in=w57, "delay"=$"tx.delay", "input sample rate"=$"tx.input sample rate", "gain"=$"tx 1.gain", "frequency shift"=$"tx 1.frequency shift", "phase"=$"tx 1.phase", "impairments"=$"tx 1.impairments") -> (instance out=w58)
    Build Array(w56, w58) -> w59
    call "DUC (Multi-Channel).gcdl"(data in=w52, enabled=w41, input valid=w54, DUC Parameters=w59, reset=$"tx.reset") -> (I data out=w60, Q data out=w61, number of overflows=w62, dsp reset done=w63, ready for input=w46)
    # #CodeRecommended - For your custom data processing IP, you can add
    # Target-Scoped FPGA FIFOs if you need to move data to/from a different clock domain.
    Array Index(array=w60) -> (out0[_]=w64, out1[_]=w65)
    Io Write(data=w64, reference in="RF 0/Tx/I")
    Io Write(data=w65, reference in="RF 1/Tx/I")
    Array Index(array=w61) -> (out0[_]=w66, out1[_]=w67)
    Io Write(data=w66, reference in="RF 0/Tx/Q")
    Io Write(data=w67, reference in="RF 1/Tx/Q")
    $"tx.state" <- w49
    Array Index(array=w62) -> (out0[_]=w68, out1[_]=w69)
    $"tx 0.number of IQ data overflows" <- w68
    $"tx.samples processed" <- w50
    $"tx 1.number of IQ data overflows" <- w69
    $"tx.dsp reset done" <- w63
    $"tx.underflows" <- w51
    stop if FALSE
  }
