vi "Tx Streaming Time (Host).gvi"   [LabVIEW Communications System Design Suite 2.0.1]
panel controls:
  "USRP RIO device": string = "RIO0"
  "tx.stop": bool
  "Reference Frequency Source": string = "Internal"
  "tx config": T5 = {"rf enable 0"=TRUE, "rf config 0"={"Antenna RF 0"="TX1", "Frequency RF 0 [Hz]"=2000000000, "LO Frequency RF 0 [Hz]"=-1, "Output Power RF 0 [dBm]"=0}, "rf enable 1"=TRUE, "rf config 1"={"Antenna RF 1"="TX1", "Frequency RF 1 [Hz]"=2000000000, "LO Frequency RF 1 [Hz]"=-1, "Output Power RF 1 [dBm]"=0}, "Number of Samples is Finite"=TRUE, "Sample Rate [S/s]"=10000000, "Number of Samples"=8192, "Start Trigger"="Future Time Event", "Tone Frequency [Hz]"=100000}
panel indicators:
  "Generating": bool
  "Tab": i32
  "Output Waveform": waveform<f64>[]
  "TX Coerced Configurations": T1
types:
  T1 = cluster{"Coerced Frequencies [Hz]": f64[], "Coerced LO Frequencies [Hz]": f64[], "Coerced Output Powers [dBm]": f64[], "Coerced Sample Rates [S/s]": f64[]}
  T2 = cluster{"Antenna RF 0": string, "Frequency RF 0 [Hz]": f64, "LO Frequency RF 0 [Hz]": f64, "Output Power RF 0 [dBm]": f64}
  T3 = cluster{"Antenna RF 1": string, "Frequency RF 1 [Hz]": f64, "LO Frequency RF 1 [Hz]": f64, "Output Power RF 1 [dBm]": f64}
  T4 = enum{"Software", "Digital Edge", "Rx Start Trigger", "Tx Start Trigger", "Immediate", "Future Time Event"}
  T5 = cluster{"rf enable 0": bool, "rf config 0": T2, "rf enable 1": bool, "rf config 1": T3, "Number of Samples is Finite": bool, "Sample Rate [S/s]": f64, "Number of Samples": u32, "Start Trigger": T4, "Tone Frequency [Hz]": f64}
diagram:
  # 1. Open and configure device
  # 2. Configure Time
  # 3. Transmit data
  # 4. Close device
  # 1.
  call "Open and Configure Device.gvi"(usrp rio device=$"USRP RIO device", reference frequency source=$"Reference Frequency Source", tx config=$"tx config") -> (niusrprio session=w1, tx.coerced configurations=w2, tx.output waveform=w3, error out=w4, tx channels=w5)
  # 2.
  call "Configure Time (Single).gvi"(niUsrpRio Session=w1, error in=w4) -> (niUsrpRio Session (out)=w6, error out=w7)
  s1 = w7  # shift register
  while (iteration -> i1) {
    Is Equal To 0(x=i1) -> w8
    # 3.
    call "Initiate and Generate Time (Single).gvi"(niusrprio session=w6, start trigger delay=1, retrigger delay=0.1, first iteration=w8, error in=s1, tx channels=w5) -> (niusrprio session 2=w9, error out=w10)
    Logical Or(w10, $"tx.stop") -> w11
    Not(x=w11) -> w12
    $Generating <- w12
    next s1 = w10
    stop if w11
  }
  # 4.
  call "Close Device.gvi"(niusrprio session=w9, error in=s1) -> (error out=w13)
  call "Simple Error Handler.gvi"(type of dialog="OK message + warnings", error in=w13)
  $"TX Coerced Configurations" <- w2
  $"Output Waveform" <- w3
