vi "Tx and Rx Streaming (Host).gvi"   [LabVIEW Communications System Design Suite 2.0.1]
panel controls:
  "Tab": i32
  "USRP RIO device": string = "RIO0"
  "Reference Frequency Source": string = "Internal"
  "tx.stop": bool
  "rx.stop": bool
  "Tab_2": i32
  "tx config": T7 = {"rf enable 0"=TRUE, "rf config 0"={"Antenna RF 0"="TX1", "Frequency RF 0 [Hz]"=2000000000, "LO Frequency RF 0 [Hz]"=-1, "Output Power RF 0 [dBm]"=0}, "rf enable 1"=TRUE, "rf config 1"={"Antenna RF 1"="TX1", "Frequency RF 1 [Hz]"=2000000000, "LO Frequency RF 1 [Hz]"=-1, "Output Power RF 1 [dBm]"=0}, "Number of Samples is Finite"=TRUE, "Sample Rate [S/s]"=10000000, "Number of Samples"=8192, "Start Trigger"="Immediate", "Tone Frequency [Hz]"=100000}
  "rx config": T10 = {"rf enable 0"=TRUE, "rf config 0"={"Antenna RF 0"="RX2", "Frequency RF 0 [Hz]"=2000000000, "LO Frequency RF 0 [Hz]"=-1, "Reference Level RF 0 [dBm]"=0}, "rf enable 1"=TRUE, "rf config 1"={"Antenna RF 1"="RX2", "Frequency RF 1 [Hz]"=2000000000, "LO Frequency RF 1 [Hz]"=-1, "Reference Level RF 1 [dBm]"=0}, "Number of Samples is Finite"=TRUE, "Sample Rate [S/s]"=10000000, "Number of Samples"=8192, "Start Trigger"="Immediate"}
panel indicators:
  "Power Spectrum": T1[]
  "Power Level": f64[][]
  "I & Q Data": f64[][]
  "Output Waveform": waveform<f64>[]
  "TX Coerced Configurations": T2
  "Acquiring": bool
  "Generating": bool
  "RX Coerced Configurations": T3
types:
  T1 = cluster{"f0": f64, "df": f64, "magnitude": f64[]}
  T2 = cluster{"Coerced Frequencies [Hz]": f64[], "Coerced LO Frequencies [Hz]": f64[], "Coerced Output Powers [dBm]": f64[], "Coerced Sample Rates [S/s]": f64[]}
  T3 = cluster{"Coerced Frequencies [Hz]": f64[], "Coerced LO Frequencies [Hz]": f64[], "Coerced Levels [dBm]": f64[], "Coerced Sample Rates [S/s]": f64[]}
  T4 = cluster{"Antenna RF 0": string, "Frequency RF 0 [Hz]": f64, "LO Frequency RF 0 [Hz]": f64, "Output Power RF 0 [dBm]": f64}
  T5 = cluster{"Antenna RF 1": string, "Frequency RF 1 [Hz]": f64, "LO Frequency RF 1 [Hz]": f64, "Output Power RF 1 [dBm]": f64}
  T6 = enum{"Software", "Digital Edge", "Rx Start Trigger", "Tx Start Trigger", "Immediate", "Future Time Event"}
  T7 = cluster{"rf enable 0": bool, "rf config 0": T4, "rf enable 1": bool, "rf config 1": T5, "Number of Samples is Finite": bool, "Sample Rate [S/s]": f64, "Number of Samples": u32, "Start Trigger": T6, "Tone Frequency [Hz]": f64}
  T8 = cluster{"Antenna RF 0": string, "Frequency RF 0 [Hz]": f64, "LO Frequency RF 0 [Hz]": f64, "Reference Level RF 0 [dBm]": f64}
  T9 = cluster{"Antenna RF 1": string, "Frequency RF 1 [Hz]": f64, "LO Frequency RF 1 [Hz]": f64, "Reference Level RF 1 [dBm]": f64}
  T10 = cluster{"rf enable 0": bool, "rf config 0": T8, "rf enable 1": bool, "rf config 1": T9, "Number of Samples is Finite": bool, "Sample Rate [S/s]": f64, "Number of Samples": u32, "Start Trigger": T6}
diagram:
  # 1. Open and configure device
  # 2a. Receive data
  # 2b. Transmit data
  # 3. Close device
  # 1.
  call "Open and Configure Device.gvi"(usrp rio device=$"USRP RIO device", reference frequency source=$"Reference Frequency Source", rx config=$"rx config", tx config=$"tx config") -> (niusrprio session=w1, rx.coerced configurations=w2, tx.coerced configurations=w3, tx.output waveform=w4, error out=w5, rx channels=w6, tx channels=w7)
  s1 = w5  # shift register
  while (iteration -> i1) {
    Is Equal To 0(x=i1) -> w8
    # 2a.
    call "Initiate and Fetch (Single).gvi"(niusrprio session=w1, first iteration=w8, error in=s1, rx channels=w6) -> (complex baseband data=w9, niusrprio session 2=w10, error out=w11)
    call "Elapsed Time.gvi"(Time Target (s)=0.05) -> (Time has Elapsed=w12)
    case (w12) {
      frame False, Default { }
      frame True {
        for {
          w13 = each element of w9
          call "Calculate Power Spectrum.gvi"(iq data=w13) -> (power spectrum=w17)
          Property Node(instance in=w13) -> ("Y"=w18)
          call "Calculate IQ Power Level.gvi"(IQ data=w18) -> (power level (dBm)=w19)
          Complex To Real Imaginary(x + iy=w18) -> (x=w20, y=w21)
          Build Array(w20, w21) -> w22
          append w19 to w14
          append w17 to w15
          concatenate w22 onto w16
        }
        $"Power Spectrum" <- w15
        $"Power Level" <- w14
        $"I & Q Data" <- w16
      }
    }
    Logical Or(w11, $"rx.stop") -> w23
    Not(x=w23) -> w24
    $Acquiring <- w24
    next s1 = w11
    stop if w23
  }
  s2 = w5  # shift register
  while (iteration -> i2) {
    Is Equal To 0(x=i2) -> w25
    # 2b.
    call "Initiate and Generate (Single).gvi"(niusrprio session=w1, first iteration=w25, error in=s2, tx channels=w7) -> (error out=w26)
    Logical Or(w26, $"tx.stop") -> w27
    Not(x=w27) -> w28
    $Generating <- w28
    next s2 = w26
    stop if w27
  }
  Merge Errors(s1, s2) -> (error out=w29)
  # 3.
  call "Close Device.gvi"(niusrprio session=w10, error in=w29) -> (error out=w30)
  call "Simple Error Handler.gvi"(type of dialog="OK message + warnings", error in=w30)
  $"RX Coerced Configurations" <- w2
  $"TX Coerced Configurations" <- w3
  $"Output Waveform" <- w4
