vi "Tx and Rx Streaming Time (Host).gvi"   [LabVIEW Communications System Design Suite 2.0.1]
panel controls:
  "Tab": i32
  "USRP RIO device": string = "RIO0"
  "Reference Frequency Source": string = "Internal"
  "stop": bool
  "Tab_2": i32 = 1
  "tx config": T7 = {"rf enable 0"=TRUE, "rf config 0"={"Antenna RF 0"="TX1", "Frequency RF 0 [Hz]"=2000000000, "LO Frequency RF 0 [Hz]"=-1, "Output Power RF 0 [dBm]"=0}, "rf enable 1"=TRUE, "rf config 1"={"Antenna RF 1"="TX1", "Frequency RF 1 [Hz]"=2000000000, "LO Frequency RF 1 [Hz]"=-1, "Output Power RF 1 [dBm]"=0}, "Number of Samples is Finite"=TRUE, "Sample Rate [S/s]"=10000000, "Number of Samples"=8192, "Start Trigger"="Rx Start Trigger", "Tone Frequency [Hz]"=100000}
  "rx config": T10 = {"rf enable 0"=TRUE, "rf config 0"={"Antenna RF 0"="RX2", "Frequency RF 0 [Hz]"=2000000000, "LO Frequency RF 0 [Hz]"=-1, "Reference Level RF 0 [dBm]"=0}, "rf enable 1"=TRUE, "rf config 1"={"Antenna RF 1"="RX2", "Frequency RF 1 [Hz]"=2000000000, "LO Frequency RF 1 [Hz]"=-1, "Reference Level RF 1 [dBm]"=0}, "Number of Samples is Finite"=TRUE, "Sample Rate [S/s]"=10000000, "Number of Samples"=8192, "Start Trigger"="Future Time Event"}
panel indicators:
  "Power Spectrum": T1[]
  "Power Level": f64[][]
  "I & Q Data": f64[][]
  "Output Waveform": waveform<f64>[]
  "TX Coerced Configurations": T2
  "Acquiring": bool
  "Generating": bool
  "RX Coerced Configurations": T3
types:
  T1 = cluster{"f0": f64, "df": f64, "magnitude": f64[]}
  T2 = cluster{"Coerced Frequencies [Hz]": f64[], "Coerced LO Frequencies [Hz]": f64[], "Coerced Output Powers [dBm]": f64[], "Coerced Sample Rates [S/s]": f64[]}
  T3 = cluster{"Coerced Frequencies [Hz]": f64[], "Coerced LO Frequencies [Hz]": f64[], "Coerced Levels [dBm]": f64[], "Coerced Sample Rates [S/s]": f64[]}
  T4 = cluster{"Antenna RF 0": string, "Frequency RF 0 [Hz]": f64, "LO Frequency RF 0 [Hz]": f64, "Output Power RF 0 [dBm]": f64}
  T5 = cluster{"Antenna RF 1": string, "Frequency RF 1 [Hz]": f64, "LO Frequency RF 1 [Hz]": f64, "Output Power RF 1 [dBm]": f64}
  T6 = enum{"Software", "Digital Edge", "Rx Start Trigger", "Tx Start Trigger", "Immediate", "Future Time Event"}
  T7 = cluster{"rf enable 0": bool, "rf config 0": T4, "rf enable 1": bool, "rf config 1": T5, "Number of Samples is Finite": bool, "Sample Rate [S/s]": f64, "Number of Samples": u32, "Start Trigger": T6, "Tone Frequency [Hz]": f64}
  T8 = cluster{"Antenna RF 0": string, "Frequency RF 0 [Hz]": f64, "LO Frequency RF 0 [Hz]": f64, "Reference Level RF 0 [dBm]": f64}
  T9 = cluster{"Antenna RF 1": string, "Frequency RF 1 [Hz]": f64, "LO Frequency RF 1 [Hz]": f64, "Reference Level RF 1 [dBm]": f64}
  T10 = cluster{"rf enable 0": bool, "rf config 0": T8, "rf enable 1": bool, "rf config 1": T9, "Number of Samples is Finite": bool, "Sample Rate [S/s]": f64, "Number of Samples": u32, "Start Trigger": T6}
diagram:
  # 1. Open and configure device
  # 2. Configure Time
  # 3a. Transmit data
  # 3b. Receive data
  # 4. Close device
  # 1.
  call "Open and Configure Device.gvi"(usrp rio device=$"USRP RIO device", reference frequency source=$"Reference Frequency Source", rx config=$"rx config", tx config=$"tx config") -> (niusrprio session=w1, rx.coerced configurations=w2, tx.coerced configurations=w3, tx.output waveform=w4, error out=w5, rx channels=w6, tx channels=w7)
  # 2.
  call "Configure Time (Single).gvi"(niUsrpRio Session=w1, error in=w5) -> (niUsrpRio Session (out)=w8, error out=w9)
  # 4.
  s1 = w9  # shift register
  while (iteration -> i1) {
    Is Equal To 0(x=i1) -> w10
    # 3a.
    call "Initiate and Generate Time (Single).gvi"(niusrprio session=w8, start trigger delay=1, retrigger delay=0.1, first iteration=w10, error in=s1, tx channels=w7) -> (niusrprio session 2=w11, error out=w12)
    call "Initiate and Fetch Time (Single).gvi"(niusrprio session=w11, start trigger delay=1, retrigger delay=0.1, first iteration=w10, error in=w12, rx channels=w6) -> (complex baseband data=w13, niusrprio session 2=w14, error out=w15)
    call "Elapsed Time.gvi"(Time Target (s)=0.05) -> (Time has Elapsed=w16)
    # 3b.
    case (w16) {
      frame False, Default { }
      frame True {
        for {
          w17 = each element of w13
          call "Calculate Power Spectrum.gvi"(iq data=w17) -> (power spectrum=w21)
          Property Node(instance in=w17) -> ("Y"=w22)
          call "Calculate IQ Power Level.gvi"(IQ data=w22) -> (power level (dBm)=w23)
          Complex To Real Imaginary(x + iy=w22) -> (x=w24, y=w25)
          Build Array(w24, w25) -> w26
          append w23 to w18
          append w21 to w19
          concatenate w26 onto w20
        }
        $"Power Spectrum" <- w19
        $"Power Level" <- w18
        $"I & Q Data" <- w20
      }
    }
    Logical Or(w15, $stop) -> w27
    Not(x=w27) -> w28
    $Generating <- w28
    $Acquiring <- w28
    next s1 = w15
    stop if w27
  }
  call "Close Device.gvi"(niusrprio session=w14, error in=s1) -> (error out=w29)
  call "Simple Error Handler.gvi"(type of dialog="OK message + warnings", error in=w29)
  $"RX Coerced Configurations" <- w2
  $"TX Coerced Configurations" <- w3
  $"Output Waveform" <- w4
