vi "GFDM Host_Cebit.gvi"   [LabVIEW Communications System Design Suite 2.0.1]
panel controls:
  "stop": bool = TRUE
  "GFDM parameter": "GFDM parameter.gtype" = {"Variable: K"=16, "Variable: M"=9, "Variable: a"=0, "filter type"="rc", "receive filter"="ZF", "inverse FFT"=FALSE, "Variable: b"=0, "Ncs"=32, "Ncp"=32}
  "Operation": i32
  "TX.modem.bitshift_in": i16 = 15
  "USRP RIO device": string = "RIO0"
  "Reference Frequency Source": string = "Internal"
  "TX.automatic trigger_in": bool = TRUE
  "RX.switch channels": bool
  "Channel Length": i32 = 32
  "RX.modem.bitshift_in": i16 = 15
  "RX.modem.fft.bitshift_in": i16 = 15
  "TX.modem.transmission time interval": u64 = 1000
  "TX.enabled": bool = TRUE
  "Control Tab": i32 = 1
  "UART.control": T11 = {"txEnable"=TRUE, "rxEnable"=TRUE, "Reset"=FALSE, "baud_count"=200, "reset frame counter"=FALSE, "reset tx counter"=FALSE, "reset rx counter"=FALSE}
  "Use Phase Tracking": bool = TRUE
  "RM:No DC": bool = TRUE
  "TX.Sample Rate [S/s]": f64 = 2000000
  "RX.Frequency [Hz]": f64 = 3517500000
  "TX.Frequency [Hz]": f64 = 3529000000
  "RX1.Sample Rate [S/s]": f64 = 15000000
  "Preamble path": path
  "Preamble mode": T15 = "Load from file"
  "preamble scale": f64 = 7
  "Fully allocated?": bool = TRUE
  "RX.sync.config": T16 = {"CFO removal"=FALSE, "ffoPiControlCte"=9.91821289062e-05, "Pi Control"=0.100006103516, "Analog Gain Controller"=TRUE, "setpoint (max. amplitude)"=0.700042724609, "numbOfBlocksBeforGainChange"=5, "Digital Gain Controller"=FALSE, " Gain [dB]"=26, "permissible error [dB]"=1}
  "normalize preamble?": bool = TRUE
  "CCA. channel": bool = TRUE
  "CCA.Control": T18
  "RX0.Sample Rate [S/s]": f64 = 80000000
  "RX.enable": bool = TRUE
  "DC correction.n": i16[2] = [10, 10]
  "DC correction.enable": bool[2] = [TRUE, TRUE]
  "Pazload size": i32 = "11"(0)
  "Transmit interval [us]": u32 = 100
  "Host.TX": bool
  "Data Routing": T19 = "Data from Host"
  "CRC Poly": u16 = 4129
  "CRC initi value (T/F)": bool
  "Packet length": i32 = 8
  "Source port": u16 = 8889
  "Host address": string = "localhost"
  "Destination Port": u16 = 60000
  "Destination address": string = "localhost"
  "Reset counters": bool
  "enable plots": bool = TRUE
  "network update interval [ms]": u32 = 3000
  "max number of packets": i32 = 1
  "TestMan broadcasts": bool = TRUE
  "TestManConfig out": T20 = {"port"=50000, "ip"="224.5.6.7", "connection"=refnum, "type"=123, "id"=123}
  "latency measurment timeout [ms]_in": u32 = 20
  "Measurement active_in": bool = TRUE
  "TestManConfig in": T20 = {"port"=50000, "ip"="224.5.6.7", "connection"=refnum, "type"=123, "id"=123}
  "repeat every [ms]": u32 = 50
panel indicators:
  "general error description": string  # source out indicates the source of the error.
  "rx.number of overflows": u32
  "rx 1.output sample rate": UFXP(1.47)
  "rx 0.number of IQ data overflows": u64
  "rx.samples processed": u32
  "rx.samples to acquire": u32
  "rx.state": enum{"Idle", "Active"}
  "tx 0.number of IQ data overflows": u64
  "rx 1.number of IQ data overflows": u64
  "tx 1.number of IQ data overflows": u64
  "tx 0.input sample rate": UFXP(1.47)
  "TX.modem.DEBUG.cluster_out": T4
  "tx.RF.state": enum{"Idle", "Active"}
  "tx.underflows": u32
  "TX Coerced Configurations": T5
  "RX Coerced Configurations": T6
  "RX.sync.sync found_out": u32
  "preamble": f64[][]
  "FPGA configuration": T7
  "RX.sync.GFDM configuration cluster": T8
  "channel freq domain": f64[][]
  "channel time domain": f64[][]
  "IQ": c128[][]
  "RE_data": f64[]
  "IM_data": f64[]
  "RX.modem.DEBUG.cluster_out": T10
  "Channel Freq. Resp.": c128[]
  "Update of channel coefficients": bool
  "Number of channel coefficients update": f64
  "received preamble": u32[]
  "transmission interval [s]": f64
  "UART.status": T12
  "K_set": i16[]
  "M_set": i16[]
  "RM properties": T13
  "TX signal": FXP(3.14)[][]
  "RX.RM.debug counter_out": T14
  "Pilot-Betrag": UFXP(2.14)[]
  "Pilot-Phase": f64[]
  "empty elements remaining": u32
  "Minimum Receive Power": f64
  "rms value": f64
  "Preamble Power_Host": f64
  "Preamble Power_Host Chart": f64
  "PSD": f64[]
  "QAM symbols per Frame": u32
  "RX Gain": UFXP(5.1)
  "RX.sync.lastWrittenRxGain": UFXP(5.1)
  "rx 0.output sample rate": UFXP(1.47)
  "CCA.status": T17
  "CCA.No frames": u64
  "DC correction. applied": CFXP(1.17)[2]
  "DC correction. average": CFXP(15.17)[2]
  "GFDM B": u16
  "Payload_size": i32
  "Data Clock Rate": u32
  "Nof PHY Tx frames": u32
  "Nof PHY correct frames": u32
  "Nof PHY malframes": u32
  "PHY Frame Error rate": f64
  "Nof MAC Tx Packets": u32
  "Nof MAC RX packets": u32
  "latency": u32
  "test packets received out": u32
  "latency value": u32
types:
  "GFDM parameter.gtype" = cluster{"Variable: K": i32, "Variable: M": i32, "Variable: a": f64, "filter type": enum{"rc", "rect"}, "receive filter": enum{"MF", "ZF"}, "inverse FFT": bool, "Variable: b": f64, "Ncs": u16, "Ncp": u16}
  T1 = cluster{"packets in_out": u16, "samples in_out": u16, "packets out_out": u16, "samples out_out": u16, "number of invalid samples": u64, "mod first samples out": u64, "mod last samples out": u64}
  T2 = cluster{"FFT misalignment": u64, "FFT halt": u64, "FFT last sample": u64}
  T3 = cluster{"number of invalid samples": u64, "first samples out": u64, "last samples out": u64, "number of cycles": u64}
  T4 = cluster{"Element 1": T1, "Element 2": T2, "Element 3": T3}
  T5 = cluster{"Coerced Frequencies [Hz]": f64[], "Coerced LO Frequencies [Hz]": f64[], "Coerced Output Powers [dBm]": f64[], "Coerced Sample Rates [S/s]": f64[]}
  T6 = cluster{"Coerced Frequencies [Hz]": f64[], "Coerced LO Frequencies [Hz]": f64[], "Coerced Levels [dBm]": f64[], "Coerced Sample Rates [S/s]": f64[]}
  T7 = cluster{"K-1": u16, "M-1": u8, "N-1": u16, "N": u16, "Npreamble+CP+CS": u16, "Npreamble": u16, "Nw": u16, "Modulator MUX config": u64[16], "K": u16, "fft_size_log2(K)": u8, "inverse_fft": bool, "Start with preamble": bool, "Burstmode": bool, "Ncs": u16, "Ncp": u16, "N-Ncp": u16, "N+Ncp": u16, "N+Ncp+Ncs": u16, "Demodulator MUX config": u64[16], "M": u8, "DFT SIZE": FXP(6.0), "Frame length": u32, "Super frame length": u32, "Ns_all_GFDM_blocks": u32, "Ns_all_preambles": u32}
  T8 = cluster{"Preamble mu": u16, "GFDM B": u16, "Preamble K": u16, "Preamble Ncp": u16, "GFDM Ncp": u16, "GFDM M": u16, "Preamble Ncs": u16, "GFDM K": u16, "GFDM Ncs": u16, "Preamble M": u16}
  T9 = cluster{"FFT misalignment count": u8, "FFT halt count": u8, "block start": u16, "block end": u16, "overflow_2": u16, "update active_2": u16, "update done_2": u16, "first sample out_2": u16, "exponent": FXP(4.0), "exponent_2": FXP(4.0), "elements read_2": u32}
  T10 = cluster{"Element 1": T1, "Element 2": T2, "Element 3": T3, "Element 4": T9}
  T11 = cluster{"txEnable": bool, "rxEnable": bool, "Reset": bool, "baud_count": u16, "reset frame counter": bool, "reset tx counter": bool, "reset rx counter": bool}
  T12 = cluster{"debug rxData": u8, "debug txData": u8, "debug rxData valid": bool, "tx FIFO output valid": bool, "debug txRdy": bool, "count Error": u32, "count tx [Bytes]": u32, "count rx [Byte]": u32}
  T13 = cluster{"Element 1": u16, "Element 2": u16, "Element 3": u16, "Element 4": u16}
  T14 = cluster{"first samples in": u16, "samples input": u16, "samples multiplexed": u16, "samples divided in blocks before multiplexer": u16, "corrected samples": u16, "samples divided in blocks after multiplexer": u16, "overflow counter_out": u16, "lost samples_out": u16, "state": u8}
  T15 = enum{"Load from file", "Generate GFDM based Preamble"}
  T16 = cluster{"CFO removal": bool, "ffoPiControlCte": FXP(2.17), "Pi Control": UFXP(1.15), "Analog Gain Controller": bool, "setpoint (max. amplitude)": UFXP(0.15), "numbOfBlocksBeforGainChange": u16, "Digital Gain Controller": bool, " Gain [dB]": UFXP(5.1), "permissible error [dB]": UFXP(5.1)}
  T17 = cluster{"Power": FXP(9.7), "Channel free?": bool, "Current sample": u16}
  T18 = cluster{"reset measure": bool, "Power Offset": FXP(9.7), "Threshold": FXP(9.7)}
  T19 = enum{"Data from Host", "Data from UART", "UART Loopback", "RX TX Loopback", "Data from Peer", ""}
  T20 = cluster{"port": u16, "ip": string, "connection": UdpNetworkConnectionRefnum, "type": u8, "id": u8}
  T21 = cluster{"Antenna RF 0": string, "Frequency RF 0 [Hz]": f64, "LO Frequency RF 0 [Hz]": f64, "Output Power RF 0 [dBm]": f64}
  T22 = cluster{"Antenna RF 1": string, "Frequency RF 1 [Hz]": f64, "LO Frequency RF 1 [Hz]": f64, "Output Power RF 1 [dBm]": f64}
  T23 = enum{"Software", "Digital Edge", "Rx Start Trigger", "Tx Start Trigger", "Immediate", "Future Time Event"}
  T24 = cluster{"rf enable 0": bool, "rf config 0": T21, "rf enable 1": bool, "rf config 1": T22, "Number of Samples is Finite": bool, "Sample Rate [S/s]": f64, "Number of Samples": u32, "Start Trigger": T23, "Tone Frequency [Hz]": f64}
  T25 = cluster{"Antenna RF 0": string, "Frequency RF 0 [Hz]": f64, "LO Frequency RF 0 [Hz]": f64, "Reference Level RF 0 [dBm]": f64}
  T26 = cluster{"Antenna RF 1": string, "Frequency RF 1 [Hz]": f64, "LO Frequency RF 1 [Hz]": f64, "Reference Level RF 1 [dBm]": f64}
  T27 = cluster{"rf enable 0": bool, "rf config 0": T25, "rf enable 1": bool, "rf config 1": T26, "Number of Samples is Finite": bool, "Sample Rate [S/s]": f64, "Number of Samples": u32, "Start Trigger": T23}
  T28 = enum{"TX1 RX1 transmits and RX2 receives", "TX1 RX1 receives and RX2 is unused"}
  T29 = cluster{"set": bool, "lo lpf": bool, "cpld ": bool, "switchChannel": bool, "Destination": enum{"configRx", "configTx"}, "antenna configuration": T28, "daughterboard": enum{"sbx", "cbx", "wbx", "unknown", "ubx"}, "GainIn": UFXP(5.1), "spi address": u8}
uses:
  NI::Analysis::Statistics::RMS (CDB).gvi
  NI::Analysis::Transforms::Inverse Complex FFT.gvi
diagram:
  Obtain Queue(element data type=u8[] [], name="extraData") -> (error out=w1, queue out=w2)
  Flush Queue(error in=w1, queue=w2)
  Obtain Queue(element data type=u8[] [], name="latency") -> (error out=w3, queue out=w4)
  Flush Queue(error in=w3, queue=w4)
  $stop <- FALSE
  $"received preamble" <- u32[] []
  Property Node(instance in=T21 {all zero or empty}, "Antenna RF 0"="TX1", "Frequency RF 0 [Hz]"=$"TX.Frequency [Hz]", "LO Frequency RF 0 [Hz]"=-1, "Output Power RF 0 [dBm]"=26) -> (instance out=w5)
  w6 = T24 {"rf enable 0"=TRUE, "rf config 0"={"Antenna RF 0"="TX1", "Frequency RF 0 [Hz]"=1990000000, "LO Frequency RF 0 [Hz]"=-1, "Output Power RF 0 [dBm]"=20}, "rf enable 1"=FALSE, "rf config 1"={"Antenna RF 1"="TX1", "Frequency RF 1 [Hz]"=1990000000, "LO Frequency RF 1 [Hz]"=-1, "Output Power RF 1 [dBm]"=0}, "Number of Samples is Finite"=FALSE, "Sample Rate [S/s]"=20000000, "Number of Samples"=800, "Start Trigger"="Software", "Tone Frequency [Hz]"=100000}
  Property Node(instance in=$"GFDM parameter") -> ("Variable: K"=w7, "Variable: M"=w8, "Ncs"=w9, "Ncp"=w10)
  Multiply(w7, w8) -> w11
  Add(w9, w10) -> w12
  Square(x=w12) -> w13
  Add(w11, 128, w13) -> w14
  Property Node(instance in=w6, "rf enable 0"=TRUE, "rf config 0"=w5, "rf enable 1"=FALSE, "rf config 1"=w5, "Number of Samples is Finite"=FALSE, "Sample Rate [S/s]"=$"TX.Sample Rate [S/s]", "Number of Samples"=w14, "Start Trigger"="Software") -> (instance out=w15)
  w16 = "RX2"  # Antenna RF0
  w17 = T25 {"Antenna RF 0"="RX2", "Frequency RF 0 [Hz]"=1990000000, "LO Frequency RF 0 [Hz]"=-1, "Reference Level RF 0 [dBm]"=0}
  Property Node(instance in=w17, "Antenna RF 0"=w16, "Frequency RF 0 [Hz]"=$"RX.Frequency [Hz]", "LO Frequency RF 0 [Hz]"=-1, "Reference Level RF 0 [dBm]"=0) -> (instance out=w18)
  w19 = T27 {"rf enable 0"=FALSE, "rf config 0"={"Antenna RF 0"="RX2", "Frequency RF 0 [Hz]"=1990000000, "LO Frequency RF 0 [Hz]"=-1, "Reference Level RF 0 [dBm]"=0}, "rf enable 1"=TRUE, "rf config 1"={"Antenna RF 1"="RX2", "Frequency RF 1 [Hz]"=2180000000, "LO Frequency RF 1 [Hz]"=-1, "Reference Level RF 1 [dBm]"=0}, "Number of Samples is Finite"=FALSE, "Sample Rate [S/s]"=20000000, "Number of Samples"=32000, "Start Trigger"="Immediate"}
  Property Node(instance in=w19, "rf enable 0"=TRUE, "rf config 0"=w18, "rf enable 1"=TRUE, "rf config 1"=w18, "Number of Samples is Finite"=FALSE, "Sample Rate [S/s]"=$"RX1.Sample Rate [S/s]", "Number of Samples"=w14, "Start Trigger"="Immediate") -> (instance out=w20)
  call "Reset FPGA.gvi"(USRP RIO device=$"USRP RIO device", L1=no error) -> (USRP RIO device out=w21)
  FPGA Open Node[ProjectItem=":NullTarget:Bitfile_GFDM\\ FPGA\\ Toplevel\\ for\\ 120MHz\\-with\\ CCA\\.lvbitx"](RIO address=$"USRP RIO device", error in=w21, run?=TRUE) -> (error out=w22, reference out=w23)
  call "Open and Configure Device.gvi"(FPGA in=w23, usrp rio device=$"USRP RIO device", reference frequency source=$"Reference Frequency Source", error in=w22, rx config=w20, tx config=w15) -> (niusrprio session=w24, rx.coerced configurations=w25, tx.coerced configurations=w26, error out=w27, rx channels=w28, tx channels=w29)
  Math Node("K"=w7, "M"=w8) -> ("K_set"=w30, "M_set"=w31)
  ~~~
  if(K == 32)
  K_set = [-K/2+4:-2, 2:K/2-4];
  else
  K_set = [-K/2+1:-1, 1:K/2-2];
  end
  M_set = 1:M-1;
  ~~~
  Boolean To Integer(Boolean=$"Use Phase Tracking") -> (0, 1=w32)
  Array Index(array=[11, 61, 92, 124, 250, 374, 464, 526, 624]) -> (out0[$"Pazload size"]=w33)
  call "ResourceMapperOptimization.gvi"(K_set=w30, M_set=w31, PayloadSize [Byte]=w33, ControlSize [Symbol]=w32, K=w7, M=w8, Replace Control with Pilots=$"Use Phase Tracking") -> (R_MAP=w34, N_Blocks [Blocks]=w35, N_DataSym_per_block [Symbol]=w36, K_set_out=w37, M_set_out=w38, InsufficientResources=w39, CanNotFit=w40, N_UsedResources [Byte]=w41)
  call "Initiate and Generate (Single).gvi"(niusrprio session=w24, first iteration=TRUE, error in=w27, tx channels=w29) -> (niusrprio session 2=w42, error out=w43)
  Property Node(instance in=w42) -> ("FPGA Interface"=w44, instance out=w45)
  call "Initiate and Fetch (Single).gvi"(niusrprio session=w45, first iteration=TRUE, error in=w43, rx channels=w28) -> (niusrprio session 2=w46, error out=w47)
  Dynamic Fpga Interface Cast(reference in=w44, type="FPGA interface.gtype" constant) -> (reference out=w48)
  Logical Or(w40, w39) -> w49
  Select(s=w49, t=error {"status"=TRUE, "code"=1, "source"="RM fault!"}, f=no error) -> w50
  Merge Errors(w47, w50) -> (error out=w51)
  call "Configure FIFOs.gvi"(FPGA interface in=w48, error in=w51, UseCAPIData=FALSE) -> (FPGA interface out=w52, error out=w53)
  case (w53) {
    frame No Error, Default {
      Obtain Queue(element data type=u8[] [], name="extraData") -> (error out=w57, queue out=w58)
      while {
        call "latencyMeasure.gvi"(packet size_in=$Payload_size, Measurement active_in=$"Measurement active_in", timeout in milliseconds_in=$"latency measurment timeout [ms]_in", repeat every [ms]=$"repeat every [ms]") -> (packet valid_out=w59, packet_out=w60, latency_out=w61, latency valid_out=w62)
        case (w59) {
          frame False, Default { }
          frame True {
            Enqueue Element(element=w60, error in=w57, queue=w58)
          }
        }
        case (w62) {
          frame False, Default { }
          frame True {
            $latency <- w61
            $"latency value" <- w61
            call "sendValue.gvi"(value=w61, active=$"TestMan broadcasts", TestManConfig out=$"TestManConfig out", value name="latency", update interval_in=1)
          }
        }
        Wait[Units=Microseconds](time to wait=100)
        stop if $stop
      }
      call "GFDM_Xcvr_configure FPGA.gvi"(FPGA interface in=w52, Error=w53, GFDM parameter=$"GFDM parameter", GFDM B=$"GFDM B", TX.Encoder.packet length [byte]=w41, Kset_in=w37, Preamble path=$"Preamble path", Preamble mode=$"Preamble mode", preamble scale=$"preamble scale") -> (FPGA interface out=w63, Error out=w64, GFDM all parameters=w65)
      call "RM config.gvi"(FPGA interface in=w63, R_MAP=w34, error in=w64) -> (Error=w66)
      Udp Open(error in=w66, net address=$"Host address", port=$"Source port") -> (connection ID=w67, error out=w68)
      while {
        Host Fifo Read Node[FifoName="Needed Resources.grsc\\RX.Data out.T2H"](error in=w68, number of elements=0, reference in=w63) -> (elements remaining=w69, error out=w70, reference out=w71)
        Is Greater Or Equal(x=w69, y=$Payload_size) -> w72
        Not(x=$"Reset counters") -> w73
        Feedback Node(initial value=0, input=w74) -> w75
        Select(s=w73, t=w75, f=0) -> w76
        Not(x=$"Reset counters") -> w77
        Feedback Node(initial value=0, input=w78) -> w79
        Select(s=w77, t=w79, f=0) -> w80
        case (w72) {
          frame False, Default {
            Wait[Units=Microseconds](time to wait=10)
            w78 = w80
            w74 = w76
            w81 = w67
          }
          frame True {
            Host Fifo Read Node[FifoName="Needed Resources.grsc\\RX.Data out.T2H"](error in=w70, number of elements=$Payload_size, reference in=w71) -> (data=w82)
            call "CRC16_Detect.gvi"(CRC frame=w82, initi value=$"CRC initi value (T/F)", Poly=$"CRC Poly") -> (Payload=w83, err=w84)
            case (w84) {
              frame False, Default {
                Increment(x=w80) -> w78
                Array Subset(array=w83, index0=1) -> w85
                Array Subset(array=w83, index0=0, length0=1) -> w86
                Array Index(array=w86) -> (out0[0]=w87)
                Feedback Node(initial value=0, input=w88) -> w89
                Is Not Equal(x=w87, y=w89) -> w90
                # w88: packet seq
                Not(x=$"Reset counters") -> w91
                Feedback Node(initial value=0, input=w92) -> w93
                Select(s=w91, t=w93, f=0) -> w94
                case (w90) {
                  frame False, Default {
                    w88 = w89
                    w81 = w67
                    w92 = w94
                  }
                  frame True {
                    Udp Write Binary(address=$"Destination address", connection ID=w67, data in=w85, port or service name=$"Destination Port", timeout ms=1000) -> (connection ID out=w81)
                    Increment(x=w94) -> w92
                    w88 = w87
                  }
                }
                $"Nof MAC RX packets" <- w92
                w74 = w76
              }
              frame True {
                Add Array Elements(numeric array=w82) -> (sum=w95: f64)
                Multiply($Payload_size, 255) -> w96
                Multiply(0.8, w96) -> w97
                Is Less Or Equal(x=w97, y=w95) -> w98
                call "limited counter.gvi"(increment=w98, limit=65555) -> (number out=w99)
                $"test packets received out" <- w99
                # dummy packet
                Is Equal(x=w95, y=127) -> w100
                case (w98) {
                  frame True {
                    # Latency test
                    # packet
                    Obtain Queue(element data type=u8[] [], name="latency") -> (error out=w101, queue out=w102)
                    Enqueue Element(element=w82, error in=w101, queue=w102)
                    w74 = w76
                  }
                  frame False {
                    Increment(x=w76) -> w103
                    # Real wrong packet
                    Select(s=w100, t=w76, f=w103) -> w74
                  }
                }
                w78 = w80
                w81 = w67
              }
            }
          }
        }
        $"Nof PHY correct frames" <- w78
        Add(w78, w74) -> w104
        Divide(x=w74, y=w104) -> w105
        $"PHY Frame Error rate" <- w105
        Feedback Node(input=w105) -> w106
        Is Not Equal(x=w105, y=w106) -> w107
        Logical And(w107, $"TestMan broadcasts") -> w108
        call "sendValue.gvi"(value=w105, active=w108, TestManConfig out=$"TestManConfig out", value name="frame error rate", update interval_in=500)
        $"Nof PHY malframes" <- w74
        stop if $stop
      }
      Udp Close(connection ID=w81)
      while (iteration -> i1) {
        Wait[Units=Microseconds](time to wait=$"Transmit interval [us]")
        Udp Read I Pv 6 Binary(connection ID=w67, max size=$"Packet length", timeout ms=0) -> (data out=w109)
        Feedback Node(initial value=0, input=w110) -> w111
        case ($"Host.TX") {
          frame False, Default {
            Quotient And Remainder(x=i1, y=10) -> (x-y*floor(x/y)=w112)
            Is Equal To 0(x=w112) -> w113
            Dequeue Element(queue=w58, timeout in ms=0) -> (element=w114, error out=w115, timed out?=w116)
            Not(x=w116) -> w117
            case (w117) {
              frame False, Default {
                case (w113) {
                  frame False, Default {
                    w118 = u8[] []
                  }
                  frame True {
                    Decrement(x=$Payload_size) -> w119
                    Initialize Array(element=0, size=w119) -> w120
                    Build Array[ConcatenateInputs=True](w120, 127) -> w118
                  }
                }
                Host Fifo Write Node[FifoName="Needed Resources.grsc\\TX.data in.H2T"](data=w118, error in=w115, reference in=w63)
              }
              frame True {
                Host Fifo Write Node[FifoName="Needed Resources.grsc\\TX.data in.H2T"](data=w114, error in=w115, reference in=w63)
              }
            }
            w110 = w111
          }
          frame True {
            Not(x=$"Reset counters") -> w121
            Select(s=w121, t=w111, f=0) -> w122
            Increment(x=w122) -> w110: u32
            Array Size(array=w109) -> (size(s)=w123)
            Is Less(x=w123, y=$"Packet length") -> w124
            Not(x=$"Reset counters") -> w125
            Feedback Node(initial value=0, input=w126) -> w127
            Select(s=w125, t=w127, f=0) -> w128
            Feedback Node(enable?=w129, initial value=u8[] [], input=w130) -> w131
            case (w124) {
              frame False, Default {
                Feedback Node(initial value=0, input=w132) -> w133
                Increment(x=w133) -> w132: u8
                Build Array[ConcatenateInputs=True](w132, w109) -> w134
                call "CRC16_Append.gvi"(Payload=w134, Poly=$"CRC Poly", initi value=$"CRC initi value (T/F)") -> (CRC frame=w130)
                Increment(x=w128) -> w126: u32
                w129 = TRUE
              }
              frame True {
                Dequeue Element(error in=w57, queue=w58, timeout in ms=0) -> (element=w135, timed out?=w129)
                Not(x=w129) -> w136
                Select(s=w136, t=w135, f=w131) -> w130
                w126 = w128
              }
            }
            Host Fifo Write Node[FifoName="Needed Resources.grsc\\TX.data in.H2T"](data=w130, error in=w68, reference in=w63)
            $"Nof MAC Tx Packets" <- w126
          }
        }
        $"Nof PHY Tx frames" <- w110
        stop if $stop
      }
      Property Node(instance in=w65) -> ("Modem Configuration:Super frame length"=w137)
      while {
        Host Fifo Read Node[FifoName="Needed Resources.grsc\\TX.Debug.frame out"](error in=w66, number of elements=0, reference in=w63) -> (elements remaining=w138, error out=w139, reference out=w140)
        Is Not Equal To 0(x=w138) -> w141
        case (w141) {
          frame False, Default {
            w142 = default
            w143 = default
          }
          frame True {
            call "Blocks in FIFO.gvi"(requested lenght=w137, number of elements in FIFO=w138) -> (number of elements=w144)
            Host Fifo Read Node[FifoName="Needed Resources.grsc\\TX.Debug.frame out"](error in=w139, number of elements=w144, reference in=w140) -> (error out=w145, reference out=w146)
            Host Fifo Read Node[FifoName="Needed Resources.grsc\\TX.Debug.frame out"](error in=w145, number of elements=w137, reference in=w146) -> (data=w142)
            w143 = TRUE
          }
        }
        Is Equal(x=$Operation, y=1) -> w147
        Logical And(w147, w143) -> w148
        case (w148) {
          frame False, Default { }
          frame True {
            call "u32 array to 2.14 CFX.gvi"(data=w142) -> (Array=w149)
            call "calculate psd.gvi"(time signal x=w149, shift?=TRUE) -> (element=w150)
            Array Size(array=w149) -> (size(s)=w151)
            Multiply(w151, 0.1) -> w152
            Initialize Array(element=0, size=w152) -> w153
            Build Array[ConcatenateInputs=True](w153, w150, w153) -> w154
            $PSD <- w154
            Complex To Real Imaginary(x + iy=w149) -> (x=w155, y=w156)
            Absolute Value(x=w149) -> w157
            Build Array(w155, w156, w157) -> w158
            $"TX signal" <- w158
          }
        }
        Wait[Units=Microseconds](time to wait=100)
        stop if $stop
      }
      Property Node(instance in=w65) -> ("Preamble"=w159)
      Array Size(array=w159) -> (size(s)=w160)
      Initialize Array(element=0, size=10) -> w161
      s1 = 0  # shift register
      s2 = w161  # shift register
      while {
        Host Fifo Write Node[FifoName="Needed Resources.grsc\\RX.channel Coefficients in"](data=u64[] [], error in=w66, reference in=w63) -> (empty elements remaining=w162)
        $"empty elements remaining" <- w162
        Wait[Units=Microseconds](time to wait=100)
        call "Preamble data available.gvi"(FPGA.Interface_in=w63, Error_in=w66, length=w160) -> (FPGA.Interface_out=w163, Error_out=w164, Data available=w165)
        case (w165) {
          frame False, Default {
            w166 = s1
            w167 = default
            w168 = s2
          }
          frame True {
            Host Fifo Read Node[FifoName="Needed Resources.grsc\\RX.Preamble out"](error in=w164, number of elements=w160, reference in=w163) -> (data=w169, error out=w170, reference out=w171)
            call "u32 4.12 CFX to CDB array.gvi"(appended array=w169) -> (x=w172)
            call "RMS (CDB).gvi"(x=w172) -> (rms value=w173)
            Replace Array Subset(inArray=s2, index=_, new=w173) -> w174
            Rotate 1D Array(array=w174, n=1) -> (array (last n elements first)=w168)
            Add Array Elements(numeric array=w168) -> (sum=w175)
            Array Size(array=w168) -> (size(s)=w176)
            Divide(x=w175, y=w176) -> w177
            Logarithm Base 10(x=w177) -> w178
            Multiply(w178, 10) -> w179
            $"Preamble Power_Host Chart" <- w179
            $"Preamble Power_Host" <- w179
            Property Node(instance in=w65) -> ("Preamble"=w180, "Modem Configuration:N"=w181, "Sync config:Preamble K"=w182)
            call "norm CFX.gvi"(Input=w172) -> (Output=w183)
            call "norm CFX.gvi"(Input=w180) -> (Output=w184)
            call "Channel Estimation.gvi"(Rx signal=w183, Preamble=w184, Channel Length=$"Channel Length", preamble FFT size=w182, index=0, data FFT size=w181, Fully allocated?=$"Fully allocated?") -> (Channel Freq. Resp.=w185)
            Array Size(array=w185) -> (size(s)=w186)
            Is Equal(x=w186, y=w181) -> w167
            case (w167) {
              frame False, Default {
                w166 = s1
              }
              frame True {
                Reciprocal(x=w185) -> w187
                call "CDB array to 2.14 FXP u32.gvi"(input=w187) -> (output=w188)
                for (iteration -> i2) {
                  w189 = each element of w188
                  Join Numbers(high(x)=i2, low(x)=w189) -> w191
                  append w191 to w190
                }
                Host Fifo Write Node[FifoName="Needed Resources.grsc\\RX.channel Coefficients in"](data=w190, error in=w170, reference in=w171)
                Increment(x=s1) -> w166
              }
            }
            $"rms value" <- w173
            Select(s=$"normalize preamble?", t=w183, f=w172) -> w192
            Is Equal(x=$Operation, y=3) -> w193
            case (w193) {
              frame False, Default { }
              frame True {
                Build Array(w192, w184) -> w194
                Absolute Value(x=w194) -> w195
                $preamble <- w195
                $"Channel Freq. Resp." <- w185
                Absolute Value(x=w185) -> w196
                Complex To Polar(r * e^(i*theta)=w185) -> (theta=w197)
                Build Array(w196, w197) -> w198
                $"channel freq domain" <- w198
                call "Inverse Complex FFT.gvi"(FFT{x}=w185) -> (x=w199)
                Complex To Polar(r * e^(i*theta)=w199) -> (theta=w200)
                Absolute Value(x=w199) -> w201
                Build Array(w201, w200) -> w202
                $"channel time domain" <- w202
                $"Number of channel coefficients update" <- s1
              }
            }
          }
        }
        $"Update of channel coefficients" <- w167
        next s1 = w166
        next s2 = w168
        stop if $stop
      }
      call "niUsrpRio Config v1 Host.lvlib__Decode Daughterboard Names.gvi"(niusrprio session in=w46, error in=w53) -> (daughterboard names=w203)
      Array Index(array=w203) -> (out0[_]=w204)
      while {
        Property Node(instance in=w63, error in=w66) -> ("rx.number of overflows"=w205, "rx.output sample rate"=w206, "rx 1.number of IQ data overflows"=w207, "rx 0.number of IQ data overflows"=w208, "rx.samples processed"=w209, "rx.samples to acquire"=w210, "rx.state"=w211, "tx 0.number of IQ data overflows"=w212, "tx 1.number of IQ data overflows"=w213, "tx.input sample rate"=w214, "TX.modem.DEBUG.cluster_out"=w215, "tx.state"=w216, "tx.underflows"=w217, "RX.sync.sync found_out"=w218, "TX.modem.configuration_in"=w219, "RX.sync.GFDM configuration cluster"=w220, "RX.modem.DEBUG.cluster_out"=w221, "UART.status"=w222, "RM properties"=w223, "RX.RM.debug counter_out"=w224, "RX.sync.lastWrittenRxGain"=w225, "rx 0.output sample rate"=w226, "CCA.status"=w227, "CCA.Noframes"=w228, "DC correction. applied"=w229, "DC correction. average"=w230, error out=w231, instance out=w232)
        $"rx.number of overflows" <- w205
        $"rx 1.output sample rate" <- w206
        Property Node(instance in=w65) -> ("Modem Configuration:N"=w233)
        w234 = T29 {"set"=FALSE, "lo lpf"=FALSE, "cpld "=FALSE, "switchChannel"=FALSE, "Destination"="configRx", "antenna configuration"="TX1 RX1 transmits and RX2 receives", "daughterboard"="cbx", "GainIn"=31.5, "spi address"=7}
        Property Node(instance in=w234, "switchChannel"=$"RX.switch channels", "daughterboard"=w204) -> (instance out=w235)
        Divide(x=$"RX0.Sample Rate [S/s]", y=$"Data Clock Rate") -> w236
        call "completeSynchConfig.gvi"(GfdmConfigurationCluster=w220, syncConfigIn=$"RX.sync.config") -> (syncConfigOut=w237)
        Property Node(instance in=w232, "RX.sync.config"=w237, "TX.modem.bitshift_in"=$"TX.modem.bitshift_in", "TX.automatic trigger_in"=$"TX.automatic trigger_in", "RX.switch channels"=$"RX.switch channels", "RX.equ.shift"=1, "RX.modem.bitshift_in"=$"RX.modem.bitshift_in", "RX.modem.fft.bitshift_in"=$"RX.modem.fft.bitshift_in", "RX.Encoder.shift"=0, "RX.Encoder.Switch I and Q"=FALSE, "RX.input delay"=1, "TX.Encoder.shift"=0, "TX.Encoder.Switch I and Q"=FALSE, "RX.sync.input enable_in"=$"RX.enable", "TX.modem.trigger limit"=$"TX.modem.transmission time interval", "TX.modem.enabled"=TRUE, "TX.modem.force transmission"=FALSE, "TX.encoder.enabled"=$"TX.enabled", "TX.encoder.force"=FALSE, "TX.encoder.threshold"=w233, "UART.control"=$"UART.control", "D2through9"=255, "Data Routing"=$"Data Routing", "AGC.config"=w235, "CCA.ch0/ch1"=$"CCA. channel", "CCA.Control"=$"CCA.Control", "DC correction.n"=$"DC correction.n", "DC correction.enable"=$"DC correction.enable", "rx 0.output sample rate"=w236, error in=w231) -> (error out=w55, instance out=w54)
        call "Display Error.gvi"(type of dialog="no dialog", error in=w55) -> (description=w238)
        $"general error description" <- w238
        $"rx 1.number of IQ data overflows" <- w207
        $"rx 0.number of IQ data overflows" <- w208
        $"rx.samples processed" <- w209
        $"rx.samples to acquire" <- w210
        $"rx.state" <- w211
        $"tx 0.number of IQ data overflows" <- w212
        $"tx 1.number of IQ data overflows" <- w213
        $"tx 0.input sample rate" <- w214
        $"TX.modem.DEBUG.cluster_out" <- w215
        $"tx.RF.state" <- w216
        $"tx.underflows" <- w217
        $"RX.sync.sync found_out" <- w218
        $"FPGA configuration" <- w219
        $"RX.sync.GFDM configuration cluster" <- w220
        $"RX.modem.DEBUG.cluster_out" <- w221
        $"UART.status" <- w222
        $"RM properties" <- w223
        $"RX.RM.debug counter_out" <- w224
        Wait(time to wait=10)
        $"RX.sync.lastWrittenRxGain" <- w225
        $"RX Gain" <- w225
        $"rx 0.output sample rate" <- w226
        $"CCA.status" <- w227
        $"CCA.No frames" <- w228
        $"DC correction. applied" <- w229
        $"DC correction. average" <- w230
        Divide(x=$"TX.modem.transmission time interval", y=180000000) -> w239
        $"transmission interval [s]" <- w239
        stop if $stop
      }
      call "Display Error.gvi"(type of dialog="no dialog", error in=w66) -> (description=w240)
      $"general error description" <- w240
      Is Equal(x=$"Preamble mode", y="Load from file") -> w241
      $"Fully allocated?" <- w241
      Property Node(instance in=w46) -> ("Data Clock Rate"=w242)
      $"Data Clock Rate" <- w242
      $"Minimum Receive Power" <- -35
      # w243: QAM symbols per Frame
      Multiply($Payload_size, 8) -> w243
      call "UDPopen.gvi"(error in=w66, TestManConfig in=$"TestManConfig in") -> (TestManConfig out=w244, error out=w245)
      while {
        Host Fifo Read Node[FifoName="Needed Resources.grsc\\RX.Debug.Modem_64 bit samples out"](error in=w245, number of elements=0, reference in=w63) -> (elements remaining=w246, error out=w247, reference out=w248)
        Host Fifo Read Node[FifoName="Needed Resources.grsc\\RX.Debug.Modem_32 bit samples out"](error in=w245, number of elements=0, reference in=w63) -> (elements remaining=w249, error out=w250, reference out=w251)
        call "IntegerMultipleOf.gvi"(availableSize=w246, blockSize=w243) -> (multipleOfBlockSize=w252)
        call "IntegerMultipleOf.gvi"(availableSize=w249, blockSize=w243) -> (multipleOfBlockSize=w253)
        Is Not Equal To 0(x=w252) -> w254
        Is Not Equal To 0(x=w253) -> w255
        Logical And(w254, w255) -> w256
        case (w256) {
          frame False, Default {
            w257 = w244
            w258 = w250
          }
          frame True {
            Host Fifo Read Node[FifoName="Needed Resources.grsc\\RX.Debug.Modem_64 bit samples out"](error in=w247, number of elements=w252, reference in=w248) -> (data=w259)
            Split Number(x=w259) -> (high(x)=w260, low(x)=w261)
            Is Equal(x=$Operation, y=0) -> w262
            Logical And(w262, $"enable plots") -> w263
            case (w263) {
              frame False, Default { }
              frame True {
                call "Calculate Pilot Results.gvi"(received pilot array=w260) -> (Pilot-Betrag=w264, Pilot-Phase=w265)
                $"Pilot-Betrag" <- w264
                $"Pilot-Phase" <- w265
              }
            }
            call "u32 array to 2.14 CFX.gvi"(data=w261) -> (Array=w266)
            To Double Precision Complex(number=w266) -> w267
            Is Equal(x=$Operation, y=4) -> w268
            Logical And(w268, $"enable plots") -> w269
            case (w269) {
              frame False, Default { }
              frame True {
                Complex To Real Imaginary(x + iy=w267) -> (x=w270, y=w271)
                $RE_data <- w270
                $IM_data <- w271
              }
            }
            Host Fifo Read Node[FifoName="Needed Resources.grsc\\RX.Debug.Modem_32 bit samples out"](error in=w250, number of elements=w253, reference in=w251) -> (data=w272, error out=w273)
            call "u32 array to 2.14 CFX.gvi"(data=w272) -> (Array=w274)
            To Double Precision Complex(number=w274) -> w275
            Is Equal(x=$Operation, y=0) -> w276
            Logical And(w276, $"enable plots") -> w277
            case (w277) {
              frame False, Default { }
              frame True {
                Build Array(w267, w275) -> w278
                $IQ <- w278
              }
            }
            case ($"TestMan broadcasts") {
              frame False, Default {
                w257 = w244
                w258 = w273
              }
              frame True {
                call "sendComplexData.gvi"(array_in=w267, error_in=w273, TestMan config_in=w244, update interval_in=$"network update interval [ms]", seriesName_in="IQ Data", chartName_in="IQ Data", max number of packets=$"max number of packets") -> (TestMan config_out=w257, Error_out=w258)
              }
            }
          }
        }
        Wait[Units=Microseconds](time to wait=1000)
        $"QAM symbols per Frame" <- w243
        stop if $stop
      }
      call "UDPstop.gvi"(TestManConfig=w257, Error=w258)
      $"TestManConfig out" <- w244
      w56 = w24
    }
    frame Error {
      call "Display Error.gvi"(type of dialog="no dialog", error in=w53) -> (description=w279)
      $"general error description" <- w279
      w54 = w52
      w55 = w53
      w56 = w24
    }
  }
  case (w55) {
    frame No Error, Default { }
    frame Error {
      $stop <- FALSE
    }
  }
  call "stop FIFOs.gvi"(FPGA interface in=w54, Error=w55) -> (error in=w280)
  call "Close Device.gvi"(niusrprio session=w56, error in=w280) -> (error out=w281)
  call "Display Error.gvi"(type of dialog="no dialog", error in=w281) -> (description=w282)
  $"general error description" <- w282
  $"RX Coerced Configurations" <- w25
  $"TX Coerced Configurations" <- w26
  $M_set <- w38
  call "Preset K+M set.gvi"(No DC=$"RM:No DC", M=w8, K=w7)
  $K_set <- w37
  $"GFDM B" <- w35
  $Payload_size <- w33
