vi "UDPdecode.gvi"   [LabVIEW Communications System Design Suite 2.0.1]
inputs:
  "TestManConfig in": T1 = {"port"=50000, "ip"="224.5.6.7", "connection"=refnum, "type"=123, "id"=123}
  "Error in": error
outputs:
  "Error out": error
  "TestManConfig out": T1
  "timestamp out": string
  "message out": T2
  "command out": string
  "Packet received": bool
types:
  T1 = cluster{"port": u16, "ip": string, "connection": UdpNetworkConnectionRefnum, "type": u8, "id": u8}
  T2 = cluster{"type": u8, "id": u8, "name of variable": string[], "content": string[]}
diagram:
  call "UDPreceive.gvi"(TestManConfig in=$"TestManConfig in", Error in=$"Error in") -> (Decoded packet=w1, Packet received=w2, TestManConfig out=w3, Error out=w4)
  $"TestManConfig out" <- w3
  $"Packet received" <- w2
  $"Error out" <- w4
  case (w2) {
    frame False, Default {
      w5 = default
      w6 = default
      w7 = default
    }
    frame True {
      call "UDPfind.gvi"(message in=w1, element="command") -> (value=w5, message out=w8)
      call "UDPfind.gvi"(message in=w8, element="timestamp") -> (value=w7, message out=w6)
    }
  }
  $"command out" <- w5
  $"message out" <- w6
  $"timestamp out" <- w7
