vi "UDPfind.gvi"   [LabVIEW Communications System Design Suite 2.0.1]
inputs:
  "message in": T1
  "element": string = "command"
  "Do not remove": bool
outputs:
  "value": string
  "found": bool
  "message out": T1
types:
  T1 = cluster{"type": u8, "id": u8, "name of variable": string[], "content": string[]}
diagram:
  Property Node(instance in=$"message in") -> ("name of variable"=w1, "content"=w2, instance out=w3)
  Search 1D Array(1D array=w1, element=$element) -> (index of element=w4)
  Is Less Than 0(x=w4) -> w5
  Logical Or($"Do not remove", w5) -> w6
  case (w6) {
    frame False, Default {
      Delete From Array(inArray=w1, index0=w4) -> w7
      Delete From Array(inArray=w2, index0=w4) -> w8
    }
    frame True {
      w7 = w1
      w8 = w2
    }
  }
  Property Node(instance in=w3, "name of variable"=w7, "content"=w8) -> (instance out=w9)
  $"message out" <- w9
  Array Index(array=w2) -> (out0[w4]=w10)
  $value <- w10
  Not(x=w5) -> w11
  $found <- w11
