vi "UDPopen.gvi"   [LabVIEW Communications System Design Suite 2.0.1]
inputs:
  "error in": error
  "TestManConfig in": T1 = {"port"=50000, "ip"="224.5.6.7", "connection"=refnum, "type"=123, "id"=123}
outputs:
  "TestManConfig out": T1
  "error out": error
types:
  T1 = cluster{"port": u16, "ip": string, "connection": UdpNetworkConnectionRefnum, "type": u8, "id": u8}
diagram:
  Property Node(instance in=$"TestManConfig in") -> ("port"=w1, "ip"=w2, instance out=w3)
  String To Ip Address(name=w2) -> (net address=w4)
  Udp Multicast Open(error in=$"error in", multicast address=w4, port=w1) -> (connection ID=w5, error out=w6)
  Property Node(instance in=w3, "connection"=w5) -> (instance out=w7)
  $"TestManConfig out" <- w7
  call "Simple Error Handler.gvi"(error source="Open UDP Multicast", error in=w6) -> (error out=w8)
  $"error out" <- w8
