vi "UDPreact.gvi"   [LabVIEW Communications System Design Suite 2.0.1]
inputs:
  "TestManConfig in": T1 = {"port"=50000, "ip"="224.5.6.7", "connection"=refnum, "type"=123, "id"=123}
  "error in": error
  "timestamp": string
  "message": string
  "timeout": string = "0"
  "received?": bool
outputs:
  "TestManConfig out": T1
  "error out": error
types:
  T1 = cluster{"port": u16, "ip": string, "connection": UdpNetworkConnectionRefnum, "type": u8, "id": u8}
  T2 = cluster{"type": u8, "id": u8, "name of variable": string[], "content": string[]}
diagram:
  w1 = T2 {"type"=0, "id"=0, "name of variable"=["command", "timeout", "timestamp"], "content"=[]}
  Property Node(instance in=w1) -> ("content"=w2, instance out=w3)
  Select(s=$"received?", t="received", f="executed") -> w4
  Insert Into Array(inArray=w2, new=w4, new=$timeout, new=$timestamp) -> w5
  Property Node(instance in=w3, "content"=w5) -> (instance out=w6)
  call "UDPsend.gvi"(TestManConfig in=$"TestManConfig in", error in=$"error in", Message=w6) -> (TestManConfig out=w7, error out=w8)
  $"TestManConfig out" <- w7
  $"error out" <- w8
