vi "UDPreceive.gvi"   [LabVIEW Communications System Design Suite 2.0.1]
inputs:
  "TestManConfig in": T2 = {"port"=50000, "ip"="224.5.6.7", "connection"=refnum, "type"=123, "id"=123}
  "Error in": error
outputs:
  "Decoded packet": T1
  "Packet received": bool
  "TestManConfig out": T2
  "Error out": error
types:
  T1 = cluster{"type": u8, "id": u8, "name of variable": string[], "content": string[]}
  T2 = cluster{"port": u16, "ip": string, "connection": UdpNetworkConnectionRefnum, "type": u8, "id": u8}
  T3 = cluster{"Element 1": u8, "Element 2": u8, "Element 3": string[], "Element 4": string[]}
diagram:
  Property Node(instance in=$"TestManConfig in") -> ("connection"=w1, instance out=w2)
  Udp Read(connection ID=w1, error in=$"Error in", max size=64000, timeout ms=10) -> (data out=w3, error out=w4)
  case (w4) {
    frame No Error, Default {
      String Length(string=w3) -> (length=w7)
      s1 = string[] []  # shift register
      s2 = string[] []  # shift register
      s3 = 3  # shift register
      while (iteration -> i1) {
        Increment(x=s3) -> w8
        String Subset(length (rest)=1, offset (0)=s3, string=w3) -> w9
        # Länge des Namens
        Type Cast(type=u8 0, x=w9) -> w10
        # Variablenname
        # Berechne Startindex des Inhalt
        String Subset(length (rest)=w10, offset (0)=w8, string=w3) -> w11
        # Erzeuge
        # Array
        # mit allen
        # Variablen-
        # namen
        Insert Into Array(inArray=s1, index0=i1, new=w11) -> w12
        Add(w10, w8) -> w13
        Add(w13, 4) -> w14
        String Subset(length (rest)=4, offset (0)=w13, string=w3) -> w15
        Reverse String(string=w15) -> (reversed=w16)
        # Länge des Inhalts
        Type Cast(type=u32 0, x=w16) -> w17
        # Berechne Startindex des nächsten Wertes
        String Subset(length (rest)=w17, offset (0)=w14, string=w3) -> w18
        Insert Into Array(inArray=s2, index0=i1, new=w18) -> w19
        Add(w14, w17) -> w20
        Increment(x=w20) -> w21
        Is Greater Or Equal(x=w21, y=w7) -> w22
        next s1 = w12
        next s2 = w19
        next s3 = w21
        stop if w22
      }
      String Subset(length (rest)=1, offset (0)=1, string=w3) -> w23
      Type Cast(type=u8 0, x=w23) -> w24
      String Subset(length (rest)=1, offset (0)=2, string=w3) -> w25
      # ID
      Type Cast(type=u8 0, x=w25) -> w26
      Build Cluster(w24, w26, s1, s2) -> w27
      call "UDPfind.gvi"(message in=w27, element="packetnumber") -> (value=w28, message out=w29)
      w30 = T3 {"Element 1"=0, "Element 2"=0, "Element 3"=["no data"], "Element 4"=["no data"]}
      Property Node(instance in=w2) -> ("type"=w31, "id"=w32)
      Is Equal(x=w31, y=w24) -> w33
      # Typ
      Is Equal(x=w32, y=w26) -> w34
      Logical And(w33, w34) -> w35
      Obtain Queue(element data type=string[] [], max queue size=10, name="packetnumber") -> (created new?=w36, error out=w37, queue out=w38)
      # Da keine Variablen
      # vorhanden, fungiert eine Queue
      # als Ersatz
      # Packet doppelt empfangen?
      case (w36) {
        frame False, Default {
          Dequeue Element(error in=w37, queue=w38) -> (element=w40, error out=w41, queue out=w42)
          Search 1D Array(1D array=w40, element=w28) -> (index of element=w43)
          Is Less Than 0(x=w43) -> w39
          case (w39) {
            frame False, Default {
              # Paket schon
              # empfangen
              w44 = w40
            }
            frame True {
              # Paket noch nicht
              # empfangen
              Insert Into Array(inArray=w40, new=w28) -> w44
            }
          }
          # Queue schon vorhanden
          # --> durchsuchen
          Enqueue Element(element=w44, error in=w41, queue=w42) -> (error out=w45, queue out=w46)
        }
        frame True {
          Insert Into Array(inArray=string[] [], new=w28) -> w47
          Enqueue Element(element=w47, error in=w37, queue=w38) -> (error out=w48, queue out=w49)
          # Queue noch nicht vorhanden,
          # daher neue erstellen
          w39 = TRUE
        }
      }
      call "UDPfind.gvi"(message in=w27, element="command", Do not remove=TRUE) -> (value=w50)
      # Nur ne befehlsbestätigung
      Is Equal(x=w50, y="ack") -> w51
      call "UDPfind.gvi"(message in=w27, element="type", Do not remove=TRUE) -> (value=w52, found=w53)
      Number To Decimal String(number=w31) -> (decimal integer string=w54)
      # command an jemand anderes geschickt?
      Is Not Equal(x=w54, y=w52) -> w55
      Is Empty String Or Path(string/path=w52) -> w56
      Logical And(w55, w53, not w56) -> w57
      call "UDPfind.gvi"(message in=w27, element="id", Do not remove=TRUE) -> (value=w58, found=w59)
      Number To Decimal String(number=w32) -> (decimal integer string=w60)
      Is Not Equal(x=w60, y=w58) -> w61
      Is Empty String Or Path(string/path=w58) -> w62
      Logical And(w61, w59, not w62) -> w63
      Logical Or(w57, w63) -> w64
      Logical And(not w64, not w51, not w35, w39) -> w6
      Select(s=w6, t=w29, f=w30) -> w5
    }
    frame Error {
      w65 = T3 {"Element 1"=0, "Element 2"=0, "Element 3"=["no data"], "Element 4"=["no data"]}
      w5 = w65
      w6 = FALSE
    }
  }
  $"Decoded packet" <- w5
  $"Packet received" <- w6
  $"TestManConfig out" <- w2
  call "Clear Errors.gvi"(error in=w4) -> (error out=w66)
  $"Error out" <- w66
