vi "UDPsend.gvi"   [LabVIEW Communications System Design Suite 2.0.1]
inputs:
  "TestManConfig in": T1 = {"port"=50000, "ip"="224.5.6.7", "connection"=refnum, "type"=123, "id"=123}
  "error in": error
  "Message": T2
outputs:
  "TestManConfig out": T1
  "error out": error
panel indicators:
  "String": string
  "output": u8[]
types:
  T1 = cluster{"port": u16, "ip": string, "connection": UdpNetworkConnectionRefnum, "type": u8, "id": u8}
  T2 = cluster{"type": u8, "id": u8, "name of variable": string[], "content": string[]}
diagram:
  Property Node(instance in=$"TestManConfig in") -> ("type"=w1, "id"=w2, instance out=w3)
  Property Node(instance in=w3) -> ("port"=w4, "ip"=w5, "connection"=w6, instance out=w7)
  $"TestManConfig out" <- w7
  Property Node(instance in=$Message) -> ("name of variable"=w8, "content"=w9)
  Type Cast(type=string "", x=w2) -> w10
  Type Cast(type=string "", x=w1) -> w11
  Concatenate Strings("`", w11) -> w12
  Concatenate Strings(w12, w10) -> w13
  # Beginn des Pakets: `[Type][ID]
  s1 = w13  # shift register
  for {
    w14 = each element of w8
    w15 = each element of w9
    # Abschlusszeichen
    Type Cast(type=string "", x=0) -> w16
    # Länge des
    # Namens
    String Length(string=w15) -> (length=w17)
    To Unsigned Byte Integer(number=w17) -> w18
    Type Cast(type=string "", x=w18) -> w19
    Reverse String(string=w19) -> (reversed=w20)
    # Länge des Inhaltes
    s2 = w20  # shift register
    while {
      Type Cast(type=s2, x=0) -> w21
      Concatenate Strings(s2, w21) -> w22
      String Length(string=s2) -> (length=w23)
      Is Greater Or Equal(x=w23, y=3) -> w24
      next s2 = w22
      stop if w24
    }
    String Length(string=w14) -> (length=w25)
    To Unsigned Byte Integer(number=w25) -> w26
    Type Cast(type=string "", x=w26) -> w27
    Concatenate Strings(s1, w27) -> w28
    # Variablen name schreiben
    # Länge des Inhaltes
    # mit Nullen auffüllen
    Concatenate Strings(w28, w14) -> w29
    # Inhalt schreiben
    Concatenate Strings(w29, s2) -> w30
    Concatenate Strings(w30, w15) -> w31
    Concatenate Strings(w31, w16) -> w32
    next s1 = w32
  }
  # Abschlusszeichen
  Type Cast(type=string "", x=0) -> w33
  Concatenate Strings(s1, w33) -> w34
  String To Ip Address(name=w5) -> (net address=w35)
  Udp Write(address=w35, connection ID=w6, data in=w34, error in=$"error in", port or service name=w4) -> (error out=w36)
  $"error out" <- w36
  $String <- w34
  Type Cast(type=u8[] [], x=w34) -> w37
  $output <- w37
