vi "UDPstop.gvi"   [LabVIEW Communications System Design Suite 2.0.1]
inputs:
  "TestManConfig": T1
  "Error": error
outputs:
  "error out": error
types:
  T1 = cluster{"port": u16, "ip": string, "connection": UdpNetworkConnectionRefnum, "type": u8, "id": u8}
diagram:
  Property Node(instance in=$TestManConfig) -> ("connection"=w1)
  Udp Close(connection ID=w1, error in=$Error) -> (error out=w2)
  $"error out" <- w2
