vi "latencyMeasure.gvi"   [LabVIEW Communications System Design Suite 2.0.1]
inputs:
  "packet size_in": u32 = 1000
  "Measurement active_in": bool
  "timeout in milliseconds_in": u32 = 1000
  "repeat every [ms]": u32 = 1000
  "queue in": Queue<u8[]>
  "error in": error
outputs:
  "packet valid_out": bool
  "packet_out": u8[]
  "latency_out": u32
  "latency valid_out": bool
diagram:
  Tick Count[Units=Microseconds]() -> (timer value=w1)
  Feedback Node(input=w2) -> w3
  Feedback Node(input=w4) -> w5
  Feedback Node(initial value="Bypass", input=w6) -> w7
  case (w7) {
    frame "Bypass", Default {
      Select(s=$"Measurement active_in", t="Idle", f=w7) -> w6
      Dequeue Element(error in=$"error in", queue=$"queue in", timeout in ms=$"timeout in milliseconds_in") -> (element=w12, timed out?=w13)
      Not(x=w13) -> w11
      Initialize Array(element=255, size=$"packet size_in") -> w14
      Select(s=w11, t=w14, f=w12) -> w10
      w4 = default
      w8 = default
      w9 = default
      w2 = w3
    }
    frame "Idle" {
      Select(s=$"Measurement active_in", t="Start", f="Bypass") -> w6
      Wait Until Next Multiple(multiple to wait=$"repeat every [ms]")
      w4 = default
      w8 = default
      w9 = default
      w10 = default
      w11 = default
      w2 = w3
    }
    frame "Start" {
      Initialize Array(element=255, size=$"packet size_in") -> w10
      w4 = w1
      w8 = default
      w9 = default
      w6 = "Wait"
      w11 = TRUE
      w2 = w3
    }
    frame "Wait" {
      Preview Queue Element(error in=$"error in", queue=$"queue in", timeout in ms=$"timeout in milliseconds_in") -> (timed out?=w15)
      Select(s=w15, t="Timeout", f="Calculate") -> w6
      w4 = w5
      w8 = default
      w9 = default
      w10 = u8[] []
      w11 = FALSE
      w2 = w3
    }
    frame "Calculate" {
      Dequeue Element(error in=$"error in", queue=$"queue in", timeout in ms=$"timeout in milliseconds_in")
      Subtract(x=w1, y=w5) -> w8
      Is Greater(x=w8, y=99) -> w9
      w4 = default
      w6 = "Idle"
      w10 = default
      w11 = default
      w2 = 0
    }
    frame "Timeout" {
      Increment(x=w3) -> w2: u64
      Is Greater(x=w2, y=20) -> w9
      w4 = default
      w8 = default
      w6 = "Idle"
      w10 = default
      w11 = default
    }
  }
  $packet_out <- w10
  $"packet valid_out" <- w11
  $latency_out <- w8
  $"latency valid_out" <- w9
