vi "sendComplexData.gvi"   [LabVIEW Communications System Design Suite 2.0.1]
inputs:
  "array_in": c128[]
  "error_in": error
  "precision": i16 = 6
  "TestMan config_in": T1
  "update interval_in": u32
  "chartName_in": string
  "max number of packets": i32 = 10
outputs:
  "TestMan config_out": T1
  "Error_out": error
types:
  T1 = cluster{"port": u16, "ip": string, "connection": UdpNetworkConnectionRefnum, "type": u8, "id": u8}
  T2 = cluster{"type": u8, "id": u8, "name of variable": string[], "content": string[]}
diagram:
  Tick Count() -> (timer value=w1)
  Feedback Node(input=w2) -> w3
  Is Greater(x=w1, y=w3) -> w4
  Array Size(array=$array_in) -> (size(s)=w5)
  Is Greater Than 0(x=w5) -> w6
  Logical And(not $error_in, w6, w4) -> w7
  case (w7) {
    frame False, Default {
      w8 = $"TestMan config_in"
      w9 = $error_in
      w2 = w3
    }
    frame True {
      w10 = T2 {"type"=249, "id"=1, "name of variable"=["status", "name"], "content"=[]}
      Build Array("clear", $chartName_in) -> w11
      Property Node(instance in=w10, "content"=w11) -> (instance out=w12)
      call "UDPsend.gvi"(TestManConfig in=$"TestMan config_in", error in=$error_in, Message=w12) -> (TestManConfig out=w13, error out=w14)
      while (iteration -> i1) {
        w15 = T2 {"type"=249, "id"=1, "name of variable"=["status", "name", "values", "counter"], "content"=[]}
        Multiply(10, i1) -> w16
        Array Subset(array=$array_in, index0=w16, length0=10) -> w17
        s1 = ""  # shift register
        for (N = 10) {
          w18 = each element of w17
          Complex To Real Imaginary(x + iy=w18) -> (x=w19, y=w20)
          Number To Fractional String(number=w19, precision (6)=$precision) -> (F-format string=w21)
          Search And Replace String(input string=w21, replace string ("")=".", search string=",") -> (result string=w22)
          Number To Fractional String(number=w20, precision (6)=$precision) -> (F-format string=w23)
          Search And Replace String(input string=w23, replace string ("")=".", search string=",") -> (result string=w24)
          Concatenate Strings(s1, w22, ",", w24, ";") -> w25
          next s1 = w25
        }
        Array Size(array=$array_in) -> (size(s)=w26)
        Add(w16, 10) -> w27
        Is Greater Or Equal(x=w27, y=w26) -> w28
        Is Greater Or Equal(x=i1, y=$"max number of packets") -> w29
        Logical Or(w28, w29) -> w30
        Select(s=w30, t=-1, f=i1) -> w31
        Number To Decimal String(number=w31) -> (decimal integer string=w32)
        Build Array("update", $chartName_in, s1, w32) -> w33
        Property Node(instance in=w15, "content"=w33) -> (instance out=w34)
        call "UDPsend.gvi"(TestManConfig in=w13, error in=w14, Message=w34) -> (TestManConfig out=w8, error out=w9)
        stop if w30
      }
      Add($"update interval_in", w1) -> w2
    }
  }
  $"TestMan config_out" <- w8
  $Error_out <- w9
