vi "sendValue.gvi"   [LabVIEW Communications System Design Suite 2.0.1]
inputs:
  "value": f64
  "active": bool
  "TestManConfig out": T1
  "value name": string = "frame error rate"
  "update interval_in": u32
types:
  T1 = cluster{"port": u16, "ip": string, "connection": UdpNetworkConnectionRefnum, "type": u8, "id": u8}
  T2 = cluster{"type": u8, "id": u8, "name of variable": string[], "content": string[]}
diagram:
  Tick Count() -> (timer value=w1)
  Feedback Node(input=w2) -> w3
  Is Greater(x=w1, y=w3) -> w4
  Logical And($active, w4) -> w5
  case (w5) {
    frame False, Default {
      w2 = w3
    }
    frame True {
      w6 = T2 {"type"=249, "id"=1, "name of variable"=["name", "value", "status"], "content"=[]}
      Number To Decimal String(number=$value) -> (decimal integer string=w7)
      Build Array($"value name", w7, "update") -> w8
      Property Node(instance in=w6, "content"=w8) -> (instance out=w9)
      call "UDPsend.gvi"(TestManConfig in=$"TestManConfig out", Message=w9)
      Add($"update interval_in", w1) -> w2
    }
  }
