vi "Top_level_rx_tx_test.gvi"   [LabVIEW Communications System Design Suite 2.0.1]
panel controls:
  "Reset": bool
  "rxEnable": bool
  "txEnable": bool
  "baud_count": u16
  "Select t_x": i8
  "reset_Errr counter": bool
  "reset_tx count": bool
  "reset_rx count": bool
panel indicators:
  "tx FIFO output valid": bool
  "Rx": bool
  "frame error": bool
  "Tx": bool
  "debug txData": u8
  "debug rxData": u8
  "debug txRdy": bool
  "debug rxData valid": bool
  "count tx [Bytes]": u32
  "count rx [Byte]": u32
  "count Error": u32
diagram:
  clock-driven loop (clock = "Resources.grsc\\120Mhz") forever {
    call "IO_read.gcdl"(reference in="AUX I/O 1") -> (data=w1)
    call "UART_V2.0.gcdl"(tx FIFO="Resources.grsc\\tx from host", rx FIFO="Resources.grsc\\Rx to host", Rx=w1, rxEnable=$rxEnable, txEnable=$txEnable, baud_count=$baud_count, Reset=$Reset) -> (Tx=w2, frame error=w3, debug txRdy=w4, rxData valid edge=w5, debug rxData valid=w6, debug txData=w7, debug rxData=w8, txReady edge=w9, FIFO output valid=w10)
    $"tx FIFO output valid" <- w10
    $"frame error" <- w3
    call "niInstr Basic Elements v1 FPGA.lvlib__Detect Rising Edge.gcdl"(signal=w3) -> (edge detected=w11)
    call "niInstr Basic Elements v1 FPGA.lvlib__Count Up U32.gcdl"(increment=w11, reset=$"reset_Errr counter") -> (count out=w12)
    $"count Error" <- w12
    call "niInstr Basic Elements v1 FPGA.lvlib__Count Up U32.gcdl"(increment=w9, reset=$"reset_tx count") -> (count out=w13)
    $"count tx [Bytes]" <- w13
    call "niInstr Basic Elements v1 FPGA.lvlib__Count Up U32.gcdl"(increment=w5, reset=$"reset_rx count") -> (count out=w14)
    $"count rx [Byte]" <- w14
    $Tx <- w2
    $Rx <- w1
    call "IO_write_select.gcdl"(data=w2, Select=$"Select t_x")
    $"debug rxData valid" <- w6
    $"debug txRdy" <- w4
    $"debug rxData" <- w8
    $"debug txData" <- w7
  }
