vi "BaudCount.gvi"   [LabVIEW Communications System Design Suite 2.0.1]
inputs:
  "Baud rate": u32
outputs:
  "Baud_count": u16
diagram:
  Divide(x=120000000, y=$"Baud rate") -> w1
  To Unsigned Word Integer(number=w1) -> w2
  $Baud_count <- w2
