vi "host_Top_level_test_rx_tx.gvi"   [LabVIEW Communications System Design Suite 2.0.1]
panel controls:
  "baud_rate": u32 = 12500
  "rxEnable": bool
  "Reset": bool
  "Select in _tx port": i8
  "Stop configuration loop": bool
  "stop status loop": bool
  "stop reading RX FIFO": bool
  "txEnable": bool
  "reset_Errr counter": bool
  "reset_rx count": bool
  "reset_tx count": bool
  "STOP tx FIFO": bool
  "tx string": string
panel indicators:
  "Ready": bool
  "count Error": u32
  "count rx [Byte]": u32
  "debug rxData": u8
  "debug rxData valid": bool
  "tx FIFO output valid": bool
  "debug txRdy": bool
  "debug txData": u8
  "count tx [Bytes]": u32
  "error out": error
  "frame error": bool
  "empty elements remaining": u32
  "Tx": bool
  "unsigned byte array": u8[]
  "available elements": u32
  "Array": u8[]
  "Array_2": string[]
  "TX data": string
diagram:
  FPGA Open Node[ProjectItem=":NullTarget:USRP\\-Bitfile_tx_rx\\-0003\\.lvbitx"](RIO address="RIO0", run?=TRUE) -> (error out=w1, reference out=w2)
  Host Fifo Configure Node[FifoName="Resources.grsc\\Rx to host"](depth=2048, error in=w1, reference in=w2) -> (error out=w3, reference out=w4)
  Host Fifo Start Node[FifoName="Resources.grsc\\Rx to host"](error in=w3, reference in=w4) -> (error out=w5, reference out=w6)
  Host Fifo Configure Node[FifoName="Resources.grsc\\tx from host"](depth=2048, error in=w5, reference in=w6) -> (error out=w7, reference out=w8)
  Host Fifo Start Node[FifoName="Resources.grsc\\tx from host"](error in=w7, reference in=w8) -> (error out=w9, reference out=w10)
  case (w9) {
    frame Error {
      w11 = w10
      w12 = w9
    }
    frame No Error {
      $Ready <- TRUE
      while {
        call "BaudCount.gvi"(Baud rate=$baud_rate) -> (Baud_count=w13)
        Property Node(instance in=w10, "baud_count"=w13, "rxEnable"=$rxEnable, "txEnable"=$txEnable, "Reset"=$Reset, "Select  t_x"=$"Select in _tx port", "reset_Errr counter"=$"reset_Errr counter", "reset_rx count"=$"reset_rx count", "reset_tx count"=$"reset_tx count", error in=w9) -> (error out=w14)
        Wait(time to wait=50)
        stop if $"Stop configuration loop"
      }
      while {
        Wait(time to wait=50)
        Property Node(instance in=w10, error in=w9) -> ("count Error"=w15, "count rx [Byte]"=w16, "debug rxData"=w17, "debug rxData valid"=w18, "tx FIFO output valid"=w19, "debug txRdy"=w20, "debug txData"=w21, "count tx [Bytes]"=w22, "frame error"=w23, error out=w24)
        $"count Error" <- w15
        $"count rx [Byte]" <- w16
        $"debug rxData" <- w17
        $"debug rxData valid" <- w18
        $"tx FIFO output valid" <- w19
        $"debug txRdy" <- w20
        $"debug txData" <- w21
        $"count tx [Bytes]" <- w22
        $"frame error" <- w23
        stop if $"stop status loop"
      }
      s1 = u8[] []  # shift register
      s2 = u8[] []  # shift register
      s3 = string[] []  # shift register
      while {
        Property Node(instance in=w10) -> ("rxEnable"=w25, "Reset"=w26, instance out=w27)
        Host Fifo Read Node[FifoName="Resources.grsc\\Rx to host"](error in=w9, number of elements=0, reference in=w27) -> (elements remaining=w28, error out=w29, reference out=w30)
        $"available elements" <- w28
        Wait(time to wait=1)
        Is Not Equal To 0(x=w28) -> w31
        Logical And(w25, not w26, w31) -> w32
        case (w32) {
          frame False, Default {
            w33 = w29
            w11 = w30
            w34 = s1
            w35 = default
            w36 = s3
          }
          frame True {
            Host Fifo Read Node[FifoName="Resources.grsc\\Rx to host"](error in=w29, number of elements=1, reference in=w30) -> (data=w37, error out=w33, reference out=w11)
            Build Array[ConcatenateInputs=True](s2, w37) -> w38
            Search 1D Array(1D array=w38, element=10) -> (index of element=w39)
            Is Greater Or Equal To 0(x=w39) -> w40
            Search 1D Array(1D array=w38, element=13) -> (index of element=w41)
            Is Greater Or Equal To 0(x=w41) -> w42
            Logical And(w40, w42) -> w43
            Array Subset(array=w38, length0=w39) -> w44
            Byte Array To String(unsigned byte array=w44) -> (string=w45)
            Build Array[ConcatenateInputs=True](w45, s3) -> w46
            Select(s=w43, t=w46, f=s3) -> w36
            Select(s=w43, t=u8[] [], f=w38) -> w35
            Build Array[ConcatenateInputs=True](w37, s1) -> w34
          }
        }
        $Array_2 <- w36
        $Array <- w34
        next s1 = w34
        next s2 = w35
        next s3 = w36
        stop if $"stop reading RX FIFO"
      }
      while (iteration -> i1) {
        Property Node(instance in=w10, error in=w9) -> ("txEnable"=w47, "Reset"=w48, "Tx"=w49, error out=w50, instance out=w51)
        Number To Decimal String(number=i1) -> (decimal integer string=w52)
        Logical And(w47, not w48) -> w53
        case (w53) {
          frame False, Default {
            w54 = w50
          }
          frame True {
            Concatenate Strings($"tx string", w52) -> w55
            $"TX data" <- w55
            String To Byte Array(string=w55) -> (unsigned byte array=w56)
            Build Array[ConcatenateInputs=True](w56, 10, 13) -> w57
            $"unsigned byte array" <- w57
            Host Fifo Write Node[FifoName="Resources.grsc\\tx from host"](data=w57, error in=w50, reference in=w51) -> (empty elements remaining=w58, error out=w54)
            $"empty elements remaining" <- w58
          }
        }
        Wait(time to wait=1000)
        $Tx <- w49
        stop if $"STOP tx FIFO"
      }
      call "Multiplex Errors.gvi"(error in 1=w33, error in 2=w54) -> (error out=w59)
      call "Multiplex Errors.gvi"(error in 1=w14, error in 2=w24, error in 3=w59) -> (error out=w12)
    }
  }
  Host Fifo Stop Node[FifoName="Resources.grsc\\tx from host"](error in=w12, reference in=w11) -> (error out=w60, reference out=w61)
  Host Fifo Stop Node[FifoName="Resources.grsc\\Rx to host"](error in=w60, reference in=w61) -> (error out=w62, reference out=w63)
  FPGA Close Node(abort?=FALSE, error in=w62, reference in=w63) -> (error out=w64)
  $"error out" <- w64
