vi "GFDM FPGA Toplevel with Flexible ChannelEstimation.gvi"   [LabVIEW Communications System Design Suite 2.0.1]
inputs:
  "RX.sync.halfPreambleVectorIn": CFXP(4.12)[64]
  "RX.sync.GFDM configuration cluster": T4 = {"Preamble mu"=1, "GFDM B"=3, "Preamble K"=128, "Preamble Ncp"=32, "GFDM Ncp"=32, "GFDM M"=5, "Preamble Ncs"=16, "GFDM K"=128, "GFDM Ncs"=16, "Preamble M"=2}
panel controls:
  "rx.reset": bool = TRUE
  "rx.samples to acquire": u32
  "rx.output sample rate": UFXP(1.47)
  "rx.delay": FXP(0.16)
  "rx 0.frequency shift": FXP(0.48)
  "rx 0.phase": FXP(0.21)
  "rx 0.impairments": T1 = {"inline gain I"=0.999992370605, "inline gain Q"=0.999992370605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}
  "rx.abort": bool
  "tx.abort": bool
  "tx.reset": bool = TRUE
  "tx.input sample rate": UFXP(1.47)
  "tx.delay": FXP(0.18)
  "tx 0.frequency shift": FXP(0.48)
  "tx 0.phase": FXP(0.21)
  "tx 0.impairments": T1 = {"inline gain I"=0.999992370605, "inline gain Q"=0.999992370605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}
  "tx.samples to generate": u32
  "tx 0.gain": T2 = {"gain I"=1, "gain Q"=1}
  "rx 1.impairments": T1 = {"inline gain I"=0.999992370605, "inline gain Q"=0.999992370605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}
  "rx 1.frequency shift": FXP(0.48)
  "rx 1.phase": FXP(0.21)
  "tx 1.impairments": T1 = {"inline gain I"=0.999992370605, "inline gain Q"=0.999992370605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}
  "tx 1.frequency shift": FXP(0.48)
  "tx 1.phase": FXP(0.21)
  "tx 1.gain": T2 = {"gain I"=1, "gain Q"=1}
  "rx 0.stream enable": bool
  "rx 1.stream enable": bool
  "tx 0.stream enable": bool
  "tx 1.stream enable": bool
  "rx.trigger select": T3 = "Immediate"
  "tx.trigger select": T3 = "Immediate"
  "rx.software trigger": bool
  "tx.software trigger": bool
  "rx.trigger enable": bool
  "tx.trigger enable": bool
  "TX.modem.configuration_in": "modem_configuration.gtype"
  "TX.modem.configure_in": bool
  "TX.modem.bitshift_in": i16
  "Reset": bool
  "Reset counter": bool
  "TX.automatic trigger_in": bool
  "RX.switch channels": bool
  "RX.modem.configure_in": bool
  "RX.modem.fft.bitshift_in": i16
  "RX.modem.bitshift_in": i16
  "RX.equ.shift": i8
  "RX.input delay": u16
  "TX.Encoder.packet length(Byte,N/8)": u32 = 72
  "TX.Encoder.Switch I and Q": bool
  "TX.Encoder.shift": i8
  "RX.Encoder.Switch I and Q": bool
  "RX.Encoder.shift": i8
  "RX.sync.input enable_in": bool
  "TX.modem.enabled": bool
  "TX.modem.force transmission": bool
  "TX.modem.trigger limit": u64
  "TX.encoder.enabled": bool
  "TX.encoder.force": bool
  "TX.encoder.threshold": u32
  "UART.control": T11
  "UART.Clear": bool
  "D2through9": u8
  "control signals_in": "Control Signals.gtype"
  "configuration_in": "Configuration Data.gtype"
  "N-1_in": u16
  "Data Routing": T14 = "Data from Host"
  "RX.decoder.Block Size(bit,N)": u32 = 576
  "RX.sync.config": "SyncConfig.gtype"
  "AGC.config": T18 = {"Destination"="configRx", "antenna configuration"="TX1 RX1 transmits and RX2 receives", "daughterboard"="sbx", "spi address"=7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}
  "reg.host read.go rcvd 0": bool
  "reg.notify host.go rcvd 0": bool
  "reg.reset 0": bool
  "RF 0/Rx/Enable": bool
  "RF 0/Tx/Enable": bool
  "RF 1/Rx/Enable": bool
  "RF 1/Tx/Enable": bool
  "ChEst.Parameters": "CE_configurationStameMashine.gtype"
  "ChEst.debugState": i32
  "ChEst.FifoEqualizedDataOutActive": bool
  "ChEst.configDataIn": u64
  "RX.sync.preambleOutFifoActive": bool
  "TX.switchTxChannel": bool
  "TX.sync.preambleOrAllData": bool
  "AGC.disableAGC": bool
panel indicators:
  "rx.samples processed": u32
  "rx.state": enum{"Idle", "Active"}
  "rx 0.number of IQ data overflows": u64
  "rx.number of overflows": u32
  "tx.samples processed": u32
  "tx.underflows": u32
  "tx 0.number of IQ data overflows": u64
  "tx.state": enum{"Idle", "Active"}
  "rx.dsp reset done": bool
  "tx.dsp reset done": bool
  "tx 1.number of IQ data overflows": u64
  "rx 1.number of IQ data overflows": u64
  "TX.modem.DEBUG.cluster_out": T8
  "TX.modem.config done_out": bool
  "RX.sync.sync found_out": u32
  "RX.modem.config done_out": bool
  "RX.modem.modem_configuration_out": "modem_configuration.gtype"
  "TX.encoder.debug count out": T9
  "RX.Decoder.Debug cluster": T10
  "RX.modem.reset active_out": bool
  "TX.modem.reset active_out": bool
  "TX.modem.count out": u64
  "UART.status": T12
  "UART.Clear done": bool
  "initial reset done_out": bool
  "control signals_out": "Control Signals.gtype"
  "ready for configuration_out": bool
  "RM properties": T13
  "loop iteration": i32
  "TX.RM.DEBUG.counter_out": T15
  "RX.RM.debug counter_out": T16
  "RX.sync.lastWrittenRxGain": UFXP(5.1)
  "reg.notify host.go 0": bool
  "reg.host read.data 0": cluster{"go": bool, "data": u32}
  "ChEst.readyForConfig": bool
  "ChEst.configDataOut": u64
  "ChEst.usedElementsPayload": u32
  "ChEst.usedElementsPreamble": u32
  "ChEst.globalStateOut": i32
  "ChEst.lokalStateOut": i32
  "ChEst.SamplesOut": u32
  "RX.modem.DEBUG.cluster_out": T8
  "RX.sync.syncPaketDicarded": u32
types:
  T1 = cluster{"inline gain I": FXP(1.17), "inline gain Q": FXP(1.17), "cross gain I": FXP(1.17), "cross gain Q": FXP(1.17), "pre-gain offset I": FXP(1.17), "pre-gain offset Q": FXP(1.17), "post-gain offset I": FXP(1.17), "post-gain offset Q": FXP(1.17)}
  T2 = cluster{"gain I": FXP(3.21), "gain Q": FXP(3.21)}
  T3 = enum{"Software", "Digital Edge", "Rx Start Trigger", "Tx Start Trigger", "Immediate", "Future Time Event"}
  T4 = cluster{"Preamble mu": u16, "GFDM B": u16, "Preamble K": u16, "Preamble Ncp": u16, "GFDM Ncp": u16, "GFDM M": u16, "Preamble Ncs": u16, "GFDM K": u16, "GFDM Ncs": u16, "Preamble M": u16}
  "modem_configuration.gtype" = cluster{"K-1": u16, "M-1": u8, "N-1": u16, "N": u16, "Npreamble+CP+CS": u16, "Npreamble": u16, "Nw": u16, "Modulator MUX config": u64[16], "K": u16, "fft_size_log2(K)": u8, "inverse_fft": bool, "Start with preamble": bool, "Burstmode": bool, "Ncs": u16, "Ncp": u16, "N-Ncp": u16, "N+Ncp": u16, "N+Ncp+Ncs": u16, "Demodulator MUX config": u64[16], "M": u8, "DFT SIZE": FXP(6.0), "Frame length": u32, "Super frame length": u32, "Ns_all_GFDM_blocks": u32, "Ns_all_preambles": u32}
  T5 = cluster{"packets in_out": u16, "samples in_out": u16, "packets out_out": u16, "samples out_out": u16, "number of invalid samples": u64, "mod first samples out": u64, "mod last samples out": u64}
  T6 = cluster{"FFT misalignment": u64, "FFT halt": u64, "FFT last sample": u64}
  T7 = cluster{"number of invalid samples": u64, "first samples out": u64, "last samples out": u64, "number of cycles": u64}
  T8 = cluster{"Element 1": T5, "Element 2": T6, "Element 3": T7}
  T9 = cluster{"QPSK mappercount out": u32, "Encoder count out": u32, "Byte to bit count out": u32, "fifo reader count out": u32}
  T10 = cluster{"debug bit to Byte count out": u64, "debug decoder count out": u64, "debug fifo reader count out": u64}
  T11 = cluster{"txEnable": bool, "rxEnable": bool, "Reset": bool, "baud_count": u16, "reset frame counter": bool, "reset tx counter": bool, "reset rx counter": bool}
  T12 = cluster{"debug rxData": u8, "debug txData": u8, "debug rxData valid": bool, "tx FIFO output valid": bool, "debug txRdy": bool, "count Error": u32, "count tx [Bytes]": u32, "count rx [Byte]": u32}
  "Control Signals.gtype" = cluster{"reset!": bool, "reset done?": bool, "request for config!": bool, "config done?": bool, "set active!": bool, "active?": bool}
  "Configuration Data.gtype" = cluster{"data": u64, "data valid": bool, "length": u16, "switch bank after": u16, "address": u16, "bank": u16, "address offset": u16, "update id": u8, "start update": bool}
  T13 = cluster{"Element 1": u16, "Element 2": u16, "Element 3": u16, "Element 4": u16}
  T14 = enum{"Data from Host", "Data from UART", "UART Loopback", "RX TX Loopback"}
  T15 = cluster{"RM packets_out": u16, "RM samples_out": u16, "payload length [sample]": u16, "payload length [bytes]": u16, "control channel length [samples]": u16, "control channel length [bytes]": u16}
  T16 = cluster{"first samples in": u16, "samples input": u16, "samples multiplexed": u16, "samples divided in blocks before multiplexer": u16, "corrected samples": u16, "samples divided in blocks after multiplexer": u16, "overflow counter_out": u16, "lost samples_out": u16, "state": u8}
  T17 = cluster{"missingSignalThresholdInSampels": u32, "GainIn": UFXP(5.1), "enableAnalogGainControl": bool, "enableDigitalGainController": bool, "enableDCremover": bool, "PiControl": UFXP(1.15), "setpointMaxAmplitude": UFXP(0.15), "NumbOfValidSamplesBetweenGainChange": u32, "permissibleControlError": UFXP(5.1)}
  "SyncConfig.gtype" = cluster{"Metric peak threshold": UFXP(1.16), "MetricThresholdMode": bool, "CFO removal": bool, "ffoPiControlCte": FXP(2.17), "shift_threshold": i16, "min_threshold": UFXP(1.16), "  AGC": T17}
  "niUsrpRio Config v1 Host.lvlib__Antenna Configuration.gtype" = enum{"TX1 RX1 transmits and RX2 receives", "TX1 RX1 receives and RX2 is unused"}
  "niUsrpRio Config v1 Host.lvlib__DB Types.gtype" = enum{"sbx", "cbx", "wbx", "unknown", "ubx"}
  T18 = cluster{"set": bool, "lo lpf": bool, "cpld ": bool, "switchChannel": bool, "Destination": enum{"configRx", "configTx"}, "antenna configuration": "niUsrpRio Config v1 Host.lvlib__Antenna Configuration.gtype", "daughterboard": "niUsrpRio Config v1 Host.lvlib__DB Types.gtype", "GainIn": UFXP(5.1), "spi address": u8}
  T19 = cluster{"config!": bool, "reset!": bool, "active!": bool}
  T20 = cluster{"NpayIsPowerOfTwo": bool, "KpreIsPowerOfTwo": bool, "Npay": u16, "Kpre": u16, "log2(Npay) or DftSizeIndex": u8, "B": u16, "log2(Kpre) or DftSizeIndex": u8, "L.ch.1": u16, "L.ch.2": u16, "shiftFactorDft": i16}
  "CE_configurationStameMashine.gtype" = cluster{"control": T19, "config": T20}
  "CE_signalsType.gtype" = cluster{"data": u32, "valid": bool, "index": u16}
  T21 = cluster{"output sample rate": UFXP(1.47), "delay": FXP(0.16), "frequency shift": FXP(0.48), "impairments": T1, "phase": FXP(0.21)}
  T22 = cluster{"frequency shift": FXP(0.48), "impairments": T1, "phase": FXP(0.21), "input sample rate": UFXP(1.47), "gain": T2, "delay": FXP(0.18)}
diagram:
  clock-driven loop (clock = "40 MHz Onboard Clock") forever {
    Number To Boolean Array(number=$D2through9) -> (Boolean array=w1)
    Array Index(array=w1) -> (out0[_]=w2, out1[_]=w3, out2[_]=w4, out3[_]=w5, out4[_]=w6, out5[_]=w7, out6[_]=w8, out7[_]=w9)
    call "IO_write.gcdl"(reference in="AUX I/O 2", data=w2)
    call "IO_write.gcdl"(reference in="AUX I/O 3", data=w3)
    call "IO_read.gcdl"(reference in="AUX I/O 1") -> (data=w10)
    call "UART_V2.0.gcdl"(Rx=w10, control=$"UART.control", Clear FIFOs=$"UART.Clear") -> (Tx=w11, Rx FIFO=w12, tx FIFO=w13, status=w14, Clear done=w15)
    call "IO_write.gcdl"(reference in="AUX I/O 0", data=w11)
    call "IO_write.gcdl"(reference in="AUX I/O 4", data=w4)
    $"UART.status" <- w14
    call "IO_write.gcdl"(reference in="AUX I/O 5", data=w5)
    $"UART.Clear done" <- w15
    call "IO_write.gcdl"(reference in="AUX I/O 6", data=w6)
    call "IO_write.gcdl"(reference in="AUX I/O 7", data=w7)
    call "IO_write.gcdl"(reference in="AUX I/O 8", data=w8)
    call "IO_write.gcdl"(reference in="AUX I/O 9", data=w9)
    Feedback Node(input=w16) -> w17
    FIFO Read(Control Protocol Input=w17, reference in="Needed Resources.grsc\\TX.data in.H2T") -> (Control Protocol Output=w18, data=w19)
    FIFO Read(Control Protocol Input=w17, reference in=w12) -> (Control Protocol Output=w20, data=w21)
    Feedback Node(input=w22) -> w23
    FIFO Read(Control Protocol Input=w23, reference in="Needed Resources.grsc\\RX.DataFromDecoder") -> (Control Protocol Output=w24, data=w25)
    case ($"Data Routing") {
      frame "Data from Host", Default {
        w26 = w19
        w27 = w18
        w28 = w25
        w29 = w24
        w30 = TRUE
        w31 = 0
        w32 = FALSE
        w33 = default
      }
      frame "Data from UART" {
        w26 = w21
        w27 = w20
        w28 = w25
        w29 = w24
        w30 = default
        w31 = w25
        w32 = w24
        w33 = default
      }
      frame "UART Loopback" {
        w26 = w21
        w27 = w20
        w28 = w21
        w29 = w20
        w30 = default
        w31 = w21
        w32 = w20
        w33 = TRUE
      }
      frame "RX TX Loopback" {
        w26 = w25
        w27 = w24
        w28 = w25
        w29 = w24
        w30 = TRUE
        w31 = default
        w32 = default
        w33 = default
      }
    }
    # Data Routing
    FIFO Write(Control Protocol Input=w27, data=w26, reference in="Needed Resources.grsc\\TX.DataToEncoder") -> (Control Protocol Output=w34)
    FIFO Write(Control Protocol Input=w29, data=w28, reference in="Needed Resources.grsc\\RX.Data out.T2H") -> (Control Protocol Output=w35)
    FIFO Write(Control Protocol Input=w32, data=w31, reference in=w13) -> (Control Protocol Output=w36)
    Select(s=w30, t=w35, f=w36) -> w22
    Not(x=w33) -> w37
    Select(s=w37, t=w34, f=w22) -> w16
  }
  clock-driven loop (clock = "Needed Resources.grsc\\90 MHz") forever {
    call "Reset.gcdl"() -> (reset=w38, reset counter=w39)
    Feedback Node(input=w40) -> w41
    Logical Or($"TX.encoder.force", w41) -> w42
    Logical And($"TX.encoder.enabled", w42) -> w43
    # Encoder
    call "Padding_Encoder_Mapper_Wrapper.gcdl"(FIFO reference in="Needed Resources.grsc\\TX.DataToEncoder", packet length (Byte)=$"TX.Encoder.packet length(Byte,N/8)", FIFO reader reset=w38, debug counter reset=w39, enable=w43) -> (QPSK Sym out=w44, output valid=w45, debug count out=w46)
    $"TX.encoder.debug count out" <- w46
    call "Adjust data format.gcdl"(data in=w44, input valid=w45, Switch I and Q=$"TX.Encoder.Switch I and Q", shift=$"TX.Encoder.shift", bypass=FALSE) -> (data out=w47, output valid=w48)
    FIFO Write(Control Protocol Input=w48, data=w47, reference in="Resource Mapper Resources.grsc\\TX.RM.payload in") -> (reference out=w49)
    Property Node(instance in=w49) -> ("free elements"=w50)
    Feedback Node(input=w50) -> w51
    Is Greater(x=w51, y=$"TX.encoder.threshold") -> w40
  }
  clock-driven loop (clock = "Needed Resources.grsc\\160 MHz") (iteration -> i1) forever {
    Feedback Node(input=w52) -> w53
    FIFO Read(Control Protocol Input=w53, reference in="Updater Resources.grsc\\download") -> (Control Protocol Output=w54, data=w55)
    Property Node(instance in=$configuration_in, "data"=w55, "data valid"=w54) -> (instance out=w56)
    call "trigger reset logic.gcdl"(control signals_in=$"control signals_in", loop iteration=i1, cycles to keep in reset=100) -> (control signals_out=w57, initial reset done_out=w58)
    # Resource Mapper - Demapper
    call "Resource Mapper.gcdl"(payload reference in="Resource Mapper Resources.grsc\\TX.RM.payload in", control channel reference in="Resource Mapper Resources.grsc\\TX.RM.control channel in", N-1=$"N-1_in", Resource Mapper Fifo_out="Resource Mapper Resources.grsc\\TX.Resource Mapper_out", Configuration data=w56, control signals_in=w57, update id_const=1) -> (control signals_out=w59, DEBUG.RM counter_out=w60, valid_out=w61, sample_out=w62, ready for RM input_out=w63, control channel length [bytes]=w64, control channel length [samples]=w65, payload length [bytes]=w66, payload length [sample]=w67)
    Feedback Node(input=w68) -> w69
    call "Resource Demapper.gcdl"(update id_const=2, data in fifo_in="Resource Mapper Resources.grsc\\RX.Resource Demapper_in", configuration data=w56, control signals_in=w59, N-1_in=$"N-1_in", ready for output=w69) -> (control signals_out=w70, payload valid_out=w71, payload_out=w72, ready for config input_out=w73, Received pilot_out=w74, RX.RM.debug counter_out=w75)
    Join Numbers(high(x)=w74, low(x)=w72) -> w76
    FIFO Write(Control Protocol Input=w71, data=w76, reference in="Needed Resources.grsc\\RX.Debug.Modem_64 bit samples out")
    Build Cluster(w64, w65, w66, w67) -> w77
    $"RM properties" <- w77
    $"control signals_out" <- w70
    call "Adjust data format.gcdl"(data in=w72, input valid=w71, Switch I and Q=$"RX.Encoder.Switch I and Q", shift=$"RX.Encoder.shift", bypass=FALSE) -> (data out=w78, output valid=w79)
    call "QPSK Demapper.gcdl"(Data In=w78, Input valid=w79) -> (output valid=w80, U2 Demap Mod Sym=w81)
    FIFO Write(Control Protocol Input=w80, data=w81, reference in="Needed Resources.grsc\\RX.Modem to decoder") -> (Control Protocol Output=w68)
    $"TX.RM.DEBUG.counter_out" <- w60
    $"RX.RM.debug counter_out" <- w75
    Logical Or(w73, w63) -> w52
    $"ready for configuration_out" <- w53
    FIFO Write(Control Protocol Input=w61, data=w62, reference in="Needed Resources.grsc\\TX.Debug.Encoder out")
    $"initial reset done_out" <- w58
    $"loop iteration" <- i1
  }
  Register Create(initial value="modem_configuration.gtype" {all zero or empty}) -> (reference out=w82)
  clock-driven loop (clock = "Needed Resources.grsc\\90 MHz") (after w82) forever {
    call "Reset.gcdl"() -> (reset=w83, reset counter=w84)
    # Decoder
    call "Decoder.gcdl"(FIFO Reference in="Needed Resources.grsc\\RX.Modem to decoder", Block Size(bit,N)=$"RX.decoder.Block Size(bit,N)", FIFO reader reset=w83, debug counter reset=w84) -> (decoded Byte=w85, outputvalid=w86, debug count out cluster=w87)
    FIFO Write(Control Protocol Input=w86, data=w85, reference in="Needed Resources.grsc\\RX.DataFromDecoder")
    $"RX.Decoder.Debug cluster" <- w87
  }
  clock-driven loop (clock = "Needed Resources.grsc\\160 MHz") forever {
    Register Read(reference in=w82) -> (data=w88)
    call "Reset.gcdl"() -> (reset=w89)
    # Detector
    call "Detection.gcdl"(RX.modem.data fifo_in="Needed Resources.grsc\\RX.gfdm data to equalizer", RX.modem.fft.bitshift_in=$"RX.modem.fft.bitshift_in", RX.modem.configuration_in=w88, RX.modem.configure_in=$"RX.modem.configure_in", RX.modem.filter fifo_in="Needed Resources.grsc\\RX.pulse shape in", RX.modem.reset_in=w89, RX.modem.bitshift_in=$"RX.modem.bitshift_in", equ.shift=$"RX.equ.shift") -> (RX.modem.data valid_out=w90, RX.modem.32 bit data_out=w91, RX.modem.modem_configuration_out=w92, RX.modem.DEBUG.cluster_out=w93, RX.modem.config done_out=w94, RX.modem.reset active_out=w95)
    FIFO Write(Control Protocol Input=w90, data=w91, reference in="Needed Resources.grsc\\RX.Debug.Modem_32 bit samples out")
    FIFO Write(Control Protocol Input=w90, data=w91, reference in="Resource Mapper Resources.grsc\\RX.Resource Demapper_in")
    $"RX.modem.modem_configuration_out" <- w92
    $"RX.modem.config done_out" <- w94
    $"RX.modem.reset active_out" <- w95
    $"RX.modem.DEBUG.cluster_out" <- w93
  }
  clock-driven loop (clock = "Needed Resources.grsc\\160 MHz") forever {
    # trigger transmitter!
    Feedback Node[DelayCount=4](input=w96) -> w97
    Register Write(data=w97, reference in="Needed Resources.grsc\\TX.start trigger")
    Register Read(reference in=w82) -> (data=w98)
    call "Reset.gcdl"() -> (reset=w99)
    Feedback Node(input=w100) -> w101
    Logical Or($"TX.modem.force transmission", w101) -> w102
    Feedback Node(input=w103) -> w104
    Logical And(w104, $"TX.modem.enabled", w102) -> w105
    call "SISO-TX.gcdl"(TX.modem.data fifo_in="Resource Mapper Resources.grsc\\TX.Resource Mapper_out", TX.modem.reset_in=w99, TX.modem.bitshift_in=$"TX.modem.bitshift_in", TX.modem.configure_in=$"TX.modem.configure_in", TX.modem.configuration_in=w98, TX.modem.filter fifo_in="Needed Resources.grsc\\TX.pulse shape in", window_in="Needed Resources.grsc\\TX.Window in", Preamble_in="Needed Resources.grsc\\TX.Preamble in", TX.modem.enable=w105) -> (TX.modem.config done_out=w106, TX.frame valid_out=w107, TX.frame_out=w108, TX.modem.DEBUG.cluster_out=w109, TX.modem.reset active_out=w110)
    call "niInstr Basic Elements v1 FPGA.lvlib__Detect Rising Edge.gcdl"(signal=w107) -> (edge detected=w111)
    Logical And(w111, $"TX.automatic trigger_in") -> w96
    # Modulator
    Property Node(instance in=w98) -> ("Super frame length"=w112)
    call "SwitchIQ.gcdl"(data_in=w108) -> (data_out=w113)
    FIFO Write(Control Protocol Input=w107, data=w113, reference in="Needed Resources.grsc\\TX.to DAC") -> (reference out=w114)
    Property Node(instance in=w114) -> ("free elements"=w115)
    Feedback Node(input=w112) -> w116
    Feedback Node(input=w115) -> w117
    Is Greater Or Equal(x=w117, y=w116) -> w103
    $"TX.modem.config done_out" <- w106
    FIFO Write(Control Protocol Input=w107, data=w108, reference in="Needed Resources.grsc\\TX.Debug.frame out")
    $"TX.modem.DEBUG.cluster_out" <- w109
    $"TX.modem.reset active_out" <- w110
    FIFO Write(Control Protocol Input=w107, data=w108, reference in="Needed Resources.grsc\\TX to RX test FIFO")
    call "niInstr Basic Elements v1 FPGA.lvlib__Count Up U64.gcdl"(increment=TRUE, reset=w101) -> (count out=w118)
    $"TX.modem.count out" <- w118
    Is Greater Or Equal(x=w118, y=$"TX.modem.trigger limit") -> w100
  }
  # w119: preamble
  FIFO Create(data type=u64 0, depth=2049) -> (reference out=w119)
  # w120: payload
  FIFO Create(data type=u64 0, depth=4097) -> (reference out=w120)
  clock-driven loop (clock = "Updater Resources.grsc\\200 MHz") forever {
    Feedback Node(input=w121) -> w122
    Feedback Node(input=w123) -> w124
    FIFO Write(Control Protocol Input=w124, data=w122, reference in="ChennalEstimationResource.grsc\\T2H.EqualizedPayladOut")
    Feedback Node(input=w125) -> w126
    Feedback Node(input=$"ChEst.Parameters") -> w127
    Feedback Node(input=$"ChEst.debugState") -> w128
    call "CE_channelEstimation.gcdl"(fifoPreamble=w119, fifoPayload=w120, configIDataIn=w126, Parameters=w127, debugState=w128) -> (readyForConfig=w129, dataOut=w130, stateOut=w131, globalStateOut=w132)
    Property Node(instance in=w130) -> ("data"=w121, "valid"=w133)
    Logical And(w133, $"ChEst.FifoEqualizedDataOutActive") -> w123
    Feedback Node(input=w129) -> w134
    $"ChEst.readyForConfig" <- w134
    Feedback Node(input=w132) -> w135
    $"ChEst.globalStateOut" <- w135
    Feedback Node(input=w131) -> w136
    $"ChEst.lokalStateOut" <- w136
    Feedback Node(input=$"ChEst.configDataIn") -> w137
    Split Number(x=w137) -> (high(x)=w138, low(x)=w139)
    Split Number(x=w139) -> (high(x)=w140, low(x)=w141)
    Is Greater Than 0(x=w141) -> w142
    Property Node(instance in="CE_signalsType.gtype" {all zero or empty}, "data"=w138, "valid"=w142, "index"=w140) -> (instance out=w125)
    Feedback Node(input=w133) -> w143
    FIFO Write(Control Protocol Input=w143, data=w122, reference in="Needed Resources.grsc\\RX.gfdm data to equalizer")
    Feedback Node(input=$"ChEst.configDataIn") -> w144
    Feedback Node(input=w144) -> w145
    $"ChEst.configDataOut" <- w145
    call "niInstr Basic Elements v1 FPGA.lvlib__Count Up U32.gcdl"(increment=w143) -> (count out=w146)
    Feedback Node(input=w146) -> w147
    $"ChEst.SamplesOut" <- w147
    Property Node(instance in=w120) -> ("used elements"=w148)
    Feedback Node(input=w148) -> w149
    $"ChEst.usedElementsPayload" <- w149
    Property Node(instance in=w119) -> ("used elements"=w150)
    Feedback Node(input=w150) -> w151
    $"ChEst.usedElementsPreamble" <- w151
  }
  FIFO Create(data type=u64 0, depth=17) -> (reference out=w152)
  FIFO Create(data type=u64 0, depth=17) -> (reference out=w153)
  # w153: port 0
  # w152: port 1
  clock-driven loop (clock = "40 MHz Onboard Clock") forever {
    Feedback Node(input=w154) -> w155
    call "4.12 cfx to u32.gcdl"(input=w155) -> (output=w156)
    Feedback Node(input=w157) -> w158
    Logical And(w158, $"RX.sync.preambleOutFifoActive") -> w159
    # to host
    FIFO Write(Control Protocol Input=w159, data=w156, reference in="Needed Resources.grsc\\RX.Preamble out")
    Feedback Node(input=$"RX.sync.GFDM configuration cluster") -> w160
    Feedback Node(input=w161) -> w162
    Feedback Node(input=w163) -> w164
    # w153: Port0
    # w152: Port1
    call "Sync_K64_TUDwrapper_pk.gcdl"(validIn=w164, GFDM configuration cluster=w160, dataIn=w162, Config=$"RX.sync.config", halfPreambleVectorIn=$"RX.sync.halfPreambleVectorIn") -> (dataOut=w154, dataValidOut=w165, SynchronizationFoundOut=w166, preambleStart=w167, preambleValid=w168, gfdmSymbolValid=w169, PreambleValidCount=w170, PayloadValidCount=w171, AnalogGainOut=w172, setAnalogGain=w173, Npay_withoutCpCs=w174)
    Select(s=$"TX.sync.preambleOrAllData", t=w165, f=w168) -> w157
    # Synchronizer + AGC
    FIFO Read(Control Protocol Input=TRUE, reference in="Needed Resources.grsc\\RX.ADC to synch") -> (Control Protocol Output=w175, data=w176)
    call "SwitchIQ.gcdl"(data_in=w176) -> (data_out=w177)
    call "u32 to 4.12 cfx.gcdl"(data in=w177) -> (data out=w161)
    Logical And(w175, $"RX.sync.input enable_in") -> w163
    Feedback Node(input=w170) -> w178
    Join Numbers(high(x)=w178, low(x)=0) -> w179
    Join Numbers(high(x)=w156, low(x)=w179) -> w180
    Feedback Node(input=w168) -> w181
    call "Sync.avoidFifoOverflow.gcdl"(FPGA.Fifo=w120, paketLength=w174, firstSampleValid=w167) -> (packetDiscarded=w182, paketValidOut=w183)
    Logical And(w181, w183) -> w184
    # preamble
    FIFO Write(Control Protocol Input=w184, data=w180, reference in=w119)
    Feedback Node(input=w171) -> w185
    Join Numbers(high(x)=w185, low(x)=0) -> w186
    Join Numbers(high(x)=w156, low(x)=w186) -> w187
    Feedback Node(input=w169) -> w188
    Logical And(w188, w183) -> w189
    # payload
    FIFO Write(Control Protocol Input=w189, data=w187, reference in=w120)
    Feedback Node(input=w166) -> w190
    call "Reset.gcdl"() -> (reset counter=w191)
    call "niInstr Basic Elements v1 FPGA.lvlib__Count Up U32.gcdl"(increment=w190, reset=w191) -> (count out=w192)
    Feedback Node(input=w192) -> w193
    $"RX.sync.sync found_out" <- w193
    Logical And(w173, $"AGC.disableAGC") -> w194
    call "setATRwrapper.gcdl"(RxGainIn=w172, setRxGainIn=w194, Fifo.Port0=w153, Fifo.Port1=w152, conf=$"AGC.config") -> (sync.lastWrittenRxGain=w195)
    $"RX.sync.lastWrittenRxGain" <- w195
    call "niInstr Basic Elements v1 FPGA.lvlib__Count Up U32.gcdl"(increment=w182, reset=w191) -> (count out=w196)
    Feedback Node(input=w196) -> w197
    $"RX.sync.syncPaketDicarded" <- w197
  }
  call "Create Resources.gvi"() -> (sync.resources=w198, config.resources=w199, time.resources=w200)
  clock-driven loop (clock = "40 MHz Onboard Clock") {
    Register Write(data=$"TX.modem.configuration_in", reference in=w82)
    # w152: Port1
    Build Array($Reset, $"Reset counter") -> w201
    Register Write(data=w201, reference in="Needed Resources.grsc\\Reset")
    Io Write(data=$"RF 1/Rx/Enable", reference in="RF 1/Rx/Enable")
    Io Write(data=$"RF 0/Tx/Enable", reference in="RF 0/Tx/Enable")
    Io Write(data=$"RF 0/Rx/Enable", reference in="RF 0/Rx/Enable")
    Io Write(data=$"RF 1/Tx/Enable", reference in="RF 1/Tx/Enable")
    # w153: Port0
    Feedback Node(input=w202) -> w203
    Property Node(instance in=w203) -> ("ready for port 0 input"=w204, "ready for port 1 input"=w205, "ready for port 2 input"=w206)
    Feedback Node(input=w207) -> w208
    call "niInstr Register Bus v1 FPGA.lvlib__Process.gcdl"(reg.notify host.go rcvd=$"reg.notify host.go rcvd 0", reg.host read.go rcvd=$"reg.host read.go rcvd 0", read completion=w208, reg.reset=$"reg.reset 0", reg.host instruction fifo="niInstr Register Bus v0.grsc\\reg.host instruction fifo 0", ready for output=w206) -> (reg.notify host.go=w209, reg.host read.data=w210, register instruction=w211)
    $"reg.notify host.go 0" <- w209
    $"reg.host read.data 0" <- w210
    FIFO Read(Control Protocol Input=w204, reference in=w153) -> (Control Protocol Output=w212, data=w213)
    call "Retrieve FPGA Scoped Instruction.gcdl"(number=w213, valid=w212) -> (output cluster=w214)
    # these FIFOs are for setting the Gain on FPGA side
    FIFO Read(Control Protocol Input=w205, reference in=w152) -> (Control Protocol Output=w215, data=w216)
    call "Retrieve FPGA Scoped Instruction.gcdl"(number=w216, valid=w215) -> (output cluster=w217)
    Feedback Node(input=w218) -> w219
    call "niInstr Register Bus v1 FPGA.lvlib__Register Instruction Arbiter (3 inputs).gcdl"(port 0=w214, port 1=w217, port 2=w211, reset=FALSE, ready for output=w219) -> (register instr out=w220, ready for input=w202)
    call "Registers.gcdl"(sync.resources=w198, register instruction=w220, config.resources=w199, time.resources=w200) -> (read completion out=w207, ready for input=w218)
    stop if FALSE
  }
  call "niUsrpRio Config v1 FPGA.lvlib__Process.gvi"(resources=w199)
  clock-driven loop (clock = "Data Clock") {
    Build Array($"rx 0.stream enable", $"rx 1.stream enable") -> w221
    # Streaming Transceiver Engine
    # trigger from TX
    # frame generation
    Register Read(reference in="Needed Resources.grsc\\TX.start trigger") -> (data=w222)
    Logical Or($"tx.software trigger", w222) -> w223
    call "Start Triggers Time.gcdl"(rx 1.stream enabled=$"rx 1.stream enable", rx.software trigger=$"rx.software trigger", tx.trigger select=$"tx.trigger select", tx.enable trigger=$"tx.trigger enable", tx 0.stream enabled=$"tx 0.stream enable", tx 1.stream enabled=$"tx 1.stream enable", rx 0.stream enabled=$"rx 0.stream enable", rx.enable trigger=$"rx.trigger enable", rx.trigger select=$"rx.trigger select", tx.software trigger=w223, time.resources=w200) -> (rx.start trigger=w224, tx.start trigger=w225)
    Build Array($"rx 0.stream enable", $"rx 1.stream enable") -> w226
    Io Read(reference in="RF 0/Rx/I") -> (data=w227)
    Io Read(reference in="RF 0/Rx/Q") -> (data=w228)
    call "niInstr DSP v1 FPGA.lvlib__I16 to IQ.gcdl"(I=w227, Q=w228) -> (IQ data=w229)
    Io Read(reference in="RF 1/Rx/I") -> (data=w230)
    Io Read(reference in="RF 1/Rx/Q") -> (data=w231)
    call "niInstr DSP v1 FPGA.lvlib__I16 to IQ.gcdl"(I=w230, Q=w231) -> (IQ data=w232)
    Build Array(w229, w232) -> w233
    w234 = T21 {"0x800000000000", 0, 0, "0x1FFFF", "0x1FFFF", 0, 0, 0, 0, 0, 0, 0}
    Property Node(instance in=w234, "impairments"=$"rx 0.impairments", "frequency shift"=$"rx 0.frequency shift", "phase"=$"rx 0.phase", "output sample rate"=$"rx.output sample rate", "delay"=$"rx.delay") -> (instance out=w235)
    w236 = T21 {"0x800000000000", 0, 0, "0x1FFFF", "0x1FFFF", 0, 0, 0, 0, 0, 0, 0}
    Property Node(instance in=w236, "delay"=$"rx.delay", "output sample rate"=$"rx.output sample rate", "impairments"=$"rx 1.impairments", "frequency shift"=$"rx 1.frequency shift", "phase"=$"rx 1.phase") -> (instance out=w237)
    Build Array(w235, w237) -> w238
    call "DDC (Multi-Channel).gcdl"(data in=w233, start trigger=w224, enabled=w226, DDC Parameters=w238, reset=$"rx.reset") -> (data out=w239, number of overflows=w240, output valid=w241, dsp reset done=w242)
    # #CodeRecommended - If you want to move the data directly to another LabVIEW FPGA device
    #  for further processing, you can replace the DMA FIFO with a Peer to Peer Writer FIFO.
    # #CodeRecommended - For your custom data processing IP, you can add Target-Scoped FPGA FIFOs
    #  if you need to move data to a different clock domain.
    call "niInstr Basic Elements v1 FPGA.lvlib__Detect Rising Edge.gcdl"(signal=$"rx.abort") -> (edge detected=w243)
    Feedback Node(input=w244) -> w245
    Not(x=w245) -> w246
    call "Input Stream Control.gcdl"(input valid=w241, start trigger=w224, burst size=$"rx.samples to acquire", abort=w243, fifo timeout=w246, reset=$"rx.reset") -> (write stream=w247, state=w248, samples processed=w249, number of overflows=w250)
    call "Write FIFO (Multi-Channel).gcdl"(switch channels=$"RX.switch channels", data in=w239, enabled=w221, input valid=w247, reset=$"rx.reset", FIFO 0="Needed Resources.grsc\\RX.ADC to synch", T2H fifo reference="Needed Resources.grsc\\Dummy") -> (ready for input=w244)
    Array Index(array=w240) -> (out0[_]=w251, out1[_]=w252)
    $"rx 0.number of IQ data overflows" <- w251
    $"rx 1.number of IQ data overflows" <- w252
    $"rx.dsp reset done" <- w242
    $"rx.state" <- w248
    $"rx.samples processed" <- w249
    $"rx.number of overflows" <- w250
    Build Array($"tx 0.stream enable", $"tx 1.stream enable") -> w253
    Build Array($"tx 0.stream enable", $"tx 1.stream enable") -> w254
    call "niInstr Basic Elements v1 FPGA.lvlib__Detect Rising Edge.gcdl"(signal=$"tx.abort") -> (edge detected=w255)
    Feedback Node(input=w256) -> w257
    Feedback Node(input=w258) -> w259
    call "Output Stream Control.gcdl"(start trigger=w225, burst size=$"tx.samples to generate", abort=w255, ready to read stream (T)=w259, fifo output valid=w257, reset=$"tx.reset") -> (read stream=w260, state=w261, samples processed=w262, number of underflows=w263)
    call "Read FIFO (Multi-Channel).gcdl"(TX.switchTxChannel=$"TX.switchTxChannel", enabled=w254, FIFO 0="Needed Resources.grsc\\TX.to DAC", ready for output=w260) -> (data out=w264, output valid=w256)
    # #CodeRecommended - If you want to pull data directly from another LabVIEW FPGA device,
    # you can replace the DMA FIFO with a Peer to Peer Reader FIFO.
    call "niInstr Basic Elements v1 FPGA.lvlib__Synchronous Latch.gcdl"(set=w256, clear=$"tx.reset") -> (out=w265)
    Logical And(w265, w259) -> w266
    w267 = T22 {0, "0x1FFFF", "0x1FFFF", 0, 0, 0, 0, 0, 0, 0, 0, "0x200000", "0x200000", 0}
    Property Node(instance in=w267, "gain"=$"tx 0.gain", "frequency shift"=$"tx 0.frequency shift", "phase"=$"tx 0.phase", "impairments"=$"tx 0.impairments", "input sample rate"=$"tx.input sample rate", "delay"=$"tx.delay") -> (instance out=w268)
    w269 = T22 {0, "0x1FFFF", "0x1FFFF", 0, 0, 0, 0, 0, 0, 0, 0, "0x200000", "0x200000", 0}
    Property Node(instance in=w269, "delay"=$"tx.delay", "input sample rate"=$"tx.input sample rate", "gain"=$"tx 1.gain", "frequency shift"=$"tx 1.frequency shift", "phase"=$"tx 1.phase", "impairments"=$"tx 1.impairments") -> (instance out=w270)
    Build Array(w268, w270) -> w271
    call "DUC (Multi-Channel).gcdl"(data in=w264, enabled=w253, input valid=w266, DUC Parameters=w271, reset=$"tx.reset") -> (I data out=w272, Q data out=w273, number of overflows=w274, dsp reset done=w275, ready for input=w258)
    Array Index(array=w272) -> (out0[_]=w276, out1[_]=w277)
    # #CodeRecommended - For your custom data processing IP, you can add
    # Target-Scoped FPGA FIFOs if you need to move data to/from a different clock domain.
    Io Write(data=w276, reference in="RF 0/Tx/I")
    Io Write(data=w277, reference in="RF 1/Tx/I")
    Array Index(array=w273) -> (out0[_]=w278, out1[_]=w279)
    Io Write(data=w278, reference in="RF 0/Tx/Q")
    Io Write(data=w279, reference in="RF 1/Tx/Q")
    $"tx.state" <- w261
    Array Index(array=w274) -> (out0[_]=w280, out1[_]=w281)
    $"tx 0.number of IQ data overflows" <- w280
    $"tx.samples processed" <- w262
    $"tx 1.number of IQ data overflows" <- w281
    $"tx.dsp reset done" <- w275
    $"tx.underflows" <- w263
    stop if FALSE
  }
