vi "GFDM FPGA Toplevel-with CCA.gvi"   [LabVIEW Communications System Design Suite 2.0.1]
inputs:
  "RX.sync.halfPreambleVectorIn": CFXP(4.12)[64]
  "RX.sync.GFDM configuration cluster": T1 = {"Preamble mu"=1, "GFDM B"=3, "Preamble K"=128, "Preamble Ncp"=32, "GFDM Ncp"=32, "GFDM M"=5, "Preamble Ncs"=16, "GFDM K"=128, "GFDM Ncs"=16, "Preamble M"=2}
panel controls:
  "TX.modem.configuration_in": "modem_configuration.gtype"
  "TX.modem.configure_in": bool
  "TX.modem.bitshift_in": i16
  "Reset": bool
  "Reset counter": bool
  "TX.automatic trigger_in": bool
  "RX.modem.configure_in": bool
  "RX.modem.fft.bitshift_in": i16
  "RX.modem.bitshift_in": i16
  "RX.equ.shift": i8
  "TX.Encoder.packet length(Byte,N/8)": u32 = 72
  "TX.Encoder.Switch I and Q": bool
  "TX.Encoder.shift": i8
  "RX.Encoder.Switch I and Q": bool
  "RX.Encoder.shift": i8
  "RX.sync.input enable_in": bool
  "TX.modem.enabled": bool
  "TX.modem.force transmission": bool
  "TX.modem.trigger limit": u64
  "TX.encoder.enabled": bool
  "TX.encoder.force": bool
  "TX.encoder.threshold": u32
  "UART.control": T10
  "UART.Clear": bool
  "D2through9": u8
  "control signals_in": "Control Signals.gtype"
  "configuration_in": "Configuration Data.gtype"
  "N-1_in": u16
  "Data Routing": T13 = "Data from Host"
  "RX.decoder.Block Size(bit,N)": u32 = 576
  "RX.sync.config": "SyncConfig.gtype"
  "AGC.config": T17 = {"Destination"="configRx", "antenna configuration"="TX1 RX1 transmits and RX2 receives", "daughterboard"="sbx", "spi address"=7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}
  "reg.host read.go rcvd 0": bool
  "reg.notify host.go rcvd 0": bool
  "reg.reset 0": bool
  "RF 0/Rx/Enable": bool
  "RF 0/Tx/Enable": bool
  "RF 1/Rx/Enable": bool
  "RF 1/Tx/Enable": bool
  "rx.reset": bool = TRUE
  "rx.samples to acquire": u32
  "rx 0.output sample rate": UFXP(1.47)
  "rx 0.delay": FXP(0.16)
  "rx 0.frequency shift": FXP(0.48)
  "rx 0.phase": FXP(0.21)
  "rx 0.impairments": T18 = {"inline gain I"=0.999992370605, "inline gain Q"=0.999992370605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}
  "rx.abort": bool
  "tx.abort": bool
  "tx.reset": bool = TRUE
  "tx.input sample rate": UFXP(1.47)
  "tx.delay": FXP(0.18)
  "tx 0.frequency shift": FXP(0.48)
  "tx 0.phase": FXP(0.21)
  "tx 0.impairments": T18 = {"inline gain I"=0.999992370605, "inline gain Q"=0.999992370605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}
  "tx.samples to generate": u32
  "tx 0.gain": T19 = {"gain I"=1, "gain Q"=1}
  "rx 1.impairments": T18 = {"inline gain I"=0.999992370605, "inline gain Q"=0.999992370605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}
  "rx 1.frequency shift": FXP(0.48)
  "rx 1.phase": FXP(0.21)
  "tx 1.impairments": T18 = {"inline gain I"=0.999992370605, "inline gain Q"=0.999992370605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}
  "tx 1.frequency shift": FXP(0.48)
  "tx 1.phase": FXP(0.21)
  "tx 1.gain": T19 = {"gain I"=1, "gain Q"=1}
  "rx 0.stream enable": bool
  "rx 1.stream enable": bool
  "tx 0.stream enable": bool
  "tx 1.stream enable": bool
  "rx.trigger select": T20 = "Immediate"
  "tx.trigger select": T20 = "Immediate"
  "rx.software trigger": bool
  "tx.software trigger": bool
  "rx.trigger enable": bool
  "tx.trigger enable": bool
  "RX.switch channels": bool
  "RX.input delay": u16
  "CCA.ch0/ch1": bool
  "rx.delay": FXP(0.16)
  "rx.output sample rate": UFXP(1.47)
  "tx 1.delay": FXP(0.18)
  "tx 1.input sample rate": UFXP(1.47)
  "DC correction.enable": bool[2]
  "DC correction.n": i16[2]
  "CCA.Control": T21
panel indicators:
  "TX.modem.DEBUG.cluster_out": T5
  "TX.modem.config done_out": bool
  "RX.sync.sync found_out": u32
  "RX.modem.config done_out": bool
  "RX.modem.DEBUG.cluster_out": T7
  "RX.modem.modem_configuration_out": "modem_configuration.gtype"
  "TX.encoder.debug count out": T8
  "RX.Decoder.Debug cluster": T9
  "RX.modem.reset active_out": bool
  "TX.modem.reset active_out": bool
  "TX.modem.count out": u64
  "UART.status": T11
  "UART.Clear done": bool
  "initial reset done_out": bool
  "control signals_out": "Control Signals.gtype"
  "ready for configuration_out": bool
  "RM properties": T12
  "loop iteration": i32
  "TX.RM.DEBUG.counter_out": T14
  "RX.RM.debug counter_out": T15
  "RX.sync.lastWrittenRxGain": UFXP(5.1)
  "reg.notify host.go 0": bool
  "reg.host read.data 0": cluster{"go": bool, "data": u32}
  "rx.samples processed": u32
  "rx.state": enum{"Idle", "Active"}
  "rx 0.number of IQ data overflows": u64
  "rx.number of overflows": u32
  "tx.samples processed": u32
  "tx.underflows": u32
  "tx 0.number of IQ data overflows": u64
  "tx.state": enum{"Idle", "Active"}
  "rx.dsp reset done": bool
  "tx.dsp reset done": bool
  "tx 1.number of IQ data overflows": u64
  "rx 1.number of IQ data overflows": u64
  "DC correction. applied": CFXP(1.17)[2]
  "DC correction. average": CFXP(15.17)[2]
  "CCA.status": T22
  "CCA.Noframes": u64
types:
  T1 = cluster{"Preamble mu": u16, "GFDM B": u16, "Preamble K": u16, "Preamble Ncp": u16, "GFDM Ncp": u16, "GFDM M": u16, "Preamble Ncs": u16, "GFDM K": u16, "GFDM Ncs": u16, "Preamble M": u16}
  "modem_configuration.gtype" = cluster{"K-1": u16, "M-1": u8, "N-1": u16, "N": u16, "Npreamble+CP+CS": u16, "Npreamble": u16, "Nw": u16, "Modulator MUX config": u64[16], "K": u16, "fft_size_log2(K)": u8, "inverse_fft": bool, "Start with preamble": bool, "Burstmode": bool, "Ncs": u16, "Ncp": u16, "N-Ncp": u16, "N+Ncp": u16, "N+Ncp+Ncs": u16, "Demodulator MUX config": u64[16], "M": u8, "DFT SIZE": FXP(6.0), "Frame length": u32, "Super frame length": u32, "Ns_all_GFDM_blocks": u32, "Ns_all_preambles": u32}
  T2 = cluster{"packets in_out": u16, "samples in_out": u16, "packets out_out": u16, "samples out_out": u16, "number of invalid samples": u64, "mod first samples out": u64, "mod last samples out": u64}
  T3 = cluster{"FFT misalignment": u64, "FFT halt": u64, "FFT last sample": u64}
  T4 = cluster{"number of invalid samples": u64, "first samples out": u64, "last samples out": u64, "number of cycles": u64}
  T5 = cluster{"Element 1": T2, "Element 2": T3, "Element 3": T4}
  T6 = cluster{"FFT misalignment count": u8, "FFT halt count": u8, "block start": u16, "block end": u16, "overflow_2": u16, "update active_2": u16, "update done_2": u16, "first sample out_2": u16, "exponent": FXP(4.0), "exponent_2": FXP(4.0), "elements read_2": u32}
  T7 = cluster{"Element 1": T2, "Element 2": T3, "Element 3": T4, "Element 4": T6}
  T8 = cluster{"QPSK mappercount out": u32, "Encoder count out": u32, "Byte to bit count out": u32, "fifo reader count out": u32}
  T9 = cluster{"debug bit to Byte count out": u64, "debug decoder count out": u64, "debug fifo reader count out": u64}
  T10 = cluster{"txEnable": bool, "rxEnable": bool, "Reset": bool, "baud_count": u16, "reset frame counter": bool, "reset tx counter": bool, "reset rx counter": bool}
  T11 = cluster{"debug rxData": u8, "debug txData": u8, "debug rxData valid": bool, "tx FIFO output valid": bool, "debug txRdy": bool, "count Error": u32, "count tx [Bytes]": u32, "count rx [Byte]": u32}
  "Control Signals.gtype" = cluster{"reset!": bool, "reset done?": bool, "request for config!": bool, "config done?": bool, "set active!": bool, "active?": bool}
  "Configuration Data.gtype" = cluster{"data": u64, "data valid": bool, "length": u16, "switch bank after": u16, "address": u16, "bank": u16, "address offset": u16, "update id": u8, "start update": bool}
  T12 = cluster{"Element 1": u16, "Element 2": u16, "Element 3": u16, "Element 4": u16}
  T13 = enum{"Data from Host", "Data from UART", "UART Loopback", "RX TX Loopback", "Data from Peer", ""}
  T14 = cluster{"RM packets_out": u16, "RM samples_out": u16, "payload length [sample]": u16, "payload length [bytes]": u16, "control channel length [samples]": u16, "control channel length [bytes]": u16}
  T15 = cluster{"first samples in": u16, "samples input": u16, "samples multiplexed": u16, "samples divided in blocks before multiplexer": u16, "corrected samples": u16, "samples divided in blocks after multiplexer": u16, "overflow counter_out": u16, "lost samples_out": u16, "state": u8}
  T16 = cluster{"missingSignalThresholdInSampels": u32, "GainIn": UFXP(5.1), "enableAnalogGainControl": bool, "enableDigitalGainController": bool, "enableDCremover": bool, "PiControl": UFXP(1.15), "setpointMaxAmplitude": UFXP(0.15), "NumbOfValidSamplesBetweenGainChange": u32, "permissibleControlError": UFXP(5.1)}
  "SyncConfig.gtype" = cluster{"Metric peak threshold": UFXP(1.16), "MetricThresholdMode": bool, "CFO removal": bool, "ffoPiControlCte": FXP(2.17), "shift_threshold": i16, "min_threshold": UFXP(1.16), "  AGC": T16}
  "niUsrpRio Config v1 Host.lvlib__Antenna Configuration.gtype" = enum{"TX1 RX1 transmits and RX2 receives", "TX1 RX1 receives and RX2 is unused"}
  "niUsrpRio Config v1 Host.lvlib__DB Types.gtype" = enum{"sbx", "cbx", "wbx", "unknown", "ubx"}
  T17 = cluster{"set": bool, "lo lpf": bool, "cpld ": bool, "switchChannel": bool, "Destination": enum{"configRx", "configTx"}, "antenna configuration": "niUsrpRio Config v1 Host.lvlib__Antenna Configuration.gtype", "daughterboard": "niUsrpRio Config v1 Host.lvlib__DB Types.gtype", "GainIn": UFXP(5.1), "spi address": u8}
  T18 = cluster{"inline gain I": FXP(1.17), "inline gain Q": FXP(1.17), "cross gain I": FXP(1.17), "cross gain Q": FXP(1.17), "pre-gain offset I": FXP(1.17), "pre-gain offset Q": FXP(1.17), "post-gain offset I": FXP(1.17), "post-gain offset Q": FXP(1.17)}
  T19 = cluster{"gain I": FXP(3.21), "gain Q": FXP(3.21)}
  T20 = enum{"Software", "Digital Edge", "Rx Start Trigger", "Tx Start Trigger", "Immediate", "Future Time Event"}
  T21 = cluster{"reset measure": bool, "Power Offset": FXP(9.7), "Threshold": FXP(9.7)}
  T22 = cluster{"log power": FXP(9.7), "CCA": bool, "Current sample": u16}
  T23 = cluster{"output sample rate": UFXP(1.47), "delay": FXP(0.16), "frequency shift": FXP(0.48), "impairments": T18, "phase": FXP(0.21)}
  T24 = cluster{"frequency shift": FXP(0.48), "impairments": T18, "phase": FXP(0.21), "input sample rate": UFXP(1.47), "gain": T19, "delay": FXP(0.18)}
diagram:
  clock-driven loop (clock = "40 MHz Onboard Clock") forever {
    Register Read(reference in="Needed Resources.grsc\\CCA.Status") -> (data=w1)
    call "IO_write.gcdl"(reference in="AUX I/O 2", data=w1)
    # Data Routing
    call "IO_read.gcdl"(reference in="AUX I/O 3") -> (data=w2)
    Register Write(data=w2, reference in="Needed Resources.grsc\\CCA.Reset")
    call "IO_read.gcdl"(reference in="AUX I/O 1") -> (data=w3)
    call "UART_V2.0.gcdl"(Rx=w3, control=$"UART.control", Clear FIFOs=$"UART.Clear") -> (Tx=w4, Rx FIFO=w5, tx FIFO=w6, status=w7, Clear done=w8)
    call "IO_write.gcdl"(reference in="AUX I/O 0", data=w4)
    $"UART.status" <- w7
    $"UART.Clear done" <- w8
    Number To Boolean Array(number=$D2through9) -> (Boolean array=w9)
    Array Index(array=w9) -> (out2[_]=w10, out3[_]=w11, out4[_]=w12, out5[_]=w13, out6[_]=w14, out7[_]=w15)
    call "IO_write.gcdl"(reference in="AUX I/O 4", data=w10)
    call "IO_write.gcdl"(reference in="AUX I/O 5", data=w11)
    call "IO_write.gcdl"(reference in="AUX I/O 6", data=w12)
    call "IO_write.gcdl"(reference in="AUX I/O 7", data=w13)
    call "IO_write.gcdl"(reference in="AUX I/O 8", data=w14)
    call "IO_write.gcdl"(reference in="AUX I/O 9", data=w15)
    Feedback Node(input=w16) -> w17
    FIFO Read(Control Protocol Input=w17, reference in="Needed Resources.grsc\\TX.data in.H2T") -> (Control Protocol Output=w18, data=w19)
    FIFO Read(Control Protocol Input=w17, reference in=w5) -> (Control Protocol Output=w20, data=w21)
    Feedback Node(input=w22) -> w23
    FIFO Read(Control Protocol Input=w23, reference in="Needed Resources.grsc\\RX.DataFromDecoder") -> (Control Protocol Output=w24, data=w25)
    FIFO Read(Control Protocol Input=w17, reference in="Needed Resources.grsc\\MAC2PHY") -> (Control Protocol Output=w26, data=w27)
    case ($"Data Routing") {
      frame "Data from Host", Default {
        w28 = w19
        w29 = w18
        w30 = w25
        w31 = w24
        w32 = TRUE
        w33 = 0
        w34 = FALSE
        w35 = default
        w36 = default
        w37 = FALSE
      }
      frame "Data from UART" {
        w28 = w21
        w29 = w20
        w30 = w25
        w31 = w24
        w32 = default
        w33 = w25
        w34 = w24
        w35 = default
        w36 = default
        w37 = FALSE
      }
      frame "UART Loopback" {
        w28 = w21
        w29 = w20
        w30 = w21
        w31 = w20
        w32 = default
        w33 = w21
        w34 = w20
        w35 = TRUE
        w36 = default
        w37 = FALSE
      }
      frame "RX TX Loopback" {
        w28 = w25
        w29 = w24
        w30 = w25
        w31 = w24
        w32 = TRUE
        w33 = default
        w34 = default
        w35 = default
        w36 = default
        w37 = FALSE
      }
      frame "Data from Peer" {
        w28 = w27
        w29 = w26
        w30 = w25
        w31 = w24
        w32 = default
        w33 = default
        w34 = default
        w35 = TRUE
        w36 = w25
        w37 = w24
      }
    }
    FIFO Write(Control Protocol Input=w29, data=w28, reference in="Needed Resources.grsc\\TX.DataToEncoder") -> (Control Protocol Output=w38)
    FIFO Write(Control Protocol Input=w31, data=w30, reference in="Needed Resources.grsc\\RX.Data out.T2H") -> (Control Protocol Output=w39)
    FIFO Write(Control Protocol Input=w34, data=w33, reference in=w6) -> (Control Protocol Output=w40)
    Select(s=w32, t=w39, f=w40) -> w22
    Not(x=w35) -> w41
    Select(s=w41, t=w38, f=w22) -> w16
    FIFO Write(Control Protocol Input=w37, data=w36, reference in="Needed Resources.grsc\\PHY2MAC")
  }
  clock-driven loop (clock = "Needed Resources.grsc\\90 MHz") forever {
    call "Reset.gcdl"() -> (reset=w42, reset counter=w43)
    Feedback Node(input=w44) -> w45
    Logical Or($"TX.encoder.force", w45) -> w46
    Logical And($"TX.encoder.enabled", w46) -> w47
    # Encoder
    call "Padding_Encoder_Mapper_Wrapper.gcdl"(FIFO reference in="Needed Resources.grsc\\TX.DataToEncoder", packet length (Byte)=$"TX.Encoder.packet length(Byte,N/8)", FIFO reader reset=w42, debug counter reset=w43, enable=w47) -> (QPSK Sym out=w48, output valid=w49, debug count out=w50)
    $"TX.encoder.debug count out" <- w50
    call "Adjust data format.gcdl"(data in=w48, input valid=w49, Switch I and Q=$"TX.Encoder.Switch I and Q", shift=$"TX.Encoder.shift", bypass=FALSE) -> (data out=w51, output valid=w52)
    FIFO Write(Control Protocol Input=w52, data=w51, reference in="Resource Mapper Resources.grsc\\TX.RM.payload in") -> (reference out=w53)
    Property Node(instance in=w53) -> ("free elements"=w54)
    Feedback Node(input=w54) -> w55
    Is Greater(x=w55, y=$"TX.encoder.threshold") -> w44
  }
  clock-driven loop (clock = "Needed Resources.grsc\\160 MHz") (iteration -> i1) forever {
    Feedback Node(input=w56) -> w57
    FIFO Read(Control Protocol Input=w57, reference in="Updater Resources.grsc\\download") -> (Control Protocol Output=w58, data=w59)
    Property Node(instance in=$configuration_in, "data"=w59, "data valid"=w58) -> (instance out=w60)
    call "trigger reset logic.gcdl"(control signals_in=$"control signals_in", loop iteration=i1, cycles to keep in reset=100) -> (control signals_out=w61, initial reset done_out=w62)
    # Resource Mapper - Demapper
    call "Resource Mapper.gcdl"(payload reference in="Resource Mapper Resources.grsc\\TX.RM.payload in", control channel reference in="Resource Mapper Resources.grsc\\TX.RM.control channel in", N-1=$"N-1_in", Resource Mapper Fifo_out="Resource Mapper Resources.grsc\\TX.Resource Mapper_out", Configuration data=w60, control signals_in=w61, update id_const=1) -> (control signals_out=w63, DEBUG.RM counter_out=w64, valid_out=w65, sample_out=w66, ready for RM input_out=w67, control channel length [bytes]=w68, control channel length [samples]=w69, payload length [bytes]=w70, payload length [sample]=w71)
    Feedback Node(input=w72) -> w73
    call "Resource Demapper.gcdl"(update id_const=2, data in fifo_in="Resource Mapper Resources.grsc\\RX.Resource Demapper_in", configuration data=w60, control signals_in=w63, N-1_in=$"N-1_in", ready for output=w73) -> (control signals_out=w74, payload valid_out=w75, payload_out=w76, ready for config input_out=w77, Received pilot_out=w78, RX.RM.debug counter_out=w79)
    Join Numbers(high(x)=w78, low(x)=w76) -> w80
    FIFO Write(Control Protocol Input=w75, data=w80, reference in="Needed Resources.grsc\\RX.Debug.Modem_64 bit samples out")
    Build Cluster(w68, w69, w70, w71) -> w81
    $"RM properties" <- w81
    $"control signals_out" <- w74
    call "Adjust data format.gcdl"(data in=w76, input valid=w75, Switch I and Q=$"RX.Encoder.Switch I and Q", shift=$"RX.Encoder.shift", bypass=FALSE) -> (data out=w82, output valid=w83)
    call "QPSK Demapper.gcdl"(Data In=w82, Input valid=w83) -> (output valid=w84, U2 Demap Mod Sym=w85)
    FIFO Write(Control Protocol Input=w84, data=w85, reference in="Needed Resources.grsc\\RX.Modem to decoder") -> (Control Protocol Output=w72)
    $"TX.RM.DEBUG.counter_out" <- w64
    $"RX.RM.debug counter_out" <- w79
    Logical Or(w77, w67) -> w56
    $"ready for configuration_out" <- w57
    FIFO Write(Control Protocol Input=w65, data=w66, reference in="Needed Resources.grsc\\TX.Debug.Encoder out")
    $"initial reset done_out" <- w62
    $"loop iteration" <- i1
  }
  Register Create(initial value="modem_configuration.gtype" {all zero or empty}) -> (reference out=w86)
  clock-driven loop (clock = "Needed Resources.grsc\\90 MHz") (after w86) forever {
    call "Reset.gcdl"() -> (reset=w87, reset counter=w88)
    # Decoder
    call "Decoder.gcdl"(FIFO Reference in="Needed Resources.grsc\\RX.Modem to decoder", Block Size(bit,N)=$"RX.decoder.Block Size(bit,N)", FIFO reader reset=w87, debug counter reset=w88) -> (decoded Byte=w89, outputvalid=w90, debug count out cluster=w91)
    FIFO Write(Control Protocol Input=w90, data=w89, reference in="Needed Resources.grsc\\RX.DataFromDecoder")
    $"RX.Decoder.Debug cluster" <- w91
  }
  clock-driven loop (clock = "Needed Resources.grsc\\160 MHz") forever {
    Register Read(reference in=w86) -> (data=w92)
    call "Reset.gcdl"() -> (reset=w93)
    # Detector
    disable {
      frame Enabled {
        call "Detection_CCA.gcdl"(RX.modem.data fifo_in="Needed Resources.grsc\\RX.gfdm data to equalizer", RX.modem.fft.bitshift_in=$"RX.modem.fft.bitshift_in", RX.modem.configuration_in=w92, RX.modem.configure_in=$"RX.modem.configure_in", RX.modem.filter fifo_in="Needed Resources.grsc\\RX.pulse shape in", RX.modem.reset_in=w93, RX.modem.bitshift_in=$"RX.modem.bitshift_in", channel coefficients_in="Needed Resources.grsc\\RX.channel Coefficients in", equ.shift=$"RX.equ.shift") -> (RX.modem.data valid_out=w99, RX.modem.32 bit data_out=w98, RX.modem.modem_configuration_out=w96, RX.modem.DEBUG.cluster_out=w95, RX.modem.config done_out=w94, RX.modem.reset active_out=w97)
      }
      frame Disabled {
        call "Detection.gcdl"(RX.modem.data fifo_in="Needed Resources.grsc\\RX.gfdm data to equalizer", RX.modem.fft.bitshift_in=$"RX.modem.fft.bitshift_in", RX.modem.configuration_in=w92, RX.modem.configure_in=$"RX.modem.configure_in", RX.modem.filter fifo_in="Needed Resources.grsc\\RX.pulse shape in", RX.modem.reset_in=w93, RX.modem.bitshift_in=$"RX.modem.bitshift_in", equ.shift=$"RX.equ.shift", L7="Needed Resources.grsc\\RX.channel Coefficients in") -> (RX.modem.data valid_out=w99, RX.modem.32 bit data_out=w98, RX.modem.modem_configuration_out=w96, RX.modem.config done_out=w94, RX.modem.reset active_out=w97)
      }
    }
    FIFO Write(Control Protocol Input=w99, data=w98, reference in="Needed Resources.grsc\\RX.Debug.Modem_32 bit samples out")
    FIFO Write(Control Protocol Input=w99, data=w98, reference in="Resource Mapper Resources.grsc\\RX.Resource Demapper_in")
    $"RX.modem.modem_configuration_out" <- w96
    $"RX.modem.config done_out" <- w94
    $"RX.modem.DEBUG.cluster_out" <- w95
    $"RX.modem.reset active_out" <- w97
  }
  clock-driven loop (clock = "Needed Resources.grsc\\160 MHz") forever {
    # trigger transmitter!
    Feedback Node[DelayCount=4](input=w100) -> w101
    Register Write(data=w101, reference in="Needed Resources.grsc\\TX.start trigger")
    Register Read(reference in=w86) -> (data=w102)
    call "Reset.gcdl"() -> (reset=w103)
    Feedback Node(input=w104) -> w105
    Logical Or($"TX.modem.force transmission", w105) -> w106
    Feedback Node(input=w107) -> w108
    Logical And(w108, $"TX.modem.enabled", w106) -> w109
    call "SISO-TX.gcdl"(TX.modem.data fifo_in="Resource Mapper Resources.grsc\\TX.Resource Mapper_out", TX.modem.reset_in=w103, TX.modem.bitshift_in=$"TX.modem.bitshift_in", TX.modem.configure_in=$"TX.modem.configure_in", TX.modem.configuration_in=w102, TX.modem.filter fifo_in="Needed Resources.grsc\\TX.pulse shape in", window_in="Needed Resources.grsc\\TX.Window in", Preamble_in="Needed Resources.grsc\\TX.Preamble in", TX.modem.enable=w109) -> (TX.modem.config done_out=w110, TX.frame valid_out=w111, TX.frame_out=w112, TX.modem.DEBUG.cluster_out=w113, TX.modem.reset active_out=w114)
    call "niInstr Basic Elements v1 FPGA.lvlib__Detect Rising Edge.gcdl"(signal=w111) -> (edge detected=w115)
    Logical And(w115, $"TX.automatic trigger_in") -> w100
    # Modulator
    Property Node(instance in=w102) -> ("Super frame length"=w116)
    call "SwitchIQ.gcdl"(data_in=w112) -> (data_out=w117)
    FIFO Write(Control Protocol Input=w111, data=w117, reference in="Needed Resources.grsc\\TX.to DAC") -> (reference out=w118)
    Property Node(instance in=w118) -> ("free elements"=w119)
    Feedback Node(input=w116) -> w120
    Feedback Node(input=w119) -> w121
    Is Greater Or Equal(x=w121, y=w120) -> w107
    $"TX.modem.config done_out" <- w110
    FIFO Write(Control Protocol Input=w111, data=w112, reference in="Needed Resources.grsc\\TX.Debug.frame out")
    $"TX.modem.DEBUG.cluster_out" <- w113
    $"TX.modem.reset active_out" <- w114
    FIFO Write(Control Protocol Input=w111, data=w112, reference in="Needed Resources.grsc\\TX to RX test FIFO")
    call "niInstr Basic Elements v1 FPGA.lvlib__Count Up U64.gcdl"(increment=TRUE, reset=w105) -> (count out=w122)
    $"TX.modem.count out" <- w122
    Is Greater Or Equal(x=w122, y=$"TX.modem.trigger limit") -> w104
  }
  FIFO Create(data type=u64 0, depth=17) -> (reference out=w123)
  FIFO Create(data type=u64 0, depth=17) -> (reference out=w124)
  clock-driven loop (clock = "40 MHz Onboard Clock") forever {
    # Synchronizer + AGC
    FIFO Read(Control Protocol Input=TRUE, reference in="Needed Resources.grsc\\RX.ADC to synch") -> (Control Protocol Output=w125, data=w126)
    call "SwitchIQ.gcdl"(data_in=w126) -> (data_out=w127)
    call "u32 to 4.12 cfx.gcdl"(data in=w127) -> (data out=w128)
    Feedback Node(input=w129) -> w130
    Feedback Node(input=w131) -> w132
    call "4.12 cfx to u32.gcdl"(input=w132) -> (output=w133)
    FIFO Write(Control Protocol Input=w130, data=w133, reference in="Needed Resources.grsc\\RX.gfdm data to equalizer")
    Logical And(w125, $"RX.sync.input enable_in") -> w134
    Feedback Node(input=w135) -> w136
    FIFO Write(Control Protocol Input=w136, data=w133, reference in="Needed Resources.grsc\\RX.Preamble out")
    Feedback Node(input=w137) -> w138
    call "Reset.gcdl"() -> (reset counter=w139)
    call "niInstr Basic Elements v1 FPGA.lvlib__Count Up U32.gcdl"(increment=w138, reset=w139) -> (count out=w140)
    $"RX.sync.sync found_out" <- w140
    Feedback Node(input=$"RX.sync.GFDM configuration cluster") -> w141
    Feedback Node(input=w128) -> w142
    Feedback Node(input=w134) -> w143
    # w124: Port0
    # w123: Port1
    call "Sync_K64_TUDwrapper_pk.gcdl"(validIn=w143, GFDM configuration cluster=w141, dataIn=w142, Config=$"RX.sync.config", halfPreambleVectorIn=$"RX.sync.halfPreambleVectorIn") -> (dataOut=w131, SynchronizationFoundOut=w137, preambleValid=w135, gfdmSymbolValid=w129, AnalogGainOut=w144, setAnalogGain=w145)
    call "setATRwrapper.gcdl"(RxGainIn=w144, setRxGainIn=w145, Fifo.Port0=w124, Fifo.Port1=w123, conf=$"AGC.config") -> (sync.lastWrittenRxGain=w146)
    $"RX.sync.lastWrittenRxGain" <- w146
  }
  call "Create Resources.gvi"() -> (sync.resources=w147, config.resources=w148, time.resources=w149)
  clock-driven loop (clock = "40 MHz Onboard Clock") {
    Register Write(data=$"TX.modem.configuration_in", reference in=w86)
    # w123: Port1
    Build Array($Reset, $"Reset counter") -> w150
    Register Write(data=w150, reference in="Needed Resources.grsc\\Reset")
    Io Write(data=$"RF 1/Rx/Enable", reference in="RF 1/Rx/Enable")
    Io Write(data=$"RF 0/Tx/Enable", reference in="RF 0/Tx/Enable")
    Io Write(data=$"RF 0/Rx/Enable", reference in="RF 0/Rx/Enable")
    Io Write(data=$"RF 1/Tx/Enable", reference in="RF 1/Tx/Enable")
    # w124: Port0
    Feedback Node(input=w151) -> w152
    Property Node(instance in=w152) -> ("ready for port 0 input"=w153, "ready for port 1 input"=w154, "ready for port 2 input"=w155)
    Feedback Node(input=w156) -> w157
    call "niInstr Register Bus v1 FPGA.lvlib__Process.gcdl"(reg.notify host.go rcvd=$"reg.notify host.go rcvd 0", reg.host read.go rcvd=$"reg.host read.go rcvd 0", read completion=w157, reg.reset=$"reg.reset 0", reg.host instruction fifo="niInstr Register Bus v0.grsc\\reg.host instruction fifo 0", ready for output=w155) -> (reg.notify host.go=w158, reg.host read.data=w159, register instruction=w160)
    $"reg.notify host.go 0" <- w158
    $"reg.host read.data 0" <- w159
    FIFO Read(Control Protocol Input=w153, reference in=w124) -> (Control Protocol Output=w161, data=w162)
    call "Retrieve FPGA Scoped Instruction.gcdl"(number=w162, valid=w161) -> (output cluster=w163)
    # these FIFOs are for setting the Gain on FPGA side
    FIFO Read(Control Protocol Input=w154, reference in=w123) -> (Control Protocol Output=w164, data=w165)
    call "Retrieve FPGA Scoped Instruction.gcdl"(number=w165, valid=w164) -> (output cluster=w166)
    Feedback Node(input=w167) -> w168
    call "niInstr Register Bus v1 FPGA.lvlib__Register Instruction Arbiter (3 inputs).gcdl"(port 0=w163, port 1=w166, port 2=w160, reset=FALSE, ready for output=w168) -> (register instr out=w169, ready for input=w151)
    call "Registers.gcdl"(sync.resources=w147, register instruction=w169, config.resources=w148, time.resources=w149) -> (read completion out=w156, ready for input=w167)
    stop if FALSE
  }
  call "niUsrpRio Config v1 FPGA.lvlib__Process.gvi"(resources=w148)
  clock-driven loop (clock = "Data Clock") {
    Build Array($"rx 0.stream enable", $"rx 1.stream enable") -> w170
    # trigger from TX
    # frame generation
    Register Read(reference in="Needed Resources.grsc\\TX.start trigger") -> (data=w171)
    Logical Or($"tx.software trigger", w171) -> w172
    disable {
      frame Enabled {
        call "Start Triggers Time_CCA.gcdl"(rx 1.stream enabled=$"rx 1.stream enable", rx.software trigger=$"rx.software trigger", tx.trigger select=$"tx.trigger select", tx.enable trigger=$"tx.trigger enable", tx 0.stream enabled=$"tx 0.stream enable", tx 1.stream enabled=$"tx 1.stream enable", rx 0.stream enabled=$"rx 0.stream enable", rx.enable trigger=$"rx.trigger enable", rx.trigger select=$"rx.trigger select", tx.software trigger=w172) -> (rx.start trigger=w173, tx.start trigger=w174)
      }
      frame Disabled {
        call "Start Triggers Time.gcdl"(rx 1.stream enabled=$"rx 1.stream enable", rx.software trigger=$"rx.software trigger", tx.trigger select=$"tx.trigger select", tx.enable trigger=$"tx.trigger enable", tx 0.stream enabled=$"tx 0.stream enable", tx 1.stream enabled=$"tx 1.stream enable", rx 0.stream enabled=$"rx 0.stream enable", rx.enable trigger=$"rx.trigger enable", rx.trigger select=$"rx.trigger select", tx.software trigger=w172) -> (rx.start trigger=w173, tx.start trigger=w174)
      }
    }
    Io Read(reference in="RF 0/Rx/I") -> (data=w175)
    Io Read(reference in="RF 0/Rx/Q") -> (data=w176)
    call "niInstr DSP v1 FPGA.lvlib__I16 to IQ.gcdl"(I=w175, Q=w176) -> (IQ data=w177)
    Io Read(reference in="RF 1/Rx/I") -> (data=w178)
    Io Read(reference in="RF 1/Rx/Q") -> (data=w179)
    call "niInstr DSP v1 FPGA.lvlib__I16 to IQ.gcdl"(I=w178, Q=w179) -> (IQ data=w180)
    Build Array(w177, w180) -> w181
    w182 = T23 {"0x800000000000", 0, 0, "0x1FFFF", "0x1FFFF", 0, 0, 0, 0, 0, 0, 0}
    Property Node(instance in=w182, "impairments"=$"rx 0.impairments", "frequency shift"=$"rx 0.frequency shift", "phase"=$"rx 0.phase", "output sample rate"=$"rx 0.output sample rate", "delay"=$"rx 0.delay") -> (instance out=w183)
    w184 = T23 {"0x800000000000", 0, 0, "0x1FFFF", "0x1FFFF", 0, 0, 0, 0, 0, 0, 0}
    Property Node(instance in=w184, "delay"=$"rx.delay", "output sample rate"=$"rx.output sample rate", "impairments"=$"rx 1.impairments", "frequency shift"=$"rx 1.frequency shift", "phase"=$"rx 1.phase") -> (instance out=w185)
    Build Array(w183, w185) -> w186
    disable {
      frame Enabled {
        call "DDC (Multi-Channel)_CCA.gcdl"(enable DC correction=$"DC correction.enable", data in=w181, start trigger=w173, enabled=w170, DDC Parameters=w186, reset=$"rx.reset", n-DC=$"DC correction.n") -> (DC Average=w191, data out=w189, number of overflows=w188, output valid=w192, dsp reset done=w187, Dc correction=w190)
      }
      frame Disabled {
        call "DDC (Multi-Channel).gcdl"(data in=w181, start trigger=w173, enabled=w170, DDC Parameters=w186, reset=$"rx.reset") -> (data out=w189, number of overflows=w188, dsp reset done=w187)
      }
    }
    # Streaming Transceiver Engine
    call "CCA_sources.gcdl"(data in=w189, enabled=w170, input valid=w192, ch0/ch1=$"CCA.ch0/ch1") -> (data valid=w193, data=w194)
    # #CodeRecommended - If you want to move the data directly to another LabVIEW FPGA device
    #  for further processing, you can replace the DMA FIFO with a Peer to Peer Writer FIFO.
    # WIFI Channel sensing: measure for 20MHz channel with sampling frequency 80MHz
    # If the sampling of the data channel is less then 80, the other RX channel must be used
    call "Sensing_FIR.gcdl"(data in=w194, input valid=w193, CS.Control=$"CCA.Control", CCS.reset register="Needed Resources.grsc\\CCA.Reset", CCS.Status="Needed Resources.grsc\\CCA.Status") -> (CS.status=w195, CS1.Noframes=w196)
    $"CCA.status" <- w195
    $"CCA.Noframes" <- w196
    # #CodeRecommended - For your custom data processing IP, you can add Target-Scoped FPGA FIFOs
    #  if you need to move data to a different clock domain.
    call "niInstr Basic Elements v1 FPGA.lvlib__Detect Rising Edge.gcdl"(signal=$"rx.abort") -> (edge detected=w197)
    Select(s=$"RX.switch channels", t=0, f=1) -> w198
    Array Index(array=w192) -> (out0[w198]=w199)
    Feedback Node(input=w200) -> w201
    Not(x=w201) -> w202
    call "Input Stream Control.gcdl"(input valid=w199, start trigger=w173, burst size=$"rx.samples to acquire", abort=w197, fifo timeout=w202, reset=$"rx.reset") -> (write stream=w203, state=w204, samples processed=w205, number of overflows=w206)
    call "Write FIFO (Multi-Channel).gcdl"(switch channels=$"RX.switch channels", data in=w189, enabled=w170, input valid=w203, reset=$"rx.reset", FIFO 0="Needed Resources.grsc\\RX.ADC to synch", T2H fifo reference="Needed Resources.grsc\\Dummy") -> (ready for input=w200)
    Array Index(array=w188) -> (out0[_]=w207, out1[_]=w208)
    $"rx 0.number of IQ data overflows" <- w207
    $"rx 1.number of IQ data overflows" <- w208
    $"rx.dsp reset done" <- w187
    $"rx.state" <- w204
    $"rx.samples processed" <- w205
    $"rx.number of overflows" <- w206
    $"DC correction. applied" <- w190
    $"DC correction. average" <- w191
    Build Array($"tx 0.stream enable", $"tx 1.stream enable") -> w209
    Build Array($"tx 0.stream enable", $"tx 1.stream enable") -> w210
    call "niInstr Basic Elements v1 FPGA.lvlib__Detect Rising Edge.gcdl"(signal=$"tx.abort") -> (edge detected=w211)
    Feedback Node(input=w212) -> w213
    Feedback Node(input=w214) -> w215
    call "Output Stream Control.gcdl"(start trigger=w174, burst size=$"tx.samples to generate", abort=w211, ready to read stream (T)=w215, fifo output valid=w213, reset=$"tx.reset") -> (read stream=w216, state=w217, samples processed=w218, number of underflows=w219)
    call "Read FIFO (Multi-Channel).gcdl"(enabled=w210, FIFO 0="Needed Resources.grsc\\TX.to DAC", ready for output=w216) -> (data out=w220, output valid=w212)
    # #CodeRecommended - If you want to pull data directly from another LabVIEW FPGA device,
    # you can replace the DMA FIFO with a Peer to Peer Reader FIFO.
    call "niInstr Basic Elements v1 FPGA.lvlib__Synchronous Latch.gcdl"(set=w212, clear=$"tx.reset") -> (out=w221)
    Logical And(w221, w215) -> w222
    w223 = T24 {0, "0x1FFFF", "0x1FFFF", 0, 0, 0, 0, 0, 0, 0, 0, "0x200000", "0x200000", 0}
    Property Node(instance in=w223, "gain"=$"tx 0.gain", "frequency shift"=$"tx 0.frequency shift", "phase"=$"tx 0.phase", "impairments"=$"tx 0.impairments", "input sample rate"=$"tx.input sample rate", "delay"=$"tx.delay") -> (instance out=w224)
    w225 = T24 {0, "0x1FFFF", "0x1FFFF", 0, 0, 0, 0, 0, 0, 0, 0, "0x200000", "0x200000", 0}
    Property Node(instance in=w225, "delay"=$"tx 1.delay", "input sample rate"=$"tx 1.input sample rate", "gain"=$"tx 1.gain", "frequency shift"=$"tx 1.frequency shift", "phase"=$"tx 1.phase", "impairments"=$"tx 1.impairments") -> (instance out=w226)
    Build Array(w224, w226) -> w227
    call "DUC (Multi-Channel).gcdl"(data in=w220, enabled=w209, input valid=w222, DUC Parameters=w227, reset=$"tx.reset") -> (I data out=w228, Q data out=w229, number of overflows=w230, dsp reset done=w231, ready for input=w214)
    Array Index(array=w228) -> (out0[_]=w232, out1[_]=w233)
    # #CodeRecommended - For your custom data processing IP, you can add
    # Target-Scoped FPGA FIFOs if you need to move data to/from a different clock domain.
    Io Write(data=w232, reference in="RF 0/Tx/I")
    Io Write(data=w233, reference in="RF 1/Tx/I")
    Array Index(array=w229) -> (out0[_]=w234, out1[_]=w235)
    Io Write(data=w234, reference in="RF 0/Tx/Q")
    Io Write(data=w235, reference in="RF 1/Tx/Q")
    $"tx.state" <- w217
    Array Index(array=w230) -> (out0[_]=w236, out1[_]=w237)
    $"tx 0.number of IQ data overflows" <- w236
    $"tx.samples processed" <- w218
    $"tx 1.number of IQ data overflows" <- w237
    $"tx.dsp reset done" <- w231
    $"tx.underflows" <- w219
    stop if FALSE
  }
