vi "GFDM Host-with CCA.gvi"   [LabVIEW Communications System Design Suite 2.0.1]
panel controls:
  "stop": bool
  "GFDM parameter": "GFDM parameter.gtype" = {"Variable: K"=64, "Variable: M"=9, "Variable: a"=0, "filter type"="rc", "receive filter"="ZF", "inverse FFT"=FALSE, "Variable: b"=0, "Ncs"=16, "Ncp"=32}
  "Operation": i32 = 2
  "TX.modem.bitshift_in": i16 = 14
  "USRP RIO device": string = "RIO0"
  "Reference Frequency Source": string = "Internal"
  "TX.automatic trigger_in": bool = TRUE
  "RX.switch channels": bool
  "Channel Length": i32 = 9
  "RX.modem.bitshift_in": i16 = 18
  "RX.modem.fft.bitshift_in": i16 = 14
  "UDP receive port": u16 = 50000
  "TX.modem.transmission time interval": u64 = 20000
  "TX.enabled": bool = TRUE
  "Control Tab": i32 = 1
  "UART.control": T11 = {"txEnable"=TRUE, "rxEnable"=TRUE, "Reset"=FALSE, "baud_count"=200, "reset frame counter"=FALSE, "reset tx counter"=FALSE, "reset rx counter"=FALSE}
  "UDP send port": u16 = 60000
  "PayloadSize [Byte]": u16 = 9
  "Use Phase Tracking": bool = TRUE
  "Add frame counter": bool
  "Data panel": i32
  "Read UDP?": bool
  "RM:No DC": bool = TRUE
  "TX.Sample Rate [S/s]": f64 = 20000000
  "RX.Frequency [Hz]": f64 = 2437000000
  "TX.Frequency [Hz]": f64 = 2437000000
  "RX1.Sample Rate [S/s]": f64 = 20000000
  "UseCAPIData": bool
  "Preamble path": path
  "Preamble mode": T15 = "Load from file"
  "preamble scale": f64 = 7
  "Fully allocated?": bool = TRUE
  "RX.sync.config": T16 = {"CFO removal"=FALSE, "ffoPiControlCte"=9.91821289062e-05, "Pi Control"=0.100006103516, "Analog Gain Controller"=TRUE, "setpoint (max. amplitude)"=0.700042724609, "numbOfBlocksBeforGainChange"=5, "Digital Gain Controller"=FALSE, " Gain [dB]"=14.5, "permissible error [dB]"=1}
  "normalize preamble?": bool = TRUE
  "CCA.switch channel": bool = TRUE
  "CCA.Control": T18 = {"reset measure"=FALSE, "Power Offset"=0, "Threshold"=-60}
  "RX0.Sample Rate [S/s]": f64 = 80000000
  "RX.enable": bool = TRUE
  "DC correction.n": i16[2] = [12, 12]
  "DC correction.enable": bool[2] = [TRUE, TRUE]
  "Data Routing": T19 = "Data from Host"
  "Pazload size [Byte]": i32 = "61"(1)
panel indicators:
  "general error description": string  # source out indicates the source of the error.
  "rx.number of overflows": u32
  "rx 1.output sample rate": UFXP(1.47)
  "rx 0.number of IQ data overflows": u64
  "rx.samples processed": u32
  "rx.samples to acquire": u32
  "rx.state": enum{"Idle", "Active"}
  "tx 0.number of IQ data overflows": u64
  "rx 1.number of IQ data overflows": u64
  "tx 1.number of IQ data overflows": u64
  "tx 0.input sample rate": UFXP(1.47)
  "TX.modem.DEBUG.cluster_out": T4
  "tx.RF.state": enum{"Idle", "Active"}
  "tx.underflows": u32
  "TX Coerced Configurations": T5
  "RX Coerced Configurations": T6
  "RX.sync.sync found_out": u32
  "preamble": f64[][]
  "FPGA configuration": T7
  "RX.sync.GFDM configuration cluster": T8
  "channel freq domain": f64[][]
  "channel time domain": f64[][]
  "IQ": c128[][]
  "RE_data": f64[]
  "IM_data": f64[]
  "RX.modem.DEBUG.cluster_out": T10
  "Channel Freq. Resp.": c128[]
  "Update of channel coefficients": bool
  "Number of channel coefficients update": f64
  "received preamble": u32[]
  "transmission interval [s]": f64
  "UART.status": T12
  "Received Bytes": u8[]
  "Decoder byte out": string
  "UDP send error": string  # source out indicates the source of the error.
  "current angle": string
  "angle over time": i32
  "K_set": i16[]
  "M_set": i16[]
  "RM properties": T13
  "UDP receive FIFO full": bool
  "UDP receive error": string  # source out indicates the source of the error.
  "UDP packet size [byte]": i32
  "transmission frame size [byte]": i32
  "half of the payload [byte]": f64
  "GFDM block payload size [byte]": u32
  "Number of GFDM blocks": u32
  "packet counter": u32
  "TX signal": FXP(3.14)[][]
  "RX.RM.debug counter_out": T14
  "Pilot-Betrag": UFXP(2.14)[]
  "Pilot-Phase": f64[]
  "TX byte": u8[]
  "received packets": u32
  "empty elements remaining": u32
  "Minimum Receive Power": f64
  "rms value": f64
  "Preamble Power_Host": f64
  "Preamble Power_Host Chart": f64
  "PSD": f64[]
  "QAM symbols per Frame": u32
  "RX Gain": UFXP(5.1)
  "RX.sync.lastWrittenRxGain": UFXP(5.1)
  "rx 0.output sample rate": UFXP(1.47)
  "CCA.status": T17
  "CCA.No frames": u64
  "DC correction. applied": CFXP(1.17)[2]
  "DC correction. average": CFXP(15.17)[2]
  "Data Clock Rate": u32
  "N_Blocks [Blocks]": u16
types:
  "GFDM parameter.gtype" = cluster{"Variable: K": i32, "Variable: M": i32, "Variable: a": f64, "filter type": enum{"rc", "rect"}, "receive filter": enum{"MF", "ZF"}, "inverse FFT": bool, "Variable: b": f64, "Ncs": u16, "Ncp": u16}
  T1 = cluster{"packets in_out": u16, "samples in_out": u16, "packets out_out": u16, "samples out_out": u16, "number of invalid samples": u64, "mod first samples out": u64, "mod last samples out": u64}
  T2 = cluster{"FFT misalignment": u64, "FFT halt": u64, "FFT last sample": u64}
  T3 = cluster{"number of invalid samples": u64, "first samples out": u64, "last samples out": u64, "number of cycles": u64}
  T4 = cluster{"Element 1": T1, "Element 2": T2, "Element 3": T3}
  T5 = cluster{"Coerced Frequencies [Hz]": f64[], "Coerced LO Frequencies [Hz]": f64[], "Coerced Output Powers [dBm]": f64[], "Coerced Sample Rates [S/s]": f64[]}
  T6 = cluster{"Coerced Frequencies [Hz]": f64[], "Coerced LO Frequencies [Hz]": f64[], "Coerced Levels [dBm]": f64[], "Coerced Sample Rates [S/s]": f64[]}
  T7 = cluster{"K-1": u16, "M-1": u8, "N-1": u16, "N": u16, "Npreamble+CP+CS": u16, "Npreamble": u16, "Nw": u16, "Modulator MUX config": u64[16], "K": u16, "fft_size_log2(K)": u8, "inverse_fft": bool, "Start with preamble": bool, "Burstmode": bool, "Ncs": u16, "Ncp": u16, "N-Ncp": u16, "N+Ncp": u16, "N+Ncp+Ncs": u16, "Demodulator MUX config": u64[16], "M": u8, "DFT SIZE": FXP(6.0), "Frame length": u32, "Super frame length": u32, "Ns_all_GFDM_blocks": u32, "Ns_all_preambles": u32}
  T8 = cluster{"Preamble mu": u16, "GFDM B": u16, "Preamble K": u16, "Preamble Ncp": u16, "GFDM Ncp": u16, "GFDM M": u16, "Preamble Ncs": u16, "GFDM K": u16, "GFDM Ncs": u16, "Preamble M": u16}
  T9 = cluster{"FFT misalignment count": u8, "FFT halt count": u8, "block start": u16, "block end": u16, "overflow_2": u16, "update active_2": u16, "update done_2": u16, "first sample out_2": u16, "exponent": FXP(4.0), "exponent_2": FXP(4.0), "elements read_2": u32}
  T10 = cluster{"Element 1": T1, "Element 2": T2, "Element 3": T3, "Element 4": T9}
  T11 = cluster{"txEnable": bool, "rxEnable": bool, "Reset": bool, "baud_count": u16, "reset frame counter": bool, "reset tx counter": bool, "reset rx counter": bool}
  T12 = cluster{"debug rxData": u8, "debug txData": u8, "debug rxData valid": bool, "tx FIFO output valid": bool, "debug txRdy": bool, "count Error": u32, "count tx [Bytes]": u32, "count rx [Byte]": u32}
  T13 = cluster{"Element 1": u16, "Element 2": u16, "Element 3": u16, "Element 4": u16}
  T14 = cluster{"first samples in": u16, "samples input": u16, "samples multiplexed": u16, "samples divided in blocks before multiplexer": u16, "corrected samples": u16, "samples divided in blocks after multiplexer": u16, "overflow counter_out": u16, "lost samples_out": u16, "state": u8}
  T15 = enum{"Load from file", "Generate GFDM based Preamble"}
  T16 = cluster{"CFO removal": bool, "ffoPiControlCte": FXP(2.17), "Pi Control": UFXP(1.15), "Analog Gain Controller": bool, "setpoint (max. amplitude)": UFXP(0.15), "numbOfBlocksBeforGainChange": u16, "Digital Gain Controller": bool, " Gain [dB]": UFXP(5.1), "permissible error [dB]": UFXP(5.1)}
  T17 = cluster{"Power": FXP(9.7), "Channel free?": bool, "Current sample": u16}
  T18 = cluster{"reset measure": bool, "Power Offset": FXP(9.7), "Threshold": FXP(9.7)}
  T19 = enum{"Data from Host", "Data from UART", "UART Loopback", "RX TX Loopback", "Data from Peer", ""}
  T20 = cluster{"Antenna RF 0": string, "Frequency RF 0 [Hz]": f64, "LO Frequency RF 0 [Hz]": f64, "Reference Level RF 0 [dBm]": f64}
  T21 = cluster{"Antenna RF 1": string, "Frequency RF 1 [Hz]": f64, "LO Frequency RF 1 [Hz]": f64, "Reference Level RF 1 [dBm]": f64}
  T22 = enum{"Software", "Digital Edge", "Rx Start Trigger", "Tx Start Trigger", "Immediate", "Future Time Event"}
  T23 = cluster{"rf enable 0": bool, "rf config 0": T20, "rf enable 1": bool, "rf config 1": T21, "Number of Samples is Finite": bool, "Sample Rate [S/s]": f64, "Number of Samples": u32, "Start Trigger": T22}
  T24 = cluster{"Antenna RF 0": string, "Frequency RF 0 [Hz]": f64, "LO Frequency RF 0 [Hz]": f64, "Output Power RF 0 [dBm]": f64}
  T25 = cluster{"Antenna RF 1": string, "Frequency RF 1 [Hz]": f64, "LO Frequency RF 1 [Hz]": f64, "Output Power RF 1 [dBm]": f64}
  T26 = cluster{"rf enable 0": bool, "rf config 0": T24, "rf enable 1": bool, "rf config 1": T25, "Number of Samples is Finite": bool, "Sample Rate [S/s]": f64, "Number of Samples": u32, "Start Trigger": T22, "Tone Frequency [Hz]": f64}
  T27 = enum{"TX1 RX1 transmits and RX2 receives", "TX1 RX1 receives and RX2 is unused"}
  T28 = cluster{"set": bool, "lo lpf": bool, "cpld ": bool, "switchChannel": bool, "Destination": enum{"configRx", "configTx"}, "antenna configuration": T27, "daughterboard": enum{"sbx", "cbx", "wbx", "unknown", "ubx"}, "GainIn": UFXP(5.1), "spi address": u8}
uses:
  NI::Analysis::Statistics::RMS (CDB).gvi
  NI::Analysis::Transforms::Inverse Complex FFT.gvi
diagram:
  $stop <- FALSE
  $"received preamble" <- u32[] []
  case ($UseCAPIData) {
    frame True {
      w1 = no error
      w2 = UdpNetworkConnectionRefnum constant
      w3 = UdpNetworkConnectionRefnum constant
    }
    frame False {
      call "config UDP.gvi"(receive port (from vlc player)=$"UDP receive port") -> (UDP receive=w2, UDP send=w3, error out=w1)
    }
  }
  call "Reset FPGA.gvi"(USRP RIO device=$"USRP RIO device", error out=w1) -> (error in=w4)
  FPGA Open Node[ProjectItem=":NullTarget:GFDM\\ FPGA\\ Toplevel\\-with\\ CCA\\.lvbitx"](RIO address=$"USRP RIO device", error in=w4, run?=TRUE) -> (error out=w5, reference out=w6)
  w7 = "RX2"  # Antenna RF0
  w8 = T20 {"Antenna RF 0"="RX2", "Frequency RF 0 [Hz]"=1990000000, "LO Frequency RF 0 [Hz]"=-1, "Reference Level RF 0 [dBm]"=0}
  Property Node(instance in=w8, "Antenna RF 0"=w7, "Frequency RF 0 [Hz]"=$"RX.Frequency [Hz]", "LO Frequency RF 0 [Hz]"=-1, "Reference Level RF 0 [dBm]"=0) -> (instance out=w9)
  Property Node(instance in=$"GFDM parameter") -> ("Variable: K"=w10, "Variable: M"=w11, "Ncs"=w12, "Ncp"=w13)
  Multiply(w10, w11) -> w14
  Add(w12, w13) -> w15
  Square(x=w15) -> w16
  Add(w14, 128, w16) -> w17
  w18 = T23 {"rf enable 0"=FALSE, "rf config 0"={"Antenna RF 0"="RX2", "Frequency RF 0 [Hz]"=1990000000, "LO Frequency RF 0 [Hz]"=-1, "Reference Level RF 0 [dBm]"=0}, "rf enable 1"=TRUE, "rf config 1"={"Antenna RF 1"="RX2", "Frequency RF 1 [Hz]"=2180000000, "LO Frequency RF 1 [Hz]"=-1, "Reference Level RF 1 [dBm]"=0}, "Number of Samples is Finite"=FALSE, "Sample Rate [S/s]"=20000000, "Number of Samples"=32000, "Start Trigger"="Immediate"}
  Property Node(instance in=w18, "rf enable 0"=TRUE, "rf config 0"=w9, "rf enable 1"=TRUE, "rf config 1"=w9, "Number of Samples is Finite"=FALSE, "Sample Rate [S/s]"=$"RX1.Sample Rate [S/s]", "Number of Samples"=w17, "Start Trigger"="Immediate") -> (instance out=w19)
  Property Node(instance in=T24 {all zero or empty}, "Antenna RF 0"="TX1", "Frequency RF 0 [Hz]"=$"TX.Frequency [Hz]", "LO Frequency RF 0 [Hz]"=-1, "Output Power RF 0 [dBm]"=26) -> (instance out=w20)
  w21 = T26 {"rf enable 0"=TRUE, "rf config 0"={"Antenna RF 0"="TX1", "Frequency RF 0 [Hz]"=1990000000, "LO Frequency RF 0 [Hz]"=-1, "Output Power RF 0 [dBm]"=20}, "rf enable 1"=FALSE, "rf config 1"={"Antenna RF 1"="TX1", "Frequency RF 1 [Hz]"=1990000000, "LO Frequency RF 1 [Hz]"=-1, "Output Power RF 1 [dBm]"=0}, "Number of Samples is Finite"=FALSE, "Sample Rate [S/s]"=20000000, "Number of Samples"=800, "Start Trigger"="Software", "Tone Frequency [Hz]"=100000}
  Property Node(instance in=w21, "rf enable 0"=TRUE, "rf config 0"=w20, "rf enable 1"=FALSE, "rf config 1"=w20, "Number of Samples is Finite"=FALSE, "Sample Rate [S/s]"=$"TX.Sample Rate [S/s]", "Number of Samples"=w17, "Start Trigger"="Software") -> (instance out=w22)
  Dynamic Fpga Interface Cast(reference in=w6, type="FPGA interface.gtype" constant) -> (reference out=w23)
  call "Open and Configure Device.gvi"(FPGA in=w23, usrp rio device=$"USRP RIO device", reference frequency source=$"Reference Frequency Source", error in=w5, rx config=w19, tx config=w22) -> (niusrprio session=w24, rx.coerced configurations=w25, tx.coerced configurations=w26, error out=w27, rx channels=w28, tx channels=w29)
  Array Index(array=[30, 61, 92, 124, 250, 374, 464, 526, 624]) -> (out0[$"Pazload size [Byte]"]=w30)
  call "Preset K+M set.gvi"(No DC=$"RM:No DC", M=w11, K=w10) -> (M_set=w31, K_set=w32)
  Boolean To Integer(Boolean=$"Use Phase Tracking") -> (0, 1=w33)
  call "ResourceMapperOptimization.gvi"(K_set=w32, M_set=w31, PayloadSize [Byte]=w30, ControlSize [Symbol]=w33, K=w10, M=w11, Replace Control with Pilots=$"Use Phase Tracking") -> (R_MAP=w34, N_Blocks [Blocks]=w35, N_DataSym_per_block [Symbol]=w36, K_set_out=w37, M_set_out=w38, InsufficientResources=w39, CanNotFit=w40, N_UsedResources [Byte]=w41)
  call "Initiate and Generate (Single).gvi"(niusrprio session=w24, first iteration=TRUE, error in=w27, tx channels=w29) -> (niusrprio session 2=w42, error out=w43)
  Property Node(instance in=w42) -> ("FPGA Interface"=w44, instance out=w45)
  call "Initiate and Fetch (Single).gvi"(niusrprio session=w45, first iteration=TRUE, error in=w43, rx channels=w28) -> (niusrprio session 2=w46, error out=w47)
  Dynamic Fpga Interface Cast(reference in=w44, type="OpaqueRefnumLiteral_2.gtype" constant) -> (reference out=w48)
  Logical Or(not TRUE, w40, w39) -> w49
  Select(s=w49, t=error {"status"=TRUE, "code"=1, "source"="RM fault!"}, f=no error) -> w50
  Merge Errors(w47, w50) -> (error out=w51)
  disable {
    frame Enabled {
      call "Configure FIFOs_CCA.gvi"(OpaqueRefnumLiteral=w48, error in=w51, UseCAPIData=$UseCAPIData) -> (reference out=w52, error out=w53)
    }
    frame Disabled {
      call "Configure FIFOs.gvi"(error in=w51, UseCAPIData=$UseCAPIData) -> (error out=w53)
    }
  }
  case (w53) {
    frame No Error, Default {
      disable {
        frame Enabled {
          call "GFDM_Xcvr_configure FPGA_CCA.gvi"(OpaqueRefnumLiteral=w52, Error=w53, GFDM parameter=$"GFDM parameter", GFDM B=$"N_Blocks [Blocks]", TX.Encoder.packet length(Byte,N/8)=w41, Kset_in=w37, Preamble path=$"Preamble path", Preamble mode=$"Preamble mode", preamble scale=$"preamble scale") -> (FPGA.Interface=w59, Error out=w57, GFDM all parameters=w58)
        }
        frame Disabled {
          call "GFDM_Xcvr_configure FPGA.gvi"(Error=w53, GFDM parameter=$"GFDM parameter", GFDM B=$"N_Blocks [Blocks]", TX.Encoder.packet length(Byte,N/8)=w41, Kset_in=w37, Preamble path=$"Preamble path", Preamble mode=$"Preamble mode", preamble scale=$"preamble scale") -> (Error out=w57, GFDM all parameters=w58)
        }
      }
      Dynamic Fpga Interface Cast(reference in=w59, type="FPGA interface.gtype" constant) -> (reference out=w60)
      call "RM config.gvi"(FPGA interface in=w60, R_MAP=w34, error in=w57) -> (Error=w61)
      w62 = $"PayloadSize [Byte]"
      w63 = $"PayloadSize [Byte]"
      case ($UseCAPIData) {
        frame True { }
        frame False {
          s1 = w61  # shift register
          while (iteration -> i1) {
            Wait[Units=Microseconds](time to wait=100)
            case ($"Read UDP?") {
              frame False, Default {
                call "create ramp.gvi"(length=w62) -> (data in=w66)
                w64 = default
                w65 = default
                w67 = s1
              }
              frame True {
                call "UDP read.gvi"(UDP connection=w2, Error=s1) -> (receive FIFO full=w64, data out=w66, UDP receive error=w65, error out=w67)
              }
            }
            Array Size(array=w66) -> (size(s)=w68)
            $"UDP packet size [byte]" <- w68
            $"UDP receive FIFO full" <- w64
            case ($"Add frame counter") {
              frame False, Default {
                w69 = w66
              }
              frame True {
                call "TX packet generator.gvi"(input data=w66, packet_counter=i1, gfdm block size[byte]=w62, overhead[byte]]=7) -> (payload=w70, split at=w71, generated length=w72, gfdm data=w69, gfdm blocks needed=w73)
                $"GFDM block payload size [byte]" <- w70
                $"half of the payload [byte]" <- w71
                $"transmission frame size [byte]" <- w72
                $"Number of GFDM blocks" <- w73
              }
            }
            $"TX byte" <- w69
            $"UDP receive error" <- w65
            Host Fifo Write Node[FifoName="Needed Resources.grsc\\TX.data in.H2T"](data=w69, error in=w67, reference in=w59) -> (error out=w74)
            next s1 = w74
            stop if $stop
          }
          Dynamic Fpga Interface Cast(reference in=w59, type="FPGA interface.gtype" constant) -> (reference out=w75)
          s2 = 0  # shift register
          while {
            Host Fifo Read Node[FifoName="Needed Resources.grsc\\RX.Data out.T2H"](error in=w61, number of elements=0, reference in=w75) -> (elements remaining=w76, error out=w77, reference out=w78)
            Is Not Equal To 0(x=w76) -> w79
            case (w79) {
              frame False, Default {
                w80 = s2
              }
              frame True {
                case ($"Add frame counter") {
                  frame True {
                    call "receive packet.gvi"(packet size[byte]=$"UDP packet size [byte]", payload=$"GFDM block payload size [byte]", split at_in=$"half of the payload [byte]", gfdm block size[byte]_in=w63, gfdm blocks needed_in=$"Number of GFDM blocks", Error_in=w77, stop=$stop, timeout in milliseconds_in=5000, FPGA reference in=w78) -> (packet_out=w81, error in=w82, frame counter=w83)
                  }
                  frame False {
                    Host Fifo Read Node[FifoName="Needed Resources.grsc\\RX.Data out.T2H"](error in=w77, number of elements=w63, reference in=w78) -> (data=w81, error out=w82)
                    w83 = default
                  }
                }
                $"Received Bytes" <- w81
                Type Cast(type=string EmptyString, x=w81) -> w84
                $"Decoder byte out" <- w84
                $"packet counter" <- w83
                call "UDP send.gvi"(UDP send.port or service name=$"UDP send port", Input=w3, Array=w81, Error=w82)
                call "Decode angle.gvi"(error out=w82, output=w84) -> (description=w85, current angle=w86, angle over time=w87)
                $"UDP send error" <- w85
                $"current angle" <- w86
                $"angle over time" <- w87
                Increment(x=s2) -> w80
                $"received packets" <- w80
              }
            }
            Wait[Units=Microseconds](time to wait=100)
            next s2 = w80
            stop if $stop
          }
        }
      }
      Property Node(instance in=w58) -> ("Modem Configuration:Super frame length"=w88)
      while {
        Host Fifo Read Node[FifoName="Needed Resources.grsc\\TX.Debug.frame out"](error in=w61, number of elements=0, reference in=w59) -> (elements remaining=w89, error out=w90, reference out=w91)
        Is Not Equal To 0(x=w89) -> w92
        case (w92) {
          frame False, Default {
            w93 = default
            w94 = default
          }
          frame True {
            call "Blocks in FIFO.gvi"(requested lenght=w88, number of elements in FIFO=w89) -> (number of elements=w95)
            Host Fifo Read Node[FifoName="Needed Resources.grsc\\TX.Debug.frame out"](error in=w90, number of elements=w95, reference in=w91) -> (error out=w96, reference out=w97)
            Host Fifo Read Node[FifoName="Needed Resources.grsc\\TX.Debug.frame out"](error in=w96, number of elements=w88, reference in=w97) -> (data=w93)
            w94 = TRUE
          }
        }
        Is Equal(x=$Operation, y=1) -> w98
        Logical And(w98, w94) -> w99
        case (w99) {
          frame False, Default { }
          frame True {
            call "u32 array to 2.14 CFX.gvi"(data=w93) -> (Array=w100)
            call "calculate psd.gvi"(time signal x=w100, shift?=TRUE) -> (element=w101)
            Array Size(array=w100) -> (size(s)=w102)
            Multiply(w102, 0.1) -> w103
            Initialize Array(element=0, size=w103) -> w104
            Build Array[ConcatenateInputs=True](w104, w101, w104) -> w105
            $PSD <- w105
            Complex To Real Imaginary(x + iy=w100) -> (x=w106, y=w107)
            Absolute Value(x=w100) -> w108
            Build Array(w106, w107, w108) -> w109
            $"TX signal" <- w109
          }
        }
        Wait[Units=Microseconds](time to wait=100)
        stop if $stop
      }
      Property Node(instance in=w58) -> ("Preamble"=w110)
      Array Size(array=w110) -> (size(s)=w111)
      Initialize Array(element=0, size=10) -> w112
      s3 = 0  # shift register
      s4 = w112  # shift register
      while {
        Host Fifo Write Node[FifoName="Needed Resources.grsc\\RX.channel Coefficients in"](data=u64[] [], error in=w61, reference in=w59) -> (empty elements remaining=w113)
        $"empty elements remaining" <- w113
        Wait[Units=Microseconds](time to wait=100)
        Dynamic Fpga Interface Cast(reference in=w59, type="FPGA interface.gtype" constant) -> (reference out=w114)
        call "Preamble data available.gvi"(FPGA.Interface_in=w114, Error_in=w61, length=w111) -> (FPGA.Interface_out=w115, Error_out=w116, Data available=w117)
        Dynamic Fpga Interface Cast(reference in=w115, type="OpaqueRefnumLiteral_2.gtype" constant) -> (reference out=w118)
        case (w117) {
          frame False, Default {
            w119 = s3
            w120 = default
            w121 = s4
          }
          frame True {
            Host Fifo Read Node[FifoName="Needed Resources.grsc\\RX.Preamble out"](error in=w116, number of elements=w111, reference in=w118) -> (data=w122, error out=w123, reference out=w124)
            call "u32 4.12 CFX to CDB array.gvi"(appended array=w122) -> (x=w125)
            call "RMS (CDB).gvi"(x=w125) -> (rms value=w126)
            Replace Array Subset(inArray=s4, index=_, new=w126) -> w127
            Rotate 1D Array(array=w127, n=1) -> (array (last n elements first)=w121)
            Add Array Elements(numeric array=w121) -> (sum=w128)
            Array Size(array=w121) -> (size(s)=w129)
            Divide(x=w128, y=w129) -> w130
            Logarithm Base 10(x=w130) -> w131
            Multiply(w131, 10) -> w132
            $"Preamble Power_Host Chart" <- w132
            $"Preamble Power_Host" <- w132
            Property Node(instance in=w58) -> ("Preamble"=w133, "Modem Configuration:N"=w134, "Sync config:Preamble K"=w135)
            call "norm CFX.gvi"(Input=w125) -> (Output=w136)
            call "norm CFX.gvi"(Input=w133) -> (Output=w137)
            call "Channel Estimation.gvi"(Rx signal=w136, Preamble=w137, Channel Length=$"Channel Length", preamble FFT size=w135, index=0, data FFT size=w134, Fully allocated?=$"Fully allocated?") -> (Channel Freq. Resp.=w138)
            Array Size(array=w138) -> (size(s)=w139)
            Is Equal(x=w139, y=w134) -> w120
            case (w120) {
              frame False, Default {
                w119 = s3
              }
              frame True {
                Reciprocal(x=w138) -> w140
                call "CDB array to 2.14 FXP u32.gvi"(input=w140) -> (output=w141)
                for (iteration -> i2) {
                  w142 = each element of w141
                  Join Numbers(high(x)=i2, low(x)=w142) -> w144
                  append w144 to w143
                }
                Host Fifo Write Node[FifoName="Needed Resources.grsc\\RX.channel Coefficients in"](data=w143, error in=w123, reference in=w124)
                Increment(x=s3) -> w119
              }
            }
            $"rms value" <- w126
            Select(s=$"normalize preamble?", t=w136, f=w125) -> w145
            Is Equal(x=$Operation, y=3) -> w146
            case (w146) {
              frame False, Default { }
              frame True {
                Build Array(w145, w137) -> w147
                Absolute Value(x=w147) -> w148
                $preamble <- w148
                $"Channel Freq. Resp." <- w138
                Absolute Value(x=w138) -> w149
                Complex To Polar(r * e^(i*theta)=w138) -> (theta=w150)
                Build Array(w149, w150) -> w151
                $"channel freq domain" <- w151
                call "Inverse Complex FFT.gvi"(FFT{x}=w138) -> (x=w152)
                Complex To Polar(r * e^(i*theta)=w152) -> (theta=w153)
                Absolute Value(x=w152) -> w154
                Build Array(w154, w153) -> w155
                $"channel time domain" <- w155
                $"Number of channel coefficients update" <- s3
              }
            }
          }
        }
        $"Update of channel coefficients" <- w120
        next s3 = w119
        next s4 = w121
        stop if $stop
      }
      call "niUsrpRio Config v1 Host.lvlib__Decode Daughterboard Names.gvi"(niusrprio session in=w46, error in=w53) -> (daughterboard names=w156)
      Array Index(array=w156) -> (out0[_]=w157)
      while {
        Property Node(instance in=w59, error in=w61) -> ("rx.number of overflows"=w158, "rx.output sample rate"=w159, "rx 1.number of IQ data overflows"=w160, "rx 0.number of IQ data overflows"=w161, "rx.samples processed"=w162, "rx.samples to acquire"=w163, "rx.state"=w164, "tx 0.number of IQ data overflows"=w165, "tx 1.number of IQ data overflows"=w166, "tx.input sample rate"=w167, "TX.modem.DEBUG.cluster_out"=w168, "tx.state"=w169, "tx.underflows"=w170, "RX.sync.sync found_out"=w171, "TX.modem.configuration_in"=w172, "RX.sync.GFDM configuration cluster"=w173, "RX.modem.DEBUG.cluster_out"=w174, "UART.status"=w175, "RM properties"=w176, "RX.RM.debug counter_out"=w177, "RX.sync.lastWrittenRxGain"=w178, "rx 0.output sample rate"=w179, "CCA.status"=w180, "CCA.Noframes"=w181, "DC correction. applied"=w182, "DC correction. average"=w183, error out=w184, instance out=w185)
        $"rx.number of overflows" <- w158
        $"rx 1.output sample rate" <- w159
        Property Node(instance in=w58) -> ("Modem Configuration:N"=w186)
        w187 = T28 {"set"=FALSE, "lo lpf"=FALSE, "cpld "=FALSE, "switchChannel"=FALSE, "Destination"="configRx", "antenna configuration"="TX1 RX1 transmits and RX2 receives", "daughterboard"="cbx", "GainIn"=31.5, "spi address"=7}
        Property Node(instance in=w187, "switchChannel"=$"RX.switch channels", "daughterboard"=w157) -> (instance out=w188)
        Divide(x=$"RX0.Sample Rate [S/s]", y=$"Data Clock Rate") -> w189
        call "completeSynchConfig.gvi"(GfdmConfigurationCluster=w173, syncConfigIn=$"RX.sync.config") -> (syncConfigOut=w190)
        Property Node(instance in=w185, "RX.sync.config"=w190, "TX.modem.bitshift_in"=$"TX.modem.bitshift_in", "TX.automatic trigger_in"=$"TX.automatic trigger_in", "RX.switch channels"=$"RX.switch channels", "RX.equ.shift"=1, "RX.modem.bitshift_in"=$"RX.modem.bitshift_in", "RX.modem.fft.bitshift_in"=$"RX.modem.fft.bitshift_in", "RX.Encoder.shift"=0, "RX.Encoder.Switch I and Q"=FALSE, "RX.input delay"=1, "TX.Encoder.shift"=0, "TX.Encoder.Switch I and Q"=FALSE, "RX.sync.input enable_in"=$"RX.enable", "TX.modem.trigger limit"=$"TX.modem.transmission time interval", "TX.modem.enabled"=TRUE, "TX.modem.force transmission"=FALSE, "TX.encoder.enabled"=$"TX.enabled", "TX.encoder.force"=FALSE, "TX.encoder.threshold"=w186, "UART.control"=$"UART.control", "D2through9"=255, "Data Routing"=$"Data Routing", "AGC.config"=w188, "CCA.ch0/ch1"=$"CCA.switch channel", "CCA.Control"=$"CCA.Control", "DC correction.n"=$"DC correction.n", "DC correction.enable"=$"DC correction.enable", "rx 0.output sample rate"=w189, error in=w184) -> (error out=w55, instance out=w54)
        call "Display Error.gvi"(type of dialog="no dialog", error in=w55) -> (description=w191)
        $"general error description" <- w191
        $"rx 1.number of IQ data overflows" <- w160
        $"rx 0.number of IQ data overflows" <- w161
        $"rx.samples processed" <- w162
        $"rx.samples to acquire" <- w163
        $"rx.state" <- w164
        $"tx 0.number of IQ data overflows" <- w165
        $"tx 1.number of IQ data overflows" <- w166
        $"tx 0.input sample rate" <- w167
        $"TX.modem.DEBUG.cluster_out" <- w168
        $"tx.RF.state" <- w169
        $"tx.underflows" <- w170
        $"RX.sync.sync found_out" <- w171
        $"FPGA configuration" <- w172
        $"RX.sync.GFDM configuration cluster" <- w173
        $"RX.modem.DEBUG.cluster_out" <- w174
        $"UART.status" <- w175
        $"RM properties" <- w176
        $"RX.RM.debug counter_out" <- w177
        Wait(time to wait=10)
        $"RX.sync.lastWrittenRxGain" <- w178
        $"RX Gain" <- w178
        $"rx 0.output sample rate" <- w179
        $"CCA.status" <- w180
        $"CCA.No frames" <- w181
        $"DC correction. applied" <- w182
        $"DC correction. average" <- w183
        Divide(x=$"TX.modem.transmission time interval", y=180000000) -> w192
        $"transmission interval [s]" <- w192
        stop if $stop
      }
      call "Display Error.gvi"(type of dialog="no dialog", error in=w61) -> (description=w193)
      $"general error description" <- w193
      Is Equal(x=$"Preamble mode", y="Load from file") -> w194
      $"Fully allocated?" <- w194
      Property Node(instance in=w46) -> ("Data Clock Rate"=w195)
      $"Data Clock Rate" <- w195
      # w196: QAM symbols per Frame
      Multiply($"PayloadSize [Byte]", 8) -> w196
      while {
        Host Fifo Read Node[FifoName="Needed Resources.grsc\\RX.Debug.Modem_64 bit samples out"](error in=w61, number of elements=0, reference in=w59) -> (elements remaining=w197, error out=w198, reference out=w199)
        Host Fifo Read Node[FifoName="Needed Resources.grsc\\RX.Debug.Modem_32 bit samples out"](error in=w61, number of elements=0, reference in=w59) -> (elements remaining=w200, error out=w201, reference out=w202)
        call "IntegerMultipleOf.gvi"(availableSize=w197, blockSize=w196) -> (multipleOfBlockSize=w203)
        call "IntegerMultipleOf.gvi"(availableSize=w200, blockSize=w196) -> (multipleOfBlockSize=w204)
        Is Not Equal To 0(x=w203) -> w205
        Is Not Equal To 0(x=w204) -> w206
        Logical And(w205, w206) -> w207
        case (w207) {
          frame False, Default { }
          frame True {
            Host Fifo Read Node[FifoName="Needed Resources.grsc\\RX.Debug.Modem_64 bit samples out"](error in=w198, number of elements=w203, reference in=w199) -> (data=w208)
            Split Number(x=w208) -> (high(x)=w209, low(x)=w210)
            Is Equal(x=$Operation, y=0) -> w211
            case (w211) {
              frame False, Default { }
              frame True {
                call "Calculate Pilot Results.gvi"(received pilot array=w209) -> (Pilot-Betrag=w212, Pilot-Phase=w213)
                $"Pilot-Betrag" <- w212
                $"Pilot-Phase" <- w213
              }
            }
            call "u32 array to 2.14 CFX.gvi"(data=w210) -> (Array=w214)
            To Double Precision Complex(number=w214) -> w215
            Is Equal(x=$Operation, y=4) -> w216
            case (w216) {
              frame False, Default { }
              frame True {
                Complex To Real Imaginary(x + iy=w215) -> (x=w217, y=w218)
                $RE_data <- w217
                $IM_data <- w218
              }
            }
            Host Fifo Read Node[FifoName="Needed Resources.grsc\\RX.Debug.Modem_32 bit samples out"](error in=w201, number of elements=w204, reference in=w202) -> (data=w219)
            call "u32 array to 2.14 CFX.gvi"(data=w219) -> (Array=w220)
            To Double Precision Complex(number=w220) -> w221
            Is Equal(x=$Operation, y=0) -> w222
            case (w222) {
              frame False, Default { }
              frame True {
                Build Array(w215, w221) -> w223
                $IQ <- w223
              }
            }
          }
        }
        Wait[Units=Microseconds](time to wait=1000)
        $"QAM symbols per Frame" <- w196
        stop if $stop
      }
      $"Minimum Receive Power" <- -35
      w56 = w24
    }
    frame Error {
      call "Display Error.gvi"(type of dialog="no dialog", error in=w53) -> (description=w224)
      $"general error description" <- w224
      w54 = w52
      w55 = w53
      w56 = w24
    }
  }
  disable {
    frame Enabled {
      call "stop FIFOs_CCA.gvi"(OpaqueRefnumLiteral=w54, Error=w55) -> (error in=w225)
    }
    frame Disabled {
      call "stop FIFOs.gvi"(Error=w55)
    }
  }
  call "Close Device.gvi"(niusrprio session=w56, error in=w225) -> (error out=w226)
  call "Display Error.gvi"(type of dialog="no dialog", error in=w226) -> (description=w227)
  $"general error description" <- w227
  $"RX Coerced Configurations" <- w25
  $"TX Coerced Configurations" <- w26
  case (w55) {
    frame No Error, Default { }
    frame Error {
      $stop <- FALSE
    }
  }
  $M_set <- w38
  $K_set <- w37
  $"N_Blocks [Blocks]" <- w35
