vi "GFDM Host_compact.gvi"   [LabVIEW Communications System Design Suite 2.0.1]
panel controls:
  "stop": bool = TRUE
  "GFDM parameter": "GFDM parameter.gtype" = {"Variable: K"=64, "Variable: M"=9, "Variable: a"=0, "filter type"="rc", "receive filter"="ZF", "inverse FFT"=FALSE, "Variable: b"=0, "Ncs"=16, "Ncp"=32}
  "Operation": i32
  "TX.modem.bitshift_in": i16 = 16
  "USRP RIO device": string = "RIO0"
  "Reference Frequency Source": string = "Internal"
  "TX.automatic trigger_in": bool = TRUE
  "RX.switch channels": bool
  "Channel Length": u16 = 12
  "RX.modem.bitshift_in": i16 = 17
  "RX.modem.fft.bitshift_in": i16 = 16
  "UDP receive port": u16 = 50000
  "RX.enable": bool = TRUE
  "TX.modem.transmission time interval": u64
  "TX.enabled": bool = TRUE
  "Control Tab": i32 = 1
  "UART.control": T9 = {"txEnable"=TRUE, "rxEnable"=TRUE, "Reset"=FALSE, "baud_count"=200, "reset frame counter"=FALSE, "reset tx counter"=FALSE, "reset rx counter"=FALSE}
  "UDP send port": u16 = 60000
  "PayloadSize [Byte]": u16 = 9
  "Use Phase Tracking": bool = TRUE
  "Data Routing": T12 = "Data from Host"
  "Add frame counter": bool
  "Data panel": i32
  "Read UDP?": bool
  "RM:No DC": bool = TRUE
  "TX.Sample Rate [S/s]": f64 = 10000000
  "RX.Frequency [Hz]": f64 = 1990000000
  "TX.Frequency [Hz]": f64 = 1990000000
  "RX.Sample Rate [S/s]": f64 = 10000000
  "UseCAPIData": bool
  "Preamble path": path
  "Preamble mode": T14 = "Load from file"
  "preamble scale": f64 = 7
  "Fully allocated?": bool = TRUE
  "RX.sync.config": T15 = {"CFO removal"=FALSE, "ffoPiControlCte"=9.91821289062e-05, "Pi Control"=0.100006103516, "Analog Gain Controller"=TRUE, "setpoint (max. amplitude)"=0.700042724609, "numbOfBlocksBeforGainChange"=5, "Digital Gain Controller"=FALSE, " Gain [dB]"=26, "permissible error [dB]"=1}
  "normalize preamble?": bool = TRUE
  "ATR.config": T17 = {"Destination"="configTx", "antenna configuration"="TX1 RX1 transmits and RX2 receives", "daughterboard"="sbx"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}
  "RX.sync.debugOut": bool
  "RX.sync.preambleOutFifoActive": bool = TRUE
  "syncDataOutGraphLength": u32
  "shiftFactorReciprocal": i16 = -1
  "AGC.disableAGC": bool
  "TX.switch channel": bool
  "Data Type": bool
  "QAM order": enum{"4-QAM", "16-QAM", "64-QAM", "256-QAM"} = "4-QAM"
  "monitorQueues": bool
  "IQ_out_selector": bool = TRUE
  "numberOfFramesToDisplayIQdata": f64 = 1
  "numbOfFramesForErrorRate": i32 = 128
panel indicators:
  "general error description": string  # source out indicates the source of the error.
  "rx.number of overflows": u32
  "rx.output sample rate": UFXP(1.47)
  "rx 0.number of IQ data overflows": u64
  "rx.samples processed": u32
  "rx.samples to acquire": u32
  "rx.state": enum{"Idle", "Active"}
  "tx 0.number of IQ data overflows": u64
  "rx 1.number of IQ data overflows": u64
  "tx 1.number of IQ data overflows": u64
  "tx.input sample rate": UFXP(1.47)
  "TX.modem.DEBUG.cluster_out": T4
  "tx.RF.state": enum{"Idle", "Active"}
  "tx.underflows": u32
  "TX Coerced Configurations": T5
  "RX Coerced Configurations": T6
  "RX.sync.sync found_out": u32
  "debugGraphSync": f64[][]
  "FPGA configuration": T7
  "RX.sync.GFDM configuration cluster": T8
  "channel freq domain": f64[][]
  "channel time domain": f64[][]
  "IQ": c128[]
  "RE_data": f64[]
  "IM_data": f64[]
  "Channel Freq. Resp.": c128[]
  "received preamble": u32[]
  "transmission interval [s]": f64
  "UART.status": T10
  "Received Bytes": u8[]
  "Decoder byte out": string
  "UDP send error": string  # source out indicates the source of the error.
  "current angle": string
  "angle over time": i32
  "K_set": i16[]
  "M_set": i16[]
  "RM properties": T11
  "UDP receive FIFO full": bool
  "UDP receive error": string  # source out indicates the source of the error.
  "UDP packet size [byte]": i32
  "transmission frame size [byte]": i32
  "half of the payload [byte]": f64
  "GFDM block payload size [byte]": u32
  "Number of GFDM blocks": u32
  "TX signal": FXP(3.14)[][]
  "RX.RM.debug counter_out": T13
  "Pilot-Betrag": UFXP(2.14)[]
  "Pilot-Phase": f64[]
  "TX byte": u8[]
  "received packets": u32
  "Minimum Receive Power": f64
  "rms value": f64
  "PSD": f64[]
  "RX Gain": UFXP(5.1)
  "RX.sync.lastWrittenRxGain": UFXP(5.1)
  "RX.modem.DEBUG.cluster_out": T4
  "ChEst.SamplesOut": u32
  "RX.sync.syncPaketsDicarded": u32
  "GFDM B out": u16
  "number elements in queue": i32
  "number elements in queue_2": i32
  "number elements in queue_3": i32
  "number elements in queue_4": i32
  "paket counter": u32
  "frameErrorRateChart": f64
  "frameErrorRate": f64
types:
  "GFDM parameter.gtype" = cluster{"Variable: K": i32, "Variable: M": i32, "Variable: a": f64, "filter type": enum{"rc", "rect"}, "receive filter": enum{"MF", "ZF"}, "inverse FFT": bool, "Variable: b": f64, "Ncs": u16, "Ncp": u16}
  T1 = cluster{"packets in_out": u16, "samples in_out": u16, "packets out_out": u16, "samples out_out": u16, "number of invalid samples": u64, "mod first samples out": u64, "mod last samples out": u64}
  T2 = cluster{"FFT misalignment": u64, "FFT halt": u64, "FFT last sample": u64}
  T3 = cluster{"number of invalid samples": u64, "first samples out": u64, "last samples out": u64, "number of cycles": u64}
  T4 = cluster{"Element 1": T1, "Element 2": T2, "Element 3": T3}
  T5 = cluster{"Coerced Frequencies [Hz]": f64[], "Coerced LO Frequencies [Hz]": f64[], "Coerced Output Powers [dBm]": f64[], "Coerced Sample Rates [S/s]": f64[]}
  T6 = cluster{"Coerced Frequencies [Hz]": f64[], "Coerced LO Frequencies [Hz]": f64[], "Coerced Levels [dBm]": f64[], "Coerced Sample Rates [S/s]": f64[]}
  T7 = cluster{"K-1": u16, "M-1": u8, "N-1": u16, "N": u16, "Npreamble+CP+CS": u16, "Npreamble": u16, "Nw": u16, "Modulator MUX config": u64[16], "K": u16, "fft_size_log2(K)": u8, "inverse_fft": bool, "Start with preamble": bool, "Burstmode": bool, "Ncs": u16, "Ncp": u16, "N-Ncp": u16, "N+Ncp": u16, "N+Ncp+Ncs": u16, "Demodulator MUX config": u64[16], "M": u8, "DFT SIZE": FXP(6.0), "Frame length": u32, "Super frame length": u32, "Ns_all_GFDM_blocks": u32, "Ns_all_preambles": u32}
  T8 = cluster{"Preamble mu": u16, "GFDM B": u16, "Preamble K": u16, "Preamble Ncp": u16, "GFDM Ncp": u16, "GFDM M": u16, "Preamble Ncs": u16, "GFDM K": u16, "GFDM Ncs": u16, "Preamble M": u16}
  T9 = cluster{"txEnable": bool, "rxEnable": bool, "Reset": bool, "baud_count": u16, "reset frame counter": bool, "reset tx counter": bool, "reset rx counter": bool}
  T10 = cluster{"debug rxData": u8, "debug txData": u8, "debug rxData valid": bool, "tx FIFO output valid": bool, "debug txRdy": bool, "count Error": u32, "count tx [Bytes]": u32, "count rx [Byte]": u32}
  T11 = cluster{"Element 1": u16, "Element 2": u16, "Element 3": u16, "Element 4": u16}
  T12 = enum{"Data from Host", "Data from UART", "UART Loopback", "RX TX Loopback"}
  T13 = cluster{"first samples in": u16, "samples input": u16, "samples multiplexed": u16, "samples divided in blocks before multiplexer": u16, "corrected samples": u16, "samples divided in blocks after multiplexer": u16, "overflow counter_out": u16, "lost samples_out": u16, "state": u8}
  T14 = enum{"Load from file", "Generate GFDM based Preamble"}
  T15 = cluster{"CFO removal": bool, "ffoPiControlCte": FXP(2.17), "Pi Control": UFXP(1.15), "Analog Gain Controller": bool, "setpoint (max. amplitude)": UFXP(0.15), "numbOfBlocksBeforGainChange": u16, "Digital Gain Controller": bool, " Gain [dB]": UFXP(5.1), "permissible error [dB]": UFXP(5.1)}
  T16 = enum{"TX1 RX1 transmits and RX2 receives", "TX1 RX1 receives and RX2 is unused"}
  T17 = cluster{"set": bool, "lo lpf": bool, "cpld ": bool, "switchChannel": bool, "Destination": enum{"configRx", "configTx"}, "antenna configuration": T16, "daughterboard": enum{"sbx", "cbx", "wbx", "unknown", "ubx"}, "GainIn": UFXP(5.1), "spi address": u8}
  "debugQueueElementType_u32.gtype" = cluster{"sourceID": string, "data": cluster{"u32": u32[]}[]}
  "debugElementQueueType.gtype" = cluster{"sourceID": string, "JSONstring": string}
  "txDataQueueElementType.gtype" = cluster{"sourceID": string, "Bytes": u8[]}
diagram:
  $"received preamble" <- u32[] []
  case ($UseCAPIData) {
    frame True {
      w1 = no error
      w2 = UdpNetworkConnectionRefnum constant
      w3 = UdpNetworkConnectionRefnum constant
    }
    frame False {
      call "config UDP.gvi"(receive port (from vlc player)=$"UDP receive port") -> (UDP receive=w2, UDP send=w3, error out=w1)
    }
  }
  call "Reset FPGA.gvi"(USRP RIO device=$"USRP RIO device", error in=w1) -> (error out=w4, USRP RIO device out=w5)
  FPGA Open Node[ProjectItem=":NullTarget:USRP\\-BitfileChEstK64\\-0023\\.lvbitx"](RIO address=w5, error in=w4, run?=TRUE) -> (error out=w6, reference out=w7)
  call "ConfigureDevice.gvi"(Reference Frequency Source=$"Reference Frequency Source", FPGA in=w7, error out=w6, USRP RIO device=$"USRP RIO device", GFDM parameter=$"GFDM parameter", TX.Frequency [Hz]=$"TX.Frequency [Hz]", TX.Sample Rate [S/s]=$"TX.Sample Rate [S/s]", RX.Frequency [Hz]=$"RX.Frequency [Hz]", RX.Sample Rate [S/s]=$"RX.Sample Rate [S/s]") -> (FPGA.Interface=w8, error in=w9, RX Coerced Configurations=w10, TX Coerced Configurations=w11, ni usrp session 2=w12, ni usrp session=w13)
  Dynamic Fpga Interface Cast(reference in=w8, type="FPGA interface.gtype" constant) -> (reference out=w14)
  call "Configure FIFOs.gvi"(FPGA interface in=w14, error in=w9, UseCAPIData=$UseCAPIData) -> (FPGA interface out=w15, error out=w16)
  # w2: UDP receive
  # w3: UDP send
  case (w16) {
    frame No Error, Default {
      call "configFPGA.gvi"(FPGA.InterfaceIn=w15, ErrorIn=w16, Preamble path=$"Preamble path", Preamble mode=$"Preamble mode", preamble scale=$"preamble scale", GFDM Parameter=$"GFDM parameter", RM:No DC=$"RM:No DC", Use Phase Tracking=$"Use Phase Tracking", PayloadSize [Byte]=$"PayloadSize [Byte]", QAM order=$"QAM order") -> (ErrorOut=w20, FPGA.InterfaceOut=w21, GfdmAllParametersOut=w22, M_set=w23, K_set=w24, Fully allocated?=w25, ChennalEstimationParameterOut=w26, GFDM B out=w27, bitsPerSymbol=w28)
      Obtain Queue(element data type="debugQueueElementType_u32.gtype" {all zero or empty}, name="debugQueue") -> (queue out=w29)
      Obtain Queue(element data type="debugElementQueueType.gtype" {all zero or empty}, name="debugQueue2") -> (queue out=w30)
      while {
        Flush Queue(queue=w29) -> (remaining elements=w31)
        Array Size(array=w31) -> (size(s)=w32)
        Is Greater Than 0(x=w32) -> w33
        # read only the last data
        Decrement(x=w32) -> w34
        Array Index(array=w31) -> (out0[w34]=w35)
        # READ DEBUG DATA FROM QUEUE AND TRANSFER TO PANEL
        case (w33) {
          frame False, Default { }
          frame True {
            case ($Operation) {
              frame 0, Default {
                call "decodeDebugDataIQ.gvi"(debugDataIn=w35, beforRDM/afterRDM=$IQ_out_selector) -> (IQ=w36, Pilot-Betrag=w37, Pilot-Phase=w38)
                $IQ <- w36
                $"Pilot-Betrag" <- w37
                $"Pilot-Phase" <- w38
              }
              frame 1 {
                call "decodeDebugDataTxFrame.gvi"(debugDataIn=w35) -> (PSD=w39, TX signal=w40)
                $PSD <- w39
                $"TX signal" <- w40
              }
              frame 2 { }
              frame 3 {
                call "decodeDebugDataSync.gvi"(DebugDataIn=w35, Channel Length=$"Channel Length", Fully allocated?=$"Fully allocated?", normalize preamble?=$"normalize preamble?", GFDM all parameters=w22) -> (rms value=w41, debugGraphSync=w42, channel freq domain=w43, channel time domain=w44, Channel Freq. Resp.=w45)
                $"rms value" <- w41
                $debugGraphSync <- w42
                $"channel freq domain" <- w43
                $"channel time domain" <- w44
                $"Channel Freq. Resp." <- w45
              }
              frame 4 {
                call "decodeDebugDataIQ.gvi"(debugDataIn=w35, beforRDM/afterRDM=$IQ_out_selector) -> (RE_data=w46, IM_data=w47)
                $RE_data <- w46
                $IM_data <- w47
              }
            }
          }
        }
        Wait[Units=Microseconds](time to wait=1000)
        Flush Queue(queue=w30) -> (remaining elements=w48)
        for {
          w49 = each element of w48
          call "decodeDebugDataRx.gvi"(debugDataIn=w49) -> (txDebugDataOut=w50, rxDebugDataOut=w51)
          Property Node(instance in=w50) -> ("Element 1"=w52, "Element 2"=w53)
          case (w53) {
            frame False, Default {
              Property Node(instance in=w51) -> ("Element 1"=w54, "Element 2"=w55)
              Property Node(instance in=w54) -> ("current angle"=w56, "UDP send error"=w57, "received packets"=w58, "angle over time"=w59, "paket counter"=w60, "rxBytes"=w61, "frameErrorRate"=w62)
              case (w55) {
                frame False, Default { }
                frame True {
                  $"current angle" <- w56
                  $"UDP send error" <- w57
                  $"received packets" <- w58
                  $"angle over time" <- w59
                  $"paket counter" <- w60
                  $"Received Bytes" <- w61
                  Type Cast(type=string EmptyString, x=w61) -> w63
                  $"Decoder byte out" <- w63
                  $frameErrorRateChart <- w62
                  $frameErrorRate <- w62
                }
              }
            }
            frame True {
              Property Node(instance in=w52) -> ("UDP receive error"=w64, "UDP packet size [byte]"=w65, "transmission frame size [byte]"=w66, "half of the payload [byte]"=w67, "GFDM block payload size [byte]"=w68, "TX byte"=w69, "Number of GFDM blocks"=w70, "UDP receive FIFO full"=w71)
              $"UDP receive error" <- w64
              $"UDP packet size [byte]" <- w65
              case ($"Add frame counter") {
                frame False, Default { }
                frame True {
                  $"transmission frame size [byte]" <- w66
                  $"half of the payload [byte]" <- w67
                  $"GFDM block payload size [byte]" <- w68
                  $"Number of GFDM blocks" <- w70
                }
              }
              $"TX byte" <- w69
              $"UDP receive FIFO full" <- w71
            }
          }
        }
        stop if $stop
      }
      call "Decode Daughterboard Names.gvi"(niUsrpRio Session=w12, error in=w16) -> (daughterboard names=w72)
      Array Index(array=w72) -> (out0[_]=w73)
      while {
        Property Node(instance in=w21, error in=w20) -> ("rx.number of overflows"=w74, "rx.output sample rate"=w75, "rx 1.number of IQ data overflows"=w76, "rx 0.number of IQ data overflows"=w77, "rx.samples processed"=w78, "rx.samples to acquire"=w79, "rx.state"=w80, "tx 0.number of IQ data overflows"=w81, "tx 1.number of IQ data overflows"=w82, "tx.input sample rate"=w83, "TX.modem.DEBUG.cluster_out"=w84, "tx.state"=w85, "tx.underflows"=w86, "RX.sync.sync found_out"=w87, "TX.modem.configuration_in"=w88, "RX.sync.GFDM configuration cluster"=w89, "RX.modem.DEBUG.cluster_out"=w90, "UART.status"=w91, "RM properties"=w92, "RX.RM.debug counter_out"=w93, "RX.sync.lastWrittenRxGain"=w94, "ChEst.SamplesOut"=w95, "RX.sync.syncPaketDicarded"=w96, error out=w97, instance out=w98)
        $"rx.number of overflows" <- w74
        $"rx.output sample rate" <- w75
        Property Node(instance in=w22) -> ("Modem Configuration:N"=w99)
        Property Node(instance in=w26, "config:L.ch.1"=$"Channel Length", "config:L.ch.2"=$"Channel Length", "config:shiftFactorDft"=$shiftFactorReciprocal) -> (instance out=w100)
        Property Node(instance in=$"ATR.config", "switchChannel"=$"RX.switch channels", "daughterboard"=w73) -> (instance out=w101)
        # READ/WRITE CONTROL PINS
        call "completeSynchConfig.gvi"(GfdmConfigurationCluster=w89, syncConfigIn=$"RX.sync.config") -> (syncConfigOut=w102)
        Property Node(instance in=w98, "RX.sync.config"=w102, "TX.modem.bitshift_in"=$"TX.modem.bitshift_in", "TX.automatic trigger_in"=$"TX.automatic trigger_in", "RX.switch channels"=$"RX.switch channels", "RX.equ.shift"=1, "RX.modem.bitshift_in"=$"RX.modem.bitshift_in", "RX.modem.fft.bitshift_in"=$"RX.modem.fft.bitshift_in", "RX.Encoder.shift"=0, "RX.Encoder.Switch I and Q"=FALSE, "RX.input delay"=1, "TX.Encoder.shift"=0, "TX.Encoder.Switch I and Q"=FALSE, "RX.sync.input enable_in"=$"RX.enable", "TX.modem.trigger limit"=$"TX.modem.transmission time interval", "TX.modem.enabled"=TRUE, "TX.modem.force transmission"=FALSE, "TX.encoder.enabled"=$"TX.enabled", "TX.encoder.force"=FALSE, "TX.encoder.threshold"=w99, "UART.control"=$"UART.control", "D2through9"=255, "Data Routing"=$"Data Routing", "AGC.config"=w101, "TX.sync.preambleOrAllData"=$"RX.sync.debugOut", "RX.sync.preambleOutFifoActive"=$"RX.sync.preambleOutFifoActive", "ChEst.Parameters"=w100, "AGC.disableAGC"=$"AGC.disableAGC", "TX.switchTxChannel"=$"TX.switch channel", error in=w97) -> (error out=w103, instance out=w17)
        call "Display Error.gvi"(type of dialog="no dialog", error in=w103) -> (description=w104)
        $"general error description" <- w104
        $"rx 1.number of IQ data overflows" <- w76
        $"rx 0.number of IQ data overflows" <- w77
        $"rx.samples processed" <- w78
        $"rx.samples to acquire" <- w79
        $"rx.state" <- w80
        $"tx 0.number of IQ data overflows" <- w81
        $"tx 1.number of IQ data overflows" <- w82
        $"tx.input sample rate" <- w83
        $"TX.modem.DEBUG.cluster_out" <- w84
        $"tx.RF.state" <- w85
        $"tx.underflows" <- w86
        $"RX.sync.sync found_out" <- w87
        $"FPGA configuration" <- w88
        $"RX.sync.GFDM configuration cluster" <- w89
        $"RX.modem.DEBUG.cluster_out" <- w90
        $"UART.status" <- w91
        $"RM properties" <- w92
        $"RX.RM.debug counter_out" <- w93
        Wait(time to wait=100)
        $"RX Gain" <- w94
        $"RX.sync.lastWrittenRxGain" <- w94
        $"ChEst.SamplesOut" <- w95
        $"RX.sync.syncPaketsDicarded" <- w96
        To Double Precision Float(number=$"TX.modem.transmission time interval") -> w105
        Divide(x=w105, y=180000000) -> w106
        $"transmission interval [s]" <- w106
        stop if $stop
      }
      # w2: UDP receive
      # w3: UDP send
      # READ DEBUG DATA FROM FPGA TO QUEUE
      case ($UseCAPIData) {
        frame True {
          w107 = default
        }
        frame False {
          call "receivedDataSink.gvi"(UDP send port=$"UDP send port", InputUDP=w3, ErrorIn=w20, fromSourceID="receiveData", toSourceID="UDP") -> (ErrorOut=w108)
          # READ DATA OR GENERATE DATA FOR TRANSMITION(etc. from UDP)
          call "getTXdata.gvi"(Add frame counter=$"Add frame counter", sendDebugData=FALSE, PayloadSize [byte]=$"PayloadSize [Byte]", UdpReference=w2, Read UDP?=$"Read UDP?", debugDataQueueName="debugQueue2", ErrorIn=w20, Random data?=$"Data Type") -> (ErrorOut=w109)
          # NOTE:
          # data exchange between blocks
          # is realized by using queues
          # READ/WRITE  DATA FROM/TO FPGA
          # TRANSFER RECEIVED DATA TO DESTINATION (etc. UDP)
          call "transmittAndReceiveData.gvi"(UDP packet size [byte]=$"UDP packet size [byte]", GFDM block payload size [byte]=$"GFDM block payload size [byte]", Add frame counter=$"Add frame counter", half of the payload [byte]=$"half of the payload [byte]", FPGA.Interface=w21, PayloadSize [Byte]=$"PayloadSize [Byte]", Number of GFDM blocks=$"Number of GFDM blocks", sendDebugData?=FALSE, Error=w20, debugQueueName="debugQueue2", numbOfFramesForErrorRate=$numbOfFramesForErrorRate) -> (ErrorOut=w110)
          Merge Errors(w109, w110, w108) -> (error out=w107)
        }
      }
      call "readFpgaDebugData.gvi"(bits per symbol=w28, syncDataOutGraphLength=$syncDataOutGraphLength, numberOfFramesToDisplay=$numberOfFramesToDisplayIQdata, RX.sync.debugOut=$"RX.sync.debugOut", PayloadSize [Byte]=$"PayloadSize [Byte]", FPGA.Interface In=w21, ErrorIn=w20, GFDM all parameters=w22) -> (ErrorOut=w111)
      Merge Errors(w107, w111) -> (error out=w112)
      Merge Errors(w112, w103) -> (error out=w18)
      $M_set <- w23
      $K_set <- w24
      call "Display Error.gvi"(type of dialog="no dialog", error in=w20) -> (description=w113)
      $"general error description" <- w113
      $"Fully allocated?" <- w25
      $"GFDM B out" <- w27
      $"Minimum Receive Power" <- -35
      w19 = w13
    }
    frame Error {
      call "Display Error.gvi"(type of dialog="no dialog", error in=w16) -> (description=w114)
      $"general error description" <- w114
      w17 = w15
      w18 = w16
      w19 = w13
    }
  }
  call "closeAll.gvi"(FPGA.Interface=w17, Error=w18, usrp rio session=w19) -> (error out=w115)
  call "Display Error.gvi"(type of dialog="no dialog", error in=w115) -> (description=w116)
  $"general error description" <- w116
  case (w18) {
    frame No Error, Default { }
    frame Error {
      $stop <- FALSE
    }
  }
  $stop <- FALSE
  $"RX Coerced Configurations" <- w10
  $"TX Coerced Configurations" <- w11
  Obtain Notifier(element data type=i32 1, name="PanelOperationNotifier") -> (error out=w117, notifier out=w118)
  Obtain Notifier(element data type=bool FALSE, name="globalStopNotifier") -> (error out=w119, notifier out=w120)
  Send Notification(error in (no error)=w119, notification=FALSE, notifier=w120) -> (notifier out=w121)
  while {
    case ($stop) {
      frame False, Default {
        w122 = $stop
      }
      frame True {
        Send Notification(notification=$stop, notifier=w121) -> (notifier out=w123)
        w122 = $stop
      }
    }
    Get Notifier Status(notifier=w121) -> (latest notification=w124)
    Logical Or(w122, w124) -> w125
    case (w125) {
      frame False, Default {
        w126 = w125
      }
      frame True {
        $stop <- w125
        w126 = w125
      }
    }
    Send Notification(error in (no error)=w117, notification=$Operation, notifier=w118)
    Wait(time to wait=1)
    stop if w126
  }
  Obtain Queue(element data type="txDataQueueElementType.gtype" {all zero or empty}, name="txDataQueue") -> (queue out=w127)
  Flush Queue(queue=w127) -> (queue out=w128)
  Obtain Queue(element data type="debugQueueElementType_u32.gtype" {all zero or empty}, max queue size=10, name="debugQueue") -> (error out=w129, queue out=w130)
  Flush Queue(error in=w129, queue=w130) -> (queue out=w131)
  Obtain Queue(element data type="debugElementQueueType.gtype" {all zero or empty}, max queue size=1, name="debugQueue2") -> (error out=w132, queue out=w133)
  Flush Queue(error in=w132, queue=w133) -> (queue out=w134)
  Obtain Queue(element data type="txDataQueueElementType.gtype" {all zero or empty}, name="txDataQueue") -> (queue out=w135)
  Flush Queue(queue=w135) -> (queue out=w136)
  case ($monitorQueues) {
    frame False, Default { }
    frame True {
      while {
        Get Queue Status(queue=w128) -> (# elements in queue=w137)
        $"number elements in queue" <- w137
        Get Queue Status(queue=w136) -> (# elements in queue=w138)
        $"number elements in queue_2" <- w138
        Get Queue Status(queue=w131) -> (# elements in queue=w139)
        $"number elements in queue_3" <- w139
        Get Queue Status(queue=w134) -> (# elements in queue=w140)
        $"number elements in queue_4" <- w140
        stop if $stop
      }
    }
  }
